# Grasshopper definition _panelconnections.gh (Grasshopper 1.0.7)
# plug-ins: Human

panel = Panel("""17
18""")
number_slider = Slider(5, range=0..39)
number_slider_2 = Slider(13, range=0..39)
data = Data(Tree({0}: [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], {1}: [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], {2}: [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], {3}: [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], {4}: [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], {5}: [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]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))
data_2 = Data(Tree({0}: [PlaneXY(-4926.989864, -8130.464446, 0)], {1}: [PlaneXY(-5621.736344, -864.7925111, 0)], {2}: [PlaneXY(-5621.696028, -840.3844832, 0)], {3}: [PlaneXY(-5620.382633, -998.4246273, 0)], {4}: [Plane(origin=(-10301.25116, -4464.973786, 0), x=(0, -1, 0), y=(1, 0, 0))], {5}: [Plane(origin=(-10466.46702, -7686.035113, 0), x=(-4.907242784e-08, 1, 0), y=(-1, -4.907242784e-08, 0))]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))
data_3 = Data(Tree({0}: [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], {1}: [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], {2}: [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], {3}: [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], {4}: [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], {5}: [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]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))
data_4 = Data(Tree({0}: [0.75, 0.75, 0.75, 0.75, 0.75, 0.75, 0.75, 0.75, 0.75, 0.75, 0.75, 0.75, 0.75], {1}: [0.75, 0.75, 0.75, 0.75, 0.75, 0.75, 0.75, 0.75, 0.75, 0.75, 0.75], {2}: [0.75, 0.75, 0.75, 0.75, 0.75, 0.75, 0.75, 0.75, 0.75, 0.75, 0.75, 0.75, 0.75], {3}: [0.75, 0.75, 0.75], {4}: [0.75, 0.75, 0.75, 0.75, 0.75, 0.75, 0.75, 0.75, 0.75, 0.75, 0.75, 0.75, 0.75, 0.75, 0.75, 0.75, 0.75, 0.75, 0.75], {5}: [0.75, 0.75, 0.75, 0.75, 0.75, 0.75, 0.75, 0.75, 0.75, 0.75, 0.75, 0.75, 0.75, 0.75, 0.75, 0.75, 0.75, 0.75, 0.75, 0.75, 0.75]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))
data_5 = Data(1)
panel_2 = Panel("9")

# ---- group: floor 2 / toflip
data_6 = Data(Tree({0}: [PlaneXY(-4116.861611, -7003.190155, 0)], {1}: [Plane(origin=(-8364.085515, -2698.466713, 0), x=(0, 1, 0), y=(-1, 0, 0))], {2}: [PlaneXY(-5704.952002, -2053.683209, 0)], {3}: [PlaneXY(-6964.416289, -2693.218311, 0)], {4}: [PlaneXY(-6396.192331, -3436.166299, 0)], {5}: [PlaneXY(-9250.873212, -5606.85953, 0)]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))

# ----
pflip = FlipPlane(Plane=data_2, ReverseX=False, ReverseY=True, SwapAxes=False)
series = Series(Start=0, Step=1, Count=Slider(1, range=1..10))
pflip_2 = FlipPlane(Plane=data_6, ReverseX=False, ReverseY=True, SwapAxes=False)
panel_3 = Panel("5 latest, thick connections")

# ---- group: floor 2
data_7 = Data(Tree({0}: [{Plane=PlaneXY(-4116.861611, -7003.190155, 0), Size=Domain2(u=-2..2, v=-2..2)}], {1}: [{Plane=Plane(origin=(-8364.085515, -2698.466713, 0), x=(0, 1, 0), y=(-1, 0, 0)), Size=Domain2(u=-2..2, v=-2..2)}], {2}: [{Plane=PlaneXY(-5704.952002, -2053.683209, 0), Size=Domain2(u=-2..2, v=-2..2)}], {3}: [{Plane=PlaneXY(-6964.416289, -2693.218311, 0), Size=Domain2(u=-2..2, v=-2..2)}], {4}: [{Plane=PlaneXY(-6396.192331, -3436.166299, 0), Size=Domain2(u=-2..2, v=-2..2)}], {5}: [{Plane=PlaneXY(-9250.873212, -5606.85953, 0), Size=Domain2(u=-2..2, v=-2..2)}]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))
data_8 = Data(Tree({0}: [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], {1}: [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], {2}: [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], {3}: [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], {4}: [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], {5}: [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]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))
data_9 = Data(Tree({0}: [0.75], {1}: [0.75], {2}: [0.75], {3}: [0.75], {4}: [0.75], {5}: [0.75]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))
data_10 = Data(1)

# ----
ghpython_script = GhPythonScript()  # -> LineUtils
# ---------- ghpython_script: Python ----------
# Name of the environment variable to read
import sys
import os
import imp

VAR_NAME = "DRAWER_PROJECT_ROOT"
root = os.environ.get(VAR_NAME)
line_utils_dir = os.path.join(root, "Gh", "Line_utils")
line_utils_file = os.path.join(line_utils_dir, "LineUtils.py")

if "LineUtils" in sys.modules:
    del sys.modules["LineUtils"]

LineUtils = imp.load_source("LineUtils", line_utils_file)

from LineUtils import LineUtils as LineUtils

# To update LineUtils.py
#if refresh:
#    reload(sys.modules["LineUtils"])
# ---------- end ghpython_script ----------
ghpython_script_2 = GhPythonScript()  # -> out, LineUtils
# ---------- ghpython_script_2: Python ----------
import Rhino.Geometry as rg
import math
import copy
import inspect
import itertools
import time
import System
import re
import zipfile
import xml.etree.ElementTree as ET
import Rhino.Collections as rc
import Grasshopper as gh
from collections import defaultdict
import random

version = 0.80

try:
    ghenv.Component.Message = "{0:.2f}".format(version) + " LineUtils library"
except:
    pass #working on imported lib

GLOBAL_TOL = 0.01 #need to fine tune, maybe 0.001 is better
ANG_EPS = 1e-6   # for dot-products
defaultpath = gh.Kernel.Data.GH_Path(0)
unitX = rg.Vector3d(1, 0, 0)
unitY = rg.Vector3d(0, 1, 0)
unitZ = rg.Vector3d(0, 0, 1) 

class LineUtils(object):
    VERSION = version
    
    class Orientation(object):
        """
        Simple enumeration for line orientation.
        """
        VERTICAL = "vertical"
        HORIZONTAL = "horizontal"
        NONORTH = "nonorth"


    class ConduitLookup(object):
        """
        Conduits trade size, inner/outer diameters, bend offset lookup, all preconverted to float
        Its a dictionary key = size as float
        """
        SIZES = [0.0, 0.5, 0.75, 1.0, 1.25, 1.5, 2.0, 2.5, 3.0, 3.5, 4.0, 6.0, 8.0]

        SPEC = {
            # trade: inner diameter (inches), outer diameter (inches), min_bend (inches), linear_section (inches)
            0.0:   {'trade': '0"', 'id': 0.0, 'od': 0.0, 'min_bend': 0.0, 'linear_section': 0.0}, #for debugging purposes
            0.5:   {'trade': '1/2"',     'id': 0.625,    'od': 0.71875,   'min_bend': 4.0,      'linear_section': 1.75},   # ID=5/8",       OD=23/32",    MinBend=4",       Linear section=1 3/4"
            0.75:  {'trade': '3/4"',     'id': 0.8125,   'od': 0.9375,    'min_bend': 5.4375,   'linear_section': 2.25},   # ID=13/16",     OD=15/16",    MinBend=5 7/16",  Linear section=2 1/4"
            1.0:   {'trade': '1"',       'id': 1.0625,   'od': 1.15625,   'min_bend': 7.0,      'linear_section': 2.25},   # ID=1 1/16",    OD=1 5/32",   MinBend=7",       Linear section=2 1/4"
            1.25:  {'trade': '1 1/4"',   'id': 1.3125,   'od': 1.5,       'min_bend': 8.8125,   'linear_section': 3.0},    # ID=1 5/16",    OD=1 1/2",    MinBend=8 13/16", Linear section=3"
            1.5:   {'trade': '1 1/2"',   'id': 1.625,    'od': 1.75,      'min_bend': 8.375,    'linear_section': 3.5},    # ID=1 5/8",     OD=1 3/4",    MinBend=8 3/8",   Linear section=3 1/2"
            2.0:   {'trade': '2"',       'id': 2.0625,   'od': 2.1875,    'min_bend': 9.25,     'linear_section': 4.0},    # ID=2 1/16",    OD=2 3/16",   MinBend=9 1/4",   Linear section=4"
            2.5:   {'trade': '2 1/2"',   'id': 2.71875,  'od': 2.875,     'min_bend': 13.90625, 'linear_section': 4.75},   # ID=2 23/32",   OD=2 7/8",    MinBend=13 29/32",Linear section=4 3/4"
            3.0:   {'trade': '3"',       'id': 3.34375,  'od': 3.5,       'min_bend': 16.46875, 'linear_section': 6.0},    # ID=3 11/32",   OD=3 1/2",    MinBend=16 15/32",Linear section=6"
            3.5:   {'trade': '3 1/2"',   'id': 3.84375,  'od': 4.0,       'min_bend': 19.8125,  'linear_section': 7.25},   # ID=3 27/32",   OD=4",        MinBend=19 13/16",Linear section=7 1/4"
            4.0:   {'trade': '4"',       'id': 4.34375,  'od': 4.5,       'min_bend': 21.5,     'linear_section': 8.5},    # ID=4 11/32",   OD=4 1/2",    MinBend=21 1/2",  Linear section=8 1/2"
            6.0:   {'trade': '6"',       'id': 6.0,      'od': 6.625,     'min_bend': 31.5,     'linear_section': 13.5},   # ID=6",         OD=6 5/8",    MinBend=31 1/2",  Linear section=13 1/2"
            8.0:   {'trade': '8"',       'id': 8.0,      'od': 8.96875,   'min_bend': 36.0,     'linear_section': 18.5},   # ID=8",         OD=8 31/32",  MinBend=36",      Linear section=18 1/2"
        }

        @staticmethod
        def _interpolate_conduit_specs(size):
            """
            Build and evaluate cubic splines for id, od, and min_bend
            across available sizes, returning inchified floats.
            """
            sizes = sorted(LineUtils.ConduitLookup.SPEC.keys())
            id_vals = [LineUtils.ConduitLookup.SPEC[s]['id'] for s in sizes]
            od_vals = [LineUtils.ConduitLookup.SPEC[s]['od'] for s in sizes]
            mb_vals = [LineUtils.ConduitLookup.SPEC[s]['min_bend'] for s in sizes]
            ls_vals = [LineUtils.ConduitLookup.SPEC[s]['linear_section'] for s in sizes]
            
            coeff_id = LineUtils.calculate_spline_coefficients(sizes, id_vals)
            coeff_od = LineUtils.calculate_spline_coefficients(sizes, od_vals)
            coeff_mb = LineUtils.calculate_spline_coefficients(sizes, mb_vals)
            coeff_ls = LineUtils.calculate_spline_coefficients(sizes, ls_vals)
            
            id_val = LineUtils.cubic_spline(sizes, coeff_id, size)
            od_val = LineUtils.cubic_spline(sizes, coeff_od, size)
            mb_val = LineUtils.cubic_spline(sizes, coeff_mb, size)
            ls_val = LineUtils.cubic_spline(sizes, coeff_ls, size)
            
            return {
                'trade': LineUtils.inchify(size),
                'id': LineUtils.inchify(id_val),
                'od': LineUtils.inchify(od_val),
                'min_bend': LineUtils.inchify(mb_val),
                'linear_section': LineUtils.inchify(ls_val)
            }

        @staticmethod
        def get_specs(size):
            #ensure size is float, default to 0.75
            try:
                sizef = float(size)
            except:
                sizef = 0.75
                
            if sizef not in LineUtils.ConduitLookup.SPEC:
                return LineUtils.ConduitLookup._interpolate_conduit_specs(sizef)
                
            specs = LineUtils.ConduitLookup.SPEC[sizef]
            return {
                'trade': LineUtils.inchify(sizef),
                'id': LineUtils.inchify(specs['id']),
                'od': LineUtils.inchify(specs['od']),
                'min_bend': LineUtils.inchify(specs['min_bend']),
                'linear_section': LineUtils.inchify(specs['linear_section'])
            }
        
        @staticmethod
        def classify_size(size):
            """
            Classify the input size:
            - 'lookedup' if float and exact match in SPEC
            - 'interpolated' if float but not in SPEC
            - 'invalid' if cannot parse as float
            """
            try:
                sizef = float(size)
            except (TypeError, ValueError):
                return 'invalid'
            if sizef in LineUtils.ConduitLookup.SPEC:
                return 'lookedup'
            return 'interpolated'


    class AngleLookup(object):
        """
        Acceptable bend angles lookup
        """
        ANGLES = [5.0, 10.0, 15.0, 22.5, 30.0, 45.0, 90.0]

        SPEC = {
            #angles in radians
            5.0:  math.pi * 5.0  / 180.0,
            10.0: math.pi * 10.0 / 180.0,
            15.0: math.pi * 15.0 / 180.0,
            22.5: math.pi * 22.5 / 180.0,
            30.0: math.pi * 30.0 / 180.0,
            45.0: math.pi * 45.0 / 180.0,
            90.0: math.pi * 90.0 / 180.0,
        }

        @staticmethod
        def get_specs(deg):
            return LineUtils.AngleLookup.SPEC[deg]


    class Spacing(object):
        """
        spacing version 0.87
        
        This module implements a two-pass “spacing” solver for polylines. It takes in a tree of input polylines, 
        converts them into segments, maps each segment onto a global lookup of axis (axis are created from all the baselines merged together whenever they touch), 
        computes turn directions and sort-orders, and finally repositions each segment so that bundles of pipes are evenly spaced (either per-panel or mixed together).
        
        --------------------
        - **Segmentization**  
          - Break each raw polyline into it's segments
          - Wrap each consecutive point pair in a `PolySegment`, tracking path and polyline indices
          - PolySegment class is usefull for storing all data about it and having the ability to move it
          as a part of polyline, similar to Offset Curve Loose
        - **Lookup & Identification**  
          - Build a global “lookup” of unique line geometries, this is used for axis determination 
          - For each segment, find its best matching lookup line (by bucketed angle + midpoint distance (midpoint distance worked the most reliably, so far problemless))  
        - **Turn & Sort Properties**  
          - In each `Polyline`, determine “previous”, “self” and “next” turn direction per segment (used to assign scores)
          - Compute per-segment sort chains (`sortchain`, `sortchainraw`) and group-indices based on turn/quadrant,
          sort chain holds information abotu all next segments in that polyline
        - **Score calculation logic**
          - Every segment is assigned a score based on :
              its panels id weight, panels are sorted based on left straight right turns and this is the heaviest influencer 
              its turns direction weight, left -> straight -> right in strength
              its turns parameter, parameter is flipped for right turns (so that both for left and right smaller values meaning earlier turns are position outside)
              finalweight = turnparameter + turndirection + panelid
        - **Offset Computation**  
          - Group segments by lookup ID and, within each group, by direction match  
          - Compute raw offsets (centered around zero) or bundle offsets (averaging subgroup positions)  
          - Move each segment along a perpendicular vector scaled by its offset  
        - **Double-Pass Refinement**  
          - First pass is mainly used to define bundle centers, as if segments go in opposite direction in a lookup axis, scoring is tricky
          - Second pass deals with bundles all in sam edirection, so scoring is reliable 
          (all lines wont be in same direction only in extreme corner cases, which could result in few extra overlaps, but the issue would be minuscule)
          - Produce paired “first” & “final” polylines and align them into bundle clusters (for ease of use, to be able to reference both first and final passes data) 
        - **Final Output**  
          - Reassemble moved polylines back into a `Grasshopper.DataTree` for downstream use  , keeping empty branches if present
        
        Public Classes
        --------------
        ### PolyPoint  
        Lightweight wrapper around `rg.Point3d` with a `.move(vector)` helper.
        
        ### PolySegment  
        Encapsulates one line segment between two `PolyPoint`s.  
        - Properties:  
          - `.geometry` -> `rg.Line`  
          - `.startpar` / `.endpar` -> nearest parameter on lookup axis line (to determine who turns first)
          - `.quadrant` -> compass quadrant of segment  
          - `.dirmatch` -> whether segment aligns with its lookup axis orientation  
          - `.sort_idx` -> computed sort key for ordering  
        
        ### Polyline  
        Builds a chain of `PolyPoint`s and `PolySegment`s from raw points.  
        - `_build()`  
          - Filters collinear points, instantiates segments  
        - `assign_ids(...)` / `assign_ids_raw(...)`  
        - `finalize_segments()`  
          - Computes turn directions, chains (`nextturnchain`, `scorechain`, `endchain`), and sort-chains  
        - Offsets:  
          - `move_segment`, `move_segments`  
          - `compute_dirflags`  
        - Properties:  
          - `.polyline_geometry` -> Rhino `Polyline`  
          - `.dirflagged` -> whether any segment failed alignment  
        
        ### DoubleSegment & DoublePoly  
        Pair up corresponding first- and final-pass segments to compute domain intervals, ordered geometry, and to support cluster re-alignment.
        """

        def Run(self, polylines, conduitsize, optionalkeys = gh.DataTree[System.Int32]([0], defaultpath),
                spacing = 1.0, perpanel = False, perlevel = False, pulltogether = True, 
                pushflag = True, pullstart = True, bimmode = False, prefilter = False):
            """
            returns: rawlinelookup, linelookup, rebuiltree, polys, polys2, finaltree, treeflags, doublepolys, Boundaryobjects
            pushflag effects compute the most, for iterating quickly it's best to disable it
            and keep just for final code
            """
            
            #pushflag = True #push colliding bundles apart
            bothpasses = True #for debugging, if False only 1 pass is run, more intersections
            debugglobals = True #debug outputs
            
            if prefilter:
                polylines = LineUtils.prefilter_polyline_tree(polylines)
            
            #nonorth move helpers 
            
            def _unit_xy(v):
                if v.Length > 0.0:
                    v.Unitize()
                return v
            
            def _left_normal_xy(v):
                n = rg.Vector3d(-v.Y, v.X, 0.0)
                if n.Length > 0.0:
                    n.Unitize()
                return n
            
            def _dot_xy(a, b):
                return a.X * b.X + a.Y * b.Y
            
            
            class PolyPoint(object):
                def __init__(self, x, y, z=0.0):
                    self.pt = rg.Point3d(x, y, z)
            
                def move(self, vector):
                    xform = rg.Transform.Translation(vector)
                    self.pt.Transform(xform)
            
                @property
                def location(self):
                    return self.pt
            
            
            class PolySegment(object):
                def __init__(self, start_point, end_point, polypath = None, 
                            polypathidx = None, polyidx = None, tradesize = 0.0,
                            outerdiameter = 0.0, optionalkey = 0.0, bimmode = False):
                    
                    self.start = start_point
                    self.end = end_point
                    self.polypath = polypath        # GH_path of parent polyline
                    self.polypathidx = polypathidx  # index of GH_path among all parent polylines paths
                    self.polyidx = polyidx          # index of parent polyline among all parent polylines
                    #self.pathsortidx = [1000, 1000, 1000, 1000] #in group calculated sort idx %left %straight %right numelements
                    self.pathsortidx = [0, 0, 0, 0] # in group calculated sort idx %left %straight %right numelements
                    self.pathsortidx_ = 0           # idx sorted by pathsortidx
                    self.optionalkey = optionalkey  # optional key to influence positioning
                    self.bimmode = bimmode          # solve sorting inside bundle itself only
                    self.lookupid = -1              # default lookup index
                    self.lookupidflip = -1
                    self.lookupidraw = -1
                    self.lookup_geometry = None      # actual flipped lookup line geometry
                    self.lookup_geometry_flip = None
                    self.lookup_geometry_raw = None
                    self.prevturn = "Unset"
                    self.nextturn = "Straight"
                    self.selfturn = "Straight"
                    self.startchain = []             # chain of start parameters
                    self.endchain = []               # chain of end parameters
                    self.nextturnchain = []
                    self.prevturnchain = []
                    self.scorechain = []
                    self.sortchain = [] #mainattempt
                    self.sortchainflip = []
                    self.sortchainraw = []
                    self.polydirflagged = False
                    self.bundleindex = -1 #default
                    self.tradesize = tradesize
                    self.outerdiameter = outerdiameter
                    self.dir = rg.Vector3d(0.0, 0.0, 0.0) #additions for nonorth
                    self.norm = rg.Vector3d(0.0, 0.0, 0.0)
                    self.prev_dir = rg.Vector3d(0.0, 0.0, 0.0)
                    self.prev_norm = rg.Vector3d(0.0, 0.0, 0.0)
                    self.next_dir = rg.Vector3d(0.0, 0.0, 0.0)
                    self.next_norm = rg.Vector3d(0.0, 0.0, 0.0)
                    self.has_prev = False
                    self.has_next = False
            
                @property
                def geometry(self):
                    return rg.Line(self.start.pt, self.end.pt)
            
                @property
                def startpar(self):
                    if not self.lookup_geometry:
                        return -1.0
                    # raw parameter on infinite line
                    return round(self.lookup_geometry.ClosestParameter(self.geometry.From), 3)
            
                @property
                def endpar(self):
                    if not self.lookup_geometry:
                        return -1.0
                    
                    return round(self.lookup_geometry.ClosestParameter(self.geometry.To), 3)
            
                @property
                def endparraw(self):
                    if not self.lookup_geometry_raw:
                        return -1.0
                    # raw parameter on infinite line
                    return round(self.lookup_geometry_raw.ClosestParameter(self.geometry.To), 3)
            
            
                #new for nonorth
                def move(self, vector):
                    # always start from the input vector
                    v = rg.Vector3d(vector.X, vector.Y, vector.Z)
            
                    # 1) use the LOOKUP axis so every segment in the bundle shares the same frame
                    if self.lookup_geometry:
                        dcur = rg.Vector3d(self.lookup_geometry.Direction.X,
                                           self.lookup_geometry.Direction.Y, 0.0)
                    else:
                        dcur = rg.Vector3d(self.dir.X, self.dir.Y, 0.0)
                    if dcur.Length <= GLOBAL_TOL:
                        dcur = self.geometry.Direction
                    if dcur.Length <= GLOBAL_TOL:
                        return
                    dcur.Unitize()
                    ncur = rg.Vector3d(-dcur.Y, dcur.X, 0.0)  # shared unit normal for the bundle
            
                    # how far we want to move in the normal direction (same for all lines in the bundle)
                    d = v.X * ncur.X + v.Y * ncur.Y
            
                    # helper: move an endpoint along a given direction so its normal shift equals d
                    def _along(dir_vec):
                        if dir_vec.Length <= GLOBAL_TOL:
                            # no reliable neighbor: just translate by the shared normal
                            return rg.Vector3d(ncur.X * d, ncur.Y * d, v.Z)
                        dp = rg.Vector3d(dir_vec.X, dir_vec.Y, 0.0); dp.Unitize()
                        denom = dp.X * ncur.X + dp.Y * ncur.Y    # == cos(angle(dp, ncur))
                        if abs(denom) < ANG_EPS:
                            # almost parallel to the axis -> treat as pure normal translation
                            return rg.Vector3d(ncur.X * d, ncur.Y * d, v.Z)
                        s = d / denom
                        return rg.Vector3d(dp.X * s, dp.Y * s, v.Z)
            
                    ds = _along(self.prev_dir) if self.has_prev else rg.Vector3d(ncur.X * d, ncur.Y * d, v.Z)
                    de = _along(self.next_dir) if self.has_next else rg.Vector3d(ncur.X * d, ncur.Y * d, v.Z)
            
                    self.start.move(ds)
                    self.end.move(de)
            
            
                def set_id(self, id):
                    self.lookupid = id
            
                def set_lookup_geometry(self, line):
                    # store a copy of the flipped lookup line
                    self.lookup_geometry = rg.Line(line.From, line.To)
            
                def set_id_raw(self, id):
                    self.lookupidraw = id
            
                def set_lookup_geometry_raw(self, line):
                    # store a copy of the flipped lookup line
                    self.lookup_geometry_raw = rg.Line(line.From, line.To)
            
                def set_polydirflag(self, flag):
                    self.polydirflagged = flag
                
                def set_pathsortidx(self, psort):
                    self.pathsortidx = psort
            
                def set_pathsortidx_(self, psort_):
                    self.pathsortidx_ = psort_
            
                def set_optionalkey(self, o_key):
                    self.optionalkey = o_key

                def set_bimmode(self, bim):
                    self.bimmode = bim

                """
                unset means straight
                left -> 0
                unset -> 1
                right -> 2
                """
                @property
                def groupindexnext(self):
                    if self.nextturn == "Left":
                        return 1#0
                    elif self.nextturn == "Straight":
                        return 3#1
                    elif self.nextturn == "Right":
                        return 5#2
                
                @property
                def groupindexnextflip(self):
                    if self.nextturn == "Left":
                        return 6#6#2
                    elif self.nextturn == "Straight":
                        return 3#3#1
                    elif self.nextturn == "Right":
                        return 0#0#0
            
                @property
                def quadrant(self): 
                    v = self.geometry.Direction
                    if abs(v.Y) >= abs(v.X):
                        if v.Y > 0:
                            direction = "Up quadrant"
                        else:
                            direction = "Down quadrant"
                    else:
                        if v.X > 0:
                            direction = "Right quadrant"
                        else:
                            direction = "Left quadrant"
                    return direction
                    
                @property
                def dirmatch(self):
                    selfdir = self.geometry.Direction
                    selfdir.Unitize()
                    lkpdir = self.lookup_geometry.Direction
                    lkpdir.Unitize()
                    dot = selfdir * lkpdir
                    
                    return dot > 0.5
            
                @property
                def sort_idx(self):
                    if perpanel:
                        pathoffset = self.pathsortidx_ * 10
                    else:
                        pathoffset = 0

                    gi = self.groupindexnext
                    gi2 = self.groupindexnextflip

                    #if not bimmode:
                    if True:
                    #if False:
                        calcpar = 0.0
                        
                        quadrant = self.quadrant
                        
                        parflip = quadrant in ["Up quadrant", "Down quadrant"] 
                        
                        if gi == 5 or gi2 == 0:# and not self.dirmatch: #was 2# and not self.polydirflagged:# or not self.dirmatch:
                #            if gi2 == 0:
                #                print "here"
                            calcpar = 1 - self.endpar
                            #calcpar = self.endpar
                        else:
                            calcpar = self.endpar
                
                        giflip = not self.dirmatch
                        
                        if giflip:
                            finpar = calcpar + self.groupindexnextflip
                        else:
                            finpar = calcpar + self.groupindexnext
                        
                        #rewrite to treat all same
                        finpar = calcpar + self.groupindexnext
                        
                        res = finpar + pathoffset + self.optionalkey
                        
                        if not self.dirmatch:
                            pass
                            #res = 10-res
                            #res = -res
                        
                        #pathoffset will prevent weaving of different panels
                        return  res
                    else:
                        if gi == 5 or gi2 == 0:  # "Right" turn
                            calcpar = 1 - self.endpar
                        else:
                            calcpar = self.endpar
                        
                        # choose group index depending on direction match so ordering
                        # is consistent regardless of segment vs axis orientation
                        if not self.dirmatch:
                            finpar = calcpar + self.groupindexnextflip
                        else:
                            finpar = calcpar + self.groupindexnext
                        
                        #finpar = calcpar#random.randint(0, 5)
                        
                        return finpar + pathoffset + self.optionalkey

            
                @property
                def sort_idx_raw(self):
                    gi = self.groupindexnext
                    calcpar = 0.0
                    
                    if gi == 2:
                        calcpar = 1 - self.endparraw
                    else:
                        calcpar = self.endparraw
                    
                    finpar = calcpar + gi 
                    
                    return finpar
            
            
            class Polyline(object):
                def __init__(self, rawpoints, ghpath=defaultpath, ghidx = -1, 
                            absidx = -1, pathidx = -1, tradesize = 0.0, 
                            outerdiameter = 0.0, optionalkey = 0.0, bimmode = False):
                    
                    self.rawpoints = list(rawpoints)
                    self.ghpath = ghpath #actual GH_Path 
                    self.ghidx = ghidx   #index of polyline inside path
                    self.absidx = absidx #index of polyline among all polylines
                    self.pathidx = pathidx#index of GH_Path among all paths
                    self.tradesize = tradesize
                    self.outerdiameter = outerdiameter
                    self.optionalkey = optionalkey
                    self.bimmode = bimmode
                    self._build()
            
                def _build(self):
                    unique = []
                    for p in self.rawpoints:
                        if not unique or unique[-1].DistanceTo(p) > GLOBAL_TOL:
                            unique.append(rg.Point3d(p.X, p.Y, p.Z))
            
                    filtered = []
                    for i in range(len(unique)):
                        if i == 0 or i == len(unique) - 1:
                            filtered.append(unique[i])
                        else:
                            p0, p1, p2 = unique[i-1], unique[i], unique[i+1]
                            v1 = rg.Vector3d(p1.X-p0.X, p1.Y-p0.Y, p1.Z-p0.Z)
                            v2 = rg.Vector3d(p2.X-p1.X, p2.Y-p1.Y, p2.Z-p1.Z)
                            if rg.Vector3d.CrossProduct(v1, v2).Length > GLOBAL_TOL:
                                filtered.append(p1)
            
                    self.points = [PolyPoint(p.X, p.Y, p.Z) for p in filtered]
                    self.segments = []
                    
                    #for i in range(len(self.points) - 1):
                    #    self.segments.append(PolySegment(self.points[i], self.points[i+1], self.ghpath, self.pathidx, self.absidx, self.tradesize, self.outerdiameter, self.optionalkey))
                    #rework for nonorth
                    for i in range(len(self.points) - 1):
                        seg = PolySegment(self.points[i], self.points[i+1], self.ghpath,
                                          self.pathidx, self.absidx, self.tradesize, 
                                          self.outerdiameter, self.optionalkey, self.bimmode)
                        self.segments.append(seg)
                    
                    for i in range(len(self.segments)):
                        seg = self.segments[i]
                    
                        dir_cur = seg.geometry.Direction
                        _unit_xy(dir_cur)
                        seg.dir = rg.Vector3d(dir_cur.X, dir_cur.Y, 0.0)
                        seg.norm = _left_normal_xy(seg.dir)
                    
                        if i > 0:
                            dir_prev = self.segments[i - 1].geometry.Direction
                            _unit_xy(dir_prev)
                            seg.prev_dir = rg.Vector3d(dir_prev.X, dir_prev.Y, 0.0)
                            seg.prev_norm = _left_normal_xy(seg.prev_dir)
                            seg.has_prev = True
                        else:
                            seg.has_prev = False
                    
                        if i < len(self.segments) - 1:
                            dir_next = self.segments[i + 1].geometry.Direction
                            _unit_xy(dir_next)
                            seg.next_dir = rg.Vector3d(dir_next.X, dir_next.Y, 0.0)
                            seg.next_norm = _left_normal_xy(seg.next_dir)
                            seg.has_next = True
                        else:
                            seg.has_next = False
            
                def move_segment(self, index, vector):
                    if index < 0 or index >= len(self.segments):
                        print "IndexError: Segment index out of range."
                        return
                    self.segments[index].move(vector)
            
                def move_segments(self, indices, vectors):
                    if len(indices) != len(vectors):
                        print "ValueError: indices and vectors must be the same length."
                        return
                    for idx, vec in zip(indices, vectors):
                        self.move_segment(idx, vec)
            
                def assign_ids(self, candidates):
                    for seg in self.segments:
                        best_idx = find_best_candidate(seg.geometry, candidates)
                        seg.set_id(best_idx)
                        seg.set_lookup_geometry(candidates[best_idx])
            
                def assign_ids_raw(self, candidates):
                    for seg in self.segments:
                        best_idx = find_best_candidate(seg.geometry, candidates)
                        seg.set_id_raw(best_idx)
                        seg.set_lookup_geometry_raw(candidates[best_idx])
            
                def finalize_segments(self):
                    count = len(self.segments)
                    for i, seg in enumerate(self.segments):
                        # previous turn
                        if i > 0:
                            prev_dir = self.segments[i-1].geometry.Direction
                            prev_dir.Unitize()
                            cur_dir = seg.geometry.Direction
                            cur_dir.Unitize()
                            cross = rg.Vector3d.CrossProduct(prev_dir, cur_dir)
                            if cross.Z > 0:
                                seg.prevturn = "Left"
                                seg.selfturn = "Left"
                            else:
                                seg.prevturn = "Right"
                                seg.selfturn = "Right"
            
                        # next turn
                        if i < count - 1:
                            next_dir = self.segments[i+1].geometry.Direction
                            next_dir.Unitize()
                            cur_dir = seg.geometry.Direction
                            cur_dir.Unitize()
                            cross = rg.Vector3d.CrossProduct(cur_dir, next_dir)
                            if cross.Z > 0:
                                seg.nextturn = "Left"
                            else:
                                seg.nextturn = "Right"
                    
                    verflag = False
                    cur_dir = seg.geometry.Direction
                    cur_dir.Unitize()
                    
                    if cur_dir * unitY > 0.5:
                        verflag = True
                    
                    for i, seg in enumerate(self.segments):
                        seg.nextturnchain = []
                        for k in range(2): # this segment + next 1
                            idx = i + k # -1 #-1 experimental edit
                            if idx < count:
                                seg.nextturnchain.append(self.segments[idx].nextturn)
                            else:
                                seg.nextturnchain.append("Unset")
                    
                    for i, seg in enumerate(self.segments):
                        seg.scorechain = []
                        for j in range(5):  # this segment + next 4
                            idx = i + j
                            
                            if idx < count:
                                #trn = self.segments[idx].nextturn
                                trn = self.segments[idx].selfturn
                                glen = round(self.segments[idx].geometry.Length, 3)
                                if trn == "Left":
                                    seg.scorechain.append(-glen)
                                    #seg.scorechain.append(glen)
                                else:
                                    seg.scorechain.append(glen)
                            else:
                                seg.scorechain.append(999999)
            
                    # build startchain and endchain for each segment
                    for i, seg in enumerate(self.segments):
                        seg.endchain = []
                        for j in range(5):  # this segment + next 4
                            idx = i + j
                            
                            if idx < count:
                                ioffset = self.segments[idx].groupindexnext
                                idxpar = self.segments[idx].endpar
                                bracketpar = -1
                                if ioffset in [0, 1, 2]:
                                    bracketpar = 0
                                if ioffset == 3:
                                    bracketpar = 1
                                if ioffset in [4, 5, 6]:
                                    bracketpar = 2
                                seg.endchain.append(bracketpar + idxpar)
                            else:
                                seg.endchain.append(0.0)
            
                    for seg in self.segments:
                        if self.dirflagged:
                            pass
                            seg.set_polydirflag(True)
                            #seg.polydirflagged = True
            
                    for i, seg in enumerate(self.segments):
                        seg.sortchain = []
                        seg.sortchainflip = []
                        seg.sortchainraw = []
                        for j in range(50):  #5 for debugging, normally could be more
                            idx = i + j
                            
                            if idx < count:
                                soridx = self.segments[idx].sort_idx
                                seg.sortchain.append(soridx)
                            else:
                                seg.sortchain.append(100)
                                
                        seg.sortchain.append(self.absidx) #add a unique consistent index as the last resort for consistent sorting for identical polys
            
                def compute_dirflags(self):
                    for seg in self.segments:
                        if self.dirflagged:
                            pass
                            seg.set_polydirflag(True)
                            #seg.polydirflagged = True
            
                @property
                def polyline_geometry(self):
                    pts = [pt.location for pt in self.points]
                    return rg.Polyline(pts)
                
                @property
                def dirflagged(self):
                    for sgm in self.segments:
                        if sgm.dirmatch == False:
                            return True
                    return False
            
            safeext = spacing*100
            
            class DoubleSegment(object):
                def __init__(self, first, final):
                    self.first = first 
                    self.final = final
                    self.bundleidx = -1
                    self.outlineidx = -1
                    self.boundlegroup = -1 #for boundary pushing grouping
                    self.maxslotdiameter = first.outerdiameter
            
                def set_bundleidx(self, idx):
                    self.bundleidx = idx
            
                def set_outlineidx(self, idx):
                    self.outlineidx = idx
                
                def set_maxslotdiameter(self, diameter):
                    self.maxslotdiameter = diameter
            
                def set_boundlegroup(self, idx):
                    self.boundlegroup = idx
            
                @property
                def id(self):
                    return self.first.lookupid
                
                @property
                def p1(self):
                    #return self.first.startpar
                    return self.lookup.ClosestParameter(self.geometry.From)
                    #return self.first.lookup_geometry.ClosestParameter(self.geometry.From)
                
                @property
                def p2(self):
                    #return self.first.endpar
                    return self.lookup.ClosestParameter(self.geometry.To)
                    #return self.first.lookup_geometry.ClosestParameter(self.geometry.To)
                
                @property
                def domain(self):
                    return rg.Interval(*sorted([self.p1, self.p2]))
                
                @property
                def geometry(self):
                    geo = self.final.geometry
                    pts = sorted([geo.From, geo.To], key = lambda p: (p.X, p.Y))
                    return rg.Line(*pts)
                
                @property
                def lookup(self):
                    lkpg = self.first.lookup_geometry
                    lkpline = rg.Line(lkpg.From, lkpg.To)
                    #lkpline.Extend(safeext, safeext) #need to check if needed
                    return lkpline
                
                
            class DoublePoly(object):
                def __init__(self, polyfirstpass, polyfinalpass):
                    self.firstpass = polyfirstpass
                    self.finalpass = polyfinalpass
                    # build and cache your DoubleSegment objects just once
                    pairs = zip(self.firstpass.segments, self.finalpass.segments)
                    self._segmentpairs = [DoubleSegment(a, b) for a, b in pairs]
            
                @property
                def segmentpairs(self):
                    return self._segmentpairs
            
            
            class Boundary(object):
                def __init__(self, geometry, bundleidx, outlineidx, encoded, axis, z):
                    self.geometry = geometry
                    self.bundleidx = bundleidx
                    self.outlineidx = outlineidx
                    self.encoded = encoded
                    self.axis = axis
                    self.movevector = rg.Vector3d(0, 0, 0)
                    self.z = z
                    self.boundlegroup = -1 #for boundary pushing grouping
            
                def set_movevector(self, vec):
                    self.movevector = vec
            
                def set_boundlegroup(self, idx):
                    self.boundlegroup = idx
            
            
            def find_best_candidate(checksegment, candidates):
                #direction prep helps with tolerance, grid is also prepped
                segment = rg.Line(*sorted([checksegment.From, checksegment.To], key=lambda point: (point.X, point.Y)))
                # Precompute angle buckets for candidates
                angle_buckets = {}
                for i, cand in enumerate(candidates):
                    dir_vec = cand.Direction
                    dir_vec.Unitize()
                    key = round(abs(dir_vec * unitY), 2)
                    #key = LineUtils.encode(dir_vec)
                    if key not in angle_buckets:
                        angle_buckets[key] = []
                    angle_buckets[key].append(i)
                
                #print angle_buckets.keys()
                
                seg_dir = segment.Direction
                seg_dir.Unitize()
                key = round(abs(seg_dir * unitY), 2)#LineUtils.encode(seg_dir, 2)
            
                bucket = angle_buckets.get(key, [])
            
                best_idx = -1
                best_dist = float('inf')
                
                mid = segment.PointAt(0.5)
                
                for i in bucket:
                    dist = candidates[i].DistanceTo(mid, True)
                    if dist < best_dist:
                        best_dist = dist
                        best_idx = i
            
                return best_idx
            
            def computeindices(n):
                # raw pairs
                if n <= 2:
                    return []
                else:
                    center = n // 2
                    if n % 2 == 0:
                        centers = {center - 1, center}
                        left = [i for i in range(n - 1) if i + 1 < center]
                    else:
                        centers = {center}
                        left = [i for i in range(n - 1) if i + 1 <= center]
                    right = [i for i in range(n - 1) if i >= center]
                    left.sort(reverse=True)
                    indexpairs = []
                    for l, r in zip(left, right):
                        indexpairs += [[l, l + 1], [r + 1, r]]
                
                #extend each pair toward the centers
                extended_indexpairs = []
                min_c = min(centers)
                for i, j in indexpairs:
                    path = [i, j]
                    while path[-1] not in centers:
                        step = 1 if path[-1] < min_c else -1
                        path.append(path[-1] + step)
                    extended_indexpairs.append(path)
                
                return extended_indexpairs
            
            if debugglobals:
                linelookup = None
                rawlinelookup = None
            
            def solver(polylines, solveparts = False, bimmode = False):
                if debugglobals:
                    global rawlinelookup
                    global linelookup #for debugging
                
                polys = []
                rawlinelookup = []
                segments_list = []
                
                icounter = 0
                
                for paidx, path in enumerate(polylines.Paths):
                    polysatpath = list(polylines.Branch(path))
                    polysizes = list(conduitsize.Branch(path))
                    
                    #print list(polysatpath)
                    #print "next"
                    #print bool(polysatpath)
                    
                    #optionalkey
                    o_key = 0
                    if path in optionalkeys.Paths:
                        o_key = optionalkeys.Branch(path)[0]
                    
                    for pidx, p in enumerate(polysatpath):
                        if p: #could be empty
                            trade_size = polysizes[pidx]
                            od_size = LineUtils.ConduitLookup.get_specs(trade_size)["od"]
                            #print p
                            #print list(p), path, pidx, icounter, paidx, trade_size, od_size, o_key
                            #print bimmode
                            polyobj = Polyline(list(p), path, pidx, icounter, paidx, trade_size, od_size, o_key, bimmode)
                            icounter += 1
                            polysegs = polyobj.segments
                            for polyseg in polysegs:
                                rawlinelookup.append(polyseg.geometry)
                                #segments_list.append(polyseg)
                            polys.append(polyobj)
                
                #linelookup = LineUtils.process_lines(rawlinelookup, 0.01, False, perlevel)
                #linelookupraw = LineUtils.process_lines(rawlinelookup, 0.01, True, perlevel)
                linelookup = LineUtils.process_lines_3d(rawlinelookup, 0.01, False, perlevel)
                linelookupraw = LineUtils.process_lines_3d(rawlinelookup, 0.01, True, perlevel)
            
                vectors = [[] for _ in linelookup]
                weight = [[] for _ in linelookup]
                
                for poly in polys:
                    poly.assign_ids(linelookup)
                    
                    for seg in poly.segments:
                        #print seg
                        seggeo = seg.geometry
                        idx = find_best_candidate(seggeo, linelookup)
                        weight[idx].append(seggeo.Length)
                        segvec = seggeo.Direction
                        segvec.Unitize()
                        #print segvec
                        vectors[idx].append(segvec)
            
                dominant_vectors = []
                
                for vec_list, w_list in zip(vectors, weight):
                    #print vec_list
                    if not vec_list:
                        continue  #added for robustness
                    ref = rg.Vector3d(vec_list[0])
                    ref.Unitize()
                
                    pos_w = 0.0
                    neg_w = 0.0
                    for v, w in zip(vec_list, w_list):
                        if v * ref >= 0:  # dot product ≥ 0 => same hemisphere
                            pos_w += w
                        else:
                            neg_w += w
                
                    if pos_w >= neg_w:
                        dominant = rg.Vector3d(ref)
                    else:
                        dominant = rg.Vector3d(-ref.X, -ref.Y, -ref.Z)
                
                    dominant_vectors.append(dominant)
                
                #adjust lines to match dominant vector
                for line, vec in zip(linelookup, dominant_vectors):
                    linedir = line.Direction
                    linedir.Unitize()
                    dotcheck = linedir * vec 
                    if dotcheck < 0:
                        pass
                        line.Flip()
                
                flippedlookup = []
                for l in linelookup:
                    flipline = rg.Line(l.To, l.From)
                    flippedlookup.append(flipline)
                
                #perpanel data fill
                perplookup = []
                for poly in polys:
                    poly.assign_ids(linelookup) 
                    poly.finalize_segments()
                    polysegs = poly.segments
                    for polyseg in polysegs:
                        perplookup.append(polyseg)
                
                groupspre = defaultdict(list)
                for seg in perplookup:
                    groupspre[seg.lookupid].append(seg)
                
                #print "groupspre", len(groupspre.values())
                
                for grps in groupspre.values():
                    idx_map={}
                    for gr in grps:
                        idx_map.setdefault(gr.polypathidx,[]).append(gr)
                    
                    stats=[]
                    for elems in idx_map.values():
                        elemslagged = not elems[0].dirmatch
                        
                        counts={'Left':0,'Straight':0,'Right':0}
                        for e in elems:
                            if e.endpar<1.0: #only not end segments
                                counts[e.nextturn]+=1
                                
                        total=len(elems)
                        left=counts['Left']
                        straight=counts['Straight']
                        right=counts['Right']
                        
                        if elemslagged:
                            pass #flip l r if its in opposite direction to bundle
                            left, right = right, left
                        
                        #key=[left, straight, right]
                        key=[-left, straight, right]
                        
                        if right > left:
                            total_key = -total
                        else:
                            total_key = total
                            
                        key.append(total_key)
                        stats.append((key,elems))
                    
                    stats.sort(key=lambda x: x[0])
            #        if grps[0].quadrant in ["Up quadrant", "Down quadrant"]:
            #            stats.sort(key=lambda x: x[0])
            #        else:
            #            stats.sort(key=lambda x: x[0], reverse = True)
                    
                    for idx,item in enumerate(stats):
                        cnts, elems = item
                        for e in elems:
                            e.set_pathsortidx(cnts)
                            e.set_pathsortidx_(idx)
            
                #finalize data fill (mostly sortchains)
                for poly in polys:
                    poly.assign_ids(linelookup) 
                    poly.finalize_segments()
                    poly.assign_ids_raw(linelookupraw)
                    
                    #move seglist creation here
                    polysegs = poly.segments
                    for polyseg in polysegs:
                        segments_list.append(polyseg)
                
                groups = defaultdict(list)
                for seg in segments_list:
                    groups[seg.lookupid].append(seg)
                
                for lid, group in groups.items():
                    if lid < 0 or not group:
                        continue
                
                    d = linelookup[lid].Direction
                    d.Unitize()
                    
                    ordered = group
                    ordered.sort(key=lambda s: s.sortchain)
                
                    groups2 = [list(g) for _, g in itertools.groupby(ordered, lambda s: s.dirmatch)]
                    
                    #pregrouper for bim mode
                    def _keyfunc(s):
                        return (s.pathsortidx_, s.dirmatch)
                    
                    ordered_sorted_bim = sorted(ordered, key=lambda s: (s.pathsortidx_, s.dirmatch, s.sortchain))
                    #ordered_sorted_bim = sorted(ordered, key=lambda s: (s.pathsortidx_))
                    #ordered_sorted_bim = ordered
                    groupsperpath_old = [list(g) for _, g in itertools.groupby(ordered, lambda s: s.pathsortidx_)]
                    groupsperpath = []
                    for k, g in itertools.groupby(ordered_sorted_bim, _keyfunc):
                        groupsperpath.append(list(g))
                    
                    #print "groupsperpathnew : ", len(groupsperpath)
                    #print "groupsperpathold : ",len(groupsperpath_old)
            
                    count = len(ordered)
                    center = (count - 1) / 2.0
                    center_global = center
                    
                    diameters = [s.outerdiameter for s in ordered]
                    total_length = sum(diameters) + spacing * (len(ordered) - 1)
                    center_offsets = []
                    current_left = -total_length / 2.0
                    #print diameters
                    for diameter in diameters:
                        # cluster center = left edge + half its width
                        center_offsets.append(current_left + diameter / 2.0)
                        # advance left edge past this cluster + one spacing
                        current_left += diameter + spacing
                        
                    raw_offsets = center_offsets#[(i - center_global) * spacing for i in range(count)]
                    
                    # map each segment to its raw offset
                    seg_to_offset = {seg: raw_offsets[i] for i, seg in enumerate(ordered)}
                
                    #perp = rg.Vector3d(-d.Y, d.X, 0)
                    perp = rg.Vector3d(d.Y, -d.X, 0)
                    perp.Unitize() #extra robustness
                    
                    if solveparts:
                        for idx, seg in enumerate(ordered):
                            offset = center_offsets[idx]#(idx - center) * spacing
                            move_vec = rg.Vector3d(perp)
                            move_vec *= offset
                            seg.move(move_vec)
                            seg.bundleindex = idx
                
                    else:
                        if bimmode:
                            #for each subgroup in groupsperpath, compute its mean offset.
                            for bundle_index, subgroup in enumerate(groupsperpath):
                                mean_off = sum(seg_to_offset[seg] for seg in subgroup) / len(subgroup)
                            
                                #move every segment in this subgroup to that subgroup center
                                for seg in subgroup:
                                    move_vec = rg.Vector3d(perp)
                                    move_vec *= mean_off
                                    seg.move(move_vec)
                                    seg.bundleindex = bundle_index
                        else:
                            #print "not here"
                            #for each subgroup in groups2, compute its mean offset.
                            for bundle_index, subgroup in enumerate(groups2):
                                mean_off = sum(seg_to_offset[seg] for seg in subgroup) / len(subgroup)
                            
                                #move every segment in this subgroup to that subgroup center
                                for seg in subgroup:
                                    move_vec = rg.Vector3d(perp)
                                    move_vec *= mean_off
                                    seg.move(move_vec)
                                    seg.bundleindex = bundle_index
                
                secondpasscandidates = []
                firstpasses = []
                for poly in polys:
                    if poly.dirflagged:
                        secondpasscandidates.append(poly)
                    else:
                        firstpasses.append(poly)
                
                
                rebuiltree = gh.DataTree[System.Object]()
                
                for path in polylines.Paths:
                    polysatpath = polylines.Branch(path)
                    if len(polysatpath) < 1:
                        rebuiltree.AddRange([], path)
                
                for poly in polys:
                    path = poly.ghpath
                    rebuiltree.Add(poly.polyline_geometry, path)
                
                return rebuiltree, polys
            
            
            if not bothpasses: #for debugging
                #rebuiltree, polys = solver(polylines, True)
                rebuiltree, polys = solver(polylines, False)
                testpass, polys2, finaltree, treeflags, doublepolys, Boundaryobjects = [], [], [], [], [], []
            else:
                if bimmode:
                    rebuiltree, polys = solver(polylines, False, True)
                    testpass, polys2 = solver(rebuiltree, True, False)
                else:
                    rebuiltree, polys = solver(polylines, False)
                    testpass, polys2 = solver(rebuiltree, True)

                doublepolys = [DoublePoly(poly, poly2) for poly, poly2 in zip(polys, polys2)]
                
                dsegments = []
                for doublepoly in doublepolys:
                    for dseg in doublepoly.segmentpairs:
                        dsegments.append(dseg)
                
                bundles = defaultdict(list)
                
                for dseg in dsegments:
                    bundles[dseg.id].append(dseg)
                
                
                gg, f, e, d, c, b, a = [], [], [], [], [], [], []
                coltags, coltags2 = [], []
                
                if pulltogether:
                    #order matters, go from larger to smaller
                    sortedbundles = sorted(bundles.values(), key = len, reverse = True)
                    #tbundle = sortedbundles[0] #50 #6 #23
                    #sortedbundles = [sortedbundles[0]] #2
                    
                    for tbundle in sortedbundles:
                        if not pullstart:
                            isfirst = False
                            for dline in tbundle:
                                if not dline.first.has_prev:
                                    isfirst = True
                                    break
                                    
                            #this is a bundle containing first segment
                            if isfirst:
                                continue
                            
                        dd = tbundle[0].lookup.Direction
                        dd.Unitize()
                        dmid = tbundle[0].lookup.PointAt(0.5) #midpoint
                        perp2 = rg.Vector3d(dd.Y, -dd.X, 0)
                        perpline = rg.Line(dmid, perp2)
                        perpvec = rg.Vector3d(dd.Y, -dd.X, 0)
                        
                        #tbundle.sort(key = lambda t: perpline.ClosestParameter(t.geometry.From))
                        
                        sorted_lines = sorted(tbundle, key=lambda l: l.domain.T0)
                        groupedbundle = []
                        for line in sorted_lines:
                            if not groupedbundle or not LineUtils.domains_overlap(line.domain, groupedbundle[-1]['domain'], tol=-0.0005): #negative tol reduce the domains
                                groupedbundle.append({'lines': [line], 'domain': line.domain})
                            else:
                                grp = groupedbundle[-1]
                                grp['lines'].append(line)
                                grp['domain'] = rg.Interval.FromUnion(grp['domain'], line.domain)
                        
                        #print "groupedbundles : {}".format(len(groupedbundle))
                        
                        for bundlegrp in groupedbundle:
                            #print "here"
                            sortedgrp = sorted(bundlegrp["lines"], key = lambda t: perpline.ClosestParameter(t.geometry.From))
                         
                            grplen = len(sortedgrp)
                            lookup_lists = computeindices(grplen)
                            domain_slots = [[member.domain] for member in sortedgrp]
                            idx_slots = [[i_] for i_, member in enumerate(sortedgrp)]
                            
                            for lookup_list in lookup_lists:
                                seed_idx = lookup_list[0]
                                haysack = lookup_list[1:]
                                
                                currdom = domain_slots[seed_idx][0]
                                #candidatedoms = [domain_slots[hay] for hay in haysack] 
                                
                                conflict = False
                                newpos = seed_idx
                                #for candidatedom, hay in zip(candidatedoms, haysack):
                                for hay in haysack:
                                    candidatedom = domain_slots[hay]
                                    if any([LineUtils.domains_overlap(currdom, canddom, tol=-0.0005) for canddom in candidatedom]):
                                        conflict = True
                                        break
                                    else:
                                        pass
                                        newpos = hay
                                
                                if newpos == seed_idx:
                                    pass
                                    #subgroup_collections.append([sortedgrp[seed_idx]])
                                else:
                                    domain_slots[newpos].append(currdom)
                                    domain_slots[seed_idx] = [rg.Interval(-100.0, -99.0)]
                                    
                                    idx_slots[newpos].append(seed_idx)
                                    idx_slots[seed_idx] = []
                                    #subgroup_collections.append([
                                
                            subgroup_collections = []
                            #print idx_slots
                            for slot in idx_slots:
                                if slot:
                                    collection = []
                                    for s in slot:
                                        collection.append(sortedgrp[s])
                                    subgroup_collections.append(collection)
                        
                            #subgroup_collections.append(current_cluster)
                
                            bcount = grplen
                            bcenter = (bcount - 1) / 2.0
                            
                            for bidx, bseg in enumerate(sortedgrp):
                                #resetprevoffsets
                                segp = bseg.geometry.From
                                projectp = perpline.ClosestPoint(segp, False) #false infinite
                                adjustvec = rg.Vector3d(dmid-projectp)
                                
                                bseg.final.move(adjustvec)#resetoffsets
                
                            ccount = len(subgroup_collections)
                            
                            #compute each cluster’s real diameter and stash in a list to walk them
                            position_max_diameter_list = [max([c.first.outerdiameter for c in cl]) for cl in subgroup_collections]
                            
                            #total span of all clusters + gaps
                            total_length = sum(position_max_diameter_list) + spacing * (ccount - 1)
                            
                            #build a list of center‐offsets for each cluster
                            center_offsets = []
                            current_left = -total_length / 2.0
                            for diameter in position_max_diameter_list:
                                # cluster center = left edge + half its width
                                center_offsets.append(current_left + diameter / 2.0)
                                # advance left edge past this cluster + one spacing
                                current_left += diameter + spacing
                            
                            for cidx, cluster in enumerate(subgroup_collections):
                                # build the vector along your perpvec
                                offset = center_offsets[cidx]
                                move_vec = rg.Vector3d(perpvec)
                                move_vec *= offset
                            
                                for item in cluster:
                                    #needed to create "boundary regions" of each cluster accurately
                                    #else too many regions are created with too many gaps
                                    item.set_maxslotdiameter(position_max_diameter_list[cidx])
                                    gg.append(cidx)
                                    item.final.move(move_vec)  # your custom move
                
                #bundles grouped on unique paths
                bundleboundaries = []
                
                #print "first bundles", len(bundles)
                #print bundles
                
                bundletolerance = 0.3
                
                Boundaryobjects = []
                
                for bidx, bundle in enumerate(bundles.values()):
                    rectangles = []
                    geometries = []
                    vectorkey = bundle[0].geometry.Direction
                    vectorkey.Unitize()
                    
                    anglekey = LineUtils.encode(vectorkey, 3)
                    
                    bundle_z = bundle[0].geometry.From.Z
                    
                    #print bundle
                    for elem in bundle:
                        elem.set_bundleidx(bidx)
                        line = elem.geometry
                        geometries.append(line)
                        #size = elem.first.outerdiameter
                        size = elem.maxslotdiameter
                        rectangle = LineUtils.rectangle_from_line(line, size + spacing + bundletolerance)
                        rectangles.append(rectangle)
                        
                    bundleboundary = LineUtils.union_intersecting_rects_outline(rectangles)
                    for oidx, bound in enumerate(bundleboundary):
                        bndry = Boundary(bound, bidx, oidx, anglekey, vectorkey, bundle_z)
                        Boundaryobjects.append(bndry)
                    
                    lineindexlookup = [LineUtils.line_in_polyline(l, bundleboundary) for l in geometries]
                    
                    for elem, lil in zip(bundle, lineindexlookup):
                        elem.set_outlineidx(lil)
                    #print "Vector {}, Angle {}, Bundlelen {}, unionregions {}, index lookup {}".format(0, anglekey, len(bundle), len(bundleboundary), lineindexlookup)
                    #print len(bundle), "___", len(bundleboundary), "___", lineindexlookup
                    
                    bundleboundaries.append(bundleboundary)
                    
                #print len(bundles)
                
                #_________OVERLAP PUSHING LOGIC_______
                # Maximum number of iterations for overlap resolution
                MAX_IT = 50
                
                # Reset all move vectors to zero
                for b in Boundaryobjects:
                    b.movevector = rg.Vector3d(0, 0, 0)
                
                # Group boundaries by encoded key and optional Z-level clustering
                groups = {}
                for b in Boundaryobjects:
                    if perlevel:
                        # snap Z to tolerance grid
                        zlvl = round(b.z / bundletolerance) * bundletolerance
                        key = (b.encoded, zlvl)
                    else:
                        key = b.encoded
                    groups.setdefault(key, []).append(b)
                
                #print len(groups.values())
                
                if pushflag: #pushout mechanism
                    for group in groups.values():
                        # ─── ensure smaller boundaries go first ───
                        group.sort(key=lambda b: b.geometry.Length)
                        
                        # make a mutable copy of each boundary’s geometry
                        lookup = {}
                        for b in group:
                            lookup[b] = rg.Polyline(b.geometry)
                    
                        locked = set()
                        it = 0
                        changed = True
                        
                        #track collision links inside this group
                        edges = defaultdict(set)
                        for _b in group:
                            edges[_b] = set()
                    
                        # repeat until no more pushes or iteration limit reached
                        while changed and it < MAX_IT:
                            changed = False
                            it = it + 1
                    
                            for b in group:
                                if b in locked:
                                    continue
                    
                                pl_s = lookup[b]
                                collided_with = None
                    
                                # find first collider for b
                                for bL in group:
                                    if bL is b:
                                        continue
                                    if LineUtils.polylines_collide(pl_s, lookup[bL]):
                                        collided_with = bL
                                        break
                                    
                                #remember that these two boundaries interacted
                                if collided_with is not None:
                                    edges[b].add(collided_with)
                                    edges[collided_with].add(b)
                    
                                if collided_with is None:
                                    continue
                    
                                # build a unit perpendicular direction
                                perp = rg.Vector3d(-b.axis.Y, b.axis.X, 0)
                                perp.Unitize()
                    
                                # ——— compute total shift in +perp direction ———
                                total_pos = 0.0
                                temp_pl = rg.Polyline(pl_s)
                                while True:
                                    next_collider = None
                                    for bO in group:
                                        if bO is b:
                                            continue
                                        if LineUtils.polylines_collide(temp_pl, lookup[bO]):
                                            next_collider = bO
                                            break
                                    if next_collider is None:
                                        break
                    
                                    # for each vertex, shoot an infinite +perp ray to next_collider
                                    pos_dists = []
                                    for pt in temp_pl:
                                        start_pt = rg.Point3d(pt)
                                        end_pt = rg.Point3d(start_pt + perp * 1e6)
                                        line_curve = rg.LineCurve(start_pt, end_pt)
                                        poly_curve = rg.PolylineCurve(lookup[next_collider])
                                        events = rg.Intersect.Intersection.CurveCurve(
                                            line_curve, poly_curve, 0.0, 0.0
                                        )
                                        for ev in events:
                                            if ev.ParameterA > 0:
                                                pos_dists.append(ev.ParameterA)
                    
                                    if pos_dists:
                                        shift = max(pos_dists)
                                    else:
                                        shift = 0.0
                                    shift = shift + GLOBAL_TOL
                    
                                    total_pos = total_pos + shift
                                    translation = rg.Transform.Translation(perp * shift)
                                    temp_pl.Transform(translation)
                    
                                # ——— compute total shift in -perp direction ———
                                total_neg = 0.0
                                temp_pl = rg.Polyline(pl_s)
                                while True:
                                    next_collider = None
                                    for bO in group:
                                        if bO is b:
                                            continue
                                        if LineUtils.polylines_collide(temp_pl, lookup[bO]):
                                            next_collider = bO
                                            break
                                    if next_collider is None:
                                        break
                    
                                    # for each vertex, shoot an infinite -perp ray to next_collider
                                    neg_dists = []
                                    for pt in temp_pl:
                                        start_pt = rg.Point3d(pt)
                                        end_pt = rg.Point3d(start_pt - perp * 1e6)
                                        line_curve = rg.LineCurve(start_pt, end_pt)
                                        poly_curve = rg.PolylineCurve(lookup[next_collider])
                                        events = rg.Intersect.Intersection.CurveCurve(
                                            line_curve, poly_curve, 0.0, 0.0
                                        )
                                        for ev in events:
                                            if ev.ParameterA > 0:
                                                neg_dists.append(ev.ParameterA)
                    
                                    if neg_dists:
                                        shift = max(neg_dists)
                                    else:
                                        shift = 0.0
                                    shift = shift + GLOBAL_TOL
                    
                                    total_neg = total_neg + shift
                                    translation = rg.Transform.Translation(perp * -shift)
                                    temp_pl.Transform(translation)
                    
                                # choose the shorter unsigned total shift
                                if total_pos <= total_neg:
                                    shift_vec = perp * total_pos
                                else:
                                    shift_vec = perp * -total_neg
                    
                                # apply the chosen shift to the real geometry
                                translation = rg.Transform.Translation(shift_vec)
                                lookup[b].Transform(translation)
                                b.movevector = b.movevector + shift_vec
                    
                                # lock this boundary and the one it first collided with
                                locked.add(b)
                                locked.add(collided_with)
                    
                                changed = True
                                break  # restart from the top of the while loop
                    
                            if changed:
                                continue
                    
                        #assign boundlegroup ids for this group based on collision graph
                        visited = set()
                        gid = 0
                        for seed in group:
                            if seed in visited:
                                continue
                            stack = [seed]
                            component = []
                            while stack:
                                cur = stack.pop()
                                if cur in visited:
                                    continue
                                visited.add(cur)
                                component.append(cur)
                                for nb in edges.get(cur, ()):
                                    if nb not in visited:
                                        stack.append(nb)
                            for m in component:
                                m.boundlegroup = gid
                            gid = gid + 1
                    
                        # warn if iteration limit reached
                        if it >= MAX_IT:
                            print("Warning: maximum iterations reached for one group")
                        else:
                            print "{} optimization iterations out of {} set as max".format(it, MAX_IT)
                
                
                #_________APPLYING BOUNDARIES SHIFTS_______
                boundarylookup = defaultdict(lambda: defaultdict(list))
                
                for b in Boundaryobjects:
                    boundarylookup[b.bundleidx][b.outlineidx].append(b)
                
                for doublepoly in doublepolys:
                    for doublesegment in doublepoly.segmentpairs:
                        ds = doublesegment
                        try:
                            linkedboundary = boundarylookup[ds.bundleidx][ds.outlineidx][0]
                            shift = linkedboundary.movevector
                            
                            #persist boundary linked-group id on the segment
                            ds.set_boundlegroup(linkedboundary.boundlegroup)
                            
                            if shift.Length > GLOBAL_TOL:
                                pass
                                doublesegment.final.move(shift)
                        except:
                            print "bundleindex {}, outlineindex {}".format(ds.bundleidx, ds.outlineidx)
                
                #_________FORMING FINAL DATATREES_______
                
                adjusted = []
                for dseg in dsegments:
                    adjusted.append(dseg.final.geometry)
                
                finaltree = gh.DataTree[System.Object]()
                treeflags = gh.DataTree[System.Object]()
                
                for path in polylines.Paths:
                    polysatpath = polylines.Branch(path)
                    if len(polysatpath) < 1:
                        finaltree.AddRange([], path)
                        treeflags.AddRange([], path)
                
                for poly, flagpoly in zip(polys2, polys):
                    #print dir(poly)
                    #break
                    path = poly.ghpath
                    finaltree.Add(poly.polyline_geometry, path)
                    treeflags.Add(flagpoly.dirflagged, path)
            
            # return outputs 
            return (rawlinelookup, linelookup, rebuiltree, polys, polys2, finaltree, treeflags, doublepolys, Boundaryobjects)

    @staticmethod
    def prefilter_polyline_tree(polylinesbatch, tol = GLOBAL_TOL):
        """
        takes a tree of polylines as input and tries to realign all axis of all
        polilines to simplify and straighten them, resnaps all polyline points
        to reconstructed axis
        """
        try:
            rawlines = []
            
            for polylines_ in polylinesbatch.Branches:
                for poly in list(polylines_):
                    #DO NOT merge collinear, it breaks the tolerances
                    #poly.MergeColinearSegments(GLOBAL_TOL, False)
                    if poly:
                        for i in range(poly.SegmentCount):
                            rawlines.append(poly.SegmentAt(i))
            
            resplit = LineUtils.split_lines_at_intersections(rawlines, tol, False)
            deduped = LineUtils.dedupe_lines(resplit, tol)
            sweeped = LineUtils.build_collinear_polylines_sweep(deduped, tol, 1.0)
            axised = [LineUtils.fit_weighted_line_from_polyline(sweep) for sweep in sweeped]
            resnapped = LineUtils.extend_lines_to_touch_others(axised)
            
            polylinesnapped = gh.DataTree[System.Object]()
            
            for path in polylinesbatch.Paths:
                polydata = list(polylinesbatch.Branch(path))
                polyresnapped = LineUtils.snap_polylines_points_to_lines(polydata, resnapped, keepempty = True)
                for p in polyresnapped:
                    if p:
                        p.MergeColinearSegments(tol, False)
                polylinesnapped.AddRange(polyresnapped, path)
            
            return polylinesnapped
        except:
            return "check your data type, has to be a tree of polylines"

    @staticmethod
    def linear_to_log(v, exponent=2.0):
        """
        Remap a linear input [0.0, 1.0] onto a logarithmic curve [0.0, 1.0].
        Clamps any input outside the [0.0, 1.0] range.
        """
        # clamp input
        # clamp input
        if v < 0.0:
            v = 0.0
        elif v > 1.0:
            v = 1.0
        # apply power mapping
        return v ** exponent

    @staticmethod
    def inchify(size):
        """
        Round a decimal inch measurement to nearest standard fraction
        (1/2, 1/4, 1/8, 1/16, or 1/32) and return the resulting float value.
        """
        whole = int(size)
        frac = size - whole
        denominators = [2, 4, 8, 16, 32]
        best_num = 0; best_den = 1; best_diff = None
        for d in denominators:
            n = int(frac * d + 0.5)
            diff = abs(frac - (float(n) / d))
            if best_diff is None or diff < best_diff:
                best_diff = diff; best_num = n; best_den = d
        def gcd(a, b):
            while b:
                a, b = b, a % b
            return a
        g = gcd(best_num, best_den)
        num_s = best_num // g; den_s = best_den // g
        if num_s == den_s:
            return float(whole + 1)
        if num_s == 0:
            return float(whole)
        return whole + float(num_s) / den_s

    # --- Spline Interpolation methods ---
    @staticmethod
    def solve_linear_system(A, b):
        """
        Solve a linear system Ax = b using Gaussian elimination
        with partial pivoting. Returns solution vector x.
        """
        n = len(A)
        for i in range(n):
            # find pivot
            max_el = abs(A[i][i]); max_row = i
            for k in range(i+1, n):
                if abs(A[k][i]) > max_el:
                    max_el = abs(A[k][i]); max_row = k
            A[i], A[max_row] = A[max_row], A[i]
            b[i], b[max_row] = b[max_row], b[i]
            # eliminate
            for k in range(i+1, n):
                c = -A[k][i] / A[i][i]
                for j in range(i, n):
                    if i == j:
                        A[k][j] = 0
                    else:
                        A[k][j] += c * A[i][j]
                b[k] += c * b[i]
        # back substitution
        x = [0 for _ in range(n)]
        for i in range(n-1, -1, -1):
            x[i] = b[i] / A[i][i]
            for k in range(i-1, -1, -1):
                b[k] -= A[k][i] * x[i]
        return x

    @staticmethod
    def calculate_spline_coefficients(x, y):
        """
        Compute cubic spline coefficients for given points (x, y).
        Returns tuples (a, b, c, d) representing spline segments.
        """
        n = len(x) - 1
        a = {k: v for k, v in enumerate(y)}
        h = {k: x[k+1] - x[k] for k in range(n)}
        # set up system
        A = [[0]*(n+1) for _ in range(n+1)]
        b = [0] * (n+1)
        for i in range(1, n):
            A[i][i-1] = h[i-1]
            A[i][i]   = 2*(h[i-1] + h[i])
            A[i][i+1] = h[i]
            b[i] = 3*((a[i+1] - a[i]) / h[i] - (a[i] - a[i-1]) / h[i-1])
        A[0][0] = 1; A[n][n] = 1
        c = LineUtils.solve_linear_system(A, b)
        bcoef = {}; dcoef = {}
        for i in range(n):
            bcoef[i] = (a[i+1] - a[i]) / h[i] - (h[i]*(c[i+1] + 2*c[i]) / 3)
            dcoef[i] = (c[i+1] - c[i]) / (3*h[i])
        return a, bcoef, c, dcoef

    @staticmethod
    def cubic_spline(x, coeffs, xi):
        """
        Evaluate the cubic spline at point xi using precomputed coefficients.
        Returns interpolated value or None if xi is out of range.
        """
        a, bcoef, c, dcoef = coeffs
        n = len(x) - 1
        for i in range(n):
            if x[i] <= xi <= x[i+1]:
                dx = xi - x[i]
                return a[i] + bcoef[i]*dx + c[i]*dx**2 + dcoef[i]*dx**3
        return None

    # --- Pipe generation methods ---
    @staticmethod
    def _bisector_plane(v1, v2, origin):
        """
        Create bisector plane for section placement.
        If v1 and v2 are colinear, returns a plane perpendicular to that direction.
        """
        # detect parallel or anti-parallel: cross will be near zero
        if abs(v1.IsParallelTo(v2, GLOBAL_TOL)) == 1:
            # For straight segments, just use a plane whose normal is the segment vector:
            return rg.Plane(origin, v2)

        # otherwise, compute true bisector plane
        bisector = v1 * v2.Length + v2 * v1.Length
        normal   = rg.Vector3d.CrossProduct(v1, v2)
        return rg.Plane(origin, bisector, normal)

    @staticmethod
    def _mesh_strip(p1, p2):
        """
        Create a quad strip mesh between two rings
        """
        m = rg.Mesh()
        cnt = p1.Count
        for i in range(cnt - 1):
            m.Vertices.Add(p1[i])
            m.Vertices.Add(p2[i])
        for j in range(cnt - 2):
            m.Faces.AddFace(j * 2 + 2, j * 2 + 3, j * 2 + 1, j * 2)
        last = cnt - 2
        m.Faces.AddFace(0, 1, last * 2 + 1, last * 2)
        return m

    @staticmethod
    def _create_ring(pt, vec, radius, segments):
        """
        Generate a circular ring at point along vector
        """
        plane = rg.Plane(pt, vec)
        cir = rg.Circle(plane, radius)
        ring = rg.Polyline()
        segf = float(segments)
        for i in range(int(segments) + 1):
            t = i * (2.0 * math.pi / segf) #fix for integer division when imported library
            ring.Add(cir.PointAt(t))
        return ring

    @staticmethod
    def _advance_ring(prev_ring, travel, sec_plane):
        """
        Project prev_ring along travel onto sec_plane
        """
        new_ring = rg.Polyline()
        for pt in prev_ring:
            line = rg.Line(pt, travel, 10.0)
            rc, t = rg.Intersect.Intersection.LinePlane(line, sec_plane)
            if not rc:
                t = 0.0
            new_ring.Add(line.PointAt(t))
        return new_ring

    @staticmethod
    def _build_rings(pl, radius, segments, closed):
        """
        Build sequence of rings along polyline
        """
        rings = [LineUtils._create_ring(pl[0], pl[1] - pl[0], radius, segments)]
        count = pl.Count
        if closed:
            v_start = pl[1] - pl[0]
            v_prev = pl[count - 2] - pl[0]
            sec_plane = LineUtils._bisector_plane(v_start, v_prev, pl[0])
            rings = [LineUtils._advance_ring(rings[0], pl[1] - pl[0], sec_plane)]
            start = 1; end = count - 2
        else:
            start = 0; end = count - 3
        for j in range(start, end + 1):
            v_prev = pl[j] - pl[j + 1]
            v_next = pl[j + 2] - pl[j + 1]
            sec_plane = LineUtils._bisector_plane(v_prev, v_next, pl[j + 1])
            travel = pl[j + 1] - pl[j]
            rings.append(LineUtils._advance_ring(rings[-1], travel, sec_plane))
        if not closed:
            end_pt = pl[count - 1]
            end_vec = pl[count - 2] - end_pt
            proj = rg.Polyline(rings[-1])
            xf = rg.Transform.PlanarProjection(rg.Plane(end_pt, end_vec))
            proj.Transform(xf)
            rings.append(proj)
        return rings

    @staticmethod
    def make_open(pl, radius, segments):
        """
        Generate pipe mesh for an open polyline
        """
        rings = LineUtils._build_rings(pl, radius, segments, False)
        mesh = rg.Mesh()
        for i in range(len(rings) - 1):
            mesh.Append(LineUtils._mesh_strip(rings[i], rings[i + 1]))
        mesh.Vertices.CombineIdentical(True, True)
        return mesh

    @staticmethod
    def make_closed(pl, radius, segments):
        """
        Generate pipe mesh for a closed polyline
        """
        rings = LineUtils._build_rings(pl, radius, segments, True)
        mesh = rg.Mesh()
        for i in range(len(rings) - 1):
            mesh.Append(LineUtils._mesh_strip(rings[i], rings[i + 1]))
        mesh.Append(LineUtils._mesh_strip(rings[0], rings[-1]))
        mesh.Vertices.CombineIdentical(True, True)
        return mesh

    @staticmethod
    def _compute_cut(r, s, theta, tol = GLOBAL_TOL):
        """
        Given bend radius r and deflection θ,  
        find the tangent offset (r·tan(θ/2)) from the pipe intersection,  
        then add the fitting’s straight stub length s.
        If near 0 -> no cut
        """
        if abs(theta) <= tol:
            return 0
        else:
            return r * math.tan(math.radians(theta/2.0)) + s

    @staticmethod
    def compute_raise(L, ang_deg, tol=GLOBAL_TOL):
        """
        Vertical rise of a straight segment of length L set at ang_deg to horizontal.
        """
        #ang_deg = 90 - ang_deg
        a = abs(ang_deg) % 180.0
        
        if a <= tol: 
            return 0
            
        if abs(a - 180.0) <= tol: 
            return 0
         
        h = L * math.sin(math.radians(a))
        
        if h <= tol: 
            return 0

        return h

    @staticmethod
    def compute_run(L, ang_deg, tol=GLOBAL_TOL):
        """
        Horizontal run of a straight segment of length L set at ang_deg to horizontal.
        """
        a = abs(ang_deg) % 180.0

        if a <= tol:
            return L

        if abs(a - 180.0) <= tol:
            return L

        if abs(a - 90.0) <= tol:
            return 0

        r = L * abs(math.cos(math.radians(a)))

        if r <= tol:
            return 0

        return r

    @staticmethod
    def compute_opposite(adjacent, ang_deg, tol=GLOBAL_TOL):
        """
        Opposite side (vertical) for a right‑triangle given adjacent side and angle to horizontal.
        """
        a = abs(ang_deg)%180.0
        if a <= tol or abs(a-180.0) <= tol:
            return 0
            
        if abs(a-90.0) <= tol:
            return float('inf')
            
        opp = adjacent*math.tan(math.radians(a))
        
        if abs(opp) <= tol:
            return 0
            
        return opp

    @staticmethod
    def fit_angle_to_height(L, avail_h, tol=GLOBAL_TOL):
        """
        Return the steepest angle whose rise fits in avail_h. 
        """
        if L <= tol:
            return 0.0
            
        if avail_h <= tol:
            return 0.0
            
        if avail_h >= L - tol:
            return 90.0
            
        ratio = avail_h / float(L)
        
        if ratio > 1.0:
            ratio = 1.0
            
        return math.degrees(math.asin(ratio))

    @staticmethod
    def smallest_ge(seq, x):
        """
        Smallest greater or equal from list of values
        """
        best = None
        for v in seq:
            if v >= x:
                if best is None or v < best: best = v
        return best

    @staticmethod
    def compute_pipe(pipepolyline, traderadius, segments, compute_normals, mergecollinear = True, linearsegments = 0.5, placefittings = False):
        """
        Create a mesh pipe along a polyline without caps
        Linear segments should be a 0.0 to 1.0 value which will 
        aproximate curvature into polyline based on radius
        """
        radius = LineUtils.ConduitLookup.get_specs(traderadius)['od']/2
        
        segments = max(segments, 3)
        
        min_factor = 0.01   # when linearsegments == 0.0 -> mapped == 0.01 * radius
        max_factor = 5.0   # when linearsegments == 1.0 -> mapped == 5.0 * radius
        
        # clamp linearsegments to [0.0, 1.0]
        clamped = LineUtils.linear_to_log(linearsegments, 2)
        if clamped < 0.0:
            clamped = 0.0
        elif clamped > 1.0:
            clamped = 1.0
        
        # linearly map to [min_factor * radius, max_factor * radius]
        mapped = radius * (min_factor + (max_factor - min_factor) * clamped)
        
        linearsegmentresolution = mapped
        
        poly = None
        polycrvflag = False
        if isinstance(pipepolyline, rg.Polyline):
            poly = pipepolyline
        elif hasattr(pipepolyline, 'TryGetPolyline'):
            result, pl = pipepolyline.TryGetPolyline()
            if result:
                poly = pl
            else:
                polycrvflag = True
                polycrv = pipepolyline.ToPolyline(linearsegmentresolution*3, math.pi, linearsegmentresolution, float("inf"))
                poly = polycrv.ToPolyline()
                
        if poly is None or poly.Count < 2:
            return None
        
        #NOTE placeholder passing handling if polycrvflag
        if placefittings and not polycrvflag:
            angleschain = [] 
            fittingplanes = []
            segmentschain = []
            poly.MergeColinearSegments(GLOBAL_TOL, True) #always merge, collinear segment fittings arent usec currently
            
            #extract straight segments
            for i in range(poly.SegmentCount):
                seg = poly.SegmentAt(i)
                segmentschain.append(seg)
            
            #for each joint, get angle and bisector plane
            for i in range(len(segmentschain) - 1):
                seg1 = segmentschain[i]
                seg2 = segmentschain[i + 1]
                
                v1 = seg1.Direction
                v2 = seg2.Direction
                v1.Unitize()
                v2.Unitize()
                
                # dot‐acos gives 0 to 180°, always nonnegative
                angle_rad = math.acos(max(-1.0, min(1.0, v1 * v2)))
                angle_deg = round(math.degrees(angle_rad), 3)
                angleschain.append(angle_deg)
                
                # bisector direction (handles 180° by picking a perp if zero)
                bis = rg.Vector3d(v1 + v2)
                if bis.IsZero:
                    # perpendicular in-plane
                    bis = rg.Vector3d(-v1.Y, v1.X, 0)
                bis.Unitize()
                
                # normal from cross product
                normal = rg.Vector3d.CrossProduct(v1, v2)
                normal.Unitize()
                
                # plane at the joint point, x-axis=bisector, z-axis=normal
                origin = seg1.To
                # compute a proper Y-axis so that Plane.Z == normal
                yaxis = rg.Vector3d.CrossProduct(normal, bis)
                yaxis.Unitize()
                
                plane = rg.Plane(origin, bis, yaxis)
                fittingplanes.append(plane)
            
            segment_angle_pairs = []  # will hold tuples of (segment, startAng, endAng)
            
            for i, seg in enumerate(segmentschain):
                # start angle: 0° if first, otherwise the previous joint angle
                if i == 0:
                    start_ang = 0.0
                else:
                    start_ang = angleschain[i - 1]
                
                # end angle: 0° if last, otherwise the next joint angle
                if i == len(segmentschain) - 1:
                    end_ang = 0.0
                else:
                    end_ang = angleschain[i]
                
                segment_angle_pairs.append((seg, start_ang, end_ang))
            
            linearstub = LineUtils.ConduitLookup.get_specs(traderadius)['linear_section']
            bendradius = LineUtils.ConduitLookup.get_specs(traderadius)['min_bend']
            
            cutsegments = []
            for sap in segment_angle_pairs:
                seg, st_a, e_a = sap
                seglen = seg.Length
                startcut = LineUtils._compute_cut(bendradius, linearstub, st_a)
                endcut = LineUtils._compute_cut(bendradius, linearstub, e_a)
                cutlen = startcut + endcut
                
                if seglen > cutlen + GLOBAL_TOL:
                    newseg = rg.Line(seg.From, seg.To) #create a "deepcopy"
                    newseg.Extend(-startcut, -endcut)
                    cutsegments.append(newseg)
                else:
                    pass #doesnt need to be placed
            
            finalmesh = rg.Mesh()
            for cutseg in cutsegments:
                cutpoly = rg.Polyline([cutseg.From, cutseg.To])
                segment = LineUtils.compute_pipe(cutpoly, traderadius, segments, compute_normals, mergecollinear, linearsegments, placefittings = False)
                #print "segment", segment
                finalmesh.Append(segment)
            
            turnsegments = []
            for angle, plane in zip(angleschain, fittingplanes):
                linearlen = LineUtils._compute_cut(bendradius, linearstub, angle)
                half = math.radians((180-angle)/2) #here lets say 30degree is considered as 150 in such planes
                dx = math.sin(half)*linearlen
                dy = math.cos(half)*linearlen
                p1 = plane.Origin + plane.XAxis*dx + plane.YAxis*dy
                p2 = plane.Origin + plane.XAxis*-dx + plane.YAxis*dy
                polyturn = rg.Polyline([p1, plane.Origin, p2])
                
                filletedturn = LineUtils.fillet2(polyturn, bendradius, segments = 10)
                turnmesh = LineUtils.compute_pipe(filletedturn, traderadius, segments, compute_normals, mergecollinear, linearsegments, placefittings = False)
                
                finalmesh.Append(turnmesh)
                #turnsegments.append(filletedturn)
                #turnsegments.append(polyturn)
            
            #return turnsegments
            return finalmesh
            #return cutsegments
            #print segment_angle_pairs
            #print angleschain
            #return fittingplanes
            
            
        else: #always here if polycrvflag currently
            if mergecollinear:
                poly.MergeColinearSegments(GLOBAL_TOL, True)
            
            mesh = LineUtils.make_closed(poly, radius, segments) if poly.IsClosed else LineUtils.make_open(poly, radius, segments)
            if compute_normals:
                mesh.Normals.ComputeNormals()
                mesh.UnifyNormals()
                
            return mesh
    
    @staticmethod
    def fillet2(polyline, radius, segments = 10):
        """
        Takes a polyline with EXACTLY 2 segments as input
        creates a fillet with n segments
        fillet is not an arch, result is always a polyline
        """
        # must be exactly two segments
        if polyline.Count != 3:
            return "Polyline must have exactly 2 segments"
        
        p0, p1, p2 = polyline[0], polyline[1], polyline[2]
    
        #build a plane through p1 using p0->p1 and p2->p1
        plane = rg.Plane(p1, p0, p2)
    
        #project into that plane (unpack success,u,v)
        ok, u0, v0 = plane.ClosestParameter(p0)
        ok, u1, v1 = plane.ClosestParameter(p1)
        ok, u2, v2 = plane.ClosestParameter(p2)
        p0_2d = rg.Point2d(u0, v0)
        p1_2d = rg.Point2d(u1, v1)
        p2_2d = rg.Point2d(u2, v2)
    
        #compute the two trim points along each incoming/outgoing edge
        vA = p0_2d - p1_2d; vA.Unitize()
        vB = p2_2d - p1_2d; vB.Unitize()
        theta = math.acos(vA * vB)
        d = radius / math.tan(theta/2.0)
        tp1_2d = p1_2d + vA * d
        tp2_2d = p1_2d + vB * d
    
        #find the 2D center of the circular fillet
        bis = vA + vB; bis.Unitize()
        h = radius / math.sin(theta/2.0)
        center2d = p1_2d + bis * h
    
        #compute start/end angles
        angle1 = math.atan2(tp1_2d.Y - center2d.Y, tp1_2d.X - center2d.X)
        angle2 = math.atan2(tp2_2d.Y - center2d.Y, tp2_2d.X - center2d.X)
    
        # normalize into [-Pi, Pi] in one go
        delta = (angle2 - angle1 + math.pi) % (2*math.pi) - math.pi
    
        #sample the arc in 'segments' steps
        arc2d = []
        for i in range(segments + 1):
            t = float(i) / segments
            ang = angle1 + delta * t
            x = center2d.X + math.cos(ang) * radius
            y = center2d.Y + math.sin(ang) * radius
            arc2d.append(rg.Point2d(x, y))
    
        #build the new 2D polyline and map back to world
        pts2d = [p0_2d, tp1_2d] + arc2d[1:-1] + [tp2_2d, p2_2d]
        pts3d = [plane.PointAt(pt.X, pt.Y) for pt in pts2d]
    
        return rg.Polyline(pts3d)

    @staticmethod
    def boundary_surface(curve, tol = GLOBAL_TOL):
        """
        Create planar Brep from a  boundary edge curve.
        (possibly empty if compute failed)
        """
        #No input -> nothing
        if not curve:
            #print "here"
            return None
            
        #Normalize polyline input
        if isinstance(curve, rg.Polyline):
            poly = curve
        elif hasattr(curve, 'TryGetPolyline'):
            result, pl = curve.TryGetPolyline()
            if result:
                poly = pl
            else:
                polycrv = curve.ToPolyline(tol*3, math.pi, tol, float("inf"))
                poly = polycrv.ToPolyline()

        pl = poly

        if pl.IsClosed:
            seg_cnt = pl.SegmentCount - 1 
            if seg_cnt in (3, 4):
                pts = [pl[i] for i in range(seg_cnt)]
                # handle triangle and quad separately
                if seg_cnt == 3:
                    brep = rg.Brep.CreateFromCornerPoints(
                        pts[0], pts[1], pts[2], tol)
                else:
                    brep = rg.Brep.CreateFromCornerPoints(
                        pts[0], pts[1], pts[2], pts[3], tol)
            else:
                brep = rg.Brep.CreatePlanarBreps(pl.ToPolylineCurve(), tol)[0]
                #print "not 3, 4, count {}".format(seg_cnt)
                
            if brep:
                return brep
        else:
            #print "notclosed"
            return None

    @staticmethod
    def extrusion(curve, direction, tol = GLOBAL_TOL):
        """
        Closed polyline as input 
        Returns capped rg.Extrusion
        """
        
        #Normalize polyline input
        if isinstance(curve, rg.Polyline):
            poly = curve
        elif hasattr(curve, 'TryGetPolyline'):
            result, pl = curve.TryGetPolyline()
            if result:
                poly = pl
            else:
                polycrv = curve.ToPolyline(tol*3, math.pi, tol, float("inf"))
                poly = polycrv.ToPolyline()
        
        if poly:
            #print "here", poly.IsClosed
            if poly.IsClosed:
                #NOTE: ToPolylineCurve() mostly gave no results, while ToNurbsCurve() worked very well 
                ext = rg.Extrusion.Create(poly.ToNurbsCurve(), direction.Length, True)
                #print [p.Z for p in poly]
                #print ext#, direction, direction.Length, poly, poly.ToPolylineCurve()
                return ext

        return None


    #currently here, need to think on where to put this style functions
    #box from rectangle, for example for line box intersection
    @staticmethod
    def rectangle_to_box(rect, thickness=10.0):
        """
        Creates a Box from a Rectangle3d by extruding it along its plane normal
        to the specified thickness.
        """
        plane = rect.Plane
        x_int = rect.X
        y_int = rect.Y
        z_int = rg.Interval(-thickness/2.0, thickness/2.0)
        return rg.Box(plane, x_int, y_int, z_int)
    
    @staticmethod
    def offset_rectangle(rect, offset, tol = GLOBAL_TOL):
        """
        Returns a new Rectangle3d expanded by the given offset on X and Y,
        enforcing a minimum size based on tolerance.
        """
        x, y = rect.X, rect.Y
        xmin, xmax = x.Min - offset, x.Max + offset
        ymin, ymax = y.Min - offset, y.Max + offset
        if xmax - xmin < tol:
            m = (xmin + xmax) * 0.5
            xmin, xmax = m - tol/2, m + tol/2
        if ymax - ymin < tol:
            m = (ymin + ymax) * 0.5
            ymin, ymax = m - tol/2, m + tol/2
        return rg.Rectangle3d(rect.Plane, rg.Interval(xmin, xmax), rg.Interval(ymin, ymax))

    @staticmethod
    def rebuild_rectangle(rect):
        """
        Rebuilds a Rectangle3d so its extents align to world X/Y axes,
        preserving its original elevation.
        """
        # get world‐space corners
        corners = [rect.Corner(i) for i in range(4)]
        xs = [pt.X for pt in corners]
        ys = [pt.Y for pt in corners]
        xmin, xmax = min(xs), max(xs)
        ymin, ymax = min(ys), max(ys)
        # build a world‐XY plane at the original Z height
        z      = rect.Plane.Origin.Z
        origin = rg.Point3d(xmin, ymin, z)
        plane  = rg.Plane(origin, rg.Vector3d.XAxis, rg.Vector3d.YAxis)
        # width along world X, height along world Y
        w = xmax - xmin
        h = ymax - ymin
        return rg.Rectangle3d(plane, w, h)

    @staticmethod
    def rectangle_axis(rect):
        """
        Returns the long axis of the rectangle as an rg.Line from midpoint to midpoint.
        """
        # get the four corners
        corners = [rect.Corner(i) for i in range(4)]
        # compute edge lengths
        lengths = [corners[i].DistanceTo(corners[(i+1)%4]) for i in range(4)]
        # find the longest edge index
        idx = lengths.index(max(lengths))
        # choose opposite midpoints based on edge orientation
        if idx in (0, 2):
            p1 = (corners[0] + corners[3]) / 2.0
            p2 = (corners[1] + corners[2]) / 2.0
        else:
            p1 = (corners[0] + corners[1]) / 2.0
            p2 = (corners[2] + corners[3]) / 2.0
        return rg.Line(p1, p2)

    @staticmethod
    def rectangle_from_line(line, thickness, extend = True):
        """
        Returns a Rectangle of n thickness around the line as its axis
        extend is adding half thickness to each end making rectangle sdf-like
        """
        if extend:
            rfl = rg.Line(line.From, line.To) #create a copy
            rfl.Extend(thickness/2, thickness/2)
            line = rfl
        v = line.UnitTangent
        
        perp = rg.Vector3d(-v.Y, v.X, 0)          # perpendicular in XY
        plane = rg.Plane(line.From, v, perp)      # X = line, Y = perp, normal = Z
        x_int = rg.Interval(0, line.Length)
        y_int = rg.Interval(-thickness/2.0, thickness/2.0)
        return rg.Rectangle3d(plane, x_int, y_int)

    @staticmethod
    def get_bounds_for_line(line, rect, axis):
        """
        Calculates a line’s projection interval on a rectangle along an axis if
        they overlap, returning that interval or None.
        """
        origin = rect.Plane.Origin
        if axis == 'y':
            rmin = origin.Y
            rmax = origin.Y + rect.Height
            lxmin = min(line.From.X, line.To.X)
            lxmax = max(line.From.X, line.To.X)
            rxmin = origin.X
            rxmax = origin.X + rect.Width
            if lxmax < rxmin - GLOBAL_TOL or lxmin > rxmax + GLOBAL_TOL:
                return None
        else:  # axis == 'x'
            rmin = origin.X
            rmax = origin.X + rect.Width
            lymin = min(line.From.Y, line.To.Y)
            lymax = max(line.From.Y, line.To.Y)
            rymin = origin.Y
            rymax = origin.Y + rect.Height
            if lymax < rymin - GLOBAL_TOL or lymin > rymax + GLOBAL_TOL:
                return None
        return (rmin, rmax)

    @staticmethod
    def get_rectangle_bounds(rect):
        """
        Calculates world-aligned X and Y bounds of a Rectangle3d,
        returning [[xmin, xmax], [ymin, ymax]].
        """
        bbox = rect.BoundingBox
        return [[bbox.Min.X, bbox.Max.X], [bbox.Min.Y, bbox.Max.Y]]

    @staticmethod
    def get_union_interval_containing(c, intervals):
        """
        Merges sorted intervals and returns the one containing a coordinate within
        tolerance, or None if no interval applies.
        """
        merged = LineUtils.merge_intervals(intervals)
        for (u_min, u_max) in merged:
            if c > u_min + GLOBAL_TOL and c < u_max - GLOBAL_TOL:
                return (u_min, u_max)
        return None

    @staticmethod
    def rects_collide(rect1, rect2):
        """
        Returns True if two Rectangle3d objects overlap by:
         - BoundingBox test  
         - Any corner of one lies Inside/Coincident with the other  
         - Any of their edges intersect
        """
        checker = (rg.PointContainment.Inside,
                   rg.PointContainment.Coincident)

        # Fast reject via AABB overlap on X/Y
        bb1 = rect1.BoundingBox
        bb2 = rect2.BoundingBox
        # no overlap if one box is entirely left/right or above/below the other
        if (bb1.Max.X < bb2.Min.X or bb1.Min.X > bb2.Max.X
         or bb1.Max.Y < bb2.Min.Y or bb1.Min.Y > bb2.Max.Y):
            return False

        #Corner containment
        for i in range(4):
            if rect1.Contains(rect2.Corner(i)) in checker:
                return True
            if rect2.Contains(rect1.Corner(i)) in checker:
                return True

        #Edge intersections: convert to closed curves and test
        crv1 = rect1.ToNurbsCurve()
        crv2 = rect2.ToNurbsCurve()
        events = rg.Intersect.Intersection.CurveCurve(
            crv1, crv2, GLOBAL_TOL, GLOBAL_TOL
        )
        if events and len(events) > 0:
            return True

        return False
    
    @staticmethod
    def polylines_collide(plA, plB):
        """
        Fast polyline‐vs‐polyline collision (AABB + segment intersection + containment)
        """
        bbA = plA.BoundingBox
        bbB = plB.BoundingBox
    
        # 1) AABB reject
        if bbA.Max.X < bbB.Min.X or bbA.Min.X > bbB.Max.X or \
           bbA.Max.Y < bbB.Min.Y or bbA.Min.Y > bbB.Max.Y:
            return False
    
        # 2) Segment‐segment intersections
        for i in range(plA.Count - 1):
            segA = rg.LineCurve(rg.Line(plA[i], plA[i+1]))
            for j in range(plB.Count - 1):
                segB = rg.LineCurve(rg.Line(plB[j], plB[j+1]))
                evts = rg.Intersect.Intersection.CurveCurve(
                    segA, segB, GLOBAL_TOL, GLOBAL_TOL
                )
                if evts:
                    return True
    
        # 3) Full‐containment check
        crvA = rg.PolylineCurve(plA)
        crvB = rg.PolylineCurve(plB)
        checker = (rg.PointContainment.Inside, rg.PointContainment.Coincident)
    
        # If any vertex of A lies inside or on B
        for pt in plA:
            if crvB.Contains(pt) in checker:
                return True
    
        # If any vertex of B lies inside or on A
        for pt in plB:
            if crvA.Contains(pt) in checker:
                return True
    
        return False
    
    @staticmethod
    def flatten_to_xy(rect):
        """
        project rectangle to world XY plane, preserving rotation about Z
        """
        p0 = rect.Corner(0)
        p1 = rect.Corner(1)
        p3 = rect.Corner(3)
        p0_flat = rg.Point3d(p0.X, p0.Y, 0)
        dir_x = rg.Vector3d(p1.X - p0.X, p1.Y - p0.Y, 0)
        dir_y = rg.Vector3d(p3.X - p0.X, p3.Y - p0.Y, 0)
        dir_x.Unitize()
        dir_y.Unitize()
        plane = rg.Plane(p0_flat, dir_x, dir_y)
        return rg.Rectangle3d(plane, rect.Width, rect.Height)

    @staticmethod
    def find_intersecting_rect_pairs(rects):
        """
        takes list of Rectangles, returns list of (i, j) index pairs that intersect in XY
        uses sweep-line on axis-aligned bboxes then precise LineUtils.rects_collide
        """
        flats = [LineUtils.flatten_to_xy(r) for r in rects]
        events = []
        for i, r in enumerate(flats):
            bb = r.BoundingBox
            events.append((bb.Min.X, True, i))
            events.append((bb.Max.X, False, i))
        events.sort(key=lambda e: (e[0], not e[1]))

        active = []
        hits = []
        for x, start, i in events:
            if start:
                bb_i = flats[i].BoundingBox
                minY, maxY = bb_i.Min.Y, bb_i.Max.Y
                for j in active:
                    bb_j = flats[j].BoundingBox
                    if bb_j.Max.Y >= minY and bb_j.Min.Y <= maxY:
                        if LineUtils.rects_collide(flats[i], flats[j]):
                            hits.append((j, i))
                active.append(i)
            else:
                active.remove(i)
        return hits

    @staticmethod
    def union_intersecting_rects_outline(rects, tol=GLOBAL_TOL):
        """
        takes list of Rectangle3d, groups intersecting ones and returns list of Polylines for outlines
        """
        pairs = LineUtils.find_intersecting_rect_pairs(rects)
        adj = {}
        for i, j in pairs:
            adj.setdefault(i, []).append(j)
            adj.setdefault(j, []).append(i)
        clusters = []
        visited = set()
        for idx in range(len(rects)):
            if idx in visited:
                continue
            stack = [idx]
            cluster = []
            while stack:
                n = stack.pop()
                if n not in visited:
                    visited.add(n)
                    cluster.append(n)
                    for m in adj.get(n, []):
                        if m not in visited:
                            stack.append(m)
            clusters.append(cluster)
        outlines = []
        
        #print "Created {} clusters".format(len(clusters))
        
        for cluster in clusters:
            curves = [LineUtils.flatten_to_xy(rects[i]).ToNurbsCurve() for i in cluster]
            unioned = rg.Curve.CreateBooleanUnion(curves, tol)
            for c in unioned or []:
                #print c
                #print c.TryGetPolyline()
                bool, pl = c.TryGetPolyline()#rg.Polyline()
                if bool:
                    outlines.append(pl)
                else:
                    outlines.append(c)
        return outlines

    @staticmethod
    def line_in_polyline(line, polylines):
        """
        Takes a Line and list of Polylines, returns index of first polyline containing both endpoints, else -1
        """
        for i, pl in enumerate(polylines):
            pc = rg.PolylineCurve(pl)
            if pc.Contains(line.From) != rg.PointContainment.Outside and pc.Contains(line.To) != rg.PointContainment.Outside:
                return i
        return -1

    @staticmethod
    def line_outside_rectangles(line, rectangles, thickness=10.0, tol=GLOBAL_TOL):
        """
        Returns a list of Line segments representing those portions of the finite
        line segment that do NOT lie within any of the given Rectangle3d objects.
        """
        # Parametric domain of the finite line
        seg_dom = rg.Interval(0.0, 1.0)

        # 1) Collect all hit‐intervals where the line enters/exits each rectangle (as a thin box)
        intervals = []
        for rect in rectangles:
            box = LineUtils.rectangle_to_box(rect, thickness)
            hit, iv = rg.Intersect.Intersection.LineBox(line, box, tol)
            if not hit:
                continue
            t0, t1 = iv.Min, iv.Max
            lo = max(seg_dom.Min, min(t0, t1))
            hi = min(seg_dom.Max, max(t0, t1))
            if hi > lo + tol:
                intervals.append((lo, hi))

        # 2) Merge overlapping or touching intervals
        merged = LineUtils.merge_intervals(intervals)

        # 3) Compute complement intervals in [0,1]
        outside = []
        current = seg_dom.Min
        for a, b in merged:
            if a > current + tol:
                outside.append((current, a))
            current = max(current, b)
        if seg_dom.Max > current + tol:
            outside.append((current, seg_dom.Max))

        # 4) Build and return the actual line segments
        segments = []
        for t0, t1 in outside:
            pt0 = line.PointAt(t0)
            pt1 = line.PointAt(t1)
            segments.append(rg.Line(pt0, pt1))
        return segments

    @staticmethod
    def _offset_along_axis(rect, axis, amount):
        """
        Returns a new Rectangle3d offset along one local axis by 'amount':
        negative extends Min, positive extends Max.
        """
        x, y = rect.X, rect.Y
        if axis == 'x':
            new_x = rg.Interval(x.Min + min(amount,0), x.Max + max(amount,0))
            return rg.Rectangle3d(rect.Plane, new_x, y)
        else:
            new_y = rg.Interval(y.Min + min(amount,0), y.Max + max(amount,0))
            return rg.Rectangle3d(rect.Plane, x, new_y)

    @staticmethod
    def _max_extension(slave, axis, direction, limit, master_rects):
        """
        Binary‐searches the max extension (up to 'limit') along one axis/direction
        before colliding with any master rectangles.
        """
        lo, hi, best = 0.0, limit, 0.0
        for _ in range(10):
            mid = (lo + hi) / 2.0
            test = LineUtils._offset_along_axis(slave, axis, direction * mid)
            if any(LineUtils.rects_collide(test, m) for m in master_rects):
                hi = mid
            else:
                best = mid
                lo = mid
        return best * direction

    @staticmethod
    def extend_rectangles(master_rects, slave_rects, extenddistance):
        """
        Extends each slave rectangle along its long axis by up to 'extenddistance'
        in both directions, stopping each way if it collides with any master.
        Returns a new list of extended Rectangle3d objects.
        """
        extended = []
        for slave in slave_rects:
            # pick the longer local axis
            axis = 'x' if slave.Width >= slave.Height else 'y'
            # compute negative and positive extensions
            neg_ext = LineUtils._max_extension(slave, axis, -1, extenddistance, master_rects)
            pos_ext = LineUtils._max_extension(slave, axis, +1, extenddistance, master_rects)
            x, y = slave.X, slave.Y
            # build new intervals
            new_x = (rg.Interval(x.Min + min(0,neg_ext), x.Max + max(0,pos_ext)) if axis == 'x' else x)
            new_y = (rg.Interval(y.Min + min(0,neg_ext), y.Max + max(0,pos_ext)) if axis == 'y' else y)
            
            extended.append(rg.Rectangle3d(slave.Plane, new_x, new_y))

        return extended

    @staticmethod
    def merge_intervals(intervals, tol = GLOBAL_TOL):
        """
        Merges overlapping or touching numeric intervals into a consolidated list.
        """
        if not intervals:
            return []
            
        sorted_int = sorted(intervals, key=lambda x: x[0])
        
        merged = [sorted_int[0]]
        for current in sorted_int[1:]:
            last = merged[-1]
            if current[0] <= last[1] + tol:
                merged[-1] = (last[0], max(last[1], current[1]))
            else:
                merged.append(current)
        return merged

    @staticmethod
    def encode(v, rounding=3, anglealigned = False):
        """
        Return the angle of a vector in the XY plane modulo π.
        """
        #added extra snapping to Pi and 2Pi to better adjust for tolerance
        v2d = rg.Vector3d(v.X, v.Y, 0)
        
        if not v2d.IsZero:
            v2d.Unitize()
            
        a = math.atan2(v2d.Y, v2d.X)
        if a < 0:
            a += 2 * math.pi
        if anglealigned:
            r = round(a, rounding)
            if r == round(2 * math.pi, rounding):
                r = 0.0
            return r
        else:
            r = round(a % math.pi, rounding)
            if r == round(math.pi, rounding):
                r = 0.0
            return r

    @staticmethod
    def find_param_group(groups, val, tol=GLOBAL_TOL):
        """
        Return existing key within tolerance or None.
        """
        for k in groups:
            if abs(k - val) < tol:
                return k
        return None

    @staticmethod
    def _qbucket(v, t):
        # stable "round half away from zero" using floor(+0.5)
        if t <= 0.0:
            t = 1e-9
        return int(math.floor((v / t) + 0.5))
    
    @staticmethod
    def _qhash_point(pt, t, use_z=False):
        kx = LineUtils._qbucket(pt.X, t)
        ky = LineUtils._qbucket(pt.Y, t)
        if use_z:
            kz = LineUtils._qbucket(pt.Z, t)
        else:
            kz = 0
        return (kx, ky, kz)

    @staticmethod
    def dedupe_lines(lines, tol=GLOBAL_TOL, use_z=False):
        """
        Remove duplicates by snapping endpoints into tolerance-based point groups.
        AB == BA. By default groups in 2D (ignore Z).
        """
        result = []
        seen = set()
    
        if tol <= 0.0:
            tol = 1e-9
        if not lines:
            return []
    
        # maps tolerant point "keys" -> representative (we just use tuple keys)
        groups2d = {}  # (x,y) -> (x,y)
        groups3d = {}  # (x,y,z) -> (x,y,z)
    
        def key2d(pt):
            k = LineUtils._find_point_group2d(groups2d, pt.X, pt.Y, tol)
            if k is None:
                k = (pt.X, pt.Y)
                groups2d[k] = k
            return k
    
        def key3d(pt):
            # simple 3D version mirroring the 2D one
            for kx, ky, kz in groups3d:
                dx = pt.X - kx
                dy = pt.Y - ky
                dz = pt.Z - kz
                if dx*dx + dy*dy + dz*dz <= tol*tol:
                    return (kx, ky, kz)
            k = (pt.X, pt.Y, pt.Z)
            groups3d[k] = k
            return k
    
        for ln in lines:
            if ln is None:
                continue
            try:
                if hasattr(ln, 'Length'):
                    if ln.Length <= tol:
                        continue
                p0 = ln.From
                p1 = ln.To
            except:
                continue
            if p0 is None or p1 is None:
                continue
    
            # snap endpoints into tolerant clusters (2D default)
            if use_z:
                k0 = key3d(p0)
                k1 = key3d(p1)
            else:
                k0 = key2d(p0)  # uses _find_point_group2d under the hood
                k1 = key2d(p1)
    
            # collapse degenerate after snapping
            if k0 == k1:
                continue
    
            # orientation-insensitive canonical key
            key = (k0, k1) if k0 <= k1 else (k1, k0)
    
            if key in seen:
                continue
            seen.add(key)
            result.append(ln)
    
        return result

    @staticmethod
    def process_lines(rawlines, tol=GLOBAL_TOL, anglealigned=False, perlevel=False):
        """
        Merge near-collinear lines into axis-aligned segments.
        """
        
        #rawlines = LineUtils.dedupe_lines(rawlines, tol)
        
        #if requested, split by .Z first
        if perlevel:
            z_groups = {}
            for ln in rawlines:
                z = ln.From.Z
                key = LineUtils.find_param_group(z_groups, z, tol)
                if key is None:
                    z_groups[z] = []
                    key = z
                z_groups[key].append(ln)
            processed = []
            for group in z_groups.values():
                processed.extend(LineUtils.process_lines(group, tol, anglealigned, perlevel=False))
            return processed
        
        #to help out with tolerance issues
        for iter in range(3):
            extrajoin = 3.0
            lines = [rg.Line(l.From, l.To) for l in rawlines]
            
            for line in lines:
                line.Extend(extrajoin, extrajoin)
            groups = {}
            
            for ln in lines:
                angle = LineUtils.encode(ln.Direction, 16, anglealigned)
                key = LineUtils.find_param_group(groups, angle, tol)
                if key is None:
                    groups[angle] = []
                    key = angle
                groups[key].append(ln)
                
            processed_lines = []
            
            for group_angle, glines in groups.items():
                delta = math.pi/2 - group_angle
                
                #pts = [rg.Point3d((ln.From.X + ln.To.X) * 0.5, (ln.From.Y + ln.To.Y) * 0.5, (ln.From.Z + ln.To.Z) * 0.5) for ln in glines]
                #n = len(pts)
                #origin = rg.Point3d(sum(pt.X for pt in pts) / n, sum(pt.Y for pt in pts) / n, sum(pt.Z for pt in pts) / n)
                origin = rg.Point3d(0, 0, 0)
                                    
                T = rg.Transform.Rotation(delta, origin)
                #_, T_inv = T.TryGetInverse()
                T_inv = rg.Transform.Rotation(-delta, origin)
                
                rotated_lines = []
                
                for ln in glines:
                    ln_copy = rg.Line(ln.From, ln.To)
                    ln_copy.Transform(T)
                    rotated_lines.append(ln_copy)
                vert_groups = {}
                
                for ln in rotated_lines:
                    xv = (ln.From.X + ln.To.X) * 0.5
                    key = LineUtils.find_param_group(vert_groups, xv, tol)
                    if key is None:
                        vert_groups[xv] = []
                        key = xv
                    y0, y1 = sorted([ln.From.Y, ln.To.Y])
                    vert_groups[key].append((y0, y1))
                    
                for xval, intervals in vert_groups.items():
                    merged_ints = LineUtils.merge_intervals(intervals, tol)
                    
                    for st, en in merged_ints:
                        new_line = rg.Line(rg.Point3d(xval, st, origin.Z),
                                           rg.Point3d(xval, en, origin.Z))
                        new_line.Transform(T_inv)
                        #extend back 
                        new_line.Extend(-extrajoin, -extrajoin)
                        processed_lines.append(new_line)

            rawlines = processed_lines
        return processed_lines

    @staticmethod
    def _orth_frame(normal):
        """
        Return orthonormal X,Y,Z axes with Z aligned to the given vector.
        """
        n = rg.Vector3d(normal.X, normal.Y, normal.Z)
        if not n.IsZero: 
            n.Unitize()
        up = rg.Vector3d(0, 0, 1)
        if abs(rg.Vector3d.Multiply(n, up)) > 0.9: 
            up = rg.Vector3d(1, 0, 0)
            
        x = rg.Vector3d.CrossProduct(up, n); x.Unitize()
        y = rg.Vector3d.CrossProduct(n, x); y.Unitize()
        return x, y, n

    @staticmethod
    def encode3d(v):
        """
        Unitize and sign-normalize a 3D vector for parallel grouping.
        """
        u = rg.Vector3d(v.X, v.Y, v.Z)
        if not u.IsZero: 
            u.Unitize()
        if u.Z < 0 or (abs(u.Z) < GLOBAL_TOL and (u.Y < 0 or (abs(u.Y) < GLOBAL_TOL and u.X < 0))):
            u *= -1.0
        return (u.X, u.Y, u.Z)

    @staticmethod
    def _find_dir_group3d(groups, dir_key, cos_thresh):
        """
        Find an existing direction key within angular threshold.
        """
        ux, uy, uz = dir_key
        for k in groups:
            kx, ky, kz = k
            if abs(ux*kx + uy*ky + uz*kz) >= cos_thresh: 
                return k
        return None

    @staticmethod
    def _find_point_group2d(groups, x, y, tol=GLOBAL_TOL):
        """
        Find 2D key in dict within given distance tolerance.
        """
        for kx, ky in groups:
            dx = x - kx
            dy = y - ky
            if dx*dx + dy*dy <= tol*tol: 
                return (kx, ky)
        return None

    @staticmethod
    def process_lines_3d(rawlines, tol=GLOBAL_TOL, anglealigned=False, perlevel=False, type = "legacy"):
        """
        Merge near-collinear 3D lines along their true axes with minimal drift.
        Type can be "sweep" or "legacy", sweep is more kitter resistant but longer
        """
        if type == "sweep":
            resplit = LineUtils.split_lines_at_intersections(rawlines, GLOBAL_TOL, False)
            deduped = LineUtils.dedupe_lines(resplit, GLOBAL_TOL)
            sweeped = LineUtils.build_collinear_polylines_sweep(deduped, GLOBAL_TOL, 1.0)
            axised = [LineUtils.fit_weighted_line_from_polyline(sweep) for sweep in sweeped]
            resnapped = LineUtils.extend_lines_to_touch_others(axised)
            
            return resnapped
        if type == "legacy":
            if not rawlines: 
                return []
            for _ in range(3):
                extrajoin = 3.0
                lines = []
                for l in rawlines:
                    ln = rg.Line(l.From, l.To)
                    ln.Extend(extrajoin, extrajoin)
                    if ln.Length > tol: 
                        lines.append(ln)
                if not lines: return []
    
                # scale-aware angular threshold so lateral drift ≤ tol
                bb = rg.BoundingBox([ln.From for ln in lines] + [ln.To for ln in lines])
                span = bb.Diagonal.Length
                if span <= 0.0: 
                    span = max([ln.Length for ln in lines] + [1.0])
                theta = min(0.25, math.asin(min(1.0, tol / span)))
                cos_thresh = math.cos(theta)
    
                dir_groups = {}
                for ln in lines:
                    dkey = LineUtils.encode3d(ln.Direction)
                    key = LineUtils._find_dir_group3d(dir_groups, dkey, cos_thresh)
                    if key is None:
                        dir_groups[dkey] = []
                        key = dkey
                    dir_groups[key].append(ln)
    
                processed = []
                for dkey, glines in dir_groups.items():
                    ux, uy, uz = dkey
                    mids = [rg.Point3d((ln.From.X+ln.To.X)*0.5, (ln.From.Y+ln.To.Y)*0.5, (ln.From.Z+ln.To.Z)*0.5) for ln in glines]
                    n = len(mids)
                    
                    origin = rg.Point3d(sum(p.X for p in mids)/n, sum(p.Y for p in mids)/n, sum(p.Z for p in mids)/n)
                    xaxis, yaxis, zaxis = LineUtils._orth_frame(rg.Vector3d(ux, uy, uz))
                    
                    from_plane = rg.Plane(origin, xaxis, yaxis)
                    to_plane = rg.Plane(origin, rg.Vector3d.XAxis, rg.Vector3d.YAxis)
                    T = rg.Transform.PlaneToPlane(from_plane, to_plane)
                    T_inv = rg.Transform.PlaneToPlane(to_plane, from_plane)
    
                    rot = []
                    for ln in glines:
                        lc = rg.Line(ln.From, ln.To)
                        lc.Transform(T)
                        rot.append(lc)
    
                    rails = {}
                    for ln in rot:
                        xv = (ln.From.X + ln.To.X) * 0.5
                        yv = (ln.From.Y + ln.To.Y) * 0.5
                        k = LineUtils._find_point_group2d(rails, xv, yv, tol)
                        if k is None:
                            rails[(xv, yv)] = []
                            k = (xv, yv)
                        z0, z1 = sorted([ln.From.Z, ln.To.Z])
                        rails[k].append((z0, z1))
    
                    for (xv, yv), intervals in rails.items():
                        merged = LineUtils.merge_intervals(intervals, tol)
                        for st, en in merged:
                            nl = rg.Line(rg.Point3d(xv, yv, st), rg.Point3d(xv, yv, en))
                            nl.Transform(T_inv)
                            nl.Extend(-extrajoin, -extrajoin)
                            if nl.IsValid and nl.Length > tol: 
                                processed.append(nl)
                rawlines = processed
            return processed

    @staticmethod
    def _unique_params(pvals, tol=0.01, include_endpoints=False):
        ps = []
        for p in pvals:
            if include_endpoints:
                if p >= -tol and p <= 1.0 + tol:
                    ps.append(p)
            else:
                if p > tol and p < 1.0 - tol:
                    ps.append(p)
        if not ps:
            return []
        ps = sorted(ps)
        out = []
        for p in ps:
            if not out or abs(p - out[-1]) > tol:
                if p < 0.0 + tol:
                    p = 0.0
                if p > 1.0 - tol:
                    p = 1.0
                out.append(p)
        return out

    @staticmethod
    def _split_line_at_params(ln, pvals, tol=0.01):
        pvals = LineUtils._unique_params(pvals, tol, include_endpoints=True)
        segs = []
        start = 0.0
        for p in pvals:
            if p > start + tol and p < 1.0 - tol:
                a = ln.PointAt(start)
                b = ln.PointAt(p)
                s = rg.Line(a, b)
                if s.IsValid and s.Length > tol:
                    segs.append(s)
                start = p
        s = rg.Line(ln.PointAt(start), ln.PointAt(1.0))
        if s.IsValid and s.Length > tol:
            segs.append(s)
        return segs

    @staticmethod
    def _build_rtree_for_lines(lines_in, tol):
        bboxes = []
        tree = rg.RTree()
        for i, ln in enumerate(lines_in):
            bb = ln.BoundingBox
            if not bb.IsValid:
                bb = rg.BoundingBox(ln.From, ln.To)
            bb.Inflate(tol)
            bboxes.append(bb)
            tree.Insert(bb, i)
        return tree, bboxes

    @staticmethod
    def _snap01(p, tol):
        if p < 0.0 + tol:
            return 0.0
        if p > 1.0 - tol:
            return 1.0
        return p

    @staticmethod
    def _in01(p, include_endpoints, tol):
        if include_endpoints:
            if p >= 0.0 and p <= 1.0:
                return True
            return False
        else:
            if p > tol and p < 1.0 - tol:
                return True
            return False

    @staticmethod
    def _closest_param_and_dist(ln, pt):
        a = ln.From
        b = ln.To
        dx = b.X - a.X
        dy = b.Y - a.Y
        dz = b.Z - a.Z
        vx = pt.X - a.X
        vy = pt.Y - a.Y
        vz = pt.Z - a.Z
        denom = dx*dx + dy*dy + dz*dz
        if denom <= 0.0:
            return 0.0, pt.DistanceTo(a)
        t = (vx*dx + vy*dy + vz*dz) / denom
        if t < 0.0:
            t = 0.0
        if t > 1.0:
            t = 1.0
        cx = a.X + t*dx
        cy = a.Y + t*dy
        cz = a.Z + t*dz
        dx2 = pt.X - cx
        dy2 = pt.Y - cy
        dz2 = pt.Z - cz
        d = math.sqrt(dx2*dx2 + dy2*dy2 + dz2*dz2)
        return t, d

    @staticmethod
    def _snap_point_to_unique(pt, uniq_pts, tol):
        best = None
        bestd2 = None
        r2 = tol * tol
        for q in uniq_pts:
            dx = q.X - pt.X
            dy = q.Y - pt.Y
            dz = q.Z - pt.Z
            d2 = dx*dx + dy*dy + dz*dz
            if d2 <= r2:
                if best is None or d2 < bestd2:
                    best = q
                    bestd2 = d2
        if best is None:
            return pt
        return best

    @staticmethod
    def split_lines_at_intersections(lines_in, tol=0.01, include_endpoints=False):
        if not lines_in:
            return []

        n = len(lines_in)
        paramdict = {}
        for i in range(n):
            paramdict[i] = []

        rtree, bboxes = LineUtils._build_rtree_for_lines(lines_in, tol)
        idxs = range(n)

        for i in idxs:
            li = lines_in[i]
            bbox = bboxes[i]
            candidate_indices = []

            def search_cb(sender, e):
                j = e.Id
                if j <= i:
                    return
                candidate_indices.append(j)

            rtree.Search(bbox, search_cb)

            for j in candidate_indices:
                lj = lines_in[j]
                rc, a, b = rg.Intersect.Intersection.LineLine(li, lj, tol, True)
                if rc:
                    a = LineUtils._snap01(a, tol)
                    b = LineUtils._snap01(b, tol)
                    if LineUtils._in01(a, include_endpoints, tol):
                        paramdict[i].append(a)
                    if LineUtils._in01(b, include_endpoints, tol):
                        paramdict[j].append(b)

        out = []
        for i in idxs:
            ln = lines_in[i]
            if paramdict[i]:
                segs = LineUtils._split_line_at_params(ln, paramdict[i], tol)
                if segs:
                    for s in segs:
                        if s.IsValid and s.Length > tol:
                            out.append(s)
            else:
                if ln.IsValid and ln.Length > tol:
                    out.append(ln)

        if not out:
            return out

        ptTol = tol * 0.25
        if ptTol > 1e-6:
            ptTol = 1e-6
        if ptTol <= 0.0:
            ptTol = 1e-9

        pts = []
        for ln in out:
            pts.append(ln.From)
            pts.append(ln.To)

        uniq_arr = rg.Point3d.CullDuplicates(pts, ptTol)
        uniq_pts = []
        if uniq_arr:
            for p in uniq_arr:
                uniq_pts.append(p)
        else:
            uniq_pts = pts

        rebuilt = []
        for ln in out:
            p0o = ln.From
            p1o = ln.To
            p0s = LineUtils._snap_point_to_unique(p0o, uniq_pts, ptTol)
            p1s = LineUtils._snap_point_to_unique(p1o, uniq_pts, ptTol)
            if p0s.DistanceTo(p1s) <= ptTol:
                rebuilt.append(rg.Line(p0o, p1o))
            else:
                rebuilt.append(rg.Line(p0s, p1s))

        final_lines = []
        for ln in rebuilt:
            L = ln.Length
            if L <= tol:
                continue
            param_eps = ptTol / L
            if param_eps > 0.49:
                param_eps = 0.49
            if param_eps < 1e-9:
                param_eps = 1e-9

            params = []
            for pt in uniq_pts:
                t, d = LineUtils._closest_param_and_dist(ln, pt)
                if d <= ptTol:
                    t = LineUtils._snap01(t, param_eps)
                    if t > param_eps and t < 1.0 - param_eps:
                        params.append(t)

            if params:
                params.sort()
                cleaned = []
                for tk in params:
                    if not cleaned:
                        cleaned.append(tk)
                    else:
                        if abs(tk - cleaned[-1]) > param_eps:
                            cleaned.append(tk)
                segs = LineUtils._split_line_at_params(ln, cleaned, tol)
                if segs:
                    for s in segs:
                        if s.IsValid and s.Length > tol:
                            final_lines.append(s)
                else:
                    if ln.IsValid and ln.Length > tol:
                        final_lines.append(ln)
            else:
                if ln.IsValid and ln.Length > tol:
                    final_lines.append(ln)

        return final_lines

    @staticmethod
    def build_collinear_polylines_sweep(lines_in, tol=GLOBAL_TOL, angle_deg=1.0):
        """
        line sweep algorithm to join touching close enough angled lines int o a polyline
        """
        result = []
        if not lines_in:
            return result
    
        rad = angle_deg * math.pi / 180.0
        cos_thr = math.cos(rad)
        pts = []
        for ln in lines_in:
            if not ln or not ln.IsValid:
                continue
            if ln.Length <= tol:
                continue
            pts.append(ln.From)
            pts.append(ln.To)
    
        uniq_arr = rg.Point3d.CullDuplicates(pts, tol)
        uniq_pts = []
        if uniq_arr:
            for p in uniq_arr:
                uniq_pts.append(p)
        else:
            for p in pts:
                uniq_pts.append(p)
    
        snapped = []
        for ln in lines_in:
            if not ln or not ln.IsValid:
                continue
            if ln.Length <= tol:
                continue
            a = LineUtils._snap_point_to_unique(ln.From, uniq_pts, tol)
            b = LineUtils._snap_point_to_unique(ln.To, uniq_pts, tol)
            if a.DistanceTo(b) <= tol:
                continue
            snapped.append((a, b, ln))
    
        if not snapped:
            return result
    
        pindex = {}
        for i, p in enumerate(uniq_pts):
            key = (p.X, p.Y, p.Z)
            pindex[key] = i
    
        edges = []
        for a, b, ln in snapped:
            ia = pindex[(a.X, a.Y, a.Z)]
            ib = pindex[(b.X, b.Y, b.Z)]
            edges.append((ia, ib, a, b))
    
        adj = {}
        for i in range(len(uniq_pts)):
            adj[i] = []
        for k, e in enumerate(edges):
            ia, ib, a, b = e
            adj[ia].append(k)
            adj[ib].append(k)
    
        used = [False for _ in edges]
        seeds = []
        for k, e in enumerate(edges):
            ia, ib, a, b = e
            minx = a.X if a.X <= b.X else b.X
            miny = a.Y if a.Y <= b.Y else b.Y
            seeds.append((minx, miny, k))
        seeds.sort()
    
        def unit_vec(p, q):
            vx = q.X - p.X
            vy = q.Y - p.Y
            vz = q.Z - p.Z
            L = math.sqrt(vx*vx + vy*vy + vz*vz)
            if L <= 0.0:
                return (0.0, 0.0, 0.0)
            return (vx / L, vy / L, vz / L)
    
        def dot_abs(u, v):
            d = u[0]*v[0] + u[1]*v[1] + u[2]*v[2]
            if d < 0.0:
                d = -d
            return d
    
        for _, _, seed_k in seeds:
            if used[seed_k]:
                continue
    
            ia, ib, pa, pb = edges[seed_k]
            u0 = unit_vec(pa, pb)
            poly_pts = [pa, pb]
            used[seed_k] = True
            start_id = ia
            end_id = ib
    
            for _ in range(len(edges)):
                best_k = None
                best_side = None
                best_dot = None
                for ek in adj[end_id]:
                    if used[ek]:
                        continue
                    eia, eib, ea, eb = edges[ek]
                    if eia == end_id:
                        ud = unit_vec(ea, eb)
                        d = dot_abs(u0, ud)
                        if d >= cos_thr:
                            if best_k is None or d > best_dot:
                                best_k = ek
                                best_side = 'end_forward'
                                best_dot = d
                    elif eib == end_id:
                        ud = unit_vec(eb, ea)
                        d = dot_abs(u0, ud)
                        if d >= cos_thr:
                            if best_k is None or d > best_dot:
                                best_k = ek
                                best_side = 'end_backward'
                                best_dot = d
                if best_k is None:
                    break
                eia, eib, ea, eb = edges[best_k]
                if best_side == 'end_forward':
                    poly_pts.append(eb)
                    end_id = eib
                else:
                    poly_pts.append(ea)
                    end_id = eia
                used[best_k] = True
    
            for _ in range(len(edges)):
                best_k = None
                best_side = None
                best_dot = None
                for ek in adj[start_id]:
                    if used[ek]:
                        continue
                    eia, eib, ea, eb = edges[ek]
                    if eib == start_id:
                        ud = unit_vec(ea, eb)
                        d = dot_abs(u0, ud)
                        if d >= cos_thr:
                            if best_k is None or d > best_dot:
                                best_k = ek
                                best_side = 'start_backward'
                                best_dot = d
                    elif eia == start_id:
                        ud = unit_vec(eb, ea)
                        d = dot_abs(u0, ud)
                        if d >= cos_thr:
                            if best_k is None or d > best_dot:
                                best_k = ek
                                best_side = 'start_forward'
                                best_dot = d
                if best_k is None:
                    break
                eia, eib, ea, eb = edges[best_k]
                if best_side == 'start_backward':
                    poly_pts.insert(0, ea)
                    start_id = eia
                else:
                    poly_pts.insert(0, eb)
                    start_id = eib
                used[best_k] = True
    
            if len(poly_pts) >= 2:
                pl = rg.Polyline(poly_pts)
                if pl.IsValid and pl.Length > tol:
                    result.append(pl)
    
        return result

    @staticmethod
    def fit_weighted_line_from_polyline(pl, tol=GLOBAL_TOL, max_iter=25):
        """
        used to rebuild a jittery polyline which is supposed to be an axis into a single line
        """
        if pl is None:
            return rg.Line(rg.Point3d(0.0, 0.0, 0.0), rg.Point3d(0.0, 0.0, 0.0))
        if not hasattr(pl, 'Count'):
            return rg.Line(rg.Point3d(0.0, 0.0, 0.0), rg.Point3d(0.0, 0.0, 0.0))
        n = pl.Count
        if n < 2:
            return rg.Line(rg.Point3d(0.0, 0.0, 0.0), rg.Point3d(0.0, 0.0, 0.0))
    
        sum_w = 0.0
        cx = 0.0
        cy = 0.0
        cz = 0.0
        i = 0
        while i < n - 1:
            p = pl[i]
            q = pl[i + 1]
            L = p.DistanceTo(q)
            if L > tol:
                mx = 0.5 * (p.X + q.X)
                my = 0.5 * (p.Y + q.Y)
                mz = 0.5 * (p.Z + q.Z)
                sum_w += L
                cx += L * mx
                cy += L * my
                cz += L * mz
            i += 1
        if sum_w <= 0.0:
            a = pl[0]
            b = pl[n - 1]
            return rg.Line(a, b)
    
        cx /= sum_w
        cy /= sum_w
        cz /= sum_w
        C = rg.Point3d(cx, cy, cz)
    
        sxx = 0.0
        sxy = 0.0
        sxz = 0.0
        syy = 0.0
        syz = 0.0
        szz = 0.0
        i = 0
        while i < n - 1:
            p = pl[i]
            q = pl[i + 1]
            L = p.DistanceTo(q)
            if L > tol:
                mx = 0.5 * (p.X + q.X)
                my = 0.5 * (p.Y + q.Y)
                mz = 0.5 * (p.Z + q.Z)
                dx = mx - cx
                dy = my - cy
                dz = mz - cz
                sxx += L * dx * dx
                sxy += L * dx * dy
                sxz += L * dx * dz
                syy += L * dy * dy
                syz += L * dy * dz
                szz += L * dz * dz
            i += 1
    
        vx = pl[n - 1].X - pl[0].X
        vy = pl[n - 1].Y - pl[0].Y
        vz = pl[n - 1].Z - pl[0].Z
        vL = math.sqrt(vx*vx + vy*vy + vz*vz)
        if vL <= 0.0:
            vx = 1.0
            vy = 0.0
            vz = 0.0
            vL = 1.0
        vx /= vL
        vy /= vL
        vz /= vL
    
        k = 0
        eps = 1e-12
        while k < max_iter:
            nx = sxx * vx + sxy * vy + sxz * vz
            ny = sxy * vx + syy * vy + syz * vz
            nz = sxz * vx + syz * vy + szz * vz
            nL = math.sqrt(nx*nx + ny*ny + nz*nz)
            if nL <= eps:
                break
            nx /= nL
            ny /= nL
            nz /= nL
            dvx = nx - vx
            dvy = ny - vy
            dvz = nz - vz
            dL = math.sqrt(dvx*dvx + dvy*dvy + dvz*dvz)
            vx = nx
            vy = ny
            vz = nz
            if dL <= 1e-6:
                break
            k += 1
    
        if k == 0 and nL <= eps:
            sx = 0.0
            sy = 0.0
            sz = 0.0
            i = 0
            while i < n - 1:
                p = pl[i]
                q = pl[i + 1]
                L = p.DistanceTo(q)
                if L > tol:
                    sx += (q.X - p.X)
                    sy += (q.Y - p.Y)
                    sz += (q.Z - p.Z)
                i += 1
            vL = math.sqrt(sx*sx + sy*sy + sz*sz)
            if vL <= 0.0:
                a = pl[0]
                b = pl[n - 1]
                return rg.Line(a, b)
            vx = sx / vL
            vy = sy / vL
            vz = sz / vL
    
        a = pl[0]
        b = pl[n - 1]
        ax = a.X - cx
        ay = a.Y - cy
        az = a.Z - cz
        bx = b.X - cx
        by = b.Y - cy
        bz = b.Z - cz
        ta = ax*vx + ay*vy + az*vz
        tb = bx*vx + by*vy + bz*vz
        A = rg.Point3d(cx + ta*vx, cy + ta*vy, cz + ta*vz)
        B = rg.Point3d(cx + tb*vx, cy + tb*vy, cz + tb*vz)
        if A.DistanceTo(B) <= tol:
            return rg.Line(pl[0], pl[n - 1])
        return rg.Line(A, B)

    @staticmethod
    def extend_lines_to_touch_others(lines_in, tol=GLOBAL_TOL):
        """
        takes a list of lines as input and for every line it check it's endpoints 
        if they are within tolerance of some other line (be it endpoint or just on the line) 
        if yes, than rebuild that line extending that point so that it lies exactly 
        on that other line (treat lines as finite)
        """
        out = []
        if not lines_in:
            return out
        tree, bboxes = LineUtils._build_rtree_for_lines(lines_in, tol)
        n = len(lines_in)
        for i in range(n):
            ln = lines_in[i]
            if not ln or not ln.IsValid:
                continue
            if ln.Length <= tol:
                continue
            p0 = ln.From
            p1 = ln.To
            q0 = p0
            q1 = p1
    
            def best_target(pt, self_index):
                best_j = -1
                best_t = 0.0
                best_d = None
                bb = rg.BoundingBox(rg.Point3d(pt.X - tol, pt.Y - tol, pt.Z - tol), rg.Point3d(pt.X + tol, pt.Y + tol, pt.Z + tol))
                cand = []
                def cb(sender, e):
                    if e.Id != self_index:
                        cand.append(e.Id)
                tree.Search(bb, cb)
                k = 0
                while k < len(cand):
                    j = cand[k]
                    lj = lines_in[j]
                    t, d = LineUtils._closest_param_and_dist(lj, pt)
                    if d <= tol:
                        if best_d is None or d < best_d:
                            best_d = d
                            best_j = j
                            best_t = t
                    k += 1
                if best_j == -1:
                    return None
                lj = lines_in[best_j]
                tgt = lj.PointAt(best_t)
                if tgt.DistanceTo(lj.From) <= tol:
                    return lj.From
                if tgt.DistanceTo(lj.To) <= tol:
                    return lj.To
                return tgt
    
            tgt0 = best_target(p0, i)
            if tgt0 is not None:
                q0 = tgt0
            tgt1 = best_target(p1, i)
            if tgt1 is not None:
                q1 = tgt1
    
            if q0.DistanceTo(q1) > tol:
                out.append(rg.Line(q0, q1))
            else:
                out.append(ln)
        return out
    
    
    @staticmethod
    def snap_polylines_points_to_lines(polylines_in, lines_in, tol=GLOBAL_TOL, keepempty = False):
        """
        takes a list of polyline and a list of lines for every point in that polyline 
        (not rebuilding the polyline itself, keeping it as is) first search if that 
        point is within tolerance of any of those lines endpoint, if so move it there, 
        if not check if the point is within tolerance of any line itself (finite portion) 
        if yes pull it to that line (closest if multiple hit)
        """
        out = []
        if not polylines_in:
            return out
        if not lines_in:
            for pl in polylines_in:
                if pl and pl.IsValid:
                    out.append(pl)
            return out
    
        tree, bboxes = LineUtils._build_rtree_for_lines(lines_in, tol)
        endpoints = []
        j = 0
        while j < len(lines_in):
            ln = lines_in[j]
            if ln and ln.IsValid:
                endpoints.append(ln.From)
                endpoints.append(ln.To)
            j += 1
        uniq_arr = rg.Point3d.CullDuplicates(endpoints, tol)
        uniq_endpts = []
        if uniq_arr:
            i = 0
            while i < len(uniq_arr):
                uniq_endpts.append(uniq_arr[i])
                i += 1
        else:
            i = 0
            while i < len(endpoints):
                uniq_endpts.append(endpoints[i])
                i += 1
    
        def closest_endpoint(pt):
            best = None
            bestd2 = None
            i = 0
            r2 = tol * tol
            while i < len(uniq_endpts):
                q = uniq_endpts[i]
                dx = q.X - pt.X
                dy = q.Y - pt.Y
                dz = q.Z - pt.Z
                d2 = dx*dx + dy*dy + dz*dz
                if d2 <= r2:
                    if best is None or d2 < bestd2:
                        best = q
                        bestd2 = d2
                i += 1
            return best
    
        def closest_on_any_line(pt):
            best = None
            bestd = None
            bb = rg.BoundingBox(rg.Point3d(pt.X - tol, pt.Y - tol, pt.Z - tol), rg.Point3d(pt.X + tol, pt.Y + tol, pt.Z + tol))
            cand = []
            def cb(sender, e):
                cand.append(e.Id)
            tree.Search(bb, cb)
            i = 0
            while i < len(cand):
                idx = cand[i]
                ln = lines_in[idx]
                t, d = LineUtils._closest_param_and_dist(ln, pt)
                if d <= tol:
                    q = ln.PointAt(t)
                    if best is None or d < bestd:
                        best = q
                        bestd = d
                i += 1
            return best
    
        for pl in polylines_in:
            if not pl or not pl.IsValid:
                if keepempty:
                    out.append(None)
                continue
            pts = []
            for i in range(pl.Count):
                p = pl[i]
                ep = closest_endpoint(p)
                if ep is not None:
                    pts.append(ep)
                else:
                    q = closest_on_any_line(p)
                    if q is not None:
                        pts.append(q)
                    else:
                        pts.append(p)
            newpl = rg.Polyline(pts)
            out.append(newpl)
        return out


    @staticmethod
    def vector_between_lines(line1, line2, tol=GLOBAL_TOL):
        """
        Return the shortest vector to move line1 (as infinite) onto line2 (as infinite).
        """
        p1 = line1.From
        p2 = line2.From
        v  = line2.Direction
        w0 = p1 - p2
        t  = (v * w0) / (v * v)
        projection = p2 + v * t
        return projection - p1

    @staticmethod
    def push_line(line, axis, rects):
        """
        Translates a line out of overlapping rectangles in one step:
        vertical lines move horizontally, horizontal lines move vertically.
        """
        # normalize axis so that callers can provide orientation names or axes
        axis_key = axis
        try:
            string_types = (basestring,)  # type: ignore[name-defined]
        except NameError:  # Python 3
            string_types = (str,)
        if isinstance(axis_key, string_types):
            axis_key = axis_key.lower()
        if axis_key in ('vertical', LineUtils.Orientation.VERTICAL):
            axis_key = 'x'
        elif axis_key in ('horizontal', LineUtils.Orientation.HORIZONTAL):
            axis_key = 'y'

        if axis_key not in ('x', 'y'):
            return rg.Vector3d(0, 0, 0)

        # determine which orientation defines the domain we need to test
        perp_orientation = (LineUtils.Orientation.VERTICAL if axis_key == 'x'
                            else LineUtils.Orientation.HORIZONTAL)
        domain = LineUtils.get_domain(line, perp_orientation)

        # midpoint coordinate along the axis we are translating on
        center = (LineUtils.get_position(line, LineUtils.Orientation.VERTICAL)
                  if axis_key == 'x'
                  else LineUtils.get_position(line, LineUtils.Orientation.HORIZONTAL))

        intervals = []
        for r in rects:
            o = r.Plane.Origin
            if axis_key == 'x':
                perp_int = (o.Y + r.Y.Min, o.Y + r.Y.Max)
                axis_int = (o.X + r.X.Min, o.X + r.X.Max)
            else:
                perp_int = (o.X + r.X.Min, o.X + r.X.Max)
                axis_int = (o.Y + r.Y.Min, o.Y + r.Y.Max)
            if LineUtils.domains_overlap(domain, perp_int):
                intervals.append((min(axis_int), max(axis_int)))

        if not intervals:
            return rg.Vector3d(0, 0, 0)

        merged = LineUtils.merge_intervals(intervals)

        push = 0.0
        for idx, (u_min, u_max) in enumerate(merged):
            if center + GLOBAL_TOL < u_min or center - GLOBAL_TOL > u_max:
                continue

            # compute offsets needed to exit on either side of the interval
            left_target = u_min - GLOBAL_TOL
            right_target = u_max + GLOBAL_TOL
            left_offset = left_target - center
            right_offset = right_target - center

            # choose direction requiring the least translation magnitude
            if abs(left_offset) <= abs(right_offset):
                push = left_offset
            else:
                push = right_offset
            break

        if axis_key == 'x':
            return rg.Vector3d(push, 0, 0)
        return rg.Vector3d(0, push, 0)

    @staticmethod
    def push_line_constrained(line, axis, rects, minpar, maxpar, bestpar = 0):
        """
        Translates a line out of overlapping rectangles in one step:
        vertical lines move horizontally, horizontal lines move vertically.
        Will not push outside constraints, if the target push goes beyond
        constraints will fallback on bestparameter or fallback to 0 if abscent
        """
        #for debugging
        # override axis: vertical lines -> horizontal movement, else -> vertical
        #axis = 'x' if LineUtils.is_vertical(line) else 'y'
        if axis == 'x':
            perp_orient = 'vertical'
        else: 
            perp_orient = 'horizontal'
        
        #bestpar = None
        # domain on the perpendicular axis
        domain = LineUtils.get_domain(line, perp_orient)
        # center coordinate on the movement axis
        c = (line.From.X + line.To.X) / 2.0 if axis == 'x' else (line.From.Y + line.To.Y) / 2.0

        # collect movement‐axis intervals from rects overlapping in perp domain
        intervals = []
        for r in rects:
            o = r.Plane.Origin
            if axis == 'x':
                perp_int = (o.Y + r.Y.Min, o.Y + r.Y.Max)
                axis_int = (o.X + r.X.Min, o.X + r.X.Max)
            else:
                perp_int = (o.X + r.X.Min, o.X + r.X.Max)
                axis_int = (o.Y + r.Y.Min, o.Y + r.Y.Max)
            if LineUtils.domains_overlap(domain, perp_int):
                intervals.append(axis_int)
        
        pushvector = rg.Vector3d(0, 0, 0)
        
        # merge and find containing interval
        for u_min, u_max in LineUtils.merge_intervals(intervals):
            if c > u_min + GLOBAL_TOL and c < u_max - GLOBAL_TOL:
                off = 0
                if abs(u_min - c) < abs(u_max - c):
                    off = (u_min - c) 
                else:
                    off = (u_max - c)
                
                if axis == 'x':
                    parameter = line.From.X
                    moved = parameter+off

                    if moved < maxpar and moved > minpar:
                        pushvector = rg.Vector3d(off, 0, 0)
                    elif moved >= maxpar:
                        if bestpar:
                            offset = moved-bestpar
                        else:
                            offset = moved-maxpar
                        pushvector = rg.Vector3d(off - offset, 0, 0)

                    elif moved <= minpar:
                        if bestpar:
                            offset = moved-bestpar
                        else:
                            offset = moved-minpar
                        pushvector = rg.Vector3d(off - offset, 0, 0)

                else: #if "y"
                    parameter = line.From.Y
                    moved = parameter+off

                    if moved < maxpar and moved > minpar:
                        pushvector = rg.Vector3d(0, off, 0)
                    elif moved >= maxpar:
                        if bestpar:
                            offset = moved-bestpar
                        else:
                            offset = moved-maxpar
                        pushvector = rg.Vector3d(0, off - offset, 0)

                    elif moved <= minpar:
                        if bestpar:
                            offset = moved-bestpar
                        else:
                            offset = moved-minpar
                        pushvector = rg.Vector3d(0, off - offset, 0)
                
                break

        # no overlap -> no move
        return pushvector

    @staticmethod
    def push_lines_onepass(lines, rects, axis='x', spacebuffer_value=5.0, tol=GLOBAL_TOL):
        """
        One‑pass, center‑out resolver that moves all parallel segments together,
        preserving order and respecting no‑fly rectangles.
        Minimal spacing between neighbors = min(original_gap, spacebuffer_value).
        axis: 'x' -> move in X (vertical lines), 'y' -> move in Y (horizontal lines)
        Returns list[rg.Vector3d] in the same order as 'lines'.
        """
        if not lines:
            return []

        # Movement axis and PERPENDICULAR orientation (critical fix)
        if axis == 'x':
            # vertical lines move in X -> use Y domain for overlap tests
            def pos(ln):  # center on X
                return (ln.From.X + ln.To.X) * 0.5
            def dom_perp(ln):  # Y-interval
                y0, y1 = ln.From.Y, ln.To.Y
                return (y0, y1) if y0 <= y1 else (y1, y0)
        else:
            # horizontal lines move in Y -> use X domain for overlap tests
            def pos(ln):  # center on Y
                return (ln.From.Y + ln.To.Y) * 0.5
            def dom_perp(ln):  # X-interval
                x0, x1 = ln.From.X, ln.To.X
                return (x0, x1) if x0 <= x1 else (x1, x0)

        # Per‑line data
        n = len(lines)
        positions = [pos(ln) for ln in lines]
        domains   = [dom_perp(ln) for ln in lines]

        # For each line, collect union of movement‑axis intervals from rects
        # whose PERP interval overlaps the line’s PERP domain
        def _merge(ints):
            return LineUtils.merge_intervals(ints, tol) if ints else []

        covers = [[] for _ in range(n)]
        for i in range(n):
            ivs = []
            dperp_lo, dperp_hi = domains[i]
            for r in rects:
                o = r.Plane.Origin
                if axis == 'x':
                    # vertical move: perp=Y, axis=X
                    perp_iv = (o.Y + r.Y.Min, o.Y + r.Y.Max)
                    axis_iv = (o.X + r.X.Min, o.X + r.X.Max)
                else:
                    # horizontal move: perp=X, axis=Y
                    perp_iv = (o.X + r.X.Min, o.X + r.X.Max)
                    axis_iv = (o.Y + r.Y.Min, o.Y + r.Y.Max)
                # overlap test on PERP axis
                if (dperp_hi + tol >= min(perp_iv) and dperp_lo <= max(perp_iv) + tol):
                    a0, a1 = axis_iv
                    if a1 < a0:
                        a0, a1 = a1, a0
                    ivs.append((a0, a1))
            covers[i] = _merge(ivs)

        # Partition into components by PERP overlap (sweep)
        idxs = sorted(range(n), key=lambda i: domains[i][0])
        comps = []
        if idxs:
            cur = [idxs[0]]
            cur_max = domains[idxs[0]][1]
            for j in idxs[1:]:
                lo, hi = domains[j]
                if lo <= cur_max + tol:
                    cur.append(j)
                    if hi > cur_max:
                        cur_max = hi
                else:
                    comps.append(cur)
                    cur = [j]
                    cur_max = hi
            comps.append(cur)

        # Utilities to clear out of a merged union in one step
        def _contains(ints, u):
            for a, b in ints:
                if u >= a - tol and u <= b + tol:
                    return (a, b)
            return None
        def _clear_left(i_idx, x):
            iv = _contains(covers[i_idx], x)
            return (iv[0] - tol) if iv is not None else x
        def _clear_right(i_idx, x):
            iv = _contains(covers[i_idx], x)
            return (iv[1] + tol) if iv is not None else x

        offsets = [0.0] * n

        for comp in comps:
            comp_sorted = sorted(comp, key=lambda i: positions[i])
            x0   = [positions[i] for i in comp_sorted]
            xnew = list(x0)
            m = len(comp_sorted)
            
            if m == 0:
                continue

            # Neighbor spacing = min(original gap, spacebuffer_value)
            dmin = [min(x0[k+1] - x0[k], spacebuffer_value) for k in range(m - 1)]

            # Center‑out deterministic order (alternate sides)
            order = []
            if m % 2 == 1:
                mid = m // 2
                order.append(mid)
                for d in range(1, m):
                    r = mid + d
                    l = mid - d
                    if r < m:
                        order.append(r)
                    if l >= 0:
                        order.append(l)
            else:
                left = (m // 2) - 1
                right = (m // 2)
                order.extend([left, right])
                for d in range(1, m):
                    r = right + d
                    l = left - d
                    if r < m:
                        order.append(r)
                    if l >= 0:
                        order.append(l)

            # Process center‑out
            for j in order:
                i_idx = comp_sorted[j]
                cur   = xnew[j]
                iv    = _contains(covers[i_idx], cur)
                if iv is None:
                    continue

                # Cheapest initial escape (ties -> left)
                left_target  = iv[0] - tol
                right_target = iv[1] + tol
                left_cost    = cur - left_target
                right_cost   = right_target - cur

                if left_cost <= right_cost:
                    xnew[j] = _clear_left(i_idx, left_target)
                    # chain left
                    for k in range(j - 1, -1, -1):
                        need   = dmin[k]
                        target = xnew[k + 1] - need
                        if xnew[k] > target:
                            xnew[k] = target
                        idk = comp_sorted[k]
                        xnew[k] = _clear_left(idk, xnew[k])
                else:
                    xnew[j] = _clear_right(i_idx, right_target)
                    # chain right
                    for k in range(j + 1, m):
                        need   = dmin[k - 1]
                        target = xnew[k - 1] + need
                        if xnew[k] < target:
                            xnew[k] = target
                        idk = comp_sorted[k]
                        xnew[k] = _clear_right(idk, xnew[k])

            # write back offsets
            for j, idx in enumerate(comp_sorted):
                offsets[idx] = xnew[j] - x0[j]

        # Build vectors in original order
        if axis == 'x':
            return [rg.Vector3d(offsets[i], 0.0, 0.0) for i in range(n)]
        else:
            return [rg.Vector3d(0.0, offsets[i], 0.0) for i in range(n)]

    @staticmethod
    def push_verticals_onepass(lines, rects, spacebuffer_value=5.0, tol=GLOBAL_TOL):
        return LineUtils.push_lines_onepass(lines, rects, axis='x',
                                            spacebuffer_value=spacebuffer_value, tol=tol)

    @staticmethod
    def push_horizontals_onepass(lines, rects, spacebuffer_value=5.0, tol=GLOBAL_TOL):
        return LineUtils.push_lines_onepass(lines, rects, axis='y',
                                            spacebuffer_value=spacebuffer_value, tol=tol)

    def lxl(line, lines, tol=GLOBAL_TOL):
        """
        Checks whether a finite line intersects any line in a list within a
        given tolerance, returning True on the first valid interior
        intersection. The tolerance can be optionally specified.
        """
        flag = False
        
        for l in lines:
            bool, p1, p2 = rg.Intersect.Intersection.LineLine(line, l, tol, True) #finite

            if bool:
                if p1 < 1.0 - tol and p1 > tol:
                    flag =True
                    break
        return flag
    
    @staticmethod
    def lxb(line, boxes, infinite = False):
        """
        Determines if a line intersects any Box in a list by testing overlapping
        parametric intervals,
        returning True if any hit occurs.
        """
        boxhit = False
       
        for box in boxes:
            #this treats line as infinite, so hits are not the only parameter to judge 
            #intersections
            bhit, interval = rg.Intersect.Intersection.LineBox(line, box, 0.0)
            #ist, iend = interval
            #smaller = min(ist, iend)
            #inint = smaller > 0.0 and smaller < 1.0 #in interval
            inint = LineUtils.domains_overlap(rg.Interval(0.0, 1.0), interval)
            
            if bhit:
                if infinite or inint:
                    boxhit = True
                    break
        #return False
        return boxhit
    
    #Rhinocommon only has line x box
    @staticmethod
    def lxr(line, rectangles, infinite = False):
        """
        Tests intersection between a line and Rectangle3d list,
        returning True if any hit occurs.
        """
        boxes = map(LineUtils.rectangle_to_box, rectangles)
        return LineUtils.lxb(line, boxes, infinite)

    @staticmethod
    def poly_hits_rects(polyline, rectangles):
        """
        Returns True if any finite segment of the polyline intersects
        any of the given Rectangle3d objects
        """
        if polyline is None:
            return False
        if not rectangles:
            return False
        for i in range(polyline.SegmentCount):
            seg = polyline.SegmentAt(i)
            if LineUtils.lxr(seg, rectangles):
                return True
        return False

    @staticmethod
    def line_inside_percentage(line, rectangles):
        """
        Calculates the percentage of a line's length that lies strictly within any
        given Rectangle3d objects, returning a float 0.0–100.0.
        """
        if line.Length <= 0:
            return 0.0

        intervals = []
        seg_dom = rg.Interval(0.0, 1.0)

        for rect in rectangles:
            box = LineUtils.rectangle_to_box(rect, thickness=10.0)
            hit, iv = rg.Intersect.Intersection.LineBox(line, box, GLOBAL_TOL)
            if not hit:
                continue
            t0, t1 = iv.Min, iv.Max
            lo = max(seg_dom.Min, min(t0, t1))
            hi = min(seg_dom.Max, max(t0, t1))
            if hi > lo + GLOBAL_TOL:
                intervals.append((lo, hi))

        merged = LineUtils.merge_intervals(intervals)
        covered = sum(b - a for a, b in merged)
        return (covered * 100.0)

    @staticmethod
    def filter_same_direction(line, lines, tol=GLOBAL_TOL):
        """
        Returns a list of booleans indicating if each line in 'lines' shares the
        general direction of 'line', ignoring sign. Uses dot product with tolerance
        to determine near-parallelism.
        """
        # get unit direction of reference line
        d0 = line.Direction
        d0.Unitize()
        flags = []
        for l in lines:
            # unit direction of test line
            d = l.Direction
            d.Unitize()
            # absolute dot gives 1.0 for parallel or anti-parallel
            flags.append(abs(d0 * d) >= 1.0 - tol)
        return flags

    @staticmethod
    def filter_by_flag(items, flags):
        """
        Returns only those items whose corresponding flag is True.
        """
        return list(itertools.compress(items, flags))

    @staticmethod
    def is_vertical(line, tol=GLOBAL_TOL):
        """
        Returns True if a line is effectively vertical within a given tolerance.
        """
        return abs(line.From.X - line.To.X) < tol
    
    @staticmethod
    def is_horizontal(line, tol=GLOBAL_TOL):
        """
        Returns True if a line is effectively horizontal within a given tolerance.
        """
        return abs(line.From.Y - line.To.Y) < tol

    @staticmethod
    def orientation_of_line(line, tol=GLOBAL_TOL):
        """
        Return Orientation constant for a line.
        """
        if LineUtils.is_vertical(line, tol):
            return LineUtils.Orientation.VERTICAL
        if LineUtils.is_horizontal(line, tol):
            return LineUtils.Orientation.HORIZONTAL
        return LineUtils.Orientation.NONORTH

    @staticmethod
    def get_position(line, orientation):
        """
        Calculates the midpoint coordinate of a line along the specified orientation
        (“vertical” or “horizontal”).
        """
        if orientation == LineUtils.Orientation.VERTICAL:
            return (line.From.X + line.To.X) / 2.0
        elif orientation == LineUtils.Orientation.HORIZONTAL:
            return (line.From.Y + line.To.Y) / 2.0
        return 0.0
    
    @staticmethod
    def get_domain(line, orientation):
        """
        Returns the sorted [min, max] coordinates of a line along the specified
        orientation (“vertical” or “horizontal”).
        """
        if orientation == LineUtils.Orientation.VERTICAL:
            return sorted([line.From.Y, line.To.Y])
        elif orientation == LineUtils.Orientation.HORIZONTAL:
            return sorted([line.From.X, line.To.X])
        return [0.0, 0.0]
    
    @staticmethod
    def domains_overlap(d1, d2, tol=1e-6):
        """
        Returns True if two numeric domains overlap within the given tolerance.
        """
        return (d1[1] + tol >= d2[0]) and (d2[1] + tol >= d1[0])
    
    @staticmethod
    def create_line(pos, domain, orientation):
        """
        Constructs a vertical or horizontal line at a fixed coordinate,
        spanning the specified domain (“vertical” or “horizontal”).
        """
        if orientation == LineUtils.Orientation.VERTICAL:
            pt1 = rg.Point3d(pos, domain[0], 0)
            pt2 = rg.Point3d(pos, domain[1], 0)
        elif orientation == LineUtils.Orientation.HORIZONTAL:
            pt1 = rg.Point3d(domain[0], pos, 0)
            pt2 = rg.Point3d(domain[1], pos, 0)
        return rg.Line(pt1, pt2)
    
    @staticmethod
    def group_lines(sorted_lines, grouper, orientation, weight_map=None):
        """
        Clusters sorted lines by proximity: lines within grouper distance and
        overlapping domains are merged into groups (“vertical” or “horizontal”).
        """
        groups = []
        for idx, line in sorted_lines:
            pos = LineUtils.get_position(line, orientation)
            dom = LineUtils.get_domain(line, orientation)
            merged = False
            
            # compute this line's weight
            if weight_map:
                weight = weight_map.get(idx, 1.0)
            else:
                weight = 1.0
            
            for g in groups:
                if abs(pos - LineUtils.get_position(g['target'], orientation)) < grouper:
                    if LineUtils.domains_overlap(dom, LineUtils.get_domain(g['target'], orientation)):
                        gdom = LineUtils.get_domain(g['target'], orientation)
                        new_dom = [min(dom[0], gdom[0]), max(dom[1], gdom[1])]
                        
                        # compute the target line's weight
                        tgt_idx = g['target_idx']                              
                        tgt_weight = weight_map.get(tgt_idx, 1.0) if weight_map else 1.0 
                        
                        if line.Length * weight >= g['target'].Length * tgt_weight:   
                            new_pos = pos 
                            g['target_idx'] = idx 
                        else:
                            new_pos = LineUtils.get_position(g['target'], orientation)
                        g['target'] = LineUtils.create_line(new_pos, new_dom, orientation)
                        g['members'].append((idx, line))
                        merged = True
                        break
            if not merged:
                # initialize target_idx for weight lookups
                groups.append({'target': line, 'members': [(idx, line)], 'target_idx': idx})
                
        return groups
    
    @staticmethod
    def transform_line(line, transform):
        """
        Applies a given Transform to a copy of a line.
        """
        tline = rg.Line(line.From, line.To)
        tline.Transform(transform)
        return tline
    
    #try moving origin line and check for intersections before operation
    @staticmethod
    def compute_transform(orig_line, target_line, orientation, avoidrects = []):
        """
        Computes a translation Transform to align one line to another along an
        orientation, optionally avoiding collisions with rectangles.
        """
        checkcollision = len(avoidrects) > 0

        if orientation == LineUtils.Orientation.VERTICAL:
            dx = target_line.From.X - orig_line.From.X
            vec = rg.Vector3d(dx, 0, 0)
            
        elif orientation == LineUtils.Orientation.HORIZONTAL:
            dy = target_line.From.Y - orig_line.From.Y
            vec = rg.Vector3d(0, dy, 0)
        else:
            return rg.Transform.Identity

        translation = rg.Transform.Translation(vec)
        if checkcollision:
            checkline = LineUtils.transform_line(orig_line, translation)
            if not LineUtils.lxr(checkline, avoidrects):
                return translation
            return rg.Transform.Identity
            
        #fallback
        return translation
        
    @staticmethod
    def grouper(lines, grouper, noflies = [], weight_map=None, keyed = False, pull_mode = 0):
        """
        Identifies vertical and horizontal lines and groups them by proximity,
        computes translations to align group members, and returns a list of
        transforms for all lines.

        pull_mode:
            0 - pull to longest (legacy)
            1 - pull to weighted average position of group
            2 - pull to middle (midrange) position of group
        """
        vert = []
        horiz = []
        nonorth = {}
        i = 0
        while i < len(lines):
            line = lines[i]
            if LineUtils.is_vertical(line):
                vert.append((i, line))
            elif LineUtils.is_horizontal(line):
                horiz.append((i, line))
            else:
                nonorth[i] = rg.Transform.Identity
            i += 1

        vert_sorted = sorted(vert, key=lambda x: LineUtils.get_position(x[1], LineUtils.Orientation.VERTICAL))
        horiz_sorted = sorted(horiz, key=lambda x: LineUtils.get_position(x[1], LineUtils.Orientation.HORIZONTAL))

        transforms = {}
        groups_dict = {}
        group_idx = 0

        def _compute_group_target_line(group, orientation):
            if pull_mode == 0:
                return group['target']

            dom_min = None
            dom_max = None
            positions = []
            weights = []
            j = 0
            while j < len(group['members']):
                idx, ln = group['members'][j]
                dom = LineUtils.get_domain(ln, orientation)
                if dom_min is None or dom[0] < dom_min:
                    dom_min = dom[0]
                if dom_max is None or dom[1] > dom_max:
                    dom_max = dom[1]
                pos = LineUtils.get_position(ln, orientation)
                positions.append(pos)

                if weight_map:
                    w = weight_map.get(idx, 1.0)
                else:
                    w = 1.0
                w = w * ln.Length
                weights.append(w)
                j += 1

            if dom_min is None or dom_max is None or not positions:
                return group['target']

            if pull_mode == 1:
                target_pos = LineUtils.weighted_average(positions, weights)
            elif pull_mode == 2:
                min_pos = min(positions)
                max_pos = max(positions)
                target_pos = (min_pos + max_pos) * 0.5
            else:
                target_pos = LineUtils.get_position(group['target'], orientation)

            dom_list = [dom_min, dom_max]
            return LineUtils.create_line(target_pos, dom_list, orientation)

        for g in LineUtils.group_lines(vert_sorted, grouper, LineUtils.Orientation.VERTICAL, weight_map):
            member_ids = []
            target_line = _compute_group_target_line(g, LineUtils.Orientation.VERTICAL)
            k = 0
            while k < len(g['members']):
                idx, orig = g['members'][k]
                transforms[idx] = LineUtils.compute_transform(orig, target_line, LineUtils.Orientation.VERTICAL, noflies)
                member_ids.append(idx)
                k += 1
            groups_dict[group_idx] = member_ids
            group_idx += 1

        for g in LineUtils.group_lines(horiz_sorted, grouper, LineUtils.Orientation.HORIZONTAL, weight_map):
            member_ids = []
            target_line = _compute_group_target_line(g, LineUtils.Orientation.HORIZONTAL)
            k = 0
            while k < len(g['members']):
                idx, orig = g['members'][k]
                transforms[idx] = LineUtils.compute_transform(orig, target_line, LineUtils.Orientation.HORIZONTAL, noflies)
                member_ids.append(idx)
                k += 1
            groups_dict[group_idx] = member_ids
            group_idx += 1

        for key_idx in nonorth:
            transforms[key_idx] = nonorth[key_idx]

        if keyed:
            return transforms, groups_dict
        else:
            return [transforms[i] for i in sorted(transforms.keys())]

    @staticmethod
    def filter_unique_nonzero(values, tol = GLOBAL_TOL):
        """
        Filters a list of numeric values, returning only those non-zero above
        tolerance and unique within tolerance.
        """
        unique = []
        for v in values:
            if abs(v) > tol and not any(abs(v - u) <= tol for u in unique):
                unique.append(v)
        return unique
        
    @staticmethod
    def largest_by_abs(values):
        """
        Returns the value with the greatest absolute magnitude from a list,
        or zero if the list is empty.
        """
        if len(values):
            return max(values, key=abs)
        else:
            return 0.0
            
    @staticmethod
    def consecutive_pairs(lst):
        """
        Converts a list of values into a list of consecutive two-element pairs.
        """
        if len(lst) < 2: return []
        return [[lst[i], lst[i+1]] for i in range(len(lst)-1)]

    @staticmethod
    def weighted_average(values, weights):
        """
        Calculates the weighted average of a list of numeric values given corresponding
        weights, returning a float. If weights sum to zero or lists mismatch, returns 0.0.
        """
        # mismatch or empty -> zero
        if len(values) != len(weights) or not values:
            return 0.0

        total = 0.0
        wsum = 0.0
        for v, w in zip(values, weights):
            total += v * w
            wsum += w

        # avoid division by zero
        if abs(wsum) < GLOBAL_TOL:
            return 0.0

        return total / wsum

    @staticmethod
    def average_point(points):
        """
        Arithmetic mean of a list of rg.Point3d.
        """
        if not points:
            return rg.Point3d(0, 0, 0)

        sx = 0.0
        sy = 0.0
        sz = 0.0
        n = len(points)
        
        for p in points:
            sx += p.X
            sy += p.Y
            sz += p.Z

        return rg.Point3d(sx / n, sy / n, sz / n)

    @staticmethod
    def median_point(points):
        """
        Coordinate-wise median (middle value) of the points.
        """
        if not points:
            return rg.Point3d(0, 0, 0)

        xs = sorted([p.X for p in points])
        ys = sorted([p.Y for p in points])
        zs = sorted([p.Z for p in points])
        n = len(points)
        mid = n // 2

        def _med(arr):
            if n % 2 == 1:
                return arr[mid]
            return (arr[mid - 1] + arr[mid]) * 0.5

        return rg.Point3d(_med(xs), _med(ys), _med(zs))

    @staticmethod
    def midrange_point(points):
        """
        Midpoint of min and max along each axis.
        """
        if not points:
            return rg.Point3d(0, 0, 0)

        xs = [p.X for p in points]
        ys = [p.Y for p in points]
        zs = [p.Z for p in points]

        return rg.Point3d(
            (min(xs) + max(xs)) * 0.5,
            (min(ys) + max(ys)) * 0.5,
            (min(zs) + max(zs)) * 0.5
        )

    @staticmethod
    def geometric_median_point(points, max_iters = 50, tol = GLOBAL_TOL):
        """
        Geometric median: the point minimizing sum of distances to all points.
        Uses Weiszfeld's algorithm; falls back to average if coincident.
        """
        n = len(points)
        if n == 0:
            return rg.Point3d(0, 0, 0)

        # start at the centroid
        current = LineUtils.average_point(points)
        for i in range(max_iters):
            num_x = 0.0
            num_y = 0.0
            num_z = 0.0
            denom = 0.0
            for p in points:
                dx = current.X - p.X
                dy = current.Y - p.Y
                dz = current.Z - p.Z
                dist = math.sqrt(dx * dx + dy * dy + dz * dz)
                if dist < tol:
                    # one point is at current => that's the median
                    return p
                w = 1.0 / dist
                num_x += p.X * w
                num_y += p.Y * w
                num_z += p.Z * w
                denom += w

            next_pt = rg.Point3d(num_x / denom, num_y / denom, num_z / denom)
            move = current.DistanceTo(next_pt)
            current = next_pt
            if move < tol:
                break

        return current

    @staticmethod
    def central_point(points, style="average"):
        """
        Returns a central point of 'points' according to 'style'.
        Styles: "average", "median", "midrange", "geometric"
        """
        if style == "average":
            return LineUtils.average_point(points)
        if style == "median":
            return LineUtils.median_point(points)
        if style == "midrange":
            return LineUtils.midrange_point(points)
        if style == "geometric":
            return LineUtils.geometric_median_point(points)

    @staticmethod
    def create_cells_from_grid(lines, tol=GLOBAL_TOL):
        """
        Build closed cell polylines from a planar line grid.
        Returns a list polylines one per cell.
        """
    
        if not lines:
            return []
    
        segs = LineUtils.split_lines_at_intersections(lines, tol, include_endpoints=True)
        if not segs:
            segs = lines
    
        key_to_pt = {}
        def _key_for_point(pt):
            k = LineUtils._find_point_group2d(key_to_pt, pt.X, pt.Y, tol)
            if k is None:
                k = (pt.X, pt.Y)
                key_to_pt[k] = rg.Point3d(pt.X, pt.Y, 0)
            return k
    
        halfedges = []
        edge_lookup = {}
        verts = {}
    
        for ln in segs:
            a = _key_for_point(ln.From)
            b = _key_for_point(ln.To)
    
            he_ab = {"origin": a, "target": b, "twin": None, "visited": False}
            he_ba = {"origin": b, "target": a, "twin": None, "visited": False}
    
            halfedges.append(he_ab)
            halfedges.append(he_ba)
    
            edge_lookup[(a, b)] = he_ab
            edge_lookup[(b, a)] = he_ba
    
            if a not in verts:
                verts[a] = []
            if b not in verts:
                verts[b] = []
            verts[a].append(he_ab)
            verts[b].append(he_ba)
    
        def _he_angle(he):
            ox, oy = he["origin"]
            tx, ty = he["target"]
            dx = tx - ox
            dy = ty - oy
            ang = math.atan2(dy, dx)
            if ang < 0.0:
                ang = ang + 2.0 * math.pi
            return ang
    
        for v in verts:
            lst = verts[v]
            lst.sort(key=_he_angle)
    
        for he in halfedges:
            twin = edge_lookup.get((he["target"], he["origin"]))
            he["twin"] = twin
    
        def _next_rule(he):
            if he["twin"] is None:
                return None
            v = he["target"]
            lst = verts.get(v)
            if not lst:
                return None
            try:
                idx = lst.index(he["twin"])
            except:
                return None
            if len(lst) == 0:
                return None
            nxt = lst[(idx - 1) % len(lst)]
            return nxt
    
        def _polygon_area(keys):
            area = 0.0
            i = 0
            while i < len(keys) - 1:
                x1 = keys[i][0]
                y1 = keys[i][1]
                x2 = keys[i + 1][0]
                y2 = keys[i + 1][1]
                area = area + (x1 * y2 - x2 * y1)
                i = i + 1
            if area < 0.0:
                area = -area
            return 0.5 * area
    
        faces = []
        for he in halfedges:
            if he["visited"]:
                continue
            if he["twin"] is None:
                continue
    
            face = []
            start = he
            cur = he
            steps = 0
    
            while True:
                he["visited"] = True
                face.append(cur["origin"])
    
                nxt = _next_rule(cur)
                if nxt is None:
                    break
    
                if nxt == start:
                    face.append(start["origin"])
                    break
    
                cur = nxt
                he = cur
                steps = steps + 1
                if steps > 10000:
                    break
    
            if len(face) > 3:
                faces.append(face)
    
        if not faces:
            return []
    
        biggest = None
        biggest_idx = -1
        i = 0
        while i < len(faces):
            a = _polygon_area(faces[i])
            if biggest is None or a > biggest:
                biggest = a
                biggest_idx = i
            i = i + 1
    
        cells = []
        i = 0
        while i < len(faces):
            if i != biggest_idx:
                keys = faces[i]
                if keys[0] != keys[-1]:
                    keys = list(keys)
                    keys.append(keys[0])
    
                pl = rg.Polyline()
                j = 0
                while j < len(keys):
                    k = keys[j]
                    pt = key_to_pt[k]
                    pl.Add(pt)
                    j = j + 1
    
                if pl.Count >= 4:
                    pl.MergeColinearSegments(tol, True)
                    if pl.IsClosed:
                        cells.append(pl)
            i = i + 1
    
        return cells

    @staticmethod
    def unique_points(points, tol=1e-8):
        """
        Return unique 2D points (XY plane) within a given tolerance.
        """
        unique = []
        for p in points:
            if not any(abs(p.X - q.X) < tol and abs(p.Y - q.Y) < tol for q in unique):
                unique.append(p)
        return unique

    @staticmethod
    def _circumcircle_contains(a, b, c, p):
        """
        Return True if p lies inside the circumcircle of triangle (a, b, c).
        """
        ax, ay = a.X, a.Y
        bx, by = b.X, b.Y
        cx, cy = c.X, c.Y
        dx, dy = p.X, p.Y
        d = 2*(ax*(by-cy) + bx*(cy-ay) + cx*(ay-by))
        
        if abs(d) < 1e-8:
            return False
            
        asq = ax*ax + ay*ay
        bsq = bx*bx + by*by
        csq = cx*cx + cy*cy
        ux = (asq*(by-cy) + bsq*(cy-ay) + csq*(ay-by)) / d
        uy = (asq*(cx-bx) + bsq*(ax-cx) + csq*(bx-ax)) / d
        return ((dx-ux)**2 + (dy-uy)**2) < ((ax-ux)**2 + (ay-uy)**2)

    @staticmethod
    def _delaunay(points):
        """
        Bowyer–Watson Delaunay triangulation of 2D points.
        Returns list of index triples into `points`.
        """
        pts = [(p.X, p.Y) for p in points]
        n = len(pts)
        xs, ys = zip(*pts)
        xmin, xmax = min(xs), max(xs)
        ymin, ymax = min(ys), max(ys)
        dx, dy = xmax-xmin, ymax-ymin
        dmax = max(dx, dy)
        mx, my = (xmin+xmax)/2.0, (ymin+ymax)/2.0
        super_pts = [
            (mx-2*dmax, my-dmax),
            (mx,        my+2*dmax),
            (mx+2*dmax, my-dmax)
        ]
        ext = pts + super_pts
        tris = [(n, n+1, n+2)]
        for i, (x, y) in enumerate(pts):
            bad, edges = [], {}
            for tri in tris:
                xi, yi = ext[tri[0]]; a = rg.Point3d(xi, yi, 0)
                xj, yj = ext[tri[1]]; b = rg.Point3d(xj, yj, 0)
                xk, yk = ext[tri[2]]; c = rg.Point3d(xk, yk, 0)
                p = rg.Point3d(x, y, 0)
                if LineUtils._circumcircle_contains(a, b, c, p):
                    bad.append(tri)
                    for u, v in ((tri[0],tri[1]), (tri[1],tri[2]), (tri[2],tri[0])):
                        key = tuple(sorted((u, v)))
                        edges[key] = edges.get(key, 0) + 1
            tris = [t for t in tris if t not in bad]
            for (u, v), cnt in edges.items():
                if cnt == 1:
                    tris.append((u, v, i))
        # remove triangles using super-vertices
        return [t for t in tris if all(j < n for j in t)]

    @staticmethod
    def _alpha_shape_edges(points, alpha):
        """
        Return boundary edges of the α-shape for 2D points.
        """
        tris = LineUtils._delaunay(points)
        edge_count = {}
        for tri in tris:
            a, b, c = (points[j] for j in tri)
            ab, ac = b-a, c-a
            d = 2*(ab.X*ac.Y - ab.Y*ac.X)
            if abs(d) < 1e-8:
                continue
            asq = ab.X*ab.X + ab.Y*ab.Y
            csq = ac.X*ac.X + ac.Y*ac.Y
            cx = (ac.Y*asq - ab.Y*csq) / d
            cy = (ab.X*csq - ac.X*asq) / d
            if math.hypot(cx, cy) <= alpha:
                for u, v in ((tri[0],tri[1]), (tri[1],tri[2]), (tri[2],tri[0])):
                    key = tuple(sorted((u, v)))
                    edge_count[key] = edge_count.get(key, 0) + 1
        return [edge for edge, cnt in edge_count.items() if cnt == 1]

    @staticmethod
    def estimate_alpha(points):
        """
        Estimate a good alpha value based on point spread.
        """
        unique = LineUtils.unique_points(points)
        if len(unique) < 2:
            return 1.0
        xs = [p.X for p in unique]; ys = [p.Y for p in unique]
        dx = max(xs) - min(xs); dy = max(ys) - min(ys)
        diag = math.hypot(dx, dy)
        finetune = 5.0 #extra multiplier hand picked
        return (diag / math.sqrt(len(unique))) * finetune

    @staticmethod
    def concave_hull_points(points, alpha=None):
        """
        Return list of Lines forming the concave hull of Point3d list (XY).
        """
        pts2d = [rg.Point3d(p.X, p.Y, 0) for p in points]
        unique = LineUtils.unique_points(pts2d)
        if alpha is None:
            alpha = LineUtils.estimate_alpha(unique)
        edges = LineUtils._alpha_shape_edges(unique, alpha)
        return [rg.Line(unique[i], unique[j]) for i, j in edges]

    @staticmethod
    def concave_hull_lines(lines, alpha=None):
        """
        Return concave hull of line segments by their endpoints.
        """
        pts = []
        for ln in lines:
            pts.append(rg.Point3d(ln.From.X, ln.From.Y, 0))
            pts.append(rg.Point3d(ln.To.X,   ln.To.Y,   0))
        return LineUtils.concave_hull_points(pts, alpha)

    @staticmethod
    def join_lines(lines, mergecollinear=True, tol=1e-8):
        """
        Join lines into polylines by connecting touching endpoints.
        """
        endpoints = []
        for ln in lines:
            endpoints.append(rg.Point3d(ln.From.X, ln.From.Y, 0))
            endpoints.append(rg.Point3d(ln.To.X,   ln.To.Y,   0))
        unique = {}
        for p in endpoints:
            key = (round(p.X/tol), round(p.Y/tol))
            if key not in unique:
                unique[key] = (p.X, p.Y)
        adj = {}
        for idx, ln in enumerate(lines):
            p1 = (round(ln.From.X/tol), round(ln.From.Y/tol))
            p2 = (round(ln.To.X/tol),   round(ln.To.Y/tol))
            adj.setdefault(p1, []).append((p2, idx))
            adj.setdefault(p2, []).append((p1, idx))
        visited = set()
        polylines = []
        for idx, ln in enumerate(lines):
            if idx in visited:
                continue
            start = (round(ln.From.X/tol), round(ln.From.Y/tol))
            comp_keys = set([start]); comp_lines = set()
            queue = [start]
            while queue:
                k = queue.pop(0)
                for neigh, li in adj.get(k, []):
                    comp_lines.add(li)
                    if neigh not in comp_keys:
                        comp_keys.add(neigh)
                        queue.append(neigh)
            deg_one = [k for k in comp_keys if sum(1 for (n,li) in adj[k] if li in comp_lines) == 1]
            cur = deg_one[0] if deg_one else start
            pts_seq = [cur]
            while True:
                found = False
                for neigh, li in adj[cur]:
                    if li in comp_lines and li not in visited:
                        visited.add(li)
                        pts_seq.append(neigh)
                        cur = neigh
                        found = True
                        break
                if not found:
                    break
            pline = rg.Polyline([rg.Point3d(unique[k][0], unique[k][1], 0) for k in pts_seq])
            polylines.append(pline)
        
        if mergecollinear:
            for poly in polylines:
                poly.MergeColinearSegments(GLOBAL_TOL, True)
        
        return polylines

    @staticmethod
    def circle_points(center, radius, count):
        """
        Returns a list of `count` rg.Point3d objects evenly distributed around
        a circle of given `radius` centered at `center`.
        """
        # guard: count must be int ≥ 1
        if not isinstance(count, int) or count < 1:
            return None
        else:
            pts = []
            
            for i in range(count):
                angle = 2.0 * math.pi * i / count
                x = center.X + radius * math.cos(angle)
                y = center.Y + radius * math.sin(angle)
                z = center.Z
                pts.append(rg.Point3d(x, y, z))
            
            return pts

    @staticmethod
    def _point_in_poly(pt, polyl, tol=1e-6):
        """
        returns True if pt is inside or on boundary.
        Uses distance-to-edge for boundary, then ray-casting for in/out.
        """
        # prepare closed vertex list
        pts = list(polyl)
        if not pts:
            return False
        if pts[0] != pts[-1]:
            pts.append(pts[0])
        x, y = pt.X, pt.Y
        
        # if the point is very close to any edge, count it as inside
        for i in range(len(pts)-1):
            if LineUtils._dist_point_seg(pt, pts[i], pts[i+1], tol) <= tol:
                return True
        
        # ray-casting
        inside = False
        for i in range(len(pts)-1):
            xi, yi = pts[i].X, pts[i].Y
            xj, yj = pts[i+1].X, pts[i+1].Y
            # check edge straddles horizontal ray
            if ((yi > y) != (yj > y)):
                xint = xi + (y - yi) * (xj - xi) / (yj - yi)
                if x < xint:
                    inside = not inside
        return inside

    @staticmethod
    def _dist_point_seg(pt, a, b, tol=1e-6):
        """
        Euclidean distance from point pt to segment AB.
        """
        vx, vy = b.X - a.X, b.Y - a.Y
        wx, wy = pt.X - a.X, pt.Y - a.Y
        denom = vx*vx + vy*vy
        if denom < tol:
            return math.hypot(wx, wy)
        t = (wx*vx + wy*vy) / denom
        if t <= 0:
            return math.hypot(wx, wy)
        if t >= 1:
            dx, dy = pt.X - b.X, pt.Y - b.Y
            return math.hypot(dx, dy)
        projx = a.X + t * vx
        projy = a.Y + t * vy
        return math.hypot(pt.X - projx, pt.Y - projy)

    @staticmethod
    def _interp(pa, pb, va, vb, iso, tol=1e-6):
        """
        Linear interpolate between points pa and pb where sdf crosses iso.
        """
        if abs(vb - va) < tol:
            t = 0.5
        else:
            t = (iso - va) / float(vb - va)
        return rg.Point3d(
            pa.X + t*(pb.X - pa.X),
            pa.Y + t*(pb.Y - pa.Y),
            0
        )

    @staticmethod
    def offset_polyline(pline, offset, resolution=50, tol=1e-6):
        """
        SDF-based offset of a planar polyline (XY plane only).
        returns list of Polylines (possibly multiple loops).
        """
        # close the loop
        verts = list(pline)
        if verts and verts[0] != verts[-1]:
            verts.append(verts[0])
    
        # compute bbox and pad offset margin
        margin = 0.1
        xs = [p.X for p in verts]
        ys = [p.Y for p in verts]
        
        minx, maxx = min(xs), max(xs)
        miny, maxy = min(ys), max(ys)
        
        w0 = maxx - minx
        h0 = maxy - miny
        
        pad_x = margin * w0
        pad_y = margin * h0
        m = abs(offset)
        
        minx -= pad_x + m
        maxx += pad_x + m
        miny -= pad_y + m
        maxy += pad_y + m
    
        # grid dimensions
        width, height = maxx - minx, maxy - miny
        cell = max(width, height) / float(resolution)
        nx, ny = int(round(width/cell)), int(round(height/cell))
    
        # sample signed distance field
        vals = [[0.0]*(nx+1) for _ in range(ny+1)]
        for i in range(ny+1):
            y = miny + i*cell
            for j in range(nx+1):
                x = minx + j*cell
                p = rg.Point3d(x, y, 0)
                inside = LineUtils._point_in_poly(p, verts, tol)
                dmin = min(
                    LineUtils._dist_point_seg(p, a, b, tol)
                    for a, b in zip(verts, verts[1:])
                )
                vals[i][j] = -dmin if inside else dmin
    
        # marching squares at iso=offset
        iso, lines = offset, []
        for i in range(ny):
            for j in range(nx):
                v0, v1 = vals[i][j],     vals[i][j+1]
                v3, v2 = vals[i+1][j],   vals[i+1][j+1]
                pts = [
                    rg.Point3d(minx+j*cell,   miny+i*cell,   0),
                    rg.Point3d(minx+(j+1)*cell, miny+i*cell,   0),
                    rg.Point3d(minx+(j+1)*cell, miny+(i+1)*cell, 0),
                    rg.Point3d(minx+j*cell,     miny+(i+1)*cell, 0)
                ]
                cs = [v >= iso for v in (v0, v1, v2, v3)]
                case = (cs[0]<<3)|(cs[1]<<2)|(cs[2]<<1)|cs[3]
                if case in (0, 15):
                    continue
    
                edges = []
                for k, (c_curr, c_next) in enumerate(zip(cs, cs[1:]+cs[:1])):
                    if c_curr != c_next:
                        a, b = pts[k], pts[(k+1)%4]
                        va, vb = (v0, v1, v2, v3)[k], (v1, v2, v3, v0)[k]
                        edges.append(LineUtils._interp(a, b, va, vb, iso, tol))
    
                if len(edges) == 2:
                    lines.append(rg.Line(edges[0], edges[1]))
                elif len(edges) == 4:
                    if case in (5, 10):
                        lines.append(rg.Line(edges[0], edges[3]))
                        lines.append(rg.Line(edges[1], edges[2]))
                    else:
                        lines.append(rg.Line(edges[0], edges[1]))
                        lines.append(rg.Line(edges[2], edges[3]))
    
        return LineUtils.join_lines(lines, mergecollinear=True, tol=tol)

    @staticmethod
    def filter_external_polylines(polylines, tol=1e-6):
        """
        Return only those closed polylines that are not fully contained
        within any other polyline in the list.
        """
        external = []
        for i, pl in enumerate(polylines):
            # get distinct vertices (drop closing duplicate)
            pts = list(pl)
            if pts and pts[0] == pts[-1]:
                pts = pts[:-1]
            # check if all vertices lie inside some other polyline
            inside_any = False
            for j, other in enumerate(polylines):
                if i == j:
                    continue
                other_pts = list(other)
                if other_pts and other_pts[0] == other_pts[-1]:
                    other_pts = other_pts[:-1]
                # test all vertices of pl against other
                if all(LineUtils._point_in_poly(p, other_pts, tol) for p in pts):
                    inside_any = True
                    break
            if not inside_any:
                external.append(pl)
        return external

    @staticmethod
    def is_point_in_any_polyline(pt, polylines, tol=1e-6):
        """
        Return True if point pt lies inside or on the boundary of
        any closed polyline in the given list.
        """
        for pl in polylines:
            pts = list(pl)
            # drop closing duplicate
            if pts and pts[0] == pts[-1]:
                pts = pts[:-1]
            if LineUtils._point_in_poly(pt, pts, tol):
                return True
        return False

    @staticmethod
    def time_block(name):
        """
        Use as: with LineUtils.time_block('name of what is being profiled')
        """
        class _Timer(object):
            def __enter__(self_inner):
                self_inner.t0 = time.clock()
                return self_inner
            def __exit__(self_inner, exc_type, exc, tb):
                dt = time.clock() - self_inner.t0
                print('%s took %.3f s' % (name, dt))
        return _Timer()

    @staticmethod
    def profile(func):
        """
        Use as decorator: @LineUtils.profile
        """
        def wrapper(*args, **kwargs):
            t0 = time.clock()
            result = func(*args, **kwargs)
            dt = time.clock() - t0
            print('%s took %.3f s' % (func.__name__, dt))
            return result
        return wrapper

    @staticmethod
    def timeout(seconds):
        """
        Use as decorator: @LineUtils.timeout(5)
        If the wrapped function doesn’t finish in <seconds>, returns "expired".
        """
        def decorator(func):
            def wrapper(*args, **kwargs):
                result = [None]
                exception = [None]
                def target():
                    try:
                        result[0] = func(*args, **kwargs)
                    except Exception as e:
                        exception[0] = e

                thread = System.Threading.Thread(System.Threading.ThreadStart(target))
                thread.IsBackground = True
                thread.Start()

                if not thread.Join(int(seconds * 1000)):
                    thread.Abort()
                    return "expired"

                if exception[0]:
                    # re-raise original exception
                    raise exception[0]
                return result[0]
            return wrapper
        return decorator

    @staticmethod
    def run_with_timeout(func, seconds):
        """
        Use as: LineUtils.run_with_timeout(lambda: your_func(arg1, arg2), 5)
        Returns the function’s result, or "expired" if it times out.
        """
        result = [None]
        exception = [None]
        def target():
            try:
                result[0] = func()
            except Exception as e:
                exception[0] = e

        thread = System.Threading.Thread(System.Threading.ThreadStart(target))
        thread.IsBackground = True
        thread.Start()

        if not thread.Join(int(seconds * 1000)):
            thread.Abort()
            return "expired"

        if exception[0]:
            raise exception[0]
        return result[0]

    @staticmethod
    def parallel(func, args_list, max_threads=4):
        """
        Use as: results = LineUtils.parallel(my_func, [a, b, c], max_threads=4)
        Runs my_func(item) over each item in args_list in up to max_threads
        concurrent threads. Returns a list of results in the same order.
        If any call raises, returns "failed to compute"
        """
        n = len(args_list)
        results = [None] * n
        exceptions = [None] * n
        idx = [0]
        lock = System.Object()

        def worker():
            while True:
                System.Threading.Monitor.Enter(lock)
                try:
                    if idx[0] >= n:
                        break
                    i = idx[0]
                    idx[0] += 1
                finally:
                    System.Threading.Monitor.Exit(lock)

                try:
                    results[i] = func(args_list[i])
                except Exception as e:
                    exceptions[i] = e

        # spawn up to max_threads workers
        threads = []
        count = max_threads if max_threads < n else n
        for _ in range(count):
            t = System.Threading.Thread(System.Threading.ThreadStart(worker))
            t.IsBackground = True
            t.Start()
            threads.append(t)

        # wait for all to finish
        for t in threads:
            t.Join()

        # re-raise first exception, if any
        for e in exceptions:
            if e:
                return "failed to compute"

        return results

    @staticmethod
    def clip_line_rectangle(line, rect, tol=GLOBAL_TOL):
        """
        Clip a line segment to a rectangle using the Liang-Barsky algorithm.
        """
        bb = rect.BoundingBox
        x0, y0, z0 = line.From.X, line.From.Y, line.From.Z
        x1, y1, z1 = line.To.X, line.To.Y, line.To.Z
        dx = x1 - x0
        dy = y1 - y0
        dz = z1 - z0
        p = [-dx, dx, -dy, dy]
        q = [x0 - bb.Min.X, bb.Max.X - x0, y0 - bb.Min.Y, bb.Max.Y - y0]
        u1, u2 = 0.0, 1.0
        for pi, qi in zip(p, q):
            if abs(pi) < tol:
                if qi < 0:
                    return []
            else:
                t = qi / float(pi)
                if pi < 0:
                    if t > u2:
                        return []
                    if t > u1:
                        u1 = t
                else:
                    if t < u1:
                        return []
                    if t < u2:
                        u2 = t
        if u2 < u1:
            return []
        p0 = rg.Point3d(x0 + u1*dx, y0 + u1*dy, z0 + u1*dz)
        p1 = rg.Point3d(x0 + u2*dx, y0 + u2*dy, z0 + u2*dz)
        return [rg.Line(p0, p1)]

    @staticmethod
    def polyline_intersection_rect(pline, rect, tol=GLOBAL_TOL):
        """
        Return list of Polyline segments of `pline` inside `rect`.
        """
        inside = []
        current = []
        pts = list(pline)
        for a, b in zip(pts, pts[1:]):
            segs = LineUtils.clip_line_rectangle(rg.Line(a, b), rect, tol)
            if not segs:
                if current:
                    inside.append(rg.Polyline(current))
                    current = []
                continue
            seg = segs[0]
            if not current:
                current.append(seg.From)
            current.append(seg.To)
        if current:
            inside.append(rg.Polyline(current))
        return inside

    @staticmethod
    def polyline_difference_rect(pline, rect, tol=GLOBAL_TOL):
        """
        Return polyline segments of `pline` outside `rect`.
        """
        segments = []
        pts = list(pline)
        for a, b in zip(pts, pts[1:]):
            outs = LineUtils.line_outside_rectangles(rg.Line(a, b), [rect], 10.0, tol)
            segments.extend([rg.Polyline([seg.From, seg.To]) for seg in outs])
        return segments
    
    @staticmethod
    def segment_to_segment_distance(seg1, seg2):
        """
        Compute the shortest distance between two finite line segments seg1 and seg2 (rg.Line).
        """
        A = seg1.From
        B = seg1.To
        C = seg2.From
        D = seg2.To
    
        # direction vectors
        u = B - A
        v = D - C
        w0 = A - C
    
        a = u * u  # dot(u, u)
        b = u * v  # dot(u, v)
        c = v * v  # dot(v, v)
        d = u * w0 # dot(u, w0)
        e = v * w0 # dot(v, w0)
    
        denom = a * c - b * b
        # initial (s, t) for infinite lines
        if abs(denom) > 1e-12:
            s = (b * e - c * d) / denom
            t = (a * e - b * d) / denom
        else:
            # parallel or nearly parallel
            s = 0.0
            if abs(c) > 1e-12:
                t = e / c
            else:
                t = 0.0
    
        # clamp s, t to [0,1]
        if s < 0.0:
            s = 0.0
        elif s > 1.0:
            s = 1.0
    
        if t < 0.0:
            t = 0.0
        elif t > 1.0:
            t = 1.0
    
        # After clamping one, recompute the other if needed
        # Check if s was clamped
        if s == 0.0 or s == 1.0:
            # solve for t that minimizes distance to P(s)
            Ps = rg.Point3d(
                A.X + u.X * s,
                A.Y + u.Y * s,
                A.Z + u.Z * s
            )
            w = Ps - C
            if abs(c) > 1e-12:
                t_candidate = (v * w) / c
                if t_candidate < 0.0:
                    t = 0.0
                elif t_candidate > 1.0:
                    t = 1.0
                else:
                    t = t_candidate
    
        # Check if t was clamped
        if t == 0.0 or t == 1.0:
            # solve for s that minimizes distance to Q(t)
            Qt = rg.Point3d(
                C.X + v.X * t,
                C.Y + v.Y * t,
                C.Z + v.Z * t
            )
            w = A - Qt
            if abs(a) > 1e-12:
                s_candidate = (u * w) / a
                if s_candidate < 0.0:
                    s = 0.0
                elif s_candidate > 1.0:
                    s = 1.0
                else:
                    s = s_candidate
    
        # Closest points on each segment
        P_closest = rg.Point3d(
            A.X + u.X * s,
            A.Y + u.Y * s,
            A.Z + u.Z * s
        )
        Q_closest = rg.Point3d(
            C.X + v.X * t,
            C.Y + v.Y * t,
            C.Z + v.Z * t
        )
    
        return P_closest.DistanceTo(Q_closest)

    @staticmethod
    def simplify_polyline(pline, tol=GLOBAL_TOL):
        """
        Simplify a polyline using the Ramer-Douglas-Peucker algorithm.
        """
        pts = list(pline)
        if len(pts) <= 2:
            return rg.Polyline(pts)
        keep = [0, len(pts)-1]
        stack = [(0, len(pts)-1)]
        while stack:
            s, e = stack.pop()
            a, b = pts[s], pts[e]
            ax, ay, az = a.X, a.Y, a.Z
            bx, by, bz = b.X, b.Y, b.Z
            dx, dy, dz = bx-ax, by-ay, bz-az
            d2 = dx*dx + dy*dy + dz*dz
            maxd = -1.0
            idx = None
            for i in range(s+1, e):
                p = pts[i]
                if d2 == 0:
                    dist = a.DistanceTo(p)
                else:
                    t = ((p.X-ax)*dx + (p.Y-ay)*dy + (p.Z-az)*dz) / d2
                    t = max(0.0, min(1.0, t))
                    proj = rg.Point3d(ax+t*dx, ay+t*dy, az+t*dz)
                    dist = p.DistanceTo(proj)
                if dist > maxd:
                    maxd = dist
                    idx = i
            if maxd > tol and idx is not None:
                stack.append((s, idx))
                stack.append((idx, e))
            else:
                keep.append(e)
        keep = sorted(set(keep))
        simp = [pts[i] for i in keep]
        return rg.Polyline(simp)

    @staticmethod
    def smooth_polyline(pline, factor=0.25, iterations=1):
        """
        Smooth a polyline using Chaikin's algorithm.
        """
        pts = list(pline)
        closed = pts[0] == pts[-1]
        for _ in range(iterations):
            new_pts = []
            rng = range(len(pts)-1) if not closed else range(len(pts))
            for i in rng:
                p0 = pts[i]
                p1 = pts[(i+1) % len(pts)]
                q = rg.Point3d(
                    p0.X + factor*(p1.X - p0.X),
                    p0.Y + factor*(p1.Y - p0.Y),
                    p0.Z + factor*(p1.Z - p0.Z)
                )
                r = rg.Point3d(
                    p1.X - factor*(p1.X - p0.X),
                    p1.Y - factor*(p1.Y - p0.Y),
                    p1.Z - factor*(p1.Z - p0.Z)
                )
                new_pts.extend([q, r])
            if not closed:
                new_pts = [pts[0]] + new_pts + [pts[-1]]
            else:
                new_pts.append(new_pts[0])
            pts = new_pts
        return rg.Polyline(pts)

    @staticmethod
    def _cross2d(a, b, c):
        return (b.X - a.X)*(c.Y - a.Y) - (b.Y - a.Y)*(c.X - a.X)

    @staticmethod
    def convex_hull(points):
        """
        Return the convex hull of 2D points.
        """
        pts = LineUtils.unique_points([rg.Point3d(p.X, p.Y, 0) for p in points])
        if len(pts) <= 1:
            return pts
        pts.sort(key=lambda p: (p.X, p.Y))
        lower = []
        for p in pts:
            while len(lower) >= 2 and LineUtils._cross2d(lower[-2], lower[-1], p) <= 0:
                lower.pop()
            lower.append(p)
        upper = []
        for p in reversed(pts):
            while len(upper) >= 2 and LineUtils._cross2d(upper[-2], upper[-1], p) <= 0:
                upper.pop()
            upper.append(p)
        return lower[:-1] + upper[:-1]

    @staticmethod
    def laplacian_smooth_polyline(pline, factor=0.5, iterations=1):
        """
        Smooth a polyline using Laplacian smoothing.

        Each interior vertex moves toward the average of its neighbors by
        `factor` on each iteration. Endpoints of an open polyline are kept
        fixed. A closed polyline is treated as a loop.
        """
        pts = list(pline)
        if len(pts) <= 2:
            return rg.Polyline(pts)
        closed = pts[0] == pts[-1]
        for _ in range(iterations):
            new_pts = [pts[0]] if not closed else []
            n = len(pts) - 1 if closed else len(pts)
            for i in range(1 if not closed else 0, n - 1):
                prev_pt = pts[i - 1]
                next_pt = pts[(i + 1) % len(pts)]
                cur_pt = pts[i]
                x = cur_pt.X + factor * ((prev_pt.X + next_pt.X) / 2.0 - cur_pt.X)
                y = cur_pt.Y + factor * ((prev_pt.Y + next_pt.Y) / 2.0 - cur_pt.Y)
                z = cur_pt.Z + factor * ((prev_pt.Z + next_pt.Z) / 2.0 - cur_pt.Z)
                new_pts.append(rg.Point3d(x, y, z))
            if closed:
                new_pts.append(new_pts[0])
            else:
                new_pts.append(pts[-1])
            pts = new_pts
        return rg.Polyline(pts)

    @staticmethod
    def minimum_bounding_rectangle(points):
        """
        Compute oriented minimum bounding rectangle of points.
        """
        hull = LineUtils.convex_hull(points)
        if not hull:
            return None
        if len(hull) == 1:
            p = hull[0]
            plane = rg.Plane(p, rg.Vector3d.XAxis, rg.Vector3d.YAxis)
            return rg.Rectangle3d(plane, 0.0, 0.0)
        min_area = None
        best_rect = None
        n = len(hull)
        for i in range(n):
            p0 = hull[i]
            p1 = hull[(i+1) % n]
            ang = math.atan2(p1.Y - p0.Y, p1.X - p0.X)
            cos_a = math.cos(-ang)
            sin_a = math.sin(-ang)
            xs = []
            ys = []
            for p in hull:
                x = p.X * cos_a - p.Y * sin_a
                y = p.X * sin_a + p.Y * cos_a
                xs.append(x)
                ys.append(y)
            minx, maxx = min(xs), max(xs)
            miny, maxy = min(ys), max(ys)
            area = (maxx - minx) * (maxy - miny)
            if min_area is None or area < min_area:
                min_area = area
                cx = (minx + maxx) / 2.0
                cy = (miny + maxy) / 2.0
                cos_ang = math.cos(ang)
                sin_ang = math.sin(ang)
                center = rg.Point3d(
                    cos_ang*cx - sin_ang*cy,
                    sin_ang*cx + cos_ang*cy,
                    0
                )
                plane = rg.Plane(center,
                                 rg.Vector3d(cos_ang, sin_ang, 0),
                                 rg.Vector3d(-sin_ang, cos_ang, 0))
                xint = rg.Interval(minx - cx, maxx - cx)
                yint = rg.Interval(miny - cy, maxy - cy)
                best_rect = rg.Rectangle3d(plane, xint, yint)
        return best_rect

    @staticmethod
    def _segments_intersect(a1, a2, b1, b2, tol=GLOBAL_TOL):
        def ccw(p1, p2, p3):
            return (p3.Y - p1.Y)*(p2.X - p1.X) > (p2.Y - p1.Y)*(p3.X - p1.X)
        if (max(a1.X, a2.X) + tol < min(b1.X, b2.X) or
            max(b1.X, b2.X) + tol < min(a1.X, a2.X) or
            max(a1.Y, a2.Y) + tol < min(b1.Y, b2.Y) or
            max(b1.Y, b2.Y) + tol < min(a1.Y, a2.Y)):
            return False
        d1 = ccw(a1, b1, b2)
        d2 = ccw(a2, b1, b2)
        d3 = ccw(a1, a2, b1)
        d4 = ccw(a1, a2, b2)
        if d1 != d2 and d3 != d4:
            return True
        return False

    @staticmethod
    def sweep_line_intersections(lines, tol=GLOBAL_TOL):
        """
        Find all segment index pairs that intersect using a sweep algorithm.
        """
        events = []
        for idx, ln in enumerate(lines):
            minx = min(ln.From.X, ln.To.X)
            maxx = max(ln.From.X, ln.To.X)
            events.append((minx, 0, idx))
            events.append((maxx, 1, idx))
        events.sort()
        active = []
        hits = []
        for x, typ, idx in events:
            if typ == 0:
                for j in active:
                    if LineUtils._segments_intersect(lines[idx].From, lines[idx].To,
                                                    lines[j].From, lines[j].To, tol):
                        hits.append((idx, j))
                active.append(idx)
            else:
                if idx in active:
                    active.remove(idx)
        return hits

    @staticmethod
    def find_furthest_point(test_point, points):
        """
        Return the point in 'points' farthest from 'test_point'.
        """
        furthest = None
        max_dist = -float('inf')
        for p in points:
            d = test_point.DistanceTo(p)
            if d > max_dist:
                max_dist, furthest = d, p
        return furthest

    @staticmethod
    def circle_center(p1, p2):
        """
        Given two points, return center and radius of their diameter circle.
        """
        cx = (p1.X + p2.X) / 2.0
        cy = (p1.Y + p2.Y) / 2.0
        center = rg.Point3d(cx, cy, 0)
        radius = p1.DistanceTo(p2) / 2.0
        return center, radius

    @staticmethod
    def circle_three_points(p1, p2, p3, tol=GLOBAL_TOL):
        """
        Return center and radius through three non-colinear points, else (None, None).
        """
        # area test for colinearity
        area = p1.X*(p2.Y-p3.Y) + p2.X*(p3.Y-p1.Y) + p3.X*(p1.Y-p2.Y)
        
        if abs(area) < tol:
            return None, None
        
        A = p2.X - p1.X
        B = p2.Y - p1.Y
        C = p3.X - p1.X
        D = p3.Y - p1.Y
        E = A*(p1.X+p2.X) + B*(p1.Y+p2.Y)
        F = C*(p1.X+p3.X) + D*(p1.Y+p3.Y)
        G = 2*(A*(p3.Y-p2.Y) - B*(p3.X-p2.X))
        
        if abs(G) < tol:
            return None, None
            
        cx = (D*E - B*F) / G
        cy = (A*F - C*E) / G
        center = rg.Point3d(cx, cy, 0)
        radius = center.DistanceTo(p1)
        
        return center, radius

    @staticmethod
    def is_point_inside_circle(center, radius, point, tol=GLOBAL_TOL):
        """
        Return True if 'point' lies within or on the circle.
        """
        return point.DistanceTo(center) <= radius + tol

    @staticmethod
    def minimal_enclosing_circle(points, tol=GLOBAL_TOL):
        """
        Compute smallest circle enclosing all points (pairs + triplets method).
        Returns (center, radius) or (None, None) if no points.
        """
        n = len(points)
        
        if n == 0:
            return None, None
        if n == 1:
            return points[0], 0.0
        if n == 2:
            return LineUtils.circle_center(points[0], points[1])
        
        best_c, best_r = None, float('inf')
        
        # pairs
        for i, j in itertools.combinations(range(n), 2):
            c, r = LineUtils.circle_center(points[i], points[j])
            if all(p.DistanceTo(c) <= r + tol for p in points) and r < best_r:
                best_c, best_r = c, r
                
        # triplets
        for i, j, k in itertools.combinations(range(n), 3):
            c, r = LineUtils.circle_three_points(points[i], points[j], points[k], tol)
            if c is not None and all(p.DistanceTo(c) <= r + tol for p in points) and r < best_r:
                best_c, best_r = c, r
                
        return best_c, best_r

    @staticmethod
    def snap_point_to_grid(pt, step):
        """
        Snap a point to the nearest grid location.
        """
        x = round(pt.X / step) * step
        y = round(pt.Y / step) * step
        z = round(pt.Z / step) * step
        return rg.Point3d(x, y, z)

    @staticmethod
    def snap_line_to_grid(line, step):
        """
        Snap both endpoints of a line to the grid.
        """
        return rg.Line(LineUtils.snap_point_to_grid(line.From, step),
                       LineUtils.snap_point_to_grid(line.To, step))

    @staticmethod
    def is_polyline_self_intersecting(pline, tol=1e-8):
        """
        Return True if `pline` self-intersects.
        """
        pts = list(pline)
        segs = [(pts[i], pts[i+1]) for i in range(len(pts)-1)]
        for i in range(len(segs)):
            for j in range(i+1, len(segs)):
                if j == i+1:
                    continue
                if LineUtils._segments_intersect(segs[i][0], segs[i][1], segs[j][0], segs[j][1], tol):
                    return True
        return False

    @staticmethod
    def safe_batch(func, args_list, timeout_sec=5, max_threads=4):
        """
        Run parrallel compute with per-call timeout.
        """
        def wrapped(arg):
            return LineUtils.run_with_timeout(lambda: func(arg), timeout_sec)
        return LineUtils.parallel(wrapped, args_list, max_threads)

    # — Finds individual “measure” tokens (mixed, fraction, int, or feet-only) —
    MEASURE_RE = re.compile(r"""
        (?:
            # 1) Feet + inches (mixed/fraction/int), e.g. -2'-1 1/4", 3'-3/8", 4'-6"
            -?\d+\s*'\s*(?:-\s*)?          # signed feet + apostrophe + optional dash
            (?:
                \d+\s+\d+/\d+             # mixed inches (1 1/4)
              |
                \d+/\d+                   # fraction only (3/8)
              |
                \d+                       # integer inches (6)
            )
            \s*"
          |
            # 2) Mixed inches without feet, e.g. -1 1/4"
            -?\d+\s+\d+/\d+\s*"
          |
            # 3) Fraction only, e.g. -3/8"
            -?\d+/\d+\s*"
          |
            # 4) Integer inches without feet, e.g. -12"
            -?\d+\s*"
          |
            # 5) Feet only, e.g. -6'
            -?\d+\s*'
        )
    """, re.VERBOSE)

    # — Breaks a single token into feet + one of (mixed, fraction, int) inches —
    PARTS_RE = re.compile(r"""
        ^\s*
        (?:(?P<feet>\d+)\s*'\s*(?:-\s*)?)?   # optional feet (e.g. 2')
        (?:
            (?P<inch_int>\d+)\s+(?P<num>\d+)\s*/\s*(?P<den>\d+)  # mixed inches (1 1/4)
          |
            (?P<num2>\d+)\s*/\s*(?P<den2>\d+)                    # fraction only (3/8)
          |
            (?P<inch_only>\d+)                                  # integer inches (6)
        )
        \s*"
        \s*$
    """, re.VERBOSE)

    @staticmethod
    def parse_measure(tok):
        """
        Parse a feet/inches token (possibly negative) into a float number of inches.
        
        Supported forms:
          "0"           ->   0.0
          "1'-0\""      ->  12.0
          "3/4\""       ->   0.75
          "1 1/4\""     ->   1.25
          "2'-1 1/8\""  ->  25.125
          "-4' 0\""     -> -48.0
          "-3/8\""      ->  -0.375
          "6'"          ->  72.0
          "-6'"         -> -72.0

        Returns a float, or an error string if parsing fails.
        """
        tok = tok.strip()
        
        # 1) Handle leading minus
        sign = 1.0
        if tok.startswith('-'):
            sign = -1.0
            tok = tok[1:].strip()

        # 2) Raw number (integer or decimal), e.g. "0", "5", "0.0"
        if tok.replace('.', '', 1).isdigit():
            return sign * float(tok)

        # 3) Feet-only, e.g. "6'" or "-4'"
        if tok.endswith("'"):
            num_feet = tok[:-1].strip()
            if not num_feet.isdigit():
                return "Can't parse measure %r" % (tok + "'")
            return sign * (int(num_feet) * 12.0)

        # 4) Mixed/fraction/int inches (with optional feet)
        m = LineUtils.PARTS_RE.match(tok)
        if not m:
            return "Can't parse measure %r" % tok

        feet = int(m.group('feet')) if m.group('feet') else 0
        inches = 0.0

        # 4a) Mixed inches: "inch_int num/den"
        if m.group('inch_int') and m.group('num') and m.group('den'):
            inch_int = int(m.group('inch_int'))
            num = int(m.group('num'))
            den = int(m.group('den'))
            inches = inch_int + (num / float(den))

        # 4b) Fraction-only: "num2/den2"
        elif m.group('num2') and m.group('den2'):
            num2 = int(m.group('num2'))
            den2 = int(m.group('den2'))
            inches = num2 / float(den2)

        # 4c) Integer-only inches
        elif m.group('inch_only'):
            inches = int(m.group('inch_only'))

        total_inches = feet * 12.0 + inches
        return sign * total_inches

    @staticmethod
    def parse_scale(s):
        """
        Parse a scale string like “1\" = 1'-0\"" (or variations) and return:
          - If two measures found -> (real_inches / draw_inches) as float.
          - If one measure found -> its inch value (float).
          - Otherwise -> an error string.
        """
        # Normalize curly quotes and common words
        s = s.replace('“', '"').replace('”', '"').lower()
        s = re.sub(r'\\([\'"])', r'\1', s) #support for 1/8"=1\'-0" style
        s = re.sub(r'\bft\b', "'", s)
        s = re.sub(r'\bin\b', '"', s)
        s = re.sub(r'\s*=\s*', ' = ', s) #support for 1/8"=1\'-0" style

        # Extract all “measure” tokens
        toks = LineUtils.MEASURE_RE.findall(s)
        if not toks:
            return "No measures found in %r" % s

        # If only one token, return its inch value
        if len(toks) == 1:
            return LineUtils.parse_measure(toks[0])

        # Otherwise, take the first two as draw & real
        draw_tok, real_tok = toks[0], toks[1]

        din = LineUtils.parse_measure(draw_tok)
        if isinstance(din, str):
            return din  # error message

        rin = LineUtils.parse_measure(real_tok)
        if isinstance(rin, str):
            return rin  # error message

        if din == 0:
            return "Drawing measure is zero in %r" % s

        return rin / din

    @staticmethod
    def read_xlsx(file_path, sheetname, filter_word=None):
        """
        Reads all data from the specified sheet in an .xlsx file, returning a list of rows,
        where each row is a list of cell‐values (strings or None). Blank cells become None.
        Any row that is entirely empty—or contains the exact filter_word in any cell—is dropped.
        Any column that is entirely empty (after row‐pruning) is also dropped, so the returned
        grid is rectangular. Errors are printed (e.g. file not found, sheet not found), and
        an empty list is returned on failure.
    
        Args:
            file_path (str): Path to the .xlsx file.
            sheetname (str): Name of the sheet to read.
            filter_word (str or None): If provided, any row containing a cell == filter_word
                                       will be skipped entirely. Default is None (no extra filtering).
    
        Returns:
            List[List[str or None]]: 2D list of cell values, with no entirely‐blank rows or columns,
                                     and with rows containing filter_word removed. Returns [] on errors.
        """
        data = []
        try:
            z = zipfile.ZipFile(file_path, 'r')
        except Exception as e:
            print("Error: cannot open '%s' as a ZIP archive: %s" % (file_path, e))
            return data
    
        # XML namespace constants
        NS_SHEET = '{http://schemas.openxmlformats.org/spreadsheetml/2006/main}'
        NS_REL   = {'ns': 'http://schemas.openxmlformats.org/package/2006/relationships'}
    
        # 1) Find the path to the requested sheet inside the XLSX
        sheet_path = None
        try:
            with z.open('xl/workbook.xml') as wb_file:
                wb_tree = ET.parse(wb_file)
                sheets = wb_tree.findall('.//%ssheet' % NS_SHEET)
                for sheet in sheets:
                    if sheet.get('name') == sheetname:
                        sheet_id = sheet.get(
                            '{http://schemas.openxmlformats.org/officeDocument/2006/relationships}id'
                        )
                        if not sheet_id:
                            print("Error: sheet '%s' has no relationship ID." % sheetname)
                            return data
    
                        try:
                            with z.open('xl/_rels/workbook.xml.rels') as rels_file:
                                rels_tree = ET.parse(rels_file)
                                relationships = rels_tree.findall('.//ns:Relationship', NS_REL)
                                for rel in relationships:
                                    if rel.get('Id') == sheet_id:
                                        target = rel.get('Target')
                                        if not target:
                                            continue
                                        sheet_path = 'xl/' + target.replace('\\', '/')
                                        break
                        except Exception as e_rels:
                            print("Error: cannot read relationships for workbook: %s" % e_rels)
                            return data
    
                        break
    
            if not sheet_path:
                print("Error: sheet named '%s' not found in workbook." % sheetname)
                return data
    
        except Exception as e_wb:
            print("Error: failed to parse 'xl/workbook.xml': %s" % e_wb)
            return data
    
        # 2) Read shared strings (if present)
        shared_strings = []
        try:
            with z.open('xl/sharedStrings.xml') as ss_file:
                ss_tree = ET.parse(ss_file)
                for t in ss_tree.findall('.//%st' % NS_SHEET):
                    shared_strings.append(t.text or '')
        except KeyError:
            # If sharedStrings.xml doesn’t exist, proceed with empty list
            shared_strings = []
        except Exception as e_ss:
            print("Warning: failed to read sharedStrings.xml: %s" % e_ss)
            shared_strings = []
    
        # 3) Parse the sheet XML and collect raw rows
        try:
            with z.open(sheet_path) as sheet_file:
                sheet_tree = ET.parse(sheet_file)
                for row in sheet_tree.findall('.//%srow' % NS_SHEET):
                    row_data = []
                    for c in row.findall('%sc' % NS_SHEET):
                        v = c.find('%sv' % NS_SHEET)
                        if v is None or v.text is None:
                            # no <v> or empty <v> -> treat as None
                            row_data.append(None)
                        else:
                            val = v.text
                            if c.get('t') == 's':
                                try:
                                    idx = int(val)
                                    if 0 <= idx < len(shared_strings):
                                        val = shared_strings[idx]
                                    else:
                                        print("Warning: sharedStrings index %d out of range" % idx)
                                        val = None
                                except Exception:
                                    print("Warning: invalid sharedStrings index '%s'" % val)
                                    val = None
                            row_data.append(val)
                    data.append(row_data)
    
        except KeyError:
            print("Error: cannot open sheet file '%s' in archive." % sheet_path)
            return []
        except Exception as e_sheet:
            print("Error: failed to parse sheet XML '%s': %s" % (sheet_path, e_sheet))
            return []
    
        # If we got no rows at all, return empty
        if not data:
            return []
    
        def is_row_empty(row):
                # empty if every cell is None or whitespace-only
                for cell in row:
                    if cell is None:
                        continue
                    try:
                        s = unicode(cell)
                    except:
                        s = cell
                    if s is None:
                        continue
                    if s.strip() != '':
                        return False
                return True

        pruned_rows = []
        for row in data:
            # 4a) Skip if entire row is empty
            if is_row_empty(row):
                continue
    
            # 4b) Skip if filter_word is provided and matches any cell exactly
            if filter_word is not None:
                skip_due_to_filter = False
                for cell in row:
                    # Compare only non-None cells
                    if cell == filter_word:
                        skip_due_to_filter = True
                        break
                if skip_due_to_filter:
                    continue
    
            # Otherwise, keep the row
            pruned_rows.append(row)
    
        if not pruned_rows:
            # All rows were empty or filtered out -> nothing to return
            return []
    
        # === 5) Pad all rows to the same length with None (so columns line up) ===
        max_cols = max(len(r) for r in pruned_rows)
        for r in pruned_rows:
            if len(r) < max_cols:
                r.extend([None] * (max_cols - len(r)))
    
        return pruned_rows
    
    
    @staticmethod
    def color_from_hsv(h, s, v, alpha = 255.0):
        """
        Construct an HSV (Hue, Saturation, Value) color
        """
        if s == 0.0:
            r = g = b = int(v * 255)
            return System.Drawing.Color.FromArgb(r, g, b)
        
        h = h / 60.0  # Sector 0 to 5
        i = int(System.Math.Floor(h))
        f = h - i
        p = v * (1 - s)
        q = v * (1 - s * f)
        t = v * (1 - s * (1 - f))
        
        if i == 0:
            r, g, b = v, t, p
        elif i == 1:
            r, g, b = q, v, p
        elif i == 2:
            r, g, b = p, v, t
        elif i == 3:
            r, g, b = p, q, v
        elif i == 4:
            r, g, b = t, p, v
        else:
            r, g, b = v, p, q
        
        r = int(round(r * 255))
        g = int(round(g * 255))
        b = int(round(b * 255))
        
        return System.Drawing.Color.FromArgb(alpha, r, g, b)
    
    @staticmethod
    def colors_generator(num_colors, alpha = 255.0):
        """
        Generate n colors equally spaced apart in the hsv scale
        special cases: 1 color -> black, 2 colors -> black/white
        """
        
        n = num_colors
        colors = []
        if n <= 0:
            return colors
        elif n == 1:
            # Return black for n=1
            colors.append(System.Drawing.Color.FromArgb(alpha, 0, 0, 0))
            return colors
        elif n == 2:
            # Return black and white for n=2
            colors.append(System.Drawing.Color.FromArgb(alpha, 0, 0, 0))      # Black
            colors.append(System.Drawing.Color.FromArgb(alpha, 255, 255, 255))# White
            return colors
        
        for i in range(n):
            hue = (i * 360.0 / n) % 360  # Evenly spaced hues
            saturation = 0.9              # High saturation for vibrancy
            value = 0.9                   # High value for brightness
            colors.append(LineUtils.color_from_hsv(hue, saturation, value, alpha))
        
        return colors


    @staticmethod
    def to_xy2(p):
        """
        Convert Rhino point to xy tuple
        Keep z ignored as algorithm is 2D
        Returns float(x), float(y)
        """
        return (float(p.X), float(p.Y))

    @staticmethod
    def bbox_xy(points, pad):
        """
        Compute xy bbox with optional pad
        Pad default is 5% of max span plus epsilon
        Returns (x0, y0, x1, y1)
        """
        xs = [p.X for p in points]
        ys = [p.Y for p in points]
        x0 = min(xs)
        x1 = max(xs)
        y0 = min(ys)
        y1 = max(ys)
        dx = x1 - x0
        dy = y1 - y0
        if pad is None:
            pad_xy = 0.05 * max(dx, dy) + 1e-9
        else:
            pad_xy = pad
        return (x0 - pad_xy, y0 - pad_xy, x1 + pad_xy, y1 + pad_xy)

    @staticmethod
    def same_point(a, b, tol):
        """
        Compare xy tuples with tol
        Returns True or False
        """
        if abs(a[0] - b[0]) <= tol and abs(a[1] - b[1]) <= tol:
            return True
        else:
            return False

    @staticmethod
    def distance_l1(p, q):
        """
        Manhattan distance helper
        Works on 2D tuples
        Returns float
        """
        return abs(p[0] - q[0]) + abs(p[1] - q[1])

    @staticmethod
    def angle(p1, p2):
        """
        Polar angle 0..2Pi
        Based on atan2 with wrap
        Returns float radians
        """
        ang = math.atan2(p2[1] - p1[1], p2[0] - p1[0])
        if ang < 0.0:
            ang = 2.0 * math.pi + ang
        else:
            ang = ang
        return ang

    @staticmethod
    def seg_intersection(l1a, l1b, l2a, l2b, tol):
        """
        Segment intersection in xy
        Returns (x,y) or None
        Handles parallel by denom==0
        """
        x1 = l1a[0]
        y1 = l1a[1]
        x2 = l1b[0]
        y2 = l1b[1]
        x3 = l2a[0]
        y3 = l2a[1]
        x4 = l2b[0]
        y4 = l2b[1]
        denom = (y4 - y3) * (x2 - x1) - (x4 - x3) * (y2 - y1)

        if abs(denom) <= 0.0:
            return None
        ua = ((x4 - x3) * (y1 - y3) - (y4 - y3) * (x1 - x3)) / float(denom)
        ub = ((x2 - x1) * (y1 - y3) - (y2 - y1) * (x1 - x3)) / float(denom)
        if ua < -tol or ua > 1.0 + tol or ub < -tol or ub > 1.0 + tol:
            return None
        xi = x1 + ua * (x2 - x1)
        yi = y1 + ua * (y2 - y1)
        return (xi, yi)

    @staticmethod
    def clean_data(raw):
        """
        Break L1 degeneracy ties
        Tiny jitter when |dx|==|dy|
        In place modification
        """
        n = len(raw)
        i = 0
        while i < n:
            xi = raw[i][0]
            yi = raw[i][1]
            j = i + 1
            while j < n:
                dx = raw[j][0] - xi
                dy = raw[j][1] - yi
                if abs(abs(dx) - abs(dy)) <= 0.0:
                    raw[j] = (raw[j][0] + 1e-10 * yi, raw[j][1] + 2e-10 * raw[j][0])
                else:
                    raw[j] = raw[j]
                j += 1
            i += 1
        return raw

    @staticmethod
    def bisector_intersection(B1, B2, tol):
        """
        Intersect two poly-bisectors
        Scans consecutive segments
        Returns first hit or None
        """
        if B1 is B2:
            return None
        i = 0
        while i < len(B1['points']) - 1:
            a1 = B1['points'][i]
            a2 = B1['points'][i + 1]
            j = 0
            ok = False
            while j < len(B2['points']) - 1:
                b1 = B2['points'][j]
                b2 = B2['points'][j + 1]
                pt = LineUtils.seg_intersection(a1, a2, b1, b2, tol)
                if pt is not None:
                    ok = True
                    break
                else:
                    j += 1
            if ok:
                return pt
            else:
                i += 1
        return None

    @staticmethod
    def is_bisector_trapped(trap_site, bisector):
        """
        Trap test against site
        All points no closer to others
        Returns True or False
        """
        k = 0
        while k < len(bisector['points']):
            pt = bisector['points'][k]
            if LineUtils.distance_l1(trap_site['site'], pt) <= LineUtils.distance_l1(bisector['sites'][0]['site'], pt) and LineUtils.distance_l1(trap_site['site'], pt) <= LineUtils.distance_l1(bisector['sites'][1]['site'], pt):
                k += 1
            else:
                return False
        return True

    @staticmethod
    def trim_bisector(target, intersector, intersection):
        """
        Trim target by intersector
        Keep points nearer to target sites
        Append intersection if present
        """

        polygon_site = None
        for s in intersector['sites']:
            found = False
            for t in target['sites']:
                if s is t:
                    found = True
                    break
                else:
                    found = found
            if not found:
                polygon_site = s
                break
            else:
                polygon_site = polygon_site
        new_pts = []
        k = 0

        while k < len(target['points']):
            p = target['points'][k]
            if LineUtils.distance_l1(p, target['sites'][0]['site']) < LineUtils.distance_l1(p, polygon_site['site']) and LineUtils.distance_l1(p, target['sites'][1]['site']) < LineUtils.distance_l1(p, polygon_site['site']):
                new_pts.append(p)
            else:
                new_pts = new_pts
            k += 1

        if intersection is not None:
            new_pts.append(intersection)
        else:
            new_pts = new_pts

        if target['up']:
            new_pts.sort(key=lambda t: t[1])
        else:
            new_pts.sort(key=lambda t: t[0])

        target['points'] = new_pts

    @staticmethod
    def find_hop_to(bisector, hop_from):
        """
        Hop across bisector ends
        Return opposite site dict
        Simple pointer logic
        """
        if bisector['sites'][0] is hop_from:
            return bisector['sites'][1]
        else:
            return bisector['sites'][0]

    @staticmethod
    def get_extreme_point(bisector, go_up):
        """
        Extreme Y value along bisector
        Max for up, min for down
        Returns float
        """

        val = -1.0e300
        if not go_up:
            val = 1.0e300
        i = 0

        while i < len(bisector['points']):
            y = bisector['points'][i][1]
            if go_up:
                if y > val:
                    val = y
                else:
                    val = val
            else:
                if y < val:
                    val = y
                else:
                    val = val
            i += 1
        return val

    @staticmethod
    def is_new_bisector_upward(hop_to, hop_from, site, go_up):
        """
        Decide stroke direction
        Based on relative geometry
        Returns True or False
        """

        dx = hop_to['site'][0] - site['site'][0]
        dy = hop_to['site'][1] - site['site'][1]
        if abs(dx) <= 0.0:
            return site['site'][1] > hop_to['site'][1]
        else:
            slope = dy / float(dx)
            intercept = hop_to['site'][1] - slope * hop_to['site'][0]
            above = hop_from['site'][1] > slope * hop_from['site'][0] + intercept
            return above

    @staticmethod
    def determine_first_border_cross(cropR, cropL, current_crop_point, tol):
        """
        Which side crosses first
        Compare vertical distances
        Returns "right" "left" or None
        """

        dyR = abs(cropR['point'][1] - current_crop_point[1])
        dyL = abs(cropL['point'][1] - current_crop_point[1])
        if abs(dyR - dyL) <= tol:
            return None
        else:
            if dyR < dyL:
                return "right"
            else:
                return "left"

    @staticmethod
    def clear_out_orphans(orphanage, trap_point):
        """
        Remove trapped bisectors
        Uses is_bisector_trapped
        Returns filtered list
        """

        out = []
        i = 0
        while i < len(orphanage['bisectors']):
            b = orphanage['bisectors'][i]
            if not LineUtils.is_bisector_trapped(trap_point, b):
                out.append(b)
            else:
                out = out
            i += 1
        return out

    @staticmethod
    def find_correct_w(w, nearest_neighbor, find_bisector):
        """
        Walk to a valid neighbor
        Avoid starting on trapped
        Returns site dict
        """

        starting = find_bisector(w, nearest_neighbor)
        traps = []
        i = 0
        while i < len(w['bisectors']):
            b = w['bisectors'][i]
            hop_to = LineUtils.find_hop_to(b, w)
            traps.append({'hopTo': hop_to, 'isTrapped': LineUtils.is_bisector_trapped(hop_to, starting)})
            i += 1
        filt = [t for t in traps if t['isTrapped']]
        if len(filt) > 0:
            filt.sort(key=lambda t: LineUtils.distance_l1(t['hopTo']['site'], nearest_neighbor['site']))
            return LineUtils.find_correct_w(filt[0]['hopTo'], nearest_neighbor, find_bisector)
        else:
            return w

    @staticmethod
    def check_for_orphans(trapper, trapped, go_up, find_bisector):
        """
        Choose trapped candidate
        Heuristic for dead ends
        Returns bisector or None
        """

        cands = []
        i = 0
        while i < len(trapped['bisectors']):
            b = trapped['bisectors'][i]
            hop_to = LineUtils.find_hop_to(b, trapped)
            cond = go_up == (hop_to['site'][1] < trapped['site'][1]) and LineUtils.is_bisector_trapped(trapper, b)
            if cond:
                cands.append(b)
            else:
                cands = cands
            i += 1
        def extreme(bis):
            hop = LineUtils.find_hop_to(bis, trapped)
            ml = find_bisector(hop, trapper)
            return LineUtils.get_extreme_point(ml, go_up)
        if len(cands) == 0:
            return None
        else:
            if go_up:
                cands.sort(key=lambda b: -extreme(b))
            else:
                cands.sort(key=lambda b: extreme(b))
            return cands[0]

    @staticmethod
    def determine_starting_bisector(w, nearest_neighbor, width, last_intersect, find_bisector, tol):
        """
        Pick starting bisector
        Uses rightward probe test
        Returns dict with fields
        """
        if last_intersect is None:
            last_intersect = w['site']
        else:
            last_intersect = last_intersect
        z = [width, w['site'][1]]
        zline = {'points': [w['site'], z]}
        hit = None
        i = 0

        while i < len(nearest_neighbor['bisectors']):
            b = nearest_neighbor['bisectors'][i]
            pt = LineUtils.bisector_intersection(zline, b, tol)
            if pt is not None:
                hit = {'point': pt, 'bisector': b}
                break
            else:
                i += 1
        if hit is not None:
            if LineUtils.distance_l1(w['site'], hit['point']) > LineUtils.distance_l1(nearest_neighbor['site'], hit['point']):
                sb = find_bisector(w, nearest_neighbor)
                return {'startingBisector': sb, 'w': w, 'nearestNeighbor': nearest_neighbor, 'startingIntersection': hit['point']}
            else:
                if LineUtils.distance_l1(w['site'], hit['point']) < LineUtils.distance_l1(nearest_neighbor['site'], hit['point']) and hit['point'][0] > last_intersect[0]:
                    nextR = None
                    if hit['bisector']['sites'][0] is nearest_neighbor:
                        nextR = hit['bisector']['sites'][1]
                    else:
                        nextR = hit['bisector']['sites'][0]
                    return LineUtils.determine_starting_bisector(w, nextR, width, hit['point'], find_bisector, tol)
                else:
                    w2 = LineUtils.find_correct_w(w, nearest_neighbor, find_bisector)
                    sb2 = find_bisector(w2, nearest_neighbor)
                    return {'startingBisector': sb2, 'w': w2, 'nearestNeighbor': nearest_neighbor, 'startingIntersection': hit['point']}
        else:
            w3 = LineUtils.find_correct_w(w, nearest_neighbor, find_bisector)
            sb3 = find_bisector(w3, nearest_neighbor)
            return {'startingBisector': sb3, 'w': w3, 'nearestNeighbor': nearest_neighbor, 'startingIntersection': w3['site']}

    @staticmethod
    def walk_merge_line(currentR, currentL, currentBisector, currentCropPoint, goUp, crossedBorder, mergeArray, find_bisector, width, height, tol):
        """
        Merge walk procedure
        Trims and hops across graph
        Appends visited bisectors
        """

        owns = True
        k = 0

        while k < len(currentBisector['sites']):
            if currentBisector['sites'][k] is currentR or currentBisector['sites'][k] is currentL:
                k += 1
            else:
                owns = False
                break
        if not owns:
            currentBisector = find_bisector(currentR, currentL)
            LineUtils.trim_bisector(currentBisector, crossedBorder, currentCropPoint)
            mergeArray.append(currentBisector)

        cropLArray = []
        i = 0

        while i < len(currentL['bisectors']):
            b = currentL['bisectors'][i]
            pt = LineUtils.bisector_intersection(currentBisector, b, tol)
            if pt is not None:
                hopTo = LineUtils.find_hop_to(b, currentL)
                cond_dir = goUp == LineUtils.is_new_bisector_upward(hopTo, currentL, currentR, goUp)
                cond_dup = not (LineUtils.same_point(pt, currentCropPoint, tol) and b is crossedBorder)
                if cond_dir and cond_dup:
                    cropLArray.append({'bisector': b, 'point': pt})
                else:
                    cropLArray = cropLArray
            else:
                cropLArray = cropLArray
            i += 1

        cropLArray.sort(key=lambda e: LineUtils.angle(currentL['site'], LineUtils.find_hop_to(e['bisector'], currentL)['site']), reverse=True)
        tmp = []
        i = 0

        while i < len(cropLArray):
            e = cropLArray[i]
            hopTo = LineUtils.find_hop_to(e['bisector'], currentL)
            newML = find_bisector(currentR, hopTo)
            LineUtils.trim_bisector(newML, e['bisector'], e['point'])
            ok = True
            j = 0
            while j < len(cropLArray):
                if j != i:
                    otherHop = LineUtils.find_hop_to(cropLArray[j]['bisector'], currentL)
                    if LineUtils.is_bisector_trapped(otherHop, newML) and otherHop is not hopTo:
                        ok = False
                        break
                    else:
                        ok = ok
                else:
                    ok = ok
                j += 1
            if ok:
                tmp.append(e)
            else:
                tmp = tmp
            i += 1

        cropLArray = tmp
        cropRArray = []
        i = 0

        while i < len(currentR['bisectors']):
            b = currentR['bisectors'][i]
            pt = LineUtils.bisector_intersection(currentBisector, b, tol)
            if pt is not None:
                hopTo = LineUtils.find_hop_to(b, currentR)
                cond_dir = goUp == LineUtils.is_new_bisector_upward(hopTo, currentR, currentL, goUp)
                cond_dup = not (LineUtils.same_point(pt, currentCropPoint, tol) and b is crossedBorder)
                if cond_dir and cond_dup:
                    cropRArray.append({'bisector': b, 'point': pt})
                else:
                    cropRArray = cropRArray
            else:
                cropRArray = cropRArray
            i += 1

        cropRArray.sort(key=lambda e: LineUtils.angle(currentR['site'], LineUtils.find_hop_to(e['bisector'], currentR)['site']))
        tmp2 = []
        i = 0

        while i < len(cropRArray):
            e = cropRArray[i]
            hopTo = LineUtils.find_hop_to(e['bisector'], currentR)
            newML = find_bisector(currentL, hopTo)
            LineUtils.trim_bisector(newML, e['bisector'], e['point'])
            ok = True
            j = 0
            while j < len(cropRArray):
                if j != i:
                    otherHop = LineUtils.find_hop_to(cropRArray[j]['bisector'], currentR)
                    if LineUtils.is_bisector_trapped(otherHop, newML) and otherHop is not hopTo:
                        ok = False
                        break
                    else:
                        ok = ok
                else:
                    ok = ok
                j += 1
            if ok:
                tmp2.append(e)
            else:
                tmp2 = tmp2
            i += 1

        cropRArray = tmp2
        cropL = None
        if len(cropLArray) > 0 and cropLArray[0]['bisector'] is not currentBisector:
            cropL = cropLArray[0]
        else:
            if goUp:
                cropL = {'bisector': None, 'point': (float('inf'), float('inf'))}
            else:
                cropL = {'bisector': None, 'point': (-float('inf'), -float('inf'))}
        cropR = None
        if len(cropRArray) > 0 and cropRArray[0]['bisector'] is not currentBisector:
            cropR = cropRArray[0]
        else:
            if goUp:
                cropR = {'bisector': None, 'point': (float('inf'), float('inf'))}
            else:
                cropR = {'bisector': None, 'point': (-float('inf'), -float('inf'))}
        if cropL['bisector'] is None and cropR['bisector'] is None:
            left_orphan = LineUtils.check_for_orphans(currentR, currentL, goUp, find_bisector)
            right_orphan = LineUtils.check_for_orphans(currentL, currentR, goUp, find_bisector)
            if left_orphan is not None:
                for s in left_orphan['sites']:
                    s['bisectors'] = [b for b in s['bisectors'] if b is not left_orphan]
                hopTo = LineUtils.find_hop_to(left_orphan, currentL)
                currentR = LineUtils.find_correct_w(currentR, hopTo, find_bisector)
                newB = find_bisector(hopTo, currentR)
                mergeArray.append(newB)
                return LineUtils.walk_merge_line(currentR, hopTo, newB, currentCropPoint, goUp, crossedBorder, mergeArray, find_bisector, width, height, tol)
            else:
                if right_orphan is not None:
                    for s in right_orphan['sites']:
                        s['bisectors'] = [b for b in s['bisectors'] if b is not right_orphan]
                    hopTo2 = LineUtils.find_hop_to(right_orphan, currentR)
                    currentL = LineUtils.find_correct_w(currentL, hopTo2, find_bisector)
                    newB2 = find_bisector(hopTo2, currentL)
                    mergeArray.append(newB2)
                    return LineUtils.walk_merge_line(hopTo2, currentL, newB2, currentCropPoint, goUp, crossedBorder, mergeArray, find_bisector, width, height, tol)
                else:
                    return mergeArray

        first = LineUtils.determine_first_border_cross(cropR, cropL, currentCropPoint, tol)
        if first == "right":
            LineUtils.trim_bisector(cropR['bisector'], currentBisector, cropR['point'])
            LineUtils.trim_bisector(currentBisector, cropR['bisector'], cropR['point'])
            currentBisector['intersections'].append(cropR['point'])
            crossedBorder = cropR['bisector']
            currentR = LineUtils.find_hop_to(cropR['bisector'], currentR)
            currentCropPoint = cropR['point']
        else:
            if first == "left":
                LineUtils.trim_bisector(cropL['bisector'], currentBisector, cropL['point'])
                LineUtils.trim_bisector(currentBisector, cropL['bisector'], cropL['point'])
                currentBisector['intersections'].append(cropL['point'])
                crossedBorder = cropL['bisector']
                currentL = LineUtils.find_hop_to(cropL['bisector'], currentL)
                currentCropPoint = cropL['point']
            else:
                LineUtils.trim_bisector(cropR['bisector'], currentBisector, cropR['point'])
                LineUtils.trim_bisector(currentBisector, cropR['bisector'], cropR['point'])
                currentBisector['intersections'].append(cropR['point'])
                crossedBorder = cropR['bisector']
                currentR = LineUtils.find_hop_to(cropR['bisector'], currentR)
                currentCropPoint = cropR['point']
                LineUtils.trim_bisector(cropL['bisector'], currentBisector, cropL['point'])
                LineUtils.trim_bisector(currentBisector, cropL['bisector'], cropL['point'])
                currentBisector['intersections'].append(cropL['point'])
                crossedBorder = cropL['bisector']
                currentL = LineUtils.find_hop_to(cropL['bisector'], currentL)
                currentCropPoint = cropL['point']

        return LineUtils.walk_merge_line(currentR, currentL, currentBisector, currentCropPoint, goUp, crossedBorder, mergeArray, find_bisector, width, height, tol)

    @staticmethod
    def find_L1_bisector(P1, P2, width, height):
        """
        Build L1 bisector polyline
        Axis or ±1 slope segments
        Returns dict descriptor
        """
        x1 = P1['site'][0]
        y1 = P1['site'][1]
        x2 = P2['site'][0]
        y2 = P2['site'][1]
        dx = x1 - x2
        dy = y1 - y2
        mid = [(x1 + x2) / 2.0, (y1 + y2) / 2.0]

        if abs(dx) <= 0.0 and abs(dy) <= 0.0:
            raise Exception("Duplicate site")
        if abs(dx) <= 0.0:
            pts = [[0.0, mid[1]], [width, mid[1]]]
            return {'sites': [P1, P2], 'up': False, 'points': pts, 'intersections': [], 'compound': False}
        if abs(dy) <= 0.0:
            pts = [[mid[0], 0.0], [mid[0], height]]
            return {'sites': [P1, P2], 'up': True, 'points': pts, 'intersections': [], 'compound': False}

        slope = -1.0
        if (dy / float(dx)) <= 0.0:
            slope = 1.0
        intercept = mid[1] - slope * mid[0]

        if abs(dx) >= abs(dy):
            v1 = [(y1 - intercept) / slope, y1]
            v2 = [(y2 - intercept) / slope, y2]
            up = True
            verts = [v1, v2]
            verts.sort(key=lambda p: p[1])
            pts = [[verts[0][0], 0.0], verts[0], verts[1], [verts[1][0], height]]
            pts.sort(key=lambda p: p[1])
            return {'sites': [P1, P2], 'up': up, 'points': pts, 'intersections': [], 'compound': False}
        else:
            v1 = [x1, x1 * slope + intercept]
            v2 = [x2, x2 * slope + intercept]
            up = False
            verts = [v1, v2]
            verts.sort(key=lambda p: p[0])
            pts = [[0.0, verts[0][1]], verts[0], verts[1], [width, verts[1][1]]]
            pts.sort(key=lambda p: p[0])
            return {'sites': [P1, P2], 'up': up, 'points': pts, 'intersections': [], 'compound': False}

    @staticmethod
    def curry_find_bisector(callback, width, height):
        """
        Partial for bisector maker
        Fix width and height args
        Returns callable(a,b)
        """
        def f(a, b):
            return callback(a, b, width, height)
        return f

    @staticmethod
    def recursive_split(split_array, find_bisector, width, height, tol):
        """
        Divide and conquer build
        Split, solve, then merge
        Returns flattened sites
        """
        n = len(split_array)
        if n > 2:
            mid = int((n - (n % 2)) / 2)
            L = LineUtils.recursive_split(split_array[0:mid], find_bisector, width, height, tol)
            R = LineUtils.recursive_split(split_array[mid:], find_bisector, width, height, tol)
            neis = sorted(R, key=lambda s: LineUtils.distance_l1(L[-1]['site'], s['site']))
            start = LineUtils.determine_starting_bisector(L[-1], neis[0], width, None, find_bisector, tol)
            initialB = start['startingBisector']
            initialR = start['nearestNeighbor']
            initialL = start['w']
            upStroke = LineUtils.walk_merge_line(initialR, initialL, initialB, [width, height], True, None, [], find_bisector, width, height, tol)
            downStroke = LineUtils.walk_merge_line(initialR, initialL, initialB, [0.0, 0.0], False, None, [], find_bisector, width, height, tol)
            mergeArray = [initialB] + upStroke + downStroke
            for bis in mergeArray:
                bis['mergeLine'] = n
                bis['sites'][0]['bisectors'] = LineUtils.clear_out_orphans(bis['sites'][0], bis['sites'][1])
                bis['sites'][1]['bisectors'] = LineUtils.clear_out_orphans(bis['sites'][1], bis['sites'][0])
                for s in bis['sites']:
                    s['bisectors'].append(bis)
            return L + R
        else:
            if n == 2:
                bis = find_bisector(split_array[0], split_array[1])
                split_array[0]['bisectors'].append(bis)
                split_array[1]['bisectors'].append(bis)
                return split_array
            else:
                return split_array

    @staticmethod
    def generate_L1_voronoi(site_points, width, height, nudge = True, tol = GLOBAL_TOL):
        #print "gl1", tol
        """
        Prepare site graph list
        Optional nudge cleans ties
        Returns site dicts array
        """
        data = site_points[:]
        if nudge:
            data = LineUtils.clean_data(data)
        else:
            data = data
        sites = sorted(data, key=lambda a: (a[0], a[1]))
        sites = [{'site': [float(s[0]), float(s[1])], 'bisectors': []} for s in sites]
        find_b = LineUtils.curry_find_bisector(LineUtils.find_L1_bisector, width, height)
        graph = LineUtils.recursive_split(sites, find_b, width, height, tol)

        return graph

    @staticmethod
    def build_edges_from_bisectors(sites, x0, y0, width, height, tol):
        #print tol
        """
        Extract unique edges
        Quantized by tol to dedupe
        Returns (segs, pairs)
        """

        qu = {}
        segs = []
        pairs = 0
        for s in sites:
            pairs += len(s['bisectors'])
            i = 0
            while i < len(s['bisectors']):
                b = s['bisectors'][i]
                j = 0
                while j < len(b['points']) - 1:
                    a = b['points'][j]
                    c = b['points'][j + 1]
                    p = (a[0] + x0, a[1] + y0)
                    q = (c[0] + x0, c[1] + y0)
                    if abs(p[0] - q[0]) <= tol and abs(p[1] - q[1]) <= tol:
                        j += 1
                    else:
                        k1 = int(round(min(p[0], q[0]) / tol))
                        k2 = int(round(min(p[1], q[1]) / tol))
                        k3 = int(round(max(p[0], q[0]) / tol))
                        k4 = int(round(max(p[1], q[1]) / tol))
                        key = (k1, k2, k3, k4)
                        if key in qu:
                            j += 1
                        else:
                            qu[key] = True
                            pa = rg.Point3d(p[0], p[1], 0.0)
                            pb = rg.Point3d(q[0], q[1], 0.0)
                            #segs.append(rg.LineCurve(pa, pb))
                            segs.append(rg.Line(pa, pb))
                            j += 1
                i += 1
        return segs, pairs

    @staticmethod
    def ManhattanVoronoi(Points, Pad, nudge=True, tol=GLOBAL_TOL):
        #print tol
        """
        Compute L1 Voronoi (Manhattan) diagram in XY.
        Returns edges (as Lines), pair count, segment count
        Higher tolerance than usual 0.01 is reccomended, 0.0001 is a good safe start
        """
        if Points is None or len(Points) == 0:
            return [], 0, 0
        pts_xy = [rg.Point3d(p.X, p.Y, 0.0) for p in Points]
        x0, y0, x1, y1 = LineUtils.bbox_xy(pts_xy, Pad)
        width = x1 - x0
        height = y1 - y0
        raw = [(p.X - x0, p.Y - y0) for p in pts_xy]
        sites = LineUtils.generate_L1_voronoi(raw, width, height, nudge, tol)
        edges, pairs = LineUtils.build_edges_from_bisectors(sites, x0, y0, width, height, tol)

        rect = [
            rg.Line(rg.Point3d(x0, y0, 0.0), rg.Point3d(x1, y0, 0.0)),
            rg.Line(rg.Point3d(x1, y0, 0.0), rg.Point3d(x1, y1, 0.0)),
            rg.Line(rg.Point3d(x1, y1, 0.0), rg.Point3d(x0, y1, 0.0)),
            rg.Line(rg.Point3d(x0, y1, 0.0), rg.Point3d(x0, y0, 0.0))
        ]
        
        edges.extend(rect)
        return edges, pairs, len(edges)

    @staticmethod
    def telegram_send_message(token, chat_id, text):
        """
        POST /sendMessage. Returns Telegram JSON or 'failed...' text.
        """
        try:
            url = "https://api.telegram.org/bot%s/sendMessage" % token
            data = System.Collections.Specialized.NameValueCollection()
            data.Add("chat_id", str(chat_id))
            data.Add("text", text)
            client = System.Net.WebClient()
            result_bytes = client.UploadValues(url, data)
            return System.Text.Encoding.UTF8.GetString(result_bytes)
        except Exception as ex:
            return "failed to send: " + str(ex)
    
    
    @staticmethod
    def telegram_send_file_from_path(token, chat_id, file_path, mime_type=None, filename=None, caption=None):
        """
        Reads file bytes and POSTs /sendDocument.
        """
        try:
            if not System.IO.File.Exists(file_path):
                return "failed to send document: file not found"
            b = System.IO.File.ReadAllBytes(file_path)
            name = filename if filename else System.IO.Path.GetFileName(file_path)
            return LineUtils.telegram_send_file(token, chat_id, name, b, mime_type, caption)
        except Exception as ex:
            return "failed to send document: " + str(ex)
    
    
    @staticmethod
    def telegram_send_file(token, chat_id, filename, content, mime_type=None, caption=None):
        """
        POST /sendDocument with in-memory content. 'content' may be str/unicode or byte[]/bytearray.
        """
        try:
            url = "https://api.telegram.org/bot%s/sendDocument" % token
            boundary = "----------%s" % System.Guid.NewGuid().ToString("N")
            crlf = "\r\n"
            enc = System.Text.Encoding.UTF8
    
            # normalize content -> .NET byte[]
            net_bytes = None
            try:
                # .NET byte[] detection
                tp = content.GetType()
                if tp.IsArray and tp.GetElementType() == System.Byte:
                    net_bytes = content
            except:
                net_bytes = None
            if net_bytes is None:
                if isinstance(content, bytearray):
                    net_bytes = System.Array.CreateInstance(System.Byte, len(content))
                    i = 0
                    for v in content:
                        net_bytes[i] = int(v)
                        i = i + 1
                elif isinstance(content, str) or isinstance(content, System.String):
                    net_bytes = enc.GetBytes(content)
                else:
                    # fallback: try to convert iterables of ints
                    try:
                        net_bytes = System.Array.CreateInstance(System.Byte, len(content))
                        i = 0
                        for v in content:
                            net_bytes[i] = int(v)
                            i = i + 1
                    except:
                        return "failed to send document: unsupported content type"
    
            if mime_type is None or mime_type == "":
                mime_type = "application/octet-stream"
    
            # build multipart preamble
            parts = []
            parts.append("--" + boundary)
            parts.append('Content-Disposition: form-data; name="chat_id"')
            parts.append("")
            parts.append(str(chat_id))
    
            if caption is not None:
                parts.append("--" + boundary)
                parts.append('Content-Disposition: form-data; name="caption"')
                parts.append("")
                parts.append(caption)
    
            parts.append("--" + boundary)
            parts.append('Content-Disposition: form-data; name="document"; filename="%s"' % filename)
            parts.append("Content-Type: %s" % mime_type)
            parts.append("")
            pre_bytes = enc.GetBytes(crlf.join(parts) + crlf)
            post_bytes = enc.GetBytes(crlf + "--" + boundary + "--" + crlf)
    
            ms = System.IO.MemoryStream()
            ms.Write(pre_bytes, 0, pre_bytes.Length)
            ms.Write(net_bytes, 0, net_bytes.Length)
            ms.Write(post_bytes, 0, post_bytes.Length)
    
            client = System.Net.WebClient()
            client.Headers.Add("Content-Type", "multipart/form-data; boundary=%s" % boundary)
            resp = client.UploadData(url, ms.ToArray())
            return enc.GetString(resp)
        except Exception as ex:
            return "failed to send document: " + str(ex)
    
    
    @staticmethod
    def svg_from_polylines(polylines, closed_polylines, polylinescolor, hatchescolor, padding_ratio=0.1, stroke_width=1.0, fill_opacity=0.2):
        """
        Returns an SVG string (UTF-8) built from open and closed polylines.
        Colors expected as objects with .R/.G/.B. Accepts Polyline or PolylineCurve.
        """
        def _to_polylist(items):
            out = []
            for it in items or []:
                if hasattr(it, "ToPolyline"):
                    out.append(it.ToPolyline())
                elif hasattr(it, "TryGetPolyline"):
                    ok, pl = it.TryGetPolyline()
                    if ok:
                        out.append(pl)
                else:
                    out.append(it)
            return out
    
        pls = _to_polylist(polylines or [])
        cls = _to_polylist(closed_polylines or [])
    
        # bounds
        have_pts = False
        minx = 0.0; miny = 0.0; maxx = 0.0; maxy = 0.0
        for pl in pls + cls:
            for p in pl:
                if not have_pts:
                    minx = p.X; miny = p.Y; maxx = p.X; maxy = p.Y
                    have_pts = True
                else:
                    if p.X < minx:
                        minx = p.X
                    if p.X > maxx:
                        maxx = p.X
                    if p.Y < miny:
                        miny = p.Y
                    if p.Y > maxy:
                        maxy = p.Y
    
        if not have_pts:
            return """<?xml version="1.0" encoding="UTF-8" standalone="no"?><svg xmlns="http://www.w3.org/2000/svg" version="1.1" width="1" height="1"/>"""
    
        width = maxx - minx
        height = maxy - miny
        pad_x = width * padding_ratio
        pad_y = height * padding_ratio
        new_w = width + 2.0 * pad_x
        new_h = height + 2.0 * pad_y
        off_x = -minx + pad_x
        off_y = -miny + pad_y
    
        def _ptlist(pl):
            pts = []
            for pt in pl:
                ax = pt.X + off_x
                ay = pt.Y + off_y
                pts.append("%.6f,%.6f" % (ax, ay))
            return " ".join(pts)
    
        def _rgb(c, default):
            if c is None:
                r = default[0]; g = default[1]; b = default[2]
                return "rgb(%d,%d,%d)" % (r, g, b)
            try:
                return "rgb(%d,%d,%d)" % (int(c.R), int(c.G), int(c.B))
            except:
                r = default[0]; g = default[1]; b = default[2]
                return "rgb(%d,%d,%d)" % (r, g, b)
    
        sb = System.Text.StringBuilder()
        sb.Append('<?xml version="1.0" encoding="UTF-8" standalone="no"?>')
        sb.Append('\n')
        sb.Append('<svg xmlns="http://www.w3.org/2000/svg" version="1.1" width="%s" height="%s" viewBox="0 0 %s %s">' % (str(new_w), str(new_h), str(new_w), str(new_h)))
        sb.Append('\n')
        sb.Append('  <g transform="scale(1,-1) translate(0,-%s)">' % str(new_h))
        sb.Append('\n')
    
        # open polylines
        pc = polylinescolor or []
        i = 0
        for pl in pls:
            col = pc[i] if i < len(pc) else None
            color_str = _rgb(col, (0, 0, 0))
            sb.Append('    <polyline points="%s" fill="none" stroke="%s" stroke-width="%.3f"/>\n' % (_ptlist(pl), color_str, float(stroke_width)))
            i = i + 1
    
        # closed filled
        hc = hatchescolor or []
        j = 0
        for pl in cls:
            col = hc[j] if j < len(hc) else None
            color_str = _rgb(col, (0, 0, 0))
            sb.Append('    <polygon points="%s" fill="%s" fill-opacity="%.3f" stroke="%s" stroke-width="%.3f"/>\n' % (_ptlist(pl), color_str, float(fill_opacity), color_str, float(stroke_width)))
            j = j + 1
    
        sb.Append('  </g>\n</svg>\n')
        return sb.ToString()
    
    @staticmethod
    def png_from_polylines(polylines, closed_polylines, polylinescolor, hatchescolor, width_px=1024, height_px=1024, padding_ratio=0.1, stroke_px=2.0, fill_opacity=0.2):
        """
        Rasterize geometry to PNG bytes for Telegram preview.
        """
        enc = System.Text.Encoding.UTF8
    
        def _to_polylist(items):
            out = []
            if items is None:
                return out
            for it in items:
                if hasattr(it, "ToPolyline"):
                    out.append(it.ToPolyline())
                elif hasattr(it, "TryGetPolyline"):
                    ok, pl = it.TryGetPolyline()
                    if ok:
                        out.append(pl)
                else:
                    out.append(it)
            return out
    
        pls = _to_polylist(polylines)
        cls = _to_polylist(closed_polylines)
    
        have_pts = False
        minx = 0.0; miny = 0.0; maxx = 0.0; maxy = 0.0
        for pl in pls + cls:
            for p in pl:
                if not have_pts:
                    minx = p.X; miny = p.Y; maxx = p.X; maxy = p.Y
                    have_pts = True
                else:
                    if p.X < minx:
                        minx = p.X
                    if p.X > maxx:
                        maxx = p.X
                    if p.Y < miny:
                        miny = p.Y
                    if p.Y > maxy:
                        maxy = p.Y
    
        if not have_pts:
            return System.Array.CreateInstance(System.Byte, 0)
    
        bw = maxx - minx
        bh = maxy - miny
        if bw <= 0.0:
            bw = 1.0
        if bh <= 0.0:
            bh = 1.0
    
        pad_w = float(width_px) * padding_ratio
        pad_h = float(height_px) * padding_ratio
        sx = (float(width_px) - 2.0 * pad_w) / bw
        sy = (float(height_px) - 2.0 * pad_h) / bh
        s = sx if sx < sy else sy
        vis_w = bw * s
        vis_h = bh * s
        left = (float(width_px) - vis_w) * 0.5
        bottom = (float(height_px) - vis_h) * 0.5
    
        def _mapx(x):
            return float(left + (x - minx) * s)
    
        def _mapy(y):
            return float(height_px - (bottom + (y - miny) * s))
    
        def _color_rgb(c, a255):
            if c is None:
                return System.Drawing.Color.FromArgb(a255, 0, 0, 0)
            try:
                return System.Drawing.Color.FromArgb(a255, int(c.R), int(c.G), int(c.B))
            except:
                return System.Drawing.Color.FromArgb(a255, 0, 0, 0)
    
        bmp = System.Drawing.Bitmap(int(width_px), int(height_px), System.Drawing.Imaging.PixelFormat.Format32bppArgb)
        g = System.Drawing.Graphics.FromImage(bmp)
        g.SmoothingMode = System.Drawing.Drawing2D.SmoothingMode.AntiAlias
        g.Clear(System.Drawing.Color.White)
    
        alpha_fill = int(max(0, min(255, int(fill_opacity * 255.0))))
        if alpha_fill < 0:
            alpha_fill = 0
        if alpha_fill > 255:
            alpha_fill = 255
    
        # filled polygons first
        hc = hatchescolor or []
        j = 0
        for pl in cls:
            c = hc[j] if j < len(hc) else None
            b = System.Drawing.SolidBrush(_color_rgb(c, alpha_fill))
            pts = System.Array.CreateInstance(System.Drawing.PointF, len(pl))
            k = 0
            for pt in pl:
                pts[k] = System.Drawing.PointF(_mapx(pt.X), _mapy(pt.Y))
                k = k + 1
            g.FillPolygon(b, pts)
            b.Dispose()
            j = j + 1
    
        # open polylines
        pc = polylinescolor or []
        i = 0
        for pl in pls:
            c = pc[i] if i < len(pc) else None
            pen = System.Drawing.Pen(_color_rgb(c, 255), float(stroke_px))
            prev = None
            for pt in pl:
                xy = System.Drawing.PointF(_mapx(pt.X), _mapy(pt.Y))
                if prev is not None:
                    g.DrawLine(pen, prev, xy)
                prev = xy
            pen.Dispose()
            i = i + 1
    
        g.Dispose()
        ms = System.IO.MemoryStream()
        bmp.Save(ms, System.Drawing.Imaging.ImageFormat.Png)
        arr = ms.ToArray()
        bmp.Dispose()
        ms.Dispose()
        return arr
    
    
    @staticmethod
    def telegram_send_photo(token, chat_id, filename, photo_bytes, caption=None):
        """
        POST /sendPhoto with in-memory PNG/JPEG bytes for instant preview.
        """
        try:
            url = "https://api.telegram.org/bot%s/sendPhoto" % token
            boundary = "----------%s" % System.Guid.NewGuid().ToString("N")
            crlf = "\r\n"
            enc = System.Text.Encoding.UTF8
    
            net_bytes = None
            try:
                tp = photo_bytes.GetType()
                if tp.IsArray and tp.GetElementType() == System.Byte:
                    net_bytes = photo_bytes
            except:
                net_bytes = None
            if net_bytes is None:
                if isinstance(photo_bytes, bytearray):
                    net_bytes = System.Array.CreateInstance(System.Byte, len(photo_bytes))
                    i = 0
                    for v in photo_bytes:
                        net_bytes[i] = int(v)
                        i = i + 1
                else:
                    return "failed to send photo: unsupported bytes"
    
            parts = []
            parts.append("--" + boundary)
            parts.append('Content-Disposition: form-data; name="chat_id"')
            parts.append("")
            parts.append(str(chat_id))
    
            if caption is not None:
                parts.append("--" + boundary)
                parts.append('Content-Disposition: form-data; name="caption"')
                parts.append("")
                parts.append(caption)
    
            parts.append("--" + boundary)
            parts.append('Content-Disposition: form-data; name="photo"; filename="%s"' % filename)
            # if your bytes are JPEG, set image/jpeg
            mime_type = "image/png"
            parts.append("Content-Type: %s" % mime_type)
            parts.append("")
            pre = enc.GetBytes(crlf.join(parts) + crlf)
            post = enc.GetBytes(crlf + "--" + boundary + "--" + crlf)
    
            ms = System.IO.MemoryStream()
            ms.Write(pre, 0, pre.Length)
            ms.Write(net_bytes, 0, net_bytes.Length)
            ms.Write(post, 0, post.Length)
    
            client = System.Net.WebClient()
            client.Headers.Add("Content-Type", "multipart/form-data; boundary=%s" % boundary)
            resp = client.UploadData(url, ms.ToArray())
            return enc.GetString(resp)
        except Exception as ex:
            return "failed to send photo: " + str(ex)
    
    
    @staticmethod
    def telegram_send_document_with_thumbnail(token, chat_id, filename, file_bytes, mime_type, thumb_jpeg_bytes, caption=None):
        """
        Optional: sendDocument with a custom JPEG thumbnail (<=200kB, <=320x320).
        """
        try:
            url = "https://api.telegram.org/bot%s/sendDocument" % token
            boundary = "----------%s" % System.Guid.NewGuid().ToString("N")
            crlf = "\r\n"
            enc = System.Text.Encoding.UTF8
    
            def _to_net_bytes(data):
                try:
                    tp = data.GetType()
                    if tp.IsArray and tp.GetElementType() == System.Byte:
                        return data
                except:
                    pass
                if isinstance(data, bytearray):
                    arr = System.Array.CreateInstance(System.Byte, len(data))
                    i = 0
                    for v in data:
                        arr[i] = int(v)
                        i = i + 1
                    return arr
                return None
    
            file_net = _to_net_bytes(file_bytes)
            thumb_net = _to_net_bytes(thumb_jpeg_bytes)
            if file_net is None or thumb_net is None:
                return "failed to send document: unsupported bytes"
    
            parts = []
            parts.append("--" + boundary)
            parts.append('Content-Disposition: form-data; name="chat_id"')
            parts.append("")
            parts.append(str(chat_id))
    
            if caption is not None:
                parts.append("--" + boundary)
                parts.append('Content-Disposition: form-data; name="caption"')
                parts.append("")
                parts.append(caption)
    
            parts.append("--" + boundary)
            parts.append('Content-Disposition: form-data; name="document"; filename="%s"' % filename)
            parts.append("Content-Type: %s" % (mime_type if mime_type else "application/octet-stream"))
            parts.append("")
    
            pre = enc.GetBytes(crlf.join(parts) + crlf)
            #mid = enc.GetBytes(crlf + "--" + boundary + crlf + 'Content-Disposition: form-data; name="thumbnail"; filename="thumb.jpg"' + crlf + "Content-Type: image/jpeg" + crlf + crlf)
            mid = enc.GetBytes(crlf + "--" + boundary + crlf + 'Content-Disposition: form-data; name="thumb"; filename="thumb.jpg"' + crlf + "Content-Type: image/jpeg" + crlf + crlf)
            post = enc.GetBytes(crlf + "--" + boundary + "--" + crlf)
    
            ms = System.IO.MemoryStream()
            ms.Write(pre, 0, pre.Length)
            ms.Write(file_net, 0, file_net.Length)
            ms.Write(mid, 0, mid.Length)
            ms.Write(thumb_net, 0, thumb_net.Length)
            ms.Write(post, 0, post.Length)
    
            client = System.Net.WebClient()
            client.Headers.Add("Content-Type", "multipart/form-data; boundary=%s" % boundary)
            resp = client.UploadData(url, ms.ToArray())
            return enc.GetString(resp)
        except Exception as ex:
            return "failed to send document: " + str(ex)

    @staticmethod
    def print_version():
        """
        Return current LineUtils version as string
        """
        s = "%.2f" % LineUtils.VERSION  + " LineUtils library"
        return s

    @staticmethod
    def generate_wiki(target_cls):
        """
        Generates a Markdown wiki of every public method in the given class.
        """

        spacer = "----------------------------------"
        title = "     {0} API     ".format(target_cls.__name__)
        lines = [spacer, title, spacer, "\n"]

        # collect and sort public methods
        methods = inspect.getmembers(target_cls, inspect.isfunction)
        count = 0
        for name, func in methods:
            #internal method
            if name.startswith("_"):
                continue
                
            count += 1
            idx = "{:02d}.".format(count)

            # build signature
            try:
                argspec = inspect.getargspec(func)
                args = argspec.args or []
                sig = "{name}({args})".format(
                    name=name,
                    args=", ".join(args)
                )
            except TypeError:
                # built-ins or callables without retrievable signature
                sig = name + "()"

            # clean and indent docstring
            doc = inspect.getdoc(func) or ""
            doc_lines = []
            for dl in doc.splitlines():
                doc_lines.append("   " + dl)

            # append enumeration, signature, and doc
            lines.append("{idx} `{sig}`".format(idx=idx, sig=sig))
            lines.append("")
            lines.extend(doc_lines)
            lines.append("")

        return "\n".join(lines)
# ---------- end ghpython_script_2 ----------
data_11 = Data(data)
data_12 = Data(pflip)
data_13 = Data(data_4)
data_14 = Data(data_3)
data_15 = Data(data_2)
data_16 = Data(data_5)
graft_tree = GraftTree(Tree=series, IncludeEmptyLists=True, IncludeNullItems=True)
data_17 = Data(data_6)
data_18 = Data(pflip_2)
data_19 = Data(data_7)
data_20 = Data(data_10)
data_21 = Data(data_8)
data_22 = Data(data_9)

data_23 = Data(Tree({0}: [{Plane=PlaneXY(1984.906293, 1246.819712, 0), Size=Domain2(u=-2..2, v=-2..2)}], {1}: [{Plane=Plane(origin=(2002.532183, 1360.853027, 0), x=(0, -1, 0), y=(1, 0, 0)), Size=Domain2(u=-2..2, v=-2..2)}], {2}: [{Plane=Plane(origin=(1925.8538, 1249.718325, 0), x=(-1, 0, 0), y=(0, -1, 0)), Size=Domain2(u=-2..2, v=-2..2)}], {3}: [{Plane=Plane(origin=(1832.302928, 1197.718297, 0), x=(0, -1, 0), y=(1, 0, 0)), Size=Domain2(u=-2..2, v=-2..2)}], {4}: [{Plane=Plane(origin=(1929.706849, 1265.707883, 0), x=(-1, 0, 0), y=(0, -1, 0)), Size=Domain2(u=-2..2, v=-2..2)}], {5}: [{Plane=Plane(origin=(2042.338363, 1269.496794, 0), x=(0, -1, 0), y=(1, 0, 0)), Size=Domain2(u=-2..2, v=-2..2)}]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))
data_24 = Data(Tree({0}: [PlaneXY(1984.906293, 1246.819712, 0)], {1}: [Plane(origin=(2002.532183, 1360.853027, 0), x=(0, -1, 0), y=(1, 0, 0))], {2}: [Plane(origin=(1925.8538, 1249.718325, 0), x=(-1, 0, 0), y=(0, -1, 0))], {3}: [Plane(origin=(1832.302928, 1197.718297, 0), x=(0, -1, 0), y=(1, 0, 0))], {4}: [Plane(origin=(1929.706849, 1265.707883, 0), x=(-1, 0, 0), y=(0, -1, 0))], {5}: [Plane(origin=(2042.338363, 1269.496794, 0), x=(0, -1, 0), y=(1, 0, 0))]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))
data_25 = Data(Tree({0}: [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], {1}: [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], {2}: [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], {3}: [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], {4}: [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], {5}: [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]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))
data_26 = Data(Tree({0}: [0.75], {1}: [0.75], {2}: [0.75], {3}: [0.75], {4}: [0.75], {5}: [0.75]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))
data_27 = Data(1)

data_28 = Data(Slider(1, range=0..5))

data_29 = Data(Tree({0}: [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], {1}: [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], {2}: [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], {3}: [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], {4}: [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], {5}: [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]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))
data_30 = Data(Tree({0}: [Plane(origin=(1978.470861, 1364.545202, 0), x=(-1, 0, 0), y=(0, -1, 0))], {1}: [Plane(origin=(2206.388729, 1959.082766, 0), x=(0, 1, 0), y=(-1, 0, 0))], {2}: [Plane(origin=(1791.974229, 2648.640244, 0), x=(0, -1, 0), y=(1, 0, 0))], {3}: [Plane(origin=(2362.07831, 2807.595326, 0), x=(0, 1, 0), y=(-1, 0, 0))], {4}: [Plane(origin=(1179.881699, 1660.039943, 0), x=(0, 1, 0), y=(-1, 0, 0))], {5}: [Plane(origin=(2012.720609, 2807.572649, 0), x=(0, 1, 0), y=(-1, 0, 0))]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))
data_31 = Data(Tree({0}: [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], {1}: [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], {2}: [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], {3}: [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], {4}: [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], {5}: [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]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))
data_32 = Data(Tree({0}: [0.75, 0.75, 0.75, 0.75, 0.75, 0.75], {1}: [0.75, 0.75, 0.75, 0.75, 0.75], {2}: [0.75, 0.75, 0.75, 0.75, 0.75, 0.75], {3}: [0.75, 0.75, 0.75, 0.75], {4}: [0.75, 0.75, 0.75], {5}: [0.75, 0.75, 0.75, 0.75, 0.75]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))
data_33 = Data(1)

data_34 = Data(Slider(8, range=0..39))
construct_path = ConstructPath(Indices=data_34)
stream_filter = StreamFilter(Gate=data_28, Stream0=data_27, Stream1=data_33, Stream2=data_20, Stream3=data_20, Stream4=data_16, Stream5=data_16)  # -> simplify(Stream)
flatten_tree = FlattenTree(Tree=construct_path, Path="{0}")
stream_filter_2 = StreamFilter(Gate=data_28, Stream0=data_24, Stream1=data_30, Stream2=data_18, Stream3=data_17, Stream4=data_12, Stream5=data_15)  # -> simplify(Stream)
stream_filter_3 = StreamFilter(Gate=data_28, Stream0=data_26, Stream1=data_32, Stream2=data_22, Stream3=data_22, Stream4=data_13, Stream5=data_13)  # -> simplify(Stream)
stream_filter_4 = StreamFilter(Gate=data_28, Stream0=data_23, Stream1=data_29, Stream2=data_19, Stream3=data_19, Stream4=data_11, Stream5=data_11)  # -> simplify(Stream)
stream_filter_5 = StreamFilter(Gate=data_28, Stream0=data_25, Stream1=data_31, Stream2=data_21, Stream3=data_21, Stream4=data_14, Stream5=data_14)  # -> simplify(Stream)

# ---- group: attempt 0.3
ghpython_script_3 = GhPythonScript()  # -> out, LineUtils
# ---------- ghpython_script_3: Python ----------
import Rhino.Geometry as rg
import math
import copy
import inspect
import itertools
import time
import System
import re
import zipfile
import xml.etree.ElementTree as ET
import Rhino.Collections as rc
import Grasshopper as gh
from collections import defaultdict
import random

version = 0.83

try:
    ghenv.Component.Message = "{0:.2f}".format(version) + " LineUtils library"
except:
    pass #working on imported lib

GLOBAL_TOL = 0.01 #need to fine tune, maybe 0.001 is better
ANG_EPS = 1e-6   # for dot-products
defaultpath = gh.Kernel.Data.GH_Path(0)
unitX = rg.Vector3d(1, 0, 0)
unitY = rg.Vector3d(0, 1, 0)
unitZ = rg.Vector3d(0, 0, 1) 

class LineUtils(object):
    VERSION = version
    
    class Orientation(object):
        """
        Simple enumeration for line orientation.
        """
        VERTICAL = "vertical"
        HORIZONTAL = "horizontal"
        NONORTH = "nonorth"


    class ConduitLookup(object):
        """
        Conduits trade size, inner/outer diameters, bend offset lookup, all preconverted to float
        Its a dictionary key = size as float
        """
        SIZES = [0.0, 0.5, 0.75, 1.0, 1.25, 1.5, 2.0, 2.5, 3.0, 3.5, 4.0, 6.0, 8.0]

        SPEC = {
            # trade: inner diameter (inches), outer diameter (inches), min_bend (inches), linear_section (inches)
            0.0:   {'trade': '0"', 'id': 0.0, 'od': 0.0, 'min_bend': 0.0, 'linear_section': 0.0}, #for debugging purposes
            0.5:   {'trade': '1/2"',     'id': 0.625,    'od': 0.71875,   'min_bend': 4.0,      'linear_section': 1.75},   # ID=5/8",       OD=23/32",    MinBend=4",       Linear section=1 3/4"
            0.75:  {'trade': '3/4"',     'id': 0.8125,   'od': 0.9375,    'min_bend': 5.4375,   'linear_section': 2.25},   # ID=13/16",     OD=15/16",    MinBend=5 7/16",  Linear section=2 1/4"
            1.0:   {'trade': '1"',       'id': 1.0625,   'od': 1.15625,   'min_bend': 7.0,      'linear_section': 2.25},   # ID=1 1/16",    OD=1 5/32",   MinBend=7",       Linear section=2 1/4"
            1.25:  {'trade': '1 1/4"',   'id': 1.3125,   'od': 1.5,       'min_bend': 8.8125,   'linear_section': 3.0},    # ID=1 5/16",    OD=1 1/2",    MinBend=8 13/16", Linear section=3"
            1.5:   {'trade': '1 1/2"',   'id': 1.625,    'od': 1.75,      'min_bend': 8.375,    'linear_section': 3.5},    # ID=1 5/8",     OD=1 3/4",    MinBend=8 3/8",   Linear section=3 1/2"
            2.0:   {'trade': '2"',       'id': 2.0625,   'od': 2.1875,    'min_bend': 9.25,     'linear_section': 4.0},    # ID=2 1/16",    OD=2 3/16",   MinBend=9 1/4",   Linear section=4"
            2.5:   {'trade': '2 1/2"',   'id': 2.71875,  'od': 2.875,     'min_bend': 13.90625, 'linear_section': 4.75},   # ID=2 23/32",   OD=2 7/8",    MinBend=13 29/32",Linear section=4 3/4"
            3.0:   {'trade': '3"',       'id': 3.34375,  'od': 3.5,       'min_bend': 16.46875, 'linear_section': 6.0},    # ID=3 11/32",   OD=3 1/2",    MinBend=16 15/32",Linear section=6"
            3.5:   {'trade': '3 1/2"',   'id': 3.84375,  'od': 4.0,       'min_bend': 19.8125,  'linear_section': 7.25},   # ID=3 27/32",   OD=4",        MinBend=19 13/16",Linear section=7 1/4"
            4.0:   {'trade': '4"',       'id': 4.34375,  'od': 4.5,       'min_bend': 21.5,     'linear_section': 8.5},    # ID=4 11/32",   OD=4 1/2",    MinBend=21 1/2",  Linear section=8 1/2"
            6.0:   {'trade': '6"',       'id': 6.0,      'od': 6.625,     'min_bend': 31.5,     'linear_section': 13.5},   # ID=6",         OD=6 5/8",    MinBend=31 1/2",  Linear section=13 1/2"
            8.0:   {'trade': '8"',       'id': 8.0,      'od': 8.96875,   'min_bend': 36.0,     'linear_section': 18.5},   # ID=8",         OD=8 31/32",  MinBend=36",      Linear section=18 1/2"
        }

        @staticmethod
        def _interpolate_conduit_specs(size):
            """
            Build and evaluate cubic splines for id, od, and min_bend
            across available sizes, returning inchified floats.
            """
            sizes = sorted(LineUtils.ConduitLookup.SPEC.keys())
            id_vals = [LineUtils.ConduitLookup.SPEC[s]['id'] for s in sizes]
            od_vals = [LineUtils.ConduitLookup.SPEC[s]['od'] for s in sizes]
            mb_vals = [LineUtils.ConduitLookup.SPEC[s]['min_bend'] for s in sizes]
            ls_vals = [LineUtils.ConduitLookup.SPEC[s]['linear_section'] for s in sizes]
            
            coeff_id = LineUtils.calculate_spline_coefficients(sizes, id_vals)
            coeff_od = LineUtils.calculate_spline_coefficients(sizes, od_vals)
            coeff_mb = LineUtils.calculate_spline_coefficients(sizes, mb_vals)
            coeff_ls = LineUtils.calculate_spline_coefficients(sizes, ls_vals)
            
            id_val = LineUtils.cubic_spline(sizes, coeff_id, size)
            od_val = LineUtils.cubic_spline(sizes, coeff_od, size)
            mb_val = LineUtils.cubic_spline(sizes, coeff_mb, size)
            ls_val = LineUtils.cubic_spline(sizes, coeff_ls, size)
            
            return {
                'trade': LineUtils.inchify(size),
                'id': LineUtils.inchify(id_val),
                'od': LineUtils.inchify(od_val),
                'min_bend': LineUtils.inchify(mb_val),
                'linear_section': LineUtils.inchify(ls_val)
            }

        @staticmethod
        def get_specs(size):
            #ensure size is float, default to 0.75
            try:
                sizef = float(size)
            except:
                sizef = 0.75
                
            if sizef not in LineUtils.ConduitLookup.SPEC:
                return LineUtils.ConduitLookup._interpolate_conduit_specs(sizef)
                
            specs = LineUtils.ConduitLookup.SPEC[sizef]
            return {
                'trade': LineUtils.inchify(sizef),
                'id': LineUtils.inchify(specs['id']),
                'od': LineUtils.inchify(specs['od']),
                'min_bend': LineUtils.inchify(specs['min_bend']),
                'linear_section': LineUtils.inchify(specs['linear_section'])
            }
        
        @staticmethod
        def classify_size(size):
            """
            Classify the input size:
            - 'lookedup' if float and exact match in SPEC
            - 'interpolated' if float but not in SPEC
            - 'invalid' if cannot parse as float
            """
            try:
                sizef = float(size)
            except (TypeError, ValueError):
                return 'invalid'
            if sizef in LineUtils.ConduitLookup.SPEC:
                return 'lookedup'
            return 'interpolated'


    class AngleLookup(object):
        """
        Acceptable bend angles lookup
        """
        ANGLES = [5.0, 10.0, 15.0, 22.5, 30.0, 45.0, 90.0]

        SPEC = {
            #angles in radians
            5.0:  math.pi * 5.0  / 180.0,
            10.0: math.pi * 10.0 / 180.0,
            15.0: math.pi * 15.0 / 180.0,
            22.5: math.pi * 22.5 / 180.0,
            30.0: math.pi * 30.0 / 180.0,
            45.0: math.pi * 45.0 / 180.0,
            90.0: math.pi * 90.0 / 180.0,
        }

        @staticmethod
        def get_specs(deg):
            return LineUtils.AngleLookup.SPEC[deg]


    class Spacing(object):
        """
        spacing version 0.87
        
        This module implements a two-pass “spacing” solver for polylines. It takes in a tree of input polylines, 
        converts them into segments, maps each segment onto a global lookup of axis (axis are created from all the baselines merged together whenever they touch), 
        computes turn directions and sort-orders, and finally repositions each segment so that bundles of pipes are evenly spaced (either per-panel or mixed together).
        
        --------------------
        - **Segmentization**  
          - Break each raw polyline into it's segments
          - Wrap each consecutive point pair in a `PolySegment`, tracking path and polyline indices
          - PolySegment class is usefull for storing all data about it and having the ability to move it
          as a part of polyline, similar to Offset Curve Loose
        - **Lookup & Identification**  
          - Build a global “lookup” of unique line geometries, this is used for axis determination 
          - For each segment, find its best matching lookup line (by bucketed angle + midpoint distance (midpoint distance worked the most reliably, so far problemless))  
        - **Turn & Sort Properties**  
          - In each `Polyline`, determine “previous”, “self” and “next” turn direction per segment (used to assign scores)
          - Compute per-segment sort chains (`sortchain`, `sortchainraw`) and group-indices based on turn/quadrant,
          sort chain holds information abotu all next segments in that polyline
        - **Score calculation logic**
          - Every segment is assigned a score based on :
              its panels id weight, panels are sorted based on left straight right turns and this is the heaviest influencer 
              its turns direction weight, left -> straight -> right in strength
              its turns parameter, parameter is flipped for right turns (so that both for left and right smaller values meaning earlier turns are position outside)
              finalweight = turnparameter + turndirection + panelid
        - **Offset Computation**  
          - Group segments by lookup ID and, within each group, by direction match  
          - Compute raw offsets (centered around zero) or bundle offsets (averaging subgroup positions)  
          - Move each segment along a perpendicular vector scaled by its offset  
        - **Double-Pass Refinement**  
          - First pass is mainly used to define bundle centers, as if segments go in opposite direction in a lookup axis, scoring is tricky
          - Second pass deals with bundles all in sam edirection, so scoring is reliable 
          (all lines wont be in same direction only in extreme corner cases, which could result in few extra overlaps, but the issue would be minuscule)
          - Produce paired “first” & “final” polylines and align them into bundle clusters (for ease of use, to be able to reference both first and final passes data) 
        - **Final Output**  
          - Reassemble moved polylines back into a `Grasshopper.DataTree` for downstream use  , keeping empty branches if present
        
        Public Classes
        --------------
        ### PolyPoint  
        Lightweight wrapper around `rg.Point3d` with a `.move(vector)` helper.
        
        ### PolySegment  
        Encapsulates one line segment between two `PolyPoint`s.  
        - Properties:  
          - `.geometry` -> `rg.Line`  
          - `.startpar` / `.endpar` -> nearest parameter on lookup axis line (to determine who turns first)
          - `.quadrant` -> compass quadrant of segment  
          - `.dirmatch` -> whether segment aligns with its lookup axis orientation  
          - `.sort_idx` -> computed sort key for ordering  
        
        ### Polyline  
        Builds a chain of `PolyPoint`s and `PolySegment`s from raw points.  
        - `_build()`  
          - Filters collinear points, instantiates segments  
        - `assign_ids(...)` / `assign_ids_raw(...)`  
        - `finalize_segments()`  
          - Computes turn directions, chains (`nextturnchain`, `scorechain`, `endchain`), and sort-chains  
        - Offsets:  
          - `move_segment`, `move_segments`  
          - `compute_dirflags`  
        - Properties:  
          - `.polyline_geometry` -> Rhino `Polyline`  
          - `.dirflagged` -> whether any segment failed alignment  
        
        ### DoubleSegment & DoublePoly  
        Pair up corresponding first- and final-pass segments to compute domain intervals, ordered geometry, and to support cluster re-alignment.
        """

        def Run(self, polylines, conduitsize, optionalkeys = gh.DataTree[System.Int32]([0], defaultpath),
                spacing = 1.0, perpanel = False, perlevel = False, pulltogether = True, 
                pushflag = True, pullstart = True, bimmode = False, prefilter = False,
                speedmode = False):
            """
            returns: rawlinelookup, linelookup, rebuiltree, polys, polys2, finaltree, treeflags, doublepolys, Boundaryobjects
            pushflag effects compute the most, for iterating quickly it's best to disable it
            and keep just for final code
            """
            
            #pushflag = True #push colliding bundles apart
            bothpasses = True #for debugging, if False only 1 pass is run, more intersections
            debugglobals = True #debug outputs
            
            # shorter sortchains in speedmode *slight accuracy reduction
            sortchain_span = 10 if speedmode else 50
            
            if speedmode:
                # Fast mode: skip most expensive global steps
                pushflag = False
                prefilter = False
            
            if prefilter:
                polylines = LineUtils.prefilter_polyline_tree(polylines)

            
            #nonorth move helpers 
            
            def _unit_xy(v):
                if v.Length > 0.0:
                    v.Unitize()
                return v
            
            def _left_normal_xy(v):
                n = rg.Vector3d(-v.Y, v.X, 0.0)
                if n.Length > 0.0:
                    n.Unitize()
                return n
            
            def _dot_xy(a, b):
                return a.X * b.X + a.Y * b.Y
            
            
            class PolyPoint(object):
                def __init__(self, x, y, z=0.0):
                    self.pt = rg.Point3d(x, y, z)
            
                def move(self, vector):
                    xform = rg.Transform.Translation(vector)
                    self.pt.Transform(xform)
            
                @property
                def location(self):
                    return self.pt
            
            
            class PolySegment(object):
                def __init__(self, start_point, end_point, polypath = None, 
                            polypathidx = None, polyidx = None, tradesize = 0.0,
                            outerdiameter = 0.0, optionalkey = 0.0, bimmode = False):
                    
                    self.start = start_point
                    self.end = end_point
                    self.polypath = polypath        # GH_path of parent polyline
                    self.polypathidx = polypathidx  # index of GH_path among all parent polylines paths
                    self.polyidx = polyidx          # index of parent polyline among all parent polylines
                    #self.pathsortidx = [1000, 1000, 1000, 1000] #in group calculated sort idx %left %straight %right numelements
                    self.pathsortidx = [0, 0, 0, 0] # in group calculated sort idx %left %straight %right numelements
                    self.pathsortidx_ = 0           # idx sorted by pathsortidx
                    self.optionalkey = optionalkey  # optional key to influence positioning
                    self.bimmode = bimmode          # solve sorting inside bundle itself only
                    self.lookupid = -1              # default lookup index
                    self.lookupidflip = -1
                    self.lookupidraw = -1
                    self.lookup_geometry = None      # actual flipped lookup line geometry
                    self.lookup_geometry_flip = None
                    self.lookup_geometry_raw = None
                    self.prevturn = "Unset"
                    self.nextturn = "Straight"
                    self.selfturn = "Straight"
                    self.startchain = []             # chain of start parameters
                    self.endchain = []               # chain of end parameters
                    self.nextturnchain = []
                    self.prevturnchain = []
                    self.scorechain = []
                    self.sortchain = [] #mainattempt
                    self.sortchainflip = []
                    self.sortchainraw = []
                    self.polydirflagged = False
                    self.bundleindex = -1 #default
                    self.bim_dirsign = 1
                    self.bim_panelrank = 0
                    self.bim_bundlekey = None
                    self.tradesize = tradesize
                    self.outerdiameter = outerdiameter
                    self.dir = rg.Vector3d(0.0, 0.0, 0.0) #additions for nonorth
                    self.norm = rg.Vector3d(0.0, 0.0, 0.0)
                    self.prev_dir = rg.Vector3d(0.0, 0.0, 0.0)
                    self.prev_norm = rg.Vector3d(0.0, 0.0, 0.0)
                    self.next_dir = rg.Vector3d(0.0, 0.0, 0.0)
                    self.next_norm = rg.Vector3d(0.0, 0.0, 0.0)
                    self.has_prev = False
                    self.has_next = False
            
                @property
                def geometry(self):
                    return rg.Line(self.start.pt, self.end.pt)
            
                @property
                def startpar(self):
                    if not self.lookup_geometry:
                        return -1.0
                    # raw parameter on infinite line
                    return round(self.lookup_geometry.ClosestParameter(self.geometry.From), 3)
            
                @property
                def endpar(self):
                    if not self.lookup_geometry:
                        return -1.0
                    
                    return round(self.lookup_geometry.ClosestParameter(self.geometry.To), 3)
            
                @property
                def endparraw(self):
                    if not self.lookup_geometry_raw:
                        return -1.0
                    # raw parameter on infinite line
                    return round(self.lookup_geometry_raw.ClosestParameter(self.geometry.To), 3)
            
            
                #new for nonorth
                def move(self, vector):
                    # always start from the input vector
                    v = rg.Vector3d(vector.X, vector.Y, vector.Z)
            
                    # 1) use the LOOKUP axis so every segment in the bundle shares the same frame
                    if self.lookup_geometry:
                        dcur = rg.Vector3d(self.lookup_geometry.Direction.X,
                                           self.lookup_geometry.Direction.Y, 0.0)
                    else:
                        dcur = rg.Vector3d(self.dir.X, self.dir.Y, 0.0)
                    if dcur.Length <= GLOBAL_TOL:
                        dcur = self.geometry.Direction
                    if dcur.Length <= GLOBAL_TOL:
                        return
                    dcur.Unitize()
                    ncur = rg.Vector3d(-dcur.Y, dcur.X, 0.0)  # shared unit normal for the bundle
            
                    # how far we want to move in the normal direction (same for all lines in the bundle)
                    d = v.X * ncur.X + v.Y * ncur.Y
            
                    # helper: move an endpoint along a given direction so its normal shift equals d
                    def _along(dir_vec):
                        if dir_vec.Length <= GLOBAL_TOL:
                            # no reliable neighbor: just translate by the shared normal
                            return rg.Vector3d(ncur.X * d, ncur.Y * d, v.Z)
                        dp = rg.Vector3d(dir_vec.X, dir_vec.Y, 0.0); dp.Unitize()
                        denom = dp.X * ncur.X + dp.Y * ncur.Y    # == cos(angle(dp, ncur))
                        if abs(denom) < ANG_EPS:
                            # almost parallel to the axis -> treat as pure normal translation
                            return rg.Vector3d(ncur.X * d, ncur.Y * d, v.Z)
                        s = d / denom
                        return rg.Vector3d(dp.X * s, dp.Y * s, v.Z)
            
                    ds = _along(self.prev_dir) if self.has_prev else rg.Vector3d(ncur.X * d, ncur.Y * d, v.Z)
                    de = _along(self.next_dir) if self.has_next else rg.Vector3d(ncur.X * d, ncur.Y * d, v.Z)
            
                    self.start.move(ds)
                    self.end.move(de)
            
            
                def set_id(self, id):
                    self.lookupid = id
            
                def set_lookup_geometry(self, line):
                    # store a copy of the flipped lookup line
                    self.lookup_geometry = rg.Line(line.From, line.To)
            
                def set_id_raw(self, id):
                    self.lookupidraw = id
            
                def set_lookup_geometry_raw(self, line):
                    # store a copy of the flipped lookup line
                    self.lookup_geometry_raw = rg.Line(line.From, line.To)
            
                def set_polydirflag(self, flag):
                    self.polydirflagged = flag
                
                def set_pathsortidx(self, psort):
                    self.pathsortidx = psort
            
                def set_pathsortidx_(self, psort_):
                    self.pathsortidx_ = psort_
            
                def set_optionalkey(self, o_key):
                    self.optionalkey = o_key

                def set_bimmode(self, bim):
                    self.bimmode = bim

                """
                unset means straight
                left -> 0
                unset -> 1
                right -> 2
                """
                @property
                def groupindexnext(self):
                    if self.nextturn == "Left":
                        return 1#0
                    elif self.nextturn == "Straight":
                        return 3#1
                    elif self.nextturn == "Right":
                        return 5#2
                
                @property
                def groupindexnextflip(self):
                    if self.nextturn == "Left":
                        return 6#6#2
                    elif self.nextturn == "Straight":
                        return 3#3#1
                    elif self.nextturn == "Right":
                        return 0#0#0
            
                @property
                def quadrant(self): 
                    v = self.geometry.Direction
                    if abs(v.Y) >= abs(v.X):
                        if v.Y > 0:
                            direction = "Up quadrant"
                        else:
                            direction = "Down quadrant"
                    else:
                        if v.X > 0:
                            direction = "Right quadrant"
                        else:
                            direction = "Left quadrant"
                    return direction
                    
                @property
                def dirmatch(self):
                    selfdir = self.geometry.Direction
                    selfdir.Unitize()
                    lkpdir = self.lookup_geometry.Direction
                    lkpdir.Unitize()
                    dot = selfdir * lkpdir
                    
                    return dot > 0.5
            
                @property
                def sort_idx(self):
                    if perpanel:
                        pathoffset = self.pathsortidx_ * 10
                    else:
                        pathoffset = 0

                    gi = self.groupindexnext
                    gi_flip = self.groupindexnextflip

                    # BIMMODE: make the parameter "travel-direction stable"
                    # so reversed segments don't invert the ordering logic.
                    if self.bimmode:
                        par = self.endpar

                        # If segment runs opposite axis orientation, invert parameter
                        if not self.dirmatch:
                            par = 1 - par

                        # Keep  "Right turn parameter flip" behaviour
                        if self.nextturn == "Right":
                            par = 1 - par

                        # If travelling opposite the axis, flip Left/Right weighting
                        gi_use = gi if self.dirmatch else gi_flip

                        return par + gi_use + pathoffset + self.optionalkey

                    # Non-bimmode: keep legacy behaviour (close to original)
                    calcpar = 0.0
                    if gi == 5 or gi_flip == 0:
                        calcpar = 1 - self.endpar
                    else:
                        calcpar = self.endpar

                    finpar = calcpar + gi
                    return finpar + pathoffset + self.optionalkey
            
                @property
                def sort_idx_raw(self):
                    gi = self.groupindexnext
                    calcpar = 0.0
                    
                    if gi == 2:
                        calcpar = 1 - self.endparraw
                    else:
                        calcpar = self.endparraw
                    
                    finpar = calcpar + gi 
                    
                    return finpar
            
            
            class Polyline(object):
                def __init__(self, rawpoints, ghpath=defaultpath, ghidx = -1, 
                            absidx = -1, pathidx = -1, tradesize = 0.0, 
                            outerdiameter = 0.0, optionalkey = 0.0, bimmode = False):
                    
                    self.rawpoints = list(rawpoints)
                    self.ghpath = ghpath #actual GH_Path 
                    self.ghidx = ghidx   #index of polyline inside path
                    self.absidx = absidx #index of polyline among all polylines
                    self.pathidx = pathidx#index of GH_Path among all paths
                    self.tradesize = tradesize
                    self.outerdiameter = outerdiameter
                    self.optionalkey = optionalkey
                    self.bimmode = bimmode
                    self._build()
            
                def _build(self):
                    unique = []
                    for p in self.rawpoints:
                        if not unique or unique[-1].DistanceTo(p) > GLOBAL_TOL:
                            unique.append(rg.Point3d(p.X, p.Y, p.Z))
            
                    filtered = []
                    for i in range(len(unique)):
                        if i == 0 or i == len(unique) - 1:
                            filtered.append(unique[i])
                        else:
                            p0, p1, p2 = unique[i-1], unique[i], unique[i+1]
                            v1 = rg.Vector3d(p1.X-p0.X, p1.Y-p0.Y, p1.Z-p0.Z)
                            v2 = rg.Vector3d(p2.X-p1.X, p2.Y-p1.Y, p2.Z-p1.Z)
                            if rg.Vector3d.CrossProduct(v1, v2).Length > GLOBAL_TOL:
                                filtered.append(p1)
            
                    self.points = [PolyPoint(p.X, p.Y, p.Z) for p in filtered]
                    self.segments = []
                    
                    #for i in range(len(self.points) - 1):
                    #    self.segments.append(PolySegment(self.points[i], self.points[i+1], self.ghpath, self.pathidx, self.absidx, self.tradesize, self.outerdiameter, self.optionalkey))
                    #rework for nonorth
                    for i in range(len(self.points) - 1):
                        seg = PolySegment(self.points[i], self.points[i+1], self.ghpath,
                                          self.pathidx, self.absidx, self.tradesize, 
                                          self.outerdiameter, self.optionalkey, self.bimmode)
                        self.segments.append(seg)
                    
                    for i in range(len(self.segments)):
                        seg = self.segments[i]
                    
                        dir_cur = seg.geometry.Direction
                        _unit_xy(dir_cur)
                        seg.dir = rg.Vector3d(dir_cur.X, dir_cur.Y, 0.0)
                        seg.norm = _left_normal_xy(seg.dir)
                    
                        if i > 0:
                            dir_prev = self.segments[i - 1].geometry.Direction
                            _unit_xy(dir_prev)
                            seg.prev_dir = rg.Vector3d(dir_prev.X, dir_prev.Y, 0.0)
                            seg.prev_norm = _left_normal_xy(seg.prev_dir)
                            seg.has_prev = True
                        else:
                            seg.has_prev = False
                    
                        if i < len(self.segments) - 1:
                            dir_next = self.segments[i + 1].geometry.Direction
                            _unit_xy(dir_next)
                            seg.next_dir = rg.Vector3d(dir_next.X, dir_next.Y, 0.0)
                            seg.next_norm = _left_normal_xy(seg.next_dir)
                            seg.has_next = True
                        else:
                            seg.has_next = False
            
                def move_segment(self, index, vector):
                    if index < 0 or index >= len(self.segments):
                        print "IndexError: Segment index out of range."
                        return
                    self.segments[index].move(vector)
            
                def move_segments(self, indices, vectors):
                    if len(indices) != len(vectors):
                        print "ValueError: indices and vectors must be the same length."
                        return
                    for idx, vec in zip(indices, vectors):
                        self.move_segment(idx, vec)
            
                def assign_ids(self, candidates):
                    for seg in self.segments:
                        best_idx = find_best_candidate(seg.geometry, candidates)
                        seg.set_id(best_idx)
                        seg.set_lookup_geometry(candidates[best_idx])
            
                def assign_ids_raw(self, candidates):
                    for seg in self.segments:
                        best_idx = find_best_candidate(seg.geometry, candidates)
                        seg.set_id_raw(best_idx)
                        seg.set_lookup_geometry_raw(candidates[best_idx])
            
                def finalize_segments(self):
                    count = len(self.segments)
                    for i, seg in enumerate(self.segments):
                        # previous turn
                        if i > 0:
                            prev_dir = self.segments[i-1].geometry.Direction
                            prev_dir.Unitize()
                            cur_dir = seg.geometry.Direction
                            cur_dir.Unitize()
                            cross = rg.Vector3d.CrossProduct(prev_dir, cur_dir)
                            if cross.Z > 0:
                                seg.prevturn = "Left"
                                seg.selfturn = "Left"
                            else:
                                seg.prevturn = "Right"
                                seg.selfturn = "Right"
            
                        # next turn
                        if i < count - 1:
                            next_dir = self.segments[i+1].geometry.Direction
                            next_dir.Unitize()
                            cur_dir = seg.geometry.Direction
                            cur_dir.Unitize()
                            cross = rg.Vector3d.CrossProduct(cur_dir, next_dir)
                            if cross.Z > 0:
                                seg.nextturn = "Left"
                            else:
                                seg.nextturn = "Right"
                    
                    verflag = False
                    cur_dir = seg.geometry.Direction
                    cur_dir.Unitize()
                    
                    if cur_dir * unitY > 0.5:
                        verflag = True
                    
                    for i, seg in enumerate(self.segments):
                        seg.nextturnchain = []
                        for k in range(2): # this segment + next 1
                            idx = i + k # -1 #-1 experimental edit
                            if idx < count:
                                seg.nextturnchain.append(self.segments[idx].nextturn)
                            else:
                                seg.nextturnchain.append("Unset")
                    
                    for i, seg in enumerate(self.segments):
                        seg.scorechain = []
                        for j in range(5):  # this segment + next 4
                            idx = i + j
                            
                            if idx < count:
                                #trn = self.segments[idx].nextturn
                                trn = self.segments[idx].selfturn
                                glen = round(self.segments[idx].geometry.Length, 3)
                                if trn == "Left":
                                    seg.scorechain.append(-glen)
                                    #seg.scorechain.append(glen)
                                else:
                                    seg.scorechain.append(glen)
                            else:
                                seg.scorechain.append(999999)
            
                    # build startchain and endchain for each segment
                    for i, seg in enumerate(self.segments):
                        seg.endchain = []
                        for j in range(5):  # this segment + next 4
                            idx = i + j
                            
                            if idx < count:
                                ioffset = self.segments[idx].groupindexnext
                                idxpar = self.segments[idx].endpar
                                bracketpar = -1
                                if ioffset in [0, 1, 2]:
                                    bracketpar = 0
                                if ioffset == 3:
                                    bracketpar = 1
                                if ioffset in [4, 5, 6]:
                                    bracketpar = 2
                                seg.endchain.append(bracketpar + idxpar)
                            else:
                                seg.endchain.append(0.0)
            
                    for seg in self.segments:
                        if self.dirflagged:
                            pass
                            seg.set_polydirflag(True)
                            #seg.polydirflagged = True
            
                    for i, seg in enumerate(self.segments):
                        seg.sortchain = []
                        seg.sortchainflip = []
                        seg.sortchainraw = []
                        for j in range(sortchain_span):  #5 for debugging, normally could be more
                            idx = i + j
                            
                            if idx < count:
                                soridx = self.segments[idx].sort_idx
                                seg.sortchain.append(soridx)
                            else:
                                seg.sortchain.append(100)
                                
                        seg.sortchain.append(self.absidx) #add a unique consistent index as the last resort for consistent sorting for identical polys
            
                def compute_dirflags(self):
                    for seg in self.segments:
                        if self.dirflagged:
                            pass
                            seg.set_polydirflag(True)
                            #seg.polydirflagged = True
            
                @property
                def polyline_geometry(self):
                    pts = [pt.location for pt in self.points]
                    return rg.Polyline(pts)
                
                @property
                def dirflagged(self):
                    for sgm in self.segments:
                        if sgm.dirmatch == False:
                            return True
                    return False
            
            safeext = spacing*100
            
            class DoubleSegment(object):
                def __init__(self, first, final):
                    self.first = first 
                    self.final = final
                    self.bundleidx = -1
                    self.outlineidx = -1
                    self.boundlegroup = -1 #for boundary pushing grouping
                    self.maxslotdiameter = first.outerdiameter
            
                def set_bundleidx(self, idx):
                    self.bundleidx = idx
            
                def set_outlineidx(self, idx):
                    self.outlineidx = idx
                
                def set_maxslotdiameter(self, diameter):
                    self.maxslotdiameter = diameter
            
                def set_boundlegroup(self, idx):
                    self.boundlegroup = idx
            
                @property
                def id(self):
                    return self.first.lookupid
                
                @property
                def p1(self):
                    #return self.first.startpar
                    return self.lookup.ClosestParameter(self.geometry.From)
                    #return self.first.lookup_geometry.ClosestParameter(self.geometry.From)
                
                @property
                def p2(self):
                    #return self.first.endpar
                    return self.lookup.ClosestParameter(self.geometry.To)
                    #return self.first.lookup_geometry.ClosestParameter(self.geometry.To)
                
                @property
                def domain(self):
                    return rg.Interval(*sorted([self.p1, self.p2]))
                
                @property
                def geometry(self):
                    geo = self.final.geometry
                    pts = sorted([geo.From, geo.To], key = lambda p: (p.X, p.Y))
                    return rg.Line(*pts)
                
                @property
                def lookup(self):
                    lkpg = self.first.lookup_geometry
                    lkpline = rg.Line(lkpg.From, lkpg.To)
                    #lkpline.Extend(safeext, safeext) #need to check if needed
                    return lkpline
                
                
            class DoublePoly(object):
                def __init__(self, polyfirstpass, polyfinalpass):
                    self.firstpass = polyfirstpass
                    self.finalpass = polyfinalpass
                    # build and cache your DoubleSegment objects just once
                    pairs = zip(self.firstpass.segments, self.finalpass.segments)
                    self._segmentpairs = [DoubleSegment(a, b) for a, b in pairs]
            
                @property
                def segmentpairs(self):
                    return self._segmentpairs
            
            
            class Boundary(object):
                def __init__(self, geometry, bundleidx, outlineidx, encoded, axis, z):
                    self.geometry = geometry
                    self.bundleidx = bundleidx
                    self.outlineidx = outlineidx
                    self.encoded = encoded
                    self.axis = axis
                    self.movevector = rg.Vector3d(0, 0, 0)
                    self.z = z
                    self.boundlegroup = -1 #for boundary pushing grouping
            
                def set_movevector(self, vec):
                    self.movevector = vec
            
                def set_boundlegroup(self, idx):
                    self.boundlegroup = idx
            
            candidate_cache = {'candidates': None, 'buckets': None}
            
            
            def find_best_candidate(checksegment, candidates):
                # direction prep helps with tolerance, grid is also prepped
                segment = rg.Line(*sorted([checksegment.From, checksegment.To],
                                          key=lambda point: (point.X, point.Y)))
                
                # segment direction key (unchanged logic)
                seg_dir = segment.Direction
                seg_dir.Unitize()
                seg_key = round(abs(seg_dir * unitY), 2)
            
                # build / reuse angle buckets for this candidate list
                if speedmode:
                    cached_candidates = candidate_cache['candidates']
                    angle_buckets = candidate_cache['buckets']
                    if cached_candidates is not candidates or angle_buckets is None:
                        angle_buckets = {}
                        for i, cand in enumerate(candidates):
                            dir_vec = cand.Direction
                            dir_vec.Unitize()
                            key = round(abs(dir_vec * unitY), 2)
                            if key not in angle_buckets:
                                angle_buckets[key] = []
                            angle_buckets[key].append(i)
                        candidate_cache['candidates'] = candidates
                        candidate_cache['buckets'] = angle_buckets
                else:
                    # original per-call behaviour (no caching)
                    angle_buckets = {}
                    for i, cand in enumerate(candidates):
                        dir_vec = cand.Direction
                        dir_vec.Unitize()
                        key = round(abs(dir_vec * unitY), 2)
                        if key not in angle_buckets:
                            angle_buckets[key] = []
                        angle_buckets[key].append(i)
            
                bucket = angle_buckets.get(seg_key, [])
            
                best_idx = -1
                best_dist = float('inf')
            
                mid = segment.PointAt(0.5)
            
                for i in bucket:
                    dist = candidates[i].DistanceTo(mid, True)
                    if dist < best_dist:
                        best_dist = dist
                        best_idx = i
            
                return best_idx
                
            def computeindices(n):
                # raw pairs
                if n <= 2:
                    return []
                else:
                    center = n // 2
                    if n % 2 == 0:
                        centers = {center - 1, center}
                        left = [i for i in range(n - 1) if i + 1 < center]
                    else:
                        centers = {center}
                        left = [i for i in range(n - 1) if i + 1 <= center]
                    right = [i for i in range(n - 1) if i >= center]
                    left.sort(reverse=True)
                    indexpairs = []
                    for l, r in zip(left, right):
                        indexpairs += [[l, l + 1], [r + 1, r]]
                
                #extend each pair toward the centers
                extended_indexpairs = []
                min_c = min(centers)
                for i, j in indexpairs:
                    path = [i, j]
                    while path[-1] not in centers:
                        step = 1 if path[-1] < min_c else -1
                        path.append(path[-1] + step)
                    extended_indexpairs.append(path)
                
                return extended_indexpairs
            
            if debugglobals:
                linelookup = None
                rawlinelookup = None
            
            def solver(polylines, solveparts = False, bimmode = False):
                if debugglobals:
                    global rawlinelookup
                    global linelookup #for debugging
                
                polys = []
                rawlinelookup = []
                segments_list = []
                
                icounter = 0
                
                for paidx, path in enumerate(polylines.Paths):
                    polysatpath = list(polylines.Branch(path))
                    polysizes = list(conduitsize.Branch(path))
                    
                    #print list(polysatpath)
                    #print "next"
                    #print bool(polysatpath)
                    
                    #optionalkey
                    o_key = 0
                    if path in optionalkeys.Paths:
                        o_key = optionalkeys.Branch(path)[0]
                    
                    for pidx, p in enumerate(polysatpath):
                        if p: #could be empty
                            trade_size = polysizes[pidx]
                            od_size = LineUtils.ConduitLookup.get_specs(trade_size)["od"]
                            #print p
                            #print list(p), path, pidx, icounter, paidx, trade_size, od_size, o_key
                            #print bimmode
                            polyobj = Polyline(list(p), path, pidx, icounter, paidx, trade_size, od_size, o_key, bimmode)
                            icounter += 1
                            polysegs = polyobj.segments
                            for polyseg in polysegs:
                                rawlinelookup.append(polyseg.geometry)
                                #segments_list.append(polyseg)
                            polys.append(polyobj)
                
                #linelookup = LineUtils.process_lines(rawlinelookup, 0.01, False, perlevel)
                #linelookupraw = LineUtils.process_lines(rawlinelookup, 0.01, True, perlevel)
                iters = 1 if speedmode else 3
                linelookup = LineUtils.process_lines_3d(rawlinelookup, 0.01, False, perlevel, "legacy", iters)
                linelookupraw = LineUtils.process_lines_3d(rawlinelookup, 0.01, True, perlevel, "legacy", iters)
            
                vectors = [[] for _ in linelookup]
                weight = [[] for _ in linelookup]

                
                if speedmode:
                    for poly in polys:
                        poly.assign_ids(linelookup)
                        for seg in poly.segments:
                            seggeo = seg.geometry
                            # reuse id computed in assign_ids to avoid a second nearest-lookup
                            idx = seg.lookupid
                            if idx < 0:
                                continue
                            weight[idx].append(seggeo.Length)
                            segvec = seggeo.Direction
                            segvec.Unitize()
                            vectors[idx].append(segvec)
                else:
                    for poly in polys:
                        poly.assign_ids(linelookup)
                        
                        for seg in poly.segments:
                            #print seg
                            seggeo = seg.geometry
                            idx = find_best_candidate(seggeo, linelookup)
                            weight[idx].append(seggeo.Length)
                            segvec = seggeo.Direction
                            segvec.Unitize()
                            #print segvec
                            vectors[idx].append(segvec)
            
                dominant_vectors = []

                
                for vec_list, w_list in zip(vectors, weight):
                    #print vec_list
                    if not vec_list:
                        continue  #added for robustness
                    ref = rg.Vector3d(vec_list[0])
                    ref.Unitize()
                
                    pos_w = 0.0
                    neg_w = 0.0
                    for v, w in zip(vec_list, w_list):
                        if v * ref >= 0:  # dot product ≥ 0 => same hemisphere
                            pos_w += w
                        else:
                            neg_w += w
                
                    if pos_w >= neg_w:
                        dominant = rg.Vector3d(ref)
                    else:
                        dominant = rg.Vector3d(-ref.X, -ref.Y, -ref.Z)
                
                    dominant_vectors.append(dominant)
                
                #adjust lines to match dominant vector
                for line, vec in zip(linelookup, dominant_vectors):
                    linedir = line.Direction
                    linedir.Unitize()
                    dotcheck = linedir * vec 
                    if dotcheck < 0:
                        pass
                        line.Flip()
                
                flippedlookup = []
                for l in linelookup:
                    flipline = rg.Line(l.To, l.From)
                    flippedlookup.append(flipline)
                
                #perpanel data fill
                perplookup = []
                if speedmode:
                    def _prep_poly_for_panel(poly):
                        poly.assign_ids(linelookup)
                        poly.finalize_segments()
                        return poly.segments
                    panel_results = LineUtils.parallel(_prep_poly_for_panel, polys)
                    if panel_results == "failed to compute":
                        # safe fallback to original single-thread path
                        for poly in polys:
                            poly.assign_ids(linelookup) 
                            poly.finalize_segments()
                            polysegs = poly.segments
                            for polyseg in polysegs:
                                perplookup.append(polyseg)
                    else:
                        for polysegs in panel_results:
                            if polysegs:
                                for polyseg in polysegs:
                                    perplookup.append(polyseg)
                else:
                    for poly in polys:
                        poly.assign_ids(linelookup) 
                        poly.finalize_segments()
                        polysegs = poly.segments
                        for polyseg in polysegs:
                            perplookup.append(polyseg)
                
                groupspre = defaultdict(list)
                for seg in perplookup:
                    groupspre[seg.lookupid].append(seg)

                
                #print "groupspre", len(groupspre.values())
                
                for grps in groupspre.values():
                    idx_map={}
                    for gr in grps:
                        idx_map.setdefault(gr.polypathidx,[]).append(gr)
                    
                    stats=[]
                    for elems in idx_map.values():
                        elemslagged = not elems[0].dirmatch
                        
                        counts={'Left':0,'Straight':0,'Right':0}
                        for e in elems:
                            if e.endpar<1.0: #only not end segments
                                counts[e.nextturn]+=1
                                
                        total=len(elems)
                        left=counts['Left']
                        straight=counts['Straight']
                        right=counts['Right']
                        
                        if elemslagged:
                            pass #flip l r if its in opposite direction to bundle
                            left, right = right, left
                        
                        #key=[left, straight, right]
                        key=[-left, straight, right]
                        
                        if right > left:
                            total_key = -total
                        else:
                            total_key = total
                            
                        key.append(total_key)
                        stats.append((key,elems))
                    
                    stats.sort(key=lambda x: x[0])
            #        if grps[0].quadrant in ["Up quadrant", "Down quadrant"]:
            #            stats.sort(key=lambda x: x[0])
            #        else:
            #            stats.sort(key=lambda x: x[0], reverse = True)
                    
                    for idx,item in enumerate(stats):
                        cnts, elems = item
                        for e in elems:
                            e.set_pathsortidx(cnts)
                            e.set_pathsortidx_(idx)
            
                #finalize data fill (mostly sortchains)
                if speedmode:
                    def _finalize_poly(poly):
                        poly.assign_ids(linelookup)
                        poly.finalize_segments()
                        poly.assign_ids_raw(linelookupraw)
                        return poly.segments
                    finalize_results = LineUtils.parallel(_finalize_poly, polys)
                    if finalize_results == "failed to compute":
                        # fallback: original single-threaded behaviour
                        for poly in polys:
                            poly.assign_ids(linelookup) 
                            poly.finalize_segments()
                            poly.assign_ids_raw(linelookupraw)
                            
                            #move seglist creation here
                            polysegs = poly.segments
                            for polyseg in polysegs:
                                segments_list.append(polyseg)
                    else:
                        for polysegs in finalize_results:
                            if polysegs:
                                for polyseg in polysegs:
                                    segments_list.append(polyseg)
                else:
                    for poly in polys:
                        poly.assign_ids(linelookup) 
                        poly.finalize_segments()
                        poly.assign_ids_raw(linelookupraw)
                        
                        #move seglist creation here
                        polysegs = poly.segments
                        for polyseg in polysegs:
                            segments_list.append(polyseg)
                
                groups = defaultdict(list)
                for seg in segments_list:
                    groups[seg.lookupid].append(seg)
                
                for lid, group in groups.items():
                    if lid < 0 or not group:
                        continue
                
                    d = linelookup[lid].Direction
                    d.Unitize()
                    
                    ordered = group

                    if bimmode:
                        # ------------------------------------------------------------
                        # BIMMODE: panel-first precompute (internal order is isolated),
                        # then global ordering only at the bundle level.
                        #
                        # Also: FORCE split by direction so each bundle moves 1 way.
                        # ------------------------------------------------------------
                        panelbundles = defaultdict(list)

                        for seg in ordered:
                            segdir = seg.geometry.Direction
                            segdir.Unitize()
                            dot = segdir * d
                            dirsign = 1 if dot >= 0 else -1

                            seg.bim_dirsign = dirsign
                            panelbundles[(seg.polypathidx, dirsign)].append(seg)

                        panelbundle_lists = []

                        for (pathidx, dirsign), blist in panelbundles.items():
                            # 1) Precompute internal order (panel isolated)
                            blist.sort(key=lambda s: s.sortchain)

                            for r, s in enumerate(blist):
                                s.bim_panelrank = r
                                s.bim_bundlekey = (pathidx, dirsign)

                            # 2) Bundle-level key (decides where the bundle sits globally)
                            counts = {'Left': 0, 'Straight': 0, 'Right': 0}
                            for s in blist:
                                if s.endpar < 1.0:  # mimic your existing "skip end segments"
                                    if s.nextturn in counts:
                                        counts[s.nextturn] += 1

                            left = counts['Left']
                            straight = counts['Straight']
                            right = counts['Right']
                            total = len(blist)

                            # If bundle runs opposite axis direction, swap Left/Right for global ordering
                            if dirsign < 0:
                                left, right = right, left

                            key = [-left, straight, right]
                            total_key = -total if right > left else total
                            key.append(total_key)

                            # Keep forward bundles before backward bundles when keys match
                            dir_order = 0 if dirsign > 0 else 1
                            key.append(dir_order)

                            # Stable tie-break (dict order in py2 is not stable)
                            key.append(pathidx)

                            panelbundle_lists.append((key, blist))

                        panelbundle_lists.sort(key=lambda x: x[0])

                        # groupsperpath == the actual BIMMODE bundles (panel+direction)
                        groupsperpath = [blist for _, blist in panelbundle_lists]

                        # Final ordered list = concatenated bundles (NO interleaving)
                        ordered = []
                        for blist in groupsperpath:
                            ordered.extend(blist)

                    else:
                        ordered.sort(key=lambda s: s.sortchain)
                        groups2 = [list(g) for _, g in itertools.groupby(ordered, lambda s: s.dirmatch)]
                    
                    count = len(ordered)
                    center = (count - 1) / 2.0
                    center_global = center
                    
                    diameters = [s.outerdiameter for s in ordered]
                    total_length = sum(diameters) + spacing * (len(ordered) - 1)
                    center_offsets = []
                    current_left = -total_length / 2.0
                    #print diameters
                    for diameter in diameters:
                        # cluster center = left edge + half its width
                        center_offsets.append(current_left + diameter / 2.0)
                        # advance left edge past this cluster + one spacing
                        current_left += diameter + spacing
                        
                    raw_offsets = center_offsets#[(i - center_global) * spacing for i in range(count)]
                    
                    # map each segment to its raw offset
                    seg_to_offset = {seg: raw_offsets[i] for i, seg in enumerate(ordered)}
                
                    #perp = rg.Vector3d(-d.Y, d.X, 0)
                    perp = rg.Vector3d(d.Y, -d.X, 0)
                    perp.Unitize() #extra robustness
                    
                    if solveparts:
                        for idx, seg in enumerate(ordered):
                            offset = center_offsets[idx]#(idx - center) * spacing
                            move_vec = rg.Vector3d(perp)
                            move_vec *= offset
                            seg.move(move_vec)
                            seg.bundleindex = idx
                
                    else:
                        if bimmode:
                            #for each subgroup in groupsperpath, compute its mean offset.
                            for bundle_index, subgroup in enumerate(groupsperpath):
                                mean_off = sum(seg_to_offset[seg] for seg in subgroup) / len(subgroup)
                            
                                #move every segment in this subgroup to that subgroup center
                                for seg in subgroup:
                                    move_vec = rg.Vector3d(perp)
                                    move_vec *= mean_off
                                    seg.move(move_vec)
                                    seg.bundleindex = bundle_index
                        else:
                            #print "not here"
                            #for each subgroup in groups2, compute its mean offset.
                            for bundle_index, subgroup in enumerate(groups2):
                                mean_off = sum(seg_to_offset[seg] for seg in subgroup) / len(subgroup)
                            
                                #move every segment in this subgroup to that subgroup center
                                for seg in subgroup:
                                    move_vec = rg.Vector3d(perp)
                                    move_vec *= mean_off
                                    seg.move(move_vec)
                                    seg.bundleindex = bundle_index
                
                secondpasscandidates = []
                firstpasses = []
                for poly in polys:
                    if poly.dirflagged:
                        secondpasscandidates.append(poly)
                    else:
                        firstpasses.append(poly)
                
                
                rebuiltree = gh.DataTree[System.Object]()
                
                for path in polylines.Paths:
                    polysatpath = polylines.Branch(path)
                    if len(polysatpath) < 1:
                        rebuiltree.AddRange([], path)
                
                for poly in polys:
                    path = poly.ghpath
                    rebuiltree.Add(poly.polyline_geometry, path)
                
                return rebuiltree, polys
            
            
            if not bothpasses: #for debugging
                #rebuiltree, polys = solver(polylines, True)
                rebuiltree, polys = solver(polylines, False)
                testpass, polys2, finaltree, treeflags, doublepolys, Boundaryobjects = [], [], [], [], [], []
            else:
                if bimmode:
                    rebuiltree, polys = solver(polylines, False, True)
                    testpass, polys2 = solver(rebuiltree, True, True)
                else:
                    rebuiltree, polys = solver(polylines, False)
                    testpass, polys2 = solver(rebuiltree, True)

                # speedmode: skip bundles & boundary pushing, use polys2 as final output
                if speedmode:
                    finaltree = gh.DataTree[System.Object]()
                    treeflags = gh.DataTree[System.Object]()
                    for path in polylines.Paths:
                        polysatpath = polylines.Branch(path)
                        if len(polysatpath) < 1:
                            finaltree.AddRange([], path)
                            treeflags.AddRange([], path)
                    for poly, flagpoly in zip(polys2, polys):
                        path = poly.ghpath
                        finaltree.Add(poly.polyline_geometry, path)
                        treeflags.Add(flagpoly.dirflagged, path)
                    doublepolys = []
                    Boundaryobjects = []
                    return (rawlinelookup, linelookup, rebuiltree, polys, polys2, finaltree, treeflags, doublepolys, Boundaryobjects)

                doublepolys = [DoublePoly(poly, poly2) for poly, poly2 in zip(polys, polys2)]
                
                dsegments = []
                for doublepoly in doublepolys:
                    for dseg in doublepoly.segmentpairs:
                        dsegments.append(dseg)
                
                bundles = defaultdict(list)
                
                for dseg in dsegments:
                    bundles[dseg.id].append(dseg)
                
                
                gg, f, e, d, c, b, a = [], [], [], [], [], [], []
                coltags, coltags2 = [], []
                
                if pulltogether:
                    #order matters, go from larger to smaller
                    sortedbundles = sorted(bundles.values(), key = len, reverse = True)
                    #tbundle = sortedbundles[0] #50 #6 #23
                    #sortedbundles = [sortedbundles[0]] #2
                    
                    for tbundle in sortedbundles:
                        if not pullstart:
                            isfirst = False
                            for dline in tbundle:
                                if not dline.first.has_prev:
                                    isfirst = True
                                    break
                                    
                            #this is a bundle containing first segment
                            if isfirst:
                                continue
                            
                        dd = tbundle[0].lookup.Direction
                        dd.Unitize()
                        dmid = tbundle[0].lookup.PointAt(0.5) #midpoint
                        perp2 = rg.Vector3d(dd.Y, -dd.X, 0)
                        perpline = rg.Line(dmid, perp2)
                        perpvec = rg.Vector3d(dd.Y, -dd.X, 0)
                        
                        #tbundle.sort(key = lambda t: perpline.ClosestParameter(t.geometry.From))
                        
                        sorted_lines = sorted(tbundle, key=lambda l: l.domain.T0)
                        groupedbundle = []
                        for line in sorted_lines:
                            if not groupedbundle or not LineUtils.domains_overlap(line.domain, groupedbundle[-1]['domain'], tol=-0.0005): #negative tol reduce the domains
                                groupedbundle.append({'lines': [line], 'domain': line.domain})
                            else:
                                grp = groupedbundle[-1]
                                grp['lines'].append(line)
                                grp['domain'] = rg.Interval.FromUnion(grp['domain'], line.domain)
                        
                        #print "groupedbundles : {}".format(len(groupedbundle))
                        
                        for bundlegrp in groupedbundle:
                            #print "here"
                            sortedgrp = sorted(bundlegrp["lines"], key = lambda t: perpline.ClosestParameter(t.geometry.From))
                         
                            grplen = len(sortedgrp)
                            lookup_lists = computeindices(grplen)
                            domain_slots = [[member.domain] for member in sortedgrp]
                            idx_slots = [[i_] for i_, member in enumerate(sortedgrp)]
                            
                            for lookup_list in lookup_lists:
                                seed_idx = lookup_list[0]
                                haysack = lookup_list[1:]
                                
                                currdom = domain_slots[seed_idx][0]
                                #candidatedoms = [domain_slots[hay] for hay in haysack] 
                                
                                conflict = False
                                newpos = seed_idx
                                #for candidatedom, hay in zip(candidatedoms, haysack):
                                for hay in haysack:
                                    candidatedom = domain_slots[hay]
                                    if any([LineUtils.domains_overlap(currdom, canddom, tol=-0.0005) for canddom in candidatedom]):
                                        conflict = True
                                        break
                                    else:
                                        pass
                                        newpos = hay
                                
                                if newpos == seed_idx:
                                    pass
                                    #subgroup_collections.append([sortedgrp[seed_idx]])
                                else:
                                    domain_slots[newpos].append(currdom)
                                    domain_slots[seed_idx] = [rg.Interval(-100.0, -99.0)]
                                    
                                    idx_slots[newpos].append(seed_idx)
                                    idx_slots[seed_idx] = []
                                    #subgroup_collections.append([
                                
                            subgroup_collections = []
                            #print idx_slots
                            for slot in idx_slots:
                                if slot:
                                    collection = []
                                    for s in slot:
                                        collection.append(sortedgrp[s])
                                    subgroup_collections.append(collection)
                        
                            #subgroup_collections.append(current_cluster)
                
                            bcount = grplen
                            bcenter = (bcount - 1) / 2.0
                            
                            for bidx, bseg in enumerate(sortedgrp):
                                #resetprevoffsets
                                segp = bseg.geometry.From
                                projectp = perpline.ClosestPoint(segp, False) #false infinite
                                adjustvec = rg.Vector3d(dmid-projectp)
                                
                                bseg.final.move(adjustvec)#resetoffsets
                
                            ccount = len(subgroup_collections)
                            
                            #compute each cluster’s real diameter and stash in a list to walk them
                            position_max_diameter_list = [max([c.first.outerdiameter for c in cl]) for cl in subgroup_collections]
                            
                            #total span of all clusters + gaps
                            total_length = sum(position_max_diameter_list) + spacing * (ccount - 1)
                            
                            #build a list of center‐offsets for each cluster
                            center_offsets = []
                            current_left = -total_length / 2.0
                            for diameter in position_max_diameter_list:
                                # cluster center = left edge + half its width
                                center_offsets.append(current_left + diameter / 2.0)
                                # advance left edge past this cluster + one spacing
                                current_left += diameter + spacing
                            
                            for cidx, cluster in enumerate(subgroup_collections):
                                # build the vector along your perpvec
                                offset = center_offsets[cidx]
                                move_vec = rg.Vector3d(perpvec)
                                move_vec *= offset
                            
                                for item in cluster:
                                    #needed to create "boundary regions" of each cluster accurately
                                    #else too many regions are created with too many gaps
                                    item.set_maxslotdiameter(position_max_diameter_list[cidx])
                                    gg.append(cidx)
                                    item.final.move(move_vec)  # your custom move
                
                #bundles grouped on unique paths
                bundleboundaries = []
                
                #print "first bundles", len(bundles)
                #print bundles
                
                bundletolerance = 0.3
                
                Boundaryobjects = []
                
                for bidx, bundle in enumerate(bundles.values()):
                    rectangles = []
                    geometries = []
                    vectorkey = bundle[0].geometry.Direction
                    vectorkey.Unitize()
                    
                    anglekey = LineUtils.encode(vectorkey, 3)
                    
                    bundle_z = bundle[0].geometry.From.Z
                    
                    #print bundle
                    for elem in bundle:
                        elem.set_bundleidx(bidx)
                        line = elem.geometry
                        geometries.append(line)
                        #size = elem.first.outerdiameter
                        size = elem.maxslotdiameter
                        rectangle = LineUtils.rectangle_from_line(line, size + spacing + bundletolerance)
                        rectangles.append(rectangle)
                        
                    bundleboundary = LineUtils.union_intersecting_rects_outline(rectangles)
                    for oidx, bound in enumerate(bundleboundary):
                        bndry = Boundary(bound, bidx, oidx, anglekey, vectorkey, bundle_z)
                        Boundaryobjects.append(bndry)
                    
                    lineindexlookup = [LineUtils.line_in_polyline(l, bundleboundary) for l in geometries]
                    
                    for elem, lil in zip(bundle, lineindexlookup):
                        elem.set_outlineidx(lil)
                    #print "Vector {}, Angle {}, Bundlelen {}, unionregions {}, index lookup {}".format(0, anglekey, len(bundle), len(bundleboundary), lineindexlookup)
                    #print len(bundle), "___", len(bundleboundary), "___", lineindexlookup
                    
                    bundleboundaries.append(bundleboundary)
                    
                #print len(bundles)
                
                #_________OVERLAP PUSHING LOGIC_______
                # Maximum number of iterations for overlap resolution
                MAX_IT = 50
                
                # Reset all move vectors to zero
                for b in Boundaryobjects:
                    b.movevector = rg.Vector3d(0, 0, 0)
                
                # Group boundaries by encoded key and optional Z-level clustering
                groups = {}
                for b in Boundaryobjects:
                    if perlevel:
                        # snap Z to tolerance grid
                        zlvl = round(b.z / bundletolerance) * bundletolerance
                        key = (b.encoded, zlvl)
                    else:
                        key = b.encoded
                    groups.setdefault(key, []).append(b)
                
                #print len(groups.values())
                
                if pushflag: #pushout mechanism
                    for group in groups.values():
                        # ─── ensure smaller boundaries go first ───
                        group.sort(key=lambda b: b.geometry.Length)
                        
                        # make a mutable copy of each boundary’s geometry
                        lookup = {}
                        for b in group:
                            lookup[b] = rg.Polyline(b.geometry)
                    
                        locked = set()
                        it = 0
                        changed = True
                        
                        #track collision links inside this group
                        edges = defaultdict(set)
                        for _b in group:
                            edges[_b] = set()
                    
                        # repeat until no more pushes or iteration limit reached
                        while changed and it < MAX_IT:
                            changed = False
                            it = it + 1
                    
                            for b in group:
                                if b in locked:
                                    continue
                    
                                pl_s = lookup[b]
                                collided_with = None
                    
                                # find first collider for b
                                for bL in group:
                                    if bL is b:
                                        continue
                                    if LineUtils.polylines_collide(pl_s, lookup[bL]):
                                        collided_with = bL
                                        break
                                    
                                #remember that these two boundaries interacted
                                if collided_with is not None:
                                    edges[b].add(collided_with)
                                    edges[collided_with].add(b)
                    
                                if collided_with is None:
                                    continue
                    
                                # build a unit perpendicular direction
                                perp = rg.Vector3d(-b.axis.Y, b.axis.X, 0)
                                perp.Unitize()
                    
                                # ——— compute total shift in +perp direction ———
                                total_pos = 0.0
                                temp_pl = rg.Polyline(pl_s)
                                while True:
                                    next_collider = None
                                    for bO in group:
                                        if bO is b:
                                            continue
                                        if LineUtils.polylines_collide(temp_pl, lookup[bO]):
                                            next_collider = bO
                                            break
                                    if next_collider is None:
                                        break
                    
                                    # for each vertex, shoot an infinite +perp ray to next_collider
                                    pos_dists = []
                                    for pt in temp_pl:
                                        start_pt = rg.Point3d(pt)
                                        end_pt = rg.Point3d(start_pt + perp * 1e6)
                                        line_curve = rg.LineCurve(start_pt, end_pt)
                                        poly_curve = rg.PolylineCurve(lookup[next_collider])
                                        events = rg.Intersect.Intersection.CurveCurve(
                                            line_curve, poly_curve, 0.0, 0.0
                                        )
                                        for ev in events:
                                            if ev.ParameterA > 0:
                                                pos_dists.append(ev.ParameterA)
                    
                                    if pos_dists:
                                        shift = max(pos_dists)
                                    else:
                                        shift = 0.0
                                    shift = shift + GLOBAL_TOL
                    
                                    total_pos = total_pos + shift
                                    translation = rg.Transform.Translation(perp * shift)
                                    temp_pl.Transform(translation)
                    
                                # ——— compute total shift in -perp direction ———
                                total_neg = 0.0
                                temp_pl = rg.Polyline(pl_s)
                                while True:
                                    next_collider = None
                                    for bO in group:
                                        if bO is b:
                                            continue
                                        if LineUtils.polylines_collide(temp_pl, lookup[bO]):
                                            next_collider = bO
                                            break
                                    if next_collider is None:
                                        break
                    
                                    # for each vertex, shoot an infinite -perp ray to next_collider
                                    neg_dists = []
                                    for pt in temp_pl:
                                        start_pt = rg.Point3d(pt)
                                        end_pt = rg.Point3d(start_pt - perp * 1e6)
                                        line_curve = rg.LineCurve(start_pt, end_pt)
                                        poly_curve = rg.PolylineCurve(lookup[next_collider])
                                        events = rg.Intersect.Intersection.CurveCurve(
                                            line_curve, poly_curve, 0.0, 0.0
                                        )
                                        for ev in events:
                                            if ev.ParameterA > 0:
                                                neg_dists.append(ev.ParameterA)
                    
                                    if neg_dists:
                                        shift = max(neg_dists)
                                    else:
                                        shift = 0.0
                                    shift = shift + GLOBAL_TOL
                    
                                    total_neg = total_neg + shift
                                    translation = rg.Transform.Translation(perp * -shift)
                                    temp_pl.Transform(translation)
                    
                                # choose the shorter unsigned total shift
                                if total_pos <= total_neg:
                                    shift_vec = perp * total_pos
                                else:
                                    shift_vec = perp * -total_neg
                    
                                # apply the chosen shift to the real geometry
                                translation = rg.Transform.Translation(shift_vec)
                                lookup[b].Transform(translation)
                                b.movevector = b.movevector + shift_vec
                    
                                # lock this boundary and the one it first collided with
                                locked.add(b)
                                locked.add(collided_with)
                    
                                changed = True
                                break  # restart from the top of the while loop
                    
                            if changed:
                                continue
                    
                        #assign boundlegroup ids for this group based on collision graph
                        visited = set()
                        gid = 0
                        for seed in group:
                            if seed in visited:
                                continue
                            stack = [seed]
                            component = []
                            while stack:
                                cur = stack.pop()
                                if cur in visited:
                                    continue
                                visited.add(cur)
                                component.append(cur)
                                for nb in edges.get(cur, ()):
                                    if nb not in visited:
                                        stack.append(nb)
                            for m in component:
                                m.boundlegroup = gid
                            gid = gid + 1
                    
                        # warn if iteration limit reached
                        if it >= MAX_IT:
                            print("Warning: maximum iterations reached for one group")
                        else:
                            print "{} optimization iterations out of {} set as max".format(it, MAX_IT)
                
                
                #_________APPLYING BOUNDARIES SHIFTS_______
                boundarylookup = defaultdict(lambda: defaultdict(list))
                
                for b in Boundaryobjects:
                    boundarylookup[b.bundleidx][b.outlineidx].append(b)
                
                for doublepoly in doublepolys:
                    for doublesegment in doublepoly.segmentpairs:
                        ds = doublesegment
                        try:
                            linkedboundary = boundarylookup[ds.bundleidx][ds.outlineidx][0]
                            shift = linkedboundary.movevector
                            
                            #persist boundary linked-group id on the segment
                            ds.set_boundlegroup(linkedboundary.boundlegroup)
                            
                            if shift.Length > GLOBAL_TOL:
                                pass
                                doublesegment.final.move(shift)
                        except:
                            print "bundleindex {}, outlineindex {}".format(ds.bundleidx, ds.outlineidx)
                
                #_________FORMING FINAL DATATREES_______
                
                adjusted = []
                for dseg in dsegments:
                    adjusted.append(dseg.final.geometry)
                
                finaltree = gh.DataTree[System.Object]()
                treeflags = gh.DataTree[System.Object]()
                
                for path in polylines.Paths:
                    polysatpath = polylines.Branch(path)
                    if len(polysatpath) < 1:
                        finaltree.AddRange([], path)
                        treeflags.AddRange([], path)
                
                for poly, flagpoly in zip(polys2, polys):
                    #print dir(poly)
                    #break
                    path = poly.ghpath
                    finaltree.Add(poly.polyline_geometry, path)
                    treeflags.Add(flagpoly.dirflagged, path)
            
            # return outputs 
            return (rawlinelookup, linelookup, rebuiltree, polys, polys2, finaltree, treeflags, doublepolys, Boundaryobjects)

    @staticmethod
    def prefilter_polyline_tree(polylinesbatch, tol = GLOBAL_TOL):
        """
        takes a tree of polylines as input and tries to realign all axis of all
        polilines to simplify and straighten them, resnaps all polyline points
        to reconstructed axis
        """
        try:
            rawlines = []
            
            for polylines_ in polylinesbatch.Branches:
                for poly in list(polylines_):
                    #DO NOT merge collinear, it breaks the tolerances
                    #poly.MergeColinearSegments(GLOBAL_TOL, False)
                    if poly:
                        for i in range(poly.SegmentCount):
                            rawlines.append(poly.SegmentAt(i))
            
            resplit = LineUtils.split_lines_at_intersections(rawlines, tol, False)
            deduped = LineUtils.dedupe_lines(resplit, tol)
            sweeped = LineUtils.build_collinear_polylines_sweep(deduped, tol, 1.0)
            axised = [LineUtils.fit_weighted_line_from_polyline(sweep) for sweep in sweeped]
            resnapped = LineUtils.extend_lines_to_touch_others(axised)
            
            polylinesnapped = gh.DataTree[System.Object]()
            
            for path in polylinesbatch.Paths:
                polydata = list(polylinesbatch.Branch(path))
                polyresnapped = LineUtils.snap_polylines_points_to_lines(polydata, resnapped, keepempty = True)
                for p in polyresnapped:
                    if p:
                        p.MergeColinearSegments(tol, False)
                polylinesnapped.AddRange(polyresnapped, path)
            
            return polylinesnapped
        except:
            return "check your data type, has to be a tree of polylines"

    @staticmethod
    def linear_to_log(v, exponent=2.0):
        """
        Remap a linear input [0.0, 1.0] onto a logarithmic curve [0.0, 1.0].
        Clamps any input outside the [0.0, 1.0] range.
        """
        # clamp input
        # clamp input
        if v < 0.0:
            v = 0.0
        elif v > 1.0:
            v = 1.0
        # apply power mapping
        return v ** exponent

    @staticmethod
    def inchify(size):
        """
        Round a decimal inch measurement to nearest standard fraction
        (1/2, 1/4, 1/8, 1/16, or 1/32) and return the resulting float value.
        """
        whole = int(size)
        frac = size - whole
        denominators = [2, 4, 8, 16, 32]
        best_num = 0; best_den = 1; best_diff = None
        for d in denominators:
            n = int(frac * d + 0.5)
            diff = abs(frac - (float(n) / d))
            if best_diff is None or diff < best_diff:
                best_diff = diff; best_num = n; best_den = d
        def gcd(a, b):
            while b:
                a, b = b, a % b
            return a
        g = gcd(best_num, best_den)
        num_s = best_num // g; den_s = best_den // g
        if num_s == den_s:
            return float(whole + 1)
        if num_s == 0:
            return float(whole)
        return whole + float(num_s) / den_s

    # --- Spline Interpolation methods ---
    @staticmethod
    def solve_linear_system(A, b):
        """
        Solve a linear system Ax = b using Gaussian elimination
        with partial pivoting. Returns solution vector x.
        """
        n = len(A)
        for i in range(n):
            # find pivot
            max_el = abs(A[i][i]); max_row = i
            for k in range(i+1, n):
                if abs(A[k][i]) > max_el:
                    max_el = abs(A[k][i]); max_row = k
            A[i], A[max_row] = A[max_row], A[i]
            b[i], b[max_row] = b[max_row], b[i]
            # eliminate
            for k in range(i+1, n):
                c = -A[k][i] / A[i][i]
                for j in range(i, n):
                    if i == j:
                        A[k][j] = 0
                    else:
                        A[k][j] += c * A[i][j]
                b[k] += c * b[i]
        # back substitution
        x = [0 for _ in range(n)]
        for i in range(n-1, -1, -1):
            x[i] = b[i] / A[i][i]
            for k in range(i-1, -1, -1):
                b[k] -= A[k][i] * x[i]
        return x

    @staticmethod
    def calculate_spline_coefficients(x, y):
        """
        Compute cubic spline coefficients for given points (x, y).
        Returns tuples (a, b, c, d) representing spline segments.
        """
        n = len(x) - 1
        a = {k: v for k, v in enumerate(y)}
        h = {k: x[k+1] - x[k] for k in range(n)}
        # set up system
        A = [[0]*(n+1) for _ in range(n+1)]
        b = [0] * (n+1)
        for i in range(1, n):
            A[i][i-1] = h[i-1]
            A[i][i]   = 2*(h[i-1] + h[i])
            A[i][i+1] = h[i]
            b[i] = 3*((a[i+1] - a[i]) / h[i] - (a[i] - a[i-1]) / h[i-1])
        A[0][0] = 1; A[n][n] = 1
        c = LineUtils.solve_linear_system(A, b)
        bcoef = {}; dcoef = {}
        for i in range(n):
            bcoef[i] = (a[i+1] - a[i]) / h[i] - (h[i]*(c[i+1] + 2*c[i]) / 3)
            dcoef[i] = (c[i+1] - c[i]) / (3*h[i])
        return a, bcoef, c, dcoef

    @staticmethod
    def cubic_spline(x, coeffs, xi):
        """
        Evaluate the cubic spline at point xi using precomputed coefficients.
        Returns interpolated value or None if xi is out of range.
        """
        a, bcoef, c, dcoef = coeffs
        n = len(x) - 1
        for i in range(n):
            if x[i] <= xi <= x[i+1]:
                dx = xi - x[i]
                return a[i] + bcoef[i]*dx + c[i]*dx**2 + dcoef[i]*dx**3
        return None

    # --- Pipe generation methods ---
    @staticmethod
    def _bisector_plane(v1, v2, origin):
        """
        Create bisector plane for section placement.
        If v1 and v2 are colinear, returns a plane perpendicular to that direction.
        """
        # detect parallel or anti-parallel: cross will be near zero
        if abs(v1.IsParallelTo(v2, GLOBAL_TOL)) == 1:
            # For straight segments, just use a plane whose normal is the segment vector:
            return rg.Plane(origin, v2)

        # otherwise, compute true bisector plane
        bisector = v1 * v2.Length + v2 * v1.Length
        normal   = rg.Vector3d.CrossProduct(v1, v2)
        return rg.Plane(origin, bisector, normal)

    @staticmethod
    def _mesh_strip(p1, p2):
        """
        Create a quad strip mesh between two rings
        """
        m = rg.Mesh()
        cnt = p1.Count
        for i in range(cnt - 1):
            m.Vertices.Add(p1[i])
            m.Vertices.Add(p2[i])
        for j in range(cnt - 2):
            m.Faces.AddFace(j * 2 + 2, j * 2 + 3, j * 2 + 1, j * 2)
        last = cnt - 2
        m.Faces.AddFace(0, 1, last * 2 + 1, last * 2)
        return m

    @staticmethod
    def _create_ring(pt, vec, radius, segments):
        """
        Generate a circular ring at point along vector
        """
        plane = rg.Plane(pt, vec)
        cir = rg.Circle(plane, radius)
        ring = rg.Polyline()
        segf = float(segments)
        for i in range(int(segments) + 1):
            t = i * (2.0 * math.pi / segf) #fix for integer division when imported library
            ring.Add(cir.PointAt(t))
        return ring

    @staticmethod
    def _advance_ring(prev_ring, travel, sec_plane):
        """
        Project prev_ring along travel onto sec_plane
        """
        new_ring = rg.Polyline()
        for pt in prev_ring:
            line = rg.Line(pt, travel, 10.0)
            rc, t = rg.Intersect.Intersection.LinePlane(line, sec_plane)
            if not rc:
                t = 0.0
            new_ring.Add(line.PointAt(t))
        return new_ring

    @staticmethod
    def _build_rings(pl, radius, segments, closed):
        """
        Build sequence of rings along polyline
        """
        rings = [LineUtils._create_ring(pl[0], pl[1] - pl[0], radius, segments)]
        count = pl.Count
        if closed:
            v_start = pl[1] - pl[0]
            v_prev = pl[count - 2] - pl[0]
            sec_plane = LineUtils._bisector_plane(v_start, v_prev, pl[0])
            rings = [LineUtils._advance_ring(rings[0], pl[1] - pl[0], sec_plane)]
            start = 1; end = count - 2
        else:
            start = 0; end = count - 3
        for j in range(start, end + 1):
            v_prev = pl[j] - pl[j + 1]
            v_next = pl[j + 2] - pl[j + 1]
            sec_plane = LineUtils._bisector_plane(v_prev, v_next, pl[j + 1])
            travel = pl[j + 1] - pl[j]
            rings.append(LineUtils._advance_ring(rings[-1], travel, sec_plane))
        if not closed:
            end_pt = pl[count - 1]
            end_vec = pl[count - 2] - end_pt
            proj = rg.Polyline(rings[-1])
            xf = rg.Transform.PlanarProjection(rg.Plane(end_pt, end_vec))
            proj.Transform(xf)
            rings.append(proj)
        return rings

    @staticmethod
    def make_open(pl, radius, segments):
        """
        Generate pipe mesh for an open polyline
        """
        rings = LineUtils._build_rings(pl, radius, segments, False)
        mesh = rg.Mesh()
        for i in range(len(rings) - 1):
            mesh.Append(LineUtils._mesh_strip(rings[i], rings[i + 1]))
        mesh.Vertices.CombineIdentical(True, True)
        return mesh

    @staticmethod
    def make_closed(pl, radius, segments):
        """
        Generate pipe mesh for a closed polyline
        """
        rings = LineUtils._build_rings(pl, radius, segments, True)
        mesh = rg.Mesh()
        for i in range(len(rings) - 1):
            mesh.Append(LineUtils._mesh_strip(rings[i], rings[i + 1]))
        mesh.Append(LineUtils._mesh_strip(rings[0], rings[-1]))
        mesh.Vertices.CombineIdentical(True, True)
        return mesh

    @staticmethod
    def _compute_cut(r, s, theta, tol = GLOBAL_TOL):
        """
        Given bend radius r and deflection θ,  
        find the tangent offset (r·tan(θ/2)) from the pipe intersection,  
        then add the fitting’s straight stub length s.
        If near 0 -> no cut
        """
        if abs(theta) <= tol:
            return 0
        else:
            return r * math.tan(math.radians(theta/2.0)) + s

    @staticmethod
    def compute_raise(L, ang_deg, tol=GLOBAL_TOL):
        """
        Vertical rise of a straight segment of length L set at ang_deg to horizontal.
        """
        #ang_deg = 90 - ang_deg
        a = abs(ang_deg) % 180.0
        
        if a <= tol: 
            return 0
            
        if abs(a - 180.0) <= tol: 
            return 0
         
        h = L * math.sin(math.radians(a))
        
        if h <= tol: 
            return 0

        return h

    @staticmethod
    def compute_run(L, ang_deg, tol=GLOBAL_TOL):
        """
        Horizontal run of a straight segment of length L set at ang_deg to horizontal.
        """
        a = abs(ang_deg) % 180.0

        if a <= tol:
            return L

        if abs(a - 180.0) <= tol:
            return L

        if abs(a - 90.0) <= tol:
            return 0

        r = L * abs(math.cos(math.radians(a)))

        if r <= tol:
            return 0

        return r

    @staticmethod
    def compute_opposite(adjacent, ang_deg, tol=GLOBAL_TOL):
        """
        Opposite side (vertical) for a right‑triangle given adjacent side and angle to horizontal.
        """
        a = abs(ang_deg)%180.0
        if a <= tol or abs(a-180.0) <= tol:
            return 0
            
        if abs(a-90.0) <= tol:
            return float('inf')
            
        opp = adjacent*math.tan(math.radians(a))
        
        if abs(opp) <= tol:
            return 0
            
        return opp

    @staticmethod
    def fit_angle_to_height(L, avail_h, tol=GLOBAL_TOL):
        """
        Return the steepest angle whose rise fits in avail_h. 
        """
        if L <= tol:
            return 0.0
            
        if avail_h <= tol:
            return 0.0
            
        if avail_h >= L - tol:
            return 90.0
            
        ratio = avail_h / float(L)
        
        if ratio > 1.0:
            ratio = 1.0
            
        return math.degrees(math.asin(ratio))

    @staticmethod
    def smallest_ge(seq, x):
        """
        Smallest greater or equal from list of values
        """
        best = None
        for v in seq:
            if v >= x:
                if best is None or v < best: best = v
        return best

    @staticmethod
    def compute_pipe(pipepolyline, traderadius, segments, compute_normals, mergecollinear = True, linearsegments = 0.5, placefittings = False):
        """
        Create a mesh pipe along a polyline without caps
        Linear segments should be a 0.0 to 1.0 value which will 
        approximate curvature into polyline based on radius
        """
        radius = LineUtils.ConduitLookup.get_specs(traderadius)['od']/2
        
        segments = max(segments, 3)
        
        min_factor = 0.01   # when linearsegments == 0.0 -> mapped == 0.01 * radius
        max_factor = 5.0   # when linearsegments == 1.0 -> mapped == 5.0 * radius
        
        # clamp linearsegments to [0.0, 1.0]
        clamped = LineUtils.linear_to_log(linearsegments, 2)
        if clamped < 0.0:
            clamped = 0.0
        elif clamped > 1.0:
            clamped = 1.0
        
        # linearly map to [min_factor * radius, max_factor * radius]
        mapped = radius * (min_factor + (max_factor - min_factor) * clamped)
        
        linearsegmentresolution = mapped
        
        poly = None
        polycrvflag = False
        if isinstance(pipepolyline, rg.Polyline):
            poly = pipepolyline
        elif hasattr(pipepolyline, 'TryGetPolyline'):
            result, pl = pipepolyline.TryGetPolyline()
            if result:
                poly = pl
            else:
                polycrvflag = True
                polycrv = pipepolyline.ToPolyline(linearsegmentresolution*3, math.pi, linearsegmentresolution, float("inf"))
                poly = polycrv.ToPolyline()
                
        if poly is None or poly.Count < 2:
            return None
        
        #NOTE placeholder passing handling if polycrvflag
        if placefittings and not polycrvflag:
            angleschain = [] 
            fittingplanes = []
            segmentschain = []
            poly.MergeColinearSegments(GLOBAL_TOL, True) #always merge, collinear segment fittings arent usec currently
            
            #extract straight segments
            for i in range(poly.SegmentCount):
                seg = poly.SegmentAt(i)
                segmentschain.append(seg)
            
            #for each joint, get angle and bisector plane
            for i in range(len(segmentschain) - 1):
                seg1 = segmentschain[i]
                seg2 = segmentschain[i + 1]
                
                v1 = seg1.Direction
                v2 = seg2.Direction
                v1.Unitize()
                v2.Unitize()
                
                # dot‐acos gives 0 to 180°, always nonnegative
                angle_rad = math.acos(max(-1.0, min(1.0, v1 * v2)))
                angle_deg = round(math.degrees(angle_rad), 3)
                angleschain.append(angle_deg)
                
                # bisector direction (handles 180° by picking a perp if zero)
                bis = rg.Vector3d(v1 + v2)
                if bis.IsZero:
                    # perpendicular in-plane
                    bis = rg.Vector3d(-v1.Y, v1.X, 0)
                bis.Unitize()
                
                # normal from cross product
                normal = rg.Vector3d.CrossProduct(v1, v2)
                normal.Unitize()
                
                # plane at the joint point, x-axis=bisector, z-axis=normal
                origin = seg1.To
                # compute a proper Y-axis so that Plane.Z == normal
                yaxis = rg.Vector3d.CrossProduct(normal, bis)
                yaxis.Unitize()
                
                plane = rg.Plane(origin, bis, yaxis)
                fittingplanes.append(plane)
            
            segment_angle_pairs = []  # will hold tuples of (segment, startAng, endAng)
            
            for i, seg in enumerate(segmentschain):
                # start angle: 0° if first, otherwise the previous joint angle
                if i == 0:
                    start_ang = 0.0
                else:
                    start_ang = angleschain[i - 1]
                
                # end angle: 0° if last, otherwise the next joint angle
                if i == len(segmentschain) - 1:
                    end_ang = 0.0
                else:
                    end_ang = angleschain[i]
                
                segment_angle_pairs.append((seg, start_ang, end_ang))
            
            linearstub = LineUtils.ConduitLookup.get_specs(traderadius)['linear_section']
            bendradius = LineUtils.ConduitLookup.get_specs(traderadius)['min_bend']
            
            cutsegments = []
            for sap in segment_angle_pairs:
                seg, st_a, e_a = sap
                seglen = seg.Length
                startcut = LineUtils._compute_cut(bendradius, linearstub, st_a)
                endcut = LineUtils._compute_cut(bendradius, linearstub, e_a)
                cutlen = startcut + endcut
                
                if seglen > cutlen + GLOBAL_TOL:
                    newseg = rg.Line(seg.From, seg.To) #create a "deepcopy"
                    newseg.Extend(-startcut, -endcut)
                    cutsegments.append(newseg)
                else:
                    pass #doesnt need to be placed
            
            finalmesh = rg.Mesh()
            for cutseg in cutsegments:
                cutpoly = rg.Polyline([cutseg.From, cutseg.To])
                segment = LineUtils.compute_pipe(cutpoly, traderadius, segments, compute_normals, mergecollinear, linearsegments, placefittings = False)
                #print "segment", segment
                finalmesh.Append(segment)
            
            turnsegments = []
            for angle, plane in zip(angleschain, fittingplanes):
                linearlen = LineUtils._compute_cut(bendradius, linearstub, angle)
                half = math.radians((180-angle)/2) #here lets say 30degree is considered as 150 in such planes
                dx = math.sin(half)*linearlen
                dy = math.cos(half)*linearlen
                p1 = plane.Origin + plane.XAxis*dx + plane.YAxis*dy
                p2 = plane.Origin + plane.XAxis*-dx + plane.YAxis*dy
                polyturn = rg.Polyline([p1, plane.Origin, p2])
                
                filletedturn = LineUtils.fillet2(polyturn, bendradius, segments = 10)
                turnmesh = LineUtils.compute_pipe(filletedturn, traderadius, segments, compute_normals, mergecollinear, linearsegments, placefittings = False)
                
                finalmesh.Append(turnmesh)
                #turnsegments.append(filletedturn)
                #turnsegments.append(polyturn)
            
            #return turnsegments
            return finalmesh
            #return cutsegments
            #print segment_angle_pairs
            #print angleschain
            #return fittingplanes
            
            
        else: #always here if polycrvflag currently
            if mergecollinear:
                poly.MergeColinearSegments(GLOBAL_TOL, True)
            
            mesh = LineUtils.make_closed(poly, radius, segments) if poly.IsClosed else LineUtils.make_open(poly, radius, segments)
            if compute_normals:
                mesh.Normals.ComputeNormals()
                mesh.UnifyNormals()
                
            return mesh
    
    @staticmethod
    def fillet2(polyline, radius, segments = 10):
        """
        Takes a polyline with EXACTLY 2 segments as input
        creates a fillet with n segments
        fillet is not an arch, result is always a polyline
        """
        # must be exactly two segments
        if polyline.Count != 3:
            return "Polyline must have exactly 2 segments"
        
        p0, p1, p2 = polyline[0], polyline[1], polyline[2]
    
        #build a plane through p1 using p0->p1 and p2->p1
        plane = rg.Plane(p1, p0, p2)
    
        #project into that plane (unpack success,u,v)
        ok, u0, v0 = plane.ClosestParameter(p0)
        ok, u1, v1 = plane.ClosestParameter(p1)
        ok, u2, v2 = plane.ClosestParameter(p2)
        p0_2d = rg.Point2d(u0, v0)
        p1_2d = rg.Point2d(u1, v1)
        p2_2d = rg.Point2d(u2, v2)
    
        #compute the two trim points along each incoming/outgoing edge
        vA = p0_2d - p1_2d; vA.Unitize()
        vB = p2_2d - p1_2d; vB.Unitize()
        theta = math.acos(vA * vB)
        d = radius / math.tan(theta/2.0)
        tp1_2d = p1_2d + vA * d
        tp2_2d = p1_2d + vB * d
    
        #find the 2D center of the circular fillet
        bis = vA + vB; bis.Unitize()
        h = radius / math.sin(theta/2.0)
        center2d = p1_2d + bis * h
    
        #compute start/end angles
        angle1 = math.atan2(tp1_2d.Y - center2d.Y, tp1_2d.X - center2d.X)
        angle2 = math.atan2(tp2_2d.Y - center2d.Y, tp2_2d.X - center2d.X)
    
        # normalize into [-Pi, Pi] in one go
        delta = (angle2 - angle1 + math.pi) % (2*math.pi) - math.pi
    
        #sample the arc in 'segments' steps
        arc2d = []
        for i in range(segments + 1):
            t = float(i) / segments
            ang = angle1 + delta * t
            x = center2d.X + math.cos(ang) * radius
            y = center2d.Y + math.sin(ang) * radius
            arc2d.append(rg.Point2d(x, y))
    
        #build the new 2D polyline and map back to world
        pts2d = [p0_2d, tp1_2d] + arc2d[1:-1] + [tp2_2d, p2_2d]
        pts3d = [plane.PointAt(pt.X, pt.Y) for pt in pts2d]
    
        return rg.Polyline(pts3d)

    @staticmethod
    def boundary_surface(curve, tol = GLOBAL_TOL):
        """
        Create planar Brep from a  boundary edge curve.
        (possibly empty if compute failed)
        """
        #No input -> nothing
        if not curve:
            #print "here"
            return None
            
        #Normalize polyline input
        if isinstance(curve, rg.Polyline):
            poly = curve
        elif hasattr(curve, 'TryGetPolyline'):
            result, pl = curve.TryGetPolyline()
            if result:
                poly = pl
            else:
                polycrv = curve.ToPolyline(tol*3, math.pi, tol, float("inf"))
                poly = polycrv.ToPolyline()

        pl = poly

        if pl.IsClosed:
            seg_cnt = pl.SegmentCount - 1 
            if seg_cnt in (3, 4):
                pts = [pl[i] for i in range(seg_cnt)]
                # handle triangle and quad separately
                if seg_cnt == 3:
                    brep = rg.Brep.CreateFromCornerPoints(
                        pts[0], pts[1], pts[2], tol)
                else:
                    brep = rg.Brep.CreateFromCornerPoints(
                        pts[0], pts[1], pts[2], pts[3], tol)
            else:
                brep = rg.Brep.CreatePlanarBreps(pl.ToPolylineCurve(), tol)[0]
                #print "not 3, 4, count {}".format(seg_cnt)
                
            if brep:
                return brep
        else:
            #print "notclosed"
            return None

    @staticmethod
    def extrusion(curve, direction, tol = GLOBAL_TOL):
        """
        Closed polyline as input 
        Returns capped rg.Extrusion
        """
        
        #Normalize polyline input
        if isinstance(curve, rg.Polyline):
            poly = curve
        elif hasattr(curve, 'TryGetPolyline'):
            result, pl = curve.TryGetPolyline()
            if result:
                poly = pl
            else:
                polycrv = curve.ToPolyline(tol*3, math.pi, tol, float("inf"))
                poly = polycrv.ToPolyline()
        
        if poly:
            #print "here", poly.IsClosed
            if poly.IsClosed:
                #NOTE: ToPolylineCurve() mostly gave no results, while ToNurbsCurve() worked very well 
                ext = rg.Extrusion.Create(poly.ToNurbsCurve(), direction.Length, True)
                #print [p.Z for p in poly]
                #print ext#, direction, direction.Length, poly, poly.ToPolylineCurve()
                return ext

        return None


    #currently here, need to think on where to put this style functions
    #box from rectangle, for example for line box intersection
    @staticmethod
    def rectangle_to_box(rect, thickness=10.0):
        """
        Creates a Box from a Rectangle3d by extruding it along its plane normal
        to the specified thickness.
        """
        plane = rect.Plane
        x_int = rect.X
        y_int = rect.Y
        z_int = rg.Interval(-thickness/2.0, thickness/2.0)
        return rg.Box(plane, x_int, y_int, z_int)
    
    @staticmethod
    def offset_rectangle(rect, offset, tol = GLOBAL_TOL):
        """
        Returns a new Rectangle3d expanded by the given offset on X and Y,
        enforcing a minimum size based on tolerance.
        """
        x, y = rect.X, rect.Y
        xmin, xmax = x.Min - offset, x.Max + offset
        ymin, ymax = y.Min - offset, y.Max + offset
        if xmax - xmin < tol:
            m = (xmin + xmax) * 0.5
            xmin, xmax = m - tol/2, m + tol/2
        if ymax - ymin < tol:
            m = (ymin + ymax) * 0.5
            ymin, ymax = m - tol/2, m + tol/2
        return rg.Rectangle3d(rect.Plane, rg.Interval(xmin, xmax), rg.Interval(ymin, ymax))

    @staticmethod
    def rebuild_rectangle(rect):
        """
        Rebuilds a Rectangle3d so its extents align to world X/Y axes,
        preserving its original elevation.
        """
        # get world‐space corners
        corners = [rect.Corner(i) for i in range(4)]
        xs = [pt.X for pt in corners]
        ys = [pt.Y for pt in corners]
        xmin, xmax = min(xs), max(xs)
        ymin, ymax = min(ys), max(ys)
        # build a world‐XY plane at the original Z height
        z      = rect.Plane.Origin.Z
        origin = rg.Point3d(xmin, ymin, z)
        plane  = rg.Plane(origin, rg.Vector3d.XAxis, rg.Vector3d.YAxis)
        # width along world X, height along world Y
        w = xmax - xmin
        h = ymax - ymin
        return rg.Rectangle3d(plane, w, h)

    @staticmethod
    def rectangle_axis(rect):
        """
        Returns the long axis of the rectangle as an rg.Line from midpoint to midpoint.
        """
        # get the four corners
        corners = [rect.Corner(i) for i in range(4)]
        # compute edge lengths
        lengths = [corners[i].DistanceTo(corners[(i+1)%4]) for i in range(4)]
        # find the longest edge index
        idx = lengths.index(max(lengths))
        # choose opposite midpoints based on edge orientation
        if idx in (0, 2):
            p1 = (corners[0] + corners[3]) / 2.0
            p2 = (corners[1] + corners[2]) / 2.0
        else:
            p1 = (corners[0] + corners[1]) / 2.0
            p2 = (corners[2] + corners[3]) / 2.0
        return rg.Line(p1, p2)

    @staticmethod
    def rectangle_from_line(line, thickness, extend = True):
        """
        Returns a Rectangle of n thickness around the line as its axis
        extend is adding half thickness to each end making rectangle sdf-like
        """
        if extend:
            rfl = rg.Line(line.From, line.To) #create a copy
            rfl.Extend(thickness/2, thickness/2)
            line = rfl
        v = line.UnitTangent
        
        perp = rg.Vector3d(-v.Y, v.X, 0)          # perpendicular in XY
        plane = rg.Plane(line.From, v, perp)      # X = line, Y = perp, normal = Z
        x_int = rg.Interval(0, line.Length)
        y_int = rg.Interval(-thickness/2.0, thickness/2.0)
        return rg.Rectangle3d(plane, x_int, y_int)

    @staticmethod
    def get_bounds_for_line(line, rect, axis):
        """
        Calculates a line’s projection interval on a rectangle along an axis if
        they overlap, returning that interval or None.
        """
        origin = rect.Plane.Origin
        if axis == 'y':
            rmin = origin.Y
            rmax = origin.Y + rect.Height
            lxmin = min(line.From.X, line.To.X)
            lxmax = max(line.From.X, line.To.X)
            rxmin = origin.X
            rxmax = origin.X + rect.Width
            if lxmax < rxmin - GLOBAL_TOL or lxmin > rxmax + GLOBAL_TOL:
                return None
        else:  # axis == 'x'
            rmin = origin.X
            rmax = origin.X + rect.Width
            lymin = min(line.From.Y, line.To.Y)
            lymax = max(line.From.Y, line.To.Y)
            rymin = origin.Y
            rymax = origin.Y + rect.Height
            if lymax < rymin - GLOBAL_TOL or lymin > rymax + GLOBAL_TOL:
                return None
        return (rmin, rmax)

    @staticmethod
    def get_rectangle_bounds(rect):
        """
        Calculates world-aligned X and Y bounds of a Rectangle3d,
        returning [[xmin, xmax], [ymin, ymax]].
        """
        bbox = rect.BoundingBox
        return [[bbox.Min.X, bbox.Max.X], [bbox.Min.Y, bbox.Max.Y]]

    @staticmethod
    def get_union_interval_containing(c, intervals):
        """
        Merges sorted intervals and returns the one containing a coordinate within
        tolerance, or None if no interval applies.
        """
        merged = LineUtils.merge_intervals(intervals)
        for (u_min, u_max) in merged:
            if c > u_min + GLOBAL_TOL and c < u_max - GLOBAL_TOL:
                return (u_min, u_max)
        return None

    @staticmethod
    def rects_collide(rect1, rect2):
        """
        Returns True if two Rectangle3d objects overlap by:
         - BoundingBox test  
         - Any corner of one lies Inside/Coincident with the other  
         - Any of their edges intersect
        """
        checker = (rg.PointContainment.Inside,
                   rg.PointContainment.Coincident)

        # Fast reject via AABB overlap on X/Y
        bb1 = rect1.BoundingBox
        bb2 = rect2.BoundingBox
        # no overlap if one box is entirely left/right or above/below the other
        if (bb1.Max.X < bb2.Min.X or bb1.Min.X > bb2.Max.X
         or bb1.Max.Y < bb2.Min.Y or bb1.Min.Y > bb2.Max.Y):
            return False

        #Corner containment
        for i in range(4):
            if rect1.Contains(rect2.Corner(i)) in checker:
                return True
            if rect2.Contains(rect1.Corner(i)) in checker:
                return True

        #Edge intersections: convert to closed curves and test
        crv1 = rect1.ToNurbsCurve()
        crv2 = rect2.ToNurbsCurve()
        events = rg.Intersect.Intersection.CurveCurve(
            crv1, crv2, GLOBAL_TOL, GLOBAL_TOL
        )
        if events and len(events) > 0:
            return True

        return False
    
    @staticmethod
    def polylines_collide(plA, plB):
        """
        Fast polyline‐vs‐polyline collision (AABB + segment intersection + containment)
        """
        bbA = plA.BoundingBox
        bbB = plB.BoundingBox
    
        # 1) AABB reject
        if bbA.Max.X < bbB.Min.X or bbA.Min.X > bbB.Max.X or \
           bbA.Max.Y < bbB.Min.Y or bbA.Min.Y > bbB.Max.Y:
            return False
    
        # 2) Segment‐segment intersections
        for i in range(plA.Count - 1):
            segA = rg.LineCurve(rg.Line(plA[i], plA[i+1]))
            for j in range(plB.Count - 1):
                segB = rg.LineCurve(rg.Line(plB[j], plB[j+1]))
                evts = rg.Intersect.Intersection.CurveCurve(
                    segA, segB, GLOBAL_TOL, GLOBAL_TOL
                )
                if evts:
                    return True
    
        # 3) Full‐containment check
        crvA = rg.PolylineCurve(plA)
        crvB = rg.PolylineCurve(plB)
        checker = (rg.PointContainment.Inside, rg.PointContainment.Coincident)
    
        # If any vertex of A lies inside or on B
        for pt in plA:
            if crvB.Contains(pt) in checker:
                return True
    
        # If any vertex of B lies inside or on A
        for pt in plB:
            if crvA.Contains(pt) in checker:
                return True
    
        return False
    
    @staticmethod
    def flatten_to_xy(rect):
        """
        project rectangle to world XY plane, preserving rotation about Z
        """
        p0 = rect.Corner(0)
        p1 = rect.Corner(1)
        p3 = rect.Corner(3)
        p0_flat = rg.Point3d(p0.X, p0.Y, 0)
        dir_x = rg.Vector3d(p1.X - p0.X, p1.Y - p0.Y, 0)
        dir_y = rg.Vector3d(p3.X - p0.X, p3.Y - p0.Y, 0)
        dir_x.Unitize()
        dir_y.Unitize()
        plane = rg.Plane(p0_flat, dir_x, dir_y)
        return rg.Rectangle3d(plane, rect.Width, rect.Height)

    @staticmethod
    def find_intersecting_rect_pairs(rects):
        """
        takes list of Rectangles, returns list of (i, j) index pairs that intersect in XY
        uses sweep-line on axis-aligned bboxes then precise LineUtils.rects_collide
        """
        flats = [LineUtils.flatten_to_xy(r) for r in rects]
        events = []
        for i, r in enumerate(flats):
            bb = r.BoundingBox
            events.append((bb.Min.X, True, i))
            events.append((bb.Max.X, False, i))
        events.sort(key=lambda e: (e[0], not e[1]))

        active = []
        hits = []
        for x, start, i in events:
            if start:
                bb_i = flats[i].BoundingBox
                minY, maxY = bb_i.Min.Y, bb_i.Max.Y
                for j in active:
                    bb_j = flats[j].BoundingBox
                    if bb_j.Max.Y >= minY and bb_j.Min.Y <= maxY:
                        if LineUtils.rects_collide(flats[i], flats[j]):
                            hits.append((j, i))
                active.append(i)
            else:
                active.remove(i)
        return hits

    @staticmethod
    def union_intersecting_rects_outline(rects, tol=GLOBAL_TOL):
        """
        takes list of Rectangle3d, groups intersecting ones and returns list of Polylines for outlines
        """
        pairs = LineUtils.find_intersecting_rect_pairs(rects)
        adj = {}
        for i, j in pairs:
            adj.setdefault(i, []).append(j)
            adj.setdefault(j, []).append(i)
        clusters = []
        visited = set()
        for idx in range(len(rects)):
            if idx in visited:
                continue
            stack = [idx]
            cluster = []
            while stack:
                n = stack.pop()
                if n not in visited:
                    visited.add(n)
                    cluster.append(n)
                    for m in adj.get(n, []):
                        if m not in visited:
                            stack.append(m)
            clusters.append(cluster)
        outlines = []
        
        #print "Created {} clusters".format(len(clusters))
        
        for cluster in clusters:
            curves = [LineUtils.flatten_to_xy(rects[i]).ToNurbsCurve() for i in cluster]
            unioned = rg.Curve.CreateBooleanUnion(curves, tol)
            for c in unioned or []:
                #print c
                #print c.TryGetPolyline()
                bool, pl = c.TryGetPolyline()#rg.Polyline()
                if bool:
                    outlines.append(pl)
                else:
                    outlines.append(c)
        return outlines

    @staticmethod
    def line_in_polyline(line, polylines):
        """
        Takes a Line and list of Polylines, returns index of first polyline containing both endpoints, else -1
        """
        for i, pl in enumerate(polylines):
            pc = rg.PolylineCurve(pl)
            if pc.Contains(line.From) != rg.PointContainment.Outside and pc.Contains(line.To) != rg.PointContainment.Outside:
                return i
        return -1

    @staticmethod
    def line_outside_rectangles(line, rectangles, thickness=10.0, tol=GLOBAL_TOL):
        """
        Returns a list of Line segments representing those portions of the finite
        line segment that do NOT lie within any of the given Rectangle3d objects.
        """
        # Parametric domain of the finite line
        seg_dom = rg.Interval(0.0, 1.0)

        # 1) Collect all hit‐intervals where the line enters/exits each rectangle (as a thin box)
        intervals = []
        for rect in rectangles:
            box = LineUtils.rectangle_to_box(rect, thickness)
            hit, iv = rg.Intersect.Intersection.LineBox(line, box, tol)
            if not hit:
                continue
            t0, t1 = iv.Min, iv.Max
            lo = max(seg_dom.Min, min(t0, t1))
            hi = min(seg_dom.Max, max(t0, t1))
            if hi > lo + tol:
                intervals.append((lo, hi))

        # 2) Merge overlapping or touching intervals
        merged = LineUtils.merge_intervals(intervals)

        # 3) Compute complement intervals in [0,1]
        outside = []
        current = seg_dom.Min
        for a, b in merged:
            if a > current + tol:
                outside.append((current, a))
            current = max(current, b)
        if seg_dom.Max > current + tol:
            outside.append((current, seg_dom.Max))

        # 4) Build and return the actual line segments
        segments = []
        for t0, t1 in outside:
            pt0 = line.PointAt(t0)
            pt1 = line.PointAt(t1)
            segments.append(rg.Line(pt0, pt1))
        return segments

    @staticmethod
    def _offset_along_axis(rect, axis, amount):
        """
        Returns a new Rectangle3d offset along one local axis by 'amount':
        negative extends Min, positive extends Max.
        """
        x, y = rect.X, rect.Y
        if axis == 'x':
            new_x = rg.Interval(x.Min + min(amount,0), x.Max + max(amount,0))
            return rg.Rectangle3d(rect.Plane, new_x, y)
        else:
            new_y = rg.Interval(y.Min + min(amount,0), y.Max + max(amount,0))
            return rg.Rectangle3d(rect.Plane, x, new_y)

    @staticmethod
    def _max_extension(slave, axis, direction, limit, master_rects):
        """
        Binary‐searches the max extension (up to 'limit') along one axis/direction
        before colliding with any master rectangles.
        """
        lo, hi, best = 0.0, limit, 0.0
        for _ in range(10):
            mid = (lo + hi) / 2.0
            test = LineUtils._offset_along_axis(slave, axis, direction * mid)
            if any(LineUtils.rects_collide(test, m) for m in master_rects):
                hi = mid
            else:
                best = mid
                lo = mid
        return best * direction

    @staticmethod
    def extend_rectangles(master_rects, slave_rects, extenddistance):
        """
        Extends each slave rectangle along its long axis by up to 'extenddistance'
        in both directions, stopping each way if it collides with any master.
        Returns a new list of extended Rectangle3d objects.
        """
        extended = []
        for slave in slave_rects:
            # pick the longer local axis
            axis = 'x' if slave.Width >= slave.Height else 'y'
            # compute negative and positive extensions
            neg_ext = LineUtils._max_extension(slave, axis, -1, extenddistance, master_rects)
            pos_ext = LineUtils._max_extension(slave, axis, +1, extenddistance, master_rects)
            x, y = slave.X, slave.Y
            # build new intervals
            new_x = (rg.Interval(x.Min + min(0,neg_ext), x.Max + max(0,pos_ext)) if axis == 'x' else x)
            new_y = (rg.Interval(y.Min + min(0,neg_ext), y.Max + max(0,pos_ext)) if axis == 'y' else y)
            
            extended.append(rg.Rectangle3d(slave.Plane, new_x, new_y))

        return extended

    @staticmethod
    def merge_intervals(intervals, tol = GLOBAL_TOL):
        """
        Merges overlapping or touching numeric intervals into a consolidated list.
        """
        if not intervals:
            return []
            
        sorted_int = sorted(intervals, key=lambda x: x[0])
        
        merged = [sorted_int[0]]
        for current in sorted_int[1:]:
            last = merged[-1]
            if current[0] <= last[1] + tol:
                merged[-1] = (last[0], max(last[1], current[1]))
            else:
                merged.append(current)
        return merged

    @staticmethod
    def encode(v, rounding=3, anglealigned = False):
        """
        Return the angle of a vector in the XY plane modulo π.
        """
        #added extra snapping to Pi and 2Pi to better adjust for tolerance
        v2d = rg.Vector3d(v.X, v.Y, 0)
        
        if not v2d.IsZero:
            v2d.Unitize()
            
        a = math.atan2(v2d.Y, v2d.X)
        if a < 0:
            a += 2 * math.pi
        if anglealigned:
            r = round(a, rounding)
            if r == round(2 * math.pi, rounding):
                r = 0.0
            return r
        else:
            r = round(a % math.pi, rounding)
            if r == round(math.pi, rounding):
                r = 0.0
            return r

    @staticmethod
    def find_param_group(groups, val, tol=GLOBAL_TOL):
        """
        Return existing key within tolerance or None.
        """
        for k in groups:
            if abs(k - val) < tol:
                return k
        return None

    @staticmethod
    def _ensure_positive_tol(t, fallback=1e-9):
        """
        Internal helper: make sure a tolerance is strictly positive.
        Used where 0.0 would cause divisions or degenerate behavior.
        """
        if t <= 0.0:
            return fallback
        return t

    @staticmethod
    def _qbucket(v, t):
        """
        Stable quantization bucket using "round half away from zero".
        """
        t = LineUtils._ensure_positive_tol(t)
        return int(math.floor((v / t) + 0.5))
    
    @staticmethod
    def _qhash_point(pt, t, use_z=False):
        kx = LineUtils._qbucket(pt.X, t)
        ky = LineUtils._qbucket(pt.Y, t)
        if use_z:
            kz = LineUtils._qbucket(pt.Z, t)
        else:
            kz = 0
        return (kx, ky, kz)

    @staticmethod
    def dedupe_lines(lines, tol=GLOBAL_TOL, use_z=False):
        """
        Remove duplicates by snapping endpoints into tolerance-based point groups.
        AB == BA. By default groups in 2D (ignore Z).
        """
        result = []
        seen = set()
    
        tol = LineUtils._ensure_positive_tol(tol)
        
        if not lines:
            return []
    
        # maps tolerant point "keys" -> representative (we just use tuple keys)
        groups2d = {}  # (x,y) -> (x,y)
        groups3d = {}  # (x,y,z) -> (x,y,z)
    
        def key2d(pt):
            k = LineUtils._find_point_group2d(groups2d, pt.X, pt.Y, tol)
            if k is None:
                k = (pt.X, pt.Y)
                groups2d[k] = k
            return k
    
        def key3d(pt):
            # simple 3D version mirroring the 2D one
            for kx, ky, kz in groups3d:
                dx = pt.X - kx
                dy = pt.Y - ky
                dz = pt.Z - kz
                if dx*dx + dy*dy + dz*dz <= tol*tol:
                    return (kx, ky, kz)
            k = (pt.X, pt.Y, pt.Z)
            groups3d[k] = k
            return k
    
        for ln in lines:
            if ln is None:
                continue
            try:
                if hasattr(ln, 'Length'):
                    if ln.Length <= tol:
                        continue
                p0 = ln.From
                p1 = ln.To
            except:
                continue
            if p0 is None or p1 is None:
                continue
    
            # snap endpoints into tolerant clusters (2D default)
            if use_z:
                k0 = key3d(p0)
                k1 = key3d(p1)
            else:
                k0 = key2d(p0)  # uses _find_point_group2d under the hood
                k1 = key2d(p1)
    
            # collapse degenerate after snapping
            if k0 == k1:
                continue
    
            # orientation-insensitive canonical key
            key = (k0, k1) if k0 <= k1 else (k1, k0)
    
            if key in seen:
                continue
            seen.add(key)
            result.append(ln)
    
        return result

    @staticmethod
    def process_lines(rawlines, tol=GLOBAL_TOL, anglealigned=False, perlevel=False):
        """
        Merge near-collinear lines into axis-aligned segments.
        """
        
        #rawlines = LineUtils.dedupe_lines(rawlines, tol)
        
        #if requested, split by .Z first
        if perlevel:
            z_groups = {}
            for ln in rawlines:
                z = ln.From.Z
                key = LineUtils.find_param_group(z_groups, z, tol)
                if key is None:
                    z_groups[z] = []
                    key = z
                z_groups[key].append(ln)
            processed = []
            for group in z_groups.values():
                processed.extend(LineUtils.process_lines(group, tol, anglealigned, perlevel=False))
            return processed
        
        #to help out with tolerance issues
        for iter in range(3):
            extrajoin = 3.0
            lines = [rg.Line(l.From, l.To) for l in rawlines]
            
            for line in lines:
                line.Extend(extrajoin, extrajoin)
            groups = {}
            
            for ln in lines:
                angle = LineUtils.encode(ln.Direction, 16, anglealigned)
                key = LineUtils.find_param_group(groups, angle, tol)
                if key is None:
                    groups[angle] = []
                    key = angle
                groups[key].append(ln)
                
            processed_lines = []
            
            for group_angle, glines in groups.items():
                delta = math.pi/2 - group_angle
                
                #pts = [rg.Point3d((ln.From.X + ln.To.X) * 0.5, (ln.From.Y + ln.To.Y) * 0.5, (ln.From.Z + ln.To.Z) * 0.5) for ln in glines]
                #n = len(pts)
                #origin = rg.Point3d(sum(pt.X for pt in pts) / n, sum(pt.Y for pt in pts) / n, sum(pt.Z for pt in pts) / n)
                origin = rg.Point3d(0, 0, 0)
                                    
                T = rg.Transform.Rotation(delta, origin)
                #_, T_inv = T.TryGetInverse()
                T_inv = rg.Transform.Rotation(-delta, origin)
                
                rotated_lines = []
                
                for ln in glines:
                    ln_copy = rg.Line(ln.From, ln.To)
                    ln_copy.Transform(T)
                    rotated_lines.append(ln_copy)
                vert_groups = {}
                
                for ln in rotated_lines:
                    xv = (ln.From.X + ln.To.X) * 0.5
                    key = LineUtils.find_param_group(vert_groups, xv, tol)
                    if key is None:
                        vert_groups[xv] = []
                        key = xv
                    y0, y1 = sorted([ln.From.Y, ln.To.Y])
                    vert_groups[key].append((y0, y1))
                    
                for xval, intervals in vert_groups.items():
                    merged_ints = LineUtils.merge_intervals(intervals, tol)
                    
                    for st, en in merged_ints:
                        new_line = rg.Line(rg.Point3d(xval, st, origin.Z),
                                           rg.Point3d(xval, en, origin.Z))
                        new_line.Transform(T_inv)
                        #extend back 
                        new_line.Extend(-extrajoin, -extrajoin)
                        processed_lines.append(new_line)

            rawlines = processed_lines
        return processed_lines

    @staticmethod
    def _orth_frame(normal):
        """
        Return orthonormal X,Y,Z axes with Z aligned to the given vector.
        """
        n = rg.Vector3d(normal.X, normal.Y, normal.Z)
        if not n.IsZero: 
            n.Unitize()
        up = rg.Vector3d(0, 0, 1)
        if abs(rg.Vector3d.Multiply(n, up)) > 0.9: 
            up = rg.Vector3d(1, 0, 0)
            
        x = rg.Vector3d.CrossProduct(up, n); x.Unitize()
        y = rg.Vector3d.CrossProduct(n, x); y.Unitize()
        return x, y, n

    @staticmethod
    def encode3d(v):
        """
        Unitize and sign-normalize a 3D vector for parallel grouping.
        """
        u = rg.Vector3d(v.X, v.Y, v.Z)
        if not u.IsZero: 
            u.Unitize()
        if u.Z < 0 or (abs(u.Z) < GLOBAL_TOL and (u.Y < 0 or (abs(u.Y) < GLOBAL_TOL and u.X < 0))):
            u *= -1.0
        return (u.X, u.Y, u.Z)

    @staticmethod
    def _find_dir_group3d(groups, dir_key, cos_thresh):
        """
        Find an existing direction key within angular threshold.
        """
        ux, uy, uz = dir_key
        for k in groups:
            kx, ky, kz = k
            if abs(ux*kx + uy*ky + uz*kz) >= cos_thresh: 
                return k
        return None

    @staticmethod
    def _find_point_group2d(groups, x, y, tol=GLOBAL_TOL):
        """
        Find 2D key in dict within given distance tolerance.
        """
        for kx, ky in groups:
            dx = x - kx
            dy = y - ky
            if dx*dx + dy*dy <= tol*tol: 
                return (kx, ky)
        return None

    @staticmethod
    def process_lines_3d(rawlines, tol=GLOBAL_TOL, anglealigned=False, perlevel=False, type = "legacy", iterations=3):
        """
        Merge near-collinear 3D lines along their true axes with minimal drift.
        Type can be "sweep" or "legacy", sweep is more kitter resistant but longer
        """
        if type == "sweep":
            resplit = LineUtils.split_lines_at_intersections(rawlines, GLOBAL_TOL, False)
            deduped = LineUtils.dedupe_lines(resplit, GLOBAL_TOL)
            sweeped = LineUtils.build_collinear_polylines_sweep(deduped, GLOBAL_TOL, 1.0)
            axised = [LineUtils.fit_weighted_line_from_polyline(sweep) for sweep in sweeped]
            resnapped = LineUtils.extend_lines_to_touch_others(axised)
            
            return resnapped
        if type == "legacy":
            if not rawlines: 
                return []
            for _ in range(iterations):
                extrajoin = 3.0
                lines = []
                for l in rawlines:
                    ln = rg.Line(l.From, l.To)
                    ln.Extend(extrajoin, extrajoin)
                    if ln.Length > tol: 
                        lines.append(ln)
                if not lines: return []
    
                # scale-aware angular threshold so lateral drift ≤ tol
                bb = rg.BoundingBox([ln.From for ln in lines] + [ln.To for ln in lines])
                span = bb.Diagonal.Length
                if span <= 0.0: 
                    span = max([ln.Length for ln in lines] + [1.0])
                theta = min(0.25, math.asin(min(1.0, tol / span)))
                cos_thresh = math.cos(theta)
    
                dir_groups = {}
                for ln in lines:
                    dkey = LineUtils.encode3d(ln.Direction)
                    key = LineUtils._find_dir_group3d(dir_groups, dkey, cos_thresh)
                    if key is None:
                        dir_groups[dkey] = []
                        key = dkey
                    dir_groups[key].append(ln)
    
                processed = []
                for dkey, glines in dir_groups.items():
                    ux, uy, uz = dkey
                    mids = [rg.Point3d((ln.From.X+ln.To.X)*0.5, (ln.From.Y+ln.To.Y)*0.5, (ln.From.Z+ln.To.Z)*0.5) for ln in glines]
                    n = len(mids)
                    
                    origin = rg.Point3d(sum(p.X for p in mids)/n, sum(p.Y for p in mids)/n, sum(p.Z for p in mids)/n)
                    xaxis, yaxis, zaxis = LineUtils._orth_frame(rg.Vector3d(ux, uy, uz))
                    
                    from_plane = rg.Plane(origin, xaxis, yaxis)
                    to_plane = rg.Plane(origin, rg.Vector3d.XAxis, rg.Vector3d.YAxis)
                    T = rg.Transform.PlaneToPlane(from_plane, to_plane)
                    T_inv = rg.Transform.PlaneToPlane(to_plane, from_plane)
    
                    rot = []
                    for ln in glines:
                        lc = rg.Line(ln.From, ln.To)
                        lc.Transform(T)
                        rot.append(lc)
    
                    rails = {}
                    for ln in rot:
                        xv = (ln.From.X + ln.To.X) * 0.5
                        yv = (ln.From.Y + ln.To.Y) * 0.5
                        k = LineUtils._find_point_group2d(rails, xv, yv, tol)
                        if k is None:
                            rails[(xv, yv)] = []
                            k = (xv, yv)
                        z0, z1 = sorted([ln.From.Z, ln.To.Z])
                        rails[k].append((z0, z1))
    
                    for (xv, yv), intervals in rails.items():
                        merged = LineUtils.merge_intervals(intervals, tol)
                        for st, en in merged:
                            nl = rg.Line(rg.Point3d(xv, yv, st), rg.Point3d(xv, yv, en))
                            nl.Transform(T_inv)
                            nl.Extend(-extrajoin, -extrajoin)
                            if nl.IsValid and nl.Length > tol: 
                                processed.append(nl)
                rawlines = processed
            return processed

    @staticmethod
    def _unique_params(pvals, tol = GLOBAL_TOL, include_endpoints=False):
        """
        Deduplicate and sort parameter values in [0,1], applying the same
        snapping and inclusion rules as _snap01 / _in01.
        """
        ps = []
        for p in pvals:
            if include_endpoints:
                if p >= -tol and p <= 1.0 + tol:
                    ps.append(p)
            else:
                if p > tol and p < 1.0 - tol:
                    ps.append(p)
        if not ps:
            return []
        ps = sorted(ps)
        out = []
        for p in ps:
            if not out or abs(p - out[-1]) > tol:
                if p < 0.0 + tol:
                    p = 0.0
                if p > 1.0 - tol:
                    p = 1.0
                out.append(p)
        return out

    @staticmethod
    def _split_line_at_params(ln, pvals, tol = GLOBAL_TOL):
        pvals = LineUtils._unique_params(pvals, tol, include_endpoints=True)
        segs = []
        start = 0.0
        for p in pvals:
            if p > start + tol and p < 1.0 - tol:
                a = ln.PointAt(start)
                b = ln.PointAt(p)
                s = rg.Line(a, b)
                if s.IsValid and s.Length > tol:
                    segs.append(s)
                start = p
        s = rg.Line(ln.PointAt(start), ln.PointAt(1.0))
        if s.IsValid and s.Length > tol:
            segs.append(s)
        return segs

    @staticmethod
    def _build_rtree_for_lines(lines_in, tol):
        bboxes = []
        tree = rg.RTree()
        for i, ln in enumerate(lines_in):
            bb = ln.BoundingBox
            if not bb.IsValid:
                bb = rg.BoundingBox(ln.From, ln.To)
            bb.Inflate(tol)
            bboxes.append(bb)
            tree.Insert(bb, i)
        return tree, bboxes

    @staticmethod
    def _snap01(p, tol):
        if p < 0.0 + tol:
            return 0.0
        if p > 1.0 - tol:
            return 1.0
        return p

    @staticmethod
    def _in01(p, include_endpoints, tol):
        if include_endpoints:
            if p >= 0.0 and p <= 1.0:
                return True
            return False
        else:
            if p > tol and p < 1.0 - tol:
                return True
            return False

    @staticmethod
    def _closest_param_and_dist(ln, pt):
        a = ln.From
        b = ln.To
        dx = b.X - a.X
        dy = b.Y - a.Y
        dz = b.Z - a.Z
        vx = pt.X - a.X
        vy = pt.Y - a.Y
        vz = pt.Z - a.Z
        denom = dx*dx + dy*dy + dz*dz
        if denom <= 0.0:
            return 0.0, pt.DistanceTo(a)
        t = (vx*dx + vy*dy + vz*dz) / denom
        if t < 0.0:
            t = 0.0
        if t > 1.0:
            t = 1.0
        cx = a.X + t*dx
        cy = a.Y + t*dy
        cz = a.Z + t*dz
        dx2 = pt.X - cx
        dy2 = pt.Y - cy
        dz2 = pt.Z - cz
        d = math.sqrt(dx2*dx2 + dy2*dy2 + dz2*dz2)
        return t, d

    @staticmethod
    def _snap_point_to_unique(pt, uniq_pts, tol):
        best = None
        bestd2 = None
        r2 = tol * tol
        for q in uniq_pts:
            dx = q.X - pt.X
            dy = q.Y - pt.Y
            dz = q.Z - pt.Z
            d2 = dx*dx + dy*dy + dz*dz
            if d2 <= r2:
                if best is None or d2 < bestd2:
                    best = q
                    bestd2 = d2
        if best is None:
            return pt
        return best

    @staticmethod
    def split_lines_at_intersections(lines_in, tol=0.01, include_endpoints=False):
        if not lines_in:
            return []

        n = len(lines_in)
        paramdict = {}
        for i in range(n):
            paramdict[i] = []

        rtree, bboxes = LineUtils._build_rtree_for_lines(lines_in, tol)
        idxs = range(n)

        for i in idxs:
            li = lines_in[i]
            bbox = bboxes[i]
            candidate_indices = []

            def search_cb(sender, e):
                j = e.Id
                if j <= i:
                    return
                candidate_indices.append(j)

            rtree.Search(bbox, search_cb)

            for j in candidate_indices:
                lj = lines_in[j]
                rc, a, b = rg.Intersect.Intersection.LineLine(li, lj, tol, True)
                if rc:
                    a = LineUtils._snap01(a, tol)
                    b = LineUtils._snap01(b, tol)
                    if LineUtils._in01(a, include_endpoints, tol):
                        paramdict[i].append(a)
                    if LineUtils._in01(b, include_endpoints, tol):
                        paramdict[j].append(b)

        out = []
        for i in idxs:
            ln = lines_in[i]
            if paramdict[i]:
                segs = LineUtils._split_line_at_params(ln, paramdict[i], tol)
                if segs:
                    for s in segs:
                        if s.IsValid and s.Length > tol:
                            out.append(s)
            else:
                if ln.IsValid and ln.Length > tol:
                    out.append(ln)

        if not out:
            return out

        ptTol = tol * 0.25
        if ptTol > 1e-6:
            ptTol = 1e-6
        if ptTol <= 0.0:
            ptTol = 1e-9

        pts = []
        for ln in out:
            pts.append(ln.From)
            pts.append(ln.To)

        uniq_arr = rg.Point3d.CullDuplicates(pts, ptTol)
        uniq_pts = []
        if uniq_arr:
            for p in uniq_arr:
                uniq_pts.append(p)
        else:
            uniq_pts = pts

        rebuilt = []
        for ln in out:
            p0o = ln.From
            p1o = ln.To
            p0s = LineUtils._snap_point_to_unique(p0o, uniq_pts, ptTol)
            p1s = LineUtils._snap_point_to_unique(p1o, uniq_pts, ptTol)
            if p0s.DistanceTo(p1s) <= ptTol:
                rebuilt.append(rg.Line(p0o, p1o))
            else:
                rebuilt.append(rg.Line(p0s, p1s))

        final_lines = []
        for ln in rebuilt:
            L = ln.Length
            if L <= tol:
                continue
            param_eps = ptTol / L
            if param_eps > 0.49:
                param_eps = 0.49
            if param_eps < 1e-9:
                param_eps = 1e-9

            params = []
            for pt in uniq_pts:
                t, d = LineUtils._closest_param_and_dist(ln, pt)
                if d <= ptTol:
                    t = LineUtils._snap01(t, param_eps)
                    if t > param_eps and t < 1.0 - param_eps:
                        params.append(t)

            if params:
                params.sort()
                cleaned = []
                for tk in params:
                    if not cleaned:
                        cleaned.append(tk)
                    else:
                        if abs(tk - cleaned[-1]) > param_eps:
                            cleaned.append(tk)
                segs = LineUtils._split_line_at_params(ln, cleaned, tol)
                if segs:
                    for s in segs:
                        if s.IsValid and s.Length > tol:
                            final_lines.append(s)
                else:
                    if ln.IsValid and ln.Length > tol:
                        final_lines.append(ln)
            else:
                if ln.IsValid and ln.Length > tol:
                    final_lines.append(ln)

        return final_lines

    @staticmethod
    def build_collinear_polylines_sweep(lines_in, tol=GLOBAL_TOL, angle_deg=1.0):
        """
        line sweep algorithm to join touching close enough angled lines into a polyline
        """
        result = []
        if not lines_in:
            return result
    
        rad = angle_deg * math.pi / 180.0
        cos_thr = math.cos(rad)
        pts = []
        for ln in lines_in:
            if not ln or not ln.IsValid:
                continue
            if ln.Length <= tol:
                continue
            pts.append(ln.From)
            pts.append(ln.To)
    
        uniq_arr = rg.Point3d.CullDuplicates(pts, tol)
        uniq_pts = []
        if uniq_arr:
            for p in uniq_arr:
                uniq_pts.append(p)
        else:
            for p in pts:
                uniq_pts.append(p)
    
        snapped = []
        for ln in lines_in:
            if not ln or not ln.IsValid:
                continue
            if ln.Length <= tol:
                continue
            a = LineUtils._snap_point_to_unique(ln.From, uniq_pts, tol)
            b = LineUtils._snap_point_to_unique(ln.To, uniq_pts, tol)
            if a.DistanceTo(b) <= tol:
                continue
            snapped.append((a, b, ln))
    
        if not snapped:
            return result
    
        pindex = {}
        for i, p in enumerate(uniq_pts):
            key = (p.X, p.Y, p.Z)
            pindex[key] = i
    
        edges = []
        for a, b, ln in snapped:
            ia = pindex[(a.X, a.Y, a.Z)]
            ib = pindex[(b.X, b.Y, b.Z)]
            edges.append((ia, ib, a, b))
    
        adj = {}
        for i in range(len(uniq_pts)):
            adj[i] = []
        for k, e in enumerate(edges):
            ia, ib, a, b = e
            adj[ia].append(k)
            adj[ib].append(k)
    
        used = [False for _ in edges]
        seeds = []
        for k, e in enumerate(edges):
            ia, ib, a, b = e
            minx = a.X if a.X <= b.X else b.X
            miny = a.Y if a.Y <= b.Y else b.Y
            seeds.append((minx, miny, k))
        seeds.sort()
    
        def unit_vec(p, q):
            vx = q.X - p.X
            vy = q.Y - p.Y
            vz = q.Z - p.Z
            L = math.sqrt(vx*vx + vy*vy + vz*vz)
            if L <= 0.0:
                return (0.0, 0.0, 0.0)
            return (vx / L, vy / L, vz / L)
    
        def dot_abs(u, v):
            d = u[0]*v[0] + u[1]*v[1] + u[2]*v[2]
            if d < 0.0:
                d = -d
            return d
    
        for _, _, seed_k in seeds:
            if used[seed_k]:
                continue
    
            ia, ib, pa, pb = edges[seed_k]
            u0 = unit_vec(pa, pb)
            poly_pts = [pa, pb]
            used[seed_k] = True
            start_id = ia
            end_id = ib
    
            for _ in range(len(edges)):
                best_k = None
                best_side = None
                best_dot = None
                for ek in adj[end_id]:
                    if used[ek]:
                        continue
                    eia, eib, ea, eb = edges[ek]
                    if eia == end_id:
                        ud = unit_vec(ea, eb)
                        d = dot_abs(u0, ud)
                        if d >= cos_thr:
                            if best_k is None or d > best_dot:
                                best_k = ek
                                best_side = 'end_forward'
                                best_dot = d
                    elif eib == end_id:
                        ud = unit_vec(eb, ea)
                        d = dot_abs(u0, ud)
                        if d >= cos_thr:
                            if best_k is None or d > best_dot:
                                best_k = ek
                                best_side = 'end_backward'
                                best_dot = d
                if best_k is None:
                    break
                eia, eib, ea, eb = edges[best_k]
                if best_side == 'end_forward':
                    poly_pts.append(eb)
                    end_id = eib
                else:
                    poly_pts.append(ea)
                    end_id = eia
                used[best_k] = True
    
            for _ in range(len(edges)):
                best_k = None
                best_side = None
                best_dot = None
                for ek in adj[start_id]:
                    if used[ek]:
                        continue
                    eia, eib, ea, eb = edges[ek]
                    if eib == start_id:
                        ud = unit_vec(ea, eb)
                        d = dot_abs(u0, ud)
                        if d >= cos_thr:
                            if best_k is None or d > best_dot:
                                best_k = ek
                                best_side = 'start_backward'
                                best_dot = d
                    elif eia == start_id:
                        ud = unit_vec(eb, ea)
                        d = dot_abs(u0, ud)
                        if d >= cos_thr:
                            if best_k is None or d > best_dot:
                                best_k = ek
                                best_side = 'start_forward'
                                best_dot = d
                if best_k is None:
                    break
                eia, eib, ea, eb = edges[best_k]
                if best_side == 'start_backward':
                    poly_pts.insert(0, ea)
                    start_id = eia
                else:
                    poly_pts.insert(0, eb)
                    start_id = eib
                used[best_k] = True
    
            if len(poly_pts) >= 2:
                pl = rg.Polyline(poly_pts)
                if pl.IsValid and pl.Length > tol:
                    result.append(pl)
    
        return result

    @staticmethod
    def fit_weighted_line_from_polyline(pl, tol=GLOBAL_TOL, max_iter=25):
        """
        used to rebuild a jittery polyline which is supposed to be an axis into a single line
        """
        if pl is None:
            return rg.Line(rg.Point3d(0.0, 0.0, 0.0), rg.Point3d(0.0, 0.0, 0.0))
        if not hasattr(pl, 'Count'):
            return rg.Line(rg.Point3d(0.0, 0.0, 0.0), rg.Point3d(0.0, 0.0, 0.0))
        n = pl.Count
        if n < 2:
            return rg.Line(rg.Point3d(0.0, 0.0, 0.0), rg.Point3d(0.0, 0.0, 0.0))
    
        sum_w = 0.0
        cx = 0.0
        cy = 0.0
        cz = 0.0
        i = 0
        while i < n - 1:
            p = pl[i]
            q = pl[i + 1]
            L = p.DistanceTo(q)
            if L > tol:
                mx = 0.5 * (p.X + q.X)
                my = 0.5 * (p.Y + q.Y)
                mz = 0.5 * (p.Z + q.Z)
                sum_w += L
                cx += L * mx
                cy += L * my
                cz += L * mz
            i += 1
        if sum_w <= 0.0:
            a = pl[0]
            b = pl[n - 1]
            return rg.Line(a, b)
    
        cx /= sum_w
        cy /= sum_w
        cz /= sum_w
        C = rg.Point3d(cx, cy, cz)
    
        sxx = 0.0
        sxy = 0.0
        sxz = 0.0
        syy = 0.0
        syz = 0.0
        szz = 0.0
        i = 0
        while i < n - 1:
            p = pl[i]
            q = pl[i + 1]
            L = p.DistanceTo(q)
            if L > tol:
                mx = 0.5 * (p.X + q.X)
                my = 0.5 * (p.Y + q.Y)
                mz = 0.5 * (p.Z + q.Z)
                dx = mx - cx
                dy = my - cy
                dz = mz - cz
                sxx += L * dx * dx
                sxy += L * dx * dy
                sxz += L * dx * dz
                syy += L * dy * dy
                syz += L * dy * dz
                szz += L * dz * dz
            i += 1
    
        vx = pl[n - 1].X - pl[0].X
        vy = pl[n - 1].Y - pl[0].Y
        vz = pl[n - 1].Z - pl[0].Z
        vL = math.sqrt(vx*vx + vy*vy + vz*vz)
        if vL <= 0.0:
            vx = 1.0
            vy = 0.0
            vz = 0.0
            vL = 1.0
        vx /= vL
        vy /= vL
        vz /= vL
    
        k = 0
        eps = 1e-12
        while k < max_iter:
            nx = sxx * vx + sxy * vy + sxz * vz
            ny = sxy * vx + syy * vy + syz * vz
            nz = sxz * vx + syz * vy + szz * vz
            nL = math.sqrt(nx*nx + ny*ny + nz*nz)
            if nL <= eps:
                break
            nx /= nL
            ny /= nL
            nz /= nL
            dvx = nx - vx
            dvy = ny - vy
            dvz = nz - vz
            dL = math.sqrt(dvx*dvx + dvy*dvy + dvz*dvz)
            vx = nx
            vy = ny
            vz = nz
            if dL <= 1e-6:
                break
            k += 1
    
        if k == 0 and nL <= eps:
            sx = 0.0
            sy = 0.0
            sz = 0.0
            i = 0
            while i < n - 1:
                p = pl[i]
                q = pl[i + 1]
                L = p.DistanceTo(q)
                if L > tol:
                    sx += (q.X - p.X)
                    sy += (q.Y - p.Y)
                    sz += (q.Z - p.Z)
                i += 1
            vL = math.sqrt(sx*sx + sy*sy + sz*sz)
            if vL <= 0.0:
                a = pl[0]
                b = pl[n - 1]
                return rg.Line(a, b)
            vx = sx / vL
            vy = sy / vL
            vz = sz / vL
    
        a = pl[0]
        b = pl[n - 1]
        ax = a.X - cx
        ay = a.Y - cy
        az = a.Z - cz
        bx = b.X - cx
        by = b.Y - cy
        bz = b.Z - cz
        ta = ax*vx + ay*vy + az*vz
        tb = bx*vx + by*vy + bz*vz
        A = rg.Point3d(cx + ta*vx, cy + ta*vy, cz + ta*vz)
        B = rg.Point3d(cx + tb*vx, cy + tb*vy, cz + tb*vz)
        if A.DistanceTo(B) <= tol:
            return rg.Line(pl[0], pl[n - 1])
        return rg.Line(A, B)

    @staticmethod
    def extend_lines_to_touch_others(lines_in, tol=GLOBAL_TOL):
        """
        takes a list of lines as input and for every line it check it's endpoints 
        if they are within tolerance of some other line (be it endpoint or just on the line) 
        if yes, than rebuild that line extending that point so that it lies exactly 
        on that other line (treat lines as finite)
        """
        out = []
        if not lines_in:
            return out
        tree, bboxes = LineUtils._build_rtree_for_lines(lines_in, tol)
        n = len(lines_in)
        for i in range(n):
            ln = lines_in[i]
            if not ln or not ln.IsValid:
                continue
            if ln.Length <= tol:
                continue
            p0 = ln.From
            p1 = ln.To
            q0 = p0
            q1 = p1
    
            def best_target(pt, self_index):
                best_j = -1
                best_t = 0.0
                best_d = None
                bb = rg.BoundingBox(rg.Point3d(pt.X - tol, pt.Y - tol, pt.Z - tol), rg.Point3d(pt.X + tol, pt.Y + tol, pt.Z + tol))
                cand = []
                def cb(sender, e):
                    if e.Id != self_index:
                        cand.append(e.Id)
                tree.Search(bb, cb)
                k = 0
                while k < len(cand):
                    j = cand[k]
                    lj = lines_in[j]
                    t, d = LineUtils._closest_param_and_dist(lj, pt)
                    if d <= tol:
                        if best_d is None or d < best_d:
                            best_d = d
                            best_j = j
                            best_t = t
                    k += 1
                if best_j == -1:
                    return None
                lj = lines_in[best_j]
                tgt = lj.PointAt(best_t)
                if tgt.DistanceTo(lj.From) <= tol:
                    return lj.From
                if tgt.DistanceTo(lj.To) <= tol:
                    return lj.To
                return tgt
    
            tgt0 = best_target(p0, i)
            if tgt0 is not None:
                q0 = tgt0
            tgt1 = best_target(p1, i)
            if tgt1 is not None:
                q1 = tgt1
    
            if q0.DistanceTo(q1) > tol:
                out.append(rg.Line(q0, q1))
            else:
                out.append(ln)
        return out
    
    
    @staticmethod
    def snap_polylines_points_to_lines(polylines_in, lines_in, tol=GLOBAL_TOL, keepempty = False):
        """
        takes a list of polyline and a list of lines for every point in that polyline 
        (not rebuilding the polyline itself, keeping it as is) first search if that 
        point is within tolerance of any of those lines endpoint, if so move it there, 
        if not check if the point is within tolerance of any line itself (finite portion) 
        if yes pull it to that line (closest if multiple hit)
        """
        out = []
        if not polylines_in:
            return out
        if not lines_in:
            for pl in polylines_in:
                if pl and pl.IsValid:
                    out.append(pl)
            return out
    
        tree, bboxes = LineUtils._build_rtree_for_lines(lines_in, tol)
        endpoints = []
        j = 0
        while j < len(lines_in):
            ln = lines_in[j]
            if ln and ln.IsValid:
                endpoints.append(ln.From)
                endpoints.append(ln.To)
            j += 1
        uniq_arr = rg.Point3d.CullDuplicates(endpoints, tol)
        uniq_endpts = []
        if uniq_arr:
            i = 0
            while i < len(uniq_arr):
                uniq_endpts.append(uniq_arr[i])
                i += 1
        else:
            i = 0
            while i < len(endpoints):
                uniq_endpts.append(endpoints[i])
                i += 1
    
        def closest_endpoint(pt):
            best = None
            bestd2 = None
            i = 0
            r2 = tol * tol
            while i < len(uniq_endpts):
                q = uniq_endpts[i]
                dx = q.X - pt.X
                dy = q.Y - pt.Y
                dz = q.Z - pt.Z
                d2 = dx*dx + dy*dy + dz*dz
                if d2 <= r2:
                    if best is None or d2 < bestd2:
                        best = q
                        bestd2 = d2
                i += 1
            return best
    
        def closest_on_any_line(pt):
            best = None
            bestd = None
            bb = rg.BoundingBox(rg.Point3d(pt.X - tol, pt.Y - tol, pt.Z - tol), rg.Point3d(pt.X + tol, pt.Y + tol, pt.Z + tol))
            cand = []
            def cb(sender, e):
                cand.append(e.Id)
            tree.Search(bb, cb)
            i = 0
            while i < len(cand):
                idx = cand[i]
                ln = lines_in[idx]
                t, d = LineUtils._closest_param_and_dist(ln, pt)
                if d <= tol:
                    q = ln.PointAt(t)
                    if best is None or d < bestd:
                        best = q
                        bestd = d
                i += 1
            return best
    
        for pl in polylines_in:
            if not pl or not pl.IsValid:
                if keepempty:
                    out.append(None)
                continue
            pts = []
            for i in range(pl.Count):
                p = pl[i]
                ep = closest_endpoint(p)
                if ep is not None:
                    pts.append(ep)
                else:
                    q = closest_on_any_line(p)
                    if q is not None:
                        pts.append(q)
                    else:
                        pts.append(p)
            newpl = rg.Polyline(pts)
            out.append(newpl)
        return out


    @staticmethod
    def vector_between_lines(line1, line2, tol=GLOBAL_TOL):
        """
        Return the shortest vector to move line1 (as infinite) onto line2 (as infinite).
        """
        p1 = line1.From
        p2 = line2.From
        v  = line2.Direction
        w0 = p1 - p2
        t  = (v * w0) / (v * v)
        projection = p2 + v * t
        return projection - p1

    @staticmethod
    def push_line(line, axis, rects):
        """
        Translates a line out of overlapping rectangles in one step:
        vertical lines move horizontally, horizontal lines move vertically.
        """
        # normalize axis so that callers can provide orientation names or axes
        axis_key = axis
        try:
            string_types = (basestring,)  # type: ignore[name-defined]
        except NameError:  # Python 3
            string_types = (str,)
        if isinstance(axis_key, string_types):
            axis_key = axis_key.lower()
        if axis_key in ('vertical', LineUtils.Orientation.VERTICAL):
            axis_key = 'x'
        elif axis_key in ('horizontal', LineUtils.Orientation.HORIZONTAL):
            axis_key = 'y'

        if axis_key not in ('x', 'y'):
            return rg.Vector3d(0, 0, 0)

        # determine which orientation defines the domain we need to test
        perp_orientation = (LineUtils.Orientation.VERTICAL if axis_key == 'x'
                            else LineUtils.Orientation.HORIZONTAL)
        domain = LineUtils.get_domain(line, perp_orientation)

        # midpoint coordinate along the axis we are translating on
        center = (LineUtils.get_position(line, LineUtils.Orientation.VERTICAL)
                  if axis_key == 'x'
                  else LineUtils.get_position(line, LineUtils.Orientation.HORIZONTAL))

        intervals = []
        for r in rects:
            o = r.Plane.Origin
            if axis_key == 'x':
                perp_int = (o.Y + r.Y.Min, o.Y + r.Y.Max)
                axis_int = (o.X + r.X.Min, o.X + r.X.Max)
            else:
                perp_int = (o.X + r.X.Min, o.X + r.X.Max)
                axis_int = (o.Y + r.Y.Min, o.Y + r.Y.Max)
            if LineUtils.domains_overlap(domain, perp_int):
                intervals.append((min(axis_int), max(axis_int)))

        if not intervals:
            return rg.Vector3d(0, 0, 0)

        merged = LineUtils.merge_intervals(intervals)

        push = 0.0
        for idx, (u_min, u_max) in enumerate(merged):
            if center + GLOBAL_TOL < u_min or center - GLOBAL_TOL > u_max:
                continue

            # compute offsets needed to exit on either side of the interval
            left_target = u_min - GLOBAL_TOL
            right_target = u_max + GLOBAL_TOL
            left_offset = left_target - center
            right_offset = right_target - center

            # choose direction requiring the least translation magnitude
            if abs(left_offset) <= abs(right_offset):
                push = left_offset
            else:
                push = right_offset
            break

        if axis_key == 'x':
            return rg.Vector3d(push, 0, 0)
        return rg.Vector3d(0, push, 0)

    @staticmethod
    def push_line_constrained(line, axis, rects, minpar, maxpar, bestpar = 0):
        """
        Translates a line out of overlapping rectangles in one step:
        vertical lines move horizontally, horizontal lines move vertically.
        Will not push outside constraints, if the target push goes beyond
        constraints will fallback on bestparameter or fallback to 0 if abscent
        """
        #for debugging
        # override axis: vertical lines -> horizontal movement, else -> vertical
        #axis = 'x' if LineUtils.is_vertical(line) else 'y'
        if axis == 'x':
            perp_orient = 'vertical'
        else: 
            perp_orient = 'horizontal'
        
        #bestpar = None
        # domain on the perpendicular axis
        domain = LineUtils.get_domain(line, perp_orient)
        # center coordinate on the movement axis
        c = (line.From.X + line.To.X) / 2.0 if axis == 'x' else (line.From.Y + line.To.Y) / 2.0

        # collect movement‐axis intervals from rects overlapping in perp domain
        intervals = []
        for r in rects:
            o = r.Plane.Origin
            if axis == 'x':
                perp_int = (o.Y + r.Y.Min, o.Y + r.Y.Max)
                axis_int = (o.X + r.X.Min, o.X + r.X.Max)
            else:
                perp_int = (o.X + r.X.Min, o.X + r.X.Max)
                axis_int = (o.Y + r.Y.Min, o.Y + r.Y.Max)
            if LineUtils.domains_overlap(domain, perp_int):
                intervals.append(axis_int)
        
        pushvector = rg.Vector3d(0, 0, 0)
        
        # merge and find containing interval
        for u_min, u_max in LineUtils.merge_intervals(intervals):
            if c > u_min + GLOBAL_TOL and c < u_max - GLOBAL_TOL:
                off = 0
                if abs(u_min - c) < abs(u_max - c):
                    off = (u_min - c) 
                else:
                    off = (u_max - c)
                
                if axis == 'x':
                    parameter = line.From.X
                    moved = parameter+off

                    if moved < maxpar and moved > minpar:
                        pushvector = rg.Vector3d(off, 0, 0)
                    elif moved >= maxpar:
                        if bestpar:
                            offset = moved-bestpar
                        else:
                            offset = moved-maxpar
                        pushvector = rg.Vector3d(off - offset, 0, 0)

                    elif moved <= minpar:
                        if bestpar:
                            offset = moved-bestpar
                        else:
                            offset = moved-minpar
                        pushvector = rg.Vector3d(off - offset, 0, 0)

                else: #if "y"
                    parameter = line.From.Y
                    moved = parameter+off

                    if moved < maxpar and moved > minpar:
                        pushvector = rg.Vector3d(0, off, 0)
                    elif moved >= maxpar:
                        if bestpar:
                            offset = moved-bestpar
                        else:
                            offset = moved-maxpar
                        pushvector = rg.Vector3d(0, off - offset, 0)

                    elif moved <= minpar:
                        if bestpar:
                            offset = moved-bestpar
                        else:
                            offset = moved-minpar
                        pushvector = rg.Vector3d(0, off - offset, 0)
                
                break

        # no overlap -> no move
        return pushvector

    @staticmethod
    def push_lines_onepass(lines, rects, axis='x', spacebuffer_value=5.0, tol=GLOBAL_TOL):
        """
        One‑pass, center‑out resolver that moves all parallel segments together,
        preserving order and respecting no‑fly rectangles.
        Minimal spacing between neighbors = min(original_gap, spacebuffer_value).
        axis: 'x' -> move in X (vertical lines), 'y' -> move in Y (horizontal lines)
        Returns list[rg.Vector3d] in the same order as 'lines'.
        """
        if not lines:
            return []

        # Movement axis and PERPENDICULAR orientation (critical fix)
        if axis == 'x':
            # vertical lines move in X -> use Y domain for overlap tests
            def pos(ln):  # center on X
                return (ln.From.X + ln.To.X) * 0.5
            def dom_perp(ln):  # Y-interval
                y0, y1 = ln.From.Y, ln.To.Y
                return (y0, y1) if y0 <= y1 else (y1, y0)
        else:
            # horizontal lines move in Y -> use X domain for overlap tests
            def pos(ln):  # center on Y
                return (ln.From.Y + ln.To.Y) * 0.5
            def dom_perp(ln):  # X-interval
                x0, x1 = ln.From.X, ln.To.X
                return (x0, x1) if x0 <= x1 else (x1, x0)

        # Per‑line data
        n = len(lines)
        positions = [pos(ln) for ln in lines]
        domains   = [dom_perp(ln) for ln in lines]

        # For each line, collect union of movement‑axis intervals from rects
        # whose PERP interval overlaps the line’s PERP domain
        def _merge(ints):
            return LineUtils.merge_intervals(ints, tol) if ints else []

        covers = [[] for _ in range(n)]
        for i in range(n):
            ivs = []
            dperp_lo, dperp_hi = domains[i]
            for r in rects:
                o = r.Plane.Origin
                if axis == 'x':
                    # vertical move: perp=Y, axis=X
                    perp_iv = (o.Y + r.Y.Min, o.Y + r.Y.Max)
                    axis_iv = (o.X + r.X.Min, o.X + r.X.Max)
                else:
                    # horizontal move: perp=X, axis=Y
                    perp_iv = (o.X + r.X.Min, o.X + r.X.Max)
                    axis_iv = (o.Y + r.Y.Min, o.Y + r.Y.Max)
                # overlap test on PERP axis
                if (dperp_hi + tol >= min(perp_iv) and dperp_lo <= max(perp_iv) + tol):
                    a0, a1 = axis_iv
                    if a1 < a0:
                        a0, a1 = a1, a0
                    ivs.append((a0, a1))
            covers[i] = _merge(ivs)

        # Partition into components by PERP overlap (sweep)
        idxs = sorted(range(n), key=lambda i: domains[i][0])
        comps = []
        if idxs:
            cur = [idxs[0]]
            cur_max = domains[idxs[0]][1]
            for j in idxs[1:]:
                lo, hi = domains[j]
                if lo <= cur_max + tol:
                    cur.append(j)
                    if hi > cur_max:
                        cur_max = hi
                else:
                    comps.append(cur)
                    cur = [j]
                    cur_max = hi
            comps.append(cur)

        # Utilities to clear out of a merged union in one step
        def _contains(ints, u):
            for a, b in ints:
                if u >= a - tol and u <= b + tol:
                    return (a, b)
            return None
        def _clear_left(i_idx, x):
            iv = _contains(covers[i_idx], x)
            return (iv[0] - tol) if iv is not None else x
        def _clear_right(i_idx, x):
            iv = _contains(covers[i_idx], x)
            return (iv[1] + tol) if iv is not None else x

        offsets = [0.0] * n

        for comp in comps:
            comp_sorted = sorted(comp, key=lambda i: positions[i])
            x0   = [positions[i] for i in comp_sorted]
            xnew = list(x0)
            m = len(comp_sorted)
            
            if m == 0:
                continue

            # Neighbor spacing = min(original gap, spacebuffer_value)
            dmin = [min(x0[k+1] - x0[k], spacebuffer_value) for k in range(m - 1)]

            # Center‑out deterministic order (alternate sides)
            order = []
            if m % 2 == 1:
                mid = m // 2
                order.append(mid)
                for d in range(1, m):
                    r = mid + d
                    l = mid - d
                    if r < m:
                        order.append(r)
                    if l >= 0:
                        order.append(l)
            else:
                left = (m // 2) - 1
                right = (m // 2)
                order.extend([left, right])
                for d in range(1, m):
                    r = right + d
                    l = left - d
                    if r < m:
                        order.append(r)
                    if l >= 0:
                        order.append(l)

            # Process center‑out
            for j in order:
                i_idx = comp_sorted[j]
                cur   = xnew[j]
                iv    = _contains(covers[i_idx], cur)
                if iv is None:
                    continue

                # Cheapest initial escape (ties -> left)
                left_target  = iv[0] - tol
                right_target = iv[1] + tol
                left_cost    = cur - left_target
                right_cost   = right_target - cur

                if left_cost <= right_cost:
                    xnew[j] = _clear_left(i_idx, left_target)
                    # chain left
                    for k in range(j - 1, -1, -1):
                        need   = dmin[k]
                        target = xnew[k + 1] - need
                        if xnew[k] > target:
                            xnew[k] = target
                        idk = comp_sorted[k]
                        xnew[k] = _clear_left(idk, xnew[k])
                else:
                    xnew[j] = _clear_right(i_idx, right_target)
                    # chain right
                    for k in range(j + 1, m):
                        need   = dmin[k - 1]
                        target = xnew[k - 1] + need
                        if xnew[k] < target:
                            xnew[k] = target
                        idk = comp_sorted[k]
                        xnew[k] = _clear_right(idk, xnew[k])

            # write back offsets
            for j, idx in enumerate(comp_sorted):
                offsets[idx] = xnew[j] - x0[j]

        # Build vectors in original order
        if axis == 'x':
            return [rg.Vector3d(offsets[i], 0.0, 0.0) for i in range(n)]
        else:
            return [rg.Vector3d(0.0, offsets[i], 0.0) for i in range(n)]

    @staticmethod
    def push_verticals_onepass(lines, rects, spacebuffer_value=5.0, tol=GLOBAL_TOL):
        return LineUtils.push_lines_onepass(lines, rects, axis='x',
                                            spacebuffer_value=spacebuffer_value, tol=tol)

    @staticmethod
    def push_horizontals_onepass(lines, rects, spacebuffer_value=5.0, tol=GLOBAL_TOL):
        return LineUtils.push_lines_onepass(lines, rects, axis='y',
                                            spacebuffer_value=spacebuffer_value, tol=tol)

    @staticmethod
    def lxl(line, lines, tol=GLOBAL_TOL):
        """
        Checks whether a finite line intersects any line in a list within a
        given tolerance, returning True on the first valid interior
        intersection. The tolerance can be optionally specified.
        """
        flag = False
        
        for l in lines:
            bool, p1, p2 = rg.Intersect.Intersection.LineLine(line, l, tol, True) #finite

            if bool:
                if p1 < 1.0 - tol and p1 > tol:
                    flag =True
                    break
        return flag
    
    @staticmethod
    def lxb(line, boxes, infinite = False):
        """
        Determines if a line intersects any Box in a list by testing overlapping
        parametric intervals,
        returning True if any hit occurs.
        """
        boxhit = False
       
        for box in boxes:
            #this treats line as infinite, so hits are not the only parameter to judge 
            #intersections
            bhit, interval = rg.Intersect.Intersection.LineBox(line, box, 0.0)
            #ist, iend = interval
            #smaller = min(ist, iend)
            #inint = smaller > 0.0 and smaller < 1.0 #in interval
            inint = LineUtils.domains_overlap(rg.Interval(0.0, 1.0), interval)
            
            if bhit:
                if infinite or inint:
                    boxhit = True
                    break
        #return False
        return boxhit
    
    #Rhinocommon only has line x box
    @staticmethod
    def lxr(line, rectangles, infinite = False):
        """
        Tests intersection between a line and Rectangle3d list,
        returning True if any hit occurs.
        """
        boxes = map(LineUtils.rectangle_to_box, rectangles)
        return LineUtils.lxb(line, boxes, infinite)

    @staticmethod
    def poly_hits_rects(polyline, rectangles):
        """
        Returns True if any finite segment of the polyline intersects
        any of the given Rectangle3d objects
        """
        if polyline is None:
            return False
        if not rectangles:
            return False
        for i in range(polyline.SegmentCount):
            seg = polyline.SegmentAt(i)
            if LineUtils.lxr(seg, rectangles):
                return True
        return False

    @staticmethod
    def line_inside_percentage(line, rectangles):
        """
        Calculates the percentage of a line's length that lies strictly within any
        given Rectangle3d objects, returning a float 0.0–100.0.
        """
        if line.Length <= 0:
            return 0.0

        intervals = []
        seg_dom = rg.Interval(0.0, 1.0)

        for rect in rectangles:
            box = LineUtils.rectangle_to_box(rect, thickness=10.0)
            hit, iv = rg.Intersect.Intersection.LineBox(line, box, GLOBAL_TOL)
            if not hit:
                continue
            t0, t1 = iv.Min, iv.Max
            lo = max(seg_dom.Min, min(t0, t1))
            hi = min(seg_dom.Max, max(t0, t1))
            if hi > lo + GLOBAL_TOL:
                intervals.append((lo, hi))

        merged = LineUtils.merge_intervals(intervals)
        covered = sum(b - a for a, b in merged)
        return (covered * 100.0)

    @staticmethod
    def filter_same_direction(line, lines, tol=GLOBAL_TOL):
        """
        Returns a list of booleans indicating if each line in 'lines' shares the
        general direction of 'line', ignoring sign. Uses dot product with tolerance
        to determine near-parallelism.
        """
        # get unit direction of reference line
        d0 = line.Direction
        d0.Unitize()
        flags = []
        for l in lines:
            # unit direction of test line
            d = l.Direction
            d.Unitize()
            # absolute dot gives 1.0 for parallel or anti-parallel
            flags.append(abs(d0 * d) >= 1.0 - tol)
        return flags

    @staticmethod
    def filter_by_flag(items, flags):
        """
        Returns only those items whose corresponding flag is True.
        """
        return list(itertools.compress(items, flags))

    @staticmethod
    def is_vertical(line, tol=GLOBAL_TOL):
        """
        Returns True if a line is effectively vertical within a given tolerance.
        """
        return abs(line.From.X - line.To.X) < tol
    
    @staticmethod
    def is_horizontal(line, tol=GLOBAL_TOL):
        """
        Returns True if a line is effectively horizontal within a given tolerance.
        """
        return abs(line.From.Y - line.To.Y) < tol

    @staticmethod
    def orientation_of_line(line, tol=GLOBAL_TOL):
        """
        Return Orientation constant for a line.
        """
        if LineUtils.is_vertical(line, tol):
            return LineUtils.Orientation.VERTICAL
        if LineUtils.is_horizontal(line, tol):
            return LineUtils.Orientation.HORIZONTAL
        return LineUtils.Orientation.NONORTH

    @staticmethod
    def get_position(line, orientation):
        """
        Calculates the midpoint coordinate of a line along the specified orientation
        (“vertical” or “horizontal”).
        """
        if orientation == LineUtils.Orientation.VERTICAL:
            return (line.From.X + line.To.X) / 2.0
        elif orientation == LineUtils.Orientation.HORIZONTAL:
            return (line.From.Y + line.To.Y) / 2.0
        return 0.0
    
    @staticmethod
    def get_domain(line, orientation):
        """
        Returns the sorted [min, max] coordinates of a line along the specified
        orientation (“vertical” or “horizontal”).
        """
        if orientation == LineUtils.Orientation.VERTICAL:
            return sorted([line.From.Y, line.To.Y])
        elif orientation == LineUtils.Orientation.HORIZONTAL:
            return sorted([line.From.X, line.To.X])
        return [0.0, 0.0]
    
    @staticmethod
    def domains_overlap(d1, d2, tol=1e-6):
        """
        Returns True if two numeric domains overlap within the given tolerance.
        """
        return (d1[1] + tol >= d2[0]) and (d2[1] + tol >= d1[0])
    
    @staticmethod
    def create_line(pos, domain, orientation):
        """
        Constructs a vertical or horizontal line at a fixed coordinate,
        spanning the specified domain (“vertical” or “horizontal”).
        """
        if orientation == LineUtils.Orientation.VERTICAL:
            pt1 = rg.Point3d(pos, domain[0], 0)
            pt2 = rg.Point3d(pos, domain[1], 0)
        elif orientation == LineUtils.Orientation.HORIZONTAL:
            pt1 = rg.Point3d(domain[0], pos, 0)
            pt2 = rg.Point3d(domain[1], pos, 0)
        return rg.Line(pt1, pt2)
    
    @staticmethod
    def group_lines(sorted_lines, grouper, orientation, weight_map=None):
        """
        Clusters sorted lines by proximity: lines within grouper distance and
        overlapping domains are merged into groups (“vertical” or “horizontal”).
        """
        groups = []
        for idx, line in sorted_lines:
            pos = LineUtils.get_position(line, orientation)
            dom = LineUtils.get_domain(line, orientation)
            merged = False
            
            # compute this line's weight
            if weight_map:
                weight = weight_map.get(idx, 1.0)
            else:
                weight = 1.0
            
            for g in groups:
                if abs(pos - LineUtils.get_position(g['target'], orientation)) < grouper:
                    if LineUtils.domains_overlap(dom, LineUtils.get_domain(g['target'], orientation)):
                        gdom = LineUtils.get_domain(g['target'], orientation)
                        new_dom = [min(dom[0], gdom[0]), max(dom[1], gdom[1])]
                        
                        # compute the target line's weight
                        tgt_idx = g['target_idx']                              
                        tgt_weight = weight_map.get(tgt_idx, 1.0) if weight_map else 1.0 
                        
                        if line.Length * weight >= g['target'].Length * tgt_weight:   
                            new_pos = pos 
                            g['target_idx'] = idx 
                        else:
                            new_pos = LineUtils.get_position(g['target'], orientation)
                        g['target'] = LineUtils.create_line(new_pos, new_dom, orientation)
                        g['members'].append((idx, line))
                        merged = True
                        break
            if not merged:
                # initialize target_idx for weight lookups
                groups.append({'target': line, 'members': [(idx, line)], 'target_idx': idx})
                
        return groups
    
    @staticmethod
    def transform_line(line, transform):
        """
        Applies a given Transform to a copy of a line.
        """
        tline = rg.Line(line.From, line.To)
        tline.Transform(transform)
        return tline
    
    #try moving origin line and check for intersections before operation
    @staticmethod
    def compute_transform(orig_line, target_line, orientation, avoidrects = []):
        """
        Computes a translation Transform to align one line to another along an
        orientation, optionally avoiding collisions with rectangles.
        """
        checkcollision = len(avoidrects) > 0

        if orientation == LineUtils.Orientation.VERTICAL:
            dx = target_line.From.X - orig_line.From.X
            vec = rg.Vector3d(dx, 0, 0)
            
        elif orientation == LineUtils.Orientation.HORIZONTAL:
            dy = target_line.From.Y - orig_line.From.Y
            vec = rg.Vector3d(0, dy, 0)
        else:
            return rg.Transform.Identity

        translation = rg.Transform.Translation(vec)
        if checkcollision:
            checkline = LineUtils.transform_line(orig_line, translation)
            if not LineUtils.lxr(checkline, avoidrects):
                return translation
            return rg.Transform.Identity
            
        #fallback
        return translation
        
    @staticmethod
    def grouper(lines, grouper, noflies = [], weight_map=None, keyed = False, pull_mode = 0):
        """
        Identifies vertical and horizontal lines and groups them by proximity,
        computes translations to align group members, and returns a list of
        transforms for all lines.

        pull_mode:
            0 - pull to longest (legacy)
            1 - pull to weighted average position of group
            2 - pull to middle (midrange) position of group
        """
        vert = []
        horiz = []
        nonorth = {}
        i = 0
        while i < len(lines):
            line = lines[i]
            if LineUtils.is_vertical(line):
                vert.append((i, line))
            elif LineUtils.is_horizontal(line):
                horiz.append((i, line))
            else:
                nonorth[i] = rg.Transform.Identity
            i += 1

        vert_sorted = sorted(vert, key=lambda x: LineUtils.get_position(x[1], LineUtils.Orientation.VERTICAL))
        horiz_sorted = sorted(horiz, key=lambda x: LineUtils.get_position(x[1], LineUtils.Orientation.HORIZONTAL))

        transforms = {}
        groups_dict = {}
        group_idx = 0

        def _compute_group_target_line(group, orientation):
            if pull_mode == 0:
                return group['target']

            dom_min = None
            dom_max = None
            positions = []
            weights = []
            j = 0
            while j < len(group['members']):
                idx, ln = group['members'][j]
                dom = LineUtils.get_domain(ln, orientation)
                if dom_min is None or dom[0] < dom_min:
                    dom_min = dom[0]
                if dom_max is None or dom[1] > dom_max:
                    dom_max = dom[1]
                pos = LineUtils.get_position(ln, orientation)
                positions.append(pos)

                if weight_map:
                    w = weight_map.get(idx, 1.0)
                else:
                    w = 1.0
                w = w * ln.Length
                weights.append(w)
                j += 1

            if dom_min is None or dom_max is None or not positions:
                return group['target']

            if pull_mode == 1:
                target_pos = LineUtils.weighted_average(positions, weights)
            elif pull_mode == 2:
                min_pos = min(positions)
                max_pos = max(positions)
                target_pos = (min_pos + max_pos) * 0.5
            else:
                target_pos = LineUtils.get_position(group['target'], orientation)

            dom_list = [dom_min, dom_max]
            return LineUtils.create_line(target_pos, dom_list, orientation)

        for g in LineUtils.group_lines(vert_sorted, grouper, LineUtils.Orientation.VERTICAL, weight_map):
            member_ids = []
            target_line = _compute_group_target_line(g, LineUtils.Orientation.VERTICAL)
            k = 0
            while k < len(g['members']):
                idx, orig = g['members'][k]
                transforms[idx] = LineUtils.compute_transform(orig, target_line, LineUtils.Orientation.VERTICAL, noflies)
                member_ids.append(idx)
                k += 1
            groups_dict[group_idx] = member_ids
            group_idx += 1

        for g in LineUtils.group_lines(horiz_sorted, grouper, LineUtils.Orientation.HORIZONTAL, weight_map):
            member_ids = []
            target_line = _compute_group_target_line(g, LineUtils.Orientation.HORIZONTAL)
            k = 0
            while k < len(g['members']):
                idx, orig = g['members'][k]
                transforms[idx] = LineUtils.compute_transform(orig, target_line, LineUtils.Orientation.HORIZONTAL, noflies)
                member_ids.append(idx)
                k += 1
            groups_dict[group_idx] = member_ids
            group_idx += 1

        for key_idx in nonorth:
            transforms[key_idx] = nonorth[key_idx]

        if keyed:
            return transforms, groups_dict
        else:
            return [transforms[i] for i in sorted(transforms.keys())]

    @staticmethod
    def filter_unique_nonzero(values, tol = GLOBAL_TOL):
        """
        Filters a list of numeric values, returning only those non-zero above
        tolerance and unique within tolerance.
        """
        unique = []
        for v in values:
            if abs(v) > tol and not any(abs(v - u) <= tol for u in unique):
                unique.append(v)
        return unique
        
    @staticmethod
    def largest_by_abs(values):
        """
        Returns the value with the greatest absolute magnitude from a list,
        or zero if the list is empty.
        """
        if len(values):
            return max(values, key=abs)
        else:
            return 0.0
            
    @staticmethod
    def consecutive_pairs(lst):
        """
        Converts a list of values into a list of consecutive two-element pairs.
        """
        if len(lst) < 2: return []
        return [[lst[i], lst[i+1]] for i in range(len(lst)-1)]

    @staticmethod
    def weighted_average(values, weights):
        """
        Calculates the weighted average of a list of numeric values given corresponding
        weights, returning a float. If weights sum to zero or lists mismatch, returns 0.0.
        """
        # mismatch or empty -> zero
        if len(values) != len(weights) or not values:
            return 0.0

        total = 0.0
        wsum = 0.0
        for v, w in zip(values, weights):
            total += v * w
            wsum += w

        # avoid division by zero
        if abs(wsum) < GLOBAL_TOL:
            return 0.0

        return total / wsum

    @staticmethod
    def average_point(points):
        """
        Arithmetic mean of a list of rg.Point3d.
        """
        if not points:
            return rg.Point3d(0, 0, 0)

        sx = 0.0
        sy = 0.0
        sz = 0.0
        n = len(points)
        
        for p in points:
            sx += p.X
            sy += p.Y
            sz += p.Z

        return rg.Point3d(sx / n, sy / n, sz / n)

    @staticmethod
    def median_point(points):
        """
        Coordinate-wise median (middle value) of the points.
        """
        if not points:
            return rg.Point3d(0, 0, 0)

        xs = sorted([p.X for p in points])
        ys = sorted([p.Y for p in points])
        zs = sorted([p.Z for p in points])
        n = len(points)
        mid = n // 2

        def _med(arr):
            if n % 2 == 1:
                return arr[mid]
            return (arr[mid - 1] + arr[mid]) * 0.5

        return rg.Point3d(_med(xs), _med(ys), _med(zs))

    @staticmethod
    def midrange_point(points):
        """
        Midpoint of min and max along each axis.
        """
        if not points:
            return rg.Point3d(0, 0, 0)

        xs = [p.X for p in points]
        ys = [p.Y for p in points]
        zs = [p.Z for p in points]

        return rg.Point3d(
            (min(xs) + max(xs)) * 0.5,
            (min(ys) + max(ys)) * 0.5,
            (min(zs) + max(zs)) * 0.5
        )

    @staticmethod
    def geometric_median_point(points, max_iters = 50, tol = GLOBAL_TOL):
        """
        Geometric median: the point minimizing sum of distances to all points.
        Uses Weiszfeld's algorithm; falls back to average if coincident.
        """
        n = len(points)
        if n == 0:
            return rg.Point3d(0, 0, 0)

        # start at the centroid
        current = LineUtils.average_point(points)
        for i in range(max_iters):
            num_x = 0.0
            num_y = 0.0
            num_z = 0.0
            denom = 0.0
            for p in points:
                dx = current.X - p.X
                dy = current.Y - p.Y
                dz = current.Z - p.Z
                dist = math.sqrt(dx * dx + dy * dy + dz * dz)
                if dist < tol:
                    # one point is at current => that's the median
                    return p
                w = 1.0 / dist
                num_x += p.X * w
                num_y += p.Y * w
                num_z += p.Z * w
                denom += w

            next_pt = rg.Point3d(num_x / denom, num_y / denom, num_z / denom)
            move = current.DistanceTo(next_pt)
            current = next_pt
            if move < tol:
                break

        return current

    @staticmethod
    def central_point(points, style="average"):
        """
        Returns a central point of 'points' according to 'style'.
        Styles: "average", "median", "midrange", "geometric"
        """
        if style == "average":
            return LineUtils.average_point(points)
        if style == "median":
            return LineUtils.median_point(points)
        if style == "midrange":
            return LineUtils.midrange_point(points)
        if style == "geometric":
            return LineUtils.geometric_median_point(points)

    @staticmethod
    def create_cells_from_grid(lines, tol=GLOBAL_TOL):
        """
        Build closed cell polylines from a planar line grid.
        Returns a list polylines one per cell.
        """
    
        if not lines:
            return []
    
        segs = LineUtils.split_lines_at_intersections(lines, tol, include_endpoints=True)
        if not segs:
            segs = lines
    
        key_to_pt = {}
        def _key_for_point(pt):
            k = LineUtils._find_point_group2d(key_to_pt, pt.X, pt.Y, tol)
            if k is None:
                k = (pt.X, pt.Y)
                key_to_pt[k] = rg.Point3d(pt.X, pt.Y, 0)
            return k
    
        halfedges = []
        edge_lookup = {}
        verts = {}
    
        for ln in segs:
            a = _key_for_point(ln.From)
            b = _key_for_point(ln.To)
    
            he_ab = {"origin": a, "target": b, "twin": None, "visited": False}
            he_ba = {"origin": b, "target": a, "twin": None, "visited": False}
    
            halfedges.append(he_ab)
            halfedges.append(he_ba)
    
            edge_lookup[(a, b)] = he_ab
            edge_lookup[(b, a)] = he_ba
    
            if a not in verts:
                verts[a] = []
            if b not in verts:
                verts[b] = []
            verts[a].append(he_ab)
            verts[b].append(he_ba)
    
        def _he_angle(he):
            ox, oy = he["origin"]
            tx, ty = he["target"]
            dx = tx - ox
            dy = ty - oy
            ang = math.atan2(dy, dx)
            if ang < 0.0:
                ang = ang + 2.0 * math.pi
            return ang
    
        for v in verts:
            lst = verts[v]
            lst.sort(key=_he_angle)
    
        for he in halfedges:
            twin = edge_lookup.get((he["target"], he["origin"]))
            he["twin"] = twin
    
        def _next_rule(he):
            if he["twin"] is None:
                return None
            v = he["target"]
            lst = verts.get(v)
            if not lst:
                return None
            try:
                idx = lst.index(he["twin"])
            except:
                return None
            if len(lst) == 0:
                return None
            nxt = lst[(idx - 1) % len(lst)]
            return nxt
    
        def _polygon_area(keys):
            area = 0.0
            i = 0
            while i < len(keys) - 1:
                x1 = keys[i][0]
                y1 = keys[i][1]
                x2 = keys[i + 1][0]
                y2 = keys[i + 1][1]
                area = area + (x1 * y2 - x2 * y1)
                i = i + 1
            if area < 0.0:
                area = -area
            return 0.5 * area
    
        faces = []
        for he in halfedges:
            if he["visited"]:
                continue
            if he["twin"] is None:
                continue
    
            face = []
            start = he
            cur = he
            steps = 0
    
            while True:
                he["visited"] = True
                face.append(cur["origin"])
    
                nxt = _next_rule(cur)
                if nxt is None:
                    break
    
                if nxt == start:
                    face.append(start["origin"])
                    break
    
                cur = nxt
                he = cur
                steps = steps + 1
                if steps > 10000:
                    break
    
            if len(face) > 3:
                faces.append(face)
    
        if not faces:
            return []
    
        biggest = None
        biggest_idx = -1
        i = 0
        while i < len(faces):
            a = _polygon_area(faces[i])
            if biggest is None or a > biggest:
                biggest = a
                biggest_idx = i
            i = i + 1
    
        cells = []
        i = 0
        while i < len(faces):
            if i != biggest_idx:
                keys = faces[i]
                if keys[0] != keys[-1]:
                    keys = list(keys)
                    keys.append(keys[0])
    
                pl = rg.Polyline()
                j = 0
                while j < len(keys):
                    k = keys[j]
                    pt = key_to_pt[k]
                    pl.Add(pt)
                    j = j + 1
    
                if pl.Count >= 4:
                    pl.MergeColinearSegments(tol, True)
                    if pl.IsClosed:
                        cells.append(pl)
            i = i + 1
    
        return cells

    @staticmethod
    def unique_points(points, tol=1e-8):
        """
        Return unique 2D points (XY plane) within a given tolerance.
        """
        unique = []
        for p in points:
            if not any(abs(p.X - q.X) < tol and abs(p.Y - q.Y) < tol for q in unique):
                unique.append(p)
        return unique

    @staticmethod
    def _circumcircle_contains(a, b, c, p):
        """
        Return True if p lies inside the circumcircle of triangle (a, b, c).
        """
        ax, ay = a.X, a.Y
        bx, by = b.X, b.Y
        cx, cy = c.X, c.Y
        dx, dy = p.X, p.Y
        d = 2*(ax*(by-cy) + bx*(cy-ay) + cx*(ay-by))
        
        if abs(d) < 1e-8:
            return False
            
        asq = ax*ax + ay*ay
        bsq = bx*bx + by*by
        csq = cx*cx + cy*cy
        ux = (asq*(by-cy) + bsq*(cy-ay) + csq*(ay-by)) / d
        uy = (asq*(cx-bx) + bsq*(ax-cx) + csq*(bx-ax)) / d
        return ((dx-ux)**2 + (dy-uy)**2) < ((ax-ux)**2 + (ay-uy)**2)

    @staticmethod
    def _delaunay(points):
        """
        Bowyer–Watson Delaunay triangulation of 2D points.
        Returns list of index triples into `points`.
        """
        pts = [(p.X, p.Y) for p in points]
        n = len(pts)
        xs, ys = zip(*pts)
        xmin, xmax = min(xs), max(xs)
        ymin, ymax = min(ys), max(ys)
        dx, dy = xmax-xmin, ymax-ymin
        dmax = max(dx, dy)
        mx, my = (xmin+xmax)/2.0, (ymin+ymax)/2.0
        super_pts = [
            (mx-2*dmax, my-dmax),
            (mx,        my+2*dmax),
            (mx+2*dmax, my-dmax)
        ]
        ext = pts + super_pts
        tris = [(n, n+1, n+2)]
        for i, (x, y) in enumerate(pts):
            bad, edges = [], {}
            for tri in tris:
                xi, yi = ext[tri[0]]; a = rg.Point3d(xi, yi, 0)
                xj, yj = ext[tri[1]]; b = rg.Point3d(xj, yj, 0)
                xk, yk = ext[tri[2]]; c = rg.Point3d(xk, yk, 0)
                p = rg.Point3d(x, y, 0)
                if LineUtils._circumcircle_contains(a, b, c, p):
                    bad.append(tri)
                    for u, v in ((tri[0],tri[1]), (tri[1],tri[2]), (tri[2],tri[0])):
                        key = tuple(sorted((u, v)))
                        edges[key] = edges.get(key, 0) + 1
            tris = [t for t in tris if t not in bad]
            for (u, v), cnt in edges.items():
                if cnt == 1:
                    tris.append((u, v, i))
        # remove triangles using super-vertices
        return [t for t in tris if all(j < n for j in t)]

    @staticmethod
    def _alpha_shape_edges(points, alpha):
        """
        Return boundary edges of the α-shape for 2D points.
        """
        tris = LineUtils._delaunay(points)
        edge_count = {}
        for tri in tris:
            a, b, c = (points[j] for j in tri)
            ab, ac = b-a, c-a
            d = 2*(ab.X*ac.Y - ab.Y*ac.X)
            if abs(d) < 1e-8:
                continue
            asq = ab.X*ab.X + ab.Y*ab.Y
            csq = ac.X*ac.X + ac.Y*ac.Y
            cx = (ac.Y*asq - ab.Y*csq) / d
            cy = (ab.X*csq - ac.X*asq) / d
            if math.hypot(cx, cy) <= alpha:
                for u, v in ((tri[0],tri[1]), (tri[1],tri[2]), (tri[2],tri[0])):
                    key = tuple(sorted((u, v)))
                    edge_count[key] = edge_count.get(key, 0) + 1
        return [edge for edge, cnt in edge_count.items() if cnt == 1]

    @staticmethod
    def estimate_alpha(points):
        """
        Estimate a good alpha value based on point spread.
        """
        unique = LineUtils.unique_points(points)
        if len(unique) < 2:
            return 1.0
        xs = [p.X for p in unique]; ys = [p.Y for p in unique]
        dx = max(xs) - min(xs); dy = max(ys) - min(ys)
        diag = math.hypot(dx, dy)
        finetune = 5.0 #extra multiplier hand picked
        return (diag / math.sqrt(len(unique))) * finetune

    @staticmethod
    def concave_hull_points(points, alpha=None):
        """
        Return list of Lines forming the concave hull of Point3d list (XY).
        """
        pts2d = [rg.Point3d(p.X, p.Y, 0) for p in points]
        unique = LineUtils.unique_points(pts2d)
        if alpha is None:
            alpha = LineUtils.estimate_alpha(unique)
        edges = LineUtils._alpha_shape_edges(unique, alpha)
        return [rg.Line(unique[i], unique[j]) for i, j in edges]

    @staticmethod
    def concave_hull_lines(lines, alpha=None):
        """
        Return concave hull of line segments by their endpoints.
        """
        pts = []
        for ln in lines:
            pts.append(rg.Point3d(ln.From.X, ln.From.Y, 0))
            pts.append(rg.Point3d(ln.To.X,   ln.To.Y,   0))
        return LineUtils.concave_hull_points(pts, alpha)

    @staticmethod
    def join_lines(lines, mergecollinear=True, tol=1e-8):
        """
        Join lines into polylines by connecting touching endpoints.
        """
        endpoints = []
        for ln in lines:
            endpoints.append(rg.Point3d(ln.From.X, ln.From.Y, 0))
            endpoints.append(rg.Point3d(ln.To.X,   ln.To.Y,   0))
        unique = {}
        for p in endpoints:
            key = (round(p.X/tol), round(p.Y/tol))
            if key not in unique:
                unique[key] = (p.X, p.Y)
        adj = {}
        for idx, ln in enumerate(lines):
            p1 = (round(ln.From.X/tol), round(ln.From.Y/tol))
            p2 = (round(ln.To.X/tol),   round(ln.To.Y/tol))
            adj.setdefault(p1, []).append((p2, idx))
            adj.setdefault(p2, []).append((p1, idx))
        visited = set()
        polylines = []
        for idx, ln in enumerate(lines):
            if idx in visited:
                continue
            start = (round(ln.From.X/tol), round(ln.From.Y/tol))
            comp_keys = set([start]); comp_lines = set()
            queue = [start]
            while queue:
                k = queue.pop(0)
                for neigh, li in adj.get(k, []):
                    comp_lines.add(li)
                    if neigh not in comp_keys:
                        comp_keys.add(neigh)
                        queue.append(neigh)
            deg_one = [k for k in comp_keys if sum(1 for (n,li) in adj[k] if li in comp_lines) == 1]
            cur = deg_one[0] if deg_one else start
            pts_seq = [cur]
            while True:
                found = False
                for neigh, li in adj[cur]:
                    if li in comp_lines and li not in visited:
                        visited.add(li)
                        pts_seq.append(neigh)
                        cur = neigh
                        found = True
                        break
                if not found:
                    break
            pline = rg.Polyline([rg.Point3d(unique[k][0], unique[k][1], 0) for k in pts_seq])
            polylines.append(pline)
        
        if mergecollinear:
            for poly in polylines:
                poly.MergeColinearSegments(GLOBAL_TOL, True)
        
        return polylines

    @staticmethod
    def circle_points(center, radius, count):
        """
        Returns a list of `count` rg.Point3d objects evenly distributed around
        a circle of given `radius` centered at `center`.
        """
        # guard: count must be int ≥ 1
        if not isinstance(count, int) or count < 1:
            return None
        else:
            pts = []
            
            for i in range(count):
                angle = 2.0 * math.pi * i / count
                x = center.X + radius * math.cos(angle)
                y = center.Y + radius * math.sin(angle)
                z = center.Z
                pts.append(rg.Point3d(x, y, z))
            
            return pts

    @staticmethod
    def _point_in_poly(pt, polyl, tol=1e-6):
        """
        returns True if pt is inside or on boundary.
        Uses distance-to-edge for boundary, then ray-casting for in/out.
        """
        # prepare closed vertex list
        pts = list(polyl)
        if not pts:
            return False
        if pts[0] != pts[-1]:
            pts.append(pts[0])
        x, y = pt.X, pt.Y
        
        # if the point is very close to any edge, count it as inside
        for i in range(len(pts)-1):
            if LineUtils._dist_point_seg(pt, pts[i], pts[i+1], tol) <= tol:
                return True
        
        # ray-casting
        inside = False
        for i in range(len(pts)-1):
            xi, yi = pts[i].X, pts[i].Y
            xj, yj = pts[i+1].X, pts[i+1].Y
            # check edge straddles horizontal ray
            if ((yi > y) != (yj > y)):
                xint = xi + (y - yi) * (xj - xi) / (yj - yi)
                if x < xint:
                    inside = not inside
        return inside

    @staticmethod
    def _dist_point_seg(pt, a, b, tol=1e-6):
        """
        Euclidean distance from point pt to segment AB.
        """
        vx, vy = b.X - a.X, b.Y - a.Y
        wx, wy = pt.X - a.X, pt.Y - a.Y
        denom = vx*vx + vy*vy
        if denom < tol:
            return math.hypot(wx, wy)
        t = (wx*vx + wy*vy) / denom
        if t <= 0:
            return math.hypot(wx, wy)
        if t >= 1:
            dx, dy = pt.X - b.X, pt.Y - b.Y
            return math.hypot(dx, dy)
        projx = a.X + t * vx
        projy = a.Y + t * vy
        return math.hypot(pt.X - projx, pt.Y - projy)

    @staticmethod
    def _interp(pa, pb, va, vb, iso, tol=1e-6):
        """
        Linear interpolate between points pa and pb where sdf crosses iso.
        """
        if abs(vb - va) < tol:
            t = 0.5
        else:
            t = (iso - va) / float(vb - va)
        return rg.Point3d(
            pa.X + t*(pb.X - pa.X),
            pa.Y + t*(pb.Y - pa.Y),
            0
        )

    @staticmethod
    def offset_polyline(pline, offset, resolution=50, tol=1e-6):
        """
        SDF-based offset of a planar polyline (XY plane only).
        returns list of Polylines (possibly multiple loops).
        """
        # close the loop
        verts = list(pline)
        if verts and verts[0] != verts[-1]:
            verts.append(verts[0])
    
        # compute bbox and pad offset margin
        margin = 0.1
        xs = [p.X for p in verts]
        ys = [p.Y for p in verts]
        
        minx, maxx = min(xs), max(xs)
        miny, maxy = min(ys), max(ys)
        
        w0 = maxx - minx
        h0 = maxy - miny
        
        pad_x = margin * w0
        pad_y = margin * h0
        m = abs(offset)
        
        minx -= pad_x + m
        maxx += pad_x + m
        miny -= pad_y + m
        maxy += pad_y + m
    
        # grid dimensions
        width, height = maxx - minx, maxy - miny
        cell = max(width, height) / float(resolution)
        nx, ny = int(round(width/cell)), int(round(height/cell))
    
        # sample signed distance field
        vals = [[0.0]*(nx+1) for _ in range(ny+1)]
        for i in range(ny+1):
            y = miny + i*cell
            for j in range(nx+1):
                x = minx + j*cell
                p = rg.Point3d(x, y, 0)
                inside = LineUtils._point_in_poly(p, verts, tol)
                dmin = min(
                    LineUtils._dist_point_seg(p, a, b, tol)
                    for a, b in zip(verts, verts[1:])
                )
                vals[i][j] = -dmin if inside else dmin
    
        # marching squares at iso=offset
        iso, lines = offset, []
        for i in range(ny):
            for j in range(nx):
                v0, v1 = vals[i][j],     vals[i][j+1]
                v3, v2 = vals[i+1][j],   vals[i+1][j+1]
                pts = [
                    rg.Point3d(minx+j*cell,   miny+i*cell,   0),
                    rg.Point3d(minx+(j+1)*cell, miny+i*cell,   0),
                    rg.Point3d(minx+(j+1)*cell, miny+(i+1)*cell, 0),
                    rg.Point3d(minx+j*cell,     miny+(i+1)*cell, 0)
                ]
                cs = [v >= iso for v in (v0, v1, v2, v3)]
                case = (cs[0]<<3)|(cs[1]<<2)|(cs[2]<<1)|cs[3]
                if case in (0, 15):
                    continue
    
                edges = []
                for k, (c_curr, c_next) in enumerate(zip(cs, cs[1:]+cs[:1])):
                    if c_curr != c_next:
                        a, b = pts[k], pts[(k+1)%4]
                        va, vb = (v0, v1, v2, v3)[k], (v1, v2, v3, v0)[k]
                        edges.append(LineUtils._interp(a, b, va, vb, iso, tol))
    
                if len(edges) == 2:
                    lines.append(rg.Line(edges[0], edges[1]))
                elif len(edges) == 4:
                    if case in (5, 10):
                        lines.append(rg.Line(edges[0], edges[3]))
                        lines.append(rg.Line(edges[1], edges[2]))
                    else:
                        lines.append(rg.Line(edges[0], edges[1]))
                        lines.append(rg.Line(edges[2], edges[3]))
    
        return LineUtils.join_lines(lines, mergecollinear=True, tol=tol)

    @staticmethod
    def filter_external_polylines(polylines, tol=1e-6):
        """
        Return only those closed polylines that are not fully contained
        within any other polyline in the list.
        """
        external = []
        for i, pl in enumerate(polylines):
            # get distinct vertices (drop closing duplicate)
            pts = list(pl)
            if pts and pts[0] == pts[-1]:
                pts = pts[:-1]
            # check if all vertices lie inside some other polyline
            inside_any = False
            for j, other in enumerate(polylines):
                if i == j:
                    continue
                other_pts = list(other)
                if other_pts and other_pts[0] == other_pts[-1]:
                    other_pts = other_pts[:-1]
                # test all vertices of pl against other
                if all(LineUtils._point_in_poly(p, other_pts, tol) for p in pts):
                    inside_any = True
                    break
            if not inside_any:
                external.append(pl)
        return external

    @staticmethod
    def is_point_in_any_polyline(pt, polylines, tol=1e-6):
        """
        Return True if point pt lies inside or on the boundary of
        any closed polyline in the given list.
        """
        for pl in polylines:
            pts = list(pl)
            # drop closing duplicate
            if pts and pts[0] == pts[-1]:
                pts = pts[:-1]
            if LineUtils._point_in_poly(pt, pts, tol):
                return True
        return False

    @staticmethod
    def time_block(name):
        """
        Use as: with LineUtils.time_block('name of what is being profiled')
        """
        class _Timer(object):
            def __enter__(self_inner):
                self_inner.t0 = time.clock()
                return self_inner
            def __exit__(self_inner, exc_type, exc, tb):
                dt = time.clock() - self_inner.t0
                print('%s took %.3f s' % (name, dt))
        return _Timer()

    @staticmethod
    def profile(func):
        """
        Use as decorator: @LineUtils.profile
        """
        def wrapper(*args, **kwargs):
            t0 = time.clock()
            result = func(*args, **kwargs)
            dt = time.clock() - t0
            print('%s took %.3f s' % (func.__name__, dt))
            return result
        return wrapper

    @staticmethod
    def timeout(seconds):
        """
        Use as decorator: @LineUtils.timeout(5)
        If the wrapped function doesn’t finish in <seconds>, returns "expired".
        """
        def decorator(func):
            def wrapper(*args, **kwargs):
                result = [None]
                exception = [None]
                def target():
                    try:
                        result[0] = func(*args, **kwargs)
                    except Exception as e:
                        exception[0] = e

                thread = System.Threading.Thread(System.Threading.ThreadStart(target))
                thread.IsBackground = True
                thread.Start()

                if not thread.Join(int(seconds * 1000)):
                    thread.Abort()
                    return "expired"

                if exception[0]:
                    # re-raise original exception
                    raise exception[0]
                return result[0]
            return wrapper
        return decorator

    @staticmethod
    def run_with_timeout(func, seconds):
        """
        Use as: LineUtils.run_with_timeout(lambda: your_func(arg1, arg2), 5)
        Returns the function’s result, or "expired" if it times out.
        """
        result = [None]
        exception = [None]
        def target():
            try:
                result[0] = func()
            except Exception as e:
                exception[0] = e

        thread = System.Threading.Thread(System.Threading.ThreadStart(target))
        thread.IsBackground = True
        thread.Start()

        if not thread.Join(int(seconds * 1000)):
            thread.Abort()
            return "expired"

        if exception[0]:
            raise exception[0]
        return result[0]

    @staticmethod
    def parallel(func, args_list, max_threads=4):
        """
        Use as: results = LineUtils.parallel(my_func, [a, b, c], max_threads=4)
        Runs my_func(item) over each item in args_list in up to max_threads
        concurrent threads. Returns a list of results in the same order.
        If any call raises, returns "failed to compute"
        """
        n = len(args_list)
        results = [None] * n
        exceptions = [None] * n
        idx = [0]
        lock = System.Object()

        def worker():
            while True:
                System.Threading.Monitor.Enter(lock)
                try:
                    if idx[0] >= n:
                        break
                    i = idx[0]
                    idx[0] += 1
                finally:
                    System.Threading.Monitor.Exit(lock)

                try:
                    results[i] = func(args_list[i])
                except Exception as e:
                    exceptions[i] = e

        # spawn up to max_threads workers
        threads = []
        count = max_threads if max_threads < n else n
        for _ in range(count):
            t = System.Threading.Thread(System.Threading.ThreadStart(worker))
            t.IsBackground = True
            t.Start()
            threads.append(t)

        # wait for all to finish
        for t in threads:
            t.Join()

        # re-raise first exception, if any
        for e in exceptions:
            if e:
                return "failed to compute"

        return results

    @staticmethod
    def clip_line_rectangle(line, rect, tol=GLOBAL_TOL):
        """
        Clip a line segment to a rectangle using the Liang-Barsky algorithm.
        """
        bb = rect.BoundingBox
        x0, y0, z0 = line.From.X, line.From.Y, line.From.Z
        x1, y1, z1 = line.To.X, line.To.Y, line.To.Z
        dx = x1 - x0
        dy = y1 - y0
        dz = z1 - z0
        p = [-dx, dx, -dy, dy]
        q = [x0 - bb.Min.X, bb.Max.X - x0, y0 - bb.Min.Y, bb.Max.Y - y0]
        u1, u2 = 0.0, 1.0
        for pi, qi in zip(p, q):
            if abs(pi) < tol:
                if qi < 0:
                    return []
            else:
                t = qi / float(pi)
                if pi < 0:
                    if t > u2:
                        return []
                    if t > u1:
                        u1 = t
                else:
                    if t < u1:
                        return []
                    if t < u2:
                        u2 = t
        if u2 < u1:
            return []
        p0 = rg.Point3d(x0 + u1*dx, y0 + u1*dy, z0 + u1*dz)
        p1 = rg.Point3d(x0 + u2*dx, y0 + u2*dy, z0 + u2*dz)
        return [rg.Line(p0, p1)]

    @staticmethod
    def polyline_intersection_rect(pline, rect, tol=GLOBAL_TOL):
        """
        Return list of Polyline segments of `pline` inside `rect`.
        """
        inside = []
        current = []
        pts = list(pline)
        for a, b in zip(pts, pts[1:]):
            segs = LineUtils.clip_line_rectangle(rg.Line(a, b), rect, tol)
            if not segs:
                if current:
                    inside.append(rg.Polyline(current))
                    current = []
                continue
            seg = segs[0]
            if not current:
                current.append(seg.From)
            current.append(seg.To)
        if current:
            inside.append(rg.Polyline(current))
        return inside

    @staticmethod
    def polyline_difference_rect(pline, rect, tol=GLOBAL_TOL):
        """
        Return polyline segments of `pline` outside `rect`.
        """
        segments = []
        pts = list(pline)
        for a, b in zip(pts, pts[1:]):
            outs = LineUtils.line_outside_rectangles(rg.Line(a, b), [rect], 10.0, tol)
            segments.extend([rg.Polyline([seg.From, seg.To]) for seg in outs])
        return segments
    
    @staticmethod
    def segment_to_segment_distance(seg1, seg2):
        """
        Compute the shortest distance between two finite line segments seg1 and seg2 (rg.Line).
        """
        A = seg1.From
        B = seg1.To
        C = seg2.From
        D = seg2.To
    
        # direction vectors
        u = B - A
        v = D - C
        w0 = A - C
    
        a = u * u  # dot(u, u)
        b = u * v  # dot(u, v)
        c = v * v  # dot(v, v)
        d = u * w0 # dot(u, w0)
        e = v * w0 # dot(v, w0)
    
        denom = a * c - b * b
        # initial (s, t) for infinite lines
        if abs(denom) > 1e-12:
            s = (b * e - c * d) / denom
            t = (a * e - b * d) / denom
        else:
            # parallel or nearly parallel
            s = 0.0
            if abs(c) > 1e-12:
                t = e / c
            else:
                t = 0.0
    
        # clamp s, t to [0,1]
        if s < 0.0:
            s = 0.0
        elif s > 1.0:
            s = 1.0
    
        if t < 0.0:
            t = 0.0
        elif t > 1.0:
            t = 1.0
    
        # After clamping one, recompute the other if needed
        # Check if s was clamped
        if s == 0.0 or s == 1.0:
            # solve for t that minimizes distance to P(s)
            Ps = rg.Point3d(
                A.X + u.X * s,
                A.Y + u.Y * s,
                A.Z + u.Z * s
            )
            w = Ps - C
            if abs(c) > 1e-12:
                t_candidate = (v * w) / c
                if t_candidate < 0.0:
                    t = 0.0
                elif t_candidate > 1.0:
                    t = 1.0
                else:
                    t = t_candidate
    
        # Check if t was clamped
        if t == 0.0 or t == 1.0:
            # solve for s that minimizes distance to Q(t)
            Qt = rg.Point3d(
                C.X + v.X * t,
                C.Y + v.Y * t,
                C.Z + v.Z * t
            )
            w = A - Qt
            if abs(a) > 1e-12:
                s_candidate = (u * w) / a
                if s_candidate < 0.0:
                    s = 0.0
                elif s_candidate > 1.0:
                    s = 1.0
                else:
                    s = s_candidate
    
        # Closest points on each segment
        P_closest = rg.Point3d(
            A.X + u.X * s,
            A.Y + u.Y * s,
            A.Z + u.Z * s
        )
        Q_closest = rg.Point3d(
            C.X + v.X * t,
            C.Y + v.Y * t,
            C.Z + v.Z * t
        )
    
        return P_closest.DistanceTo(Q_closest)

    @staticmethod
    def simplify_polyline(pline, tol=GLOBAL_TOL):
        """
        Simplify a polyline using the Ramer-Douglas-Peucker algorithm.
        """
        pts = list(pline)
        if len(pts) <= 2:
            return rg.Polyline(pts)
        keep = [0, len(pts)-1]
        stack = [(0, len(pts)-1)]
        while stack:
            s, e = stack.pop()
            a, b = pts[s], pts[e]
            ax, ay, az = a.X, a.Y, a.Z
            bx, by, bz = b.X, b.Y, b.Z
            dx, dy, dz = bx-ax, by-ay, bz-az
            d2 = dx*dx + dy*dy + dz*dz
            maxd = -1.0
            idx = None
            for i in range(s+1, e):
                p = pts[i]
                if d2 == 0:
                    dist = a.DistanceTo(p)
                else:
                    t = ((p.X-ax)*dx + (p.Y-ay)*dy + (p.Z-az)*dz) / d2
                    t = max(0.0, min(1.0, t))
                    proj = rg.Point3d(ax+t*dx, ay+t*dy, az+t*dz)
                    dist = p.DistanceTo(proj)
                if dist > maxd:
                    maxd = dist
                    idx = i
            if maxd > tol and idx is not None:
                stack.append((s, idx))
                stack.append((idx, e))
            else:
                keep.append(e)
        keep = sorted(set(keep))
        simp = [pts[i] for i in keep]
        return rg.Polyline(simp)

    @staticmethod
    def smooth_polyline(pline, factor=0.25, iterations=1):
        """
        Smooth a polyline using Chaikin's algorithm.
        """
        pts = list(pline)
        closed = pts[0] == pts[-1]
        for _ in range(iterations):
            new_pts = []
            rng = range(len(pts)-1) if not closed else range(len(pts))
            for i in rng:
                p0 = pts[i]
                p1 = pts[(i+1) % len(pts)]
                q = rg.Point3d(
                    p0.X + factor*(p1.X - p0.X),
                    p0.Y + factor*(p1.Y - p0.Y),
                    p0.Z + factor*(p1.Z - p0.Z)
                )
                r = rg.Point3d(
                    p1.X - factor*(p1.X - p0.X),
                    p1.Y - factor*(p1.Y - p0.Y),
                    p1.Z - factor*(p1.Z - p0.Z)
                )
                new_pts.extend([q, r])
            if not closed:
                new_pts = [pts[0]] + new_pts + [pts[-1]]
            else:
                new_pts.append(new_pts[0])
            pts = new_pts
        return rg.Polyline(pts)

    @staticmethod
    def _cross2d(a, b, c):
        return (b.X - a.X)*(c.Y - a.Y) - (b.Y - a.Y)*(c.X - a.X)

    @staticmethod
    def convex_hull(points):
        """
        Return the convex hull of 2D points.
        """
        pts = LineUtils.unique_points([rg.Point3d(p.X, p.Y, 0) for p in points])
        if len(pts) <= 1:
            return pts
        pts.sort(key=lambda p: (p.X, p.Y))
        lower = []
        for p in pts:
            while len(lower) >= 2 and LineUtils._cross2d(lower[-2], lower[-1], p) <= 0:
                lower.pop()
            lower.append(p)
        upper = []
        for p in reversed(pts):
            while len(upper) >= 2 and LineUtils._cross2d(upper[-2], upper[-1], p) <= 0:
                upper.pop()
            upper.append(p)
        return lower[:-1] + upper[:-1]

    @staticmethod
    def laplacian_smooth_polyline(pline, factor=0.5, iterations=1):
        """
        Smooth a polyline using Laplacian smoothing.

        Each interior vertex moves toward the average of its neighbors by
        `factor` on each iteration. Endpoints of an open polyline are kept
        fixed. A closed polyline is treated as a loop.
        """
        pts = list(pline)
        if len(pts) <= 2:
            return rg.Polyline(pts)
        closed = pts[0] == pts[-1]
        for _ in range(iterations):
            new_pts = [pts[0]] if not closed else []
            n = len(pts) - 1 if closed else len(pts)
            for i in range(1 if not closed else 0, n - 1):
                prev_pt = pts[i - 1]
                next_pt = pts[(i + 1) % len(pts)]
                cur_pt = pts[i]
                x = cur_pt.X + factor * ((prev_pt.X + next_pt.X) / 2.0 - cur_pt.X)
                y = cur_pt.Y + factor * ((prev_pt.Y + next_pt.Y) / 2.0 - cur_pt.Y)
                z = cur_pt.Z + factor * ((prev_pt.Z + next_pt.Z) / 2.0 - cur_pt.Z)
                new_pts.append(rg.Point3d(x, y, z))
            if closed:
                new_pts.append(new_pts[0])
            else:
                new_pts.append(pts[-1])
            pts = new_pts
        return rg.Polyline(pts)

    @staticmethod
    def minimum_bounding_rectangle(points):
        """
        Compute oriented minimum bounding rectangle of points.
        """
        hull = LineUtils.convex_hull(points)
        if not hull:
            return None
        if len(hull) == 1:
            p = hull[0]
            plane = rg.Plane(p, rg.Vector3d.XAxis, rg.Vector3d.YAxis)
            return rg.Rectangle3d(plane, 0.0, 0.0)
        min_area = None
        best_rect = None
        n = len(hull)
        for i in range(n):
            p0 = hull[i]
            p1 = hull[(i+1) % n]
            ang = math.atan2(p1.Y - p0.Y, p1.X - p0.X)
            cos_a = math.cos(-ang)
            sin_a = math.sin(-ang)
            xs = []
            ys = []
            for p in hull:
                x = p.X * cos_a - p.Y * sin_a
                y = p.X * sin_a + p.Y * cos_a
                xs.append(x)
                ys.append(y)
            minx, maxx = min(xs), max(xs)
            miny, maxy = min(ys), max(ys)
            area = (maxx - minx) * (maxy - miny)
            if min_area is None or area < min_area:
                min_area = area
                cx = (minx + maxx) / 2.0
                cy = (miny + maxy) / 2.0
                cos_ang = math.cos(ang)
                sin_ang = math.sin(ang)
                center = rg.Point3d(
                    cos_ang*cx - sin_ang*cy,
                    sin_ang*cx + cos_ang*cy,
                    0
                )
                plane = rg.Plane(center,
                                 rg.Vector3d(cos_ang, sin_ang, 0),
                                 rg.Vector3d(-sin_ang, cos_ang, 0))
                xint = rg.Interval(minx - cx, maxx - cx)
                yint = rg.Interval(miny - cy, maxy - cy)
                best_rect = rg.Rectangle3d(plane, xint, yint)
        return best_rect

    @staticmethod
    def _segments_intersect(a1, a2, b1, b2, tol=GLOBAL_TOL):
        def ccw(p1, p2, p3):
            return (p3.Y - p1.Y)*(p2.X - p1.X) > (p2.Y - p1.Y)*(p3.X - p1.X)
        if (max(a1.X, a2.X) + tol < min(b1.X, b2.X) or
            max(b1.X, b2.X) + tol < min(a1.X, a2.X) or
            max(a1.Y, a2.Y) + tol < min(b1.Y, b2.Y) or
            max(b1.Y, b2.Y) + tol < min(a1.Y, a2.Y)):
            return False
        d1 = ccw(a1, b1, b2)
        d2 = ccw(a2, b1, b2)
        d3 = ccw(a1, a2, b1)
        d4 = ccw(a1, a2, b2)
        if d1 != d2 and d3 != d4:
            return True
        return False

    @staticmethod
    def sweep_line_intersections(lines, tol=GLOBAL_TOL):
        """
        Find all segment index pairs that intersect using a sweep algorithm.
        """
        events = []
        for idx, ln in enumerate(lines):
            minx = min(ln.From.X, ln.To.X)
            maxx = max(ln.From.X, ln.To.X)
            events.append((minx, 0, idx))
            events.append((maxx, 1, idx))
        events.sort()
        active = []
        hits = []
        for x, typ, idx in events:
            if typ == 0:
                for j in active:
                    if LineUtils._segments_intersect(lines[idx].From, lines[idx].To,
                                                    lines[j].From, lines[j].To, tol):
                        hits.append((idx, j))
                active.append(idx)
            else:
                if idx in active:
                    active.remove(idx)
        return hits

    @staticmethod
    def find_furthest_point(test_point, points):
        """
        Return the point in 'points' farthest from 'test_point'.
        """
        furthest = None
        max_dist = -float('inf')
        for p in points:
            d = test_point.DistanceTo(p)
            if d > max_dist:
                max_dist, furthest = d, p
        return furthest

    @staticmethod
    def circle_center(p1, p2):
        """
        Given two points, return center and radius of their diameter circle.
        """
        cx = (p1.X + p2.X) / 2.0
        cy = (p1.Y + p2.Y) / 2.0
        center = rg.Point3d(cx, cy, 0)
        radius = p1.DistanceTo(p2) / 2.0
        return center, radius

    @staticmethod
    def circle_three_points(p1, p2, p3, tol=GLOBAL_TOL):
        """
        Return center and radius through three non-colinear points, else (None, None).
        """
        # area test for colinearity
        area = p1.X*(p2.Y-p3.Y) + p2.X*(p3.Y-p1.Y) + p3.X*(p1.Y-p2.Y)
        
        if abs(area) < tol:
            return None, None
        
        A = p2.X - p1.X
        B = p2.Y - p1.Y
        C = p3.X - p1.X
        D = p3.Y - p1.Y
        E = A*(p1.X+p2.X) + B*(p1.Y+p2.Y)
        F = C*(p1.X+p3.X) + D*(p1.Y+p3.Y)
        G = 2*(A*(p3.Y-p2.Y) - B*(p3.X-p2.X))
        
        if abs(G) < tol:
            return None, None
            
        cx = (D*E - B*F) / G
        cy = (A*F - C*E) / G
        center = rg.Point3d(cx, cy, 0)
        radius = center.DistanceTo(p1)
        
        return center, radius

    @staticmethod
    def is_point_inside_circle(center, radius, point, tol=GLOBAL_TOL):
        """
        Return True if 'point' lies within or on the circle.
        """
        return point.DistanceTo(center) <= radius + tol

    @staticmethod
    def minimal_enclosing_circle(points, tol=GLOBAL_TOL):
        """
        Compute smallest circle enclosing all points (pairs + triplets method).
        Returns (center, radius) or (None, None) if no points.
        """
        n = len(points)
        
        if n == 0:
            return None, None
        if n == 1:
            return points[0], 0.0
        if n == 2:
            return LineUtils.circle_center(points[0], points[1])
        
        best_c, best_r = None, float('inf')
        
        # pairs
        for i, j in itertools.combinations(range(n), 2):
            c, r = LineUtils.circle_center(points[i], points[j])
            if all(p.DistanceTo(c) <= r + tol for p in points) and r < best_r:
                best_c, best_r = c, r
                
        # triplets
        for i, j, k in itertools.combinations(range(n), 3):
            c, r = LineUtils.circle_three_points(points[i], points[j], points[k], tol)
            if c is not None and all(p.DistanceTo(c) <= r + tol for p in points) and r < best_r:
                best_c, best_r = c, r
                
        return best_c, best_r

    @staticmethod
    def snap_point_to_grid(pt, step):
        """
        Snap a point to the nearest grid location.
        """
        x = round(pt.X / step) * step
        y = round(pt.Y / step) * step
        z = round(pt.Z / step) * step
        return rg.Point3d(x, y, z)

    @staticmethod
    def snap_line_to_grid(line, step):
        """
        Snap both endpoints of a line to the grid.
        """
        return rg.Line(LineUtils.snap_point_to_grid(line.From, step),
                       LineUtils.snap_point_to_grid(line.To, step))

    @staticmethod
    def is_polyline_self_intersecting(pline, tol=1e-8):
        """
        Return True if `pline` self-intersects.
        """
        pts = list(pline)
        segs = [(pts[i], pts[i+1]) for i in range(len(pts)-1)]
        for i in range(len(segs)):
            for j in range(i+1, len(segs)):
                if j == i+1:
                    continue
                if LineUtils._segments_intersect(segs[i][0], segs[i][1], segs[j][0], segs[j][1], tol):
                    return True
        return False

    @staticmethod
    def safe_batch(func, args_list, timeout_sec=5, max_threads=4):
        """
        Run parrallel compute with per-call timeout.
        """
        def wrapped(arg):
            return LineUtils.run_with_timeout(lambda: func(arg), timeout_sec)
        return LineUtils.parallel(wrapped, args_list, max_threads)

    # — Finds individual “measure” tokens (mixed, fraction, int, or feet-only) —
    MEASURE_RE = re.compile(r"""
        (?:
            # 1) Feet + inches (mixed/fraction/int), e.g. -2'-1 1/4", 3'-3/8", 4'-6"
            -?\d+\s*'\s*(?:-\s*)?          # signed feet + apostrophe + optional dash
            (?:
                \d+\s+\d+/\d+             # mixed inches (1 1/4)
              |
                \d+/\d+                   # fraction only (3/8)
              |
                \d+                       # integer inches (6)
            )
            \s*"
          |
            # 2) Mixed inches without feet, e.g. -1 1/4"
            -?\d+\s+\d+/\d+\s*"
          |
            # 3) Fraction only, e.g. -3/8"
            -?\d+/\d+\s*"
          |
            # 4) Integer inches without feet, e.g. -12"
            -?\d+\s*"
          |
            # 5) Feet only, e.g. -6'
            -?\d+\s*'
        )
    """, re.VERBOSE)

    # — Breaks a single token into feet + one of (mixed, fraction, int) inches —
    PARTS_RE = re.compile(r"""
        ^\s*
        (?:(?P<feet>\d+)\s*'\s*(?:-\s*)?)?   # optional feet (e.g. 2')
        (?:
            (?P<inch_int>\d+)\s+(?P<num>\d+)\s*/\s*(?P<den>\d+)  # mixed inches (1 1/4)
          |
            (?P<num2>\d+)\s*/\s*(?P<den2>\d+)                    # fraction only (3/8)
          |
            (?P<inch_only>\d+)                                  # integer inches (6)
        )
        \s*"
        \s*$
    """, re.VERBOSE)

    @staticmethod
    def parse_measure(tok):
        """
        Parse a feet/inches token (possibly negative) into a float number of inches.
        
        Supported forms:
          "0"           ->   0.0
          "1'-0\""      ->  12.0
          "3/4\""       ->   0.75
          "1 1/4\""     ->   1.25
          "2'-1 1/8\""  ->  25.125
          "-4' 0\""     -> -48.0
          "-3/8\""      ->  -0.375
          "6'"          ->  72.0
          "-6'"         -> -72.0

        Returns a float, or an error string if parsing fails.
        """
        tok = tok.strip()
        
        # 1) Handle leading minus
        sign = 1.0
        if tok.startswith('-'):
            sign = -1.0
            tok = tok[1:].strip()

        # 2) Raw number (integer or decimal), e.g. "0", "5", "0.0"
        if tok.replace('.', '', 1).isdigit():
            return sign * float(tok)

        # 3) Feet-only, e.g. "6'" or "-4'"
        if tok.endswith("'"):
            num_feet = tok[:-1].strip()
            if not num_feet.isdigit():
                return "Can't parse measure %r" % (tok + "'")
            return sign * (int(num_feet) * 12.0)

        # 4) Mixed/fraction/int inches (with optional feet)
        m = LineUtils.PARTS_RE.match(tok)
        if not m:
            return "Can't parse measure %r" % tok

        feet = int(m.group('feet')) if m.group('feet') else 0
        inches = 0.0

        # 4a) Mixed inches: "inch_int num/den"
        if m.group('inch_int') and m.group('num') and m.group('den'):
            inch_int = int(m.group('inch_int'))
            num = int(m.group('num'))
            den = int(m.group('den'))
            inches = inch_int + (num / float(den))

        # 4b) Fraction-only: "num2/den2"
        elif m.group('num2') and m.group('den2'):
            num2 = int(m.group('num2'))
            den2 = int(m.group('den2'))
            inches = num2 / float(den2)

        # 4c) Integer-only inches
        elif m.group('inch_only'):
            inches = int(m.group('inch_only'))

        total_inches = feet * 12.0 + inches
        return sign * total_inches

    @staticmethod
    def parse_scale(s):
        """
        Parse a scale string like “1\" = 1'-0\"" (or variations) and return:
          - If two measures found -> (real_inches / draw_inches) as float.
          - If one measure found -> its inch value (float).
          - Otherwise -> an error string.
        """
        # Normalize curly quotes and common words
        s = s.replace('“', '"').replace('”', '"').lower()
        s = re.sub(r'\\([\'"])', r'\1', s) #support for 1/8"=1\'-0" style
        s = re.sub(r'\bft\b', "'", s)
        s = re.sub(r'\bin\b', '"', s)
        s = re.sub(r'\s*=\s*', ' = ', s) #support for 1/8"=1\'-0" style

        # Extract all “measure” tokens
        toks = LineUtils.MEASURE_RE.findall(s)
        if not toks:
            return "No measures found in %r" % s

        # If only one token, return its inch value
        if len(toks) == 1:
            return LineUtils.parse_measure(toks[0])

        # Otherwise, take the first two as draw & real
        draw_tok, real_tok = toks[0], toks[1]

        din = LineUtils.parse_measure(draw_tok)
        if isinstance(din, str):
            return din  # error message

        rin = LineUtils.parse_measure(real_tok)
        if isinstance(rin, str):
            return rin  # error message

        if din == 0:
            return "Drawing measure is zero in %r" % s

        return rin / din

    @staticmethod
    def read_xlsx(file_path, sheetname, filter_word=None):
        """
        Reads all data from the specified sheet in an .xlsx file, returning a list of rows,
        where each row is a list of cell‐values (strings or None). Blank cells become None.
        Any row that is entirely empty—or contains the exact filter_word in any cell—is dropped.
        Any column that is entirely empty (after row‐pruning) is also dropped, so the returned
        grid is rectangular. Errors are printed (e.g. file not found, sheet not found), and
        an empty list is returned on failure.
    
        Args:
            file_path (str): Path to the .xlsx file.
            sheetname (str): Name of the sheet to read.
            filter_word (str or None): If provided, any row containing a cell == filter_word
                                       will be skipped entirely. Default is None (no extra filtering).
    
        Returns:
            List[List[str or None]]: 2D list of cell values, with no entirely‐blank rows or columns,
                                     and with rows containing filter_word removed. Returns [] on errors.
        """
        data = []
        try:
            z = zipfile.ZipFile(file_path, 'r')
        except Exception as e:
            print("Error: cannot open '%s' as a ZIP archive: %s" % (file_path, e))
            return data
    
        # XML namespace constants
        NS_SHEET = '{http://schemas.openxmlformats.org/spreadsheetml/2006/main}'
        NS_REL   = {'ns': 'http://schemas.openxmlformats.org/package/2006/relationships'}
    
        # 1) Find the path to the requested sheet inside the XLSX
        sheet_path = None
        try:
            with z.open('xl/workbook.xml') as wb_file:
                wb_tree = ET.parse(wb_file)
                sheets = wb_tree.findall('.//%ssheet' % NS_SHEET)
                for sheet in sheets:
                    if sheet.get('name') == sheetname:
                        sheet_id = sheet.get(
                            '{http://schemas.openxmlformats.org/officeDocument/2006/relationships}id'
                        )
                        if not sheet_id:
                            print("Error: sheet '%s' has no relationship ID." % sheetname)
                            return data
    
                        try:
                            with z.open('xl/_rels/workbook.xml.rels') as rels_file:
                                rels_tree = ET.parse(rels_file)
                                relationships = rels_tree.findall('.//ns:Relationship', NS_REL)
                                for rel in relationships:
                                    if rel.get('Id') == sheet_id:
                                        target = rel.get('Target')
                                        if not target:
                                            continue
                                        sheet_path = 'xl/' + target.replace('\\', '/')
                                        break
                        except Exception as e_rels:
                            print("Error: cannot read relationships for workbook: %s" % e_rels)
                            return data
    
                        break
    
            if not sheet_path:
                print("Error: sheet named '%s' not found in workbook." % sheetname)
                return data
    
        except Exception as e_wb:
            print("Error: failed to parse 'xl/workbook.xml': %s" % e_wb)
            return data
    
        # 2) Read shared strings (if present)
        shared_strings = []
        try:
            with z.open('xl/sharedStrings.xml') as ss_file:
                ss_tree = ET.parse(ss_file)
                for t in ss_tree.findall('.//%st' % NS_SHEET):
                    shared_strings.append(t.text or '')
        except KeyError:
            # If sharedStrings.xml doesn’t exist, proceed with empty list
            shared_strings = []
        except Exception as e_ss:
            print("Warning: failed to read sharedStrings.xml: %s" % e_ss)
            shared_strings = []
    
        # 3) Parse the sheet XML and collect raw rows
        try:
            with z.open(sheet_path) as sheet_file:
                sheet_tree = ET.parse(sheet_file)
                for row in sheet_tree.findall('.//%srow' % NS_SHEET):
                    row_data = []
                    for c in row.findall('%sc' % NS_SHEET):
                        v = c.find('%sv' % NS_SHEET)
                        if v is None or v.text is None:
                            # no <v> or empty <v> -> treat as None
                            row_data.append(None)
                        else:
                            val = v.text
                            if c.get('t') == 's':
                                try:
                                    idx = int(val)
                                    if 0 <= idx < len(shared_strings):
                                        val = shared_strings[idx]
                                    else:
                                        print("Warning: sharedStrings index %d out of range" % idx)
                                        val = None
                                except Exception:
                                    print("Warning: invalid sharedStrings index '%s'" % val)
                                    val = None
                            row_data.append(val)
                    data.append(row_data)
    
        except KeyError:
            print("Error: cannot open sheet file '%s' in archive." % sheet_path)
            return []
        except Exception as e_sheet:
            print("Error: failed to parse sheet XML '%s': %s" % (sheet_path, e_sheet))
            return []
    
        # If we got no rows at all, return empty
        if not data:
            return []
    
        def is_row_empty(row):
                # empty if every cell is None or whitespace-only
                for cell in row:
                    if cell is None:
                        continue
                    try:
                        s = unicode(cell)
                    except:
                        s = cell
                    if s is None:
                        continue
                    if s.strip() != '':
                        return False
                return True

        pruned_rows = []
        for row in data:
            # 4a) Skip if entire row is empty
            if is_row_empty(row):
                continue
    
            # 4b) Skip if filter_word is provided and matches any cell exactly
            if filter_word is not None:
                skip_due_to_filter = False
                for cell in row:
                    # Compare only non-None cells
                    if cell == filter_word:
                        skip_due_to_filter = True
                        break
                if skip_due_to_filter:
                    continue
    
            # Otherwise, keep the row
            pruned_rows.append(row)
    
        if not pruned_rows:
            # All rows were empty or filtered out -> nothing to return
            return []
    
        # === 5) Pad all rows to the same length with None (so columns line up) ===
        max_cols = max(len(r) for r in pruned_rows)
        for r in pruned_rows:
            if len(r) < max_cols:
                r.extend([None] * (max_cols - len(r)))
    
        return pruned_rows
    
    
    @staticmethod
    def color_from_hsv(h, s, v, alpha = 255.0):
        """
        Construct an HSV (Hue, Saturation, Value) color
        """
        if s == 0.0:
            r = g = b = int(v * 255)
            return System.Drawing.Color.FromArgb(r, g, b)
        
        h = h / 60.0  # Sector 0 to 5
        i = int(System.Math.Floor(h))
        f = h - i
        p = v * (1 - s)
        q = v * (1 - s * f)
        t = v * (1 - s * (1 - f))
        
        if i == 0:
            r, g, b = v, t, p
        elif i == 1:
            r, g, b = q, v, p
        elif i == 2:
            r, g, b = p, v, t
        elif i == 3:
            r, g, b = p, q, v
        elif i == 4:
            r, g, b = t, p, v
        else:
            r, g, b = v, p, q
        
        r = int(round(r * 255))
        g = int(round(g * 255))
        b = int(round(b * 255))
        
        return System.Drawing.Color.FromArgb(alpha, r, g, b)
    
    @staticmethod
    def colors_generator(num_colors, alpha = 255.0):
        """
        Generate n colors equally spaced apart in the hsv scale
        special cases: 1 color -> black, 2 colors -> black/white
        """
        
        n = num_colors
        colors = []
        if n <= 0:
            return colors
        elif n == 1:
            # Return black for n=1
            colors.append(System.Drawing.Color.FromArgb(alpha, 0, 0, 0))
            return colors
        elif n == 2:
            # Return black and white for n=2
            colors.append(System.Drawing.Color.FromArgb(alpha, 0, 0, 0))      # Black
            colors.append(System.Drawing.Color.FromArgb(alpha, 255, 255, 255))# White
            return colors
        
        for i in range(n):
            hue = (i * 360.0 / n) % 360  # Evenly spaced hues
            saturation = 0.9              # High saturation for vibrancy
            value = 0.9                   # High value for brightness
            colors.append(LineUtils.color_from_hsv(hue, saturation, value, alpha))
        
        return colors


    @staticmethod
    def to_xy2(p):
        """
        Convert Rhino point to xy tuple
        Keep z ignored as algorithm is 2D
        Returns float(x), float(y)
        """
        return (float(p.X), float(p.Y))

    @staticmethod
    def bbox_xy(points, pad):
        """
        Compute xy bbox with optional pad
        Pad default is 5% of max span plus epsilon
        Returns (x0, y0, x1, y1)
        """
        xs = [p.X for p in points]
        ys = [p.Y for p in points]
        x0 = min(xs)
        x1 = max(xs)
        y0 = min(ys)
        y1 = max(ys)
        dx = x1 - x0
        dy = y1 - y0
        if pad is None:
            pad_xy = 0.05 * max(dx, dy) + 1e-9
        else:
            pad_xy = pad
        return (x0 - pad_xy, y0 - pad_xy, x1 + pad_xy, y1 + pad_xy)

    @staticmethod
    def same_point(a, b, tol):
        """
        Compare xy tuples with tol
        Returns True or False
        """
        if abs(a[0] - b[0]) <= tol and abs(a[1] - b[1]) <= tol:
            return True
        else:
            return False

    @staticmethod
    def distance_l1(p, q):
        """
        Manhattan distance helper
        Works on 2D tuples
        Returns float
        """
        return abs(p[0] - q[0]) + abs(p[1] - q[1])

    @staticmethod
    def angle(p1, p2):
        """
        Polar angle 0..2Pi
        Based on atan2 with wrap
        Returns float radians
        """
        ang = math.atan2(p2[1] - p1[1], p2[0] - p1[0])
        if ang < 0.0:
            ang = 2.0 * math.pi + ang
        else:
            ang = ang
        return ang

    @staticmethod
    def seg_intersection(l1a, l1b, l2a, l2b, tol):
        """
        Segment intersection in xy
        Returns (x,y) or None
        Handles parallel by denom==0
        """
        x1 = l1a[0]
        y1 = l1a[1]
        x2 = l1b[0]
        y2 = l1b[1]
        x3 = l2a[0]
        y3 = l2a[1]
        x4 = l2b[0]
        y4 = l2b[1]
        denom = (y4 - y3) * (x2 - x1) - (x4 - x3) * (y2 - y1)

        if abs(denom) <= 0.0:
            return None
        ua = ((x4 - x3) * (y1 - y3) - (y4 - y3) * (x1 - x3)) / float(denom)
        ub = ((x2 - x1) * (y1 - y3) - (y2 - y1) * (x1 - x3)) / float(denom)
        if ua < -tol or ua > 1.0 + tol or ub < -tol or ub > 1.0 + tol:
            return None
        xi = x1 + ua * (x2 - x1)
        yi = y1 + ua * (y2 - y1)
        return (xi, yi)

    @staticmethod
    def clean_data(raw):
        """
        Break L1 degeneracy ties
        Tiny jitter when |dx|==|dy|
        In place modification
        """
        n = len(raw)
        i = 0
        while i < n:
            xi = raw[i][0]
            yi = raw[i][1]
            j = i + 1
            while j < n:
                dx = raw[j][0] - xi
                dy = raw[j][1] - yi
                if abs(abs(dx) - abs(dy)) <= 0.0:
                    raw[j] = (raw[j][0] + 1e-10 * yi, raw[j][1] + 2e-10 * raw[j][0])
                else:
                    raw[j] = raw[j]
                j += 1
            i += 1
        return raw

    @staticmethod
    def bisector_intersection(B1, B2, tol):
        """
        Intersect two poly-bisectors
        Scans consecutive segments
        Returns first hit or None
        """
        if B1 is B2:
            return None
        i = 0
        while i < len(B1['points']) - 1:
            a1 = B1['points'][i]
            a2 = B1['points'][i + 1]
            j = 0
            ok = False
            while j < len(B2['points']) - 1:
                b1 = B2['points'][j]
                b2 = B2['points'][j + 1]
                pt = LineUtils.seg_intersection(a1, a2, b1, b2, tol)
                if pt is not None:
                    ok = True
                    break
                else:
                    j += 1
            if ok:
                return pt
            else:
                i += 1
        return None

    @staticmethod
    def is_bisector_trapped(trap_site, bisector):
        """
        Trap test against site
        All points no closer to others
        Returns True or False
        """
        k = 0
        while k < len(bisector['points']):
            pt = bisector['points'][k]
            if LineUtils.distance_l1(trap_site['site'], pt) <= LineUtils.distance_l1(bisector['sites'][0]['site'], pt) and LineUtils.distance_l1(trap_site['site'], pt) <= LineUtils.distance_l1(bisector['sites'][1]['site'], pt):
                k += 1
            else:
                return False
        return True

    @staticmethod
    def trim_bisector(target, intersector, intersection):
        """
        Trim target by intersector
        Keep points nearer to target sites
        Append intersection if present
        """

        polygon_site = None
        for s in intersector['sites']:
            found = False
            for t in target['sites']:
                if s is t:
                    found = True
                    break
                else:
                    found = found
            if not found:
                polygon_site = s
                break
            else:
                polygon_site = polygon_site
        new_pts = []
        k = 0

        while k < len(target['points']):
            p = target['points'][k]
            if LineUtils.distance_l1(p, target['sites'][0]['site']) < LineUtils.distance_l1(p, polygon_site['site']) and LineUtils.distance_l1(p, target['sites'][1]['site']) < LineUtils.distance_l1(p, polygon_site['site']):
                new_pts.append(p)
            else:
                new_pts = new_pts
            k += 1

        if intersection is not None:
            new_pts.append(intersection)
        else:
            new_pts = new_pts

        if target['up']:
            new_pts.sort(key=lambda t: t[1])
        else:
            new_pts.sort(key=lambda t: t[0])

        target['points'] = new_pts

    @staticmethod
    def find_hop_to(bisector, hop_from):
        """
        Hop across bisector ends
        Return opposite site dict
        Simple pointer logic
        """
        if bisector['sites'][0] is hop_from:
            return bisector['sites'][1]
        else:
            return bisector['sites'][0]

    @staticmethod
    def get_extreme_point(bisector, go_up):
        """
        Extreme Y value along bisector
        Max for up, min for down
        Returns float
        """

        val = -1.0e300
        if not go_up:
            val = 1.0e300
        i = 0

        while i < len(bisector['points']):
            y = bisector['points'][i][1]
            if go_up:
                if y > val:
                    val = y
                else:
                    val = val
            else:
                if y < val:
                    val = y
                else:
                    val = val
            i += 1
        return val

    @staticmethod
    def is_new_bisector_upward(hop_to, hop_from, site, go_up):
        """
        Decide stroke direction
        Based on relative geometry
        Returns True or False
        """

        dx = hop_to['site'][0] - site['site'][0]
        dy = hop_to['site'][1] - site['site'][1]
        if abs(dx) <= 0.0:
            return site['site'][1] > hop_to['site'][1]
        else:
            slope = dy / float(dx)
            intercept = hop_to['site'][1] - slope * hop_to['site'][0]
            above = hop_from['site'][1] > slope * hop_from['site'][0] + intercept
            return above

    @staticmethod
    def determine_first_border_cross(cropR, cropL, current_crop_point, tol):
        """
        Which side crosses first
        Compare vertical distances
        Returns "right" "left" or None
        """

        dyR = abs(cropR['point'][1] - current_crop_point[1])
        dyL = abs(cropL['point'][1] - current_crop_point[1])
        if abs(dyR - dyL) <= tol:
            return None
        else:
            if dyR < dyL:
                return "right"
            else:
                return "left"

    @staticmethod
    def clear_out_orphans(orphanage, trap_point):
        """
        Remove trapped bisectors
        Uses is_bisector_trapped
        Returns filtered list
        """

        out = []
        i = 0
        while i < len(orphanage['bisectors']):
            b = orphanage['bisectors'][i]
            if not LineUtils.is_bisector_trapped(trap_point, b):
                out.append(b)
            else:
                out = out
            i += 1
        return out

    @staticmethod
    def find_correct_w(w, nearest_neighbor, find_bisector):
        """
        Walk to a valid neighbor
        Avoid starting on trapped
        Returns site dict
        """

        starting = find_bisector(w, nearest_neighbor)
        traps = []
        i = 0
        while i < len(w['bisectors']):
            b = w['bisectors'][i]
            hop_to = LineUtils.find_hop_to(b, w)
            traps.append({'hopTo': hop_to, 'isTrapped': LineUtils.is_bisector_trapped(hop_to, starting)})
            i += 1
        filt = [t for t in traps if t['isTrapped']]
        if len(filt) > 0:
            filt.sort(key=lambda t: LineUtils.distance_l1(t['hopTo']['site'], nearest_neighbor['site']))
            return LineUtils.find_correct_w(filt[0]['hopTo'], nearest_neighbor, find_bisector)
        else:
            return w

    @staticmethod
    def check_for_orphans(trapper, trapped, go_up, find_bisector):
        """
        Choose trapped candidate
        Heuristic for dead ends
        Returns bisector or None
        """

        cands = []
        i = 0
        while i < len(trapped['bisectors']):
            b = trapped['bisectors'][i]
            hop_to = LineUtils.find_hop_to(b, trapped)
            cond = go_up == (hop_to['site'][1] < trapped['site'][1]) and LineUtils.is_bisector_trapped(trapper, b)
            if cond:
                cands.append(b)
            else:
                cands = cands
            i += 1
        def extreme(bis):
            hop = LineUtils.find_hop_to(bis, trapped)
            ml = find_bisector(hop, trapper)
            return LineUtils.get_extreme_point(ml, go_up)
        if len(cands) == 0:
            return None
        else:
            if go_up:
                cands.sort(key=lambda b: -extreme(b))
            else:
                cands.sort(key=lambda b: extreme(b))
            return cands[0]

    @staticmethod
    def determine_starting_bisector(w, nearest_neighbor, width, last_intersect, find_bisector, tol):
        """
        Pick starting bisector
        Uses rightward probe test
        Returns dict with fields
        """
        if last_intersect is None:
            last_intersect = w['site']
        else:
            last_intersect = last_intersect
        z = [width, w['site'][1]]
        zline = {'points': [w['site'], z]}
        hit = None
        i = 0

        while i < len(nearest_neighbor['bisectors']):
            b = nearest_neighbor['bisectors'][i]
            pt = LineUtils.bisector_intersection(zline, b, tol)
            if pt is not None:
                hit = {'point': pt, 'bisector': b}
                break
            else:
                i += 1
        if hit is not None:
            if LineUtils.distance_l1(w['site'], hit['point']) > LineUtils.distance_l1(nearest_neighbor['site'], hit['point']):
                sb = find_bisector(w, nearest_neighbor)
                return {'startingBisector': sb, 'w': w, 'nearestNeighbor': nearest_neighbor, 'startingIntersection': hit['point']}
            else:
                if LineUtils.distance_l1(w['site'], hit['point']) < LineUtils.distance_l1(nearest_neighbor['site'], hit['point']) and hit['point'][0] > last_intersect[0]:
                    nextR = None
                    if hit['bisector']['sites'][0] is nearest_neighbor:
                        nextR = hit['bisector']['sites'][1]
                    else:
                        nextR = hit['bisector']['sites'][0]
                    return LineUtils.determine_starting_bisector(w, nextR, width, hit['point'], find_bisector, tol)
                else:
                    w2 = LineUtils.find_correct_w(w, nearest_neighbor, find_bisector)
                    sb2 = find_bisector(w2, nearest_neighbor)
                    return {'startingBisector': sb2, 'w': w2, 'nearestNeighbor': nearest_neighbor, 'startingIntersection': hit['point']}
        else:
            w3 = LineUtils.find_correct_w(w, nearest_neighbor, find_bisector)
            sb3 = find_bisector(w3, nearest_neighbor)
            return {'startingBisector': sb3, 'w': w3, 'nearestNeighbor': nearest_neighbor, 'startingIntersection': w3['site']}

    @staticmethod
    def walk_merge_line(currentR, currentL, currentBisector, currentCropPoint, goUp, crossedBorder, mergeArray, find_bisector, width, height, tol):
        """
        Merge walk procedure
        Trims and hops across graph
        Appends visited bisectors
        """

        owns = True
        k = 0

        while k < len(currentBisector['sites']):
            if currentBisector['sites'][k] is currentR or currentBisector['sites'][k] is currentL:
                k += 1
            else:
                owns = False
                break
        if not owns:
            currentBisector = find_bisector(currentR, currentL)
            LineUtils.trim_bisector(currentBisector, crossedBorder, currentCropPoint)
            mergeArray.append(currentBisector)

        cropLArray = []
        i = 0

        while i < len(currentL['bisectors']):
            b = currentL['bisectors'][i]
            pt = LineUtils.bisector_intersection(currentBisector, b, tol)
            if pt is not None:
                hopTo = LineUtils.find_hop_to(b, currentL)
                cond_dir = goUp == LineUtils.is_new_bisector_upward(hopTo, currentL, currentR, goUp)
                cond_dup = not (LineUtils.same_point(pt, currentCropPoint, tol) and b is crossedBorder)
                if cond_dir and cond_dup:
                    cropLArray.append({'bisector': b, 'point': pt})
                else:
                    cropLArray = cropLArray
            else:
                cropLArray = cropLArray
            i += 1

        cropLArray.sort(key=lambda e: LineUtils.angle(currentL['site'], LineUtils.find_hop_to(e['bisector'], currentL)['site']), reverse=True)
        tmp = []
        i = 0

        while i < len(cropLArray):
            e = cropLArray[i]
            hopTo = LineUtils.find_hop_to(e['bisector'], currentL)
            newML = find_bisector(currentR, hopTo)
            LineUtils.trim_bisector(newML, e['bisector'], e['point'])
            ok = True
            j = 0
            while j < len(cropLArray):
                if j != i:
                    otherHop = LineUtils.find_hop_to(cropLArray[j]['bisector'], currentL)
                    if LineUtils.is_bisector_trapped(otherHop, newML) and otherHop is not hopTo:
                        ok = False
                        break
                    else:
                        ok = ok
                else:
                    ok = ok
                j += 1
            if ok:
                tmp.append(e)
            else:
                tmp = tmp
            i += 1

        cropLArray = tmp
        cropRArray = []
        i = 0

        while i < len(currentR['bisectors']):
            b = currentR['bisectors'][i]
            pt = LineUtils.bisector_intersection(currentBisector, b, tol)
            if pt is not None:
                hopTo = LineUtils.find_hop_to(b, currentR)
                cond_dir = goUp == LineUtils.is_new_bisector_upward(hopTo, currentR, currentL, goUp)
                cond_dup = not (LineUtils.same_point(pt, currentCropPoint, tol) and b is crossedBorder)
                if cond_dir and cond_dup:
                    cropRArray.append({'bisector': b, 'point': pt})
                else:
                    cropRArray = cropRArray
            else:
                cropRArray = cropRArray
            i += 1

        cropRArray.sort(key=lambda e: LineUtils.angle(currentR['site'], LineUtils.find_hop_to(e['bisector'], currentR)['site']))
        tmp2 = []
        i = 0

        while i < len(cropRArray):
            e = cropRArray[i]
            hopTo = LineUtils.find_hop_to(e['bisector'], currentR)
            newML = find_bisector(currentL, hopTo)
            LineUtils.trim_bisector(newML, e['bisector'], e['point'])
            ok = True
            j = 0
            while j < len(cropRArray):
                if j != i:
                    otherHop = LineUtils.find_hop_to(cropRArray[j]['bisector'], currentR)
                    if LineUtils.is_bisector_trapped(otherHop, newML) and otherHop is not hopTo:
                        ok = False
                        break
                    else:
                        ok = ok
                else:
                    ok = ok
                j += 1
            if ok:
                tmp2.append(e)
            else:
                tmp2 = tmp2
            i += 1

        cropRArray = tmp2
        cropL = None
        if len(cropLArray) > 0 and cropLArray[0]['bisector'] is not currentBisector:
            cropL = cropLArray[0]
        else:
            if goUp:
                cropL = {'bisector': None, 'point': (float('inf'), float('inf'))}
            else:
                cropL = {'bisector': None, 'point': (-float('inf'), -float('inf'))}
        cropR = None
        if len(cropRArray) > 0 and cropRArray[0]['bisector'] is not currentBisector:
            cropR = cropRArray[0]
        else:
            if goUp:
                cropR = {'bisector': None, 'point': (float('inf'), float('inf'))}
            else:
                cropR = {'bisector': None, 'point': (-float('inf'), -float('inf'))}
        if cropL['bisector'] is None and cropR['bisector'] is None:
            left_orphan = LineUtils.check_for_orphans(currentR, currentL, goUp, find_bisector)
            right_orphan = LineUtils.check_for_orphans(currentL, currentR, goUp, find_bisector)
            if left_orphan is not None:
                for s in left_orphan['sites']:
                    s['bisectors'] = [b for b in s['bisectors'] if b is not left_orphan]
                hopTo = LineUtils.find_hop_to(left_orphan, currentL)
                currentR = LineUtils.find_correct_w(currentR, hopTo, find_bisector)
                newB = find_bisector(hopTo, currentR)
                mergeArray.append(newB)
                return LineUtils.walk_merge_line(currentR, hopTo, newB, currentCropPoint, goUp, crossedBorder, mergeArray, find_bisector, width, height, tol)
            else:
                if right_orphan is not None:
                    for s in right_orphan['sites']:
                        s['bisectors'] = [b for b in s['bisectors'] if b is not right_orphan]
                    hopTo2 = LineUtils.find_hop_to(right_orphan, currentR)
                    currentL = LineUtils.find_correct_w(currentL, hopTo2, find_bisector)
                    newB2 = find_bisector(hopTo2, currentL)
                    mergeArray.append(newB2)
                    return LineUtils.walk_merge_line(hopTo2, currentL, newB2, currentCropPoint, goUp, crossedBorder, mergeArray, find_bisector, width, height, tol)
                else:
                    return mergeArray

        first = LineUtils.determine_first_border_cross(cropR, cropL, currentCropPoint, tol)
        if first == "right":
            LineUtils.trim_bisector(cropR['bisector'], currentBisector, cropR['point'])
            LineUtils.trim_bisector(currentBisector, cropR['bisector'], cropR['point'])
            currentBisector['intersections'].append(cropR['point'])
            crossedBorder = cropR['bisector']
            currentR = LineUtils.find_hop_to(cropR['bisector'], currentR)
            currentCropPoint = cropR['point']
        else:
            if first == "left":
                LineUtils.trim_bisector(cropL['bisector'], currentBisector, cropL['point'])
                LineUtils.trim_bisector(currentBisector, cropL['bisector'], cropL['point'])
                currentBisector['intersections'].append(cropL['point'])
                crossedBorder = cropL['bisector']
                currentL = LineUtils.find_hop_to(cropL['bisector'], currentL)
                currentCropPoint = cropL['point']
            else:
                LineUtils.trim_bisector(cropR['bisector'], currentBisector, cropR['point'])
                LineUtils.trim_bisector(currentBisector, cropR['bisector'], cropR['point'])
                currentBisector['intersections'].append(cropR['point'])
                crossedBorder = cropR['bisector']
                currentR = LineUtils.find_hop_to(cropR['bisector'], currentR)
                currentCropPoint = cropR['point']
                LineUtils.trim_bisector(cropL['bisector'], currentBisector, cropL['point'])
                LineUtils.trim_bisector(currentBisector, cropL['bisector'], cropL['point'])
                currentBisector['intersections'].append(cropL['point'])
                crossedBorder = cropL['bisector']
                currentL = LineUtils.find_hop_to(cropL['bisector'], currentL)
                currentCropPoint = cropL['point']

        return LineUtils.walk_merge_line(currentR, currentL, currentBisector, currentCropPoint, goUp, crossedBorder, mergeArray, find_bisector, width, height, tol)

    @staticmethod
    def find_L1_bisector(P1, P2, width, height):
        """
        Build L1 bisector polyline
        Axis or ±1 slope segments
        Returns dict descriptor
        """
        x1 = P1['site'][0]
        y1 = P1['site'][1]
        x2 = P2['site'][0]
        y2 = P2['site'][1]
        dx = x1 - x2
        dy = y1 - y2
        mid = [(x1 + x2) / 2.0, (y1 + y2) / 2.0]

        if abs(dx) <= 0.0 and abs(dy) <= 0.0:
            raise Exception("Duplicate site")
        if abs(dx) <= 0.0:
            pts = [[0.0, mid[1]], [width, mid[1]]]
            return {'sites': [P1, P2], 'up': False, 'points': pts, 'intersections': [], 'compound': False}
        if abs(dy) <= 0.0:
            pts = [[mid[0], 0.0], [mid[0], height]]
            return {'sites': [P1, P2], 'up': True, 'points': pts, 'intersections': [], 'compound': False}

        slope = -1.0
        if (dy / float(dx)) <= 0.0:
            slope = 1.0
        intercept = mid[1] - slope * mid[0]

        if abs(dx) >= abs(dy):
            v1 = [(y1 - intercept) / slope, y1]
            v2 = [(y2 - intercept) / slope, y2]
            up = True
            verts = [v1, v2]
            verts.sort(key=lambda p: p[1])
            pts = [[verts[0][0], 0.0], verts[0], verts[1], [verts[1][0], height]]
            pts.sort(key=lambda p: p[1])
            return {'sites': [P1, P2], 'up': up, 'points': pts, 'intersections': [], 'compound': False}
        else:
            v1 = [x1, x1 * slope + intercept]
            v2 = [x2, x2 * slope + intercept]
            up = False
            verts = [v1, v2]
            verts.sort(key=lambda p: p[0])
            pts = [[0.0, verts[0][1]], verts[0], verts[1], [width, verts[1][1]]]
            pts.sort(key=lambda p: p[0])
            return {'sites': [P1, P2], 'up': up, 'points': pts, 'intersections': [], 'compound': False}

    @staticmethod
    def curry_find_bisector(callback, width, height):
        """
        Partial for bisector maker
        Fix width and height args
        Returns callable(a,b)
        """
        def f(a, b):
            return callback(a, b, width, height)
        return f

    @staticmethod
    def recursive_split(split_array, find_bisector, width, height, tol):
        """
        Divide and conquer build
        Split, solve, then merge
        Returns flattened sites
        """
        n = len(split_array)
        if n > 2:
            mid = int((n - (n % 2)) / 2)
            L = LineUtils.recursive_split(split_array[0:mid], find_bisector, width, height, tol)
            R = LineUtils.recursive_split(split_array[mid:], find_bisector, width, height, tol)
            neis = sorted(R, key=lambda s: LineUtils.distance_l1(L[-1]['site'], s['site']))
            start = LineUtils.determine_starting_bisector(L[-1], neis[0], width, None, find_bisector, tol)
            initialB = start['startingBisector']
            initialR = start['nearestNeighbor']
            initialL = start['w']
            upStroke = LineUtils.walk_merge_line(initialR, initialL, initialB, [width, height], True, None, [], find_bisector, width, height, tol)
            downStroke = LineUtils.walk_merge_line(initialR, initialL, initialB, [0.0, 0.0], False, None, [], find_bisector, width, height, tol)
            mergeArray = [initialB] + upStroke + downStroke
            for bis in mergeArray:
                bis['mergeLine'] = n
                bis['sites'][0]['bisectors'] = LineUtils.clear_out_orphans(bis['sites'][0], bis['sites'][1])
                bis['sites'][1]['bisectors'] = LineUtils.clear_out_orphans(bis['sites'][1], bis['sites'][0])
                for s in bis['sites']:
                    s['bisectors'].append(bis)
            return L + R
        else:
            if n == 2:
                bis = find_bisector(split_array[0], split_array[1])
                split_array[0]['bisectors'].append(bis)
                split_array[1]['bisectors'].append(bis)
                return split_array
            else:
                return split_array

    @staticmethod
    def generate_L1_voronoi(site_points, width, height, nudge = True, tol = GLOBAL_TOL):
        #print "gl1", tol
        """
        Prepare site graph list
        Optional nudge cleans ties
        Returns site dicts array
        """
        data = site_points[:]
        if nudge:
            data = LineUtils.clean_data(data)
        else:
            data = data
        sites = sorted(data, key=lambda a: (a[0], a[1]))
        sites = [{'site': [float(s[0]), float(s[1])], 'bisectors': []} for s in sites]
        find_b = LineUtils.curry_find_bisector(LineUtils.find_L1_bisector, width, height)
        graph = LineUtils.recursive_split(sites, find_b, width, height, tol)

        return graph

    @staticmethod
    def build_edges_from_bisectors(sites, x0, y0, width, height, tol):
        #print tol
        """
        Extract unique edges
        Quantized by tol to dedupe
        Returns (segs, pairs)
        """

        qu = {}
        segs = []
        pairs = 0
        for s in sites:
            pairs += len(s['bisectors'])
            i = 0
            while i < len(s['bisectors']):
                b = s['bisectors'][i]
                j = 0
                while j < len(b['points']) - 1:
                    a = b['points'][j]
                    c = b['points'][j + 1]
                    p = (a[0] + x0, a[1] + y0)
                    q = (c[0] + x0, c[1] + y0)
                    if abs(p[0] - q[0]) <= tol and abs(p[1] - q[1]) <= tol:
                        j += 1
                    else:
                        k1 = int(round(min(p[0], q[0]) / tol))
                        k2 = int(round(min(p[1], q[1]) / tol))
                        k3 = int(round(max(p[0], q[0]) / tol))
                        k4 = int(round(max(p[1], q[1]) / tol))
                        key = (k1, k2, k3, k4)
                        if key in qu:
                            j += 1
                        else:
                            qu[key] = True
                            pa = rg.Point3d(p[0], p[1], 0.0)
                            pb = rg.Point3d(q[0], q[1], 0.0)
                            #segs.append(rg.LineCurve(pa, pb))
                            segs.append(rg.Line(pa, pb))
                            j += 1
                i += 1
        return segs, pairs

    @staticmethod
    def ManhattanVoronoi(Points, Pad, nudge=True, tol=GLOBAL_TOL):
        #print tol
        """
        Compute L1 Voronoi (Manhattan) diagram in XY.
        Returns edges (as Lines), pair count, segment count
        Higher tolerance than usual 0.01 is reccomended, 0.0001 is a good safe start
        """
        if Points is None or len(Points) == 0:
            return [], 0, 0
        pts_xy = [rg.Point3d(p.X, p.Y, 0.0) for p in Points]
        x0, y0, x1, y1 = LineUtils.bbox_xy(pts_xy, Pad)
        width = x1 - x0
        height = y1 - y0
        raw = [(p.X - x0, p.Y - y0) for p in pts_xy]
        sites = LineUtils.generate_L1_voronoi(raw, width, height, nudge, tol)
        edges, pairs = LineUtils.build_edges_from_bisectors(sites, x0, y0, width, height, tol)

        rect = [
            rg.Line(rg.Point3d(x0, y0, 0.0), rg.Point3d(x1, y0, 0.0)),
            rg.Line(rg.Point3d(x1, y0, 0.0), rg.Point3d(x1, y1, 0.0)),
            rg.Line(rg.Point3d(x1, y1, 0.0), rg.Point3d(x0, y1, 0.0)),
            rg.Line(rg.Point3d(x0, y1, 0.0), rg.Point3d(x0, y0, 0.0))
        ]
        
        edges.extend(rect)
        return edges, pairs, len(edges)

    @staticmethod
    def telegram_send_message(token, chat_id, text):
        """
        POST /sendMessage. Returns Telegram JSON or 'failed...' text.
        """
        try:
            url = "https://api.telegram.org/bot%s/sendMessage" % token
            data = System.Collections.Specialized.NameValueCollection()
            data.Add("chat_id", str(chat_id))
            data.Add("text", text)
            client = System.Net.WebClient()
            result_bytes = client.UploadValues(url, data)
            return System.Text.Encoding.UTF8.GetString(result_bytes)
        except Exception as ex:
            return "failed to send: " + str(ex)
    
    
    @staticmethod
    def telegram_send_file_from_path(token, chat_id, file_path, mime_type=None, filename=None, caption=None):
        """
        Reads file bytes and POSTs /sendDocument.
        """
        try:
            if not System.IO.File.Exists(file_path):
                return "failed to send document: file not found"
            b = System.IO.File.ReadAllBytes(file_path)
            name = filename if filename else System.IO.Path.GetFileName(file_path)
            return LineUtils.telegram_send_file(token, chat_id, name, b, mime_type, caption)
        except Exception as ex:
            return "failed to send document: " + str(ex)
    
    
    @staticmethod
    def telegram_send_file(token, chat_id, filename, content, mime_type=None, caption=None):
        """
        POST /sendDocument with in-memory content. 'content' may be str/unicode or byte[]/bytearray.
        """
        try:
            url = "https://api.telegram.org/bot%s/sendDocument" % token
            boundary = "----------%s" % System.Guid.NewGuid().ToString("N")
            crlf = "\r\n"
            enc = System.Text.Encoding.UTF8
    
            # normalize content -> .NET byte[]
            net_bytes = None
            try:
                # .NET byte[] detection
                tp = content.GetType()
                if tp.IsArray and tp.GetElementType() == System.Byte:
                    net_bytes = content
            except:
                net_bytes = None
            if net_bytes is None:
                if isinstance(content, bytearray):
                    net_bytes = System.Array.CreateInstance(System.Byte, len(content))
                    i = 0
                    for v in content:
                        net_bytes[i] = int(v)
                        i = i + 1
                elif isinstance(content, str) or isinstance(content, System.String):
                    net_bytes = enc.GetBytes(content)
                else:
                    # fallback: try to convert iterables of ints
                    try:
                        net_bytes = System.Array.CreateInstance(System.Byte, len(content))
                        i = 0
                        for v in content:
                            net_bytes[i] = int(v)
                            i = i + 1
                    except:
                        return "failed to send document: unsupported content type"
    
            if mime_type is None or mime_type == "":
                mime_type = "application/octet-stream"
    
            # build multipart preamble
            parts = []
            parts.append("--" + boundary)
            parts.append('Content-Disposition: form-data; name="chat_id"')
            parts.append("")
            parts.append(str(chat_id))
    
            if caption is not None:
                parts.append("--" + boundary)
                parts.append('Content-Disposition: form-data; name="caption"')
                parts.append("")
                parts.append(caption)
    
            parts.append("--" + boundary)
            parts.append('Content-Disposition: form-data; name="document"; filename="%s"' % filename)
            parts.append("Content-Type: %s" % mime_type)
            parts.append("")
            pre_bytes = enc.GetBytes(crlf.join(parts) + crlf)
            post_bytes = enc.GetBytes(crlf + "--" + boundary + "--" + crlf)
    
            ms = System.IO.MemoryStream()
            ms.Write(pre_bytes, 0, pre_bytes.Length)
            ms.Write(net_bytes, 0, net_bytes.Length)
            ms.Write(post_bytes, 0, post_bytes.Length)
    
            client = System.Net.WebClient()
            client.Headers.Add("Content-Type", "multipart/form-data; boundary=%s" % boundary)
            resp = client.UploadData(url, ms.ToArray())
            return enc.GetString(resp)
        except Exception as ex:
            return "failed to send document: " + str(ex)
    
    
    @staticmethod
    def svg_from_polylines(polylines, closed_polylines, polylinescolor, hatchescolor, padding_ratio=0.1, stroke_width=1.0, fill_opacity=0.2):
        """
        Returns an SVG string (UTF-8) built from open and closed polylines.
        Colors expected as objects with .R/.G/.B. Accepts Polyline or PolylineCurve.
        """
        def _to_polylist(items):
            out = []
            for it in items or []:
                if hasattr(it, "ToPolyline"):
                    out.append(it.ToPolyline())
                elif hasattr(it, "TryGetPolyline"):
                    ok, pl = it.TryGetPolyline()
                    if ok:
                        out.append(pl)
                else:
                    out.append(it)
            return out
    
        pls = _to_polylist(polylines or [])
        cls = _to_polylist(closed_polylines or [])
    
        # bounds
        have_pts = False
        minx = 0.0; miny = 0.0; maxx = 0.0; maxy = 0.0
        for pl in pls + cls:
            for p in pl:
                if not have_pts:
                    minx = p.X; miny = p.Y; maxx = p.X; maxy = p.Y
                    have_pts = True
                else:
                    if p.X < minx:
                        minx = p.X
                    if p.X > maxx:
                        maxx = p.X
                    if p.Y < miny:
                        miny = p.Y
                    if p.Y > maxy:
                        maxy = p.Y
    
        if not have_pts:
            return """<?xml version="1.0" encoding="UTF-8" standalone="no"?><svg xmlns="http://www.w3.org/2000/svg" version="1.1" width="1" height="1"/>"""
    
        width = maxx - minx
        height = maxy - miny
        pad_x = width * padding_ratio
        pad_y = height * padding_ratio
        new_w = width + 2.0 * pad_x
        new_h = height + 2.0 * pad_y
        off_x = -minx + pad_x
        off_y = -miny + pad_y
    
        def _ptlist(pl):
            pts = []
            for pt in pl:
                ax = pt.X + off_x
                ay = pt.Y + off_y
                pts.append("%.6f,%.6f" % (ax, ay))
            return " ".join(pts)
    
        def _rgb(c, default):
            if c is None:
                r = default[0]; g = default[1]; b = default[2]
                return "rgb(%d,%d,%d)" % (r, g, b)
            try:
                return "rgb(%d,%d,%d)" % (int(c.R), int(c.G), int(c.B))
            except:
                r = default[0]; g = default[1]; b = default[2]
                return "rgb(%d,%d,%d)" % (r, g, b)
    
        sb = System.Text.StringBuilder()
        sb.Append('<?xml version="1.0" encoding="UTF-8" standalone="no"?>')
        sb.Append('\n')
        sb.Append('<svg xmlns="http://www.w3.org/2000/svg" version="1.1" width="%s" height="%s" viewBox="0 0 %s %s">' % (str(new_w), str(new_h), str(new_w), str(new_h)))
        sb.Append('\n')
        sb.Append('  <g transform="scale(1,-1) translate(0,-%s)">' % str(new_h))
        sb.Append('\n')
    
        # open polylines
        pc = polylinescolor or []
        i = 0
        for pl in pls:
            col = pc[i] if i < len(pc) else None
            color_str = _rgb(col, (0, 0, 0))
            sb.Append('    <polyline points="%s" fill="none" stroke="%s" stroke-width="%.3f"/>\n' % (_ptlist(pl), color_str, float(stroke_width)))
            i = i + 1
    
        # closed filled
        hc = hatchescolor or []
        j = 0
        for pl in cls:
            col = hc[j] if j < len(hc) else None
            color_str = _rgb(col, (0, 0, 0))
            sb.Append('    <polygon points="%s" fill="%s" fill-opacity="%.3f" stroke="%s" stroke-width="%.3f"/>\n' % (_ptlist(pl), color_str, float(fill_opacity), color_str, float(stroke_width)))
            j = j + 1
    
        sb.Append('  </g>\n</svg>\n')
        return sb.ToString()
    
    @staticmethod
    def png_from_polylines(polylines, closed_polylines, polylinescolor, hatchescolor, width_px=1024, height_px=1024, padding_ratio=0.1, stroke_px=2.0, fill_opacity=0.2):
        """
        Rasterize geometry to PNG bytes for Telegram preview.
        """
        enc = System.Text.Encoding.UTF8
    
        def _to_polylist(items):
            out = []
            if items is None:
                return out
            for it in items:
                if hasattr(it, "ToPolyline"):
                    out.append(it.ToPolyline())
                elif hasattr(it, "TryGetPolyline"):
                    ok, pl = it.TryGetPolyline()
                    if ok:
                        out.append(pl)
                else:
                    out.append(it)
            return out
    
        pls = _to_polylist(polylines)
        cls = _to_polylist(closed_polylines)
    
        have_pts = False
        minx = 0.0; miny = 0.0; maxx = 0.0; maxy = 0.0
        for pl in pls + cls:
            for p in pl:
                if not have_pts:
                    minx = p.X; miny = p.Y; maxx = p.X; maxy = p.Y
                    have_pts = True
                else:
                    if p.X < minx:
                        minx = p.X
                    if p.X > maxx:
                        maxx = p.X
                    if p.Y < miny:
                        miny = p.Y
                    if p.Y > maxy:
                        maxy = p.Y
    
        if not have_pts:
            return System.Array.CreateInstance(System.Byte, 0)
    
        bw = maxx - minx
        bh = maxy - miny
        if bw <= 0.0:
            bw = 1.0
        if bh <= 0.0:
            bh = 1.0
    
        pad_w = float(width_px) * padding_ratio
        pad_h = float(height_px) * padding_ratio
        sx = (float(width_px) - 2.0 * pad_w) / bw
        sy = (float(height_px) - 2.0 * pad_h) / bh
        s = sx if sx < sy else sy
        vis_w = bw * s
        vis_h = bh * s
        left = (float(width_px) - vis_w) * 0.5
        bottom = (float(height_px) - vis_h) * 0.5
    
        def _mapx(x):
            return float(left + (x - minx) * s)
    
        def _mapy(y):
            return float(height_px - (bottom + (y - miny) * s))
    
        def _color_rgb(c, a255):
            if c is None:
                return System.Drawing.Color.FromArgb(a255, 0, 0, 0)
            try:
                return System.Drawing.Color.FromArgb(a255, int(c.R), int(c.G), int(c.B))
            except:
                return System.Drawing.Color.FromArgb(a255, 0, 0, 0)
    
        bmp = System.Drawing.Bitmap(int(width_px), int(height_px), System.Drawing.Imaging.PixelFormat.Format32bppArgb)
        g = System.Drawing.Graphics.FromImage(bmp)
        g.SmoothingMode = System.Drawing.Drawing2D.SmoothingMode.AntiAlias
        g.Clear(System.Drawing.Color.White)
    
        alpha_fill = int(max(0, min(255, int(fill_opacity * 255.0))))
        if alpha_fill < 0:
            alpha_fill = 0
        if alpha_fill > 255:
            alpha_fill = 255
    
        # filled polygons first
        hc = hatchescolor or []
        j = 0
        for pl in cls:
            c = hc[j] if j < len(hc) else None
            b = System.Drawing.SolidBrush(_color_rgb(c, alpha_fill))
            pts = System.Array.CreateInstance(System.Drawing.PointF, len(pl))
            k = 0
            for pt in pl:
                pts[k] = System.Drawing.PointF(_mapx(pt.X), _mapy(pt.Y))
                k = k + 1
            g.FillPolygon(b, pts)
            b.Dispose()
            j = j + 1
    
        # open polylines
        pc = polylinescolor or []
        i = 0
        for pl in pls:
            c = pc[i] if i < len(pc) else None
            pen = System.Drawing.Pen(_color_rgb(c, 255), float(stroke_px))
            prev = None
            for pt in pl:
                xy = System.Drawing.PointF(_mapx(pt.X), _mapy(pt.Y))
                if prev is not None:
                    g.DrawLine(pen, prev, xy)
                prev = xy
            pen.Dispose()
            i = i + 1
    
        g.Dispose()
        ms = System.IO.MemoryStream()
        bmp.Save(ms, System.Drawing.Imaging.ImageFormat.Png)
        arr = ms.ToArray()
        bmp.Dispose()
        ms.Dispose()
        return arr
    
    
    @staticmethod
    def telegram_send_photo(token, chat_id, filename, photo_bytes, caption=None):
        """
        POST /sendPhoto with in-memory PNG/JPEG bytes for instant preview.
        """
        try:
            url = "https://api.telegram.org/bot%s/sendPhoto" % token
            boundary = "----------%s" % System.Guid.NewGuid().ToString("N")
            crlf = "\r\n"
            enc = System.Text.Encoding.UTF8
    
            net_bytes = None
            try:
                tp = photo_bytes.GetType()
                if tp.IsArray and tp.GetElementType() == System.Byte:
                    net_bytes = photo_bytes
            except:
                net_bytes = None
            if net_bytes is None:
                if isinstance(photo_bytes, bytearray):
                    net_bytes = System.Array.CreateInstance(System.Byte, len(photo_bytes))
                    i = 0
                    for v in photo_bytes:
                        net_bytes[i] = int(v)
                        i = i + 1
                else:
                    return "failed to send photo: unsupported bytes"
    
            parts = []
            parts.append("--" + boundary)
            parts.append('Content-Disposition: form-data; name="chat_id"')
            parts.append("")
            parts.append(str(chat_id))
    
            if caption is not None:
                parts.append("--" + boundary)
                parts.append('Content-Disposition: form-data; name="caption"')
                parts.append("")
                parts.append(caption)
    
            parts.append("--" + boundary)
            parts.append('Content-Disposition: form-data; name="photo"; filename="%s"' % filename)
            # if your bytes are JPEG, set image/jpeg
            mime_type = "image/png"
            parts.append("Content-Type: %s" % mime_type)
            parts.append("")
            pre = enc.GetBytes(crlf.join(parts) + crlf)
            post = enc.GetBytes(crlf + "--" + boundary + "--" + crlf)
    
            ms = System.IO.MemoryStream()
            ms.Write(pre, 0, pre.Length)
            ms.Write(net_bytes, 0, net_bytes.Length)
            ms.Write(post, 0, post.Length)
    
            client = System.Net.WebClient()
            client.Headers.Add("Content-Type", "multipart/form-data; boundary=%s" % boundary)
            resp = client.UploadData(url, ms.ToArray())
            return enc.GetString(resp)
        except Exception as ex:
            return "failed to send photo: " + str(ex)
    
    
    @staticmethod
    def telegram_send_document_with_thumbnail(token, chat_id, filename, file_bytes, mime_type, thumb_jpeg_bytes, caption=None):
        """
        Optional: sendDocument with a custom JPEG thumbnail (<=200kB, <=320x320).
        """
        try:
            url = "https://api.telegram.org/bot%s/sendDocument" % token
            boundary = "----------%s" % System.Guid.NewGuid().ToString("N")
            crlf = "\r\n"
            enc = System.Text.Encoding.UTF8
    
            def _to_net_bytes(data):
                try:
                    tp = data.GetType()
                    if tp.IsArray and tp.GetElementType() == System.Byte:
                        return data
                except:
                    pass
                if isinstance(data, bytearray):
                    arr = System.Array.CreateInstance(System.Byte, len(data))
                    i = 0
                    for v in data:
                        arr[i] = int(v)
                        i = i + 1
                    return arr
                return None
    
            file_net = _to_net_bytes(file_bytes)
            thumb_net = _to_net_bytes(thumb_jpeg_bytes)
            if file_net is None or thumb_net is None:
                return "failed to send document: unsupported bytes"
    
            parts = []
            parts.append("--" + boundary)
            parts.append('Content-Disposition: form-data; name="chat_id"')
            parts.append("")
            parts.append(str(chat_id))
    
            if caption is not None:
                parts.append("--" + boundary)
                parts.append('Content-Disposition: form-data; name="caption"')
                parts.append("")
                parts.append(caption)
    
            parts.append("--" + boundary)
            parts.append('Content-Disposition: form-data; name="document"; filename="%s"' % filename)
            parts.append("Content-Type: %s" % (mime_type if mime_type else "application/octet-stream"))
            parts.append("")
    
            pre = enc.GetBytes(crlf.join(parts) + crlf)
            #mid = enc.GetBytes(crlf + "--" + boundary + crlf + 'Content-Disposition: form-data; name="thumbnail"; filename="thumb.jpg"' + crlf + "Content-Type: image/jpeg" + crlf + crlf)
            mid = enc.GetBytes(crlf + "--" + boundary + crlf + 'Content-Disposition: form-data; name="thumb"; filename="thumb.jpg"' + crlf + "Content-Type: image/jpeg" + crlf + crlf)
            post = enc.GetBytes(crlf + "--" + boundary + "--" + crlf)
    
            ms = System.IO.MemoryStream()
            ms.Write(pre, 0, pre.Length)
            ms.Write(file_net, 0, file_net.Length)
            ms.Write(mid, 0, mid.Length)
            ms.Write(thumb_net, 0, thumb_net.Length)
            ms.Write(post, 0, post.Length)
    
            client = System.Net.WebClient()
            client.Headers.Add("Content-Type", "multipart/form-data; boundary=%s" % boundary)
            resp = client.UploadData(url, ms.ToArray())
            return enc.GetString(resp)
        except Exception as ex:
            return "failed to send document: " + str(ex)

    @staticmethod
    def print_version():
        """
        Return current LineUtils version as string
        """
        s = "%.2f" % LineUtils.VERSION  + " LineUtils library"
        return s

    @staticmethod
    def generate_wiki(target_cls):
        """
        Generates a Markdown wiki of every public method in the given class.
        """

        spacer = "----------------------------------"
        title = "     {0} API     ".format(target_cls.__name__)
        lines = [spacer, title, spacer, "\n"]

        # collect and sort public methods
        methods = inspect.getmembers(target_cls, inspect.isfunction)
        count = 0
        for name, func in methods:
            #internal method
            if name.startswith("_"):
                continue
                
            count += 1
            idx = "{:02d}.".format(count)

            # build signature
            try:
                argspec = inspect.getargspec(func)
                args = argspec.args or []
                sig = "{name}({args})".format(
                    name=name,
                    args=", ".join(args)
                )
            except TypeError:
                # built-ins or callables without retrievable signature
                sig = name + "()"

            # clean and indent docstring
            doc = inspect.getdoc(func) or ""
            doc_lines = []
            for dl in doc.splitlines():
                doc_lines.append("   " + dl)

            # append enumeration, signature, and doc
            lines.append("{idx} `{sig}`".format(idx=idx, sig=sig))
            lines.append("")
            lines.extend(doc_lines)
            lines.append("")

        return "\n".join(lines)


    class SelfTest(object):
        """
        Lightweight, opt-in self-tests for LineUtils.

        Usage inside Grasshopper (IronPython 2.7):

            summary = LineUtils.SelfTest.run_parsing()
            # or
            summary = LineUtils.SelfTest.run_basic()
            summary = LineUtils.SelfTest.run_all()

        Each test case is small and is executed via LineUtils.run_with_timeout()
        so that a broken test cannot freeze Rhino.
        """

        # Default per-test timeout in seconds
        DEFAULT_TIMEOUT = 0.25

        # -------------------
        # Small helpers
        # -------------------

        @staticmethod
        def _almost_equal(a, b, eps = GLOBAL_TOL):
            """
            Numeric comparison with absolute tolerance.
            Falls back to == if types do not support subtraction.
            """
            try:
                return abs(a - b) <= eps
            except TypeError:
                return a == b

        @staticmethod
        def _almost_equal_point(p, q, eps = GLOBAL_TOL):
            """
            Compare two rg.Point3d with tolerance.
            """
            return (abs(p.X - q.X) <= eps and
                    abs(p.Y - q.Y) <= eps and
                    abs(p.Z - q.Z) <= eps)

        @staticmethod
        def _resolve_target(name):
            """
            Resolve a string like 'parse_measure' or
            'ConduitLookup.classify_size' to a callable.
            """
            if '.' in name:
                cls_name, meth_name = name.split('.', 1)
                cls = getattr(LineUtils, cls_name)
                return getattr(cls, meth_name)
            return getattr(LineUtils, name)

        @staticmethod
        def _run_case(case, timeout_sec):
            """
            Execute a single test case with timeout.
            case dict keys:
                - name    : human-readable name
                - target  : function name or 'Class.method'
                - args    : tuple of positional args
                - kwargs  : dict of keyword args (optional)
                - expected: expected result
                - kind    : 'float', 'point', 'sequence', or 'exact'
            """
            fn = LineUtils.SelfTest._resolve_target(case['target'])
            args = case.get('args') or ()
            kwargs = case.get('kwargs') or {}
            status = 'ok'
            result = None
            err_str = None

            def _call():
                return fn(*args, **kwargs)

            # Make sure exceptions do not bubble out and kill the component
            try:
                result = LineUtils.run_with_timeout(_call, timeout_sec)
            except Exception as e:
                status = 'error'
                err_str = repr(e)
                result = None
            else:
                if result == "expired":
                    status = 'timeout'
                else:
                    expected = case.get('expected')
                    kind = case.get('kind', 'exact')

                    if kind == 'float':
                        if not LineUtils.SelfTest._almost_equal(result, expected):
                            status = 'mismatch'

                    elif kind == 'point':
                        if not LineUtils.SelfTest._almost_equal_point(result, expected):
                            status = 'mismatch'

                    elif kind == 'sequence':
                        exp = expected
                        if len(result) != len(exp):
                            status = 'mismatch'
                        else:
                            for a, b in zip(result, exp):
                                # Handle numeric sub-items approximately,
                                # other values exactly
                                if isinstance(a, float) or isinstance(b, float):
                                    if not LineUtils.SelfTest._almost_equal(a, b):
                                        status = 'mismatch'
                                        break
                                else:
                                    if a != b:
                                        status = 'mismatch'
                                        break

                    else:  # 'exact' fallback
                        if result != expected:
                            status = 'mismatch'

            return {
                'name': case.get('name'),
                'target': case.get('target'),
                'status': status,       # 'ok', 'mismatch', 'timeout', 'error'
                'result': result,
                'expected': case.get('expected'),
                'error': err_str,
            }

        @staticmethod
        def _run_group(group_name, cases, timeout_sec, verbose):
            """
            Run a list of cases and return a summary dict.
            """
            if timeout_sec is None:
                timeout_sec = LineUtils.SelfTest.DEFAULT_TIMEOUT

            results = []
            passed = 0
            failed = 0
            timeouts = 0
            errors = 0

            for case in cases:
                r = LineUtils.SelfTest._run_case(case, timeout_sec)
                results.append(r)
                st = r['status']

                if st == 'ok':
                    passed += 1
                else:
                    failed += 1
                    if st == 'timeout':
                        timeouts += 1
                    if st == 'error':
                        errors += 1

                if verbose:
                    print('[%s] %-30s %r -> %r' %
                          (st.upper(), case.get('name'), case.get('args'), r['result']))

            return {
                'group': group_name,
                'total': len(cases),
                'passed': passed,
                'failed': failed,
                'timeouts': timeouts,
                'errors': errors,
                'cases': results,
            }

        # -------------------
        # Test case builders
        # -------------------

        @staticmethod
        def _parsing_cases():
            """
            Tests for parse_measure / parse_scale.

            To add more cases later, just append more add(...) calls here.
            """
            cases = []

            def add(name, target, args, expected, kind):
                cases.append({
                    'name': name,
                    'target': target,
                    'args': tuple(args),
                    'expected': expected,
                    'kind': kind,
                })

            # --- parse_measure ---

            add('parse_measure_zero',
                'parse_measure',
                ('0',),
                0.0,
                'float')

            add('parse_measure_feet',
                'parse_measure',
                ("6'",),
                72.0,
                'float')

            add('parse_measure_neg_feet',
                'parse_measure',
                ("-6'",),
                -72.0,
                'float')

            add('parse_measure_inches',
                'parse_measure',
                ('12"',),
                12.0,
                'float')

            add('parse_measure_fraction',
                'parse_measure',
                ('3/4"',),
                0.75,
                'float')

            add('parse_measure_mixed',
                'parse_measure',
                ('1 1/4"',),
                1.25,
                'float')

            add('parse_measure_feet_mixed',
                'parse_measure',
                ("2'-1 1/8\"",),
                25.125,
                'float')

            add('parse_measure_negative',
                'parse_measure',
                ('-3/8"',),
                -0.375,
                'float')

            add('parse_measure_error',
                'parse_measure',
                ('foo',),
                "Can't parse measure 'foo'",
                'exact')

            # --- parse_scale ---

            add('parse_scale_simple',
                'parse_scale',
                ('1" = 1\'-0"',),
                12.0,
                'float')

            add('parse_scale_halfinch',
                'parse_scale',
                ('1/2" = 1\'-0"',),
                24.0,
                'float')

            add('parse_scale_three_eighth',
                'parse_scale',
                ('3/8" = 1\'-0"',),
                32.0,
                'float')

            add('parse_scale_mixed',
                'parse_scale',
                ('1 1/2" = 2\'-0"',),
                16.0,
                'float')

            add('parse_scale_nospace',
                'parse_scale',
                ('1/8"=1\'-0"',),
                96.0,
                'float')

            add('parse_scale_words',
                'parse_scale',
                ('1/8 in = 1 ft',),
                96.0,
                'float')

            add('parse_scale_single',
                'parse_scale',
                ('3/8"',),
                0.375,
                'float')

            add('parse_scale_no_measures',
                'parse_scale',
                ('abc',),
                "No measures found in 'abc'",
                'exact')

            return cases

        @staticmethod
        def _basic_numeric_cases():
            """
            Small pure-numeric helpers that are easy and safe to test.
            """
            cases = []

            def add(name, target, args, expected, kind):
                cases.append({
                    'name': name,
                    'target': target,
                    'args': tuple(args),
                    'expected': expected,
                    'kind': kind,
                })

            # --- inchify ---

            add('inchify_zero',
                'inchify',
                (0.0,),
                0.0,
                'float')

            add('inchify_exact_half',
                'inchify',
                (1.5,),
                1.5,
                'float')

            add('inchify_round_up',
                'inchify',
                (1.499,),
                1.5,
                'float')

            add('inchify_third',
                'inchify',
                (1.333,),
                1.34375,
                'float')

            add('inchify_almost_int',
                'inchify',
                (2.999,),
                3.0,
                'float')

            # --- filter_unique_nonzero ---

            add('filter_unique_nonzero_basic',
                'filter_unique_nonzero',
                ([0.0, 0.011, 0.0110001, 0.03, -0.009], 0.01),
                [0.011, 0.03],
                'sequence')

            # --- largest_by_abs ---

            add('largest_by_abs',
                'largest_by_abs',
                ([-1.0, 2.0, -3.0],),
                -3.0,
                'float')

            add('largest_by_abs_empty',
                'largest_by_abs',
                ([],),
                0.0,
                'float')

            # --- consecutive_pairs ---

            add('consecutive_pairs_basic',
                'consecutive_pairs',
                ([1, 2, 3],),
                [[1, 2], [2, 3]],
                'sequence')

            add('consecutive_pairs_short',
                'consecutive_pairs',
                ([1],),
                [],
                'sequence')

            # --- weighted_average ---

            add('weighted_average_basic',
                'weighted_average',
                ([1.0, 2.0, 3.0], [1.0, 1.0, 2.0]),
                2.25,
                'float')

            add('weighted_average_zero_wsum',
                'weighted_average',
                ([1.0, 2.0], [0.0, 0.0]),
                0.0,
                'float')

            add('weighted_average_mismatch',
                'weighted_average',
                ([1.0, 2.0], [1.0],),
                0.0,
                'float')

            # --- distance_l1 ---

            add('distance_l1_zero',
                'distance_l1',
                (((0.0, 0.0), (0.0, 0.0))),
                0.0,
                'float')

            add('distance_l1_axis',
                'distance_l1',
                (((0.0, 0.0), (3.0, 4.0))),
                7.0,
                'float')

            add('distance_l1_symmetry',
                'distance_l1',
                (((5.0, -2.0), (-1.0, 1.0))),
                9.0,
                'float')

            # --- angle (polar) ---

            add('angle_east',
                'angle',
                (((0.0, 0.0), (1.0, 0.0))),
                0.0,
                'float')

            add('angle_north',
                'angle',
                (((0.0, 0.0), (0.0, 1.0))),
                math.pi * 0.5,
                'float')

            add('angle_west',
                'angle',
                (((0.0, 0.0), (-1.0, 0.0))),
                math.pi,
                'float')

            add('angle_south',
                'angle',
                (((0.0, 0.0), (0.0, -1.0))),
                math.pi * 1.5,
                'float')

            add('angle_diag',
                'angle',
                (((0.0, 0.0), (1.0, 1.0))),
                math.pi * 0.25,
                'float')

            return cases


        @staticmethod
        def _geometry_cases():
            """
            Simple geometry tests that only touch very cheap functions:
            orientation_of_line, get_position, get_domain, domains_overlap,
            and some small helpers around them.
            """
            cases = []

            def add(name, target, args, expected, kind):
                cases.append({
                    'name': name,
                    'target': target,
                    'args': tuple(args),
                    'expected': expected,
                    'kind': kind,
                })

            # Vertical line: X constant, Y varies
            vline = rg.Line(rg.Point3d(5, 0, 0), rg.Point3d(5, 10, 0))
            # Horizontal line: Y constant, X varies
            hline = rg.Line(rg.Point3d(0, 3, 0), rg.Point3d(10, 3, 0))
            # Non-orthogonal
            dline = rg.Line(rg.Point3d(0, 0, 0), rg.Point3d(10, 10, 0))

            # --- orientation_of_line ---

            add('orientation_vertical',
                'orientation_of_line',
                (vline,),
                LineUtils.Orientation.VERTICAL,
                'exact')

            add('orientation_horizontal',
                'orientation_of_line',
                (hline,),
                LineUtils.Orientation.HORIZONTAL,
                'exact')

            add('orientation_nonorth',
                'orientation_of_line',
                (dline,),
                LineUtils.Orientation.NONORTH,
                'exact')

            # --- get_position ---

            add('position_vertical',
                'get_position',
                (vline, LineUtils.Orientation.VERTICAL),
                5.0,
                'float')

            add('position_horizontal',
                'get_position',
                (hline, LineUtils.Orientation.HORIZONTAL),
                3.0,
                'float')

            # --- get_domain ---

            add('domain_vertical',
                'get_domain',
                (vline, LineUtils.Orientation.VERTICAL),
                [0.0, 10.0],
                'sequence')

            add('domain_horizontal',
                'get_domain',
                (hline, LineUtils.Orientation.HORIZONTAL),
                [0.0, 10.0],
                'sequence')

            # --- domains_overlap ---

            add('domains_overlap_true',
                'domains_overlap',
                ([0.0, 10.0], [9.0, 20.0]),
                True,
                'exact')

            add('domains_overlap_false',
                'domains_overlap',
                ([0.0, 10.0], [10.1, 20.0]),
                False,
                'exact')

            add('domains_overlap_touch',
                'domains_overlap',
                ([0.0, 10.0], [10.0, 20.0]),
                True,
                'exact')

            add('domains_overlap_negative',
                'domains_overlap',
                ([-5.0, -1.0], [-3.0, 2.0]),
                True,
                'exact')

            # --- is_vertical / is_horizontal ---

            add('is_vertical_true',
                'is_vertical',
                (vline,),
                True,
                'exact')

            add('is_vertical_false',
                'is_vertical',
                (hline,),
                False,
                'exact')

            add('is_horizontal_true',
                'is_horizontal',
                (hline,),
                True,
                'exact')

            add('is_horizontal_false',
                'is_horizontal',
                (vline,),
                False,
                'exact')

            # --- filter_same_direction / filter_by_flag ---

            ref = rg.Line(rg.Point3d(0, 0, 0), rg.Point3d(10, 0, 0))
            par = rg.Line(rg.Point3d(5, 5, 0), rg.Point3d(15, 5, 0))    # parallel
            anti = rg.Line(rg.Point3d(5, 5, 0), rg.Point3d(-5, 5, 0))   # anti-parallel
            perp = rg.Line(rg.Point3d(0, 0, 0), rg.Point3d(0, 10, 0))   # perpendicular

            add('filter_same_direction_basic',
                'filter_same_direction',
                (ref, [par, anti, perp]),
                [True, True, False],
                'sequence')

            add('filter_by_flag_basic',
                'filter_by_flag',
                (['a', 'b', 'c'], [True, False, True]),
                ['a', 'c'],
                'sequence')

            add('filter_by_flag_all_false',
                'filter_by_flag',
                (['a', 'b', 'c'], [False, False, False]),
                [],
                'sequence')

            # --- _snap01 / _in01 ---

            add('snap01_below_zero',
                '_snap01',
                (-0.1, 0.001),
                0.0,
                'float')

            add('snap01_above_one',
                '_snap01',
                (1.001, 0.001),
                1.0,
                'float')

            add('snap01_inside',
                '_snap01',
                (0.5, 0.001),
                0.5,
                'float')

            add('in01_inside_exclusive',
                '_in01',
                (0.5, False, 0.001),
                True,
                'exact')

            add('in01_outside_exclusive',
                '_in01',
                (0.0, False, 0.001),
                False,
                'exact')

            add('in01_endpoint_inclusive_low',
                '_in01',
                (0.0, True, 0.001),
                True,
                'exact')

            add('in01_endpoint_inclusive_high',
                '_in01',
                (1.0, True, 0.001),
                True,
                'exact')

            return cases

        # -------------------
        # Public entry points
        # -------------------

        @staticmethod
        def run_parsing(timeout_sec=None, verbose=True):
            """
            Run only parsing-related tests (parse_measure / parse_scale).
            """
            cases = LineUtils.SelfTest._parsing_cases()
            return LineUtils.SelfTest._run_group('parsing', cases, timeout_sec, verbose)

        @staticmethod
        def run_basic(timeout_sec=None, verbose=True):
            """
            Run parsing + basic numeric + simple geometry tests.
            Cheap and safe to run often.
            """
            cases = []
            cases.extend(LineUtils.SelfTest._parsing_cases())
            cases.extend(LineUtils.SelfTest._basic_numeric_cases())
            cases.extend(LineUtils.SelfTest._geometry_cases())
            return LineUtils.SelfTest._run_group('basic', cases, timeout_sec, verbose)

        @staticmethod
        def run_all(timeout_sec=None, verbose=True):
            """
            Alias for run_basic for now.
            Kept separate so you can add heavier tests later.
            """
            return LineUtils.SelfTest.run_basic(timeout_sec, verbose)
# ---------- end ghpython_script_3 ----------

# ----
data_35 = Data(flatten_tree)
panel_4 = Panel(data_35)
split_tree = SplitTree(Data=stream_filter_4, Masks=flatten(data_35))  # -> Positive, Negative
split_tree_2 = SplitTree(Data=stream_filter_2, Masks=flatten(data_35))  # -> Positive, Negative
split_tree_3 = SplitTree(Data=stream_filter_5, Masks=flatten(data_35))  # -> Positive, Negative
split_tree_4 = SplitTree(Data=stream_filter_3, Masks=flatten(data_35))  # -> Positive, Negative
split_tree_5 = SplitTree(Data=stream_filter, Masks=flatten(data_35))  # -> Positive, Negative; disabled
point = Point([Point(-2.103089862, 249.5946937, 0), Point(-2.103089862, 159.7163663, 0), Point(117.1232628, 159.7163663, 0), Point(117.1232628, 7.106634859, 0), Point(21.37533036, 7.106634859, 0)])
point_2 = Point([Point(3.028890213, 0.3498498394, 0), Point(3.028890213, 21.44741151, 0), Point(119.5112025, 21.44741151, 0), Point(119.5112025, 87.41443532, 0), Point(-3.805531173, 87.41443532, 0), Point(-3.805531173, 281.4525729, 0)])
deconstruct_plane = DeconstructPlane(Plane=split_tree_2.Positive)  # -> Origin, XAxis, YAxis, ZAxis
construct_point = ConstructPoint(XCoordinate=0, YCoordinate=0, ZCoordinate=0)
reverse_list = ReverseList(List=point)
polyline = PolyLine(Vertices=point_2, Closed=False)
vector_xyz = VectorXYZ(XComponent=0, YComponent=0, ZComponent=0)  # -> Vector, Length
lineutils = Data(ghpython_script)
polyline_2 = PolyLine(Vertices=reverse_list, Closed=False)
vector_2pt = Vector2Pt(PointA=deconstruct_plane.Origin, PointB=construct_point, Unitize=False)  # -> Vector, Length
number_slider_3 = Slider(6.13, range=0..10)  # disabled
data_36 = Data(vector_2pt.Vector)
move = Move(Motion=data_36)  # -> Geometry, Transform
data_37 = Data(move.Transform)
transform = Transform(Geometry=split_tree_3.Positive, Transform=data_37)
transform_2 = Transform(Geometry=split_tree.Positive, Transform=data_37)
transform_3 = Transform(Geometry=split_tree_2.Positive, Transform=data_37)
entwine = Entwine(Branch00=polyline_2, Branch01=polyline, FlattenInputs=True)  # -> flatten(Result)
data_38 = Data(Tree({0}: [Plane(origin=(255.2098621, -2833.094695, 0), x=(-1, 0, 0), y=(0, -1, 0))], {1}: [Plane(origin=(214.7215158, -2847.790049, 0), x=(0, 1, 0), y=(-1, 0, 0))], {2}: [Plane(origin=(-12.50164524, -2874.741254, 0), x=(-1, 0, 0), y=(0, -1, 0))]))  # disabled
data_39 = Data(1)  # disabled
data_40 = Data(Tree({0}: [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], {1}: [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], {2}: [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]))  # disabled
data_41 = Data(Tree({0}: [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], {1}: [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], {2}: [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]))  # disabled
data_42 = Data(Tree({0}: [0.75, 0.75], {1}: [0.75, 0.75, 0.75, 0.75, 0.75, 0.75, 0.75, 0.75, 0.75, 0.75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], {2}: ["2.5", "1.25"]))  # disabled
ghpython_script_4 = GhPythonScript(LineUtils=lineutils, polylines=entwine, refresh=Button(), randominside=Toggle(True))  # -> out, randomconduitsize; inputs polylines: tree, randominside: Boolean
# ---------- ghpython_script_4: Python ----------
import Rhino.Geometry as rg
import random
import System
import Grasshopper as gh
import itertools

print LineUtils.ConduitLookup.SIZES

lkpsizes = [0.5, 0.75, 0.75, 1.0, 1.5, 4.0]

randomconduitsize = gh.DataTree[System.Object]()

for path in polylines.Paths:
    objcnt = polylines.Branch(path)
    lkp = random.choice(lkpsizes)
    if randominside:
        items = [random.choice(lkpsizes) for _ in range(len(objcnt))]
    else:
        items = list(itertools.repeat(lkp,len(objcnt)))
    randomconduitsize.AddRange(items, path)
# ---------- end ghpython_script_4 ----------
ghpython_script_5 = GhPythonScript()  # -> out, a
# ---------- ghpython_script_5: Python ----------
def scale_around(x, center, factor):
    return center + (x - center) * factor

# example
result = scale_around(10.0, 0.0, 1.2)

print result
# ---------- end ghpython_script_5 ----------
number_slider_4 = Slider(0, range=0..30)  # disabled

panel_5 = Panel("Gh\Spacing\Py\spacingshell.py")  # disabled
python = GhPythonScript(local_path=panel_5)  # -> drawer_project, full_path; disabled
# ---------- python: Python ----------
"""
GH Python (IronPython)
Description:
Builds an absolute path within the project using the base directory 
defined in the environment variable DRAWER_PROJECT_ROOT.

Inputs:
    local_path : str  — relative path inside the project (e.g. "Gh\Grid_and_path\Grid_and_path_data_validation.py")

Outputs:
    drawer_project : str — root path of the project (from environment variable)
    full_path      : str — combined absolute path (drawer_project + local_path)
"""

import os

ghenv.Component.Message = "drawer_project_path v0.02"

# Name of the environment variable to read
VAR_NAME = "DRAWER_PROJECT_ROOT"

# Get project root from environment variable
drawer_project = os.environ.get(VAR_NAME)

# Validate existence
if not drawer_project:
    raise ValueError(
        "Environment variable '{}' is not set. "
        "Please define it in your system environment.".format(VAR_NAME)
    )

# Normalize and safely combine paths
full_path = os.path.join(drawer_project, local_path)
# ---------- end python ----------
file = ReadFile(File=python.full_path, PerLineParse=False)  # disabled

number_slider_5 = Slider(25, range=0..200)  # disabled
boolean_toggle = BooleanToggle(False)  # disabled
boolean_toggle_2 = BooleanToggle(True)  # disabled
boolean_toggle_3 = BooleanToggle(False)  # disabled
data_43 = Data(data_40)  # disabled
data_44 = Data(data_38)  # disabled
data_45 = Data(data_41)  # disabled
data_46 = Data(data_42)  # disabled
data_47 = Data(number_slider_3)  # disabled
tree_branch = TreeBranch(Tree=data_45, Path=Slider(1, range=0..2), MaintainPaths=True)  # disabled
data_48 = Data(stream_filter)
unit_z = UnitZ(Factor=Slider(10, range=0..10))
data_49 = Data(transform_3)
data_50 = Data(transform_2)
data_51 = Data(transform)
data_52 = Data(split_tree_4.Positive)
number_slider_6 = Slider(4, range=0..10)  # disabled
boolean_toggle_4 = BooleanToggle(False)  # disabled
colour_swatch = ColourSwatch(SwatchColor=RGB(0, 0, 0))  # disabled
button = Button()  # disabled
reverse = Reverse(Vector=unit_z)
cross_reference = CrossReference(ListListA=data_51, ListListB=Slider(0, range=0..100), CrossMode=1)  # -> ListListA, ListListB
ghpython_script_6 = GhPythonScript(
    LineUtils=lineutils,
    panel=data_43,
    panelplane=data_44,
    polylines=data_45,
    conduitsizes=data_46,
    spacing=data_47,
    removeshorts=boolean_toggle_3,
    pullstart=boolean_toggle_2,
    manhattanradius=number_slider_5,
    devicemode=boolean_toggle,
    devicetolerance=number_slider_4)  # -> out, reconnected, polylines_LR, finaltree; inputs panel: Rectangle3d, panelplane: Plane, polylines: list of Polyline, conduitsizes: list, removeshorts: Boolean, pullstart: Boolean, devicemode: Boolean; disabled
# ---------- ghpython_script_6: Python ----------
"""
GH Python (IronPython)
Description: Reconnect and re-route conduit polylines at a panel with optional Manhattan logic and device-aware tolerance.

Inputs:
    LineUtils       : LineUtils           — helper class instance used for panel reconnection logic
    panel           : rg.Rectangle3d      — panel outline in 3D
    panelplane      : rg.Plane            — panel plane used for projection and orientation
    polylines       : List[rg.Polyline]   — main input, list of conduit centreline polylines
    conduitsize     : List[float]         — conduit size per polyline; list length must match polylines
    spacing         : float               — target centre-to-centre distance between conduits
    removeshorts    : bool                — treat single-segment polylines as Manhattan runs if False; best to default at False
    pullstart       : bool                — when connections exit panel from both sides: single row if False, double row if True
    manhattanradius : float               — if end of a polyline is within this distance from panel centre, treat as Manhattan polyline
    devicemode      : bool                — enable device-aware logic using devicetolerance
    devicetolerance : float               — distance around connection rectangles within which a connection is considered covered

Outputs:
    reconnected : List[rg.Polyline] — list of reconnected / adjusted conduit polylines
"""


import Rhino.Geometry as rg
import Grasshopper as gh
import math
from collections import defaultdict
import itertools
import System
import random
import copy

GLOBAL_TOL = 0.01
defaultpath = gh.Kernel.Data.GH_Path(0)
unitX = rg.Vector3d(1, 0, 0)
unitY = rg.Vector3d(0, 1, 0)
unitZ = rg.Vector3d(0, 0, 1) 
lineargap = 4.0 #4" between bends
ghenv.Component.Message = "v0.40 panelconnections"

spacing_ = copy.deepcopy(spacing)
spacing = 0

conduitsizes_ = copy.deepcopy(conduitsizes)
conduitsizes = [0 for _ in conduitsizes]

#dont apply angled if offset is more than x minimal shifts
offsetshitcoof = 10#2000#10.00

sidesextra = 3.0

n_items = len(polylines)
orig_idx = list(range(n_items))  # tracks where each current item came from

polylines_ = []

#short start to end collapsing
planecenter = panelplane.Origin
for poly in polylines:
    lastp = poly.Last
    dist = planecenter.DistanceTo(lastp)
    if dist <= manhattanradius:
        newpol = rg.Polyline([planecenter, lastp])
        polylines_.append(newpol)
    else:
        polylines_.append(poly)

polylines = polylines_

def x_positions(diameters, gap, angle_deg, padding, tol = GLOBAL_TOL):
    if angle_deg <= tol:
        return [0]
    ang = angle_deg * math.pi / 180.0
    n = len(diameters)
    if n == 0:
        return [0]
    # first center
    pos = padding + diameters[0] / 2.0
    if n == 1:
        return [0, pos, pos*2]
    centers = [pos]
    # subsequent centers
    for i in range(1, n):
        if ang == 0.0:
            dx = diameters[i-1]/2.0 + gap + diameters[i]/2.0
        else:
            dx = (diameters[i-1]/2.0 + gap + diameters[i]/2.0) / math.sin(ang)
        pos += dx
        centers.append(pos)
    # end of end padding
    end = centers[-1] + diameters[-1]/2.0 + padding
    values = [0]+centers+[end]
    rvalues = [round(v, 3) for v in values]
    
    return rvalues

def split_up_down(plane, lines, tol = GLOBAL_TOL):
    origin_uv = plane.RemapToPlaneSpace(plane.Origin)[1]
    upper = []
    lower = []
    for i, ln in enumerate(lines):
        mid_uv = plane.RemapToPlaneSpace(ln.PointAt(0.5))[1]
        if mid_uv.X - origin_uv.X > tol:
            upper.append((i, ln))
        else:
            lower.append((i, ln))
    return upper, lower

def classify_direction(plane, line, tol = GLOBAL_TOL):
    d = rg.Vector3d(line.Direction)
    d.Unitize()
    ax_y = rg.Vector3d(plane.XAxis)
    ax_x = rg.Vector3d(plane.YAxis)
    
    if abs(d * ax_y) >= 1.0 - tol:
        return 'straight'
        
    if d * ax_x > 0:
        return 'right'
    return 'left'

def _sort_block(plane, items, tag, is_upper):
    if tag == 'straight':
        #key_fun = lambda it: plane.RemapToPlaneSpace(it[1].PointAtStart)[1].Y
        key_fun = lambda it: plane.RemapToPlaneSpace(it[1].From)[1].Y
        reverse_flag = False#True  # always descending Y
    else:
        #key_fun = lambda it: plane.RemapToPlaneSpace(it[1].PointAtStart)[1].X
        key_fun = lambda it: plane.RemapToPlaneSpace(it[1].From)[1].X
        if tag == 'left':
            reverse_flag = is_upper  # upper -> asc lower -> desc
        else:  # 'right'
            reverse_flag = not is_upper      # upper -> desc lower -> asc
    
    return sorted(items, key=key_fun, reverse=reverse_flag)

def sort_lines(plane, lines, tol = GLOBAL_TOL):
    upper, lower = split_up_down(plane, lines, tol)
    #lower = []
    ordered = []
    
    for grp, is_upper in ((upper, False), (lower, True)):
        buckets = {'left': [], 'straight': [], 'right': []}
        tagorder = ['left', 'straight', 'right']
        if is_upper:
            #tagorder.reverse()
            pass
        
        #print "is_upper ", is_upper
        #print tagorder
        
        for idx, ln in grp:
            buckets[classify_direction(plane, ln, tol)].append((idx, ln))
        
        #print buckets
        
        for tag in tagorder:
            ordered.extend(_sort_block(plane, buckets[tag], tag, is_upper))
            
    sorted_lines = [item[1] for item in ordered]
    index_map = [item[0] for item in ordered]
    
    return sorted_lines, index_map

def snappolyline(polyline, plane, point, moveflag = False, tol = GLOBAL_TOL):
    if polyline.SegmentCount <= 2:
        #print tol
        return [False, polyline]
    
    firstsegment = polyline.SegmentAt(0)
    fsdir = firstsegment.UnitTangent
    planeX = plane.XAxis
    dot = fsdir*planeX
    
    result, targetplanept = plane.RemapToPlaneSpace(point)
            
    newpoly = [None, None]
    
    polypts = list(polyline)
    firstp = polypts[0]
    secondp = polypts[1]
    otherpts = polypts[1:]
    otherpts2 = polypts[2:]
    
    _, firstplanep = plane.RemapToPlaneSpace(firstp)
    _, secondplanep = plane.RemapToPlaneSpace(secondp)
    
    #print tol
    
    if abs(dot) >= 1 - tol: #same dir
        
        #if False:#moveflag:
        if moveflag:
            remappedxy = plane.PointAt(targetplanept.X, targetplanept.Y, firstplanep.Z)
            remapped2nd = plane.PointAt(secondplanep.X, targetplanept.Y, secondplanep.Z) 
            
            newpoly = [True, rg.Polyline([remappedxy, remapped2nd]+otherpts2)]
        else:
            #print "here"
            remappedxy = plane.PointAt(targetplanept.X, firstplanep.Y, firstplanep.Z)
            
            newpoly = [False, rg.Polyline([remappedxy]+otherpts)]
    else:
        
        remappedxy = plane.PointAt(firstplanep.X, targetplanept.Y, firstplanep.Z)
        extrapt = plane.PointAt(targetplanept.X, targetplanept.Y, firstplanep.Z)
        
        newpoly = [True, rg.Polyline([extrapt, remappedxy]+otherpts)]
        #newpoly = [True, rg.Polyline([remappedxy]+otherpts)]
    #print "_______"
    
    #newpoly[1].DeleteShortSegments(tol)
    
    return newpoly

def clean_polyline(pl, mindistance, tol = GLOBAL_TOL):
    # if ≤2 segments, nothing to do
    if pl.SegmentCount <= 2:
        return pl
        
    tol_rad = math.radians(tol)
    pts = list(pl)
    i = 0
    # walk sliding window of 3 segments → 4 points
    
    while i <= len(pts) - 4:
        p0 = pts[i]
        p1 = pts[i+1]
        p2 = pts[i+2]
        p3 = pts[i+3]
        
        # first segment
        v1 = p1 - p0
        if not v1.Unitize():
            i += 1
            continue
            
        # middle segment: capture its length before unitizing
        raw_v2 = p2 - p1
        seg2_len = raw_v2.Length
        v2 = rg.Vector3d(raw_v2)
        v2.Unitize()
        # third segment
        v3 = p3 - p2
        if not v3.Unitize():
            i += 1
            continue
            
        # angles between segments
        ang12 = rg.Vector3d.VectorAngle(v1, v2)
        ang23 = rg.Vector3d.VectorAngle(v2, v3)
        
        # test both ~90° within tol
        if abs(ang12 - math.pi/2) <= tol_rad and abs(ang23 - math.pi/2) <= tol_rad:
            # if middle is too short, remove it and merge
            if seg2_len < mindistance + tol:
                new_p3 = rg.Point3d(p3)
                # align along axis of first segment
                if abs(v1.X) > abs(v1.Y):
                    new_p3.Y = p0.Y
                else:
                    new_p3.X = p0.X
                # drop the middle point, replace next point
                pts.pop(i+2)
                pts[i+2] = new_p3
                # shift index by extra 1 so next triplet spans correctly
                i += 2
                continue
        i += 1
     
    return rg.Polyline(pts)

def extend_polyline_segments(pl, mindistance, mode='triplet', tol=GLOBAL_TOL):
    """
    Extend/collapse segments in a polyline.
    
    'triplet'  - three-seg groups: if middle seg is short, extend it.
    'singular' - each seg: if ≤ tol, collapse it
                 elif < mindistance+tol, extend to mindistance.
    'singular_first'- only the first segment
                      if ≤ tol, collapse it
                      elif < mindistance+tol, extend it.
    """
    pl.MergeColinearSegments(tol, False)
    
    # nothing to do for 0 or 1 segment
    if pl.SegmentCount <= 1:
        return pl

    # copy points and precompute tolerance in radians
    pts = list(pl)
    tol_rad = math.radians(tol)

    # --- Triplet mode ---
    if mode == 'triplet':
        i = 0
        max_i = len(pts) - 4
        while i <= max_i:
            p0 = pts[i]
            p1 = pts[i+1]
            p2 = pts[i+2]
            p3 = pts[i+3]

            v1 = p1 - p0
            if not v1.Unitize():
                i += 1
                continue

            raw_v2 = p2 - p1
            seg2_len = raw_v2.Length
            v2 = rg.Vector3d(raw_v2)
            v2.Unitize()

            v3 = p3 - p2
            if not v3.Unitize():
                i += 1
                continue

            ang12 = rg.Vector3d.VectorAngle(v1, v2)
            ang23 = rg.Vector3d.VectorAngle(v2, v3)

            is_perp1 = abs(ang12 - math.pi/2) <= tol_rad
            is_perp2 = abs(ang23 - math.pi/2) <= tol_rad
            is_short = seg2_len < mindistance + tol

            if is_perp1 and is_perp2 and is_short:
                # compute new p2 extended to mindistance
                new_p2 = rg.Point3d(p1)
                new_p2 = new_p2 + v2 * mindistance
                delta = new_p2 - p2

                pts[i+2] = new_p2

                # shift only p3 along the extension axis
                if abs(raw_v2.X) > abs(raw_v2.Y):
                    pts[i+3].X += delta.X
                else:
                    pts[i+3].Y += delta.Y

                i += 2
            else:
                i += 1

    # --- Singular-first mode ---
    elif mode == 'singular_first':
        # only operate on the very first segment
        if len(pts) < 2:
            return rg.Polyline(pts)

        p0 = pts[0]
        p1 = pts[1]

        raw_v = p1 - p0
        seg_len = raw_v.Length

        # collapse tiny first segment
        if seg_len <= tol:
            delta = rg.Vector3d(raw_v)
            pts.pop(1)
            j = 1
            while j < len(pts):
                pts[j].X = pts[j].X - delta.X
                pts[j].Y = pts[j].Y - delta.Y
                pts[j].Z = pts[j].Z - delta.Z
                j = j + 1

        # extend short first segment
        elif seg_len < mindistance + tol and len(pts) > 2:
            v = rg.Vector3d(raw_v)
            v.Unitize()
            new_p1 = rg.Point3d(p0)
            new_p1 = new_p1 + v * mindistance
            ext_delta = new_p1 - p1

            pts[1] = new_p1

            # shift only the next point along dominant axis
            if abs(raw_v.X) > abs(raw_v.Y):
                pts[2].X = pts[2].X + ext_delta.X
            else:
                pts[2].Y = pts[2].Y + ext_delta.Y

        return rg.Polyline(pts)

    # --- Singular mode ---
    elif mode == 'singular':
        i = 0
        while i < len(pts) - 1:
            p0 = pts[i]
            p1 = pts[i+1]

            raw_v = p1 - p0
            seg_len = raw_v.Length

            # collapse tiny segment
            if seg_len <= tol:
                delta = rg.Vector3d(raw_v)
                pts.pop(i+1)
                j = i + 1
                while j < len(pts):
                    pts[j].X -= delta.X
                    pts[j].Y -= delta.Y
                    pts[j].Z -= delta.Z
                    j += 1
                continue

            # extend short segment, only if next point exists
            if seg_len < mindistance + tol and i+2 < len(pts):
                v = rg.Vector3d(raw_v)
                v.Unitize()
                new_p1 = rg.Point3d(p0)
                new_p1 = new_p1 + v * mindistance
                ext_delta = new_p1 - p1

                pts[i+1] = new_p1

                # shift only the very next point along dominant axis
                if abs(raw_v.X) > abs(raw_v.Y):
                    pts[i+2].X += ext_delta.X
                else:
                    pts[i+2].Y += ext_delta.Y

            i += 1

    # unknown mode: return original
    else:
        return pl

    return rg.Polyline(pts)
    

def remove_spikes(pl, tol_deg=GLOBAL_TOL):
    """remove any back‑tracking spikes from a polyline
    spike is detected when two consecutive segments are nearly 180* apart 
    tolerance is defaulted to global tol, but much tighter is reccomended 0.0001
    """
    # if fewer than 2 segments, nothing to clean
    if pl.SegmentCount < 2:
        return pl
    tol = math.radians(tol_deg)
    pts = list(pl)
    i = 0
    while i < len(pts) - 2:
        p0 = pts[i]
        p1 = pts[i+1]
        p2 = pts[i+2]
        v1 = p1 - p0
        if not v1.Unitize():
            i += 1
            continue
        v2 = p2 - p1
        if not v2.Unitize():
            i += 1
            continue
        ang = rg.Vector3d.VectorAngle(v1, v2)
        # if they reverse direction within tol, drop the spike apex
        if abs(ang - math.pi) <= tol:
            pts.pop(i+1)
            # re‑test at same index since list got shorter
            continue
        i += 1
    return rg.Polyline(pts)

def middle_line_in_rectangle(rect, plane, tol=GLOBAL_TOL):
    center = rect.Center
    dir_y = plane.YAxis
    infinite_line = rg.Line(center - dir_y * 1e6, center + dir_y * 1e6)

    rect_curve = rect.ToNurbsCurve()
    intersections = rg.Intersect.Intersection.CurveLine(rect_curve, infinite_line, tol, tol)

    if not intersections or intersections.Count != 2:
        return None

    pt1 = intersections[0].PointA
    pt2 = intersections[1].PointA
    
    return rg.Line(pt1, pt2)

def apply_perm(seq, perm):
    return [seq[i] for i in perm]

def restore_input_order(seq, idx_track):
    n = len(idx_track)
    out = [None for _ in range(n)]
    for pos, orig in enumerate(idx_track):
        out[orig] = seq[pos]
    return out

def snap_parameters(parameters0, parameters1):
    epsilon = 1e-9
    tol = 0.01
    max_iterations = 50

    def abs_float(x):
        if x < 0.0:
            return -x
        return x

    p0 = []
    p1 = []
    i = 0
    for i in range(len(parameters0)):
        p0.append(float(parameters0[i]))
    i = 0
    for i in range(len(parameters1)):
        p1.append(float(parameters1[i]))

    n0 = len(p0)
    n1 = len(p1)
    if n0 == 0 or n1 == 0:
        return p0, p1

    min0 = p0[0]
    max0 = p0[0]
    i = 1
    for i in range(1, n0):
        v = p0[i]
        if v < min0:
            min0 = v
        if v > max0:
            max0 = v
    domain0 = max0 - min0

    min1 = p1[0]
    max1 = p1[0]
    i = 1
    for i in range(1, n1):
        v = p1[i]
        if v < min1:
            min1 = v
        if v > max1:
            max1 = v
    domain1 = max1 - min1

    best_diff = None
    anchor0 = 0
    anchor1 = 0
    i = 0
    for i in range(n0):
        a = p0[i]
        j = 0
        for j in range(n1):
            b = p1[j]
            d = a - b
            if d < 0.0:
                d = -d
            if best_diff is None or d < best_diff:
                best_diff = d
                anchor0 = i
                anchor1 = j

    if domain0 < domain1:
        delta = p1[anchor1] - p0[anchor0]
        i = 0
        for i in range(n0):
            p0[i] = p0[i] + delta
    elif domain1 < domain0:
        delta = p0[anchor0] - p1[anchor1]
        j = 0
        for j in range(n1):
            p1[j] = p1[j] + delta
    else:
        delta = p1[anchor1] - p0[anchor0]
        i = 0
        for i in range(n0):
            p0[i] = p0[i] + delta

    anchor_value = p0[anchor0]

    locked0 = []
    locked1 = []
    i = 0
    for i in range(n0):
        locked0.append(False)
    i = 0
    for i in range(n1):
        locked1.append(False)

    locked0[anchor0] = True
    locked1[anchor1] = True

    def process_side(side):
        iteration = 0
        for iteration in range(max_iterations):
            candidates = []

            if side == -1:
                i = 0
                for i in range(anchor0):
                    if locked0[i]:
                        continue
                    d = p0[i] - anchor_value
                    if d < 0.0:
                        d = -d
                    candidates.append((d, 0, i))
                j = 0
                for j in range(anchor1):
                    if locked1[j]:
                        continue
                    d = p1[j] - anchor_value
                    if d < 0.0:
                        d = -d
                    candidates.append((d, 1, j))
            else:
                i = anchor0 + 1
                for i in range(anchor0 + 1, n0):
                    if locked0[i]:
                        continue
                    d = p0[i] - anchor_value
                    if d < 0.0:
                        d = -d
                    candidates.append((d, 0, i))
                j = anchor1 + 1
                for j in range(anchor1 + 1, n1):
                    if locked1[j]:
                        continue
                    d = p1[j] - anchor_value
                    if d < 0.0:
                        d = -d
                    candidates.append((d, 1, j))

            if not candidates:
                break

            candidates.sort()

            changed = False

            ci = 0
            for ci in range(len(candidates)):
                d_c, list_id, idx = candidates[ci]

                if list_id == 0 and locked0[idx]:
                    continue
                if list_id == 1 and locked1[idx]:
                    continue

                if list_id == 0:
                    v_c = p0[idx]
                else:
                    v_c = p1[idx]

                # collect all "smaller or equal" (closer/equal to anchor) in other list
                partner_indices = []
                partner_dists = []

                if list_id == 0:
                    # candidate in list 0, search list 1
                    if side == -1:
                        start = 0
                        end = anchor1
                    else:
                        start = anchor1 + 1
                        end = n1
                    j = start
                    for j in range(start, end):
                        if locked1[j]:
                            continue
                        d_o = p1[j] - anchor_value
                        if d_o < 0.0:
                            d_o = -d_o
                        if d_o < d_c - tol or abs_float(d_o - d_c) <= tol:
                            partner_indices.append(j)
                            partner_dists.append(d_o)

                    if len(partner_indices) > 0:
                        # pick partner furthest from anchor (max distance)
                        best_pos = 0
                        best_d = partner_dists[0]
                        t = 1
                        for t in range(1, len(partner_indices)):
                            if partner_dists[t] > best_d + epsilon:
                                best_d = partner_dists[t]
                                best_pos = t
                        best_k = partner_indices[best_pos]
                        v_o = p1[best_k]
                        delta2 = v_c - v_o

                        if side == -1:
                            k = 0
                            for k in range(0, best_k + 1):
                                p1[k] = p1[k] + delta2
                        else:
                            k = best_k
                            for k in range(best_k, n1):
                                p1[k] = p1[k] + delta2

                        locked0[idx] = True
                        locked1[best_k] = True

                        # lock all closer ones from that list that also matched condition
                        t = 0
                        for t in range(len(partner_indices)):
                            k2 = partner_indices[t]
                            d2 = partner_dists[t]
                            if k2 != best_k:
                                if d2 + epsilon < best_d:
                                    locked1[k2] = True

                        changed = True

                else:
                    # candidate in list 1, search list 0
                    if side == -1:
                        start = 0
                        end = anchor0
                    else:
                        start = anchor0 + 1
                        end = n0
                    i2 = start
                    for i2 in range(start, end):
                        if locked0[i2]:
                            continue
                        d_o = p0[i2] - anchor_value
                        if d_o < 0.0:
                            d_o = -d_o
                        if d_o < d_c - tol or abs_float(d_o - d_c) <= tol:
                            partner_indices.append(i2)
                            partner_dists.append(d_o)

                    if len(partner_indices) > 0:
                        best_pos = 0
                        best_d = partner_dists[0]
                        t = 1
                        for t in range(1, len(partner_indices)):
                            if partner_dists[t] > best_d + epsilon:
                                best_d = partner_dists[t]
                                best_pos = t
                        best_k = partner_indices[best_pos]
                        v_o = p0[best_k]
                        delta2 = v_c - v_o

                        if side == -1:
                            k = 0
                            for k in range(0, best_k + 1):
                                p0[k] = p0[k] + delta2
                        else:
                            k = best_k
                            for k in range(best_k, n0):
                                p0[k] = p0[k] + delta2

                        locked1[idx] = True
                        locked0[best_k] = True

                        t = 0
                        for t in range(len(partner_indices)):
                            k2 = partner_indices[t]
                            d2 = partner_dists[t]
                            if k2 != best_k:
                                if d2 + epsilon < best_d:
                                    locked0[k2] = True

                        changed = True

                if changed:
                    break

            if not changed:
                break

    process_side(-1)
    process_side(1)

    return p0, p1

def scale_around(x, center, factor):
    return x - (center + (x - center) * factor)

if devicemode:
    if abs(devicetolerance) > GLOBAL_TOL:
        panel = LineUtils.offset_rectangle(panel, devicetolerance)

#reusing normal logic if not under condition, dirty patch
run_else = False

if devicemode and len(polylines) == 1:
    #print "devmode 1"
    dpolyline = polylines[0]
    firstseg = dpolyline.SegmentAt(0)
    hitspanel = LineUtils.lxr(firstseg, [panel], True)
    if hitspanel:
        print "in panel"
        porigin = panelplane.Origin
        newp = firstseg.ClosestPoint(porigin, False) #treat as infinite
        polypts = list(dpolyline)
        polypts[0] = newp
        rerespaced = rg.PolylineCurve(polypts)
    else:
        run_else = True
else:
    run_else = True

if run_else:
    #don't use other angles for now, keep 90
    #angleslookup = LineUtils.AngleLookup.ANGLES
    angleslookup = [90]
    
    #boundspreview = LineUtils.rectangle_axis(panel)
    boundspreview = middle_line_in_rectangle(panel, panelplane)
    
    panelwidth = boundspreview.Length
    od_lookup = [LineUtils.ConduitLookup.get_specs(cs)["od"] for cs in conduitsizes]
    
    #1.0" padding on both ends
    padding = 1.0
    positions = x_positions(od_lookup, spacing, 90, padding)
    mostgradualangle = 90
    
    if positions[-1] <= panelwidth:
        #loop from higher to lower except for 90
        for a in angleslookup[-2::-1]:
            testpos = x_positions(od_lookup, spacing, a, padding)
            if testpos[-1] <= panelwidth:
                positions = testpos
                mostgradualangle = a
            else:
                break
        
        #as the most gradual angle is found, center the positions
        offset = (panelwidth-positions[-1])/2
        positions = [p+offset for p in positions][1:-1]
    else:
        #in case positions dont fit even at 90*, scale uniformly to fit
        coof = panelwidth/positions[-1]
        positions = [p*coof for p in positions][1:-1]
    
    startpts = [boundspreview.PointAtLength(p) for p in positions]
    
    boundspreviewnormal = boundspreview.UnitTangent
    
    print "mostgradualangle : {}".format(mostgradualangle)
    
    #debugging
    b = startpts 
    firstsegments = [poly.SegmentAt(0) for poly in polylines]
    upperg, lowerg = split_up_down(panelplane, firstsegments)
    try:
        uidx, upper = zip(*upperg)
    except:
        pass
    try:
        lidx, lower = zip(*lowerg) 
    except:
        pass
    #debugging end
    
    #loop start
    iteration_counter = 0
    max_iterations = 5 #was 5
    
    #save og before changes
    ogpolylines = [rg.Polyline(list(poly)) for poly in polylines]
    lastflags = [False for _ in ogpolylines]
    
    # set up a dict to hold each quadrant’s offset
    offsetsdict = dict.fromkeys(('upperleft','upperright','lowerleft','lowerright'), 0)
    
    while iteration_counter < max_iterations:
        iteration_counter += 1
        #print [p.Length for p in polylines]
        
        #prefilter
        for p in polylines:
            p.MergeColinearSegments(GLOBAL_TOL, False)
            p.DeleteShortSegments(GLOBAL_TOL)
    
        #print [p.Length for p in polylines]
        
        firstsegments = [poly.SegmentAt(0) for poly in polylines]
        sorted_curves, lookupidx = sort_lines(panelplane, firstsegments)
        
        polylines = apply_perm(polylines, lookupidx)
        conduitsizes = apply_perm(conduitsizes, lookupidx)
        lastflags = apply_perm(lastflags, lookupidx)
        orig_idx = apply_perm(orig_idx, lookupidx)
        sorted_polys = polylines
        
        #snapping pass
        #print "iteration ", iteration_counter
        #print "prepass", lastflags
        
        flags, polylines = zip(*[snappolyline(polyline, panelplane, point, mflag) for polyline, point, mflag in zip(sorted_polys, startpts, lastflags)])
        #flags, polylines = zip(*[snappolyline(polyline, panelplane, point, True) for polyline, point, mflag in zip(sorted_polys, startpts, lastflags)])
        
        lastflags = list(flags)
        
        #print [p.Length for p in polylines], "here"
        
        #print "afterpass", lastflags
        
        #polylines = snapped
        tweakedpoly = []
        
        for poly, conduitsize, conduitsize_, pidx in zip(polylines, conduitsizes, conduitsizes_, range(len(polylines))):
            #print "here", iteration_counter
            od_size = LineUtils.ConduitLookup.get_specs(conduitsize)["od"]
            #linearstub = LineUtils.ConduitLookup.get_specs(conduitsize)['linear_section']
            #bendradius = LineUtils.ConduitLookup.get_specs(conduitsize)['min_bend']
            linearstub = LineUtils.ConduitLookup.get_specs(conduitsize_)['linear_section']
            bendradius = LineUtils.ConduitLookup.get_specs(conduitsize_)['min_bend']
            
            startcut = LineUtils._compute_cut(bendradius, linearstub, 90)
            
            #to be safe calculated at 2x 90 degree turns + the linear section between
            #checklength = 0#experiment at 0
            checklength = lineargap + startcut*2 
            
            #print checklength
            
            first_s = poly.SegmentAt(0)
            first_s_len = first_s.Length
            
            next_s_len = float('inf')
            if poly.SegmentCount > 1:
                next_s = poly.SegmentAt(1)
                next_s_len = next_s.Length
            
            polypts = list(poly)
            
            filteredpts = polypts
            
            #print "iteration ", iteration_counter
            
            
            
            #checking first and second for potentiall shortness
            if first_s.Length < checklength or next_s_len < checklength:
                #print "here"
                lastflags[pidx] = False #reset flag
                #print next_s_len < checklength
                if len(polypts) == 2:
                    #unchanged
                    pass
                elif abs(boundspreviewnormal*first_s.UnitTangent) < GLOBAL_TOL or next_s_len < checklength:
                    #if the first segment is short and perpendicular to panel
                    #need to also remove second to fix it
                    #or if the second is too short need to remove 1st and 2nd
                    #remove first 2 segments
                    if len(polypts) > 3:
                        filteredpts = polypts[2:]
                    else:
                        filteredpts = polypts[1:]
                    #print "here"
                else:
                    #print "here"
                    #remove first segment, leave just last one
                    filteredpts = polypts[1:]
                #else:
                    #remove first 2 segments
                    #filteredpts = polypts[2:]
            
            else:
                pass
                #print "passed"
            
            if abs(boundspreviewnormal*first_s.UnitTangent) < GLOBAL_TOL and False:
                #print "here"
                filteredpts = filteredpts[1:] #remove 1 more
    #        if next_s_len < checklength:
    #            #print next_s_len
    #            filteredpts = filteredpts[1:] #remove 1 more
            
            tweakedpoly.append(rg.Polyline(filteredpts))
        
        #print "afterlenchecks", lastflags
        
        #reassign
        polylines = tweakedpoly
    
    #print [p.Length for p in polylines]
    
    #snap too close segments
    adjustedpoly = []
    
    smallestangle = LineUtils.AngleLookup.ANGLES[0]
    #print smallestangle, "smallestangle"
    
    #prefilter
    for p in polylines:
        p.MergeColinearSegments(GLOBAL_TOL, False)
        p.DeleteShortSegments(GLOBAL_TOL)
    
    checkpolys = polylines
    c = []
    
    
    sorters = []
    upperleft = []
    upperright = []
    lowerleft = []
    lowerright = []
    
    #print polylines
    #print [p.Length for p in polylines]
    
    #print "START HERE"
    
    for pl, p, idx in zip(polylines, startpts, range(len(polylines))):
        nc = pl.ToNurbsCurve()
        p2 = nc.PointAtLength(min(pl.Length-GLOBAL_TOL, 20.0))
        sline = rg.Line(p, p2)
        sorters.append(sline)
        u, l = split_up_down(panelplane, [sline])
        if u:
            #print u[0][1]
            dir = classify_direction(panelplane, u[0][1], 0.0001)
            if dir == "left":
                upperleft.append(idx)
            else:
                upperright.append(idx)
        if l:
            dir = classify_direction(panelplane, l[0][1], 0.0001)
            #print dir
            if dir == "left":
                lowerleft.append(idx)
            else:
                lowerright.append(idx)
    
    #print "upperleft {}, upperright {}, lowerleft {}, lowerright {}".format(upperleft, upperright, lowerleft, lowerright)
    
    # build a lookup dict mapping each index to its “quadrant” name
    quadrant = {}
    quadrant.update({i: 'upperleft'   for i in upperleft})
    quadrant.update({i: 'upperright'  for i in upperright})
    quadrant.update({i: 'lowerleft'   for i in lowerleft})
    quadrant.update({i: 'lowerright'  for i in lowerright})
    
    #print quadrant
    #print offsetsdict
    
    #sortedsorters, lookupidx = sort_lines(panelplane, sorters)
    #
    #print lookupidx
    
    ##offset for 90 degree turns
    #curroffset = 0
    #upperleftoffset = 0
    #upperrightoffset = 0
    #lowerleftoffset = 0
    #lowerrightoffset = 0
    
    #resort for finalprocessing
    neworder = range(len(polylines))
    neworder = upperleft + upperright[::-1] + lowerleft + lowerright[::-1]
    
    polylines = apply_perm(polylines, neworder)
    conduitsizes = apply_perm(conduitsizes, neworder)
    startpts = apply_perm(startpts, neworder)
    orig_idx = apply_perm(orig_idx, neworder)
    
    #print neworder
    #neworder = [neworder[i] for i in neworder]
    
    for polyline, conduitsize, conduitsize_, point, sortidx in zip(polylines, conduitsizes, conduitsizes_, startpts, range(len(polylines))):
        #print sortidx
        q = quadrant.get(sortidx)
        #print loc
        
        polyline.MergeColinearSegments(GLOBAL_TOL, False)
        #rg.Polyline.MergeColinearSegments(GLOBAL_TOl, FALSE)
        
        od_size = LineUtils.ConduitLookup.get_specs(conduitsize)["od"]
        #linearstub = LineUtils.ConduitLookup.get_specs(conduitsize)['linear_section']
        #bendradius = LineUtils.ConduitLookup.get_specs(conduitsize)['min_bend']
        linearstub = LineUtils.ConduitLookup.get_specs(conduitsize_)['linear_section']
        bendradius = LineUtils.ConduitLookup.get_specs(conduitsize_)['min_bend']
        
        #calculate for smallest angle
        startcut = LineUtils._compute_cut(bendradius, linearstub, smallestangle)
        
        minlength = lineargap + startcut*2 
        minimalraise = LineUtils.compute_raise(minlength, smallestangle)
        
        polypts = list(polyline)
        
        first_s = polyline.SegmentAt(0)
        firstp = polypts[0]
        secondp = polypts[1]
        otherpts2 = polypts[2:]
        
        c.append(first_s)
        
        #print first_s.UnitTangent
        #print  round(abs(boundspreviewnormal*first_s.UnitTangent))
        #print polyline.SegmentCount
        #print "___"
    
        _, planep = panelplane.RemapToPlaneSpace(point)
        _, firstplanep = panelplane.RemapToPlaneSpace(firstp)
        
        if abs(boundspreviewnormal*first_s.UnitTangent) < GLOBAL_TOL:
            heightshiftsigned = planep.Y - firstplanep.Y
            heightshift = abs(heightshiftsigned)
            #if startsegment is within minlength from panel exit
            #than shift it to panel exit
            if heightshift < minimalraise:# and False:
                print heightshift ,minimalraise
                #print "first trigger"
                _, secondplanep = panelplane.RemapToPlaneSpace(secondp)
                #print "shifting"
                remappedxy = panelplane.PointAt(planep.X, planep.Y, firstplanep.Z)
                remapped2nd = panelplane.PointAt(secondplanep.X, planep.Y, secondplanep.Z) 
                
                newpoly = rg.Polyline([remappedxy, remapped2nd]+otherpts2)
                adjustedpoly.append(newpoly)
            #else process shift at specified parameters
            else:
                #print "in here"
                anglecalc = LineUtils.fit_angle_to_height(minlength, heightshift)
                minfitted = LineUtils.smallest_ge(LineUtils.AngleLookup.ANGLES, anglecalc)
                
                offsetdist = abs(planep.Y -firstplanep.Y)
                
                #at the most gradual offset
                #mostgradualangle = 45
                #print mostgradualangle
                startcut_ = LineUtils._compute_cut(bendradius, linearstub, mostgradualangle)
                minlength_ = lineargap + startcut_*2 
                minimalraise_ = LineUtils.compute_raise(minlength_, mostgradualangle)
                minrun = LineUtils.compute_run(minlength_, mostgradualangle)
                minopp = LineUtils.compute_opposite(offsetdist, 90-mostgradualangle)
                
                _, secondplanep = panelplane.RemapToPlaneSpace(secondp)
                
                conditions = [
                    first_s.Length >= minopp+minlength,   #length of first segment has to be larger than minimal opposite righttriangle side and minimal length of 2 fitting + space between
                    offsetdist >= minimalraise_,  #it has to be shifted more than minimalraise else fittings + space between wont fit
                    offsetdist <= minimalraise_*offsetshitcoof,  #this is a visual addition to prevent extremely long angled segments
                    mostgradualangle < 90  #90 degree isnt angled, it has to start with straight segment, so its excluded
                ]
                
                #need to add 2 fittings at end
                #if first_s.Length >= minopp+minlength and offsetdist >= minimalraise_ and offsetdist <= minimalraise_*offsetshitcoof and mostgradualangle < 90: 
                if all(conditions): #too many conditions, more elegant this way
                    #print minimalraise_*offsetshitcoof
                    #print "can fit !!"
                    newp = first_s.PointAtLength(minopp) #pnt at distance and at parameter ISNT always same for lines
                    #panelplane.PointAt(minopp, secondplanep.Y, secondplanep.Z)
                    adjustedpoly.append(rg.Polyline([point, newp, secondp]+otherpts2))
                else:
                    #print "here"
                    #if point falls within plane, let it be
                    if abs(firstplanep.Y) <= panelwidth/2 and len(polylines) == 1:
                        #print "here"
                        adjustedpoly.append(polyline)
                    else:
                        #start offsets
                        curroffset = 0
                        
                        if offsetsdict[q] == 0:
                            offsetsdict[q] = minlength
                        else:
                            offsetsdict[q] = offsetsdict[q] + od_size + spacing
                        
                        curroffset = offsetsdict[q]
    #                    if curroffset == 0:
    #                        curroffset = minlength
    #                    else:
    #                        #add spacing and its diameter (diamter isnt super accurate but will do)
    #                        curroffset += od_size + spacing
                        
                        if secondplanep.X > 0:
                            newpone = panelplane.PointAt(curroffset, planep.Y, planep.Z)
                            newptwo = panelplane.PointAt(curroffset, secondplanep.Y, planep.Z)
                        else:
                            newpone = panelplane.PointAt(-curroffset, planep.Y, planep.Z)
                            newptwo = panelplane.PointAt(-curroffset, secondplanep.Y, planep.Z)
                        
                        adjustedpoly.append(rg.Polyline([point, newpone, newptwo, secondp]+otherpts2))
                            
                        #print "cant fit"
                
                #print planep.Y, firstplanep.Y, offsetdist, "___",minlength_,   minimalraise_, minrun, "__", minopp
                
                #
                #print anglecalc, minfitted
                
                #print minlength, heightshift, anglecalc, heightshiftsigned
                #print minfitted
                #print "___"
                
                #if panel exits dont fit for minimal segments length in a bundle
                #compress all to fit
                
                #if 90 degrees need extra processing
                if mostgradualangle >= 90:
                    pass
                    #adjustedpoly.append(polyline)
                #under 90 degrees gradual, do gradual directly out of panel
                else:
                    #print mostgradualangle
                    pass
                    #adjustedpoly.append(polyline)
            #print planep.Y
            #print firstp.Y
            
            #print "pass"
            
        #perpendicular
        else:
            #print "here"
            #check if it can connect
            _, secondplanep = panelplane.RemapToPlaneSpace(secondp)
            #print secondplanep
            #print planep
            secondshifted = rg.Point3d(secondplanep.X, planep.Y, secondplanep.Z)
            #print secondshifted
            checkdist = secondplanep.DistanceTo(secondshifted)
            #just a direct connection
            if checkdist<minlength and len(polypts) == 2 and removeshorts:
                #print "direct connection"
                #adjustedpoly.append(rg.Polyline([point, secondp]))
                pass
                adjustedpoly.append(rg.Polyline([point, secondp]))
            #90* connection
            else:
                #print "90* connection"
                shiftedinplane = panelplane.PointAt(secondshifted.X, secondshifted.Y, secondshifted.Z)
                #adjustedpoly.append(rg.Polyline([point, shiftedinplane, secondp]))
                adjustedpoly.append(rg.Polyline([point, shiftedinplane, secondp]+otherpts2))
            #print checkdist
            #print "perpendicular"
            #a = snappolyline(polyline, panelplane, point, False, 0.02)
            #print "aftersnap"
            #adjustedpoly.append(polyline)
            #not perpendicular to panel
            pass
        #print minimalraise
    
    readjustedpoly = []
    
    upperleftmin = 0
    upperrightmin = 0
    lowerleftmin = 0
    lowerrightmin = 0
    
    upperleftfs = []
    upperrightfs = []
    lowerleftfs = []
    lowerrightfs = []
    
    def finalsortkey(poly):
        _, p = panelplane.RemapToPlaneSpace(list(poly)[0])
        return round(p.Y, 3)
    
    def fit_number(lst, x ,spacing, tol = GLOBAL_TOL):
        if not lst:
            return x
            
        s=sorted(lst)
        c=x
        
        while True:
            blocker=None
            for y in s:
                # only tolerate being closer than (spacing - GLOBAL_TOL)
                if abs(c-y) < spacing - tol:
                    blocker=y
                    break
            # no conflicts -> c fits everywhere
            if blocker is None:
                return c
            # bump c up just past the blocker by full spacing
            c=blocker + spacing
    
    fittol = 0.01
    
    for polyline, conduitsize in zip(adjustedpoly, conduitsizes):
        od_size = LineUtils.ConduitLookup.get_specs(conduitsize)["od"]
        linearstub = LineUtils.ConduitLookup.get_specs(conduitsize)['linear_section']
        bendradius = LineUtils.ConduitLookup.get_specs(conduitsize)['min_bend']
        
        #calculate for smallest angle
        startcut = LineUtils._compute_cut(bendradius, linearstub, smallestangle)
        
        minlength = lineargap + startcut*2 
        
        secondsegment = polyline.SegmentAt(1) if polyline.SegmentCount > 1 else polyline.SegmentAt(0)
        firstslen = polyline.SegmentAt(0).Length
        
        u, l = split_up_down(panelplane, [secondsegment])
        
        minoffset = minlength
        
        spcng = od_size + spacing
        #minlen = minlength-spcng
        minlen = minlength
        #print "spacing {}".format(spcng)
        
        
        if u:
            #print u[0][1]
            dir = classify_direction(panelplane, u[0][1], 0.0001)
            if dir == "left":
                if upperleftmin == 0:
                    upperleftmin = minlen
                    #
                else:
                    upperleftmin += spcng
                #minoffset = upperleftmin
                #upperleftfs.append(max(firstslen, upperleftmin))
                minoffset = fit_number(upperleftfs, upperleftmin, spcng, fittol) 
                upperleftfs.append(max(firstslen, minoffset))
            else:
                if upperrightmin == 0:
                    upperrightmin = minlen
                else:
                    upperrightmin += spcng
                #minoffset = upperrightmin
                #upperrightfs.append(max(firstslen, upperrightmin))
                minoffset = fit_number(upperrightfs, upperrightmin, spcng, fittol) 
                upperrightfs.append(max(firstslen, minoffset))
        if l:
            dir = classify_direction(panelplane, l[0][1], 0.0001)
            #print dir
            if dir == "left":
                if lowerleftmin == 0:
                    lowerleftmin = minlen
                else:
                    lowerleftmin += spcng
                #minoffset = lowerleftmin
                #lowerleftfs.append(max(firstslen, lowerleftmin))
                #print lowerleftfs
                #print lowerleftmin
                minoffset = fit_number(lowerleftfs, lowerleftmin, spcng, fittol) 
                lowerleftfs.append(max(firstslen, minoffset))
                #print minoffset
                #minoffset = 0
            else:
                if lowerrightmin == 0:
                    lowerrightmin = minlen
                else:
                    lowerrightmin += spcng
                #minoffset = lowerrightmin
                #lowerrightfs.append(max(firstslen, lowerrightmin))
                minoffset = fit_number(lowerrightfs, lowerrightmin, spcng, fittol) 
                lowerrightfs.append(max(firstslen, minoffset))
        
        #ensure minlength for all segments, but calculated first only for first obv
        extended = extend_polyline_segments(polyline, minlength, 'singular')
        extended = extend_polyline_segments(extended, minoffset, 'singular_first')
        #extended = extend_polyline_segments(polyline, 0, 'singular')
        polyline = extended
        
        #iteratively clean for a couple iterations
        for j in range(5):
            unspiked = remove_spikes(polyline, 0.0001)
            if unspiked.SegmentCount <= 3:
                pass
                minlength = startcut*2  #let it fit without linear segment
                
            cleaned = clean_polyline(unspiked, minlength)
    
            polyline = cleaned
        
        #extended = extend_polyline_segments(polyline, minlength, 'singular')
        #extended = polyline
        #print minlength
        
        readjustedpoly.append(polyline)
        #readjustedpoly.append(extended)
        
        
    ##finalsort
    #firstsegments = [poly.SegmentAt(1) for poly in adjustedpoly]
    ##print firstsegments
    #sorted_curves, lookupidx = sort_lines(panelplane, firstsegments)
    #
    #print lookupidx
    
    adjustedpoly = restore_input_order(adjustedpoly, orig_idx)
    readjustedpoly = restore_input_order(readjustedpoly, orig_idx)
    polylines = restore_input_order(polylines, orig_idx)
    
    snapped = polylines
    
    # ---- extra per-side push using 2nd segment in panelplane X ----
    
    origin_ok, origin_uv = panelplane.RemapToPlaneSpace(panelplane.Origin)
    
    left_indices = []
    right_indices = []
    center_indices = []
    mid_x_values = []
    
    for idx, pl in enumerate(readjustedpoly):
        if pl.SegmentCount > 1:
            seg = pl.SegmentAt(1)
        else:
            seg = pl.SegmentAt(0)
    
        mid_pt = seg.PointAt(0.5)
        remap_ok, mid_uv = panelplane.RemapToPlaneSpace(mid_pt)
    
        if remap_ok:
            mid_x = mid_uv.X
            dx = mid_x - origin_uv.X
        else:
            mid_x = None
            dx = 0.0
    
        mid_x_values.append(mid_x)
    
        if dx > GLOBAL_TOL:
            left_indices.append(idx)
        elif dx < -GLOBAL_TOL:
            right_indices.append(idx)
        else:
            center_indices.append(idx)
    
    # if some land exactly on origin X, assign them to the smaller side
    for idx in center_indices:
        if len(left_indices) <= len(right_indices):
            left_indices.append(idx)
        else:
            right_indices.append(idx)
    
    # find bundles: indices whose 2nd segment X matches some other 2nd segment X
    stacked_indices = set()
    for i in range(len(mid_x_values)):
        x_i = mid_x_values[i]
        if x_i is None:
            continue
        for j in range(len(mid_x_values)):
            if i == j:
                continue
            x_j = mid_x_values[j]
            if x_j is None:
                continue
            if abs(x_j - x_i) <= GLOBAL_TOL:
                stacked_indices.add(i)
                break
    
    n_left = len(left_indices)
    n_right = len(right_indices)
    print "n_left, n_right:", n_left, n_right
    
    extra_left = 0.0
    extra_right = 0.0
    
    #for now
    smallestconduit = min(conduitsizes_)
    
    if spacing_ > 0.0:
        if n_left > 1:
            extra_left = 0.5 * (spacing_ + smallestconduit) * float(n_left - 1)
        if n_right > 1:
            extra_right = 0.5 * (spacing_ + smallestconduit) * float(n_right - 1)
    
    #print extra_left, extra_right
    
    # direction along which the 2nd segment should move "away" in panelplane
    push_axis = rg.Vector3d(panelplane.XAxis)  # change to YAxis if that is your push dir
    if not push_axis.IsZero:
        push_axis.Unitize()
    
        new_readjusted = []
    
        for idx, pl in enumerate(readjustedpoly):
            d = 0.0
            if idx in left_indices:
                d = extra_left
            elif idx in right_indices:
                d = -extra_right  # negative to move away from origin on the other side
    
            # only push if:
            # - this index is part of a stacked bundle (same X as others)
            # - 2nd segment is NOT the last one
            if d != 0.0 and idx in stacked_indices:
                seg_count = pl.SegmentCount
                if seg_count > 2 and pl.Count > 2:
                    move_vec = rg.Vector3d(push_axis)
                    move_vec = move_vec * d
    
                    pts = list(pl)
                    # move only the 2nd segment endpoints: pts[1] and pts[2]
                    pts[1] = pts[1] + move_vec
                    pts[2] = pts[2] + move_vec
    
                    new_pl = rg.Polyline(pts)
                    new_readjusted.append(new_pl)
                else:
                    new_readjusted.append(pl)
            else:
                new_readjusted.append(pl)
    
        readjustedpoly = new_readjusted
    
    # ---- end extra per-side push ----
    
    #cached
    spacing = spacing_
    conduitsize = gh.DataTree[System.Object]()#conduitsizes_
    polylines = gh.DataTree[System.Object]()
    
    conduitsize.AddRange(conduitsizes_, defaultpath)
    polylines.AddRange(readjustedpoly, defaultpath)
    
    polylines_LR = gh.DataTree[System.Object]()
    conduitsize_LR = gh.DataTree[System.Object]()
    
    path_left = gh.Kernel.Data.GH_Path(0)
    path_right = gh.Kernel.Data.GH_Path(1)
    
    for idx, pl in enumerate(readjustedpoly):
        size = conduitsizes_[idx]
    
        if idx in left_indices:
            polylines_LR.Add(pl, path_left)
            conduitsize_LR.Add(size, path_left)
        elif idx in right_indices:
            polylines_LR.Add(pl, path_right)
            conduitsize_LR.Add(size, path_right)
        else:
            # should not happen because center_indices are reassigned,
            # but keep it in defaultpath just in case
            polylines_LR.Add(pl, defaultpath)
            conduitsize_LR.Add(size, defaultpath)
    
    #print conduitsize.Branch(0)
    #print polylines.Branch(0)
    #print  gh.DataTree[System.Int32]([0], defaultpath)
    
    sp = LineUtils.Spacing()
    
    #sp_results = sp.Run(polylines, conduitsize, optionalkeys = gh.DataTree[System.Int32]([0], defaultpath),
    #                    spacing = spacing, perpanel = False, perlevel = False, 
    #                    pulltogether = True, pushflag = False, pullstart = pullstart)
    
    #pushflag is resource intensive
    sp_results = sp.Run(polylines_LR, conduitsize_LR, optionalkeys = gh.DataTree[System.Int32]([0], defaultpath),
                        spacing = spacing, perpanel = True, perlevel = False, 
                        pulltogether = True, pushflag = False, pullstart = pullstart)
    
    rawlinelookup, linelookup, rebuiltree, polys, polys2, finaltree, treeflags, doublepolys, Boundaryobjects = sp_results
    
    respaced = []
    
    planeY = panelplane.YAxis
    planeY.Unitize()
    
    cutstart = True
    
    if finaltree.BranchCount <= 1:
        cutstart = False
        #for simplicity of unification
        
        if path_left in finaltree.Paths:
            finaltree.AddRange([], path_right)
        else:
            finaltree.AddRange([], path_left)
    
    #if only one line on a side and it would be reasonable to just run it straight
    porigin = panelplane.Origin
    panelXax = panelplane.XAxis
    
    for branch in finaltree.Branches:
        if len(branch) == 1:
            #checking hits
            dpolyline = branch[0]
            firstseg = dpolyline.SegmentAt(0)
            lastseg = dpolyline.SegmentAt(dpolyline.SegmentCount - 1)
            hitspanel1 = LineUtils.lxr(lastseg, [panel], True)
            hitspanel2 = LineUtils.lxr(firstseg, [panel], True)
            
            shortchecklen = porigin.DistanceTo(dpolyline.Last)
            manhcheck = shortchecklen <= manhattanradius
            #short segment manhattan
            if manhcheck:
                #print "shortie"
                checkline = rg.Line(dpolyline.Last,  panelXax)
                hitcheck = LineUtils.lxr(checkline, [panel], True)
                newp = checkline.ClosestPoint(porigin, False) #treat as infinite
                newpoly = rg.Polyline([newp, dpolyline.Last])
                branch[0] = newpoly
            else:
                if hitspanel1 and hitspanel2 and manhcheck:
                    #print "in panel"
                    newp = lastseg.ClosestPoint(porigin, False) #treat as infinite
                    newpoly = rg.Polyline([newp, dpolyline.Last])
                    branch[0] = newpoly
        else:
            for i in range(len(branch)):
                dpolyline = branch[i]
                #snake segments within a panel, special case
                if dpolyline.SegmentCount == 3:
                    firstseg = dpolyline.SegmentAt(0)
                    lastseg = dpolyline.SegmentAt(dpolyline.SegmentCount - 1)
                    hitspanel1 = LineUtils.lxr(lastseg, [panel], True)
                    hitspanel2 = LineUtils.lxr(firstseg, [panel], True)
                    if hitspanel1 and hitspanel2:
                        #print "in panel"
                        newpstart = firstseg.ClosestPoint(porigin, False) #treat as infinite
                        newpend = firstseg.ClosestPoint(dpolyline.Last, False) #treat as infinite
                        newpoly = rg.Polyline([newpstart, newpend])
                        branch[i] = newpoly
    if False:
    #if finaltree.BranchCount <= 1:
        for branch in finaltree.Branches:
            respaced.extend(list(branch))
    else:
        parameters0 = []
        parameters1 = []
        offsets0 = []
        offsets1 = []
        offsets_left_branch = []
        offsets_right_branch = []
        
        for j in [0, 1]:
    #        try:
            for poly in finaltree.Branch(j):
                startp = poly.First
                remap_ok, mid_uv = panelplane.RemapToPlaneSpace(startp)
                par = mid_uv.Y
                if j == 0:
                    parameters0.append(par)
                else:
                    parameters1.append(par)
    #        except:
    #            pass
        
        parameters0.sort()
        parameters1.sort()
        
        #print parameters0, parameters1
        
        if pullstart:
            new0, new1 = snap_parameters(parameters0, parameters1)
        else:
            new0, new1 = parameters0, parameters1
        
        #print new0, new1
        
        workwidth = 1.0
        if sidesextra * 2 < panelwidth * 0.5:
            workwidth = panelwidth - sidesextra * 2
        else:
            workwidth = panelwidth
        
        panelzero = panelplane.Origin.Y
        allpars = new0 + new1
        minpar_ = min(allpars)
        maxpar_ = max(allpars)
        midpar_ = minpar_ * 0.5 + maxpar_ * 0.5
        pardomain_ = abs(maxpar_ - minpar_)
        paroffset = midpar_ - 0
        scalefactor = 1.0
        
        if pardomain_ > workwidth:
            scalefactor = workwidth / pardomain_
        
        #scalefactor = 1.0
        
        for p0, n0 in zip(parameters0, new0):
            offset0 = n0 - p0 - paroffset
            off0 = p0 + offset0
            scalef = off0 * (1 - scalefactor)
            offset0 -= scalef
            ovec0 = copy.deepcopy(planeY)
            ovec0 *= offset0
            offsets0.append(ovec0)
        
        for p1, n1 in zip(parameters1, new1):
            offset1 = n1 - p1 - paroffset
            off1 = p1 + offset1
            scalef = off1 * (1 - scalefactor)
            offset1 -= scalef
            ovec1 = copy.deepcopy(planeY)
            ovec1 *= offset1
            offsets1.append(ovec1)
        
        #print offsets0, offsets1
        
        # build offsets per-branch, matching branch poly order
        left_polys = list(finaltree.Branch(0))
        right_polys = list(finaltree.Branch(1))
        used0 = [False] * len(parameters0)
        used1 = [False] * len(parameters1)
        tol_par = 1e-6
        
        porigin = panelplane.Origin
        
        run_else = False
        
        for poly in left_polys:
            startp = poly.First
            remap_ok, mid_uv = panelplane.RemapToPlaneSpace(startp)
            par = mid_uv.Y
            offset_vec = None
            for k in range(len(parameters0)):
                if not used0[k]:
                    if abs(parameters0[k] - par) <= tol_par:
                        offset_vec = offsets0[k]
                        used0[k] = True
                        break
            offsets_left_branch.append(offset_vec)
        
        for poly in right_polys:
            startp = poly.First
            remap_ok, mid_uv = panelplane.RemapToPlaneSpace(startp)
            par = mid_uv.Y
            offset_vec = None
            for k in range(len(parameters1)):
                if not used1[k]:
                    if abs(parameters1[k] - par) <= tol_par:
                        offset_vec = offsets1[k]
                        used1[k] = True
                        break
            offsets_right_branch.append(offset_vec)
        
        # original respaced (not strictly needed, but kept)
        for branch in finaltree.Branches:
            respaced.extend(list(branch))
        
        # reorder to match readjustedpoly indexing
        left_set = set(left_indices)
        right_set = set(right_indices)
        
        respaced_ordered = []
        offsets_respaced = []
        left_i = 0
        right_i = 0
        
        for idx in range(len(readjustedpoly)):
            if idx in left_set:
                respaced_ordered.append(left_polys[left_i])
                offsets_respaced.append(offsets_left_branch[left_i])
                left_i += 1
            elif idx in right_set:
                respaced_ordered.append(right_polys[right_i])
                offsets_respaced.append(offsets_right_branch[right_i])
                right_i += 1
            else:
                respaced_ordered.append(readjustedpoly[idx])
                offsets_respaced.append(None)
        
        respaced = respaced_ordered
        # offsets_respaced now has same indexing as respaced / readjustedpoly
    
    rerespaced = []
    
    trimdist = 1.0 #remove 1 inch
    
    for rspcd, ovec in zip(respaced, offsets_respaced):
        newpoly = copy.deepcopy(list(rspcd))
        trnsfrm = rg.Transform.Translation(ovec)
        for j in [0, 1]:
            newpoly[j].Transform(trnsfrm)
        
        if cutstart and pullstart:
            cutvec = rg.Vector3d(newpoly[0] - newpoly[1])
            cutvec.Unitize()
            cutvec *= -trimdist
            trimsf = rg.Transform.Translation(cutvec)
            newpoly[0].Transform(trimsf)
    
        newcrv = rg.PolylineCurve(newpoly)
        rerespaced.append(newcrv)
    
reconnected = rerespaced
# ---------- end ghpython_script_6 ----------
custom_preview_lineweights = CustomPreviewLineweights(Geometry=data_45, Shader=colour_swatch, Thickness=number_slider_6, Absolute=False)  # disabled
data_53 = Data(data_51)
data_54 = Data(data_49)
deconstruct_plane_2 = DeconstructPlane(Plane=data_54)  # -> Origin, XAxis, YAxis, ZAxis
end_points = EndPoints(Curve=data_53)  # -> Start, End
number_slider_7 = Slider(8, range=0..15)
number_slider_8 = Slider(3.8, range=0..10)  # disabled
colour_swatch_2 = ColourSwatch(SwatchColor=RGB(255, 0, 0))  # disabled
bounding_box = BoundingBox(Content=data_51, Plane=PlaneXY(0, 0, 0), UnionBox=True)  # -> Box, Box_2
number_slider_9 = Slider(2.5, range=0..10)  # disabled
number_slider_10 = Slider(1, range=0..1)  # disabled
line = Line(StartPoint=deconstruct_plane_2.Origin, EndPoint=end_points.End)
discontinuity = Discontinuity(Curve=line, Level=1)  # -> Points, Parameters
boolean_toggle_5 = BooleanToggle(False)  # disabled
number_slider_11 = Slider(0, range=-150..150)
boolean_toggle_6 = BooleanToggle(True)  # disabled
data_55 = Data(ghpython_script_6.reconnected)  # disabled
boolean_toggle_7 = BooleanToggle(False)  # disabled
boolean_toggle_8 = BooleanToggle(False)  # disabled
boolean_toggle_9 = BooleanToggle(True)  # disabled
boolean_toggle_10 = BooleanToggle(True)  # disabled
data_56 = Data(ghpython_script_6.polylines_LR)  # disabled
data_57 = Data(data_56)  # disabled
ghpython_script_7 = GhPythonScript(LineUtils=lineutils, polylines=data_57, refresh=button, randominside=boolean_toggle_4)  # -> out, randomconduitsize; inputs polylines: tree, randominside: Boolean; disabled
# ---------- ghpython_script_7: Python ----------
import Rhino.Geometry as rg
import random
import System
import Grasshopper as gh
import itertools

print LineUtils.ConduitLookup.SIZES

lkpsizes = [0.5, 0.75, 0.75, 1.0]#, 1.5, 4.0]

randomconduitsize = gh.DataTree[System.Object]()

for path in polylines.Paths:
    objcnt = polylines.Branch(path)
    lkp = random.choice(lkpsizes)
    if randominside:
        items = [random.choice(lkpsizes) for _ in range(len(objcnt))]
    else:
        items = list(itertools.repeat(lkp,len(objcnt)))
    randomconduitsize.AddRange(items, path)
# ---------- end ghpython_script_7 ----------
data_58 = Data(ghpython_script_6.finaltree)  # disabled
point_order = PointOrder(Points=discontinuity.Points)
populate_geometry = PopulateGeometry(Geometry=bounding_box.Box, Count=Slider(2, range=0..15), Seed=Slider(4, range=0..10))
data_59 = Data(data_51)
data_60 = Data(line)
discontinuity_2 = Discontinuity(Curve=data_56, Level=1)  # -> Points, Parameters; disabled
xy_plane = XYPlane(Origin=Point(0, 0, 0))
custom_preview_lineweights_2 = CustomPreviewLineweights(Geometry=data_55, Shader=colour_swatch_2, Thickness=number_slider_8, Absolute=False)  # disabled
data_61 = Data(data_59)
vector_xyz_2 = VectorXYZ(XComponent=Slider(0, range=-150..150), YComponent=Slider(-3.85, range=-150..150), ZComponent=0)  # -> Vector, Length
point_order_2 = PointOrder(Points=discontinuity_2.Points)  # disabled
ghpython_script_8 = GhPythonScript(
    LineUtils=lineutils,
    polylines=data_57,
    conduitsize=ghpython_script_7.randomconduitsize,
    spacing=number_slider_9,
    perpanel=boolean_toggle_10,
    perlevel=boolean_toggle_9,
    pulltogether=boolean_toggle_6,
    pushflag=boolean_toggle_7,
    prefilter=boolean_toggle_8,
    speedmode=boolean_toggle_5)  # -> out, rebuiltree, simplify(finaltree), treeflags, doublepolys; inputs polylines: tree of Polyline, conduitsize: tree, optionalkeys: tree, perpanel: Boolean, perlevel: Boolean, pulltogether: Boolean, pushflag: Boolean, prefilter: Boolean, speedmode: Boolean; disabled
# ---------- ghpython_script_8: Python ----------
"""
GH Python (IronPython)
Description: Space and bundle conduit polylines with optional panel grouping and preprocessing.

Inputs:
    LineUtils    : LineUtils                 — helper class instance used for spacing logic
    polylines    : DataTree[rg.Polyline]     — main input, tree of conduit centreline polylines
    conduitsize  : DataTree[float]           — conduit size per polyline; tree length must match polylines
    optionalkeys : DataTree[float]           — optional weights/keys influencing conduit ordering/positions
    spacing      : float                     — target centre-to-centre distance between conduits
    perpanel     : bool                      — group polylines within a bundle by panel (less optimal, prettier)
    pulltogether : bool                      — enable denser branch packing inside bundles
    pushflag     : bool                      — increase spacing between different bundles (slower to compute)
    prefilter    : bool                      — extra preprocessing for jittery grids (slower, but cleaner input)
    speedmode    : bool                      — fast approximate mode (cached axis lookup, no prefilter/pushflag)

Outputs:
    finaltree : DataTree[rg.Polyline] — spaced-out polylines matching the structure of `polylines` input

Note:
    All other component outputs are optional / dev-only; see LineUtils.Spacing() docs for details.
"""

ghenv.Component.Message = "v0.91 spacing shell"

sp = LineUtils.Spacing()
sp_results = sp.Run(polylines, conduitsize, optionalkeys, spacing, perpanel, 
                    perlevel, pulltogether, pushflag, pullstart = True, 
                    bimmode = perpanel, prefilter = prefilter, 
                    speedmode = speedmode)
rawlinelookup, linelookup, rebuiltree, polys, polys2, finaltree, treeflags, doublepolys, Boundaryobjects = sp_results
# ---------- end ghpython_script_8 ----------
project = Project(Geometry=populate_geometry, Plane=xy_plane)  # -> Geometry, Transform

# ---- group: starr 2
data_62 = Data(Tree({0}: [Plane(origin=(983.5537767, 2749.406289, 0), x=(-0.5, 0.8660254038, 0), y=(-0.8660254038, -0.5, 0))], {1}: [Plane(origin=(1490.813029, 2080.08048, 0), x=(-0.5, 0.8660254038, 0), y=(-0.8660254038, -0.5, 0))], {2}: [Plane(origin=(1921.168394, 156.2105707, 0), x=(0, 1, 0), y=(-1, 0, 0))], {3}: [Plane(origin=(2030.537906, -1.601366599, 0), x=(0, 1, 0), y=(-1, 0, 0))], {4}: [Plane(origin=(1040.003658, 2785.247834, 0), x=(-0.5, 0.8660254038, 0), y=(-0.8660254038, -0.5, 0))], {5}: [Plane(origin=(1845.461411, 983.3827256, 0), x=(0, 1, 0), y=(-1, 0, 0))], {6}: [Plane(origin=(1963.890227, 0.3145388041, 0), x=(0, 1, 0), y=(-1, 0, 0))], {7}: [Plane(origin=(2893.466089, 1300.19179, 0), x=(0, 1, 0), y=(-1, 0, 0))]))
data_63 = Data(Tree({0}: [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], {1}: [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], {2}: [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], {3}: [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], {4}: [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], {5}: [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], {6}: [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], {7}: [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]))
data_64 = Data(Tree({0}: [0.75, 0.75, 0.75, 0.75], {1}: [0.75, 0.75], {2}: [0.75, 0.75, 0.75, 0.75], {3}: [0.75, 0.75, 0.75], {4}: [0.75], {5}: [0.75, 0.75, 0.75, 0.75], {6}: [0.75], {7}: [0.75, 0.75, 0.75, 0.75, 0.75, 0.75, 0.75, 0.75, 0.75]))
data_65 = Data(1)
data_66 = Data(Tree({0}: [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], {1}: [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], {2}: [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], {3}: [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], {4}: [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], {5}: [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], {6}: [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], {7}: [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]))

# ---- group: starr 1
data_67 = Data(Tree({0}: [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], {1}: [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], {2}: [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], {3}: [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], {4}: [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], {5}: [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], {6}: [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], {7}: [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], {8}: [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], {9}: [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], {10}: [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]))
data_68 = Data(Tree({0}: [Plane(origin=(983.5537767, 2749.406289, 0), x=(-0.5, 0.8660254038, 0), y=(-0.8660254038, -0.5, 0))], {1}: [Plane(origin=(3075.601292, 1405.620887, 0), x=(-1, 0, 0), y=(0, -1, 0))], {2}: [Plane(origin=(1490.813029, 2080.08048, 0), x=(-0.5, 0.8660254038, 0), y=(-0.8660254038, -0.5, 0))], {3}: [Plane(origin=(1921.168394, 156.2105707, 0), x=(0, 1, 0), y=(-1, 0, 0))], {4}: [Plane(origin=(2030.537906, -1.601366599, 0), x=(0, 1, 0), y=(-1, 0, 0))], {5}: [Plane(origin=(1040.003658, 2785.247834, 0), x=(-0.5, 0.8660254038, 0), y=(-0.8660254038, -0.5, 0))], {6}: [Plane(origin=(1845.461411, 983.3827256, 0), x=(0, 1, 0), y=(-1, 0, 0))], {7}: [Plane(origin=(1963.890227, 0.3145388041, 0), x=(0, 1, 0), y=(-1, 0, 0))], {8}: [Plane(origin=(2893.466089, 1300.19179, 0), x=(0, 1, 0), y=(-1, 0, 0))], {9}: [Plane(origin=(2453.110451, 2638.692766, 0), x=(-0.8660254038, -0.5, 0), y=(0.5, -0.8660254038, 0))], {10}: [Plane(origin=(1904.348309, -1362.689845, 0), x=(0, 1, 0), y=(-1, 0, 0))]))
data_69 = Data(Tree({0}: [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], {1}: [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], {2}: [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], {3}: [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], {4}: [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], {5}: [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], {6}: [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], {7}: [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], {8}: [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], {9}: [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], {10}: [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]))
data_70 = Data(Tree({0}: [0.75, 0.75, 0.75, 0.75, 0.75, 0.75, 0.75, 0.75, 0.75], {1}: [0.75, 0.75], {2}: [0.75, 0.75, 0.75, 0.75, 0.75, 0.75, 0.75, 0.75, 0.75, 0.75, 0.75, 0.75, 0.75, 0.75, 0.75, 0.75], {3}: [0.75, 0.75, 0.75, 0.75, 0.75, 0.75, 0.75], {4}: [0.75, 0.75, 0.75, 0.75, 0.75, 0.75, 0.75, 0.75, 0.75], {5}: [0.75, 0.75, 0.75, 0.75, 0.75, 0.75, 0.75, 0.75, 0.75, 0.75], {6}: [0.75, 0.75, 0.75, 0.75, 0.75, 0.75, 0.75, 0.75, 0.75, 0.75, 0.75, 0.75, 0.75], {7}: [0.75, 0.75, 0.75, 0.75, 0.75, 0.75, 0.75, 0.75], {8}: [0.75, 0.75, 0.75, 0.75, 0.75, 0.75, 0.75, 0.75, 0.75, 0.75, 0.75], {9}: [0.75, 0.75, 0.75, 0.75, 0.75, 0.75, 0.75, 0.75, 0.75, 0.75, 0.75, 0.75, 0.75, 0.75, 0.75, 0.75, 0.75, 0.75, 0.75, 0.75, 0.75, 0.75], {10}: [0.75, 0.75, 0.75, 0.75, 0.75, 0.75, 0.75, 0.75, 0.75, 0.75, 0.75, 0.75, 0.75, 0.75]))
data_71 = Data(1)

# ---- group: floor 1 biobloom
data_72 = Data(Tree({0}: [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], {1}: [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], {2}: [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], {3}: [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], {4}: [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], {5}: [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]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))
data_73 = Data(Tree({0}: [Plane(origin=(23100.50273, -43571.73893, 0), x=(-1, 0, 0), y=(0, -1, 0))], {1}: [Plane(origin=(22460.64603, -44136.72783, 0), x=(0, -1, 0), y=(1, 0, 0))], {2}: [Plane(origin=(23102.04131, -40842.57854, 0), x=(0, -1, 0), y=(1, 0, 0))], {3}: [Plane(origin=(26250.90139, -41434.08389, 0), x=(0, -1, 0), y=(1, 0, 0))], {4}: [Plane(origin=(26250.81832, -41445.65491, 0), x=(0, -1, 0), y=(1, 0, 0))], {5}: [Plane(origin=(24237.97328, -42803.93255, 0), x=(-1, 0, 0), y=(0, -1, 0))]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))
data_74 = Data(Tree({0}: [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], {1}: [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], {2}: [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], {3}: [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], {4}: [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], {5}: [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]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))
data_75 = Data(Tree({0}: ["1.25", "1.25"], {1}: ["1.25"], {2}: ["2"], {3}: ["0.75"], {4}: ["0.75"], {5}: ["1.25"]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))
data_76 = Data(1)

data_77 = Data(Tree({0}: [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], {1}: [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], {2}: [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], {3}: [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], {4}: [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], {5}: [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]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))
data_78 = Data(Tree({0}: [Plane(origin=(22870.62052, -41052.91271, 0), x=(-1, 0, 0), y=(0, -1, 0))], {1}: [Plane(origin=(22399.7191, -44104.21579, 0), x=(-1, 0, 0), y=(0, -1, 0))], {2}: [Plane(origin=(23218.698, -43542.8113, 0), x=(-1, 0, 0), y=(0, -1, 0))], {3}: [Plane(origin=(22871.69525, -41871.23618, 0), x=(-1, 0, 0), y=(0, -1, 0))], {4}: [Plane(origin=(20598.07942, -40936.95932, 0), x=(-1, 0, 0), y=(0, -1, 0))], {5}: [Plane(origin=(23218.698, -43619.74547, 0), x=(-1, 0, 0), y=(0, -1, 0))]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))
data_79 = Data(Tree({0}: [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], {1}: [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], {2}: [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], {3}: [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], {4}: [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], {5}: [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]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))
data_80 = Data(Tree({0}: [0.75, 0.75, 0.75], {1}: [0.75, 0.75, 0.75, 0.75, 0.75, 0.75, 0.75, 0.75, 0.75, 0.75, 0.75, 0.75, 0.75, 0.75, 0.75, 0.75, 0.75], {2}: [0.75, 0.75, 0.75, 0.75, 0.75], {3}: [0.75, 0.75, 0.75, 0.75, 0.75, 0.75, 0.75, 0.75, 0.75, 0.75, 0.75, 0.75, 0.75, 0.75, 0.75, 0.75, 0.75, 0.75, 0.75, 0.75, 0.75, 0.75, 0.75, 0.75], {4}: [0.75, 0.75, 0.75, 0.75, 0.75, 0.75, 0.75, 0.75], {5}: [0.75, 0.75, 0.75, 0.75]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))
data_81 = Data(1)

# ----
line_2 = Line(StartPoint=deconstruct_plane_2.Origin, EndPoint=project.Geometry)

python_2 = GhPythonScript(local_path="Gh\Panelconnections\Py\panelconnections.py")  # -> drawer_project, full_path; same code as python
file_2 = ReadFile(File=python_2.full_path, PerLineParse=False)

clean_tree = CleanTree(RemoveNulls=True, RemoveInvalid=True, RemoveEmpty=False, Tree=line_2)
entwine_2 = Entwine(Branch00=data_61, Branch01=clean_tree, FlattenInputs=True)  # -> flatten(Result)
move_2 = Move(Geometry=entwine_2, Motion=vector_xyz_2.Vector)  # -> Geometry, Transform
data_82 = Data(Slider(0, range=0..3))
data_83 = Data(ghpython_script_8.finaltree)  # disabled
pln = Plane(Tree({0;0}: [Plane(origin=(38.19230376, -2650.882333, 0), x=(-1, 0, 0), y=(0, -1, 0))], {1;0}: [Plane(origin=(228.7145079, -2731.189341, 0), x=(0, 1, 0), y=(-1, 0, 0))], {2;0}: []))
geo = Geometry(Tree({0}: [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], {1}: [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], {2}: []))
geo_2 = Geometry(Tree({0;0}: [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], {0;1}: [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]))
data_84 = Data(Tree({0;0}: [0.75, 0.75, 0.75, 0.75, 0.75, 0.75, 0.75, 0.75, 0.75, 0.75, 0.75, 0.75, 0.75, 0.75, 0.75, 0.75, 0.75, 0.75, 0.75, 0.75, 0.75, 0.75], {0;1}: [0.75]))
data_85 = Data(1)
data_86 = Data(move_2.Geometry)
entwine_3 = Entwine(Branch00=data_50, Branch01=data_86, FlattenInputs=True)
move_3 = Move(Geometry=entwine_3, Motion=reverse)  # -> Geometry, Transform
discontinuity_3 = Discontinuity(Curve=move_3.Geometry, Level=1)  # -> Points, Parameters
point_order_3 = PointOrder(Points=discontinuity_3.Points)
custom_preview_lineweights_3 = CustomPreviewLineweights(
    Geometry=move_3.Geometry,
    Shader=ColourSwatch(SwatchColor=RGB(0, 0, 0)),
    Thickness=Slider(4, range=0..10),
    Absolute=False)
ghpython_script_9 = GhPythonScript(LineUtils=lineutils, polylines=data_86, refresh=Button(), randominside=Toggle(True))  # -> out, randomconduitsize; inputs polylines: tree, randominside: Boolean; same code as ghpython_script_4
pln_2 = Plane(Tree({0;0}: [Plane(origin=(38.19230376, -2650.882333, 0), x=(-1, 0, 0), y=(0, -1, 0))], {1;0}: [Plane(origin=(228.7145079, -2731.189341, 0), x=(0, 1, 0), y=(-1, 0, 0))], {2;0}: []))
geo_3 = Geometry(Tree({0}: [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], {1}: [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], {2}: []))
geo_4 = Geometry(Tree({0;0}: [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], {0;1}: [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]))
data_87 = Data(Tree({0;0}: [0.75, 0.75, 0.75, 0.75, 0.75, 0.75, 0.75, 0.75, 0.75, 0.75, 0.75, 0.75, 0.75, 0.75, 0.75, 0.75, 0.75, 0.75, 0.75, 0.75, 0.75, 0.75], {0;1}: [0.75]))
data_88 = Data(1)
clean = CleanTree(RemoveNulls=True, RemoveInvalid=True, RemoveEmpty=invert(False), Tree=geo)  # -> simplify(Tree)
clean_2 = CleanTree(RemoveNulls=True, RemoveInvalid=True, RemoveEmpty=invert(False), Tree=pln)  # -> simplify(Tree)
clean_3 = CleanTree(RemoveNulls=True, RemoveInvalid=True, RemoveEmpty=invert(False), Tree=geo_2)  # -> simplify(Tree)
clean_4 = CleanTree(RemoveNulls=True, RemoveInvalid=True, RemoveEmpty=invert(False), Tree=data_84)  # -> simplify(Tree)
clean_5 = CleanTree(RemoveNulls=True, RemoveInvalid=True, RemoveEmpty=invert(False), Tree=geo_3)  # -> simplify(Tree)
clean_6 = CleanTree(RemoveNulls=True, RemoveInvalid=True, RemoveEmpty=invert(False), Tree=pln_2)  # -> simplify(Tree)
clean_7 = CleanTree(RemoveNulls=True, RemoveInvalid=True, RemoveEmpty=invert(False), Tree=geo_4)  # -> simplify(Tree)
clean_8 = CleanTree(RemoveNulls=True, RemoveInvalid=True, RemoveEmpty=invert(False), Tree=data_87)  # -> simplify(Tree)
stream_filter_6 = StreamFilter(Gate=data_82, Stream0=data_72, Stream1=data_77, Stream2=data_67, Stream3=data_66)
stream_filter_7 = StreamFilter(Gate=data_82, Stream0=data_74, Stream1=data_79, Stream2=data_69, Stream3=data_63)
stream_filter_8 = StreamFilter(Gate=data_82, Stream0=data_73, Stream1=data_78, Stream2=data_68, Stream3=data_62)
stream_filter_9 = StreamFilter(Gate=data_82, Stream0=data_75, Stream1=data_80, Stream2=data_70, Stream3=data_64)
stream_filter_10 = StreamFilter(Gate=data_82, Stream0=data_76, Stream1=data_81, Stream2=data_71, Stream3=data_65)
number_slider_12 = Slider(0, range=0..30)
number_slider_13 = Slider(126, range=0..200)
boolean_toggle_11 = BooleanToggle(False)
boolean_toggle_12 = BooleanToggle(True)
boolean_toggle_13 = BooleanToggle(False)
ghpython_script_10 = GhPythonScript(
    LineUtils=lineutils,
    panel=data_50,
    panelplane=data_49,
    polylines=entwine,
    conduitsizes=ghpython_script_4.randomconduitsize,
    spacing=data_48,
    removeshorts=boolean_toggle_11,
    pullstart=boolean_toggle_12,
    manhattanradius=Slider(0, range=0..300),
    devicemode=boolean_toggle_13,
    devicetolerance=number_slider_12)  # -> out, reconnected; inputs panel: Rectangle3d, panelplane: Plane, polylines: list of Polyline, conduitsizes: list, removeshorts: Boolean, pullstart: Boolean, devicemode: Boolean; same code as ghpython_script_6
data_89 = Data(data_52)
data_90 = Data(ghpython_script_9.randomconduitsize)
scale_nu = ScaleNU(Geometry=clean, Plane=clean_2, ScaleX=1, ScaleY=Slider(3, range=0..10), ScaleZ=1)  # -> Geometry, Transform
data_91 = Data("{*}")
scale_nu_2 = ScaleNU(Geometry=clean_5, Plane=clean_6, ScaleX=1, ScaleY=Slider(3, range=0..10), ScaleZ=1)  # -> Geometry, Transform
split_tree_6 = SplitTree(Data=stream_filter_6, Masks=flatten(data_91))  # -> Positive, Negative
split_tree_7 = SplitTree(Data=stream_filter_8, Masks=flatten(data_91))  # -> Positive, Negative
split_tree_8 = SplitTree(Data=stream_filter_7, Masks=flatten(data_91))  # -> Positive, Negative
split_tree_9 = SplitTree(Data=stream_filter_9, Masks=flatten(data_91))  # -> Positive, Negative
pflip_3 = FlipPlane(Plane=clean_2, ReverseX=False, ReverseY=True, SwapAxes=False)
construct_path_2 = ConstructPath(Indices=Slider(1, range=0..33))
data_92 = Data(data_90)
pflip_4 = FlipPlane(Plane=clean_6, ReverseX=False, ReverseY=True, SwapAxes=False)
data_93 = Data(split_tree_6.Positive)
data_94 = Data(split_tree_7.Positive)
data_95 = Data(split_tree_8.Positive)
data_96 = Data(split_tree_9.Positive)
data_97 = Data(stream_filter_10)
number_slider_14 = Slider(5, range=-50..50)  # disabled
ghpython_script_11 = GhPythonScript(
    Code=file_2,
    LineUtils=lineutils,
    Panel=data_50,
    Panelplane=data_49,
    Polylines=data_86,
    Conduitsizes=data_92,
    Spacing=data_48,
    Removeshorts=boolean_toggle_11,
    Pullstart=boolean_toggle_12,
    Manhattanradius=number_slider_13,
    Devicemode=boolean_toggle_13,
    Devicetolerance=number_slider_12)  # -> Out, Reconnected
ghpython_script_12 = GhPythonScript(
    LineUtils=lineutils,
    panel=data_50,
    panelplane=data_49,
    polylines=data_86,
    conduitsizes=data_92,
    spacing=data_48,
    removeshorts=boolean_toggle_11,
    pullstart=boolean_toggle_12,
    manhattanradius=number_slider_13,
    devicemode=boolean_toggle_13,
    devicetolerance=number_slider_12)  # -> out, reconnected; inputs panel: Rectangle3d, panelplane: Plane, polylines: list of Polyline, conduitsizes: list, removeshorts: Boolean, pullstart: Boolean, devicemode: Boolean
# ---------- ghpython_script_12: Python ----------
"""
GH Python (IronPython)
Description: Reconnect and re-route conduit polylines at a panel with optional Manhattan logic and device-aware tolerance.

Inputs:
    LineUtils       : LineUtils           — helper class instance used for panel reconnection logic
    panel           : rg.Rectangle3d      — panel outline in 3D
    panelplane      : rg.Plane            — panel plane used for projection and orientation
    polylines       : List[rg.Polyline]   — main input, list of conduit centreline polylines
    conduitsize     : List[float]         — conduit size per polyline; list length must match polylines
    spacing         : float               — target centre-to-centre distance between conduits
    removeshorts    : bool                — treat single-segment polylines as Manhattan runs if False; best to default at False
    pullstart       : bool                — when connections exit panel from both sides: single row if False, double row if True
    manhattanradius : float               — if end of a polyline is within this distance from panel centre, treat as Manhattan polyline
    devicemode      : bool                — enable device-aware logic using devicetolerance
    devicetolerance : float               — distance around connection rectangles within which a connection is considered covered

Outputs:
    reconnected : List[rg.Polyline] — list of reconnected / adjusted conduit polylines
"""

import Rhino.Geometry as rg
import Grasshopper as gh
import math
from collections import defaultdict
import itertools
import System
import random
import copy

class Panelconnection(object):
    def Run(self, LineUtils, panel, panelplane, polylines, conduitsizes, spacing = 1.0,
            removeshorts = False, pullstart = True, manhattanradius = 25.0,
            devicemode = False, devicetolerance = 0.0):
        
        GLOBAL_TOL = 0.01
        defaultpath = gh.Kernel.Data.GH_Path(0)
        unitX = rg.Vector3d(1, 0, 0)
        unitY = rg.Vector3d(0, 1, 0)
        unitZ = rg.Vector3d(0, 0, 1) 
        lineargap = 4.0 #4" between bends
        
        spacing_ = copy.deepcopy(spacing)
        spacing = 0
        
        conduitsizes_ = copy.deepcopy(conduitsizes)
        conduitsizes = [0 for _ in conduitsizes]
        
        #dont apply angled if offset is more than x minimal shifts
        offsetshitcoof = 10#2000#10.00
        
        sidesextra = 3.0
        
        n_items = len(polylines)
        orig_idx = list(range(n_items))  # tracks where each current item came from
        
        def x_positions(diameters, gap, angle_deg, padding, tol = GLOBAL_TOL):
            if angle_deg <= tol:
                return [0]
            ang = angle_deg * math.pi / 180.0
            n = len(diameters)
            if n == 0:
                return [0]
            # first center
            pos = padding + diameters[0] / 2.0
            if n == 1:
                return [0, pos, pos*2]
            centers = [pos]
            # subsequent centers
            for i in range(1, n):
                if ang == 0.0:
                    dx = diameters[i-1]/2.0 + gap + diameters[i]/2.0
                else:
                    dx = (diameters[i-1]/2.0 + gap + diameters[i]/2.0) / math.sin(ang)
                pos += dx
                centers.append(pos)
            # end of end padding
            end = centers[-1] + diameters[-1]/2.0 + padding
            values = [0]+centers+[end]
            rvalues = [round(v, 3) for v in values]
            
            return rvalues
        
        def split_up_down(plane, lines, tol = GLOBAL_TOL):
            origin_uv = plane.RemapToPlaneSpace(plane.Origin)[1]
            upper = []
            lower = []
            for i, ln in enumerate(lines):
                mid_uv = plane.RemapToPlaneSpace(ln.PointAt(0.5))[1]
                if mid_uv.X - origin_uv.X > tol:
                    upper.append((i, ln))
                else:
                    lower.append((i, ln))
            return upper, lower
        
        def classify_direction(plane, line, tol = GLOBAL_TOL):
            d = rg.Vector3d(line.Direction)
            d.Unitize()
            ax_y = rg.Vector3d(plane.XAxis)
            ax_x = rg.Vector3d(plane.YAxis)
            
            if abs(d * ax_y) >= 1.0 - tol:
                return 'straight'
                
            if d * ax_x > 0:
                return 'right'
            return 'left'
        
        def _sort_block(plane, items, tag, is_upper):
            if tag == 'straight':
                #key_fun = lambda it: plane.RemapToPlaneSpace(it[1].PointAtStart)[1].Y
                key_fun = lambda it: plane.RemapToPlaneSpace(it[1].From)[1].Y
                reverse_flag = False#True  # always descending Y
            else:
                #key_fun = lambda it: plane.RemapToPlaneSpace(it[1].PointAtStart)[1].X
                key_fun = lambda it: plane.RemapToPlaneSpace(it[1].From)[1].X
                if tag == 'left':
                    reverse_flag = is_upper  # upper -> asc lower -> desc
                else:  # 'right'
                    reverse_flag = not is_upper      # upper -> desc lower -> asc
            
            return sorted(items, key=key_fun, reverse=reverse_flag)
        
        def sort_lines(plane, lines, tol = GLOBAL_TOL):
            upper, lower = split_up_down(plane, lines, tol)
            #lower = []
            ordered = []
            
            for grp, is_upper in ((upper, False), (lower, True)):
                buckets = {'left': [], 'straight': [], 'right': []}
                tagorder = ['left', 'straight', 'right']
                if is_upper:
                    #tagorder.reverse()
                    pass
                
                #print "is_upper ", is_upper
                #print tagorder
                
                for idx, ln in grp:
                    buckets[classify_direction(plane, ln, tol)].append((idx, ln))
                
                #print buckets
                
                for tag in tagorder:
                    ordered.extend(_sort_block(plane, buckets[tag], tag, is_upper))
                    
            sorted_lines = [item[1] for item in ordered]
            index_map = [item[0] for item in ordered]
            
            return sorted_lines, index_map
        
        def snappolyline(polyline, plane, point, moveflag = False, tol = GLOBAL_TOL):
            if polyline.SegmentCount <= 2:
                #print tol
                return [False, polyline]
            
            firstsegment = polyline.SegmentAt(0)
            fsdir = firstsegment.UnitTangent
            planeX = plane.XAxis
            dot = fsdir*planeX
            
            result, targetplanept = plane.RemapToPlaneSpace(point)
                    
            newpoly = [None, None]
            
            polypts = list(polyline)
            firstp = polypts[0]
            secondp = polypts[1]
            otherpts = polypts[1:]
            otherpts2 = polypts[2:]
            
            _, firstplanep = plane.RemapToPlaneSpace(firstp)
            _, secondplanep = plane.RemapToPlaneSpace(secondp)
            
            #print tol
            
            if abs(dot) >= 1 - tol: #same dir
                
                #if False:#moveflag:
                if moveflag:
                    remappedxy = plane.PointAt(targetplanept.X, targetplanept.Y, firstplanep.Z)
                    remapped2nd = plane.PointAt(secondplanep.X, targetplanept.Y, secondplanep.Z) 
                    
                    newpoly = [True, rg.Polyline([remappedxy, remapped2nd]+otherpts2)]
                else:
                    #print "here"
                    remappedxy = plane.PointAt(targetplanept.X, firstplanep.Y, firstplanep.Z)
                    
                    newpoly = [False, rg.Polyline([remappedxy]+otherpts)]
            else:
                
                remappedxy = plane.PointAt(firstplanep.X, targetplanept.Y, firstplanep.Z)
                extrapt = plane.PointAt(targetplanept.X, targetplanept.Y, firstplanep.Z)
                
                newpoly = [True, rg.Polyline([extrapt, remappedxy]+otherpts)]
                #newpoly = [True, rg.Polyline([remappedxy]+otherpts)]
            #print "_______"
            
            #newpoly[1].DeleteShortSegments(tol)
            
            return newpoly
        
        def clean_polyline(pl, mindistance, tol = GLOBAL_TOL):
            # if ≤2 segments, nothing to do
            if pl.SegmentCount <= 2:
                return pl
                
            tol_rad = math.radians(tol)
            pts = list(pl)
            i = 0
            # walk sliding window of 3 segments -> 4 points
            
            while i <= len(pts) - 4:
                p0 = pts[i]
                p1 = pts[i+1]
                p2 = pts[i+2]
                p3 = pts[i+3]
                
                # first segment
                v1 = p1 - p0
                if not v1.Unitize():
                    i += 1
                    continue
                    
                # middle segment: capture its length before unitizing
                raw_v2 = p2 - p1
                seg2_len = raw_v2.Length
                v2 = rg.Vector3d(raw_v2)
                v2.Unitize()
                # third segment
                v3 = p3 - p2
                if not v3.Unitize():
                    i += 1
                    continue
                    
                # angles between segments
                ang12 = rg.Vector3d.VectorAngle(v1, v2)
                ang23 = rg.Vector3d.VectorAngle(v2, v3)
                
                # test both ~90° within tol
                if abs(ang12 - math.pi/2) <= tol_rad and abs(ang23 - math.pi/2) <= tol_rad:
                    # if middle is too short, remove it and merge
                    if seg2_len < mindistance + tol:
                        new_p3 = rg.Point3d(p3)
                        # align along axis of first segment
                        if abs(v1.X) > abs(v1.Y):
                            new_p3.Y = p0.Y
                        else:
                            new_p3.X = p0.X
                        # drop the middle point, replace next point
                        pts.pop(i+2)
                        pts[i+2] = new_p3
                        # shift index by extra 1 so next triplet spans correctly
                        i += 2
                        continue
                i += 1
             
            return rg.Polyline(pts)
        
        def clean_beginning(pl, mindistance, tol = GLOBAL_TOL):
            #print "in clean"
            # if ≤2 segments, nothing to do
            if pl.SegmentCount <= 2:
                return pl
            
            else:
                polypts = copy.deepcopy(list(pl))
                if polypts[1].DistanceTo(polypts[2]) <= mindistance:
                    shift = polypts[1]-polypts[2]
                    polypts[0] -= shift
                    #remove 2nd and 3rd pts
                    popd = polypts.pop(1)
                    popd = polypts.pop(1)
                    return rg.Polyline(polypts)
                else:
                    return pl 
        
        def extend_polyline_segments(pl, mindistance, mode='triplet', tol=GLOBAL_TOL):
            """
            Extend/collapse segments in a polyline.
            
            'triplet'  - three-seg groups: if middle seg is short, extend it.
            'singular' - each seg: if ≤ tol, collapse it
                         elif < mindistance+tol, extend to mindistance.
            'singular_first'- only the first segment
                              if ≤ tol, collapse it
                              elif < mindistance+tol, extend it.
            """
            pl.MergeColinearSegments(tol, False)
            
            # nothing to do for 0 or 1 segment
            if pl.SegmentCount <= 1:
                return pl
        
            # copy points and precompute tolerance in radians
            pts = list(pl)
            tol_rad = math.radians(tol)
        
            # --- Triplet mode ---
            if mode == 'triplet':
                i = 0
                max_i = len(pts) - 4
                while i <= max_i:
                    p0 = pts[i]
                    p1 = pts[i+1]
                    p2 = pts[i+2]
                    p3 = pts[i+3]
        
                    v1 = p1 - p0
                    if not v1.Unitize():
                        i += 1
                        continue
        
                    raw_v2 = p2 - p1
                    seg2_len = raw_v2.Length
                    v2 = rg.Vector3d(raw_v2)
                    v2.Unitize()
        
                    v3 = p3 - p2
                    if not v3.Unitize():
                        i += 1
                        continue
        
                    ang12 = rg.Vector3d.VectorAngle(v1, v2)
                    ang23 = rg.Vector3d.VectorAngle(v2, v3)
        
                    is_perp1 = abs(ang12 - math.pi/2) <= tol_rad
                    is_perp2 = abs(ang23 - math.pi/2) <= tol_rad
                    is_short = seg2_len < mindistance + tol
        
                    if is_perp1 and is_perp2 and is_short:
                        # compute new p2 extended to mindistance
                        new_p2 = rg.Point3d(p1)
                        new_p2 = new_p2 + v2 * mindistance
                        delta = new_p2 - p2
        
                        pts[i+2] = new_p2
        
                        # shift only p3 along the extension axis
                        if abs(raw_v2.X) > abs(raw_v2.Y):
                            pts[i+3].X += delta.X
                        else:
                            pts[i+3].Y += delta.Y
        
                        i += 2
                    else:
                        i += 1
        
            # --- Singular-first mode ---
            elif mode == 'singular_first':
                # only operate on the very first segment
                if len(pts) < 2:
                    return rg.Polyline(pts)
        
                p0 = pts[0]
                p1 = pts[1]
        
                raw_v = p1 - p0
                seg_len = raw_v.Length
        
                # collapse tiny first segment
                if seg_len <= tol:
                    delta = rg.Vector3d(raw_v)
                    pts.pop(1)
                    j = 1
                    while j < len(pts):
                        pts[j].X = pts[j].X - delta.X
                        pts[j].Y = pts[j].Y - delta.Y
                        pts[j].Z = pts[j].Z - delta.Z
                        j = j + 1
        
                # extend short first segment
                elif seg_len < mindistance + tol and len(pts) > 2:
                    v = rg.Vector3d(raw_v)
                    v.Unitize()
                    new_p1 = rg.Point3d(p0)
                    new_p1 = new_p1 + v * mindistance
                    ext_delta = new_p1 - p1
        
                    pts[1] = new_p1
        
                    # shift only the next point along dominant axis
                    if abs(raw_v.X) > abs(raw_v.Y):
                        pts[2].X = pts[2].X + ext_delta.X
                    else:
                        pts[2].Y = pts[2].Y + ext_delta.Y
        
                return rg.Polyline(pts)
        
            # --- Singular mode ---
            elif mode == 'singular':
                i = 0
                while i < len(pts) - 1:
                    p0 = pts[i]
                    p1 = pts[i+1]
        
                    raw_v = p1 - p0
                    seg_len = raw_v.Length
        
                    # collapse tiny segment
                    if seg_len <= tol:
                        delta = rg.Vector3d(raw_v)
                        pts.pop(i+1)
                        j = i + 1
                        while j < len(pts):
                            pts[j].X -= delta.X
                            pts[j].Y -= delta.Y
                            pts[j].Z -= delta.Z
                            j += 1
                        continue
        
                    # extend short segment, only if next point exists
                    if seg_len < mindistance + tol and i+2 < len(pts):
                        v = rg.Vector3d(raw_v)
                        v.Unitize()
                        new_p1 = rg.Point3d(p0)
                        new_p1 = new_p1 + v * mindistance
                        ext_delta = new_p1 - p1
        
                        pts[i+1] = new_p1
        
                        # shift only the very next point along dominant axis
                        if abs(raw_v.X) > abs(raw_v.Y):
                            pts[i+2].X += ext_delta.X
                        else:
                            pts[i+2].Y += ext_delta.Y
        
                    i += 1
        
            # unknown mode: return original
            else:
                return pl
        
            return rg.Polyline(pts)
        
        def repull(MasterPolys, SlavePolys):
            Tol = 0.001
            ANG_EPS = 1e-9
            ParallelDot = 0.999
            SegIndex = 1  
        
            def _unit_xy(v):
                if v.Length > 0.0:
                    v.Unitize()
                return v
        
            def _left_normal_xy(v):
                n = rg.Vector3d(-v.Y, v.X, 0.0)
                if n.Length > 0.0:
                    n.Unitize()
                return n
        
            def _dot_xy(a, b):
                return a.X * b.X + a.Y * b.Y
        
            def _to_polyline(obj):
                if obj is None:
                    return None
                if isinstance(obj, rg.Polyline):
                    return rg.Polyline(obj)
                if isinstance(obj, rg.PolylineCurve):
                    return obj.ToPolyline()
                try:
                    tmp = rg.Polyline()
                    ok = obj.TryGetPolyline(tmp)
                    if ok:
                        return tmp
                except:
                    pass
                return None
        
            Out = []
        
            m_count = len(MasterPolys)
            s_count = len(SlavePolys)
        
            for i in range(m_count):
                m_in = MasterPolys[i]
        
                if i >= s_count:
                    Out.append(m_in)
                    continue
        
                s_in = SlavePolys[i]
        
                m_pl = _to_polyline(m_in)
                s_pl = _to_polyline(s_in)
        
                if m_pl is None or s_pl is None:
                    Out.append(m_in)
                    continue
        
                if m_pl.SegmentCount != s_pl.SegmentCount:
                    Out.append(m_in)
                    continue
        
                if SegIndex < 0 or SegIndex >= m_pl.SegmentCount:
                    Out.append(m_in)
                    continue
        
                ok_parallel = True
                for j in range(m_pl.SegmentCount):
                    ml = m_pl.SegmentAt(j)
                    sl = s_pl.SegmentAt(j)
        
                    md = rg.Vector3d(ml.Direction.X, ml.Direction.Y, 0.0)
                    sd = rg.Vector3d(sl.Direction.X, sl.Direction.Y, 0.0)
        
                    if md.Length <= Tol or sd.Length <= Tol:
                        ok_parallel = False
                        break
        
                    _unit_xy(md)
                    _unit_xy(sd)
        
                    dot = md * sd
                    if dot < 0.0:
                        dot = -dot
        
                    if dot < ParallelDot:
                        ok_parallel = False
                        break
        
                if not ok_parallel:
                    Out.append(m_in)
                    continue
        
                mseg = m_pl.SegmentAt(SegIndex)
                sseg = s_pl.SegmentAt(SegIndex)
        
                dcur = rg.Vector3d(mseg.Direction.X, mseg.Direction.Y, 0.0)
                if dcur.Length <= Tol:
                    Out.append(m_in)
                    continue
                _unit_xy(dcur)
        
                ncur = _left_normal_xy(dcur)
                if ncur.Length <= Tol:
                    Out.append(m_in)
                    continue
        
                p = rg.Point3d(sseg.From)
                a = rg.Vector3d(p.X - mseg.From.X, p.Y - mseg.From.Y, 0.0)
                t = _dot_xy(a, dcur)
                proj = rg.Point3d(mseg.From.X + dcur.X * t, mseg.From.Y + dcur.Y * t, p.Z)
        
                v = rg.Vector3d(proj.X - p.X, proj.Y - p.Y, proj.Z - p.Z)
                d = _dot_xy(v, ncur)
        
                def _along(dir_vec):
                    if dir_vec.Length <= Tol:
                        return rg.Vector3d(ncur.X * d, ncur.Y * d, v.Z)
        
                    dp = rg.Vector3d(dir_vec.X, dir_vec.Y, 0.0)
                    _unit_xy(dp)
        
                    denom = _dot_xy(dp, ncur)
                    if abs(denom) < ANG_EPS:
                        return rg.Vector3d(ncur.X * d, ncur.Y * d, v.Z)
        
                    s = d / denom
                    return rg.Vector3d(dp.X * s, dp.Y * s, v.Z)
        
                segcount = s_pl.SegmentCount
                has_prev = False
                has_next = False
                prev_dir = rg.Vector3d(0.0, 0.0, 0.0)
                next_dir = rg.Vector3d(0.0, 0.0, 0.0)
        
                if SegIndex > 0:
                    pln = s_pl.SegmentAt(SegIndex - 1)
                    prev_dir = rg.Vector3d(pln.Direction.X, pln.Direction.Y, 0.0)
                    if prev_dir.Length > Tol:
                        has_prev = True
        
                if SegIndex < segcount - 1:
                    nln = s_pl.SegmentAt(SegIndex + 1)
                    next_dir = rg.Vector3d(nln.Direction.X, nln.Direction.Y, 0.0)
                    if next_dir.Length > Tol:
                        has_next = True
        
                if has_prev:
                    ds = _along(prev_dir)
                else:
                    ds = rg.Vector3d(ncur.X * d, ncur.Y * d, v.Z)
        
                if has_next:
                    de = _along(next_dir)
                else:
                    de = rg.Vector3d(ncur.X * d, ncur.Y * d, v.Z)
        
                pts = []
                for p0 in s_pl:
                    pts.append(rg.Point3d(p0))
        
                idx0 = SegIndex
                idx1 = SegIndex + 1
        
                if idx0 < 0 or idx1 >= len(pts):
                    Out.append(m_in)
                    continue
        
                p0 = pts[idx0]
                p1 = pts[idx1]
        
                pts[idx0] = rg.Point3d(p0.X + ds.X, p0.Y + ds.Y, p0.Z + ds.Z)
                pts[idx1] = rg.Point3d(p1.X + de.X, p1.Y + de.Y, p1.Z + de.Z)
        
                if s_pl.IsClosed:
                    if idx0 == 0:
                        pts[len(pts) - 1] = rg.Point3d(pts[0])
                    if idx1 == 0:
                        pts[len(pts) - 1] = rg.Point3d(pts[0])
        
                Out.append(rg.Polyline(pts))
            
            return Out
        
        def remove_spikes(pl, tol_deg=GLOBAL_TOL):
            """remove any back‑tracking spikes from a polyline
            spike is detected when two consecutive segments are nearly 180* apart 
            tolerance is defaulted to global tol, but much tighter is reccomended 0.0001
            """
            # if fewer than 2 segments, nothing to clean
            if pl.SegmentCount < 2:
                return pl
            tol = math.radians(tol_deg)
            pts = list(pl)
            i = 0
            while i < len(pts) - 2:
                p0 = pts[i]
                p1 = pts[i+1]
                p2 = pts[i+2]
                v1 = p1 - p0
                if not v1.Unitize():
                    i += 1
                    continue
                v2 = p2 - p1
                if not v2.Unitize():
                    i += 1
                    continue
                ang = rg.Vector3d.VectorAngle(v1, v2)
                # if they reverse direction within tol, drop the spike apex
                if abs(ang - math.pi) <= tol:
                    pts.pop(i+1)
                    # re‑test at same index since list got shorter
                    continue
                i += 1
            return rg.Polyline(pts)
        
        def middle_line_in_rectangle(rect, plane, tol=GLOBAL_TOL):
            center = rect.Center
            dir_y = plane.YAxis
            infinite_line = rg.Line(center - dir_y * 1e6, center + dir_y * 1e6)
        
            rect_curve = rect.ToNurbsCurve()
            intersections = rg.Intersect.Intersection.CurveLine(rect_curve, infinite_line, tol, tol)
        
            if not intersections or intersections.Count != 2:
                return None
        
            pt1 = intersections[0].PointA
            pt2 = intersections[1].PointA
            
            return rg.Line(pt1, pt2)
        
        def apply_perm(seq, perm):
            return [seq[i] for i in perm]
        
        def restore_input_order(seq, idx_track):
            n = len(idx_track)
            out = [None for _ in range(n)]
            for pos, orig in enumerate(idx_track):
                out[orig] = seq[pos]
            return out
        
        def snap_parameters(parameters0, parameters1):
            epsilon = 1e-9
            tol = 0.01
            max_iterations = 50
        
            def abs_float(x):
                if x < 0.0:
                    return -x
                return x
        
            p0 = []
            p1 = []
            i = 0
            for i in range(len(parameters0)):
                p0.append(float(parameters0[i]))
            i = 0
            for i in range(len(parameters1)):
                p1.append(float(parameters1[i]))
        
            n0 = len(p0)
            n1 = len(p1)
            if n0 == 0 or n1 == 0:
                return p0, p1
        
            min0 = p0[0]
            max0 = p0[0]
            i = 1
            for i in range(1, n0):
                v = p0[i]
                if v < min0:
                    min0 = v
                if v > max0:
                    max0 = v
            domain0 = max0 - min0
        
            min1 = p1[0]
            max1 = p1[0]
            i = 1
            for i in range(1, n1):
                v = p1[i]
                if v < min1:
                    min1 = v
                if v > max1:
                    max1 = v
            domain1 = max1 - min1
        
            best_diff = None
            anchor0 = 0
            anchor1 = 0
            i = 0
            for i in range(n0):
                a = p0[i]
                j = 0
                for j in range(n1):
                    b = p1[j]
                    d = a - b
                    if d < 0.0:
                        d = -d
                    if best_diff is None or d < best_diff:
                        best_diff = d
                        anchor0 = i
                        anchor1 = j
        
            if domain0 < domain1:
                delta = p1[anchor1] - p0[anchor0]
                i = 0
                for i in range(n0):
                    p0[i] = p0[i] + delta
            elif domain1 < domain0:
                delta = p0[anchor0] - p1[anchor1]
                j = 0
                for j in range(n1):
                    p1[j] = p1[j] + delta
            else:
                delta = p1[anchor1] - p0[anchor0]
                i = 0
                for i in range(n0):
                    p0[i] = p0[i] + delta
        
            anchor_value = p0[anchor0]
        
            locked0 = []
            locked1 = []
            i = 0
            for i in range(n0):
                locked0.append(False)
            i = 0
            for i in range(n1):
                locked1.append(False)
        
            locked0[anchor0] = True
            locked1[anchor1] = True
        
            def process_side(side):
                iteration = 0
                for iteration in range(max_iterations):
                    candidates = []
        
                    if side == -1:
                        i = 0
                        for i in range(anchor0):
                            if locked0[i]:
                                continue
                            d = p0[i] - anchor_value
                            if d < 0.0:
                                d = -d
                            candidates.append((d, 0, i))
                        j = 0
                        for j in range(anchor1):
                            if locked1[j]:
                                continue
                            d = p1[j] - anchor_value
                            if d < 0.0:
                                d = -d
                            candidates.append((d, 1, j))
                    else:
                        i = anchor0 + 1
                        for i in range(anchor0 + 1, n0):
                            if locked0[i]:
                                continue
                            d = p0[i] - anchor_value
                            if d < 0.0:
                                d = -d
                            candidates.append((d, 0, i))
                        j = anchor1 + 1
                        for j in range(anchor1 + 1, n1):
                            if locked1[j]:
                                continue
                            d = p1[j] - anchor_value
                            if d < 0.0:
                                d = -d
                            candidates.append((d, 1, j))
        
                    if not candidates:
                        break
        
                    candidates.sort()
        
                    changed = False
        
                    ci = 0
                    for ci in range(len(candidates)):
                        d_c, list_id, idx = candidates[ci]
        
                        if list_id == 0 and locked0[idx]:
                            continue
                        if list_id == 1 and locked1[idx]:
                            continue
        
                        if list_id == 0:
                            v_c = p0[idx]
                        else:
                            v_c = p1[idx]
        
                        # collect all "smaller or equal" (closer/equal to anchor) in other list
                        partner_indices = []
                        partner_dists = []
        
                        if list_id == 0:
                            # candidate in list 0, search list 1
                            if side == -1:
                                start = 0
                                end = anchor1
                            else:
                                start = anchor1 + 1
                                end = n1
                            j = start
                            for j in range(start, end):
                                if locked1[j]:
                                    continue
                                d_o = p1[j] - anchor_value
                                if d_o < 0.0:
                                    d_o = -d_o
                                if d_o < d_c - tol or abs_float(d_o - d_c) <= tol:
                                    partner_indices.append(j)
                                    partner_dists.append(d_o)
        
                            if len(partner_indices) > 0:
                                # pick partner furthest from anchor (max distance)
                                best_pos = 0
                                best_d = partner_dists[0]
                                t = 1
                                for t in range(1, len(partner_indices)):
                                    if partner_dists[t] > best_d + epsilon:
                                        best_d = partner_dists[t]
                                        best_pos = t
                                best_k = partner_indices[best_pos]
                                v_o = p1[best_k]
                                delta2 = v_c - v_o
        
                                if side == -1:
                                    k = 0
                                    for k in range(0, best_k + 1):
                                        p1[k] = p1[k] + delta2
                                else:
                                    k = best_k
                                    for k in range(best_k, n1):
                                        p1[k] = p1[k] + delta2
        
                                locked0[idx] = True
                                locked1[best_k] = True
        
                                # lock all closer ones from that list that also matched condition
                                t = 0
                                for t in range(len(partner_indices)):
                                    k2 = partner_indices[t]
                                    d2 = partner_dists[t]
                                    if k2 != best_k:
                                        if d2 + epsilon < best_d:
                                            locked1[k2] = True
        
                                changed = True
        
                        else:
                            # candidate in list 1, search list 0
                            if side == -1:
                                start = 0
                                end = anchor0
                            else:
                                start = anchor0 + 1
                                end = n0
                            i2 = start
                            for i2 in range(start, end):
                                if locked0[i2]:
                                    continue
                                d_o = p0[i2] - anchor_value
                                if d_o < 0.0:
                                    d_o = -d_o
                                if d_o < d_c - tol or abs_float(d_o - d_c) <= tol:
                                    partner_indices.append(i2)
                                    partner_dists.append(d_o)
        
                            if len(partner_indices) > 0:
                                best_pos = 0
                                best_d = partner_dists[0]
                                t = 1
                                for t in range(1, len(partner_indices)):
                                    if partner_dists[t] > best_d + epsilon:
                                        best_d = partner_dists[t]
                                        best_pos = t
                                best_k = partner_indices[best_pos]
                                v_o = p0[best_k]
                                delta2 = v_c - v_o
        
                                if side == -1:
                                    k = 0
                                    for k in range(0, best_k + 1):
                                        p0[k] = p0[k] + delta2
                                else:
                                    k = best_k
                                    for k in range(best_k, n0):
                                        p0[k] = p0[k] + delta2
        
                                locked1[idx] = True
                                locked0[best_k] = True
        
                                t = 0
                                for t in range(len(partner_indices)):
                                    k2 = partner_indices[t]
                                    d2 = partner_dists[t]
                                    if k2 != best_k:
                                        if d2 + epsilon < best_d:
                                            locked0[k2] = True
        
                                changed = True
        
                        if changed:
                            break
        
                    if not changed:
                        break
        
            process_side(-1)
            process_side(1)
        
            return p0, p1
        
        TolDeg = 1.0
        RightDeg = 90.0
        
        def _is_angle_non_orth(v1, v2, tol_deg):
            if v1.IsTiny() or v2.IsTiny():
                return False
            a = rg.Vector3d.VectorAngle(v1, v2)
            deg = math.degrees(a)
            m = deg % RightDeg
            if m > RightDeg * 0.5:
                m = RightDeg - m
            if m > tol_deg:
                return True
            return False
        
        def ispolyselfnonorth(pl):
            segs = pl.GetSegments()
            if len(segs) < 2:
                return False
            for i in range(len(segs) - 1):
                v1 = segs[i].Direction
                v2 = segs[i + 1].Direction
                if _is_angle_non_orth(v1, v2, TolDeg):
                    return True
            return False
        
        def ispolynonorthtoplane(pl, pln):
            segs = pl.GetSegments()
            if len(segs) == 0:
                return False
            v = segs[0].Direction
            x = pln.XAxis
            if _is_angle_non_orth(v, x, TolDeg):
                return True
            return False
        
        ExtLen = 10.0
        
        def poly_add_start_axis_segment(pl, pln):
            # Collect polyline points
            pts = []
            for p in pl:
                pts.append(p)
                
            if len(pts) < 2:
                return pl
        
            p0 = pts[0]
            p1 = pts[1]
        
            # First segment direction (projected into the plane to avoid Z/noise)
            v = p1 - p0
            v.Unitize()
            
            # Plane axes
            x = rg.Vector3d(pln.XAxis)
            y = rg.Vector3d(pln.YAxis)
        
            # Use sign of dot with XAxis to decide:
            # angle in [90..180] (side-agnostic)  <=>  dot(v, x) <= 0
            dx = v * x
            dy = v * y
            
            checkvec = p0 - pln.Origin
            checkvec.Unitize()
        
            dir_vec = None
        
            if dx >= 0.0:
                if checkvec * x < 0:
                    # Choose +Y or -Y based on which makes a shallower angle with the first segment
                    # This is equivalent to choosing the sign of dy in plane coords
                    dir_vec = rg.Vector3d(y)
                    if dy < 0.0:
                        dir_vec.Reverse()
                else:
                    # Choose XAxis, but flip it so it points "toward plane center" (plane origin)
                    dir_vec = rg.Vector3d(x)
                    dir_vec.Unitize()
                    if dir_vec*v < 0:
                        dir_vec.Reverse()
            else:
                if dx < 0 and checkvec * x < 0:
                    dir_vec = rg.Vector3d(x)
                    dir_vec.Reverse()
                else:
                    # Choose +Y or -Y based on which makes a shallower angle with the first segment
                    # This is equivalent to choosing the sign of dy in plane coords
                    dir_vec = rg.Vector3d(y)
                    if dy < 0.0:
                        dir_vec.Reverse()
        
            # IMPORTANT: we insert a NEW START point, so the new first segment is (p0 - p_new)
            # To make that segment direction == dir_vec, we must place p_new at (p0 - dir_vec * ExtLen)
            dir_vec.Unitize()
            p_new = p0 - dir_vec * ExtLen
            pts.insert(0, p_new)
        
            return rg.Polyline(pts)
        
        def scale_around(x, center, factor):
            return x - (center + (x - center) * factor)
        
        if devicemode:
            if abs(devicetolerance) > GLOBAL_TOL:
                panel = LineUtils.offset_rectangle(panel, devicetolerance)
        
        #reusing normal logic if not under condition, dirty patch
        run_else = False
        
        if devicemode and len(polylines) == 1:
            #print "devmode 1"
            dpolyline = polylines[0]
            firstseg = dpolyline.SegmentAt(0)
            hitspanel = LineUtils.lxr(firstseg, [panel], True)
            if hitspanel:
                #print "in panel"
                porigin = panelplane.Origin
                newp = firstseg.ClosestPoint(porigin, False) #treat as infinite
                polypts = list(dpolyline)
                polypts[0] = newp
                rerespaced = rg.PolylineCurve(polypts)
            else:
                run_else = True
        else:
            run_else = True
        
        #portion to handle polylinebundle nonorth to panel
        for i, checkpoly in enumerate(polylines):
            selfno = ispolyselfnonorth(checkpoly)
            planeno = ispolynonorthtoplane(checkpoly, panelplane)
            #print planeno, selfno
            if planeno:
                stubbedpoly = poly_add_start_axis_segment(checkpoly, panelplane)
                polylines[i] = stubbedpoly
                
        #run a check if all segments are already near panel
        closetopanel = 100.0 #hardcoded distance where everythign else could get overriden and simplest direct connection made
        matchpanel = False
        pulledbuffer = []
        
        buffercheck = 2 if len(polylines) <= 3 else 0
        
        for polybuffer in polylines:    
            firstseg = polybuffer.SegmentAt(0)
            hitspanel = LineUtils.lxr(firstseg, [panel], True)
            porigin = panelplane.Origin
            shortchecklen = porigin.DistanceTo(polybuffer.First)
            if hitspanel and shortchecklen < closetopanel and polybuffer.SegmentCount > buffercheck:
                newpstart = firstseg.ClosestPoint(porigin, False) #treat as infinite
                newpoly = rg.Polyline([newpstart]+list(polybuffer)[1:])
                pulledbuffer.append(newpoly)
            else:
                break
        else:
            #matchpanel branch if it didnt break
            matchpanel = True
        
        print "matchpanel {}".format(matchpanel)
        
        if matchpanel:
            rerespaced = pulledbuffer
        elif run_else:
            polylines_ = []
            
            #short start to end collapsing
            planecenter = panelplane.Origin
            for poly in polylines:
                lastp = poly.Last
                dist = planecenter.DistanceTo(lastp)
                if dist <= manhattanradius:
                    newpol = rg.Polyline([planecenter, lastp])
                    polylines_.append(newpol)
                else:
                    polylines_.append(poly)
            
            polylines = polylines_

            #don't use other angles for now, keep 90
            #angleslookup = LineUtils.AngleLookup.ANGLES
            angleslookup = [90]
            
            #boundspreview = LineUtils.rectangle_axis(panel)
            boundspreview = middle_line_in_rectangle(panel, panelplane)
            
            panelwidth = boundspreview.Length
            od_lookup = [LineUtils.ConduitLookup.get_specs(cs)["od"] for cs in conduitsizes]
            
            #1.0" padding on both ends
            padding = 1.0
            positions = x_positions(od_lookup, spacing, 90, padding)
            mostgradualangle = 90
            
            if positions[-1] <= panelwidth:
                #loop from higher to lower except for 90
                for a in angleslookup[-2::-1]:
                    testpos = x_positions(od_lookup, spacing, a, padding)
                    if testpos[-1] <= panelwidth:
                        positions = testpos
                        mostgradualangle = a
                    else:
                        break
                
                #as the most gradual angle is found, center the positions
                offset = (panelwidth-positions[-1])/2
                positions = [p+offset for p in positions][1:-1]
            else:
                #in case positions dont fit even at 90*, scale uniformly to fit
                coof = panelwidth/positions[-1]
                positions = [p*coof for p in positions][1:-1]
            
            startpts = [boundspreview.PointAtLength(p) for p in positions]
            
            boundspreviewnormal = boundspreview.UnitTangent
            
            #print "mostgradualangle : {}".format(mostgradualangle)
            
            #debugging
            b = startpts 
            firstsegments = [poly.SegmentAt(0) for poly in polylines]
            upperg, lowerg = split_up_down(panelplane, firstsegments)
            try:
                uidx, upper = zip(*upperg)
            except:
                pass
            try:
                lidx, lower = zip(*lowerg) 
            except:
                pass
            #debugging end
            
            #loop start
            iteration_counter = 0
            max_iterations = 5 #was 5
            
            #save og before changes
            ogpolylines = [rg.Polyline(list(poly)) for poly in polylines]
            lastflags = [False for _ in ogpolylines]
            
            # set up a dict to hold each quadrant’s offset
            offsetsdict = dict.fromkeys(('upperleft','upperright','lowerleft','lowerright'), 0)
            
            while iteration_counter < max_iterations:
                iteration_counter += 1
                #print [p.Length for p in polylines]
                
                #prefilter
                for p in polylines:
                    p.MergeColinearSegments(GLOBAL_TOL, False)
                    p.DeleteShortSegments(GLOBAL_TOL)
            
                #print [p.Length for p in polylines]
                
                firstsegments = [poly.SegmentAt(0) for poly in polylines]
                sorted_curves, lookupidx = sort_lines(panelplane, firstsegments)
                
                polylines = apply_perm(polylines, lookupidx)
                conduitsizes = apply_perm(conduitsizes, lookupidx)
                lastflags = apply_perm(lastflags, lookupidx)
                orig_idx = apply_perm(orig_idx, lookupidx)
                sorted_polys = polylines
                
                #snapping pass
                #print "iteration ", iteration_counter
                #print "prepass", lastflags
                
                flags, polylines = zip(*[snappolyline(polyline, panelplane, point, mflag) for polyline, point, mflag in zip(sorted_polys, startpts, lastflags)])
                #flags, polylines = zip(*[snappolyline(polyline, panelplane, point, True) for polyline, point, mflag in zip(sorted_polys, startpts, lastflags)])
                
                lastflags = list(flags)
                
                #print [p.Length for p in polylines], "here"
                
                #print "afterpass", lastflags
                
                #polylines = snapped
                tweakedpoly = []
                
                for poly, conduitsize, conduitsize_, pidx in zip(polylines, conduitsizes, conduitsizes_, range(len(polylines))):
                    #print "here", iteration_counter
                    od_size = LineUtils.ConduitLookup.get_specs(conduitsize)["od"]
                    #linearstub = LineUtils.ConduitLookup.get_specs(conduitsize)['linear_section']
                    #bendradius = LineUtils.ConduitLookup.get_specs(conduitsize)['min_bend']
                    linearstub = LineUtils.ConduitLookup.get_specs(conduitsize_)['linear_section']
                    bendradius = LineUtils.ConduitLookup.get_specs(conduitsize_)['min_bend']
                    
                    startcut = LineUtils._compute_cut(bendradius, linearstub, 90)
                    
                    #to be safe calculated at 2x 90 degree turns + the linear section between
                    #checklength = 0#experiment at 0
                    checklength = lineargap + startcut*2 
                    
                    #print checklength
                    
                    first_s = poly.SegmentAt(0)
                    first_s_len = first_s.Length
                    
                    next_s_len = float('inf')
                    if poly.SegmentCount > 1:
                        next_s = poly.SegmentAt(1)
                        next_s_len = next_s.Length
                    
                    polypts = list(poly)
                    
                    filteredpts = polypts
                    
                    #print "iteration ", iteration_counter
                    
                    
                    
                    #checking first and second for potentiall shortness
                    if first_s.Length < checklength or next_s_len < checklength:
                        #print "here"
                        lastflags[pidx] = False #reset flag
                        #print next_s_len < checklength
                        if len(polypts) == 2:
                            #unchanged
                            pass
                        elif abs(boundspreviewnormal*first_s.UnitTangent) < GLOBAL_TOL or next_s_len < checklength:
                            #if the first segment is short and perpendicular to panel
                            #need to also remove second to fix it
                            #or if the second is too short need to remove 1st and 2nd
                            #remove first 2 segments
                            if len(polypts) > 3:
                                filteredpts = polypts[2:]
                            else:
                                filteredpts = polypts[1:]
                            #print "here"
                        else:
                            #print "here"
                            #remove first segment, leave just last one
                            filteredpts = polypts[1:]
                        #else:
                            #remove first 2 segments
                            #filteredpts = polypts[2:]
                    
                    else:
                        pass
                        #print "passed"
                    
                    if abs(boundspreviewnormal*first_s.UnitTangent) < GLOBAL_TOL and False:
                        #print "here"
                        filteredpts = filteredpts[1:] #remove 1 more
            #        if next_s_len < checklength:
            #            #print next_s_len
            #            filteredpts = filteredpts[1:] #remove 1 more
                    
                    tweakedpoly.append(rg.Polyline(filteredpts))
                
                #print "afterlenchecks", lastflags
                
                #reassign
                polylines = tweakedpoly
            
            #print [p.Length for p in polylines]
            
            #snap too close segments
            adjustedpoly = []
            
            smallestangle = LineUtils.AngleLookup.ANGLES[0]
            #print smallestangle, "smallestangle"
            
            #prefilter
            for p in polylines:
                p.MergeColinearSegments(GLOBAL_TOL, False)
                p.DeleteShortSegments(GLOBAL_TOL)
            
            checkpolys = polylines
            c = []
            
            
            sorters = []
            upperleft = []
            upperright = []
            lowerleft = []
            lowerright = []
            
            #print polylines
            #print [p.Length for p in polylines]
            
            #print "START HERE"
            
            for pl, p, idx in zip(polylines, startpts, range(len(polylines))):
                nc = pl.ToNurbsCurve()
                p2 = nc.PointAtLength(min(pl.Length-GLOBAL_TOL, 20.0))
                sline = rg.Line(p, p2)
                sorters.append(sline)
                u, l = split_up_down(panelplane, [sline])
                if u:
                    #print u[0][1]
                    dir = classify_direction(panelplane, u[0][1], 0.0001)
                    if dir == "left":
                        upperleft.append(idx)
                    else:
                        upperright.append(idx)
                if l:
                    dir = classify_direction(panelplane, l[0][1], 0.0001)
                    #print dir
                    if dir == "left":
                        lowerleft.append(idx)
                    else:
                        lowerright.append(idx)
            
            #print "upperleft {}, upperright {}, lowerleft {}, lowerright {}".format(upperleft, upperright, lowerleft, lowerright)
            
            # build a lookup dict mapping each index to its “quadrant” name
            quadrant = {}
            quadrant.update({i: 'upperleft'   for i in upperleft})
            quadrant.update({i: 'upperright'  for i in upperright})
            quadrant.update({i: 'lowerleft'   for i in lowerleft})
            quadrant.update({i: 'lowerright'  for i in lowerright})
            
            #print quadrant
            #print offsetsdict
            
            #sortedsorters, lookupidx = sort_lines(panelplane, sorters)
            #
            #print lookupidx
            
            ##offset for 90 degree turns
            #curroffset = 0
            #upperleftoffset = 0
            #upperrightoffset = 0
            #lowerleftoffset = 0
            #lowerrightoffset = 0
            
            #resort for finalprocessing
            neworder = range(len(polylines))
            neworder = upperleft + upperright[::-1] + lowerleft + lowerright[::-1]
            
            polylines = apply_perm(polylines, neworder)
            conduitsizes = apply_perm(conduitsizes, neworder)
            startpts = apply_perm(startpts, neworder)
            orig_idx = apply_perm(orig_idx, neworder)
            
            #print neworder
            #neworder = [neworder[i] for i in neworder]
            
            for polyline, conduitsize, conduitsize_, point, sortidx in zip(polylines, conduitsizes, conduitsizes_, startpts, range(len(polylines))):
                #print sortidx
                q = quadrant.get(sortidx)
                #print loc
                
                polyline.MergeColinearSegments(GLOBAL_TOL, False)
                #rg.Polyline.MergeColinearSegments(GLOBAL_TOl, FALSE)
                
                od_size = LineUtils.ConduitLookup.get_specs(conduitsize)["od"]
                #linearstub = LineUtils.ConduitLookup.get_specs(conduitsize)['linear_section']
                #bendradius = LineUtils.ConduitLookup.get_specs(conduitsize)['min_bend']
                linearstub = LineUtils.ConduitLookup.get_specs(conduitsize_)['linear_section']
                bendradius = LineUtils.ConduitLookup.get_specs(conduitsize_)['min_bend']
                
                #calculate for smallest angle
                startcut = LineUtils._compute_cut(bendradius, linearstub, smallestangle)
                
                minlength = lineargap + startcut*2 
                minimalraise = LineUtils.compute_raise(minlength, smallestangle)
                
                polypts = list(polyline)
                
                first_s = polyline.SegmentAt(0)
                firstp = polypts[0]
                secondp = polypts[1]
                otherpts2 = polypts[2:]
                
                c.append(first_s)
                
                #print first_s.UnitTangent
                #print  round(abs(boundspreviewnormal*first_s.UnitTangent))
                #print polyline.SegmentCount
                #print "___"
            
                _, planep = panelplane.RemapToPlaneSpace(point)
                _, firstplanep = panelplane.RemapToPlaneSpace(firstp)
                
                if abs(boundspreviewnormal*first_s.UnitTangent) < GLOBAL_TOL:
                    heightshiftsigned = planep.Y - firstplanep.Y
                    heightshift = abs(heightshiftsigned)
                    #if startsegment is within minlength from panel exit
                    #than shift it to panel exit
                    if heightshift < minimalraise:# and False:
                        print heightshift ,minimalraise
                        #print "first trigger"
                        _, secondplanep = panelplane.RemapToPlaneSpace(secondp)
                        #print "shifting"
                        remappedxy = panelplane.PointAt(planep.X, planep.Y, firstplanep.Z)
                        remapped2nd = panelplane.PointAt(secondplanep.X, planep.Y, secondplanep.Z) 
                        
                        newpoly = rg.Polyline([remappedxy, remapped2nd]+otherpts2)
                        adjustedpoly.append(newpoly)
                    #else process shift at specified parameters
                    else:
                        #print "in here"
                        anglecalc = LineUtils.fit_angle_to_height(minlength, heightshift)
                        minfitted = LineUtils.smallest_ge(LineUtils.AngleLookup.ANGLES, anglecalc)
                        
                        offsetdist = abs(planep.Y -firstplanep.Y)
                        
                        #at the most gradual offset
                        #mostgradualangle = 45
                        #print mostgradualangle
                        startcut_ = LineUtils._compute_cut(bendradius, linearstub, mostgradualangle)
                        minlength_ = lineargap + startcut_*2 
                        minimalraise_ = LineUtils.compute_raise(minlength_, mostgradualangle)
                        minrun = LineUtils.compute_run(minlength_, mostgradualangle)
                        minopp = LineUtils.compute_opposite(offsetdist, 90-mostgradualangle)
                        
                        _, secondplanep = panelplane.RemapToPlaneSpace(secondp)
                        
                        conditions = [
                            first_s.Length >= minopp+minlength,   #length of first segment has to be larger than minimal opposite righttriangle side and minimal length of 2 fitting + space between
                            offsetdist >= minimalraise_,  #it has to be shifted more than minimalraise else fittings + space between wont fit
                            offsetdist <= minimalraise_*offsetshitcoof,  #this is a visual addition to prevent extremely long angled segments
                            mostgradualangle < 90  #90 degree isnt angled, it has to start with straight segment, so its excluded
                        ]
                        
                        #need to add 2 fittings at end
                        #if first_s.Length >= minopp+minlength and offsetdist >= minimalraise_ and offsetdist <= minimalraise_*offsetshitcoof and mostgradualangle < 90: 
                        if all(conditions): #too many conditions, more elegant this way
                            #print minimalraise_*offsetshitcoof
                            #print "can fit !!"
                            newp = first_s.PointAtLength(minopp) #pnt at distance and at parameter ISNT always same for lines
                            #panelplane.PointAt(minopp, secondplanep.Y, secondplanep.Z)
                            adjustedpoly.append(rg.Polyline([point, newp, secondp]+otherpts2))
                        else:
                            #print "here"
                            #if point falls within plane, let it be
                            if abs(firstplanep.Y) <= panelwidth/2 and len(polylines) == 1:
                                #print "here"
                                adjustedpoly.append(polyline)
                            else:
                                #start offsets
                                curroffset = 0
                                
                                if offsetsdict[q] == 0:
                                    offsetsdict[q] = minlength
                                else:
                                    offsetsdict[q] = offsetsdict[q] + od_size + spacing
                                
                                curroffset = offsetsdict[q]
            #                    if curroffset == 0:
            #                        curroffset = minlength
            #                    else:
            #                        #add spacing and its diameter (diamter isnt super accurate but will do)
            #                        curroffset += od_size + spacing
                                
                                if secondplanep.X > 0:
                                    newpone = panelplane.PointAt(curroffset, planep.Y, planep.Z)
                                    newptwo = panelplane.PointAt(curroffset, secondplanep.Y, planep.Z)
                                else:
                                    newpone = panelplane.PointAt(-curroffset, planep.Y, planep.Z)
                                    newptwo = panelplane.PointAt(-curroffset, secondplanep.Y, planep.Z)
                                
                                adjustedpoly.append(rg.Polyline([point, newpone, newptwo, secondp]+otherpts2))
                                    
                                #print "cant fit"
                        
                        #print planep.Y, firstplanep.Y, offsetdist, "___",minlength_,   minimalraise_, minrun, "__", minopp
                        
                        #
                        #print anglecalc, minfitted
                        
                        #print minlength, heightshift, anglecalc, heightshiftsigned
                        #print minfitted
                        #print "___"
                        
                        #if panel exits dont fit for minimal segments length in a bundle
                        #compress all to fit
                        
                        #if 90 degrees need extra processing
                        if mostgradualangle >= 90:
                            pass
                            #adjustedpoly.append(polyline)
                        #under 90 degrees gradual, do gradual directly out of panel
                        else:
                            #print mostgradualangle
                            pass
                            #adjustedpoly.append(polyline)
                    #print planep.Y
                    #print firstp.Y
                    
                    #print "pass"
                    
                #perpendicular
                else:
                    #print "here"
                    #check if it can connect
                    _, secondplanep = panelplane.RemapToPlaneSpace(secondp)
                    #print secondplanep
                    #print planep
                    secondshifted = rg.Point3d(secondplanep.X, planep.Y, secondplanep.Z)
                    #print secondshifted
                    checkdist = secondplanep.DistanceTo(secondshifted)
                    #just a direct connection
                    if checkdist<minlength and len(polypts) == 2 and removeshorts:
                        #print "direct connection"
                        #adjustedpoly.append(rg.Polyline([point, secondp]))
                        pass
                        adjustedpoly.append(rg.Polyline([point, secondp]))
                    #90* connection
                    else:
                        #print "90* connection"
                        shiftedinplane = panelplane.PointAt(secondshifted.X, secondshifted.Y, secondshifted.Z)
                        #adjustedpoly.append(rg.Polyline([point, shiftedinplane, secondp]))
                        adjustedpoly.append(rg.Polyline([point, shiftedinplane, secondp]+otherpts2))
                    #print checkdist
                    #print "perpendicular"
                    #a = snappolyline(polyline, panelplane, point, False, 0.02)
                    #print "aftersnap"
                    #adjustedpoly.append(polyline)
                    #not perpendicular to panel
                    pass
                #print minimalraise
            
            readjustedpoly = []
            
            upperleftmin = 0
            upperrightmin = 0
            lowerleftmin = 0
            lowerrightmin = 0
            
            upperleftfs = []
            upperrightfs = []
            lowerleftfs = []
            lowerrightfs = []
            
            def finalsortkey(poly):
                _, p = panelplane.RemapToPlaneSpace(list(poly)[0])
                return round(p.Y, 3)
            
            def fit_number(lst, x ,spacing, tol = GLOBAL_TOL):
                if not lst:
                    return x
                    
                s=sorted(lst)
                c=x
                
                while True:
                    blocker=None
                    for y in s:
                        # only tolerate being closer than (spacing - GLOBAL_TOL)
                        if abs(c-y) < spacing - tol:
                            blocker=y
                            break
                    # no conflicts -> c fits everywhere
                    if blocker is None:
                        return c
                    # bump c up just past the blocker by full spacing
                    c=blocker + spacing
            
            fittol = 0.01
            
            for polyline_, conduitsize in zip(adjustedpoly, conduitsizes):
                od_size = LineUtils.ConduitLookup.get_specs(conduitsize)["od"]
                linearstub = LineUtils.ConduitLookup.get_specs(conduitsize)['linear_section']
                bendradius = LineUtils.ConduitLookup.get_specs(conduitsize)['min_bend']
                
                polyline = polyline_
                
                #calculate for smallest angle
                startcut = LineUtils._compute_cut(bendradius, linearstub, smallestangle)
                
                minlength = lineargap + startcut*2 
                
                secondsegment = polyline.SegmentAt(1) if polyline.SegmentCount > 1 else polyline.SegmentAt(0)
                firstslen = polyline.SegmentAt(0).Length
                
                u, l = split_up_down(panelplane, [secondsegment])
                
                minoffset = minlength
                
                spcng = od_size + spacing
                #minlen = minlength-spcng
                minlen = minlength
                #print "spacing {}".format(spcng)
                
                #startcut = 0.01 #testing
                
                if u:
                    #print u[0][1]
                    dir = classify_direction(panelplane, u[0][1], 0.0001)
                    if dir == "left":
                        if upperleftmin == 0:
                            upperleftmin = minlen
                            #
                        else:
                            upperleftmin += spcng
                        #minoffset = upperleftmin
                        #upperleftfs.append(max(firstslen, upperleftmin))
                        minoffset = fit_number(upperleftfs, upperleftmin, spcng, fittol) 
                        upperleftfs.append(max(firstslen, minoffset))
                    else:
                        if upperrightmin == 0:
                            upperrightmin = minlen
                        else:
                            upperrightmin += spcng
                        #minoffset = upperrightmin
                        #upperrightfs.append(max(firstslen, upperrightmin))
                        minoffset = fit_number(upperrightfs, upperrightmin, spcng, fittol) 
                        upperrightfs.append(max(firstslen, minoffset))
                if l:
                    dir = classify_direction(panelplane, l[0][1], 0.0001)
                    #print dir
                    if dir == "left":
                        if lowerleftmin == 0:
                            lowerleftmin = minlen
                        else:
                            lowerleftmin += spcng
                        #minoffset = lowerleftmin
                        #lowerleftfs.append(max(firstslen, lowerleftmin))
                        #print lowerleftfs
                        #print lowerleftmin
                        minoffset = fit_number(lowerleftfs, lowerleftmin, spcng, fittol) 
                        lowerleftfs.append(max(firstslen, minoffset))
                        #print minoffset
                        #minoffset = 0
                    else:
                        if lowerrightmin == 0:
                            lowerrightmin = minlen
                        else:
                            lowerrightmin += spcng
                        #minoffset = lowerrightmin
                        #lowerrightfs.append(max(firstslen, lowerrightmin))
                        minoffset = fit_number(lowerrightfs, lowerrightmin, spcng, fittol) 
                        lowerrightfs.append(max(firstslen, minoffset))
                
                #ensure minlength for all segments, but calculated first only for first obv
                #extended = extend_polyline_segments(polyline, minlength, 'singular')
                #extended = extend_polyline_segments(extended, minoffset, 'singular_first')
                extended = extend_polyline_segments(polyline, minoffset, 'singular_first')
        
                polyline = extended
                
                #iteratively clean for a couple iterations
                for j in range(0):
                    unspiked = remove_spikes(polyline, 0.0001)
                    if unspiked.SegmentCount <= 3:
                        pass
                        minlength = startcut*2  #let it fit without linear segment
                        minlength = 0.01
                        
                    cleaned = clean_polyline(unspiked, minlength)
            
                    polyline = cleaned
                
                #extended = extend_polyline_segments(polyline, minlength, 'singular')
                #extended = polyline
                #print minlength
                
                readjustedpoly.append(polyline)
                #readjustedpoly.append(polyline_)
            
            readjustedpoly_debug = [rc.ToPolylineCurve() for rc in readjustedpoly]
            
            ##finalsort
            #firstsegments = [poly.SegmentAt(1) for poly in adjustedpoly]
            ##print firstsegments
            #sorted_curves, lookupidx = sort_lines(panelplane, firstsegments)
            #
            #print lookupidx
            
            adjustedpoly = restore_input_order(adjustedpoly, orig_idx)
            readjustedpoly = restore_input_order(readjustedpoly, orig_idx)
            polylines = restore_input_order(polylines, orig_idx)
            
            snapped = polylines
            
            # ---- extra per-side push using 2nd segment in panelplane X ----
            
            origin_ok, origin_uv = panelplane.RemapToPlaneSpace(panelplane.Origin)
            
            left_indices = []
            right_indices = []
            center_indices = []
            mid_x_values = []
            
            for idx, pl in enumerate(readjustedpoly):
                if pl.SegmentCount > 1:
                    seg = pl.SegmentAt(1)
                else:
                    seg = pl.SegmentAt(0)
            
                mid_pt = seg.PointAt(0.5)
                remap_ok, mid_uv = panelplane.RemapToPlaneSpace(mid_pt)
            
                if remap_ok:
                    mid_x = mid_uv.X
                    dx = mid_x - origin_uv.X
                else:
                    mid_x = None
                    dx = 0.0
            
                mid_x_values.append(mid_x)
            
                if dx > GLOBAL_TOL:
                    left_indices.append(idx)
                elif dx < -GLOBAL_TOL:
                    right_indices.append(idx)
                else:
                    center_indices.append(idx)
            
            # if some land exactly on origin X, assign them to the smaller side
            for idx in center_indices:
                if len(left_indices) <= len(right_indices):
                    left_indices.append(idx)
                else:
                    right_indices.append(idx)
            
            # find bundles: indices whose 2nd segment X matches some other 2nd segment X
            stacked_indices = set()
            for i in range(len(mid_x_values)):
                x_i = mid_x_values[i]
                if x_i is None:
                    continue
                for j in range(len(mid_x_values)):
                    if i == j:
                        continue
                    x_j = mid_x_values[j]
                    if x_j is None:
                        continue
                    if abs(x_j - x_i) <= GLOBAL_TOL:
                        stacked_indices.add(i)
                        break
            
            n_left = len(left_indices)
            n_right = len(right_indices)
            #print "n_left, n_right:", n_left, n_right
            
            extra_left = 0.0
            extra_right = 0.0
            
            #for now
            smallestconduit = min(conduitsizes_)
            
            if spacing_ > 0.0:
                if n_left > 1:
                    extra_left = 0.5 * (spacing_ + smallestconduit) * float(n_left - 1)
                if n_right > 1:
                    extra_right = 0.5 * (spacing_ + smallestconduit) * float(n_right - 1)
            
            #print extra_left, extra_right
            
            # direction along which the 2nd segment should move "away" in panelplane
            push_axis = rg.Vector3d(panelplane.XAxis)  # change to YAxis if that is your push dir
            if not push_axis.IsZero:
                push_axis.Unitize()
            
                new_readjusted = []
            
                for idx, pl in enumerate(readjustedpoly):
                    d = 0.0
                    if idx in left_indices:
                        d = extra_left
                    elif idx in right_indices:
                        d = -extra_right  # negative to move away from origin on the other side
            
                    # only push if:
                    # - this index is part of a stacked bundle (same X as others)
                    # - 2nd segment is NOT the last one
                    if d != 0.0 and idx in stacked_indices:
                        seg_count = pl.SegmentCount
                        if seg_count > 2 and pl.Count > 2:
                            move_vec = rg.Vector3d(push_axis)
                            move_vec = move_vec * d
            
                            pts = list(pl)
                            # move only the 2nd segment endpoints: pts[1] and pts[2]
                            pts[1] = pts[1] + move_vec
                            pts[2] = pts[2] + move_vec
            
                            new_pl = rg.Polyline(pts)
                            new_readjusted.append(new_pl)
                        else:
                            new_readjusted.append(pl)
                    else:
                        new_readjusted.append(pl)
            
                readjustedpoly = new_readjusted
            
            # ---- end extra per-side push ----
            
            #cached
            spacing = spacing_
            conduitsize = gh.DataTree[System.Object]()#conduitsizes_
            polylines = gh.DataTree[System.Object]()
            
            conduitsize.AddRange(conduitsizes_, defaultpath)
            polylines.AddRange(readjustedpoly, defaultpath)
            
            polylines_LR = gh.DataTree[System.Object]()
            conduitsize_LR = gh.DataTree[System.Object]()
            
            path_left = gh.Kernel.Data.GH_Path(0)
            path_right = gh.Kernel.Data.GH_Path(1)
            
            for idx, pl in enumerate(readjustedpoly):
                size = conduitsizes_[idx]
            
                if idx in left_indices:
                    polylines_LR.Add(pl, path_left)
                    conduitsize_LR.Add(size, path_left)
                elif idx in right_indices:
                    polylines_LR.Add(pl, path_right)
                    conduitsize_LR.Add(size, path_right)
                else:
                    # should not happen because center_indices are reassigned,
                    # but keep it in defaultpath just in case
                    polylines_LR.Add(pl, defaultpath)
                    conduitsize_LR.Add(size, defaultpath)
            
            #print conduitsize.Branch(0)
            #print polylines.Branch(0)
            #print  gh.DataTree[System.Int32]([0], defaultpath)
            
            sp = LineUtils.Spacing()
            
            #sp_results = sp.Run(polylines, conduitsize, optionalkeys = gh.DataTree[System.Int32]([0], defaultpath),
            #                    spacing = spacing, perpanel = False, perlevel = False, 
            #                    pulltogether = True, pushflag = False, pullstart = pullstart)
            
            #pushflag is resource intensive
            sp_results = sp.Run(polylines_LR, conduitsize_LR, optionalkeys = gh.DataTree[System.Int32]([0], defaultpath),
                                spacing = spacing, perpanel = True, perlevel = False, 
                                pulltogether = True, pushflag = False, pullstart = pullstart)
            
            rawlinelookup, linelookup, rebuiltree, polys, polys2, finaltree, treeflags, doublepolys, Boundaryobjects = sp_results
            
            #2 step process for 2nd segment to ensure proper order
            #repull(MasterPolys, SlavePolys)
            repulltest = gh.DataTree[System.Object]()
            
            for path in polylines_LR.Paths:
                masterpolys = list(polylines_LR.Branch(path))
                slavepolys = list(finaltree.Branch(path))
                #print " len(masterpolys), len(slavepolys)", len(masterpolys), len(slavepolys)
                repulled = repull(masterpolys, slavepolys)
                #print "repulled ", len(repulled)
                repulltest.AddRange(repulled, path)
                #repulltest.extend(repulled)
            
            sp2 = LineUtils.Spacing()
            sp_results2 = sp2.Run(repulltest, conduitsize_LR, optionalkeys = gh.DataTree[System.Int32]([0], defaultpath),
                                spacing = spacing, perpanel = True, perlevel = False, 
                                pulltogether = True, pushflag = False, pullstart = pullstart)
                                
            rawlinelookup, linelookup, rebuiltree, polys, polys2, rerespaced_, treeflags, doublepolys, Boundaryobjects = sp_results2
            finaltree = gh.DataTree[System.Object]()
            
            for path in rerespaced_.Paths:
                r_polys = list(rerespaced_.Branch(path))
                c_sizes = list(conduitsize_LR.Branch(path))
                
                for rpoly, conduitsize in zip(r_polys, c_sizes):
                    od_size = LineUtils.ConduitLookup.get_specs(conduitsize)["od"]
                    linearstub = LineUtils.ConduitLookup.get_specs(conduitsize)['linear_section']
                    bendradius = LineUtils.ConduitLookup.get_specs(conduitsize)['min_bend']
                    
                    startcut = LineUtils._compute_cut(bendradius, linearstub, smallestangle)
                    minlength = lineargap + startcut*2 
                    minlength_ = startcut*2 
                    
                    #cleaned = clean_polyline(rpoly, minlength)
                    cleaned = clean_beginning(rpoly, minlength_) #do without linear as more conservative for now 
                    finaltree.Add(cleaned, path)
            
            respaced = []
            
            planeY = panelplane.YAxis
            planeY.Unitize()
            
            cutstart = True
            
            if finaltree.BranchCount <= 1:
                cutstart = False
                #for simplicity of unification
                
                if path_left in finaltree.Paths:
                    finaltree.AddRange([], path_right)
                else:
                    finaltree.AddRange([], path_left)
            
            #if only one line on a side and it would be reasonable to just run it straight
            porigin = panelplane.Origin
            panelXax = panelplane.XAxis
            
            for branch in finaltree.Branches:
                if len(branch) == 1:
                    #checking hits
                    dpolyline = branch[0]
                    firstseg = dpolyline.SegmentAt(0)
                    lastseg = dpolyline.SegmentAt(dpolyline.SegmentCount - 1)
                    hitspanel1 = LineUtils.lxr(lastseg, [panel], True)
                    hitspanel2 = LineUtils.lxr(firstseg, [panel], True)
                    
                    shortchecklen = porigin.DistanceTo(dpolyline.Last)
                    manhcheck = shortchecklen <= manhattanradius
                    #short segment manhattan
                    if manhcheck:
                        #print "shortie"
                        checkline = rg.Line(dpolyline.Last,  panelXax)
                        hitcheck = LineUtils.lxr(checkline, [panel], True)
                        newp = checkline.ClosestPoint(porigin, False) #treat as infinite
                        newpoly = rg.Polyline([newp, dpolyline.Last])
                        branch[0] = newpoly
                    else:
                        if hitspanel1 and hitspanel2 and manhcheck:
                            #print "in panel"
                            newp = lastseg.ClosestPoint(porigin, False) #treat as infinite
                            newpoly = rg.Polyline([newp, dpolyline.Last])
                            branch[0] = newpoly
                else:
                    for i in range(len(branch)):
                        dpolyline = branch[i]
                        #snake segments within a panel, special case, was 3 do for all ? 
                        if dpolyline.SegmentCount == 3:
                            firstseg = dpolyline.SegmentAt(0)
                            lastseg = dpolyline.SegmentAt(dpolyline.SegmentCount - 1)
                            hitspanel1 = LineUtils.lxr(lastseg, [panel], True)
                            hitspanel2 = LineUtils.lxr(firstseg, [panel], True)
                            if hitspanel1 and hitspanel2:
                                #print "in panel"
                                newpstart = firstseg.ClosestPoint(porigin, False) #treat as infinite
                                newpend = firstseg.ClosestPoint(dpolyline.Last, False) #treat as infinite
                                newpoly = rg.Polyline([newpstart, newpend])
                                branch[i] = newpoly
                        else:
                            pass
                            #print "here not snake"
            if False:
            #if finaltree.BranchCount <= 1:
                for branch in finaltree.Branches:
                    respaced.extend(list(branch))
            else:
                parameters0 = []
                parameters1 = []
                offsets0 = []
                offsets1 = []
                offsets_left_branch = []
                offsets_right_branch = []
                
                for j in [0, 1]:
            #        try:
                    for poly in finaltree.Branch(j):
                        startp = poly.First
                        remap_ok, mid_uv = panelplane.RemapToPlaneSpace(startp)
                        par = mid_uv.Y
                        if j == 0:
                            parameters0.append(par)
                        else:
                            parameters1.append(par)
            #        except:
            #            pass
                
                parameters0.sort()
                parameters1.sort()
                
                #print parameters0, parameters1
                
                if pullstart:
                    new0, new1 = snap_parameters(parameters0, parameters1)
                else:
                    new0, new1 = parameters0, parameters1
                
                #print new0, new1
                
                workwidth = 1.0
                if sidesextra * 2 < panelwidth * 0.5:
                    workwidth = panelwidth - sidesextra * 2
                else:
                    workwidth = panelwidth
                
                panelzero = panelplane.Origin.Y
                allpars = new0 + new1
                minpar_ = min(allpars)
                maxpar_ = max(allpars)
                midpar_ = minpar_ * 0.5 + maxpar_ * 0.5
                pardomain_ = abs(maxpar_ - minpar_)
                paroffset = midpar_ - 0
                scalefactor = 1.0
                
                if pardomain_ > workwidth:
                    scalefactor = workwidth / pardomain_
                
                #scalefactor = 1.0
                
                for p0, n0 in zip(parameters0, new0):
                    offset0 = n0 - p0 - paroffset
                    off0 = p0 + offset0
                    scalef = off0 * (1 - scalefactor)
                    offset0 -= scalef
                    ovec0 = copy.deepcopy(planeY)
                    ovec0 *= offset0
                    offsets0.append(ovec0)
                
                for p1, n1 in zip(parameters1, new1):
                    offset1 = n1 - p1 - paroffset
                    off1 = p1 + offset1
                    scalef = off1 * (1 - scalefactor)
                    offset1 -= scalef
                    ovec1 = copy.deepcopy(planeY)
                    ovec1 *= offset1
                    offsets1.append(ovec1)
                
                #print offsets0, offsets1
                
                # build offsets per-branch, matching branch poly order
                left_polys = list(finaltree.Branch(0))
                right_polys = list(finaltree.Branch(1))
                used0 = [False] * len(parameters0)
                used1 = [False] * len(parameters1)
                tol_par = 1e-6
                
                porigin = panelplane.Origin
                
                run_else = False
                
                for poly in left_polys:
                    startp = poly.First
                    remap_ok, mid_uv = panelplane.RemapToPlaneSpace(startp)
                    par = mid_uv.Y
                    offset_vec = None
                    for k in range(len(parameters0)):
                        if not used0[k]:
                            if abs(parameters0[k] - par) <= tol_par:
                                offset_vec = offsets0[k]
                                used0[k] = True
                                break
                    offsets_left_branch.append(offset_vec)
                
                for poly in right_polys:
                    startp = poly.First
                    remap_ok, mid_uv = panelplane.RemapToPlaneSpace(startp)
                    par = mid_uv.Y
                    offset_vec = None
                    for k in range(len(parameters1)):
                        if not used1[k]:
                            if abs(parameters1[k] - par) <= tol_par:
                                offset_vec = offsets1[k]
                                used1[k] = True
                                break
                    offsets_right_branch.append(offset_vec)
                
                # original respaced (not strictly needed, but kept)
                for branch in finaltree.Branches:
                    respaced.extend(list(branch))
                
                # reorder to match readjustedpoly indexing
                left_set = set(left_indices)
                right_set = set(right_indices)
                
                respaced_ordered = []
                offsets_respaced = []
                left_i = 0
                right_i = 0
                
                for idx in range(len(readjustedpoly)):
                    if idx in left_set:
                        respaced_ordered.append(left_polys[left_i])
                        offsets_respaced.append(offsets_left_branch[left_i])
                        left_i += 1
                    elif idx in right_set:
                        respaced_ordered.append(right_polys[right_i])
                        offsets_respaced.append(offsets_right_branch[right_i])
                        right_i += 1
                    else:
                        respaced_ordered.append(readjustedpoly[idx])
                        offsets_respaced.append(None)
                
                respaced = respaced_ordered
                # offsets_respaced now has same indexing as respaced / readjustedpoly
            
            rerespaced = []
            
            trimdist = 1.0 #remove 1 inch
            
            for rspcd, ovec in zip(respaced, offsets_respaced):
                newpoly = copy.deepcopy(list(rspcd))
                trnsfrm = rg.Transform.Translation(ovec)
                for j in [0, 1]:
                    newpoly[j].Transform(trnsfrm)
                
                if cutstart and pullstart:
                    cutvec = rg.Vector3d(newpoly[0] - newpoly[1])
                    cutvec.Unitize()
                    cutvec *= -trimdist
                    trimsf = rg.Transform.Translation(cutvec)
                    newpoly[0].Transform(trimsf)
            
                newcrv = rg.PolylineCurve(newpoly)
                rerespaced.append(newcrv)
            
        #reconnected = rerespaced
        return rerespaced

# make the class docstring match the top-of-file docstring (single source of truth)
Panelconnection.__doc__ = __doc__

#guard, so it doesn't run on import, but will run in regular components
if __name__ == "__main__":
    ghenv.Component.Message = "v0.44 panelconnections classed"

    pc = Panelconnection()
    pc_results = pc.Run(LineUtils, panel, panelplane, polylines, conduitsizes, spacing,
                        removeshorts, pullstart, manhattanradius, devicemode, devicetolerance)

    reconnected = pc_results
# ---------- end ghpython_script_12 ----------
discontinuity_4 = Discontinuity(Curve=data_95, Level=1)  # -> Points, Parameters; disabled
ghpython_script_13 = GhPythonScript(
    LineUtils=lineutils,
    panel=data_50,
    panelplane=data_49,
    polylines=data_86,
    conduitsizes=data_92,
    spacing=data_48,
    removeshorts=boolean_toggle_11,
    pullstart=boolean_toggle_12,
    manhattanradius=number_slider_13,
    devicemode=boolean_toggle_13,
    devicetolerance=number_slider_12)  # -> out, reconnected; inputs panel: Rectangle3d, panelplane: Plane, polylines: list of Polyline, conduitsizes: list, removeshorts: Boolean, pullstart: Boolean, devicemode: Boolean
# ---------- ghpython_script_13: Python ----------
"""
GH Python (IronPython)
Description: Reconnect and re-route conduit polylines at a panel with optional Manhattan logic and device-aware tolerance.

Inputs:
    LineUtils       : LineUtils           — helper class instance used for panel reconnection logic
    panel           : rg.Rectangle3d      — panel outline in 3D
    panelplane      : rg.Plane            — panel plane used for projection and orientation
    polylines       : List[rg.Polyline]   — main input, list of conduit centreline polylines
    conduitsize     : List[float]         — conduit size per polyline; list length must match polylines
    spacing         : float               — target centre-to-centre distance between conduits
    removeshorts    : bool                — treat single-segment polylines as Manhattan runs if False; best to default at False
    pullstart       : bool                — when connections exit panel from both sides: single row if False, double row if True
    manhattanradius : float               — if end of a polyline is within this distance from panel centre, treat as Manhattan polyline
    devicemode      : bool                — enable device-aware logic using devicetolerance
    devicetolerance : float               — distance around connection rectangles within which a connection is considered covered

Outputs:
    reconnected : List[rg.Polyline] — list of reconnected / adjusted conduit polylines
"""

import Rhino.Geometry as rg
import Grasshopper as gh
import math
from collections import defaultdict
import itertools
import System
import random
import copy

class Panelconnection(object):
    def Run(self, LineUtils, panel, panelplane, polylines, conduitsizes, spacing = 1.0,
            removeshorts = False, pullstart = True, manhattanradius = 25.0,
            devicemode = False, devicetolerance = 0.0):
        
        GLOBAL_TOL = 0.01
        defaultpath = gh.Kernel.Data.GH_Path(0)
        unitX = rg.Vector3d(1, 0, 0)
        unitY = rg.Vector3d(0, 1, 0)
        unitZ = rg.Vector3d(0, 0, 1) 
        lineargap = 4.0 #4" between bends
        
        spacing_ = copy.deepcopy(spacing)
        spacing = 0
        
        conduitsizes_ = copy.deepcopy(conduitsizes)
        conduitsizes = [0 for _ in conduitsizes]
        
        #dont apply angled if offset is more than x minimal shifts
        offsetshitcoof = 10#2000#10.00
        
        sidesextra = 3.0
        
        n_items = len(polylines)
        orig_idx = list(range(n_items))  # tracks where each current item came from
        
        polylines_ = []
        
        #short start to end collapsing
        planecenter = panelplane.Origin
        for poly in polylines:
            lastp = poly.Last
            dist = planecenter.DistanceTo(lastp)
            if dist <= manhattanradius:
                newpol = rg.Polyline([planecenter, lastp])
                polylines_.append(newpol)
            else:
                polylines_.append(poly)
        
        polylines = polylines_
        
        def x_positions(diameters, gap, angle_deg, padding, tol = GLOBAL_TOL):
            if angle_deg <= tol:
                return [0]
            ang = angle_deg * math.pi / 180.0
            n = len(diameters)
            if n == 0:
                return [0]
            # first center
            pos = padding + diameters[0] / 2.0
            if n == 1:
                return [0, pos, pos*2]
            centers = [pos]
            # subsequent centers
            for i in range(1, n):
                if ang == 0.0:
                    dx = diameters[i-1]/2.0 + gap + diameters[i]/2.0
                else:
                    dx = (diameters[i-1]/2.0 + gap + diameters[i]/2.0) / math.sin(ang)
                pos += dx
                centers.append(pos)
            # end of end padding
            end = centers[-1] + diameters[-1]/2.0 + padding
            values = [0]+centers+[end]
            rvalues = [round(v, 3) for v in values]
            
            return rvalues
        
        def split_up_down(plane, lines, tol = GLOBAL_TOL):
            origin_uv = plane.RemapToPlaneSpace(plane.Origin)[1]
            upper = []
            lower = []
            for i, ln in enumerate(lines):
                mid_uv = plane.RemapToPlaneSpace(ln.PointAt(0.5))[1]
                if mid_uv.X - origin_uv.X > tol:
                    upper.append((i, ln))
                else:
                    lower.append((i, ln))
            return upper, lower
        
        def classify_direction(plane, line, tol = GLOBAL_TOL):
            d = rg.Vector3d(line.Direction)
            d.Unitize()
            ax_y = rg.Vector3d(plane.XAxis)
            ax_x = rg.Vector3d(plane.YAxis)
            
            if abs(d * ax_y) >= 1.0 - tol:
                return 'straight'
                
            if d * ax_x > 0:
                return 'right'
            return 'left'
        
        def _sort_block(plane, items, tag, is_upper):
            if tag == 'straight':
                #key_fun = lambda it: plane.RemapToPlaneSpace(it[1].PointAtStart)[1].Y
                key_fun = lambda it: plane.RemapToPlaneSpace(it[1].From)[1].Y
                reverse_flag = False#True  # always descending Y
            else:
                #key_fun = lambda it: plane.RemapToPlaneSpace(it[1].PointAtStart)[1].X
                key_fun = lambda it: plane.RemapToPlaneSpace(it[1].From)[1].X
                if tag == 'left':
                    reverse_flag = is_upper  # upper -> asc lower -> desc
                else:  # 'right'
                    reverse_flag = not is_upper      # upper -> desc lower -> asc
            
            return sorted(items, key=key_fun, reverse=reverse_flag)
        
        def sort_lines(plane, lines, tol = GLOBAL_TOL):
            upper, lower = split_up_down(plane, lines, tol)
            #lower = []
            ordered = []
            
            for grp, is_upper in ((upper, False), (lower, True)):
                buckets = {'left': [], 'straight': [], 'right': []}
                tagorder = ['left', 'straight', 'right']
                if is_upper:
                    #tagorder.reverse()
                    pass
                
                #print "is_upper ", is_upper
                #print tagorder
                
                for idx, ln in grp:
                    buckets[classify_direction(plane, ln, tol)].append((idx, ln))
                
                #print buckets
                
                for tag in tagorder:
                    ordered.extend(_sort_block(plane, buckets[tag], tag, is_upper))
                    
            sorted_lines = [item[1] for item in ordered]
            index_map = [item[0] for item in ordered]
            
            return sorted_lines, index_map
        
        def snappolyline(polyline, plane, point, moveflag = False, tol = GLOBAL_TOL):
            if polyline.SegmentCount <= 2:
                #print tol
                return [False, polyline]
            
            firstsegment = polyline.SegmentAt(0)
            fsdir = firstsegment.UnitTangent
            planeX = plane.XAxis
            dot = fsdir*planeX
            
            result, targetplanept = plane.RemapToPlaneSpace(point)
                    
            newpoly = [None, None]
            
            polypts = list(polyline)
            firstp = polypts[0]
            secondp = polypts[1]
            otherpts = polypts[1:]
            otherpts2 = polypts[2:]
            
            _, firstplanep = plane.RemapToPlaneSpace(firstp)
            _, secondplanep = plane.RemapToPlaneSpace(secondp)
            
            #print tol
            
            if abs(dot) >= 1 - tol: #same dir
                
                #if False:#moveflag:
                if moveflag:
                    remappedxy = plane.PointAt(targetplanept.X, targetplanept.Y, firstplanep.Z)
                    remapped2nd = plane.PointAt(secondplanep.X, targetplanept.Y, secondplanep.Z) 
                    
                    newpoly = [True, rg.Polyline([remappedxy, remapped2nd]+otherpts2)]
                else:
                    #print "here"
                    remappedxy = plane.PointAt(targetplanept.X, firstplanep.Y, firstplanep.Z)
                    
                    newpoly = [False, rg.Polyline([remappedxy]+otherpts)]
            else:
                
                remappedxy = plane.PointAt(firstplanep.X, targetplanept.Y, firstplanep.Z)
                extrapt = plane.PointAt(targetplanept.X, targetplanept.Y, firstplanep.Z)
                
                newpoly = [True, rg.Polyline([extrapt, remappedxy]+otherpts)]
                #newpoly = [True, rg.Polyline([remappedxy]+otherpts)]
            #print "_______"
            
            #newpoly[1].DeleteShortSegments(tol)
            
            return newpoly
        
        def clean_polyline(pl, mindistance, tol = GLOBAL_TOL):
            # if ≤2 segments, nothing to do
            if pl.SegmentCount <= 2:
                return pl
                
            tol_rad = math.radians(tol)
            pts = list(pl)
            i = 0
            # walk sliding window of 3 segments -> 4 points
            
            while i <= len(pts) - 4:
                p0 = pts[i]
                p1 = pts[i+1]
                p2 = pts[i+2]
                p3 = pts[i+3]
                
                # first segment
                v1 = p1 - p0
                if not v1.Unitize():
                    i += 1
                    continue
                    
                # middle segment: capture its length before unitizing
                raw_v2 = p2 - p1
                seg2_len = raw_v2.Length
                v2 = rg.Vector3d(raw_v2)
                v2.Unitize()
                # third segment
                v3 = p3 - p2
                if not v3.Unitize():
                    i += 1
                    continue
                    
                # angles between segments
                ang12 = rg.Vector3d.VectorAngle(v1, v2)
                ang23 = rg.Vector3d.VectorAngle(v2, v3)
                
                # test both ~90° within tol
                if abs(ang12 - math.pi/2) <= tol_rad and abs(ang23 - math.pi/2) <= tol_rad:
                    # if middle is too short, remove it and merge
                    if seg2_len < mindistance + tol:
                        new_p3 = rg.Point3d(p3)
                        # align along axis of first segment
                        if abs(v1.X) > abs(v1.Y):
                            new_p3.Y = p0.Y
                        else:
                            new_p3.X = p0.X
                        # drop the middle point, replace next point
                        pts.pop(i+2)
                        pts[i+2] = new_p3
                        # shift index by extra 1 so next triplet spans correctly
                        i += 2
                        continue
                i += 1
             
            return rg.Polyline(pts)
        
        def clean_beginning(pl, mindistance, tol = GLOBAL_TOL):
            #print "in clean"
            # if ≤2 segments, nothing to do
            if pl.SegmentCount <= 2:
                return pl
            
            else:
                polypts = copy.deepcopy(list(pl))
                if polypts[1].DistanceTo(polypts[2]) <= mindistance:
                    shift = polypts[1]-polypts[2]
                    polypts[0] -= shift
                    #remove 2nd and 3rd pts
                    popd = polypts.pop(1)
                    popd = polypts.pop(1)
                    return rg.Polyline(polypts)
                else:
                    return pl 
        
        def extend_polyline_segments(pl, mindistance, mode='triplet', tol=GLOBAL_TOL):
            """
            Extend/collapse segments in a polyline.
            
            'triplet'  - three-seg groups: if middle seg is short, extend it.
            'singular' - each seg: if ≤ tol, collapse it
                         elif < mindistance+tol, extend to mindistance.
            'singular_first'- only the first segment
                              if ≤ tol, collapse it
                              elif < mindistance+tol, extend it.
            """
            pl.MergeColinearSegments(tol, False)
            
            # nothing to do for 0 or 1 segment
            if pl.SegmentCount <= 1:
                return pl
        
            # copy points and precompute tolerance in radians
            pts = list(pl)
            tol_rad = math.radians(tol)
        
            # --- Triplet mode ---
            if mode == 'triplet':
                i = 0
                max_i = len(pts) - 4
                while i <= max_i:
                    p0 = pts[i]
                    p1 = pts[i+1]
                    p2 = pts[i+2]
                    p3 = pts[i+3]
        
                    v1 = p1 - p0
                    if not v1.Unitize():
                        i += 1
                        continue
        
                    raw_v2 = p2 - p1
                    seg2_len = raw_v2.Length
                    v2 = rg.Vector3d(raw_v2)
                    v2.Unitize()
        
                    v3 = p3 - p2
                    if not v3.Unitize():
                        i += 1
                        continue
        
                    ang12 = rg.Vector3d.VectorAngle(v1, v2)
                    ang23 = rg.Vector3d.VectorAngle(v2, v3)
        
                    is_perp1 = abs(ang12 - math.pi/2) <= tol_rad
                    is_perp2 = abs(ang23 - math.pi/2) <= tol_rad
                    is_short = seg2_len < mindistance + tol
        
                    if is_perp1 and is_perp2 and is_short:
                        # compute new p2 extended to mindistance
                        new_p2 = rg.Point3d(p1)
                        new_p2 = new_p2 + v2 * mindistance
                        delta = new_p2 - p2
        
                        pts[i+2] = new_p2
        
                        # shift only p3 along the extension axis
                        if abs(raw_v2.X) > abs(raw_v2.Y):
                            pts[i+3].X += delta.X
                        else:
                            pts[i+3].Y += delta.Y
        
                        i += 2
                    else:
                        i += 1
        
            # --- Singular-first mode ---
            elif mode == 'singular_first':
                # only operate on the very first segment
                if len(pts) < 2:
                    return rg.Polyline(pts)
        
                p0 = pts[0]
                p1 = pts[1]
        
                raw_v = p1 - p0
                seg_len = raw_v.Length
        
                # collapse tiny first segment
                if seg_len <= tol:
                    delta = rg.Vector3d(raw_v)
                    pts.pop(1)
                    j = 1
                    while j < len(pts):
                        pts[j].X = pts[j].X - delta.X
                        pts[j].Y = pts[j].Y - delta.Y
                        pts[j].Z = pts[j].Z - delta.Z
                        j = j + 1
        
                # extend short first segment
                elif seg_len < mindistance + tol and len(pts) > 2:
                    v = rg.Vector3d(raw_v)
                    v.Unitize()
                    new_p1 = rg.Point3d(p0)
                    new_p1 = new_p1 + v * mindistance
                    ext_delta = new_p1 - p1
        
                    pts[1] = new_p1
        
                    # shift only the next point along dominant axis
                    if abs(raw_v.X) > abs(raw_v.Y):
                        pts[2].X = pts[2].X + ext_delta.X
                    else:
                        pts[2].Y = pts[2].Y + ext_delta.Y
        
                return rg.Polyline(pts)
        
            # --- Singular mode ---
            elif mode == 'singular':
                i = 0
                while i < len(pts) - 1:
                    p0 = pts[i]
                    p1 = pts[i+1]
        
                    raw_v = p1 - p0
                    seg_len = raw_v.Length
        
                    # collapse tiny segment
                    if seg_len <= tol:
                        delta = rg.Vector3d(raw_v)
                        pts.pop(i+1)
                        j = i + 1
                        while j < len(pts):
                            pts[j].X -= delta.X
                            pts[j].Y -= delta.Y
                            pts[j].Z -= delta.Z
                            j += 1
                        continue
        
                    # extend short segment, only if next point exists
                    if seg_len < mindistance + tol and i+2 < len(pts):
                        v = rg.Vector3d(raw_v)
                        v.Unitize()
                        new_p1 = rg.Point3d(p0)
                        new_p1 = new_p1 + v * mindistance
                        ext_delta = new_p1 - p1
        
                        pts[i+1] = new_p1
        
                        # shift only the very next point along dominant axis
                        if abs(raw_v.X) > abs(raw_v.Y):
                            pts[i+2].X += ext_delta.X
                        else:
                            pts[i+2].Y += ext_delta.Y
        
                    i += 1
        
            # unknown mode: return original
            else:
                return pl
        
            return rg.Polyline(pts)
        
        def repull(MasterPolys, SlavePolys):
            Tol = 0.001
            ANG_EPS = 1e-9
            ParallelDot = 0.999
            SegIndex = 1  
        
            def _unit_xy(v):
                if v.Length > 0.0:
                    v.Unitize()
                return v
        
            def _left_normal_xy(v):
                n = rg.Vector3d(-v.Y, v.X, 0.0)
                if n.Length > 0.0:
                    n.Unitize()
                return n
        
            def _dot_xy(a, b):
                return a.X * b.X + a.Y * b.Y
        
            def _to_polyline(obj):
                if obj is None:
                    return None
                if isinstance(obj, rg.Polyline):
                    return rg.Polyline(obj)
                if isinstance(obj, rg.PolylineCurve):
                    return obj.ToPolyline()
                try:
                    tmp = rg.Polyline()
                    ok = obj.TryGetPolyline(tmp)
                    if ok:
                        return tmp
                except:
                    pass
                return None
        
            Out = []
        
            m_count = len(MasterPolys)
            s_count = len(SlavePolys)
        
            for i in range(m_count):
                m_in = MasterPolys[i]
        
                if i >= s_count:
                    Out.append(m_in)
                    continue
        
                s_in = SlavePolys[i]
        
                m_pl = _to_polyline(m_in)
                s_pl = _to_polyline(s_in)
        
                if m_pl is None or s_pl is None:
                    Out.append(m_in)
                    continue
        
                if m_pl.SegmentCount != s_pl.SegmentCount:
                    Out.append(m_in)
                    continue
        
                if SegIndex < 0 or SegIndex >= m_pl.SegmentCount:
                    Out.append(m_in)
                    continue
        
                ok_parallel = True
                for j in range(m_pl.SegmentCount):
                    ml = m_pl.SegmentAt(j)
                    sl = s_pl.SegmentAt(j)
        
                    md = rg.Vector3d(ml.Direction.X, ml.Direction.Y, 0.0)
                    sd = rg.Vector3d(sl.Direction.X, sl.Direction.Y, 0.0)
        
                    if md.Length <= Tol or sd.Length <= Tol:
                        ok_parallel = False
                        break
        
                    _unit_xy(md)
                    _unit_xy(sd)
        
                    dot = md * sd
                    if dot < 0.0:
                        dot = -dot
        
                    if dot < ParallelDot:
                        ok_parallel = False
                        break
        
                if not ok_parallel:
                    Out.append(m_in)
                    continue
        
                mseg = m_pl.SegmentAt(SegIndex)
                sseg = s_pl.SegmentAt(SegIndex)
        
                dcur = rg.Vector3d(mseg.Direction.X, mseg.Direction.Y, 0.0)
                if dcur.Length <= Tol:
                    Out.append(m_in)
                    continue
                _unit_xy(dcur)
        
                ncur = _left_normal_xy(dcur)
                if ncur.Length <= Tol:
                    Out.append(m_in)
                    continue
        
                p = rg.Point3d(sseg.From)
                a = rg.Vector3d(p.X - mseg.From.X, p.Y - mseg.From.Y, 0.0)
                t = _dot_xy(a, dcur)
                proj = rg.Point3d(mseg.From.X + dcur.X * t, mseg.From.Y + dcur.Y * t, p.Z)
        
                v = rg.Vector3d(proj.X - p.X, proj.Y - p.Y, proj.Z - p.Z)
                d = _dot_xy(v, ncur)
        
                def _along(dir_vec):
                    if dir_vec.Length <= Tol:
                        return rg.Vector3d(ncur.X * d, ncur.Y * d, v.Z)
        
                    dp = rg.Vector3d(dir_vec.X, dir_vec.Y, 0.0)
                    _unit_xy(dp)
        
                    denom = _dot_xy(dp, ncur)
                    if abs(denom) < ANG_EPS:
                        return rg.Vector3d(ncur.X * d, ncur.Y * d, v.Z)
        
                    s = d / denom
                    return rg.Vector3d(dp.X * s, dp.Y * s, v.Z)
        
                segcount = s_pl.SegmentCount
                has_prev = False
                has_next = False
                prev_dir = rg.Vector3d(0.0, 0.0, 0.0)
                next_dir = rg.Vector3d(0.0, 0.0, 0.0)
        
                if SegIndex > 0:
                    pln = s_pl.SegmentAt(SegIndex - 1)
                    prev_dir = rg.Vector3d(pln.Direction.X, pln.Direction.Y, 0.0)
                    if prev_dir.Length > Tol:
                        has_prev = True
        
                if SegIndex < segcount - 1:
                    nln = s_pl.SegmentAt(SegIndex + 1)
                    next_dir = rg.Vector3d(nln.Direction.X, nln.Direction.Y, 0.0)
                    if next_dir.Length > Tol:
                        has_next = True
        
                if has_prev:
                    ds = _along(prev_dir)
                else:
                    ds = rg.Vector3d(ncur.X * d, ncur.Y * d, v.Z)
        
                if has_next:
                    de = _along(next_dir)
                else:
                    de = rg.Vector3d(ncur.X * d, ncur.Y * d, v.Z)
        
                pts = []
                for p0 in s_pl:
                    pts.append(rg.Point3d(p0))
        
                idx0 = SegIndex
                idx1 = SegIndex + 1
        
                if idx0 < 0 or idx1 >= len(pts):
                    Out.append(m_in)
                    continue
        
                p0 = pts[idx0]
                p1 = pts[idx1]
        
                pts[idx0] = rg.Point3d(p0.X + ds.X, p0.Y + ds.Y, p0.Z + ds.Z)
                pts[idx1] = rg.Point3d(p1.X + de.X, p1.Y + de.Y, p1.Z + de.Z)
        
                if s_pl.IsClosed:
                    if idx0 == 0:
                        pts[len(pts) - 1] = rg.Point3d(pts[0])
                    if idx1 == 0:
                        pts[len(pts) - 1] = rg.Point3d(pts[0])
        
                Out.append(rg.Polyline(pts))
            
            return Out
        
        def remove_spikes(pl, tol_deg=GLOBAL_TOL):
            """remove any back‑tracking spikes from a polyline
            spike is detected when two consecutive segments are nearly 180* apart 
            tolerance is defaulted to global tol, but much tighter is reccomended 0.0001
            """
            # if fewer than 2 segments, nothing to clean
            if pl.SegmentCount < 2:
                return pl
            tol = math.radians(tol_deg)
            pts = list(pl)
            i = 0
            while i < len(pts) - 2:
                p0 = pts[i]
                p1 = pts[i+1]
                p2 = pts[i+2]
                v1 = p1 - p0
                if not v1.Unitize():
                    i += 1
                    continue
                v2 = p2 - p1
                if not v2.Unitize():
                    i += 1
                    continue
                ang = rg.Vector3d.VectorAngle(v1, v2)
                # if they reverse direction within tol, drop the spike apex
                if abs(ang - math.pi) <= tol:
                    pts.pop(i+1)
                    # re‑test at same index since list got shorter
                    continue
                i += 1
            return rg.Polyline(pts)
        
        def middle_line_in_rectangle(rect, plane, tol=GLOBAL_TOL):
            center = rect.Center
            dir_y = plane.YAxis
            infinite_line = rg.Line(center - dir_y * 1e6, center + dir_y * 1e6)
        
            rect_curve = rect.ToNurbsCurve()
            intersections = rg.Intersect.Intersection.CurveLine(rect_curve, infinite_line, tol, tol)
        
            if not intersections or intersections.Count != 2:
                return None
        
            pt1 = intersections[0].PointA
            pt2 = intersections[1].PointA
            
            return rg.Line(pt1, pt2)
        
        def apply_perm(seq, perm):
            return [seq[i] for i in perm]
        
        def restore_input_order(seq, idx_track):
            n = len(idx_track)
            out = [None for _ in range(n)]
            for pos, orig in enumerate(idx_track):
                out[orig] = seq[pos]
            return out
        
        def snap_parameters(parameters0, parameters1):
            epsilon = 1e-9
            tol = 0.01
            max_iterations = 50
        
            def abs_float(x):
                if x < 0.0:
                    return -x
                return x
        
            p0 = []
            p1 = []
            i = 0
            for i in range(len(parameters0)):
                p0.append(float(parameters0[i]))
            i = 0
            for i in range(len(parameters1)):
                p1.append(float(parameters1[i]))
        
            n0 = len(p0)
            n1 = len(p1)
            if n0 == 0 or n1 == 0:
                return p0, p1
        
            min0 = p0[0]
            max0 = p0[0]
            i = 1
            for i in range(1, n0):
                v = p0[i]
                if v < min0:
                    min0 = v
                if v > max0:
                    max0 = v
            domain0 = max0 - min0
        
            min1 = p1[0]
            max1 = p1[0]
            i = 1
            for i in range(1, n1):
                v = p1[i]
                if v < min1:
                    min1 = v
                if v > max1:
                    max1 = v
            domain1 = max1 - min1
        
            best_diff = None
            anchor0 = 0
            anchor1 = 0
            i = 0
            for i in range(n0):
                a = p0[i]
                j = 0
                for j in range(n1):
                    b = p1[j]
                    d = a - b
                    if d < 0.0:
                        d = -d
                    if best_diff is None or d < best_diff:
                        best_diff = d
                        anchor0 = i
                        anchor1 = j
        
            if domain0 < domain1:
                delta = p1[anchor1] - p0[anchor0]
                i = 0
                for i in range(n0):
                    p0[i] = p0[i] + delta
            elif domain1 < domain0:
                delta = p0[anchor0] - p1[anchor1]
                j = 0
                for j in range(n1):
                    p1[j] = p1[j] + delta
            else:
                delta = p1[anchor1] - p0[anchor0]
                i = 0
                for i in range(n0):
                    p0[i] = p0[i] + delta
        
            anchor_value = p0[anchor0]
        
            locked0 = []
            locked1 = []
            i = 0
            for i in range(n0):
                locked0.append(False)
            i = 0
            for i in range(n1):
                locked1.append(False)
        
            locked0[anchor0] = True
            locked1[anchor1] = True
        
            def process_side(side):
                iteration = 0
                for iteration in range(max_iterations):
                    candidates = []
        
                    if side == -1:
                        i = 0
                        for i in range(anchor0):
                            if locked0[i]:
                                continue
                            d = p0[i] - anchor_value
                            if d < 0.0:
                                d = -d
                            candidates.append((d, 0, i))
                        j = 0
                        for j in range(anchor1):
                            if locked1[j]:
                                continue
                            d = p1[j] - anchor_value
                            if d < 0.0:
                                d = -d
                            candidates.append((d, 1, j))
                    else:
                        i = anchor0 + 1
                        for i in range(anchor0 + 1, n0):
                            if locked0[i]:
                                continue
                            d = p0[i] - anchor_value
                            if d < 0.0:
                                d = -d
                            candidates.append((d, 0, i))
                        j = anchor1 + 1
                        for j in range(anchor1 + 1, n1):
                            if locked1[j]:
                                continue
                            d = p1[j] - anchor_value
                            if d < 0.0:
                                d = -d
                            candidates.append((d, 1, j))
        
                    if not candidates:
                        break
        
                    candidates.sort()
        
                    changed = False
        
                    ci = 0
                    for ci in range(len(candidates)):
                        d_c, list_id, idx = candidates[ci]
        
                        if list_id == 0 and locked0[idx]:
                            continue
                        if list_id == 1 and locked1[idx]:
                            continue
        
                        if list_id == 0:
                            v_c = p0[idx]
                        else:
                            v_c = p1[idx]
        
                        # collect all "smaller or equal" (closer/equal to anchor) in other list
                        partner_indices = []
                        partner_dists = []
        
                        if list_id == 0:
                            # candidate in list 0, search list 1
                            if side == -1:
                                start = 0
                                end = anchor1
                            else:
                                start = anchor1 + 1
                                end = n1
                            j = start
                            for j in range(start, end):
                                if locked1[j]:
                                    continue
                                d_o = p1[j] - anchor_value
                                if d_o < 0.0:
                                    d_o = -d_o
                                if d_o < d_c - tol or abs_float(d_o - d_c) <= tol:
                                    partner_indices.append(j)
                                    partner_dists.append(d_o)
        
                            if len(partner_indices) > 0:
                                # pick partner furthest from anchor (max distance)
                                best_pos = 0
                                best_d = partner_dists[0]
                                t = 1
                                for t in range(1, len(partner_indices)):
                                    if partner_dists[t] > best_d + epsilon:
                                        best_d = partner_dists[t]
                                        best_pos = t
                                best_k = partner_indices[best_pos]
                                v_o = p1[best_k]
                                delta2 = v_c - v_o
        
                                if side == -1:
                                    k = 0
                                    for k in range(0, best_k + 1):
                                        p1[k] = p1[k] + delta2
                                else:
                                    k = best_k
                                    for k in range(best_k, n1):
                                        p1[k] = p1[k] + delta2
        
                                locked0[idx] = True
                                locked1[best_k] = True
        
                                # lock all closer ones from that list that also matched condition
                                t = 0
                                for t in range(len(partner_indices)):
                                    k2 = partner_indices[t]
                                    d2 = partner_dists[t]
                                    if k2 != best_k:
                                        if d2 + epsilon < best_d:
                                            locked1[k2] = True
        
                                changed = True
        
                        else:
                            # candidate in list 1, search list 0
                            if side == -1:
                                start = 0
                                end = anchor0
                            else:
                                start = anchor0 + 1
                                end = n0
                            i2 = start
                            for i2 in range(start, end):
                                if locked0[i2]:
                                    continue
                                d_o = p0[i2] - anchor_value
                                if d_o < 0.0:
                                    d_o = -d_o
                                if d_o < d_c - tol or abs_float(d_o - d_c) <= tol:
                                    partner_indices.append(i2)
                                    partner_dists.append(d_o)
        
                            if len(partner_indices) > 0:
                                best_pos = 0
                                best_d = partner_dists[0]
                                t = 1
                                for t in range(1, len(partner_indices)):
                                    if partner_dists[t] > best_d + epsilon:
                                        best_d = partner_dists[t]
                                        best_pos = t
                                best_k = partner_indices[best_pos]
                                v_o = p0[best_k]
                                delta2 = v_c - v_o
        
                                if side == -1:
                                    k = 0
                                    for k in range(0, best_k + 1):
                                        p0[k] = p0[k] + delta2
                                else:
                                    k = best_k
                                    for k in range(best_k, n0):
                                        p0[k] = p0[k] + delta2
        
                                locked1[idx] = True
                                locked0[best_k] = True
        
                                t = 0
                                for t in range(len(partner_indices)):
                                    k2 = partner_indices[t]
                                    d2 = partner_dists[t]
                                    if k2 != best_k:
                                        if d2 + epsilon < best_d:
                                            locked0[k2] = True
        
                                changed = True
        
                        if changed:
                            break
        
                    if not changed:
                        break
        
            process_side(-1)
            process_side(1)
        
            return p0, p1
        
        TolDeg = 1.0
        RightDeg = 90.0
        
        def _is_angle_non_orth(v1, v2, tol_deg):
            if v1.IsTiny() or v2.IsTiny():
                return False
            a = rg.Vector3d.VectorAngle(v1, v2)
            deg = math.degrees(a)
            m = deg % RightDeg
            if m > RightDeg * 0.5:
                m = RightDeg - m
            if m > tol_deg:
                return True
            return False
        
        def ispolyselfnonorth(pl):
            segs = pl.GetSegments()
            if len(segs) < 2:
                return False
            for i in range(len(segs) - 1):
                v1 = segs[i].Direction
                v2 = segs[i + 1].Direction
                if _is_angle_non_orth(v1, v2, TolDeg):
                    return True
            return False
        
        def ispolynonorthtoplane(pl, pln):
            segs = pl.GetSegments()
            if len(segs) == 0:
                return False
            v = segs[0].Direction
            x = pln.XAxis
            if _is_angle_non_orth(v, x, TolDeg):
                return True
            return False
        
        ExtLen = 10.0
        
        def poly_add_start_axis_segment(pl, pln):
            # Collect polyline points
            pts = []
            for p in pl:
                pts.append(p)
                
            if len(pts) < 2:
                return pl
        
            p0 = pts[0]
            p1 = pts[1]
        
            # First segment direction (projected into the plane to avoid Z/noise)
            v = p1 - p0
            v.Unitize()
            
            # Plane axes
            x = rg.Vector3d(pln.XAxis)
            y = rg.Vector3d(pln.YAxis)
        
            # Use sign of dot with XAxis to decide:
            # angle in [90..180] (side-agnostic)  <=>  dot(v, x) <= 0
            dx = v * x
            dy = v * y
            
            checkvec = p0 - pln.Origin
            checkvec.Unitize()
        
            dir_vec = None
        
            if dx >= 0.0:
                if checkvec * x < 0:
                    # Choose +Y or -Y based on which makes a shallower angle with the first segment
                    # This is equivalent to choosing the sign of dy in plane coords
                    dir_vec = rg.Vector3d(y)
                    if dy < 0.0:
                        dir_vec.Reverse()
                else:
                    # Choose XAxis, but flip it so it points "toward plane center" (plane origin)
                    dir_vec = rg.Vector3d(x)
                    dir_vec.Unitize()
                    if dir_vec*v < 0:
                        dir_vec.Reverse()
            else:
                if dx < 0 and checkvec * x < 0:
                    dir_vec = rg.Vector3d(x)
                    dir_vec.Reverse()
                else:
                    # Choose +Y or -Y based on which makes a shallower angle with the first segment
                    # This is equivalent to choosing the sign of dy in plane coords
                    dir_vec = rg.Vector3d(y)
                    if dy < 0.0:
                        dir_vec.Reverse()
        
            # IMPORTANT: we insert a NEW START point, so the new first segment is (p0 - p_new)
            # To make that segment direction == dir_vec, we must place p_new at (p0 - dir_vec * ExtLen)
            dir_vec.Unitize()
            p_new = p0 - dir_vec * ExtLen
            pts.insert(0, p_new)
        
            return rg.Polyline(pts)
        
        def scale_around(x, center, factor):
            return x - (center + (x - center) * factor)
        
        if devicemode:
            if abs(devicetolerance) > GLOBAL_TOL:
                panel = LineUtils.offset_rectangle(panel, devicetolerance)
        
        #reusing normal logic if not under condition, dirty patch
        run_else = False
        
        if devicemode and len(polylines) == 1:
            #print "devmode 1"
            dpolyline = polylines[0]
            firstseg = dpolyline.SegmentAt(0)
            hitspanel = LineUtils.lxr(firstseg, [panel], True)
            if hitspanel:
                #print "in panel"
                porigin = panelplane.Origin
                newp = firstseg.ClosestPoint(porigin, False) #treat as infinite
                polypts = list(dpolyline)
                polypts[0] = newp
                rerespaced = rg.PolylineCurve(polypts)
            else:
                run_else = True
        else:
            run_else = True
        
        #portion to handle polylinebundle nonorth to panel
        for i, checkpoly in enumerate(polylines):
            selfno = ispolyselfnonorth(checkpoly)
            planeno = ispolynonorthtoplane(checkpoly, panelplane)
            #print planeno, selfno
            if planeno:
                stubbedpoly = poly_add_start_axis_segment(checkpoly, panelplane)
                polylines[i] = stubbedpoly
                
        #run a check if all segments are already near panel
        closetopanel = 100.0 #hardcoded distance where everythign else could get overriden and simplest direct connection made
        matchpanel = False
        pulledbuffer = []
        
        for polybuffer in polylines:    
            firstseg = polybuffer.SegmentAt(0)
            hitspanel = LineUtils.lxr(firstseg, [panel], True)
            porigin = panelplane.Origin
            shortchecklen = porigin.DistanceTo(polybuffer.First)
            if hitspanel and shortchecklen < closetopanel and polybuffer.SegmentCount > 2:
                newpstart = firstseg.ClosestPoint(porigin, False) #treat as infinite
                newpoly = rg.Polyline([newpstart]+list(polybuffer)[1:])
                pulledbuffer.append(newpoly)
            else:
                break
        else:
            #matchpanel branch if it didnt break
            matchpanel = True
        
        if matchpanel:
            rerespaced = pulledbuffer
        elif run_else:
            #don't use other angles for now, keep 90
            #angleslookup = LineUtils.AngleLookup.ANGLES
            angleslookup = [90]
            
            #boundspreview = LineUtils.rectangle_axis(panel)
            boundspreview = middle_line_in_rectangle(panel, panelplane)
            
            panelwidth = boundspreview.Length
            od_lookup = [LineUtils.ConduitLookup.get_specs(cs)["od"] for cs in conduitsizes]
            
            #1.0" padding on both ends
            padding = 1.0
            positions = x_positions(od_lookup, spacing, 90, padding)
            mostgradualangle = 90
            
            if positions[-1] <= panelwidth:
                #loop from higher to lower except for 90
                for a in angleslookup[-2::-1]:
                    testpos = x_positions(od_lookup, spacing, a, padding)
                    if testpos[-1] <= panelwidth:
                        positions = testpos
                        mostgradualangle = a
                    else:
                        break
                
                #as the most gradual angle is found, center the positions
                offset = (panelwidth-positions[-1])/2
                positions = [p+offset for p in positions][1:-1]
            else:
                #in case positions dont fit even at 90*, scale uniformly to fit
                coof = panelwidth/positions[-1]
                positions = [p*coof for p in positions][1:-1]
            
            startpts = [boundspreview.PointAtLength(p) for p in positions]
            
            boundspreviewnormal = boundspreview.UnitTangent
            
            #print "mostgradualangle : {}".format(mostgradualangle)
            
            #debugging
            b = startpts 
            firstsegments = [poly.SegmentAt(0) for poly in polylines]
            upperg, lowerg = split_up_down(panelplane, firstsegments)
            try:
                uidx, upper = zip(*upperg)
            except:
                pass
            try:
                lidx, lower = zip(*lowerg) 
            except:
                pass
            #debugging end
            
            #loop start
            iteration_counter = 0
            max_iterations = 5 #was 5
            
            #save og before changes
            ogpolylines = [rg.Polyline(list(poly)) for poly in polylines]
            lastflags = [False for _ in ogpolylines]
            
            # set up a dict to hold each quadrant’s offset
            offsetsdict = dict.fromkeys(('upperleft','upperright','lowerleft','lowerright'), 0)
            
            while iteration_counter < max_iterations:
                iteration_counter += 1
                #print [p.Length for p in polylines]
                
                #prefilter
                for p in polylines:
                    p.MergeColinearSegments(GLOBAL_TOL, False)
                    p.DeleteShortSegments(GLOBAL_TOL)
            
                #print [p.Length for p in polylines]
                
                firstsegments = [poly.SegmentAt(0) for poly in polylines]
                sorted_curves, lookupidx = sort_lines(panelplane, firstsegments)
                
                polylines = apply_perm(polylines, lookupidx)
                conduitsizes = apply_perm(conduitsizes, lookupidx)
                lastflags = apply_perm(lastflags, lookupidx)
                orig_idx = apply_perm(orig_idx, lookupidx)
                sorted_polys = polylines
                
                #snapping pass
                #print "iteration ", iteration_counter
                #print "prepass", lastflags
                
                flags, polylines = zip(*[snappolyline(polyline, panelplane, point, mflag) for polyline, point, mflag in zip(sorted_polys, startpts, lastflags)])
                #flags, polylines = zip(*[snappolyline(polyline, panelplane, point, True) for polyline, point, mflag in zip(sorted_polys, startpts, lastflags)])
                
                lastflags = list(flags)
                
                #print [p.Length for p in polylines], "here"
                
                #print "afterpass", lastflags
                
                #polylines = snapped
                tweakedpoly = []
                
                for poly, conduitsize, conduitsize_, pidx in zip(polylines, conduitsizes, conduitsizes_, range(len(polylines))):
                    #print "here", iteration_counter
                    od_size = LineUtils.ConduitLookup.get_specs(conduitsize)["od"]
                    #linearstub = LineUtils.ConduitLookup.get_specs(conduitsize)['linear_section']
                    #bendradius = LineUtils.ConduitLookup.get_specs(conduitsize)['min_bend']
                    linearstub = LineUtils.ConduitLookup.get_specs(conduitsize_)['linear_section']
                    bendradius = LineUtils.ConduitLookup.get_specs(conduitsize_)['min_bend']
                    
                    startcut = LineUtils._compute_cut(bendradius, linearstub, 90)
                    
                    #to be safe calculated at 2x 90 degree turns + the linear section between
                    #checklength = 0#experiment at 0
                    checklength = lineargap + startcut*2 
                    
                    #print checklength
                    
                    first_s = poly.SegmentAt(0)
                    first_s_len = first_s.Length
                    
                    next_s_len = float('inf')
                    if poly.SegmentCount > 1:
                        next_s = poly.SegmentAt(1)
                        next_s_len = next_s.Length
                    
                    polypts = list(poly)
                    
                    filteredpts = polypts
                    
                    #print "iteration ", iteration_counter
                    
                    
                    
                    #checking first and second for potentiall shortness
                    if first_s.Length < checklength or next_s_len < checklength:
                        #print "here"
                        lastflags[pidx] = False #reset flag
                        #print next_s_len < checklength
                        if len(polypts) == 2:
                            #unchanged
                            pass
                        elif abs(boundspreviewnormal*first_s.UnitTangent) < GLOBAL_TOL or next_s_len < checklength:
                            #if the first segment is short and perpendicular to panel
                            #need to also remove second to fix it
                            #or if the second is too short need to remove 1st and 2nd
                            #remove first 2 segments
                            if len(polypts) > 3:
                                filteredpts = polypts[2:]
                            else:
                                filteredpts = polypts[1:]
                            #print "here"
                        else:
                            #print "here"
                            #remove first segment, leave just last one
                            filteredpts = polypts[1:]
                        #else:
                            #remove first 2 segments
                            #filteredpts = polypts[2:]
                    
                    else:
                        pass
                        #print "passed"
                    
                    if abs(boundspreviewnormal*first_s.UnitTangent) < GLOBAL_TOL and False:
                        #print "here"
                        filteredpts = filteredpts[1:] #remove 1 more
            #        if next_s_len < checklength:
            #            #print next_s_len
            #            filteredpts = filteredpts[1:] #remove 1 more
                    
                    tweakedpoly.append(rg.Polyline(filteredpts))
                
                #print "afterlenchecks", lastflags
                
                #reassign
                polylines = tweakedpoly
            
            #print [p.Length for p in polylines]
            
            #snap too close segments
            adjustedpoly = []
            
            smallestangle = LineUtils.AngleLookup.ANGLES[0]
            #print smallestangle, "smallestangle"
            
            #prefilter
            for p in polylines:
                p.MergeColinearSegments(GLOBAL_TOL, False)
                p.DeleteShortSegments(GLOBAL_TOL)
            
            checkpolys = polylines
            c = []
            
            
            sorters = []
            upperleft = []
            upperright = []
            lowerleft = []
            lowerright = []
            
            #print polylines
            #print [p.Length for p in polylines]
            
            #print "START HERE"
            
            for pl, p, idx in zip(polylines, startpts, range(len(polylines))):
                nc = pl.ToNurbsCurve()
                p2 = nc.PointAtLength(min(pl.Length-GLOBAL_TOL, 20.0))
                sline = rg.Line(p, p2)
                sorters.append(sline)
                u, l = split_up_down(panelplane, [sline])
                if u:
                    #print u[0][1]
                    dir = classify_direction(panelplane, u[0][1], 0.0001)
                    if dir == "left":
                        upperleft.append(idx)
                    else:
                        upperright.append(idx)
                if l:
                    dir = classify_direction(panelplane, l[0][1], 0.0001)
                    #print dir
                    if dir == "left":
                        lowerleft.append(idx)
                    else:
                        lowerright.append(idx)
            
            #print "upperleft {}, upperright {}, lowerleft {}, lowerright {}".format(upperleft, upperright, lowerleft, lowerright)
            
            # build a lookup dict mapping each index to its “quadrant” name
            quadrant = {}
            quadrant.update({i: 'upperleft'   for i in upperleft})
            quadrant.update({i: 'upperright'  for i in upperright})
            quadrant.update({i: 'lowerleft'   for i in lowerleft})
            quadrant.update({i: 'lowerright'  for i in lowerright})
            
            #print quadrant
            #print offsetsdict
            
            #sortedsorters, lookupidx = sort_lines(panelplane, sorters)
            #
            #print lookupidx
            
            ##offset for 90 degree turns
            #curroffset = 0
            #upperleftoffset = 0
            #upperrightoffset = 0
            #lowerleftoffset = 0
            #lowerrightoffset = 0
            
            #resort for finalprocessing
            neworder = range(len(polylines))
            neworder = upperleft + upperright[::-1] + lowerleft + lowerright[::-1]
            
            polylines = apply_perm(polylines, neworder)
            conduitsizes = apply_perm(conduitsizes, neworder)
            startpts = apply_perm(startpts, neworder)
            orig_idx = apply_perm(orig_idx, neworder)
            
            #print neworder
            #neworder = [neworder[i] for i in neworder]
            
            for polyline, conduitsize, conduitsize_, point, sortidx in zip(polylines, conduitsizes, conduitsizes_, startpts, range(len(polylines))):
                #print sortidx
                q = quadrant.get(sortidx)
                #print loc
                
                polyline.MergeColinearSegments(GLOBAL_TOL, False)
                #rg.Polyline.MergeColinearSegments(GLOBAL_TOl, FALSE)
                
                od_size = LineUtils.ConduitLookup.get_specs(conduitsize)["od"]
                #linearstub = LineUtils.ConduitLookup.get_specs(conduitsize)['linear_section']
                #bendradius = LineUtils.ConduitLookup.get_specs(conduitsize)['min_bend']
                linearstub = LineUtils.ConduitLookup.get_specs(conduitsize_)['linear_section']
                bendradius = LineUtils.ConduitLookup.get_specs(conduitsize_)['min_bend']
                
                #calculate for smallest angle
                startcut = LineUtils._compute_cut(bendradius, linearstub, smallestangle)
                
                minlength = lineargap + startcut*2 
                minimalraise = LineUtils.compute_raise(minlength, smallestangle)
                
                polypts = list(polyline)
                
                first_s = polyline.SegmentAt(0)
                firstp = polypts[0]
                secondp = polypts[1]
                otherpts2 = polypts[2:]
                
                c.append(first_s)
                
                #print first_s.UnitTangent
                #print  round(abs(boundspreviewnormal*first_s.UnitTangent))
                #print polyline.SegmentCount
                #print "___"
            
                _, planep = panelplane.RemapToPlaneSpace(point)
                _, firstplanep = panelplane.RemapToPlaneSpace(firstp)
                
                if abs(boundspreviewnormal*first_s.UnitTangent) < GLOBAL_TOL:
                    heightshiftsigned = planep.Y - firstplanep.Y
                    heightshift = abs(heightshiftsigned)
                    #if startsegment is within minlength from panel exit
                    #than shift it to panel exit
                    if heightshift < minimalraise:# and False:
                        print heightshift ,minimalraise
                        #print "first trigger"
                        _, secondplanep = panelplane.RemapToPlaneSpace(secondp)
                        #print "shifting"
                        remappedxy = panelplane.PointAt(planep.X, planep.Y, firstplanep.Z)
                        remapped2nd = panelplane.PointAt(secondplanep.X, planep.Y, secondplanep.Z) 
                        
                        newpoly = rg.Polyline([remappedxy, remapped2nd]+otherpts2)
                        adjustedpoly.append(newpoly)
                    #else process shift at specified parameters
                    else:
                        #print "in here"
                        anglecalc = LineUtils.fit_angle_to_height(minlength, heightshift)
                        minfitted = LineUtils.smallest_ge(LineUtils.AngleLookup.ANGLES, anglecalc)
                        
                        offsetdist = abs(planep.Y -firstplanep.Y)
                        
                        #at the most gradual offset
                        #mostgradualangle = 45
                        #print mostgradualangle
                        startcut_ = LineUtils._compute_cut(bendradius, linearstub, mostgradualangle)
                        minlength_ = lineargap + startcut_*2 
                        minimalraise_ = LineUtils.compute_raise(minlength_, mostgradualangle)
                        minrun = LineUtils.compute_run(minlength_, mostgradualangle)
                        minopp = LineUtils.compute_opposite(offsetdist, 90-mostgradualangle)
                        
                        _, secondplanep = panelplane.RemapToPlaneSpace(secondp)
                        
                        conditions = [
                            first_s.Length >= minopp+minlength,   #length of first segment has to be larger than minimal opposite righttriangle side and minimal length of 2 fitting + space between
                            offsetdist >= minimalraise_,  #it has to be shifted more than minimalraise else fittings + space between wont fit
                            offsetdist <= minimalraise_*offsetshitcoof,  #this is a visual addition to prevent extremely long angled segments
                            mostgradualangle < 90  #90 degree isnt angled, it has to start with straight segment, so its excluded
                        ]
                        
                        #need to add 2 fittings at end
                        #if first_s.Length >= minopp+minlength and offsetdist >= minimalraise_ and offsetdist <= minimalraise_*offsetshitcoof and mostgradualangle < 90: 
                        if all(conditions): #too many conditions, more elegant this way
                            #print minimalraise_*offsetshitcoof
                            #print "can fit !!"
                            newp = first_s.PointAtLength(minopp) #pnt at distance and at parameter ISNT always same for lines
                            #panelplane.PointAt(minopp, secondplanep.Y, secondplanep.Z)
                            adjustedpoly.append(rg.Polyline([point, newp, secondp]+otherpts2))
                        else:
                            #print "here"
                            #if point falls within plane, let it be
                            if abs(firstplanep.Y) <= panelwidth/2 and len(polylines) == 1:
                                #print "here"
                                adjustedpoly.append(polyline)
                            else:
                                #start offsets
                                curroffset = 0
                                
                                if offsetsdict[q] == 0:
                                    offsetsdict[q] = minlength
                                else:
                                    offsetsdict[q] = offsetsdict[q] + od_size + spacing
                                
                                curroffset = offsetsdict[q]
            #                    if curroffset == 0:
            #                        curroffset = minlength
            #                    else:
            #                        #add spacing and its diameter (diamter isnt super accurate but will do)
            #                        curroffset += od_size + spacing
                                
                                if secondplanep.X > 0:
                                    newpone = panelplane.PointAt(curroffset, planep.Y, planep.Z)
                                    newptwo = panelplane.PointAt(curroffset, secondplanep.Y, planep.Z)
                                else:
                                    newpone = panelplane.PointAt(-curroffset, planep.Y, planep.Z)
                                    newptwo = panelplane.PointAt(-curroffset, secondplanep.Y, planep.Z)
                                
                                adjustedpoly.append(rg.Polyline([point, newpone, newptwo, secondp]+otherpts2))
                                    
                                #print "cant fit"
                        
                        #print planep.Y, firstplanep.Y, offsetdist, "___",minlength_,   minimalraise_, minrun, "__", minopp
                        
                        #
                        #print anglecalc, minfitted
                        
                        #print minlength, heightshift, anglecalc, heightshiftsigned
                        #print minfitted
                        #print "___"
                        
                        #if panel exits dont fit for minimal segments length in a bundle
                        #compress all to fit
                        
                        #if 90 degrees need extra processing
                        if mostgradualangle >= 90:
                            pass
                            #adjustedpoly.append(polyline)
                        #under 90 degrees gradual, do gradual directly out of panel
                        else:
                            #print mostgradualangle
                            pass
                            #adjustedpoly.append(polyline)
                    #print planep.Y
                    #print firstp.Y
                    
                    #print "pass"
                    
                #perpendicular
                else:
                    #print "here"
                    #check if it can connect
                    _, secondplanep = panelplane.RemapToPlaneSpace(secondp)
                    #print secondplanep
                    #print planep
                    secondshifted = rg.Point3d(secondplanep.X, planep.Y, secondplanep.Z)
                    #print secondshifted
                    checkdist = secondplanep.DistanceTo(secondshifted)
                    #just a direct connection
                    if checkdist<minlength and len(polypts) == 2 and removeshorts:
                        #print "direct connection"
                        #adjustedpoly.append(rg.Polyline([point, secondp]))
                        pass
                        adjustedpoly.append(rg.Polyline([point, secondp]))
                    #90* connection
                    else:
                        #print "90* connection"
                        shiftedinplane = panelplane.PointAt(secondshifted.X, secondshifted.Y, secondshifted.Z)
                        #adjustedpoly.append(rg.Polyline([point, shiftedinplane, secondp]))
                        adjustedpoly.append(rg.Polyline([point, shiftedinplane, secondp]+otherpts2))
                    #print checkdist
                    #print "perpendicular"
                    #a = snappolyline(polyline, panelplane, point, False, 0.02)
                    #print "aftersnap"
                    #adjustedpoly.append(polyline)
                    #not perpendicular to panel
                    pass
                #print minimalraise
            
            readjustedpoly = []
            
            upperleftmin = 0
            upperrightmin = 0
            lowerleftmin = 0
            lowerrightmin = 0
            
            upperleftfs = []
            upperrightfs = []
            lowerleftfs = []
            lowerrightfs = []
            
            def finalsortkey(poly):
                _, p = panelplane.RemapToPlaneSpace(list(poly)[0])
                return round(p.Y, 3)
            
            def fit_number(lst, x ,spacing, tol = GLOBAL_TOL):
                if not lst:
                    return x
                    
                s=sorted(lst)
                c=x
                
                while True:
                    blocker=None
                    for y in s:
                        # only tolerate being closer than (spacing - GLOBAL_TOL)
                        if abs(c-y) < spacing - tol:
                            blocker=y
                            break
                    # no conflicts -> c fits everywhere
                    if blocker is None:
                        return c
                    # bump c up just past the blocker by full spacing
                    c=blocker + spacing
            
            fittol = 0.01
            
            for polyline_, conduitsize in zip(adjustedpoly, conduitsizes):
                od_size = LineUtils.ConduitLookup.get_specs(conduitsize)["od"]
                linearstub = LineUtils.ConduitLookup.get_specs(conduitsize)['linear_section']
                bendradius = LineUtils.ConduitLookup.get_specs(conduitsize)['min_bend']
                
                polyline = polyline_
                
                #calculate for smallest angle
                startcut = LineUtils._compute_cut(bendradius, linearstub, smallestangle)
                
                minlength = lineargap + startcut*2 
                
                secondsegment = polyline.SegmentAt(1) if polyline.SegmentCount > 1 else polyline.SegmentAt(0)
                firstslen = polyline.SegmentAt(0).Length
                
                u, l = split_up_down(panelplane, [secondsegment])
                
                minoffset = minlength
                
                spcng = od_size + spacing
                #minlen = minlength-spcng
                minlen = minlength
                #print "spacing {}".format(spcng)
                
                #startcut = 0.01 #testing
                
                if u:
                    #print u[0][1]
                    dir = classify_direction(panelplane, u[0][1], 0.0001)
                    if dir == "left":
                        if upperleftmin == 0:
                            upperleftmin = minlen
                            #
                        else:
                            upperleftmin += spcng
                        #minoffset = upperleftmin
                        #upperleftfs.append(max(firstslen, upperleftmin))
                        minoffset = fit_number(upperleftfs, upperleftmin, spcng, fittol) 
                        upperleftfs.append(max(firstslen, minoffset))
                    else:
                        if upperrightmin == 0:
                            upperrightmin = minlen
                        else:
                            upperrightmin += spcng
                        #minoffset = upperrightmin
                        #upperrightfs.append(max(firstslen, upperrightmin))
                        minoffset = fit_number(upperrightfs, upperrightmin, spcng, fittol) 
                        upperrightfs.append(max(firstslen, minoffset))
                if l:
                    dir = classify_direction(panelplane, l[0][1], 0.0001)
                    #print dir
                    if dir == "left":
                        if lowerleftmin == 0:
                            lowerleftmin = minlen
                        else:
                            lowerleftmin += spcng
                        #minoffset = lowerleftmin
                        #lowerleftfs.append(max(firstslen, lowerleftmin))
                        #print lowerleftfs
                        #print lowerleftmin
                        minoffset = fit_number(lowerleftfs, lowerleftmin, spcng, fittol) 
                        lowerleftfs.append(max(firstslen, minoffset))
                        #print minoffset
                        #minoffset = 0
                    else:
                        if lowerrightmin == 0:
                            lowerrightmin = minlen
                        else:
                            lowerrightmin += spcng
                        #minoffset = lowerrightmin
                        #lowerrightfs.append(max(firstslen, lowerrightmin))
                        minoffset = fit_number(lowerrightfs, lowerrightmin, spcng, fittol) 
                        lowerrightfs.append(max(firstslen, minoffset))
                
                #ensure minlength for all segments, but calculated first only for first obv
                #extended = extend_polyline_segments(polyline, minlength, 'singular')
                #extended = extend_polyline_segments(extended, minoffset, 'singular_first')
                extended = extend_polyline_segments(polyline, minoffset, 'singular_first')
        
                polyline = extended
                
                #iteratively clean for a couple iterations
                for j in range(0):
                    unspiked = remove_spikes(polyline, 0.0001)
                    if unspiked.SegmentCount <= 3:
                        pass
                        minlength = startcut*2  #let it fit without linear segment
                        minlength = 0.01
                        
                    cleaned = clean_polyline(unspiked, minlength)
            
                    polyline = cleaned
                
                #extended = extend_polyline_segments(polyline, minlength, 'singular')
                #extended = polyline
                #print minlength
                
                readjustedpoly.append(polyline)
                #readjustedpoly.append(polyline_)
            
            readjustedpoly_debug = [rc.ToPolylineCurve() for rc in readjustedpoly]
            
            ##finalsort
            #firstsegments = [poly.SegmentAt(1) for poly in adjustedpoly]
            ##print firstsegments
            #sorted_curves, lookupidx = sort_lines(panelplane, firstsegments)
            #
            #print lookupidx
            
            adjustedpoly = restore_input_order(adjustedpoly, orig_idx)
            readjustedpoly = restore_input_order(readjustedpoly, orig_idx)
            polylines = restore_input_order(polylines, orig_idx)
            
            snapped = polylines
            
            # ---- extra per-side push using 2nd segment in panelplane X ----
            
            origin_ok, origin_uv = panelplane.RemapToPlaneSpace(panelplane.Origin)
            
            left_indices = []
            right_indices = []
            center_indices = []
            mid_x_values = []
            
            for idx, pl in enumerate(readjustedpoly):
                if pl.SegmentCount > 1:
                    seg = pl.SegmentAt(1)
                else:
                    seg = pl.SegmentAt(0)
            
                mid_pt = seg.PointAt(0.5)
                remap_ok, mid_uv = panelplane.RemapToPlaneSpace(mid_pt)
            
                if remap_ok:
                    mid_x = mid_uv.X
                    dx = mid_x - origin_uv.X
                else:
                    mid_x = None
                    dx = 0.0
            
                mid_x_values.append(mid_x)
            
                if dx > GLOBAL_TOL:
                    left_indices.append(idx)
                elif dx < -GLOBAL_TOL:
                    right_indices.append(idx)
                else:
                    center_indices.append(idx)
            
            # if some land exactly on origin X, assign them to the smaller side
            for idx in center_indices:
                if len(left_indices) <= len(right_indices):
                    left_indices.append(idx)
                else:
                    right_indices.append(idx)
            
            # find bundles: indices whose 2nd segment X matches some other 2nd segment X
            stacked_indices = set()
            for i in range(len(mid_x_values)):
                x_i = mid_x_values[i]
                if x_i is None:
                    continue
                for j in range(len(mid_x_values)):
                    if i == j:
                        continue
                    x_j = mid_x_values[j]
                    if x_j is None:
                        continue
                    if abs(x_j - x_i) <= GLOBAL_TOL:
                        stacked_indices.add(i)
                        break
            
            n_left = len(left_indices)
            n_right = len(right_indices)
            #print "n_left, n_right:", n_left, n_right
            
            extra_left = 0.0
            extra_right = 0.0
            
            #for now
            smallestconduit = min(conduitsizes_)
            
            if spacing_ > 0.0:
                if n_left > 1:
                    extra_left = 0.5 * (spacing_ + smallestconduit) * float(n_left - 1)
                if n_right > 1:
                    extra_right = 0.5 * (spacing_ + smallestconduit) * float(n_right - 1)
            
            #print extra_left, extra_right
            
            # direction along which the 2nd segment should move "away" in panelplane
            push_axis = rg.Vector3d(panelplane.XAxis)  # change to YAxis if that is your push dir
            if not push_axis.IsZero:
                push_axis.Unitize()
            
                new_readjusted = []
            
                for idx, pl in enumerate(readjustedpoly):
                    d = 0.0
                    if idx in left_indices:
                        d = extra_left
                    elif idx in right_indices:
                        d = -extra_right  # negative to move away from origin on the other side
            
                    # only push if:
                    # - this index is part of a stacked bundle (same X as others)
                    # - 2nd segment is NOT the last one
                    if d != 0.0 and idx in stacked_indices:
                        seg_count = pl.SegmentCount
                        if seg_count > 2 and pl.Count > 2:
                            move_vec = rg.Vector3d(push_axis)
                            move_vec = move_vec * d
            
                            pts = list(pl)
                            # move only the 2nd segment endpoints: pts[1] and pts[2]
                            pts[1] = pts[1] + move_vec
                            pts[2] = pts[2] + move_vec
            
                            new_pl = rg.Polyline(pts)
                            new_readjusted.append(new_pl)
                        else:
                            new_readjusted.append(pl)
                    else:
                        new_readjusted.append(pl)
            
                readjustedpoly = new_readjusted
            
            # ---- end extra per-side push ----
            
            #cached
            spacing = spacing_
            conduitsize = gh.DataTree[System.Object]()#conduitsizes_
            polylines = gh.DataTree[System.Object]()
            
            conduitsize.AddRange(conduitsizes_, defaultpath)
            polylines.AddRange(readjustedpoly, defaultpath)
            
            polylines_LR = gh.DataTree[System.Object]()
            conduitsize_LR = gh.DataTree[System.Object]()
            
            path_left = gh.Kernel.Data.GH_Path(0)
            path_right = gh.Kernel.Data.GH_Path(1)
            
            for idx, pl in enumerate(readjustedpoly):
                size = conduitsizes_[idx]
            
                if idx in left_indices:
                    polylines_LR.Add(pl, path_left)
                    conduitsize_LR.Add(size, path_left)
                elif idx in right_indices:
                    polylines_LR.Add(pl, path_right)
                    conduitsize_LR.Add(size, path_right)
                else:
                    # should not happen because center_indices are reassigned,
                    # but keep it in defaultpath just in case
                    polylines_LR.Add(pl, defaultpath)
                    conduitsize_LR.Add(size, defaultpath)
            
            #print conduitsize.Branch(0)
            #print polylines.Branch(0)
            #print  gh.DataTree[System.Int32]([0], defaultpath)
            
            sp = LineUtils.Spacing()
            
            #sp_results = sp.Run(polylines, conduitsize, optionalkeys = gh.DataTree[System.Int32]([0], defaultpath),
            #                    spacing = spacing, perpanel = False, perlevel = False, 
            #                    pulltogether = True, pushflag = False, pullstart = pullstart)
            
            #pushflag is resource intensive
            sp_results = sp.Run(polylines_LR, conduitsize_LR, optionalkeys = gh.DataTree[System.Int32]([0], defaultpath),
                                spacing = spacing, perpanel = True, perlevel = False, 
                                pulltogether = True, pushflag = False, pullstart = pullstart)
            
            rawlinelookup, linelookup, rebuiltree, polys, polys2, finaltree, treeflags, doublepolys, Boundaryobjects = sp_results
            
            #2 step process for 2nd segment to ensure proper order
            #repull(MasterPolys, SlavePolys)
            repulltest = gh.DataTree[System.Object]()
            
            for path in polylines_LR.Paths:
                masterpolys = list(polylines_LR.Branch(path))
                slavepolys = list(finaltree.Branch(path))
                #print " len(masterpolys), len(slavepolys)", len(masterpolys), len(slavepolys)
                repulled = repull(masterpolys, slavepolys)
                #print "repulled ", len(repulled)
                repulltest.AddRange(repulled, path)
                #repulltest.extend(repulled)
            
            sp2 = LineUtils.Spacing()
            sp_results2 = sp2.Run(repulltest, conduitsize_LR, optionalkeys = gh.DataTree[System.Int32]([0], defaultpath),
                                spacing = spacing, perpanel = True, perlevel = False, 
                                pulltogether = True, pushflag = False, pullstart = pullstart)
                                
            rawlinelookup, linelookup, rebuiltree, polys, polys2, rerespaced_, treeflags, doublepolys, Boundaryobjects = sp_results2
            finaltree = gh.DataTree[System.Object]()
            
            for path in rerespaced_.Paths:
                r_polys = list(rerespaced_.Branch(path))
                c_sizes = list(conduitsize_LR.Branch(path))
                
                for rpoly, conduitsize in zip(r_polys, c_sizes):
                    od_size = LineUtils.ConduitLookup.get_specs(conduitsize)["od"]
                    linearstub = LineUtils.ConduitLookup.get_specs(conduitsize)['linear_section']
                    bendradius = LineUtils.ConduitLookup.get_specs(conduitsize)['min_bend']
                    
                    startcut = LineUtils._compute_cut(bendradius, linearstub, smallestangle)
                    minlength = lineargap + startcut*2 
                    minlength_ = startcut*2 
                    
                    #cleaned = clean_polyline(rpoly, minlength)
                    cleaned = clean_beginning(rpoly, minlength_) #do without linear as more conservative for now 
                    finaltree.Add(cleaned, path)
            
            respaced = []
            
            planeY = panelplane.YAxis
            planeY.Unitize()
            
            cutstart = True
            
            if finaltree.BranchCount <= 1:
                cutstart = False
                #for simplicity of unification
                
                if path_left in finaltree.Paths:
                    finaltree.AddRange([], path_right)
                else:
                    finaltree.AddRange([], path_left)
            
            #if only one line on a side and it would be reasonable to just run it straight
            porigin = panelplane.Origin
            panelXax = panelplane.XAxis
            
            for branch in finaltree.Branches:
                if len(branch) == 1:
                    #checking hits
                    dpolyline = branch[0]
                    firstseg = dpolyline.SegmentAt(0)
                    lastseg = dpolyline.SegmentAt(dpolyline.SegmentCount - 1)
                    hitspanel1 = LineUtils.lxr(lastseg, [panel], True)
                    hitspanel2 = LineUtils.lxr(firstseg, [panel], True)
                    
                    shortchecklen = porigin.DistanceTo(dpolyline.Last)
                    manhcheck = shortchecklen <= manhattanradius
                    #short segment manhattan
                    if manhcheck:
                        #print "shortie"
                        checkline = rg.Line(dpolyline.Last,  panelXax)
                        hitcheck = LineUtils.lxr(checkline, [panel], True)
                        newp = checkline.ClosestPoint(porigin, False) #treat as infinite
                        newpoly = rg.Polyline([newp, dpolyline.Last])
                        branch[0] = newpoly
                    else:
                        if hitspanel1 and hitspanel2 and manhcheck:
                            #print "in panel"
                            newp = lastseg.ClosestPoint(porigin, False) #treat as infinite
                            newpoly = rg.Polyline([newp, dpolyline.Last])
                            branch[0] = newpoly
                else:
                    for i in range(len(branch)):
                        dpolyline = branch[i]
                        #snake segments within a panel, special case, was 3 do for all ? 
                        if dpolyline.SegmentCount == 3:
                            firstseg = dpolyline.SegmentAt(0)
                            lastseg = dpolyline.SegmentAt(dpolyline.SegmentCount - 1)
                            hitspanel1 = LineUtils.lxr(lastseg, [panel], True)
                            hitspanel2 = LineUtils.lxr(firstseg, [panel], True)
                            if hitspanel1 and hitspanel2:
                                #print "in panel"
                                newpstart = firstseg.ClosestPoint(porigin, False) #treat as infinite
                                newpend = firstseg.ClosestPoint(dpolyline.Last, False) #treat as infinite
                                newpoly = rg.Polyline([newpstart, newpend])
                                branch[i] = newpoly
                        else:
                            pass
                            #print "here not snake"
            if False:
            #if finaltree.BranchCount <= 1:
                for branch in finaltree.Branches:
                    respaced.extend(list(branch))
            else:
                parameters0 = []
                parameters1 = []
                offsets0 = []
                offsets1 = []
                offsets_left_branch = []
                offsets_right_branch = []
                
                for j in [0, 1]:
            #        try:
                    for poly in finaltree.Branch(j):
                        startp = poly.First
                        remap_ok, mid_uv = panelplane.RemapToPlaneSpace(startp)
                        par = mid_uv.Y
                        if j == 0:
                            parameters0.append(par)
                        else:
                            parameters1.append(par)
            #        except:
            #            pass
                
                parameters0.sort()
                parameters1.sort()
                
                #print parameters0, parameters1
                
                if pullstart:
                    new0, new1 = snap_parameters(parameters0, parameters1)
                else:
                    new0, new1 = parameters0, parameters1
                
                #print new0, new1
                
                workwidth = 1.0
                if sidesextra * 2 < panelwidth * 0.5:
                    workwidth = panelwidth - sidesextra * 2
                else:
                    workwidth = panelwidth
                
                panelzero = panelplane.Origin.Y
                allpars = new0 + new1
                minpar_ = min(allpars)
                maxpar_ = max(allpars)
                midpar_ = minpar_ * 0.5 + maxpar_ * 0.5
                pardomain_ = abs(maxpar_ - minpar_)
                paroffset = midpar_ - 0
                scalefactor = 1.0
                
                if pardomain_ > workwidth:
                    scalefactor = workwidth / pardomain_
                
                #scalefactor = 1.0
                
                for p0, n0 in zip(parameters0, new0):
                    offset0 = n0 - p0 - paroffset
                    off0 = p0 + offset0
                    scalef = off0 * (1 - scalefactor)
                    offset0 -= scalef
                    ovec0 = copy.deepcopy(planeY)
                    ovec0 *= offset0
                    offsets0.append(ovec0)
                
                for p1, n1 in zip(parameters1, new1):
                    offset1 = n1 - p1 - paroffset
                    off1 = p1 + offset1
                    scalef = off1 * (1 - scalefactor)
                    offset1 -= scalef
                    ovec1 = copy.deepcopy(planeY)
                    ovec1 *= offset1
                    offsets1.append(ovec1)
                
                #print offsets0, offsets1
                
                # build offsets per-branch, matching branch poly order
                left_polys = list(finaltree.Branch(0))
                right_polys = list(finaltree.Branch(1))
                used0 = [False] * len(parameters0)
                used1 = [False] * len(parameters1)
                tol_par = 1e-6
                
                porigin = panelplane.Origin
                
                run_else = False
                
                for poly in left_polys:
                    startp = poly.First
                    remap_ok, mid_uv = panelplane.RemapToPlaneSpace(startp)
                    par = mid_uv.Y
                    offset_vec = None
                    for k in range(len(parameters0)):
                        if not used0[k]:
                            if abs(parameters0[k] - par) <= tol_par:
                                offset_vec = offsets0[k]
                                used0[k] = True
                                break
                    offsets_left_branch.append(offset_vec)
                
                for poly in right_polys:
                    startp = poly.First
                    remap_ok, mid_uv = panelplane.RemapToPlaneSpace(startp)
                    par = mid_uv.Y
                    offset_vec = None
                    for k in range(len(parameters1)):
                        if not used1[k]:
                            if abs(parameters1[k] - par) <= tol_par:
                                offset_vec = offsets1[k]
                                used1[k] = True
                                break
                    offsets_right_branch.append(offset_vec)
                
                # original respaced (not strictly needed, but kept)
                for branch in finaltree.Branches:
                    respaced.extend(list(branch))
                
                # reorder to match readjustedpoly indexing
                left_set = set(left_indices)
                right_set = set(right_indices)
                
                respaced_ordered = []
                offsets_respaced = []
                left_i = 0
                right_i = 0
                
                for idx in range(len(readjustedpoly)):
                    if idx in left_set:
                        respaced_ordered.append(left_polys[left_i])
                        offsets_respaced.append(offsets_left_branch[left_i])
                        left_i += 1
                    elif idx in right_set:
                        respaced_ordered.append(right_polys[right_i])
                        offsets_respaced.append(offsets_right_branch[right_i])
                        right_i += 1
                    else:
                        respaced_ordered.append(readjustedpoly[idx])
                        offsets_respaced.append(None)
                
                respaced = respaced_ordered
                # offsets_respaced now has same indexing as respaced / readjustedpoly
            
            rerespaced = []
            
            trimdist = 1.0 #remove 1 inch
            
            for rspcd, ovec in zip(respaced, offsets_respaced):
                newpoly = copy.deepcopy(list(rspcd))
                trnsfrm = rg.Transform.Translation(ovec)
                for j in [0, 1]:
                    newpoly[j].Transform(trnsfrm)
                
                if cutstart and pullstart:
                    cutvec = rg.Vector3d(newpoly[0] - newpoly[1])
                    cutvec.Unitize()
                    cutvec *= -trimdist
                    trimsf = rg.Transform.Translation(cutvec)
                    newpoly[0].Transform(trimsf)
            
                newcrv = rg.PolylineCurve(newpoly)
                rerespaced.append(newcrv)
            
        #reconnected = rerespaced
        return rerespaced

# make the class docstring match the top-of-file docstring (single source of truth)
Panelconnection.__doc__ = __doc__

#guard, so it doesn't run on import, but will run in regular components
if __name__ == "__main__":
    ghenv.Component.Message = "v0.43 panelconnections classed"

    pc = Panelconnection()
    pc_results = pc.Run(LineUtils, panel, panelplane, polylines, conduitsizes, spacing,
                        removeshorts, pullstart, manhattanradius, devicemode, devicetolerance)

    reconnected = pc_results
# ---------- end ghpython_script_13 ----------
python_3 = GhPythonScript(local_path="Gh\Panelconnections\Py\panelconnections.py")  # -> drawer_project, full_path; same code as python
data_98 = Data(data_95)
python_4 = GhPythonScript(local_path="Gh\Panelconnections\Py\panelconnections.py")  # -> drawer_project, full_path; same code as python
end_points_2 = EndPoints(Curve=data_98)  # -> Start, End
unit_x = UnitX(Factor=number_slider_14)  # disabled
list_item = ListItem(List=discontinuity_4.Points, Index=0, Wrap=True)  # disabled
file_3 = ReadFile(File=python_3.full_path, PerLineParse=False)
number_slider_15 = Slider(0, range=0..30)
number_slider_16 = Slider(25, range=0..200)
data_99 = Data(end_points_2.Start)
boolean_toggle_14 = BooleanToggle(False)
panel_6 = Panel(ghpython_script_11.Out)
file_4 = ReadFile(File=python_4.full_path, PerLineParse=False)
boolean_toggle_15 = BooleanToggle(True)
boolean_toggle_16 = BooleanToggle(False)
move_4 = Move(Geometry=list_item, Motion=unit_x)  # -> Geometry, Transform; disabled
data_100 = Data(ghpython_script_13.reconnected)

log_panelconnections_s2 = GhPythonScript(
    LineUtils=lineutils,
    panel=scale_nu.Geometry,
    panelplane=clean_2,
    polylines=clean_3,
    conduitsizes=clean_4,
    spacing=data_85,
    removeshorts=Toggle(False),
    pullstart=Toggle(True),
    manhattanradius=Slider(25, range=0..200),
    devicemode=Toggle(False),
    devicetolerance=Slider(0, range=0..30))  # -> out, reconnected; inputs panel: Rectangle3d, panelplane: Plane, polylines: list of Polyline, conduitsizes: list, removeshorts: Boolean, pullstart: Boolean, devicemode: Boolean; same code as ghpython_script_12
suirify = Suirify(log_panelconnections_s2.reconnected)
data_101 = Data(suirify)
log_panelconnections_s2_2 = GhPythonScript(
    LineUtils=lineutils,
    panel=scale_nu_2.Geometry,
    panelplane=clean_6,
    polylines=clean_7,
    conduitsizes=clean_8,
    spacing=data_88,
    removeshorts=Toggle(False),
    pullstart=Toggle(True),
    manhattanradius=Slider(25, range=0..200),
    devicemode=Toggle(False),
    devicetolerance=Slider(0, range=0..30))  # -> out, reconnected; inputs panel: Rectangle3d, panelplane: Plane, polylines: list of Polyline, conduitsizes: list, removeshorts: Boolean, pullstart: Boolean, devicemode: Boolean
# ---------- log_panelconnections_s2_2: Python ----------
"""
    LineUtils       : LineUtils           — helper class instance used for panel reconnection logic
    panel           : rg.Rectangle3d      — panel outline in 3D
    panelplane      : rg.Plane            — panel plane used for projection and orientation
    polylines       : List[rg.Polyline]   — main input, list of conduit centreline polylines
    conduitsize     : List[float]         — conduit size per polyline; list length must match polylines
    spacing         : float               — target centre-to-centre distance between conduits
    removeshorts    : bool                — treat single-segment polylines as Manhattan runs if False; best to default at False
    pullstart       : bool                — when connections exit panel from both sides: single row if False, double row if True
    manhattanradius : float               — if end of a polyline is within this distance from panel centre, treat as Manhattan polyline
    devicemode      : bool                — enable device-aware logic using devicetolerance
    devicetolerance : float               — distance around connection rectangles within which a connection is considered covered

Outputs:
    reconnected : List[rg.Polyline] — list of reconnected / adjusted conduit polylines
"""

import Rhino.Geometry as rg
import Grasshopper as gh
import math
from collections import defaultdict
import itertools
import System
import random
import copy

class Panelconnection(object):
    def Run(self, LineUtils, panel, panelplane, polylines, conduitsizes, spacing = 1.0,
            removeshorts = False, pullstart = True, manhattanradius = 25.0,
            devicemode = False, devicetolerance = 0.0):
        
        GLOBAL_TOL = 0.01
        defaultpath = gh.Kernel.Data.GH_Path(0)
        unitX = rg.Vector3d(1, 0, 0)
        unitY = rg.Vector3d(0, 1, 0)
        unitZ = rg.Vector3d(0, 0, 1) 
        lineargap = 4.0 #4" between bends
        
        spacing_ = copy.deepcopy(spacing)
        spacing = 0
        
        conduitsizes_ = copy.deepcopy(conduitsizes)
        conduitsizes = [0 for _ in conduitsizes]
        
        #dont apply angled if offset is more than x minimal shifts
        offsetshitcoof = 10#2000#10.00
        
        sidesextra = 3.0
        
        n_items = len(polylines)
        orig_idx = list(range(n_items))  # tracks where each current item came from
        
        polylines_ = []
        
        #short start to end collapsing
        planecenter = panelplane.Origin
        for poly in polylines:
            lastp = poly.Last
            dist = planecenter.DistanceTo(lastp)
            if dist <= manhattanradius:
                newpol = rg.Polyline([planecenter, lastp])
                polylines_.append(newpol)
            else:
                polylines_.append(poly)
        
        polylines = polylines_
        
        def x_positions(diameters, gap, angle_deg, padding, tol = GLOBAL_TOL):
            if angle_deg <= tol:
                return [0]
            ang = angle_deg * math.pi / 180.0
            n = len(diameters)
            if n == 0:
                return [0]
            # first center
            pos = padding + diameters[0] / 2.0
            if n == 1:
                return [0, pos, pos*2]
            centers = [pos]
            # subsequent centers
            for i in range(1, n):
                if ang == 0.0:
                    dx = diameters[i-1]/2.0 + gap + diameters[i]/2.0
                else:
                    dx = (diameters[i-1]/2.0 + gap + diameters[i]/2.0) / math.sin(ang)
                pos += dx
                centers.append(pos)
            # end of end padding
            end = centers[-1] + diameters[-1]/2.0 + padding
            values = [0]+centers+[end]
            rvalues = [round(v, 3) for v in values]
            
            return rvalues
        
        def split_up_down(plane, lines, tol = GLOBAL_TOL):
            origin_uv = plane.RemapToPlaneSpace(plane.Origin)[1]
            upper = []
            lower = []
            for i, ln in enumerate(lines):
                mid_uv = plane.RemapToPlaneSpace(ln.PointAt(0.5))[1]
                if mid_uv.X - origin_uv.X > tol:
                    upper.append((i, ln))
                else:
                    lower.append((i, ln))
            return upper, lower
        
        def classify_direction(plane, line, tol = GLOBAL_TOL):
            d = rg.Vector3d(line.Direction)
            d.Unitize()
            ax_y = rg.Vector3d(plane.XAxis)
            ax_x = rg.Vector3d(plane.YAxis)
            
            if abs(d * ax_y) >= 1.0 - tol:
                return 'straight'
                
            if d * ax_x > 0:
                return 'right'
            return 'left'
        
        def _sort_block(plane, items, tag, is_upper):
            if tag == 'straight':
                #key_fun = lambda it: plane.RemapToPlaneSpace(it[1].PointAtStart)[1].Y
                key_fun = lambda it: plane.RemapToPlaneSpace(it[1].From)[1].Y
                reverse_flag = False#True  # always descending Y
            else:
                #key_fun = lambda it: plane.RemapToPlaneSpace(it[1].PointAtStart)[1].X
                key_fun = lambda it: plane.RemapToPlaneSpace(it[1].From)[1].X
                if tag == 'left':
                    reverse_flag = is_upper  # upper -> asc lower -> desc
                else:  # 'right'
                    reverse_flag = not is_upper      # upper -> desc lower -> asc
            
            return sorted(items, key=key_fun, reverse=reverse_flag)
        
        def sort_lines(plane, lines, tol = GLOBAL_TOL):
            upper, lower = split_up_down(plane, lines, tol)
            #lower = []
            ordered = []
            
            for grp, is_upper in ((upper, False), (lower, True)):
                buckets = {'left': [], 'straight': [], 'right': []}
                tagorder = ['left', 'straight', 'right']
                if is_upper:
                    #tagorder.reverse()
                    pass
                
                #print "is_upper ", is_upper
                #print tagorder
                
                for idx, ln in grp:
                    buckets[classify_direction(plane, ln, tol)].append((idx, ln))
                
                #print buckets
                
                for tag in tagorder:
                    ordered.extend(_sort_block(plane, buckets[tag], tag, is_upper))
                    
            sorted_lines = [item[1] for item in ordered]
            index_map = [item[0] for item in ordered]
            
            return sorted_lines, index_map
        
        def snappolyline(polyline, plane, point, moveflag = False, tol = GLOBAL_TOL):
            if polyline.SegmentCount <= 2:
                #print tol
                return [False, polyline]
            
            firstsegment = polyline.SegmentAt(0)
            fsdir = firstsegment.UnitTangent
            planeX = plane.XAxis
            dot = fsdir*planeX
            
            result, targetplanept = plane.RemapToPlaneSpace(point)
                    
            newpoly = [None, None]
            
            polypts = list(polyline)
            firstp = polypts[0]
            secondp = polypts[1]
            otherpts = polypts[1:]
            otherpts2 = polypts[2:]
            
            _, firstplanep = plane.RemapToPlaneSpace(firstp)
            _, secondplanep = plane.RemapToPlaneSpace(secondp)
            
            #print tol
            
            if abs(dot) >= 1 - tol: #same dir
                
                #if False:#moveflag:
                if moveflag:
                    remappedxy = plane.PointAt(targetplanept.X, targetplanept.Y, firstplanep.Z)
                    remapped2nd = plane.PointAt(secondplanep.X, targetplanept.Y, secondplanep.Z) 
                    
                    newpoly = [True, rg.Polyline([remappedxy, remapped2nd]+otherpts2)]
                else:
                    #print "here"
                    remappedxy = plane.PointAt(targetplanept.X, firstplanep.Y, firstplanep.Z)
                    
                    newpoly = [False, rg.Polyline([remappedxy]+otherpts)]
            else:
                
                remappedxy = plane.PointAt(firstplanep.X, targetplanept.Y, firstplanep.Z)
                extrapt = plane.PointAt(targetplanept.X, targetplanept.Y, firstplanep.Z)
                
                newpoly = [True, rg.Polyline([extrapt, remappedxy]+otherpts)]
                #newpoly = [True, rg.Polyline([remappedxy]+otherpts)]
            #print "_______"
            
            #newpoly[1].DeleteShortSegments(tol)
            
            return newpoly
        
        def clean_polyline(pl, mindistance, tol = GLOBAL_TOL):
            # if ≤2 segments, nothing to do
            if pl.SegmentCount <= 2:
                return pl
                
            tol_rad = math.radians(tol)
            pts = list(pl)
            i = 0
            # walk sliding window of 3 segments -> 4 points
            
            while i <= len(pts) - 4:
                p0 = pts[i]
                p1 = pts[i+1]
                p2 = pts[i+2]
                p3 = pts[i+3]
                
                # first segment
                v1 = p1 - p0
                if not v1.Unitize():
                    i += 1
                    continue
                    
                # middle segment: capture its length before unitizing
                raw_v2 = p2 - p1
                seg2_len = raw_v2.Length
                v2 = rg.Vector3d(raw_v2)
                v2.Unitize()
                # third segment
                v3 = p3 - p2
                if not v3.Unitize():
                    i += 1
                    continue
                    
                # angles between segments
                ang12 = rg.Vector3d.VectorAngle(v1, v2)
                ang23 = rg.Vector3d.VectorAngle(v2, v3)
                
                # test both ~90° within tol
                if abs(ang12 - math.pi/2) <= tol_rad and abs(ang23 - math.pi/2) <= tol_rad:
                    # if middle is too short, remove it and merge
                    if seg2_len < mindistance + tol:
                        new_p3 = rg.Point3d(p3)
                        # align along axis of first segment
                        if abs(v1.X) > abs(v1.Y):
                            new_p3.Y = p0.Y
                        else:
                            new_p3.X = p0.X
                        # drop the middle point, replace next point
                        pts.pop(i+2)
                        pts[i+2] = new_p3
                        # shift index by extra 1 so next triplet spans correctly
                        i += 2
                        continue
                i += 1
             
            return rg.Polyline(pts)
        
        def clean_beginning(pl, mindistance, tol = GLOBAL_TOL):
            #print "in clean"
            # if ≤2 segments, nothing to do
            if pl.SegmentCount <= 2:
                return pl
            
            else:
                polypts = copy.deepcopy(list(pl))
                if polypts[1].DistanceTo(polypts[2]) <= mindistance:
                    shift = polypts[1]-polypts[2]
                    polypts[0] -= shift
                    #remove 2nd and 3rd pts
                    popd = polypts.pop(1)
                    popd = polypts.pop(1)
                    return rg.Polyline(polypts)
                else:
                    return pl 
        
        def extend_polyline_segments(pl, mindistance, mode='triplet', tol=GLOBAL_TOL):
            """
            Extend/collapse segments in a polyline.
            
            'triplet'  - three-seg groups: if middle seg is short, extend it.
            'singular' - each seg: if ≤ tol, collapse it
                         elif < mindistance+tol, extend to mindistance.
            'singular_first'- only the first segment
                              if ≤ tol, collapse it
                              elif < mindistance+tol, extend it.
            """
            pl.MergeColinearSegments(tol, False)
            
            # nothing to do for 0 or 1 segment
            if pl.SegmentCount <= 1:
                return pl
        
            # copy points and precompute tolerance in radians
            pts = list(pl)
            tol_rad = math.radians(tol)
        
            # --- Triplet mode ---
            if mode == 'triplet':
                i = 0
                max_i = len(pts) - 4
                while i <= max_i:
                    p0 = pts[i]
                    p1 = pts[i+1]
                    p2 = pts[i+2]
                    p3 = pts[i+3]
        
                    v1 = p1 - p0
                    if not v1.Unitize():
                        i += 1
                        continue
        
                    raw_v2 = p2 - p1
                    seg2_len = raw_v2.Length
                    v2 = rg.Vector3d(raw_v2)
                    v2.Unitize()
        
                    v3 = p3 - p2
                    if not v3.Unitize():
                        i += 1
                        continue
        
                    ang12 = rg.Vector3d.VectorAngle(v1, v2)
                    ang23 = rg.Vector3d.VectorAngle(v2, v3)
        
                    is_perp1 = abs(ang12 - math.pi/2) <= tol_rad
                    is_perp2 = abs(ang23 - math.pi/2) <= tol_rad
                    is_short = seg2_len < mindistance + tol
        
                    if is_perp1 and is_perp2 and is_short:
                        # compute new p2 extended to mindistance
                        new_p2 = rg.Point3d(p1)
                        new_p2 = new_p2 + v2 * mindistance
                        delta = new_p2 - p2
        
                        pts[i+2] = new_p2
        
                        # shift only p3 along the extension axis
                        if abs(raw_v2.X) > abs(raw_v2.Y):
                            pts[i+3].X += delta.X
                        else:
                            pts[i+3].Y += delta.Y
        
                        i += 2
                    else:
                        i += 1
        
            # --- Singular-first mode ---
            elif mode == 'singular_first':
                # only operate on the very first segment
                if len(pts) < 2:
                    return rg.Polyline(pts)
        
                p0 = pts[0]
                p1 = pts[1]
        
                raw_v = p1 - p0
                seg_len = raw_v.Length
        
                # collapse tiny first segment
                if seg_len <= tol:
                    delta = rg.Vector3d(raw_v)
                    pts.pop(1)
                    j = 1
                    while j < len(pts):
                        pts[j].X = pts[j].X - delta.X
                        pts[j].Y = pts[j].Y - delta.Y
                        pts[j].Z = pts[j].Z - delta.Z
                        j = j + 1
        
                # extend short first segment
                elif seg_len < mindistance + tol and len(pts) > 2:
                    v = rg.Vector3d(raw_v)
                    v.Unitize()
                    new_p1 = rg.Point3d(p0)
                    new_p1 = new_p1 + v * mindistance
                    ext_delta = new_p1 - p1
        
                    pts[1] = new_p1
        
                    # shift only the next point along dominant axis
                    if abs(raw_v.X) > abs(raw_v.Y):
                        pts[2].X = pts[2].X + ext_delta.X
                    else:
                        pts[2].Y = pts[2].Y + ext_delta.Y
        
                return rg.Polyline(pts)
        
            # --- Singular mode ---
            elif mode == 'singular':
                i = 0
                while i < len(pts) - 1:
                    p0 = pts[i]
                    p1 = pts[i+1]
        
                    raw_v = p1 - p0
                    seg_len = raw_v.Length
        
                    # collapse tiny segment
                    if seg_len <= tol:
                        delta = rg.Vector3d(raw_v)
                        pts.pop(i+1)
                        j = i + 1
                        while j < len(pts):
                            pts[j].X -= delta.X
                            pts[j].Y -= delta.Y
                            pts[j].Z -= delta.Z
                            j += 1
                        continue
        
                    # extend short segment, only if next point exists
                    if seg_len < mindistance + tol and i+2 < len(pts):
                        v = rg.Vector3d(raw_v)
                        v.Unitize()
                        new_p1 = rg.Point3d(p0)
                        new_p1 = new_p1 + v * mindistance
                        ext_delta = new_p1 - p1
        
                        pts[i+1] = new_p1
        
                        # shift only the very next point along dominant axis
                        if abs(raw_v.X) > abs(raw_v.Y):
                            pts[i+2].X += ext_delta.X
                        else:
                            pts[i+2].Y += ext_delta.Y
        
                    i += 1
        
            # unknown mode: return original
            else:
                return pl
        
            return rg.Polyline(pts)
        
        def repull(MasterPolys, SlavePolys):
            Tol = 0.001
            ANG_EPS = 1e-9
            ParallelDot = 0.999
            SegIndex = 1  
        
            def _unit_xy(v):
                if v.Length > 0.0:
                    v.Unitize()
                return v
        
            def _left_normal_xy(v):
                n = rg.Vector3d(-v.Y, v.X, 0.0)
                if n.Length > 0.0:
                    n.Unitize()
                return n
        
            def _dot_xy(a, b):
                return a.X * b.X + a.Y * b.Y
        
            def _to_polyline(obj):
                if obj is None:
                    return None
                if isinstance(obj, rg.Polyline):
                    return rg.Polyline(obj)
                if isinstance(obj, rg.PolylineCurve):
                    return obj.ToPolyline()
                try:
                    tmp = rg.Polyline()
                    ok = obj.TryGetPolyline(tmp)
                    if ok:
                        return tmp
                except:
                    pass
                return None
        
            Out = []
        
            m_count = len(MasterPolys)
            s_count = len(SlavePolys)
        
            for i in range(m_count):
                m_in = MasterPolys[i]
        
                if i >= s_count:
                    Out.append(m_in)
                    continue
        
                s_in = SlavePolys[i]
        
                m_pl = _to_polyline(m_in)
                s_pl = _to_polyline(s_in)
        
                if m_pl is None or s_pl is None:
                    Out.append(m_in)
                    continue
        
                if m_pl.SegmentCount != s_pl.SegmentCount:
                    Out.append(m_in)
                    continue
        
                if SegIndex < 0 or SegIndex >= m_pl.SegmentCount:
                    Out.append(m_in)
                    continue
        
                ok_parallel = True
                for j in range(m_pl.SegmentCount):
                    ml = m_pl.SegmentAt(j)
                    sl = s_pl.SegmentAt(j)
        
                    md = rg.Vector3d(ml.Direction.X, ml.Direction.Y, 0.0)
                    sd = rg.Vector3d(sl.Direction.X, sl.Direction.Y, 0.0)
        
                    if md.Length <= Tol or sd.Length <= Tol:
                        ok_parallel = False
                        break
        
                    _unit_xy(md)
                    _unit_xy(sd)
        
                    dot = md * sd
                    if dot < 0.0:
                        dot = -dot
        
                    if dot < ParallelDot:
                        ok_parallel = False
                        break
        
                if not ok_parallel:
                    Out.append(m_in)
                    continue
        
                mseg = m_pl.SegmentAt(SegIndex)
                sseg = s_pl.SegmentAt(SegIndex)
        
                dcur = rg.Vector3d(mseg.Direction.X, mseg.Direction.Y, 0.0)
                if dcur.Length <= Tol:
                    Out.append(m_in)
                    continue
                _unit_xy(dcur)
        
                ncur = _left_normal_xy(dcur)
                if ncur.Length <= Tol:
                    Out.append(m_in)
                    continue
        
                p = rg.Point3d(sseg.From)
                a = rg.Vector3d(p.X - mseg.From.X, p.Y - mseg.From.Y, 0.0)
                t = _dot_xy(a, dcur)
                proj = rg.Point3d(mseg.From.X + dcur.X * t, mseg.From.Y + dcur.Y * t, p.Z)
        
                v = rg.Vector3d(proj.X - p.X, proj.Y - p.Y, proj.Z - p.Z)
                d = _dot_xy(v, ncur)
        
                def _along(dir_vec):
                    if dir_vec.Length <= Tol:
                        return rg.Vector3d(ncur.X * d, ncur.Y * d, v.Z)
        
                    dp = rg.Vector3d(dir_vec.X, dir_vec.Y, 0.0)
                    _unit_xy(dp)
        
                    denom = _dot_xy(dp, ncur)
                    if abs(denom) < ANG_EPS:
                        return rg.Vector3d(ncur.X * d, ncur.Y * d, v.Z)
        
                    s = d / denom
                    return rg.Vector3d(dp.X * s, dp.Y * s, v.Z)
        
                segcount = s_pl.SegmentCount
                has_prev = False
                has_next = False
                prev_dir = rg.Vector3d(0.0, 0.0, 0.0)
                next_dir = rg.Vector3d(0.0, 0.0, 0.0)
        
                if SegIndex > 0:
                    pln = s_pl.SegmentAt(SegIndex - 1)
                    prev_dir = rg.Vector3d(pln.Direction.X, pln.Direction.Y, 0.0)
                    if prev_dir.Length > Tol:
                        has_prev = True
        
                if SegIndex < segcount - 1:
                    nln = s_pl.SegmentAt(SegIndex + 1)
                    next_dir = rg.Vector3d(nln.Direction.X, nln.Direction.Y, 0.0)
                    if next_dir.Length > Tol:
                        has_next = True
        
                if has_prev:
                    ds = _along(prev_dir)
                else:
                    ds = rg.Vector3d(ncur.X * d, ncur.Y * d, v.Z)
        
                if has_next:
                    de = _along(next_dir)
                else:
                    de = rg.Vector3d(ncur.X * d, ncur.Y * d, v.Z)
        
                pts = []
                for p0 in s_pl:
                    pts.append(rg.Point3d(p0))
        
                idx0 = SegIndex
                idx1 = SegIndex + 1
        
                if idx0 < 0 or idx1 >= len(pts):
                    Out.append(m_in)
                    continue
        
                p0 = pts[idx0]
                p1 = pts[idx1]
        
                pts[idx0] = rg.Point3d(p0.X + ds.X, p0.Y + ds.Y, p0.Z + ds.Z)
                pts[idx1] = rg.Point3d(p1.X + de.X, p1.Y + de.Y, p1.Z + de.Z)
        
                if s_pl.IsClosed:
                    if idx0 == 0:
                        pts[len(pts) - 1] = rg.Point3d(pts[0])
                    if idx1 == 0:
                        pts[len(pts) - 1] = rg.Point3d(pts[0])
        
                Out.append(rg.Polyline(pts))
            
            return Out
        
        def remove_spikes(pl, tol_deg=GLOBAL_TOL):
            """remove any back‑tracking spikes from a polyline
            spike is detected when two consecutive segments are nearly 180* apart 
            tolerance is defaulted to global tol, but much tighter is reccomended 0.0001
            """
            # if fewer than 2 segments, nothing to clean
            if pl.SegmentCount < 2:
                return pl
            tol = math.radians(tol_deg)
            pts = list(pl)
            i = 0
            while i < len(pts) - 2:
                p0 = pts[i]
                p1 = pts[i+1]
                p2 = pts[i+2]
                v1 = p1 - p0
                if not v1.Unitize():
                    i += 1
                    continue
                v2 = p2 - p1
                if not v2.Unitize():
                    i += 1
                    continue
                ang = rg.Vector3d.VectorAngle(v1, v2)
                # if they reverse direction within tol, drop the spike apex
                if abs(ang - math.pi) <= tol:
                    pts.pop(i+1)
                    # re‑test at same index since list got shorter
                    continue
                i += 1
            return rg.Polyline(pts)
        
        def middle_line_in_rectangle(rect, plane, tol=GLOBAL_TOL):
            center = rect.Center
            dir_y = plane.YAxis
            infinite_line = rg.Line(center - dir_y * 1e6, center + dir_y * 1e6)
        
            rect_curve = rect.ToNurbsCurve()
            intersections = rg.Intersect.Intersection.CurveLine(rect_curve, infinite_line, tol, tol)
        
            if not intersections or intersections.Count != 2:
                return None
        
            pt1 = intersections[0].PointA
            pt2 = intersections[1].PointA
            
            return rg.Line(pt1, pt2)
        
        def apply_perm(seq, perm):
            return [seq[i] for i in perm]
        
        def restore_input_order(seq, idx_track):
            n = len(idx_track)
            out = [None for _ in range(n)]
            for pos, orig in enumerate(idx_track):
                out[orig] = seq[pos]
            return out
        
        def snap_parameters(parameters0, parameters1):
            epsilon = 1e-9
            tol = 0.01
            max_iterations = 50
        
            def abs_float(x):
                if x < 0.0:
                    return -x
                return x
        
            p0 = []
            p1 = []
            i = 0
            for i in range(len(parameters0)):
                p0.append(float(parameters0[i]))
            i = 0
            for i in range(len(parameters1)):
                p1.append(float(parameters1[i]))
        
            n0 = len(p0)
            n1 = len(p1)
            if n0 == 0 or n1 == 0:
                return p0, p1
        
            min0 = p0[0]
            max0 = p0[0]
            i = 1
            for i in range(1, n0):
                v = p0[i]
                if v < min0:
                    min0 = v
                if v > max0:
                    max0 = v
            domain0 = max0 - min0
        
            min1 = p1[0]
            max1 = p1[0]
            i = 1
            for i in range(1, n1):
                v = p1[i]
                if v < min1:
                    min1 = v
                if v > max1:
                    max1 = v
            domain1 = max1 - min1
        
            best_diff = None
            anchor0 = 0
            anchor1 = 0
            i = 0
            for i in range(n0):
                a = p0[i]
                j = 0
                for j in range(n1):
                    b = p1[j]
                    d = a - b
                    if d < 0.0:
                        d = -d
                    if best_diff is None or d < best_diff:
                        best_diff = d
                        anchor0 = i
                        anchor1 = j
        
            if domain0 < domain1:
                delta = p1[anchor1] - p0[anchor0]
                i = 0
                for i in range(n0):
                    p0[i] = p0[i] + delta
            elif domain1 < domain0:
                delta = p0[anchor0] - p1[anchor1]
                j = 0
                for j in range(n1):
                    p1[j] = p1[j] + delta
            else:
                delta = p1[anchor1] - p0[anchor0]
                i = 0
                for i in range(n0):
                    p0[i] = p0[i] + delta
        
            anchor_value = p0[anchor0]
        
            locked0 = []
            locked1 = []
            i = 0
            for i in range(n0):
                locked0.append(False)
            i = 0
            for i in range(n1):
                locked1.append(False)
        
            locked0[anchor0] = True
            locked1[anchor1] = True
        
            def process_side(side):
                iteration = 0
                for iteration in range(max_iterations):
                    candidates = []
        
                    if side == -1:
                        i = 0
                        for i in range(anchor0):
                            if locked0[i]:
                                continue
                            d = p0[i] - anchor_value
                            if d < 0.0:
                                d = -d
                            candidates.append((d, 0, i))
                        j = 0
                        for j in range(anchor1):
                            if locked1[j]:
                                continue
                            d = p1[j] - anchor_value
                            if d < 0.0:
                                d = -d
                            candidates.append((d, 1, j))
                    else:
                        i = anchor0 + 1
                        for i in range(anchor0 + 1, n0):
                            if locked0[i]:
                                continue
                            d = p0[i] - anchor_value
                            if d < 0.0:
                                d = -d
                            candidates.append((d, 0, i))
                        j = anchor1 + 1
                        for j in range(anchor1 + 1, n1):
                            if locked1[j]:
                                continue
                            d = p1[j] - anchor_value
                            if d < 0.0:
                                d = -d
                            candidates.append((d, 1, j))
        
                    if not candidates:
                        break
        
                    candidates.sort()
        
                    changed = False
        
                    ci = 0
                    for ci in range(len(candidates)):
                        d_c, list_id, idx = candidates[ci]
        
                        if list_id == 0 and locked0[idx]:
                            continue
                        if list_id == 1 and locked1[idx]:
                            continue
        
                        if list_id == 0:
                            v_c = p0[idx]
                        else:
                            v_c = p1[idx]
        
                        # collect all "smaller or equal" (closer/equal to anchor) in other list
                        partner_indices = []
                        partner_dists = []
        
                        if list_id == 0:
                            # candidate in list 0, search list 1
                            if side == -1:
                                start = 0
                                end = anchor1
                            else:
                                start = anchor1 + 1
                                end = n1
                            j = start
                            for j in range(start, end):
                                if locked1[j]:
                                    continue
                                d_o = p1[j] - anchor_value
                                if d_o < 0.0:
                                    d_o = -d_o
                                if d_o < d_c - tol or abs_float(d_o - d_c) <= tol:
                                    partner_indices.append(j)
                                    partner_dists.append(d_o)
        
                            if len(partner_indices) > 0:
                                # pick partner furthest from anchor (max distance)
                                best_pos = 0
                                best_d = partner_dists[0]
                                t = 1
                                for t in range(1, len(partner_indices)):
                                    if partner_dists[t] > best_d + epsilon:
                                        best_d = partner_dists[t]
                                        best_pos = t
                                best_k = partner_indices[best_pos]
                                v_o = p1[best_k]
                                delta2 = v_c - v_o
        
                                if side == -1:
                                    k = 0
                                    for k in range(0, best_k + 1):
                                        p1[k] = p1[k] + delta2
                                else:
                                    k = best_k
                                    for k in range(best_k, n1):
                                        p1[k] = p1[k] + delta2
        
                                locked0[idx] = True
                                locked1[best_k] = True
        
                                # lock all closer ones from that list that also matched condition
                                t = 0
                                for t in range(len(partner_indices)):
                                    k2 = partner_indices[t]
                                    d2 = partner_dists[t]
                                    if k2 != best_k:
                                        if d2 + epsilon < best_d:
                                            locked1[k2] = True
        
                                changed = True
        
                        else:
                            # candidate in list 1, search list 0
                            if side == -1:
                                start = 0
                                end = anchor0
                            else:
                                start = anchor0 + 1
                                end = n0
                            i2 = start
                            for i2 in range(start, end):
                                if locked0[i2]:
                                    continue
                                d_o = p0[i2] - anchor_value
                                if d_o < 0.0:
                                    d_o = -d_o
                                if d_o < d_c - tol or abs_float(d_o - d_c) <= tol:
                                    partner_indices.append(i2)
                                    partner_dists.append(d_o)
        
                            if len(partner_indices) > 0:
                                best_pos = 0
                                best_d = partner_dists[0]
                                t = 1
                                for t in range(1, len(partner_indices)):
                                    if partner_dists[t] > best_d + epsilon:
                                        best_d = partner_dists[t]
                                        best_pos = t
                                best_k = partner_indices[best_pos]
                                v_o = p0[best_k]
                                delta2 = v_c - v_o
        
                                if side == -1:
                                    k = 0
                                    for k in range(0, best_k + 1):
                                        p0[k] = p0[k] + delta2
                                else:
                                    k = best_k
                                    for k in range(best_k, n0):
                                        p0[k] = p0[k] + delta2
        
                                locked1[idx] = True
                                locked0[best_k] = True
        
                                t = 0
                                for t in range(len(partner_indices)):
                                    k2 = partner_indices[t]
                                    d2 = partner_dists[t]
                                    if k2 != best_k:
                                        if d2 + epsilon < best_d:
                                            locked0[k2] = True
        
                                changed = True
        
                        if changed:
                            break
        
                    if not changed:
                        break
        
            process_side(-1)
            process_side(1)
        
            return p0, p1
        
        TolDeg = 1.0
        RightDeg = 90.0
        
        def _is_angle_non_orth(v1, v2, tol_deg):
            if v1.IsTiny() or v2.IsTiny():
                return False
            a = rg.Vector3d.VectorAngle(v1, v2)
            deg = math.degrees(a)
            m = deg % RightDeg
            if m > RightDeg * 0.5:
                m = RightDeg - m
            if m > tol_deg:
                return True
            return False
        
        def ispolyselfnonorth(pl):
            segs = pl.GetSegments()
            if len(segs) < 2:
                return False
            for i in range(len(segs) - 1):
                v1 = segs[i].Direction
                v2 = segs[i + 1].Direction
                if _is_angle_non_orth(v1, v2, TolDeg):
                    return True
            return False
        
        def ispolynonorthtoplane(pl, pln):
            segs = pl.GetSegments()
            if len(segs) == 0:
                return False
            v = segs[0].Direction
            x = pln.XAxis
            if _is_angle_non_orth(v, x, TolDeg):
                return True
            return False
        
        ExtLen = 10.0
        
        def poly_add_start_axis_segment(pl, pln):
            # Collect polyline points
            pts = []
            for p in pl:
                pts.append(p)
                
            if len(pts) < 2:
                return pl
        
            p0 = pts[0]
            p1 = pts[1]
        
            # First segment direction (projected into the plane to avoid Z/noise)
            v = p1 - p0
            v.Unitize()
            
            # Plane axes
            x = rg.Vector3d(pln.XAxis)
            y = rg.Vector3d(pln.YAxis)
        
            # Use sign of dot with XAxis to decide:
            # angle in [90..180] (side-agnostic)  <=>  dot(v, x) <= 0
            dx = v * x
            dy = v * y
            
            checkvec = p0 - pln.Origin
            checkvec.Unitize()
        
            dir_vec = None
        
            if dx >= 0.0:
                if checkvec * x < 0:
                    # Choose +Y or -Y based on which makes a shallower angle with the first segment
                    # This is equivalent to choosing the sign of dy in plane coords
                    dir_vec = rg.Vector3d(y)
                    if dy < 0.0:
                        dir_vec.Reverse()
                else:
                    # Choose XAxis, but flip it so it points "toward plane center" (plane origin)
                    dir_vec = rg.Vector3d(x)
                    dir_vec.Unitize()
                    if dir_vec*v < 0:
                        dir_vec.Reverse()
            else:
                if dx < 0 and checkvec * x < 0:
                    dir_vec = rg.Vector3d(x)
                    dir_vec.Reverse()
                else:
                    # Choose +Y or -Y based on which makes a shallower angle with the first segment
                    # This is equivalent to choosing the sign of dy in plane coords
                    dir_vec = rg.Vector3d(y)
                    if dy < 0.0:
                        dir_vec.Reverse()
        
            # IMPORTANT: we insert a NEW START point, so the new first segment is (p0 - p_new)
            # To make that segment direction == dir_vec, we must place p_new at (p0 - dir_vec * ExtLen)
            dir_vec.Unitize()
            p_new = p0 - dir_vec * ExtLen
            pts.insert(0, p_new)
        
            return rg.Polyline(pts)
        
        def scale_around(x, center, factor):
            return x - (center + (x - center) * factor)
        
        if devicemode:
            if abs(devicetolerance) > GLOBAL_TOL:
                panel = LineUtils.offset_rectangle(panel, devicetolerance)
        
        #reusing normal logic if not under condition, dirty patch
        run_else = False
        
        if devicemode and len(polylines) == 1:
            #print "devmode 1"
            dpolyline = polylines[0]
            firstseg = dpolyline.SegmentAt(0)
            hitspanel = LineUtils.lxr(firstseg, [panel], True)
            if hitspanel:
                #print "in panel"
                porigin = panelplane.Origin
                newp = firstseg.ClosestPoint(porigin, False) #treat as infinite
                polypts = list(dpolyline)
                polypts[0] = newp
                rerespaced = rg.PolylineCurve(polypts)
            else:
                run_else = True
        else:
            run_else = True
        
        #portion to handle polylinebundle nonorth to panel
        for i, checkpoly in enumerate(polylines):
            selfno = ispolyselfnonorth(checkpoly)
            planeno = ispolynonorthtoplane(checkpoly, panelplane)
            #print planeno, selfno
            if planeno:
                stubbedpoly = poly_add_start_axis_segment(checkpoly, panelplane)
                polylines[i] = stubbedpoly
                
        #run a check if all segments are already near panel
        closetopanel = 100.0 #hardcoded distance where everythign else could get overriden and simplest direct connection made
        matchpanel = False
        pulledbuffer = []
        
        for polybuffer in polylines:    
            firstseg = polybuffer.SegmentAt(0)
            hitspanel = LineUtils.lxr(firstseg, [panel], True)
            porigin = panelplane.Origin
            shortchecklen = porigin.DistanceTo(polybuffer.First)
            if hitspanel and shortchecklen < closetopanel and polybuffer.SegmentCount > 2:
                newpstart = firstseg.ClosestPoint(porigin, False) #treat as infinite
                newpoly = rg.Polyline([newpstart]+list(polybuffer)[1:])
                pulledbuffer.append(newpoly)
            else:
                break
        else:
            #matchpanel branch if it didnt break
            matchpanel = True
        
        if matchpanel:
            rerespaced = pulledbuffer
        elif run_else:
            #don't use other angles for now, keep 90
            #angleslookup = LineUtils.AngleLookup.ANGLES
            angleslookup = [90]
            
            #boundspreview = LineUtils.rectangle_axis(panel)
            boundspreview = middle_line_in_rectangle(panel, panelplane)
            
            panelwidth = boundspreview.Length
            od_lookup = [LineUtils.ConduitLookup.get_specs(cs)["od"] for cs in conduitsizes]
            
            #1.0" padding on both ends
            padding = 1.0
            positions = x_positions(od_lookup, spacing, 90, padding)
            mostgradualangle = 90
            
            if positions[-1] <= panelwidth:
                #loop from higher to lower except for 90
                for a in angleslookup[-2::-1]:
                    testpos = x_positions(od_lookup, spacing, a, padding)
                    if testpos[-1] <= panelwidth:
                        positions = testpos
                        mostgradualangle = a
                    else:
                        break
                
                #as the most gradual angle is found, center the positions
                offset = (panelwidth-positions[-1])/2
                positions = [p+offset for p in positions][1:-1]
            else:
                #in case positions dont fit even at 90*, scale uniformly to fit
                coof = panelwidth/positions[-1]
                positions = [p*coof for p in positions][1:-1]
            
            startpts = [boundspreview.PointAtLength(p) for p in positions]
            
            boundspreviewnormal = boundspreview.UnitTangent
            
            #print "mostgradualangle : {}".format(mostgradualangle)
            
            #debugging
            b = startpts 
            firstsegments = [poly.SegmentAt(0) for poly in polylines]
            upperg, lowerg = split_up_down(panelplane, firstsegments)
            try:
                uidx, upper = zip(*upperg)
            except:
                pass
            try:
                lidx, lower = zip(*lowerg) 
            except:
                pass
            #debugging end
            
            #loop start
            iteration_counter = 0
            max_iterations = 5 #was 5
            
            #save og before changes
            ogpolylines = [rg.Polyline(list(poly)) for poly in polylines]
            lastflags = [False for _ in ogpolylines]
            
            # set up a dict to hold each quadrant’s offset
            offsetsdict = dict.fromkeys(('upperleft','upperright','lowerleft','lowerright'), 0)
            
            while iteration_counter < max_iterations:
                iteration_counter += 1
                #print [p.Length for p in polylines]
                
                #prefilter
                for p in polylines:
                    p.MergeColinearSegments(GLOBAL_TOL, False)
                    p.DeleteShortSegments(GLOBAL_TOL)
            
                #print [p.Length for p in polylines]
                
                firstsegments = [poly.SegmentAt(0) for poly in polylines]
                sorted_curves, lookupidx = sort_lines(panelplane, firstsegments)
                
                polylines = apply_perm(polylines, lookupidx)
                conduitsizes = apply_perm(conduitsizes, lookupidx)
                lastflags = apply_perm(lastflags, lookupidx)
                orig_idx = apply_perm(orig_idx, lookupidx)
                sorted_polys = polylines
                
                #snapping pass
                #print "iteration ", iteration_counter
                #print "prepass", lastflags
                
                flags, polylines = zip(*[snappolyline(polyline, panelplane, point, mflag) for polyline, point, mflag in zip(sorted_polys, startpts, lastflags)])
                #flags, polylines = zip(*[snappolyline(polyline, panelplane, point, True) for polyline, point, mflag in zip(sorted_polys, startpts, lastflags)])
                
                lastflags = list(flags)
                
                #print [p.Length for p in polylines], "here"
                
                #print "afterpass", lastflags
                
                #polylines = snapped
                tweakedpoly = []
                
                for poly, conduitsize, conduitsize_, pidx in zip(polylines, conduitsizes, conduitsizes_, range(len(polylines))):
                    #print "here", iteration_counter
                    od_size = LineUtils.ConduitLookup.get_specs(conduitsize)["od"]
                    #linearstub = LineUtils.ConduitLookup.get_specs(conduitsize)['linear_section']
                    #bendradius = LineUtils.ConduitLookup.get_specs(conduitsize)['min_bend']
                    linearstub = LineUtils.ConduitLookup.get_specs(conduitsize_)['linear_section']
                    bendradius = LineUtils.ConduitLookup.get_specs(conduitsize_)['min_bend']
                    
                    startcut = LineUtils._compute_cut(bendradius, linearstub, 90)
                    
                    #to be safe calculated at 2x 90 degree turns + the linear section between
                    #checklength = 0#experiment at 0
                    checklength = lineargap + startcut*2 
                    
                    #print checklength
                    
                    first_s = poly.SegmentAt(0)
                    first_s_len = first_s.Length
                    
                    next_s_len = float('inf')
                    if poly.SegmentCount > 1:
                        next_s = poly.SegmentAt(1)
                        next_s_len = next_s.Length
                    
                    polypts = list(poly)
                    
                    filteredpts = polypts
                    
                    #print "iteration ", iteration_counter
                    
                    
                    
                    #checking first and second for potentiall shortness
                    if first_s.Length < checklength or next_s_len < checklength:
                        #print "here"
                        lastflags[pidx] = False #reset flag
                        #print next_s_len < checklength
                        if len(polypts) == 2:
                            #unchanged
                            pass
                        elif abs(boundspreviewnormal*first_s.UnitTangent) < GLOBAL_TOL or next_s_len < checklength:
                            #if the first segment is short and perpendicular to panel
                            #need to also remove second to fix it
                            #or if the second is too short need to remove 1st and 2nd
                            #remove first 2 segments
                            if len(polypts) > 3:
                                filteredpts = polypts[2:]
                            else:
                                filteredpts = polypts[1:]
                            #print "here"
                        else:
                            #print "here"
                            #remove first segment, leave just last one
                            filteredpts = polypts[1:]
                        #else:
                            #remove first 2 segments
                            #filteredpts = polypts[2:]
                    
                    else:
                        pass
                        #print "passed"
                    
                    if abs(boundspreviewnormal*first_s.UnitTangent) < GLOBAL_TOL and False:
                        #print "here"
                        filteredpts = filteredpts[1:] #remove 1 more
            #        if next_s_len < checklength:
            #            #print next_s_len
            #            filteredpts = filteredpts[1:] #remove 1 more
                    
                    tweakedpoly.append(rg.Polyline(filteredpts))
                
                #print "afterlenchecks", lastflags
                
                #reassign
                polylines = tweakedpoly
            
            #print [p.Length for p in polylines]
            
            #snap too close segments
            adjustedpoly = []
            
            smallestangle = LineUtils.AngleLookup.ANGLES[0]
            #print smallestangle, "smallestangle"
            
            #prefilter
            for p in polylines:
                p.MergeColinearSegments(GLOBAL_TOL, False)
                p.DeleteShortSegments(GLOBAL_TOL)
            
            checkpolys = polylines
            c = []
            
            
            sorters = []
            upperleft = []
            upperright = []
            lowerleft = []
            lowerright = []
            
            #print polylines
            #print [p.Length for p in polylines]
            
            #print "START HERE"
            
            for pl, p, idx in zip(polylines, startpts, range(len(polylines))):
                nc = pl.ToNurbsCurve()
                p2 = nc.PointAtLength(min(pl.Length-GLOBAL_TOL, 20.0))
                sline = rg.Line(p, p2)
                sorters.append(sline)
                u, l = split_up_down(panelplane, [sline])
                if u:
                    #print u[0][1]
                    dir = classify_direction(panelplane, u[0][1], 0.0001)
                    if dir == "left":
                        upperleft.append(idx)
                    else:
                        upperright.append(idx)
                if l:
                    dir = classify_direction(panelplane, l[0][1], 0.0001)
                    #print dir
                    if dir == "left":
                        lowerleft.append(idx)
                    else:
                        lowerright.append(idx)
            
            #print "upperleft {}, upperright {}, lowerleft {}, lowerright {}".format(upperleft, upperright, lowerleft, lowerright)
            
            # build a lookup dict mapping each index to its “quadrant” name
            quadrant = {}
            quadrant.update({i: 'upperleft'   for i in upperleft})
            quadrant.update({i: 'upperright'  for i in upperright})
            quadrant.update({i: 'lowerleft'   for i in lowerleft})
            quadrant.update({i: 'lowerright'  for i in lowerright})
            
            #print quadrant
            #print offsetsdict
            
            #sortedsorters, lookupidx = sort_lines(panelplane, sorters)
            #
            #print lookupidx
            
            ##offset for 90 degree turns
            #curroffset = 0
            #upperleftoffset = 0
            #upperrightoffset = 0
            #lowerleftoffset = 0
            #lowerrightoffset = 0
            
            #resort for finalprocessing
            neworder = range(len(polylines))
            neworder = upperleft + upperright[::-1] + lowerleft + lowerright[::-1]
            
            polylines = apply_perm(polylines, neworder)
            conduitsizes = apply_perm(conduitsizes, neworder)
            startpts = apply_perm(startpts, neworder)
            orig_idx = apply_perm(orig_idx, neworder)
            
            #print neworder
            #neworder = [neworder[i] for i in neworder]
            
            for polyline, conduitsize, conduitsize_, point, sortidx in zip(polylines, conduitsizes, conduitsizes_, startpts, range(len(polylines))):
                #print sortidx
                q = quadrant.get(sortidx)
                #print loc
                
                polyline.MergeColinearSegments(GLOBAL_TOL, False)
                #rg.Polyline.MergeColinearSegments(GLOBAL_TOl, FALSE)
                
                od_size = LineUtils.ConduitLookup.get_specs(conduitsize)["od"]
                #linearstub = LineUtils.ConduitLookup.get_specs(conduitsize)['linear_section']
                #bendradius = LineUtils.ConduitLookup.get_specs(conduitsize)['min_bend']
                linearstub = LineUtils.ConduitLookup.get_specs(conduitsize_)['linear_section']
                bendradius = LineUtils.ConduitLookup.get_specs(conduitsize_)['min_bend']
                
                #calculate for smallest angle
                startcut = LineUtils._compute_cut(bendradius, linearstub, smallestangle)
                
                minlength = lineargap + startcut*2 
                minimalraise = LineUtils.compute_raise(minlength, smallestangle)
                
                polypts = list(polyline)
                
                first_s = polyline.SegmentAt(0)
                firstp = polypts[0]
                secondp = polypts[1]
                otherpts2 = polypts[2:]
                
                c.append(first_s)
                
                #print first_s.UnitTangent
                #print  round(abs(boundspreviewnormal*first_s.UnitTangent))
                #print polyline.SegmentCount
                #print "___"
            
                _, planep = panelplane.RemapToPlaneSpace(point)
                _, firstplanep = panelplane.RemapToPlaneSpace(firstp)
                
                if abs(boundspreviewnormal*first_s.UnitTangent) < GLOBAL_TOL:
                    heightshiftsigned = planep.Y - firstplanep.Y
                    heightshift = abs(heightshiftsigned)
                    #if startsegment is within minlength from panel exit
                    #than shift it to panel exit
                    if heightshift < minimalraise:# and False:
                        print heightshift ,minimalraise
                        #print "first trigger"
                        _, secondplanep = panelplane.RemapToPlaneSpace(secondp)
                        #print "shifting"
                        remappedxy = panelplane.PointAt(planep.X, planep.Y, firstplanep.Z)
                        remapped2nd = panelplane.PointAt(secondplanep.X, planep.Y, secondplanep.Z) 
                        
                        newpoly = rg.Polyline([remappedxy, remapped2nd]+otherpts2)
                        adjustedpoly.append(newpoly)
                    #else process shift at specified parameters
                    else:
                        #print "in here"
                        anglecalc = LineUtils.fit_angle_to_height(minlength, heightshift)
                        minfitted = LineUtils.smallest_ge(LineUtils.AngleLookup.ANGLES, anglecalc)
                        
                        offsetdist = abs(planep.Y -firstplanep.Y)
                        
                        #at the most gradual offset
                        #mostgradualangle = 45
                        #print mostgradualangle
                        startcut_ = LineUtils._compute_cut(bendradius, linearstub, mostgradualangle)
                        minlength_ = lineargap + startcut_*2 
                        minimalraise_ = LineUtils.compute_raise(minlength_, mostgradualangle)
                        minrun = LineUtils.compute_run(minlength_, mostgradualangle)
                        minopp = LineUtils.compute_opposite(offsetdist, 90-mostgradualangle)
                        
                        _, secondplanep = panelplane.RemapToPlaneSpace(secondp)
                        
                        conditions = [
                            first_s.Length >= minopp+minlength,   #length of first segment has to be larger than minimal opposite righttriangle side and minimal length of 2 fitting + space between
                            offsetdist >= minimalraise_,  #it has to be shifted more than minimalraise else fittings + space between wont fit
                            offsetdist <= minimalraise_*offsetshitcoof,  #this is a visual addition to prevent extremely long angled segments
                            mostgradualangle < 90  #90 degree isnt angled, it has to start with straight segment, so its excluded
                        ]
                        
                        #need to add 2 fittings at end
                        #if first_s.Length >= minopp+minlength and offsetdist >= minimalraise_ and offsetdist <= minimalraise_*offsetshitcoof and mostgradualangle < 90: 
                        if all(conditions): #too many conditions, more elegant this way
                            #print minimalraise_*offsetshitcoof
                            #print "can fit !!"
                            newp = first_s.PointAtLength(minopp) #pnt at distance and at parameter ISNT always same for lines
                            #panelplane.PointAt(minopp, secondplanep.Y, secondplanep.Z)
                            adjustedpoly.append(rg.Polyline([point, newp, secondp]+otherpts2))
                        else:
                            #print "here"
                            #if point falls within plane, let it be
                            if abs(firstplanep.Y) <= panelwidth/2 and len(polylines) == 1:
                                #print "here"
                                adjustedpoly.append(polyline)
                            else:
                                #start offsets
                                curroffset = 0
                                
                                if offsetsdict[q] == 0:
                                    offsetsdict[q] = minlength
                                else:
                                    offsetsdict[q] = offsetsdict[q] + od_size + spacing
                                
                                curroffset = offsetsdict[q]
            #                    if curroffset == 0:
            #                        curroffset = minlength
            #                    else:
            #                        #add spacing and its diameter (diamter isnt super accurate but will do)
            #                        curroffset += od_size + spacing
                                
                                if secondplanep.X > 0:
                                    newpone = panelplane.PointAt(curroffset, planep.Y, planep.Z)
                                    newptwo = panelplane.PointAt(curroffset, secondplanep.Y, planep.Z)
                                else:
                                    newpone = panelplane.PointAt(-curroffset, planep.Y, planep.Z)
                                    newptwo = panelplane.PointAt(-curroffset, secondplanep.Y, planep.Z)
                                
                                adjustedpoly.append(rg.Polyline([point, newpone, newptwo, secondp]+otherpts2))
                                    
                                #print "cant fit"
                        
                        #print planep.Y, firstplanep.Y, offsetdist, "___",minlength_,   minimalraise_, minrun, "__", minopp
                        
                        #
                        #print anglecalc, minfitted
                        
                        #print minlength, heightshift, anglecalc, heightshiftsigned
                        #print minfitted
                        #print "___"
                        
                        #if panel exits dont fit for minimal segments length in a bundle
                        #compress all to fit
                        
                        #if 90 degrees need extra processing
                        if mostgradualangle >= 90:
                            pass
                            #adjustedpoly.append(polyline)
                        #under 90 degrees gradual, do gradual directly out of panel
                        else:
                            #print mostgradualangle
                            pass
                            #adjustedpoly.append(polyline)
                    #print planep.Y
                    #print firstp.Y
                    
                    #print "pass"
                    
                #perpendicular
                else:
                    #print "here"
                    #check if it can connect
                    _, secondplanep = panelplane.RemapToPlaneSpace(secondp)
                    #print secondplanep
                    #print planep
                    secondshifted = rg.Point3d(secondplanep.X, planep.Y, secondplanep.Z)
                    #print secondshifted
                    checkdist = secondplanep.DistanceTo(secondshifted)
                    #just a direct connection
                    if checkdist<minlength and len(polypts) == 2 and removeshorts:
                        #print "direct connection"
                        #adjustedpoly.append(rg.Polyline([point, secondp]))
                        pass
                        adjustedpoly.append(rg.Polyline([point, secondp]))
                    #90* connection
                    else:
                        #print "90* connection"
                        shiftedinplane = panelplane.PointAt(secondshifted.X, secondshifted.Y, secondshifted.Z)
                        #adjustedpoly.append(rg.Polyline([point, shiftedinplane, secondp]))
                        adjustedpoly.append(rg.Polyline([point, shiftedinplane, secondp]+otherpts2))
                    #print checkdist
                    #print "perpendicular"
                    #a = snappolyline(polyline, panelplane, point, False, 0.02)
                    #print "aftersnap"
                    #adjustedpoly.append(polyline)
                    #not perpendicular to panel
                    pass
                #print minimalraise
            
            readjustedpoly = []
            
            upperleftmin = 0
            upperrightmin = 0
            lowerleftmin = 0
            lowerrightmin = 0
            
            upperleftfs = []
            upperrightfs = []
            lowerleftfs = []
            lowerrightfs = []
            
            def finalsortkey(poly):
                _, p = panelplane.RemapToPlaneSpace(list(poly)[0])
                return round(p.Y, 3)
            
            def fit_number(lst, x ,spacing, tol = GLOBAL_TOL):
                if not lst:
                    return x
                    
                s=sorted(lst)
                c=x
                
                while True:
                    blocker=None
                    for y in s:
                        # only tolerate being closer than (spacing - GLOBAL_TOL)
                        if abs(c-y) < spacing - tol:
                            blocker=y
                            break
                    # no conflicts -> c fits everywhere
                    if blocker is None:
                        return c
                    # bump c up just past the blocker by full spacing
                    c=blocker + spacing
            
            fittol = 0.01
            
            for polyline_, conduitsize in zip(adjustedpoly, conduitsizes):
                od_size = LineUtils.ConduitLookup.get_specs(conduitsize)["od"]
                linearstub = LineUtils.ConduitLookup.get_specs(conduitsize)['linear_section']
                bendradius = LineUtils.ConduitLookup.get_specs(conduitsize)['min_bend']
                
                polyline = polyline_
                
                #calculate for smallest angle
                startcut = LineUtils._compute_cut(bendradius, linearstub, smallestangle)
                
                minlength = lineargap + startcut*2 
                
                secondsegment = polyline.SegmentAt(1) if polyline.SegmentCount > 1 else polyline.SegmentAt(0)
                firstslen = polyline.SegmentAt(0).Length
                
                u, l = split_up_down(panelplane, [secondsegment])
                
                minoffset = minlength
                
                spcng = od_size + spacing
                #minlen = minlength-spcng
                minlen = minlength
                #print "spacing {}".format(spcng)
                
                #startcut = 0.01 #testing
                
                if u:
                    #print u[0][1]
                    dir = classify_direction(panelplane, u[0][1], 0.0001)
                    if dir == "left":
                        if upperleftmin == 0:
                            upperleftmin = minlen
                            #
                        else:
                            upperleftmin += spcng
                        #minoffset = upperleftmin
                        #upperleftfs.append(max(firstslen, upperleftmin))
                        minoffset = fit_number(upperleftfs, upperleftmin, spcng, fittol) 
                        upperleftfs.append(max(firstslen, minoffset))
                    else:
                        if upperrightmin == 0:
                            upperrightmin = minlen
                        else:
                            upperrightmin += spcng
                        #minoffset = upperrightmin
                        #upperrightfs.append(max(firstslen, upperrightmin))
                        minoffset = fit_number(upperrightfs, upperrightmin, spcng, fittol) 
                        upperrightfs.append(max(firstslen, minoffset))
                if l:
                    dir = classify_direction(panelplane, l[0][1], 0.0001)
                    #print dir
                    if dir == "left":
                        if lowerleftmin == 0:
                            lowerleftmin = minlen
                        else:
                            lowerleftmin += spcng
                        #minoffset = lowerleftmin
                        #lowerleftfs.append(max(firstslen, lowerleftmin))
                        #print lowerleftfs
                        #print lowerleftmin
                        minoffset = fit_number(lowerleftfs, lowerleftmin, spcng, fittol) 
                        lowerleftfs.append(max(firstslen, minoffset))
                        #print minoffset
                        #minoffset = 0
                    else:
                        if lowerrightmin == 0:
                            lowerrightmin = minlen
                        else:
                            lowerrightmin += spcng
                        #minoffset = lowerrightmin
                        #lowerrightfs.append(max(firstslen, lowerrightmin))
                        minoffset = fit_number(lowerrightfs, lowerrightmin, spcng, fittol) 
                        lowerrightfs.append(max(firstslen, minoffset))
                
                #ensure minlength for all segments, but calculated first only for first obv
                #extended = extend_polyline_segments(polyline, minlength, 'singular')
                #extended = extend_polyline_segments(extended, minoffset, 'singular_first')
                extended = extend_polyline_segments(polyline, minoffset, 'singular_first')
        
                polyline = extended
                
                #iteratively clean for a couple iterations
                for j in range(0):
                    unspiked = remove_spikes(polyline, 0.0001)
                    if unspiked.SegmentCount <= 3:
                        pass
                        minlength = startcut*2  #let it fit without linear segment
                        minlength = 0.01
                        
                    cleaned = clean_polyline(unspiked, minlength)
            
                    polyline = cleaned
                
                #extended = extend_polyline_segments(polyline, minlength, 'singular')
                #extended = polyline
                #print minlength
                
                readjustedpoly.append(polyline)
                #readjustedpoly.append(polyline_)
            
            readjustedpoly_debug = [rc.ToPolylineCurve() for rc in readjustedpoly]
            
            ##finalsort
            #firstsegments = [poly.SegmentAt(1) for poly in adjustedpoly]
            ##print firstsegments
            #sorted_curves, lookupidx = sort_lines(panelplane, firstsegments)
            #
            #print lookupidx
            
            adjustedpoly = restore_input_order(adjustedpoly, orig_idx)
            readjustedpoly = restore_input_order(readjustedpoly, orig_idx)
            polylines = restore_input_order(polylines, orig_idx)
            
            snapped = polylines
            
            # ---- extra per-side push using 2nd segment in panelplane X ----
            
            origin_ok, origin_uv = panelplane.RemapToPlaneSpace(panelplane.Origin)
            
            left_indices = []
            right_indices = []
            center_indices = []
            mid_x_values = []
            
            for idx, pl in enumerate(readjustedpoly):
                if pl.SegmentCount > 1:
                    seg = pl.SegmentAt(1)
                else:
                    seg = pl.SegmentAt(0)
            
                mid_pt = seg.PointAt(0.5)
                remap_ok, mid_uv = panelplane.RemapToPlaneSpace(mid_pt)
            
                if remap_ok:
                    mid_x = mid_uv.X
                    dx = mid_x - origin_uv.X
                else:
                    mid_x = None
                    dx = 0.0
            
                mid_x_values.append(mid_x)
            
                if dx > GLOBAL_TOL:
                    left_indices.append(idx)
                elif dx < -GLOBAL_TOL:
                    right_indices.append(idx)
                else:
                    center_indices.append(idx)
            
            # if some land exactly on origin X, assign them to the smaller side
            for idx in center_indices:
                if len(left_indices) <= len(right_indices):
                    left_indices.append(idx)
                else:
                    right_indices.append(idx)
            
            # find bundles: indices whose 2nd segment X matches some other 2nd segment X
            stacked_indices = set()
            for i in range(len(mid_x_values)):
                x_i = mid_x_values[i]
                if x_i is None:
                    continue
                for j in range(len(mid_x_values)):
                    if i == j:
                        continue
                    x_j = mid_x_values[j]
                    if x_j is None:
                        continue
                    if abs(x_j - x_i) <= GLOBAL_TOL:
                        stacked_indices.add(i)
                        break
            
            n_left = len(left_indices)
            n_right = len(right_indices)
            #print "n_left, n_right:", n_left, n_right
            
            extra_left = 0.0
            extra_right = 0.0
            
            #for now
            smallestconduit = min(conduitsizes_)
            
            if spacing_ > 0.0:
                if n_left > 1:
                    extra_left = 0.5 * (spacing_ + smallestconduit) * float(n_left - 1)
                if n_right > 1:
                    extra_right = 0.5 * (spacing_ + smallestconduit) * float(n_right - 1)
            
            #print extra_left, extra_right
            
            # direction along which the 2nd segment should move "away" in panelplane
            push_axis = rg.Vector3d(panelplane.XAxis)  # change to YAxis if that is your push dir
            if not push_axis.IsZero:
                push_axis.Unitize()
            
                new_readjusted = []
            
                for idx, pl in enumerate(readjustedpoly):
                    d = 0.0
                    if idx in left_indices:
                        d = extra_left
                    elif idx in right_indices:
                        d = -extra_right  # negative to move away from origin on the other side
            
                    # only push if:
                    # - this index is part of a stacked bundle (same X as others)
                    # - 2nd segment is NOT the last one
                    if d != 0.0 and idx in stacked_indices:
                        seg_count = pl.SegmentCount
                        if seg_count > 2 and pl.Count > 2:
                            move_vec = rg.Vector3d(push_axis)
                            move_vec = move_vec * d
            
                            pts = list(pl)
                            # move only the 2nd segment endpoints: pts[1] and pts[2]
                            pts[1] = pts[1] + move_vec
                            pts[2] = pts[2] + move_vec
            
                            new_pl = rg.Polyline(pts)
                            new_readjusted.append(new_pl)
                        else:
                            new_readjusted.append(pl)
                    else:
                        new_readjusted.append(pl)
            
                readjustedpoly = new_readjusted
            
            # ---- end extra per-side push ----
            
            #cached
            spacing = spacing_
            conduitsize = gh.DataTree[System.Object]()#conduitsizes_
            polylines = gh.DataTree[System.Object]()
            
            conduitsize.AddRange(conduitsizes_, defaultpath)
            polylines.AddRange(readjustedpoly, defaultpath)
            
            polylines_LR = gh.DataTree[System.Object]()
            conduitsize_LR = gh.DataTree[System.Object]()
            
            path_left = gh.Kernel.Data.GH_Path(0)
            path_right = gh.Kernel.Data.GH_Path(1)
            
            for idx, pl in enumerate(readjustedpoly):
                size = conduitsizes_[idx]
            
                if idx in left_indices:
                    polylines_LR.Add(pl, path_left)
                    conduitsize_LR.Add(size, path_left)
                elif idx in right_indices:
                    polylines_LR.Add(pl, path_right)
                    conduitsize_LR.Add(size, path_right)
                else:
                    # should not happen because center_indices are reassigned,
                    # but keep it in defaultpath just in case
                    polylines_LR.Add(pl, defaultpath)
                    conduitsize_LR.Add(size, defaultpath)
            
            #print conduitsize.Branch(0)
            #print polylines.Branch(0)
            #print  gh.DataTree[System.Int32]([0], defaultpath)
            
            sp = LineUtils.Spacing()
            
            #sp_results = sp.Run(polylines, conduitsize, optionalkeys = gh.DataTree[System.Int32]([0], defaultpath),
            #                    spacing = spacing, perpanel = False, perlevel = False, 
            #                    pulltogether = True, pushflag = False, pullstart = pullstart)
            
            #pushflag is resource intensive
            sp_results = sp.Run(polylines_LR, conduitsize_LR, optionalkeys = gh.DataTree[System.Int32]([0], defaultpath),
                                spacing = spacing, perpanel = True, perlevel = False, 
                                pulltogether = True, pushflag = False, pullstart = pullstart)
            
            rawlinelookup, linelookup, rebuiltree, polys, polys2, finaltree, treeflags, doublepolys, Boundaryobjects = sp_results
            
            #2 step process for 2nd segment to ensure proper order
            #repull(MasterPolys, SlavePolys)
            repulltest = gh.DataTree[System.Object]()
            
            for path in polylines_LR.Paths:
                masterpolys = list(polylines_LR.Branch(path))
                slavepolys = list(finaltree.Branch(path))
                #print " len(masterpolys), len(slavepolys)", len(masterpolys), len(slavepolys)
                repulled = repull(masterpolys, slavepolys)
                #print "repulled ", len(repulled)
                repulltest.AddRange(repulled, path)
                #repulltest.extend(repulled)
            
            sp2 = LineUtils.Spacing()
            sp_results2 = sp2.Run(repulltest, conduitsize_LR, optionalkeys = gh.DataTree[System.Int32]([0], defaultpath),
                                spacing = spacing, perpanel = True, perlevel = False, 
                                pulltogether = True, pushflag = False, pullstart = pullstart)
                                
            rawlinelookup, linelookup, rebuiltree, polys, polys2, rerespaced_, treeflags, doublepolys, Boundaryobjects = sp_results2
            finaltree = gh.DataTree[System.Object]()
            
            for path in rerespaced_.Paths:
                r_polys = list(rerespaced_.Branch(path))
                c_sizes = list(conduitsize_LR.Branch(path))
                
                for rpoly, conduitsize in zip(r_polys, c_sizes):
                    od_size = LineUtils.ConduitLookup.get_specs(conduitsize)["od"]
                    linearstub = LineUtils.ConduitLookup.get_specs(conduitsize)['linear_section']
                    bendradius = LineUtils.ConduitLookup.get_specs(conduitsize)['min_bend']
                    
                    startcut = LineUtils._compute_cut(bendradius, linearstub, smallestangle)
                    minlength = lineargap + startcut*2 
                    minlength_ = startcut*2 
                    
                    #cleaned = clean_polyline(rpoly, minlength)
                    cleaned = clean_beginning(rpoly, minlength_) #do without linear as more conservative for now 
                    finaltree.Add(cleaned, path)
            
            respaced = []
            
            planeY = panelplane.YAxis
            planeY.Unitize()
            
            cutstart = True
            
            if finaltree.BranchCount <= 1:
                cutstart = False
                #for simplicity of unification
                
                if path_left in finaltree.Paths:
                    finaltree.AddRange([], path_right)
                else:
                    finaltree.AddRange([], path_left)
            
            #if only one line on a side and it would be reasonable to just run it straight
            porigin = panelplane.Origin
            panelXax = panelplane.XAxis
            
            for branch in finaltree.Branches:
                if len(branch) == 1:
                    #checking hits
                    dpolyline = branch[0]
                    firstseg = dpolyline.SegmentAt(0)
                    lastseg = dpolyline.SegmentAt(dpolyline.SegmentCount - 1)
                    hitspanel1 = LineUtils.lxr(lastseg, [panel], True)
                    hitspanel2 = LineUtils.lxr(firstseg, [panel], True)
                    
                    shortchecklen = porigin.DistanceTo(dpolyline.Last)
                    manhcheck = shortchecklen <= manhattanradius
                    #short segment manhattan
                    if manhcheck:
                        #print "shortie"
                        checkline = rg.Line(dpolyline.Last,  panelXax)
                        hitcheck = LineUtils.lxr(checkline, [panel], True)
                        newp = checkline.ClosestPoint(porigin, False) #treat as infinite
                        newpoly = rg.Polyline([newp, dpolyline.Last])
                        branch[0] = newpoly
                    else:
                        if hitspanel1 and hitspanel2 and manhcheck:
                            #print "in panel"
                            newp = lastseg.ClosestPoint(porigin, False) #treat as infinite
                            newpoly = rg.Polyline([newp, dpolyline.Last])
                            branch[0] = newpoly
                else:
                    for i in range(len(branch)):
                        dpolyline = branch[i]
                        #snake segments within a panel, special case, was 3 do for all ? 
                        if dpolyline.SegmentCount == 3:
                            firstseg = dpolyline.SegmentAt(0)
                            lastseg = dpolyline.SegmentAt(dpolyline.SegmentCount - 1)
                            hitspanel1 = LineUtils.lxr(lastseg, [panel], True)
                            hitspanel2 = LineUtils.lxr(firstseg, [panel], True)
                            if hitspanel1 and hitspanel2:
                                #print "in panel"
                                newpstart = firstseg.ClosestPoint(porigin, False) #treat as infinite
                                newpend = firstseg.ClosestPoint(dpolyline.Last, False) #treat as infinite
                                newpoly = rg.Polyline([newpstart, newpend])
                                branch[i] = newpoly
                        else:
                            pass
                            #print "here not snake"
            if False:
            #if finaltree.BranchCount <= 1:
                for branch in finaltree.Branches:
                    respaced.extend(list(branch))
            else:
                parameters0 = []
                parameters1 = []
                offsets0 = []
                offsets1 = []
                offsets_left_branch = []
                offsets_right_branch = []
                
                for j in [0, 1]:
            #        try:
                    for poly in finaltree.Branch(j):
                        startp = poly.First
                        remap_ok, mid_uv = panelplane.RemapToPlaneSpace(startp)
                        par = mid_uv.Y
                        if j == 0:
                            parameters0.append(par)
                        else:
                            parameters1.append(par)
            #        except:
            #            pass
                
                parameters0.sort()
                parameters1.sort()
                
                #print parameters0, parameters1
                
                if pullstart:
                    new0, new1 = snap_parameters(parameters0, parameters1)
                else:
                    new0, new1 = parameters0, parameters1
                
                #print new0, new1
                
                workwidth = 1.0
                if sidesextra * 2 < panelwidth * 0.5:
                    workwidth = panelwidth - sidesextra * 2
                else:
                    workwidth = panelwidth
                
                panelzero = panelplane.Origin.Y
                allpars = new0 + new1
                minpar_ = min(allpars)
                maxpar_ = max(allpars)
                midpar_ = minpar_ * 0.5 + maxpar_ * 0.5
                pardomain_ = abs(maxpar_ - minpar_)
                paroffset = midpar_ - 0
                scalefactor = 1.0
                
                if pardomain_ > workwidth:
                    scalefactor = workwidth / pardomain_
                
                #scalefactor = 1.0
                
                for p0, n0 in zip(parameters0, new0):
                    offset0 = n0 - p0 - paroffset
                    off0 = p0 + offset0
                    scalef = off0 * (1 - scalefactor)
                    offset0 -= scalef
                    ovec0 = copy.deepcopy(planeY)
                    ovec0 *= offset0
                    offsets0.append(ovec0)
                
                for p1, n1 in zip(parameters1, new1):
                    offset1 = n1 - p1 - paroffset
                    off1 = p1 + offset1
                    scalef = off1 * (1 - scalefactor)
                    offset1 -= scalef
                    ovec1 = copy.deepcopy(planeY)
                    ovec1 *= offset1
                    offsets1.append(ovec1)
                
                #print offsets0, offsets1
                
                # build offsets per-branch, matching branch poly order
                left_polys = list(finaltree.Branch(0))
                right_polys = list(finaltree.Branch(1))
                used0 = [False] * len(parameters0)
                used1 = [False] * len(parameters1)
                tol_par = 1e-6
                
                porigin = panelplane.Origin
                
                run_else = False
                
                for poly in left_polys:
                    startp = poly.First
                    remap_ok, mid_uv = panelplane.RemapToPlaneSpace(startp)
                    par = mid_uv.Y
                    offset_vec = None
                    for k in range(len(parameters0)):
                        if not used0[k]:
                            if abs(parameters0[k] - par) <= tol_par:
                                offset_vec = offsets0[k]
                                used0[k] = True
                                break
                    offsets_left_branch.append(offset_vec)
                
                for poly in right_polys:
                    startp = poly.First
                    remap_ok, mid_uv = panelplane.RemapToPlaneSpace(startp)
                    par = mid_uv.Y
                    offset_vec = None
                    for k in range(len(parameters1)):
                        if not used1[k]:
                            if abs(parameters1[k] - par) <= tol_par:
                                offset_vec = offsets1[k]
                                used1[k] = True
                                break
                    offsets_right_branch.append(offset_vec)
                
                # original respaced (not strictly needed, but kept)
                for branch in finaltree.Branches:
                    respaced.extend(list(branch))
                
                # reorder to match readjustedpoly indexing
                left_set = set(left_indices)
                right_set = set(right_indices)
                
                respaced_ordered = []
                offsets_respaced = []
                left_i = 0
                right_i = 0
                
                for idx in range(len(readjustedpoly)):
                    if idx in left_set:
                        respaced_ordered.append(left_polys[left_i])
                        offsets_respaced.append(offsets_left_branch[left_i])
                        left_i += 1
                    elif idx in right_set:
                        respaced_ordered.append(right_polys[right_i])
                        offsets_respaced.append(offsets_right_branch[right_i])
                        right_i += 1
                    else:
                        respaced_ordered.append(readjustedpoly[idx])
                        offsets_respaced.append(None)
                
                respaced = respaced_ordered
                # offsets_respaced now has same indexing as respaced / readjustedpoly
            
            rerespaced = []
            
            trimdist = 1.0 #remove 1 inch
            
            for rspcd, ovec in zip(respaced, offsets_respaced):
                newpoly = copy.deepcopy(list(rspcd))
                trnsfrm = rg.Transform.Translation(ovec)
                for j in [0, 1]:
                    newpoly[j].Transform(trnsfrm)
                
                if cutstart and pullstart:
                    cutvec = rg.Vector3d(newpoly[0] - newpoly[1])
                    cutvec.Unitize()
                    cutvec *= -trimdist
                    trimsf = rg.Transform.Translation(cutvec)
                    newpoly[0].Transform(trimsf)
            
                newcrv = rg.PolylineCurve(newpoly)
                rerespaced.append(newcrv)
            
        #reconnected = rerespaced
        return rerespaced

# make the class docstring match the top-of-file docstring (single source of truth)
Panelconnection.__doc__ = __doc__

#guard, so it doesn't run on import, but will run in regular components
if __name__ == "__main__":
    ghenv.Component.Message = "v0.43 panelconnections classed"

    pc = Panelconnection()
    pc_results = pc.Run(LineUtils, panel, panelplane, polylines, conduitsizes, spacing,
                        removeshorts, pullstart, manhattanradius, devicemode, devicetolerance)

    reconnected = pc_results
# ---------- end log_panelconnections_s2_2 ----------
data_102 = Data(data_95)
merge = Merge(Data1=move_4.Geometry, Data2=discontinuity_4.Points)  # -> simplify(Result); disabled
data_103 = Data(ghpython_script_12.reconnected)
ghpython_script_14 = GhPythonScript(
    LineUtils=lineutils,
    panel=data_93,
    panelplane=data_94,
    polylines=data_102,
    conduitsizes=data_96,
    spacing=data_97,
    removeshorts=boolean_toggle_14,
    pullstart=boolean_toggle_15,
    manhattanradius=number_slider_16,
    devicemode=boolean_toggle_16,
    devicetolerance=number_slider_15)  # -> out, tweakedpoly, adjustedpoly, readjustedpoly, polylines_LR, rerespaced, finaltree, reconnected; inputs panel: Rectangle3d, panelplane: Plane, polylines: list of Polyline, conduitsizes: list, removeshorts: Boolean, pullstart: Boolean, devicemode: Boolean; same code as ghpython_script_13
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