# Grasshopper definition _underground.gh (Grasshopper 1.0.7)

# ---- group: real data / walls
data = Data([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])

# ---- group: real data / connections
crv = Curve(Tree({0}: [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], {1}: [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], {2}: [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], {3}: [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], {4}: [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], {5}: [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]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))

# ---- group: real data / columns
data_2 = Data([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])

# ---- group: real data / panels
crv_2 = Curve(Tree({0}: [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], {1}: [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], {2}: [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], {3}: [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], {4}: [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], {5}: [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]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))

# ----
ghpython_script = GhPythonScript()  # -> LineUtils
# ---------- ghpython_script: Python ----------
# Name of the environment variable to read
import sys
import os
import imp

VAR_NAME = "DRAWER_PROJECT_ROOT"
root = os.environ.get(VAR_NAME)
line_utils_dir = os.path.join(root, "Gh", "Line_utils")
line_utils_file = os.path.join(line_utils_dir, "LineUtils.py")

if "LineUtils" in sys.modules:
    del sys.modules["LineUtils"]

LineUtils = imp.load_source("LineUtils", line_utils_file)

from LineUtils import LineUtils as LineUtils

# To update LineUtils.py
#if refresh:
#    reload(sys.modules["LineUtils"])
# ---------- end ghpython_script ----------
rectangle = Rectangle(data_2)
rectangle_2 = Rectangle(crv_2)
data_3 = Data(ghpython_script)
rotate_plane = RotatePlane(Plane=rectangle_2, Angle=degrees(Slider(90, range=0..100)))
entwine = Entwine(
    Branch00=Slider(12, range=0..100),
    Branch01=Slider(10, range=0..100),
    Branch02=Slider(20, range=0..100),
    FlattenInputs=True)  # -> flatten(Result)
entwine_2 = Entwine(
    Branch00=Slider(30, range=0..100),
    Branch01=Slider(45, range=0..100),
    Branch02=Slider(50, range=0..100),
    Branch03=Slider(70, range=0..100),
    Branch04=Slider(75, range=0..100),
    FlattenInputs=True)  # -> flatten(Result)
plane = Plane(rotate_plane)
ghpython_script_2 = GhPythonScript(panels=plane, widthlookup=entwine_2, heightlookup=entwine)  # -> out, randompanels; inputs panels: tree, widthlookup: list, heightlookup: list
# ---------- ghpython_script_2: Python ----------
import Rhino.Geometry as rg
import random
import System
import Grasshopper as gh
import itertools


randompanels = gh.DataTree[System.Object]()

random.seed(seed)

for path in panels.Paths:
    objct = list(panels.Branch(path))
    lkpw = random.choice(widthlookup)
    lkph = random.choice(heightlookup)
    itemsw = list(itertools.repeat(lkpw, len(objct)))
    itemsh = list(itertools.repeat(lkph, len(objct)))
    panelsl = []
    for lw, lh, pn in zip(itemsw, itemsh, objct):
        iw = rg.Interval(-lw*0.5, lw*0.5)
        ih = rg.Interval(-lh*0.5, lh*0.5)
        rect = rg.Rectangle3d(pn, ih, iw)
        panelsl.append(rect)
    randompanels.AddRange(panelsl, path)
    
    
    #random.choice(
# ---------- end ghpython_script_2 ----------
data_4 = Data(rectangle)
data_5 = Data(data_4)

python = GhPythonScript(local_path="Gh\Underground\Py\underground.py")  # -> drawer_project, full_path
# ---------- python: Python ----------
"""
GH Python (IronPython)
Description:
Builds an absolute path within the project using the base directory 
defined in the environment variable DRAWER_PROJECT_ROOT.

Inputs:
    local_path : str  — relative path inside the project (e.g. "Gh\Grid_and_path\Grid_and_path_data_validation.py")

Outputs:
    drawer_project : str — root path of the project (from environment variable)
    full_path      : str — combined absolute path (drawer_project + local_path)
"""

import os

ghenv.Component.Message = "drawer_project_path v0.02"

# Name of the environment variable to read
VAR_NAME = "DRAWER_PROJECT_ROOT"

# Get project root from environment variable
drawer_project = os.environ.get(VAR_NAME)

# Validate existence
if not drawer_project:
    raise ValueError(
        "Environment variable '{}' is not set. "
        "Please define it in your system environment.".format(VAR_NAME)
    )

# Normalize and safely combine paths
full_path = os.path.join(drawer_project, local_path)
# ---------- end python ----------
file = ReadFile(File=python.full_path, PerLineParse=False)

data_6 = Data(ghpython_script_2.randompanels)
data_7 = Data(crv)
ghpython_script_3 = GhPythonScript(LineUtils=data_3, polylines=data_7)  # -> out, randomconduitsize; inputs polylines: tree
# ---------- ghpython_script_3: Python ----------
import Rhino.Geometry as rg
import random
import System
import Grasshopper as gh
import itertools

print LineUtils.ConduitLookup.SIZES

lkpsizes = [1.0, 1.0, 2.0, 4.0]
#[4.0, 4.0, 6.0, 8.0]

randomconduitsize = gh.DataTree[System.Object]()

for path in polylines.Paths:
    objcnt = polylines.Branch(path)
    lkp = random.choice(lkpsizes)
    items = list(itertools.repeat(lkp,len(objcnt)))
    randomconduitsize.AddRange(items, path)
# ---------- end ghpython_script_3 ----------
data_8 = Data(ghpython_script_3.randomconduitsize)
iterations = Slider(3, range=1..5)
data_9 = Data(data_7)
data_10 = Data(Slider(1, range=0..10))
data_11 = Data(iterations)
data_12 = Data(Toggle(True))
data_13 = Data(Slider(25, range=0..100))
data_14 = Data(Slider(15, range=5..30))
ghpython_script_4 = GhPythonScript(
    Code=file,
    LineUtils=data_3,
    Panelsgeometry=data_6,
    Panels=simplify(plane),
    Connections=simplify(data_9),
    Conduitsizes=simplify(data_8),
    Noflies=data_5,
    Spacing=data_10,
    Iterations=data_11,
    Groupingdistance=data_13,
    Enforcebendradius=data_12,
    Splitafter=data_14)  # -> Reconnectedtree, Conduitsizestree

# ---- group: example of importing Underground to use elsewhere
ghpython_script_5 = GhPythonScript(x=python.full_path)  # -> out, a
# ---------- ghpython_script_5: Python ----------
import sys
import os
import imp

VAR_NAME = "DRAWER_PROJECT_ROOT"
root = os.environ.get(VAR_NAME)
line_utils_dir = os.path.join(root, "Gh", "Underground", "Py")
line_utils_file = os.path.join(line_utils_dir, "underground.py")

if "Underground" in sys.modules:
    del sys.modules["Underground"]

Underground = imp.load_source("Underground", line_utils_file)

from Underground import Underground

Underground()
# ---------- end ghpython_script_5 ----------

# ----
data_15 = Data(ghpython_script_4.Conduitsizestree)
data_16 = Data("{*;0}")
data_17 = Data(ghpython_script_4.Reconnectedtree)
unit_z = UnitZ(Factor=Slider(-5, range=-15..15))
split_tree = SplitTree(Data=data_17, Masks=flatten(data_16))  # -> Positive, Negative
split_tree_2 = SplitTree(Data=data_15, Masks=flatten(data_16))  # -> Positive, Negative
move = Move(Geometry=split_tree.Negative, Motion=unit_z)  # -> Geometry, Transform
data_18 = Data(split_tree.Positive)
data_19 = Data(split_tree_2.Negative)
data_20 = Data(split_tree_2.Positive)
data_21 = Data(move.Geometry)
